# Grasshopper definition hernandez_mariela_meyerson_massing.gh (Grasshopper 0.9.76)
# plug-ins: Python Interpreter

panel = Panel("https://www.energyplus.net/weather-download/north_and_central_america_wmo_region_4/USA/PA/USA_PA_Philadelphia.Intl.AP.724080_TMY3/all")
ladybug = Ladybug_Ladybug()  # -> Vviiiiiiiiiizzz; plug-in component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
epw_stat = Ladybug_OpenEPWAndSTATWeatherFiles(weatherFileURL=panel)  # -> epwFile, statFile; plug-in component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
importepw = Ladybug_ImportEpw(epwFile=epw_stat.epwFile)  # -> readMe, latitude, location, dryBulbTemperature, dewPointTemperature, relativeHumidity, windSpeed, windDirection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; plug-in component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
gencumulativeskymtx = Ladybug_GenCumulativeSkyMtx(epwFile=epw_stat.epwFile, skyDensity=0, useOldRes=True, runIt=Toggle(True))  # -> readMe, cumulativeSkyMtx; plug-in component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

legendpar = Ladybug_LegendParameters(customColors=flatten([ColourSwatch(SwatchColor=RGB(255, 255, 255)), ColourSwatch(SwatchColor=RGB(40, 199, 151))]))  # -> legendPar; plug-in component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
analysisperiod = Ladybug_AnalysisPeriod()  # -> readMe, analysisPeriod; plug-in component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
sunpath = Ladybug_SunPath(
    location=importepw.location,
    hour=12,
    day=21,
    month=12,
    timeStep=1,
    analysisPeriod=analysisperiod.analysisPeriod,
    conditionalStatement="a>12",
    legendPar=legendpar,
    dailyOrAnnualSunPath=True)  # -> readMe, sunVectors, sunAltitudes, sunAzimuths, port, sunSpheresMesh, sunPathCrvs, compassCrvs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; plug-in component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
selectskymtx = Ladybug_selectSkyMtx(
    cumulativeSkyMtx=gencumulativeskymtx.cumulativeSkyMtx,
    HOY=sunpath.sunPositionsHOY,
    removeDiffuse=False,
    removeDirect=False)  # -> readMe, selectedSkyMtx; plug-in component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

pt = Point(<point referenced from the Rhino model>)

legendpar_2 = Ladybug_LegendParameters(customColors=flatten([ColourSwatch(SwatchColor=RGB(255, 255, 255)), ColourSwatch(SwatchColor=RGB(255, 0, 0))]))  # -> legendPar; plug-in component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
analysisperiod_2 = Ladybug_AnalysisPeriod()  # -> readMe, analysisPeriod; plug-in component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
sunpath_2 = Ladybug_SunPath(
    location=importepw.location,
    hour=12,
    day=21,
    month=12,
    timeStep=1,
    analysisPeriod=analysisperiod_2.analysisPeriod,
    centerPt=pt,
    sunPathScale=".5",
    annualHourlyData=flatten(importepw.dryBulbTemperature),
    conditionalStatement="a>18",
    legendPar=legendpar_2,
    dailyOrAnnualSunPath=True)  # -> readMe, sunVectors, sunAltitudes, sunAzimuths, port, sunSpheresMesh, sunPathCrvs, compassCrvs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; plug-in component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
selectskymtx_2 = Ladybug_selectSkyMtx(
    cumulativeSkyMtx=gencumulativeskymtx.cumulativeSkyMtx,
    HOY=sunpath_2.sunPositionsHOY,
    removeDiffuse=False,
    removeDirect=False)  # -> readMe, selectedSkyMtx; plug-in component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

facade_geometry = Brep(<brep referenced from the Rhino model>)
roof_geometry = Brep(<brep referenced from the Rhino model>)
toggle = BooleanToggle(True)

radiationanalysis = Ladybug_RadiationAnalysis(
    geometry=flatten([roof_geometry, facade_geometry]),
    gridSize="10",
    disFromBase="0.01",
    selectedSkyMtx=flatten(selectskymtx.selectedSkyMtx),
    legendPar=flatten(legendpar),
    parallel=toggle,
    runIt=toggle)  # -> readMe, contextMesh, analysisMesh, testPts, testVec, port, radiationResult, radiationMesh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; plug-in component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
skydome = Ladybug_SkyDome(selectedSkyMtx=selectskymtx.selectedSkyMtx, scale="1.9", legendPar=legendpar, showTotalOnly=False, runIt=Toggle(True))  # -> readMe, skyPatchesMesh, baseCrvs, altitudeCrvs, legend, legendBasePts, skyPatchesCenPts, skyPatchesAreas, skyPatchesAsBrep, values; plug-in component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

radiationanalysis_2 = Ladybug_RadiationAnalysis(
    geometry=flatten([facade_geometry, roof_geometry]),
    gridSize="10",
    disFromBase="0.01",
    selectedSkyMtx=flatten(selectskymtx_2.selectedSkyMtx),
    legendPar=flatten(legendpar_2),
    parallel=toggle,
    runIt=toggle)  # -> readMe, contextMesh, analysisMesh, testPts, testVec, port, radiationResult, radiationMesh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; plug-in component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
skydome_2 = Ladybug_SkyDome(
    selectedSkyMtx=selectskymtx_2.selectedSkyMtx,
    scale="1.9",
    legendPar=legendpar_2,
    showTotalOnly=False,
    runIt=Toggle(True))  # -> readMe, skyPatchesMesh, baseCrvs, altitudeCrvs, legend, legendBasePts, skyPatchesCenPts, skyPatchesAreas, skyPatchesAsBrep, values; plug-in component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

mesh = Mesh(radiationanalysis_2.radiationMesh)
subtraction = Subtraction(A=radiationanalysis.radiationResult, B=radiationanalysis_2.radiationResult)  # -> flatten(Result)
legendpar_3 = Ladybug_LegendParameters(
    lowBound="-50",
    highBound="50",
    customColors=flatten([ColourSwatch(SwatchColor=RGB(40, 199, 151)), ColourSwatch(SwatchColor=RGB(255, 255, 255)), ColourSwatch(SwatchColor=RGB(255, 0, 0))]))  # -> legendPar; plug-in component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
wh2btu = Ladybug_Wh2BTU(Wh=subtraction)  # -> BTU; plug-in component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

ma = MassAddition(Input=wh2btu)  # -> Result, PartialResults
int = Integer(ma.Result)
panel_2 = Panel(int)
panel_3 = Panel("Net Solar Benefit")

recolormesh = Ladybug_RecolorMesh(
    analysisResult=wh2btu,
    inputMesh=mesh,
    legendPar=legendpar_3,
    analysisTitle="Solar Radiation Benefit",
    legendTitle="kBTU/ft2")  # -> readMe, newMesh, newLegend, legendBasePt, meshColors, legendColors; plug-in component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
