# Grasshopper definition weaver_logan_meyerson_massing.gh (Grasshopper 0.9.76)
# plug-ins: Python Interpreter

ladybug = Ladybug_Ladybug()  # -> Vviiiiiiiiiizzz; plug-in component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
# 1
# Create Cumulative Sky
toggle = BooleanToggle(True)

# ----
# Import Climate Data
weather_file = Panel("https://www.energyplus.net/weather-download/north_and_central_america_wmo_region_4/USA/PA/USA_PA_Philadelphia.Intl.AP.724080_TMY3/all")
epw_stat = Ladybug_OpenEPWAndSTATWeatherFiles(weatherFileURL=weather_file)  # -> epwFile, statFile; plug-in component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
importepw = Ladybug_ImportEpw(epwFile=epw_stat.epwFile)  # -> readMe, latitude, location, dryBulbTemperature, dewPointTemperature, relativeHumidity, windSpeed, windDirection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; plug-in component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
gencumulativeskymtx = Ladybug_GenCumulativeSkyMtx(epwFile=epw_stat.epwFile, skyDensity=0, useOldRes=True, runIt=toggle)  # -> readMe, cumulativeSkyMtx; plug-in component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

# ----
# Create a Sky of Helpful Winter Solar Energy
swatch = ColourSwatch(SwatchColor=RGB(0, 201, 17))
legendpar = Ladybug_LegendParameters(customColors=flatten([ColourSwatch(SwatchColor=RGB(255, 255, 255)), swatch]))  # -> legendPar; plug-in component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

analysisperiod = Ladybug_AnalysisPeriod()  # -> readMe, analysisPeriod; plug-in component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
sunpath = Ladybug_SunPath(
    location=importepw.location,
    hour=12,
    day=21,
    month=12,
    timeStep=1,
    analysisPeriod=analysisperiod.analysisPeriod,
    annualHourlyData=flatten(importepw.dryBulbTemperature),
    conditionalStatement="a<12",
    legendPar=legendpar,
    dailyOrAnnualSunPath=True)  # -> readMe, sunVectors, sunAltitudes, sunAzimuths, port, sunSpheresMesh, sunPathCrvs, compassCrvs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; plug-in component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
selectskymtx = Ladybug_selectSkyMtx(
    cumulativeSkyMtx=gencumulativeskymtx.cumulativeSkyMtx,
    HOY=sunpath.sunPositionsHOY,
    removeDiffuse=False,
    removeDirect=False)  # -> readMe, selectedSkyMtx; plug-in component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

legendpar_2 = Ladybug_LegendParameters(customColors=flatten([ColourSwatch(SwatchColor=RGB(255, 255, 255)), ColourSwatch(SwatchColor=RGB(255, 0, 0))]))  # -> legendPar; plug-in component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

# ----
# Create a Sky of Harmful Summer Solar Energy
analysisperiod_2 = Ladybug_AnalysisPeriod()  # -> readMe, analysisPeriod; plug-in component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
sunpath_2 = Ladybug_SunPath(
    location=importepw.location,
    hour=12,
    day=21,
    month=12,
    timeStep=1,
    analysisPeriod=analysisperiod_2.analysisPeriod,
    annualHourlyData=flatten(importepw.dryBulbTemperature),
    conditionalStatement="a>18",
    legendPar=legendpar_2,
    dailyOrAnnualSunPath=True)  # -> readMe, sunVectors, sunAltitudes, sunAzimuths, port, sunSpheresMesh, sunPathCrvs, compassCrvs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; plug-in component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
selectskymtx_2 = Ladybug_selectSkyMtx(
    cumulativeSkyMtx=gencumulativeskymtx.cumulativeSkyMtx,
    HOY=sunpath_2.sunPositionsHOY,
    removeDiffuse=False,
    removeDirect=False)  # -> readMe, selectedSkyMtx; plug-in component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

pipeline = GeometryPipeline(
    GroupByLayer=False,
    GroupByType=False,
    IncludeHidden=True,
    IncludeLocked=True,
    LayerFilter="Context",
    NameFilter="*",
    TypeFilter=1073741848)
pipeline_2 = GeometryPipeline(
    GroupByLayer=False,
    GroupByType=False,
    IncludeHidden=True,
    IncludeLocked=True,
    LayerFilter="Roof (NEW)",
    NameFilter="*",
    TypeFilter=1073741848)
pipeline_3 = GeometryPipeline(
    GroupByLayer=False,
    GroupByType=False,
    IncludeHidden=True,
    IncludeLocked=True,
    LayerFilter="Facade (OLD)",
    NameFilter="*",
    TypeFilter=1073741848)
pipeline_4 = GeometryPipeline(
    GroupByLayer=False,
    GroupByType=False,
    IncludeHidden=True,
    IncludeLocked=True,
    LayerFilter="Roof (OLD)",
    NameFilter="*",
    TypeFilter=1073741848)
pipeline_5 = GeometryPipeline(
    GroupByLayer=False,
    GroupByType=False,
    IncludeHidden=True,
    IncludeLocked=True,
    LayerFilter="Facade (NEW)",
    NameFilter="*",
    TypeFilter=1073741848)
grid_size = Panel("10")
distance_from_base = Panel("0.01")
# Run Solar
# Radiation Study
# 3
toggle_2 = BooleanToggle(True)

facade_geometry = Geometry(pipeline_5)
# 2
# Set Geometry
contextbuildings = Geometry(pipeline)
roof_geometry = Geometry(pipeline_2)

# ----
# Visualize Winter Sky
toggle_3 = BooleanToggle(False)
# Visualize Summer Sky
toggle_4 = BooleanToggle(False)

skydome = Ladybug_SkyDome(
    selectedSkyMtx=selectskymtx_2.selectedSkyMtx,
    scale="1.9",
    legendPar=legendpar_2,
    showTotalOnly=Toggle(True),
    runIt=toggle_4)  # -> readMe, skyPatchesMesh, baseCrvs, altitudeCrvs, legend, legendBasePts, skyPatchesCenPts, skyPatchesAreas, skyPatchesAsBrep, values; plug-in component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

skydome_2 = Ladybug_SkyDome(selectedSkyMtx=selectskymtx.selectedSkyMtx, scale="1.9", legendPar=legendpar, showTotalOnly=Toggle(True), runIt=toggle_3)  # -> readMe, skyPatchesMesh, baseCrvs, altitudeCrvs, legend, legendBasePts, skyPatchesCenPts, skyPatchesAreas, skyPatchesAsBrep, values; plug-in component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

# ----
# Summer Solar Study
radiationanalysis = Ladybug_RadiationAnalysis(
    geometry=flatten(facade_geometry),
    context=flatten([contextbuildings, roof_geometry]),
    gridSize=grid_size,
    disFromBase=distance_from_base,
    selectedSkyMtx=flatten(selectskymtx_2.selectedSkyMtx),
    legendPar=flatten(legendpar_2),
    parallel=toggle_2,
    runIt=toggle_2)  # -> readMe, contextMesh, analysisMesh, testPts, testVec, port, radiationResult, radiationMesh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; plug-in component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
# Winter Solar Study
radiationanalysis_2 = Ladybug_RadiationAnalysis(
    geometry=flatten(facade_geometry),
    context=flatten([contextbuildings, roof_geometry]),
    gridSize=grid_size,
    disFromBase=distance_from_base,
    selectedSkyMtx=flatten(selectskymtx.selectedSkyMtx),
    legendPar=flatten(legendpar),
    parallel=toggle_2,
    runIt=toggle_2)  # -> readMe, contextMesh, analysisMesh, testPts, testVec, port, radiationResult, radiationMesh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; plug-in component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

# ----
# Subtract Helpful
# from Harmful
subtraction = Subtraction(A=radiationanalysis_2.radiationResult, B=radiationanalysis.radiationResult)  # -> flatten(Result)
wh2btu = Ladybug_Whm2BTUft(Wh_m2=subtraction)  # -> BTU_ft2; plug-in component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

# ----
# Visualize Solar Benefit
swatch_2 = ColourSwatch(SwatchColor=RGB(255, 0, 0))
mesh = Mesh(radiationanalysis.radiationMesh)
legendpar_3 = Ladybug_LegendParameters(
    lowBound="-50",
    highBound="50",
    customColors=flatten([swatch_2, ColourSwatch(SwatchColor=RGB(255, 255, 255)), ColourSwatch(SwatchColor=RGB(0, 201, 17))]))  # -> legendPar; plug-in component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
recolormesh = Ladybug_RecolorMesh(
    analysisResult=wh2btu,
    inputMesh=mesh,
    legendPar=legendpar_3,
    analysisTitle="Solar Radiation Benefit",
    legendTitle="kBTU/ft2")  # -> readMe, newMesh, newLegend, legendBasePt, meshColors, legendColors; plug-in component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

ma = MassAddition(Input=wh2btu)  # -> Result, PartialResults
int = Integer(ma.Result)
# A higher number here
# is a better-oriented building
# NEW MASSING = 3701
# OLD MASSING = -14725
net_solar_benefit = Panel(int)
