# Grasshopper definition jiang_hewen.gh (Grasshopper 0.9.76)
# plug-ins: Python Interpreter

ladybug = Ladybug_Ladybug()  # -> Vviiiiiiiiiizzz; plug-in component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
path = FilePath("C:\Users\wen\Desktop\grasshopper class\ARCH 753\USA_PA_Philadelphia.Intl.AP.724080_TMY3.epw")
gencumulativeskymtx = Ladybug_GenCumulativeSkyMtx(epwFile=path, skyDensity=0, useOldRes=True, runIt=Toggle(True))  # -> readMe, cumulativeSkyMtx; plug-in component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
importepw = Ladybug_ImportEpw(epwFile=path)  # -> readMe, latitude, location, dryBulbTemperature, dewPointTemperature, relativeHumidity, windSpeed, windDirection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; plug-in component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
strnum = Ladybug_SeparateData(inputList=flatten(importepw.dryBulbTemperature))  # -> numbers, strings; plug-in component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
gradientlibrary = Ladybug_GradientLibrary()  # -> customColors; plug-in component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
avr = Average(Input=strnum.numbers)
panel = Panel("-3")
solaradjusttemperature = Ladybug_OutdoorSolarTemperatureAdjustor(
    location=importepw.location,
    cumSkyMtxOrDirNormRad=importepw.directNormalRadiation,
    diffuseHorizRad=importepw.diffuseHorizontalRadiation,
    baseTemperature=importepw.dryBulbTemperature,
    horizInfraredRad=importepw.horizontalInfraredRadiation,
    runIt=Toggle(True))  # -> readMe, port, effectiveRadiantField, MRTDelta, solarAdjustedMRT, port_2, mannequinMesh, port_3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; plug-in component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
gradientlibrary_2 = Ladybug_GradientLibrary(gradIndex="8")  # -> customColors; plug-in component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
analysisperiod = Ladybug_AnalysisPeriod()  # -> readMe, analysisPeriod; plug-in component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
outdoorcomfortcalculator = Ladybug_OutdoorComfortCalculator(
    dryBulbTemperature=importepw.dryBulbTemperature,
    meanRadiantTemperature=solaradjusttemperature.solarAdjustedMRT,
    windSpeed_tenMeters=importepw.windSpeed,
    relativeHumidity=importepw.relativeHumidity,
    runIt=Toggle(True))  # -> readMe, port, universalThermalClimateIndex, comfortableOrNot, thermalStress, conditionOfPerson, port_2, percentOfTimeComfortable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; plug-in component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
outdoorcomfortcalculator_2 = Ladybug_OutdoorComfortCalculator(
    dryBulbTemperature=importepw.dryBulbTemperature,
    windSpeed_tenMeters=importepw.windSpeed,
    relativeHumidity=importepw.relativeHumidity,
    runIt=Toggle(True))  # -> readMe, port, universalThermalClimateIndex, comfortableOrNot, thermalStress, conditionOfPerson, port_2, percentOfTimeComfortable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; plug-in component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
legendpar = Ladybug_LegendParameters(lowBound="-3", highBound="3", numSegments=Slider(7, range=0..10), customColors=flatten(gradientlibrary_2))  # -> legendPar; plug-in component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
panel_2 = Panel([outdoorcomfortcalculator.percentOfTimeComfortable, outdoorcomfortcalculator.percentComfForShortPeriod, outdoorcomfortcalculator.percentHeatStress, outdoorcomfortcalculator.percentColdStress])
panel_3 = Panel(outdoorcomfortcalculator.universalThermalClimateIndex)
_3dchart = Ladybug_3DChart(
    inputData=flatten([outdoorcomfortcalculator.conditionOfPerson, outdoorcomfortcalculator_2.conditionOfPerson]),
    xScale=Slider(0.25, range=0..1),
    legendPar=legendpar,
    bakeIt=Toggle(True))  # -> readMe, graphMesh, graphCurves, legend, legendBasePts, title, titleBasePts, dataPts, conditionalHOY; plug-in component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
panel_4 = Panel(importepw.dryBulbTemperature)
strnum_2 = Ladybug_SeparateData(inputList=flatten(outdoorcomfortcalculator.conditionOfPerson))  # -> numbers, strings; plug-in component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
strnum_3 = Ladybug_SeparateData(inputList=flatten(outdoorcomfortcalculator_2.conditionOfPerson))  # -> numbers, strings; plug-in component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
python = PythonScript(UNshaded=strnum_2.numbers, shaded=strnum_3.numbers)  # -> out, a, heat, cold; inputs UNshaded: list, shaded: list
# ---------- python: Python ----------
a=[]
amount=len(UNshaded)
heat=0
cold=0
for i in range(amount):
    if (shaded[i] in [0,1]) and (UNshaded[i] in [-3,-2,-1,2,3]):
        a.append(1)
    else:
        a.append(0)
    
    """if shaded[i]<bushaded[i] and bushaded[i]>1:
        a.append(1)
    elif bushaded[i]>shaded[i] and shaded[i]<0:
        a.append(1)
    else:
        a.append(0)
        """
        
        
    """if shaded[i]<2 and shaded[i]>-2 and bushaded[i]>1:
        a.append(1)
        heat+=1
    elif shaded[i]<-1 and bushaded[i]<2 and bushaded[i]>-2:
        a.append(-1)
        cold+=1
    else:
        a.append(0)"""
# ---------- end python ----------
addition = Addition(A=python.heat, B=python.cold)
lng = ListLength(List=python.a)
ma = MassAddition(Input=python.a)  # -> Result, PartialResults
_3dchart_2 = Ladybug_3DChart(inputData=flatten(python.a), xScale=Slider(0.25, range=0..1))  # -> readMe, graphMesh, graphCurves, legend, legendBasePts, title, titleBasePts, dataPts, conditionalHOY; plug-in component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
division = Division(A=ma.Result, B=lng)
panel_5 = Panel(division)

panel_6 = Panel(importepw.dryBulbTemperature)
split = SplitList(List=panel_6, Index=Slider(7, range=0..10))  # -> ListA, ListB
series = Series(Start=Slider(1, range=0..1), Step=1, Count=Slider(12, range=0..100))
series_2 = Series(Start=0, Step=1, Count=Slider(24, range=0..100))
merge = Merge(Data1=flatten(split.ListA), Data2=flatten(python.a))
sunpath = Ladybug_SunPath(
    location=importepw.location,
    hour=series_2,
    day=21,
    month=series,
    timeStep=Slider(3, range=0..10),
    annualHourlyData=flatten(merge),
    conditionalStatement="a>0",
    dailyOrAnnualSunPath=True)  # -> readMe, sunVectors, sunAltitudes, sunAzimuths, port, sunSpheresMesh, sunPathCrvs, compassCrvs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; plug-in component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
