# Grasshopper definition kamath_ayodh.gh (Grasshopper 0.9.76)
# plug-ins: Python Interpreter

ladybug = Ladybug_Ladybug()  # -> Vviiiiiiiiiizzz; plug-in component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
path = FilePath("C:\Users\Ayodh\Documents\Us\Ayodh\UPenn\1709\753\USA_PA_Philadelphia.Intl.AP.724080_TMY3\USA_PA_Philadelphia.Intl.AP.724080_TMY3.epw")
importepw = Ladybug_ImportEpw(epwFile=path)  # -> readMe, latitude, location, dryBulbTemperature, dewPointTemperature, relativeHumidity, windSpeed, windDirection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; plug-in component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

# ---- group: With Radiation
solaradjusttemperature = Ladybug_OutdoorSolarTemperatureAdjustor(
    location=importepw.location,
    cumSkyMtxOrDirNormRad=importepw.directNormalRadiation,
    diffuseHorizRad=importepw.diffuseHorizontalRadiation,
    baseTemperature=importepw.dryBulbTemperature,
    horizInfraredRad=importepw.horizontalInfraredRadiation,
    runIt=Toggle(True))  # -> readMe, port, effectiveRadiantField, MRTDelta, solarAdjustedMRT, port_2, mannequinMesh, port_3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; plug-in component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
outdoorcomfortcalculator = Ladybug_OutdoorComfortCalculator(
    dryBulbTemperature=importepw.dryBulbTemperature,
    meanRadiantTemperature=solaradjusttemperature.solarAdjustedMRT,
    windSpeed_tenMeters=importepw.windSpeed,
    relativeHumidity=importepw.relativeHumidity,
    runIt=Toggle(True))  # -> readMe, port, universalThermalClimateIndex, comfortableOrNot, thermalStress, conditionOfPerson, port_2, percentOfTimeComfortable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; plug-in component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

# ---- group: Without Radiation
outdoorcomfortcalculator_2 = Ladybug_OutdoorComfortCalculator(
    dryBulbTemperature=importepw.dryBulbTemperature,
    windSpeed_tenMeters=importepw.windSpeed,
    relativeHumidity=importepw.relativeHumidity,
    runIt=Toggle(True))  # -> readMe, port, universalThermalClimateIndex, comfortableOrNot, thermalStress, conditionOfPerson, port_2, percentOfTimeComfortable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; plug-in component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
panel = Panel(outdoorcomfortcalculator_2.percentComfForShortPeriod)
panel_2 = Panel(outdoorcomfortcalculator_2.percentColdStress)
panel_3 = Panel(outdoorcomfortcalculator_2.percentOfTimeComfortable)
panel_4 = Panel(outdoorcomfortcalculator_2.percentHeatStress)

# ---- group: Calculation
strnum = Ladybug_SeparateData(inputList=flatten(outdoorcomfortcalculator_2.comfortableOrNot))  # -> numbers, strings; plug-in component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
strnum_2 = Ladybug_SeparateData(inputList=flatten(outdoorcomfortcalculator.comfortableOrNot))  # -> numbers, strings; plug-in component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
or = GateOr(A=strnum.numbers, B=strnum_2.numbers)
num = Number(or)
ma = MassAddition(Input=num)  # -> Result, PartialResults
division = Division(A=ma.Result, B=8760)
multiplication = Multiplication(A=division, B=100)
panel_5 = Panel(multiplication)
