# Grasshopper definition ma_xiaoyu.gh (Grasshopper 0.9.76)
# plug-ins: Python Interpreter

file_path = FilePath("C:\myself\S3\Grasshopper\weather files\Philadelphia\USA_PA_Philadelphia.Intl.AP.724080_TMY3\USA_PA_Philadelphia.Intl.AP.724080_TMY3.epw")
importepw = Ladybug_ImportEpw(epwFile=file_path)  # -> Output, latitude, location, dryBulbTemperature, dewPointTemperature, relativeHumidity, windSpeed, windDirection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; plug-in component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
ladybug = Ladybug_Ladybug()  # -> out; plug-in component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
boolean_toggle = BooleanToggle(True)
solaradjusttemperature = Ladybug_OutdoorSolarTemperatureAdjustor(
    location=importepw.location,
    cumSkyMtxOrDirNormRad=importepw.directNormalRadiation,
    diffuseHorizRad=importepw.diffuseHorizontalRadiation,
    baseTemperature=importepw.dryBulbTemperature,
    horizInfraredRad=importepw.horizontalInfraredRadiation,
    runIt=boolean_toggle)  # -> readMe, port, effectiveRadiantField, MRTDelta, solarAdjustedMRT, port_2, mannequinMesh, port_3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; plug-in component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
outdoorcomfortcalculator = Ladybug_OutdoorComfortCalculator(
    dryBulbTemperature=importepw.dryBulbTemperature,
    meanRadiantTemperature=solaradjusttemperature.solarAdjustedMRT,
    windSpeed_tenMeters=importepw.windSpeed,
    relativeHumidity=importepw.relativeHumidity,
    runIt=boolean_toggle)  # -> out, port, universalThermalClimateIndex, comfortableOrNot, thermalStress, conditionOfPerson, port_2, percentOfTimeComfortable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; plug-in component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
outdoorcomfortcalculator_2 = Ladybug_OutdoorComfortCalculator(
    dryBulbTemperature=importepw.dryBulbTemperature,
    windSpeed_tenMeters=importepw.windSpeed,
    relativeHumidity=importepw.relativeHumidity,
    runIt=boolean_toggle)  # -> out, port, universalThermalClimateIndex, comfortableOrNot, thermalStress, conditionOfPerson, port_2, percentOfTimeComfortable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; plug-in component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
panel = Panel(outdoorcomfortcalculator_2.conditionOfPerson)
panel_2 = Panel(outdoorcomfortcalculator.conditionOfPerson)
gradientlibrary = Ladybug_GradientLibrary(gradIndex="8")  # -> customColors; plug-in component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
strnum = Ladybug_SeparateData(inputList=flatten(panel_2))  # -> numbers, strings; plug-in component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
legendpar = Ladybug_LegendParameters(highBound="3", numSegments="7", customColors=flatten(gradientlibrary))  # -> legendPar; plug-in component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
strnum_2 = Ladybug_SeparateData(inputList=flatten(panel))  # -> numbers, strings; plug-in component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
panel_3 = Panel(strnum_2.numbers)
_3dchart = Ladybug_3DChart(
    inputData=flatten([outdoorcomfortcalculator.conditionOfPerson, outdoorcomfortcalculator_2.conditionOfPerson]),
    xScale="0.25",
    yScale="0",
    legendPar=legendpar)  # -> out, graphMesh, graphCurves, legend, legendBasePts, title, titleBasePts, dataPts, conditionalHOY; plug-in component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
larger_than = LargerThan(FirstNumber=strnum.numbers, SecondNumber=Slider(1, range=0..1))  # -> LargerThan, OrEqualTo
panel_4 = Panel(larger_than.OrEqualTo)
panel_5 = Panel(strnum.numbers)
panel_6 = Panel("""haha
wawa
lala""")
member_index = MemberIndex(Set=panel_4, Member="True")  # -> Index, Count
cull_pattern = CullPattern(List=panel_5, CullPattern=larger_than.OrEqualTo)
cull_pattern_2 = CullPattern(List=panel_3, CullPattern=larger_than.OrEqualTo)
subtraction = Subtraction(A=cull_pattern, B=cull_pattern_2)
panel_7 = Panel(cull_pattern)
panel_8 = Panel(cull_pattern_2)
series = Series(Start=Slider(0, range=0..100), Step=Slider(0, range=0..100), Count=Slider(8760, range=0..10000))
panel_9 = Panel(member_index.Index)
panel_10 = Panel(subtraction)
replace_items = ReplaceItems(List=series, Item=subtraction, Indices=member_index.Index, Wrap=False)
integer = Integer(replace_items)
panel_11 = Panel(integer)
panel_12 = Panel("""255,255,255
255,230,230
255,0,0""")
construct_point = ConstructPoint(XCoordinate=Slider(0, range=0..1000), YCoordinate=Slider(375, range=0..1000), ZCoordinate=Slider(0, range=0..100))
legendpar_2 = Ladybug_LegendParameters(lowBound="0", highBound="3", numSegments="4", customColors=flatten(panel_12))  # -> legendPar; plug-in component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
_3dchart_2 = Ladybug_3DChart(
    inputData=flatten(panel_11),
    basePoint=construct_point,
    xScale="0.25",
    yScale=Slider(0, range=0..100),
    legendPar=legendpar_2)  # -> out, graphMesh, graphCurves, legend, legendBasePts, title, titleBasePts, dataPts, conditionalHOY; plug-in component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
