# Grasshopper definition nelson_graham.gh (Grasshopper 0.9.76)
# plug-ins: Python Interpreter

ladybug = Ladybug_Ladybug(defaultFolder="c:\ladybug")  # -> Vviiiiiiiiiizzz; plug-in component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
path = FilePath("C:\Users\Graham P Nelson\Documents\MEBD\Parametric Stuff MEBD\USA_PA_Philadelphia.Intl.AP.724080_TMY3\USA_PA_Philadelphia.Intl.AP.724080_TMY3.epw")
importepw = Ladybug_ImportEpw(epwFile=path)  # -> readMe, latitude, location, dryBulbTemperature, dewPointTemperature, relativeHumidity, windSpeed, windDirection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; plug-in component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
importlocation = Ladybug_ImportLocation(epwFile=path)  # -> location; plug-in component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
solaradjusttemperature = Ladybug_OutdoorSolarTemperatureAdjustor(
    location=importepw.location,
    cumSkyMtxOrDirNormRad=importepw.directNormalRadiation,
    diffuseHorizRad=importepw.diffuseHorizontalRadiation,
    meanRadTemperature=importepw.dryBulbTemperature,
    runIt=Toggle(True))  # -> readMe, port, effectiveRadiantField, MRTDelta, solarAdjustedMRT, port_2, mannequinMesh, port_3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; plug-in component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
outdoorcomfortcalculator = Ladybug_OutdoorComfortCalculator(
    dryBulbTemperature=importepw.dryBulbTemperature,
    meanRadiantTemperature=solaradjusttemperature.solarAdjustedMRT,
    windSpeed_tenMeters=importepw.windSpeed,
    relativeHumidity=importepw.relativeHumidity,
    runIt=Toggle(True))  # -> readMe, port, universalThermalClimateIndex, comfortableOrNot, thermalStress, conditionOfPerson, port_2, percentOfTimeComfortable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; plug-in component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
legendpar = Ladybug_LegendParameters(lowBound="-40", highBound="36")  # -> legendPar; plug-in component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
_3dchart = Ladybug_3DChart(
    inputData=flatten([outdoorcomfortcalculator.universalThermalClimateIndex, importepw.dryBulbTemperature]),
    legendPar=legendpar)  # -> readMe, graphMesh, graphCurves, legend, legendBasePts, title, titleBasePts, dataPts, conditionalHOY; plug-in component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
panel = Panel(outdoorcomfortcalculator.percentColdStress)
panel_2 = Panel(outdoorcomfortcalculator.universalThermalClimateIndex)
separatedata = Ladybug_SeparateData(inputList=flatten(importepw.relativeHumidity))  # -> numbers, strings; plug-in component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
separatedata_2 = Ladybug_SeparateData(inputList=flatten(importepw.dryBulbTemperature))  # -> numbers, strings; plug-in component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
smaller = SmallerThan(FirstNumber=separatedata.numbers, SecondNumber="80")  # -> SmallerThan, OrEqualTo
smaller_2 = SmallerThan(FirstNumber=separatedata_2.numbers, SecondNumber="26")  # -> SmallerThan, OrEqualTo
larger = LargerThan(FirstNumber=separatedata_2.numbers, SecondNumber="18")  # -> LargerThan, OrEqualTo
and = GateAnd(A=larger.LargerThan, B=smaller_2.SmallerThan)
panel_3 = Panel(smaller.SmallerThan)
panel_4 = Panel(and)
num = Number(panel_3)
ma = MassAddition(Input=num)  # -> Result, PartialResults
lng = ListLength(List=num)
num_2 = Number(panel_4)
ma_2 = MassAddition(Input=num_2)  # -> Result, PartialResults
lng_2 = ListLength(List=num_2)
panel_5 = Panel(ma.Result)
panel_6 = Panel(lng)
panel_7 = Panel(ma_2.Result)
panel_8 = Panel(lng_2)
division = Division(A=panel_5, B=panel_6)
panel_9 = Panel(division)
division_2 = Division(A=panel_7, B=panel_8)
panel_10 = Panel(division_2)
