# Grasshopper definition peng_yunzhongda_1009.gh (Grasshopper 0.9.76)
# plug-ins: Python Interpreter

ladybug = Ladybug_Ladybug()  # -> Vviiiiiiiiiizzz; plug-in component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
panel = Panel("https://www.energyplus.net/weather-download/north_and_central_america_wmo_region_4/USA/PA/USA_PA_Philadelphia.Intl.AP.724080_TMY3/all")
epw_stat = Ladybug_OpenEPWAndSTATWeatherFiles(weatherFileURL=panel)  # -> epwFile, statFile; plug-in component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
importepw = Ladybug_ImportEpw(epwFile=epw_stat.epwFile)  # -> readMe, latitude, location, dryBulbTemperature, dewPointTemperature, relativeHumidity, windSpeed, windDirection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; plug-in component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
toggle = BooleanToggle(True)

# ---- group: shade surface
Y = UnitY(Factor="-12")
crv = Curve(<curve referenced from the Rhino model>)
extr = Extrude(Base=crv, Direction=Y)
srf = Surface(extr)

# ----
solaradjusttemperature = Ladybug_OutdoorSolarTemperatureAdjustor(
    location=importepw.location,
    cumSkyMtxOrDirNormRad=importepw.directNormalRadiation,
    diffuseHorizRad=importepw.diffuseHorizontalRadiation,
    baseTemperature=importepw.dryBulbTemperature,
    horizInfraredRad=importepw.horizontalInfraredRadiation,
    parallel=toggle,
    runIt=toggle)  # -> readMe, port, effectiveRadiantField, MRTDelta, solarAdjustedMRT, port_2, mannequinMesh, port_3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; plug-in component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
mesh = Mesh(srf)
boundary = BoundarySurfaces(Edges=[<geometry referenced from the Rhino model> x2])
Z = UnitZ(Factor="0.5")
move = Move(Geometry=boundary, Motion=Z)  # -> Geometry, Transform
outdoorcomfortcalculator = Ladybug_OutdoorComfortCalculator(
    dryBulbTemperature=importepw.dryBulbTemperature,
    meanRadiantTemperature=solaradjusttemperature.solarAdjustedMRT,
    windSpeed_tenMeters=importepw.windSpeed,
    relativeHumidity=importepw.relativeHumidity,
    runIt=Toggle(True))  # -> readMe, port, universalThermalClimateIndex, comfortableOrNot, thermalStress, conditionOfPerson, port_2, percentOfTimeComfortable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; plug-in component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

# ---- group: sun path
series = Series(Start="1", Step="1", Count=Slider(23, range=0..100))
series_2 = Series(Start="1", Step="1", Count=Slider(12, range=0..100))
sunpath = Ladybug_SunPath(
    location=importepw.location,
    hour=series,
    day=21,
    month=series_2,
    timeStep=Slider(3, range=0..10),
    annualHourlyData=flatten(outdoorcomfortcalculator.conditionOfPerson),
    conditionalStatement="a>2",
    dailyOrAnnualSunPath=True)  # -> readMe, sunVectors, sunAltitudes, sunAzimuths, port, sunSpheresMesh, sunPathCrvs, compassCrvs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; plug-in component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

# ---- group: sun vec
amp = Amplitude(Vector=sunpath.sunVectors, Amplitude=Slider(80, range=0..100))
vdis = VectorDisplay(Anchor=sunpath.sunPositions, Vector=amp)

# ---- group: test region
srf_2 = Surface(move.Geometry)

# ----
rev = Reverse(Vector=sunpath.sunVectors)
debrep = DeconstructBrep(Brep=srf_2)  # -> Faces, Edges, Vertices
meshray = MeshRay(Mesh=mesh, Point=graft(debrep.Vertices), Direction=rev)  # -> flatten(Point), Hit
del = DelaunayMesh(Points=meshray.Point, Plane=PlaneXY(0, 0, 0))
brep = Brep(<brep referenced from the Rhino model>)
comfortshadebenefit = Ladybug_ComfortShadeBenefitEvaluator(
    location=importepw.location,
    temperatures=importepw.dryBulbTemperature,
    testShades=del,
    testRegion=srf_2,
    context=brep,
    delNonIntersect=False,
    runIt=Toggle(True))  # -> readMe, port, sunVectors, regionTestPts, shadeMesh, legend, legendBasePoint, port_2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; plug-in component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
ma = MassAddition(Input=comfortshadebenefit.shadeNetEffect)  # -> Result, PartialResults
panel_2 = Panel(ma.Result)
mesh_2 = Mesh(comfortshadebenefit.shadeMesh)
meshselector = Ladybug_MeshThresholdSelector(inputMesh=mesh_2, analysisResult=flatten(comfortshadebenefit.shadeNetEffect))  # -> readMe, totalValue, areaMeetsThresh, newColoredMesh, newMeshOutline; plug-in component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
pt = Point(Point(97.60016522, -86.53647562, 0))

# ---- group: comfort map
gradientlibrary = Ladybug_GradientLibrary(gradIndex="8")  # -> customColors; plug-in component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
legendpar = Ladybug_LegendParameters(lowBound="-3", highBound="3", numSegments="7", customColors=flatten(gradientlibrary))  # -> legendPar; plug-in component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
_3dchart = Ladybug_3DChart(
    inputData=flatten(outdoorcomfortcalculator.conditionOfPerson),
    basePoint=pt,
    xScale=Slider(0.2, range=0..1),
    zScale=Slider(0, range=0..100),
    legendPar=legendpar)  # -> readMe, graphMesh, graphCurves, legend, legendBasePts, title, titleBasePts, dataPts, conditionalHOY; plug-in component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

# ----
mesh_3 = Mesh(meshselector.newColoredMesh)
