# Grasshopper definition huang_weston.gh (Grasshopper 0.9.76)
# plug-ins: Python Interpreter

ladybug = Ladybug_Ladybug()  # -> Vviiiiiiiiiizzz; plug-in component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
path_now = FilePath("E:\UPenn MEBD\USA_PA_Philadelphia.Intl.AP.724080_TMY3.epw")
path_2050 = FilePath("E:\UPenn MEBD\USA_Philadelphia International Ap_HadCM3-A2-2050.epw")
importepw = Ladybug_ImportEpw(epwFile=path_now)  # -> readMe, latitude, location, dryBulbTemperature, dewPointTemperature, relativeHumidity, windSpeed, windDirection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; plug-in component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
importepw_2 = Ladybug_ImportEpw(epwFile=path_now)  # -> readMe, latitude, location, dryBulbTemperature, dewPointTemperature, relativeHumidity, windSpeed, windDirection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; disabled; plug-in component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
analysisperiod = Ladybug_AnalysisPeriod(fromMonth="1", toMonth="12")  # -> readMe, analysisPeriod; plug-in component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
pt = Point(<point referenced from the Rhino model>)
analysisperiod_2 = Ladybug_AnalysisPeriod()  # -> readMe, analysisPeriod; plug-in component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
series = Series(Start="1", Step=1, Count="24")
sunpath = Ladybug_SunPath(
    location=importepw.location,
    hour=12,
    day=21,
    month=12,
    timeStep=1,
    analysisPeriod=analysisperiod.analysisPeriod,
    sunScale=Slider(0.3, range=0..3),
    annualHourlyData=flatten([importepw.dryBulbTemperature, importepw.directNormalRadiation, importepw.relativeHumidity]),
    conditionalStatement="a>28 and b>80",
    dailyOrAnnualSunPath=True)  # -> readMe, sunVectors, sunAltitudes, sunAzimuths, port, sunSpheresMesh, sunPathCrvs, compassCrvs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; plug-in component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
solaradjusttemperature = Ladybug_OutdoorSolarTemperatureAdjustor(
    location=importepw_2.location,
    cumSkyMtxOrDirNormRad=importepw_2.directNormalRadiation,
    diffuseHorizRad=importepw_2.diffuseHorizontalRadiation,
    baseTemperature=importepw_2.dryBulbTemperature,
    horizInfraredRad=importepw_2.horizontalInfraredRadiation,
    bodyPosture=Slider(1, range=0..5),
    rotationAngle=Slider(90, range=0..360),
    bodyLocation=pt,
    analysisPeriodOrHOY=analysisperiod_2.analysisPeriod,
    runIt=Toggle(True))  # -> readMe, port, effectiveRadiantField, MRTDelta, solarAdjustedMRT, port_2, mannequinMesh, legend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; plug-in component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
Z = UnitZ(Factor=Slider(30, range=0..100))
mesh = Mesh(sunpath.sunSpheresMesh)
geo = Geometry([sunpath.legend, sunpath.sunPathCrvs, sunpath.title])
move = Move(Geometry=sunpath.sunPositions, Motion=Z)  # -> Geometry, Transform
ln = Line(StartPoint=sunpath.sunPathCenPts, EndPoint=sunpath.sunPositions)
preview = CustomPreview(Geometry=geo, Shader=ColourSwatch(SwatchColor=RGB(194, 188, 188)))
tag = TextTag(Location=move.Geometry, Text=sunpath.sunPositionsInfo)
outdoorcomfortcalculator = Ladybug_OutdoorComfortCalculator(
    dryBulbTemperature=importepw_2.dryBulbTemperature,
    windSpeed_tenMeters=importepw_2.windSpeed,
    relativeHumidity=importepw_2.relativeHumidity,
    runIt=Toggle(True))  # -> readMe, port, universalThermalClimateIndex, comfortableOrNot, thermalStress, conditionOfPerson, port_2, percentOfTimeComfortable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; plug-in component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
outdoorcomfortcalculator_2 = Ladybug_OutdoorComfortCalculator(
    dryBulbTemperature=importepw_2.dryBulbTemperature,
    meanRadiantTemperature=solaradjusttemperature.solarAdjustedMRT,
    windSpeed_tenMeters=importepw_2.windSpeed,
    relativeHumidity=importepw_2.relativeHumidity,
    runIt=Toggle(True))  # -> readMe, port, universalThermalClimateIndex, comfortableOrNot, thermalStress, conditionOfPerson, port_2, percentOfTimeComfortable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; plug-in component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
preview_2 = CustomPreview(Geometry=[ln, mesh], Shader=ColourSwatch(SwatchColor=RGB(255, 255, 0)))
brep_glass = Brep(<brep referenced from the Rhino model>)
brep_shade = Brep(<brep referenced from the Rhino model>)
number_slider = Slider(4, range=0..10)
wires = BrepWireframe(Brep=brep_shade, Density=-1)
smesh = SimpleMesh(Brep=brep_shade)
mjoin = MeshJoin(Meshes=smesh)
debrep = DeconstructBrep(Brep=brep_glass)  # -> Faces, Edges, Vertices
ext = ExtendCurve(Curve=wires, Type=0, Start=number_slider, End=number_slider)
preview_3 = CustomPreview(Geometry=brep_glass, Shader=ColourSwatch(SwatchColor=RGB(0, 170, 255)))
rev = Reverse(Vector=sunpath.sunVectors)
preview_4 = CustomPreview(Geometry=ext, Shader=ColourSwatch(SwatchColor=RGB(0, 0, 0)))
preview_5 = CustomPreview(Geometry=brep_shade, Shader=ColourSwatch(SwatchColor=RGB(255, 255, 255)))
meshray = MeshRay(Mesh=mjoin, Point=debrep.Vertices, Direction=rev)  # -> Point, Hit
brep = Brep(<brep referenced from the Rhino model>)
brep_2 = Brep(<brep referenced from the Rhino model>)
pt_2 = Point(<point referenced from the Rhino model>)
ma = MassAddition(Input=meshray.Hit)  # -> Result, PartialResults
_3dchart = Ladybug_3DChart(
    inputData=flatten([outdoorcomfortcalculator.conditionOfPerson, outdoorcomfortcalculator_2.conditionOfPerson]),
    basePoint=pt_2,
    xScale="0.25",
    zScale="0")  # -> readMe, graphMesh, graphCurves, legend, legendBasePts, title, titleBasePts, dataPts, conditionalHOY; disabled; plug-in component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
comfortshadebenefit = Ladybug_ComfortShadeBenefitEvaluator(
    location=importepw_2.location,
    temperatures=outdoorcomfortcalculator_2.universalThermalClimateIndex,
    testShades=brep,
    testRegion=brep_2,
    gridSize="1",
    skyResolution="7",
    delNonIntersect=False,
    parallel=Toggle(True),
    runIt=Toggle(True))  # -> readMe, port, sunVectors, regionTestPts, shadeMesh, legend, legendBasePoint, port_2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; plug-in component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
smaller = SmallerThan(FirstNumber=ma.Result, SecondNumber="4")  # -> SmallerThan, OrEqualTo
dispatch = Dispatch(List=sunpath.sunVectors, DispatchPattern=smaller.SmallerThan)  # -> ListA, ListB
dispatch_2 = Dispatch(List=sunpath.selHourlyData, DispatchPattern=smaller.SmallerThan)  # -> ListA, ListB
bnd = Bounds(Numbers=dispatch_2.ListA)
remap = RemapNumbers(Value=dispatch_2.ListA, Source=bnd, Target=Domain(0, 1))  # -> Mapped, Clipped
preview_6 = CustomPreview(Geometry=[_3dchart.legend, _3dchart.graphCurves], Shader=ColourSwatch(SwatchColor=RGB(0, 0, 0)))
preview_7 = CustomPreview(
    Geometry=simplify([comfortshadebenefit.legend, comfortshadebenefit.legendBasePoint]),
    Shader=ColourSwatch(SwatchColor=RGB(0, 0, 0)))
gradient = Gradient(
    LowerLimit=0,
    UpperLimit=1,
    Parameter=remap.Mapped,
    stops=[0: RGB(234, 38, 0), 0.25: RGB(234, 126, 0), 0.5: RGB(254, 244, 84), 0.75: RGB(173, 203, 249), 1: RGB(75, 107, 169)])
shddesigner = Ladybug_ShadingDesigner(glzSrf=flatten(brep_glass), depthOrVector=flatten(dispatch.ListA), numOfShds="1", runIt=Toggle(True), mergeVectors=False)  # -> readMe, shadingSrfs; plug-in component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
meshselector = Ladybug_MeshThresholdSelector(
    inputMesh=comfortshadebenefit.shadeMesh,
    analysisResult=flatten(comfortshadebenefit.shadeNetEffect),
    percentToKeep=Slider(30, range=0..100))  # -> readMe, totalValue, areaMeetsThresh, newColoredMesh, newMeshOutline; plug-in component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
material = CreateMaterial(Diffuse=gradient, Specular=RGB(255, 255, 255), Emission=RGB(0, 0, 0), Transparency=Slider(0.8, range=0..1), Shine=0)
preview_8 = CustomPreview(Geometry=shddesigner.shadingSrfs, Shader=material)
panel = Panel(meshselector.areaMeetsThresh)
preview_9 = CustomPreview(Geometry=[meshselector.newMeshOutline, meshselector.newColoredMesh], Shader=ColourSwatch(SwatchColor=RGB(0, 0, 0)))
panel_2 = Panel(meshselector.totalValue)
