# Grasshopper definition hwang_youngjin.gh (Grasshopper 0.9.76)
# plug-ins: Python Interpreter

ladybug = Ladybug_Ladybug()  # -> Vviiiiiiiiiizzz; plug-in component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
path = FilePath("C:\Users\himyn\OneDrive - PennO365\MEBD-2017-1ST\BUILDING PERFORMANCE SIMULATION\Class\Philadelphia_weather_files\USA_PA_Philadelphia.Intl.AP.724080_TMY3.epw")
importepw = Ladybug_ImportEpw(epwFile=path)  # -> readMe, latitude, location, dryBulbTemperature, dewPointTemperature, relativeHumidity, windSpeed, windDirection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; plug-in component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
panel = Panel(importepw.location)

outdoorcomfortcalculator = Ladybug_OutdoorComfortCalculator(
    dryBulbTemperature=importepw.dryBulbTemperature,
    windSpeed_tenMeters=importepw.windSpeed,
    relativeHumidity=importepw.relativeHumidity,
    runIt=Toggle(True))  # -> readMe, port, universalThermalClimateIndex, comfortableOrNot, thermalStress, conditionOfPerson, port_2, percentOfTimeComfortable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; plug-in component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

solaradjusttemperature = Ladybug_OutdoorSolarTemperatureAdjustor(
    location=importepw.location,
    cumSkyMtxOrDirNormRad=importepw.directNormalRadiation,
    diffuseHorizRad=importepw.diffuseHorizontalRadiation,
    baseTemperature=importepw.dryBulbTemperature,
    horizInfraredRad=importepw.horizontalInfraredRadiation,
    bodyPosture=Slider(1, range=0..10),
    runIt=Toggle(True))  # -> readMe, port, effectiveRadiantField, MRTDelta, solarAdjustedMRT, port_2, mannequinMesh, port_3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; plug-in component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
outdoorcomfortcalculator_2 = Ladybug_OutdoorComfortCalculator(
    dryBulbTemperature=importepw.dryBulbTemperature,
    meanRadiantTemperature=solaradjusttemperature.MRTDelta,
    windSpeed_tenMeters=importepw.windSpeed,
    relativeHumidity=importepw.relativeHumidity,
    runIt=Toggle(True))  # -> readMe, port, universalThermalClimateIndex, comfortableOrNot, thermalStress, conditionOfPerson, port_2, percentOfTimeComfortable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; plug-in component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

pt = Point(<point referenced from the Rhino model>)
series = Series(Start="0", Step=1, Count="24")
sunpath = Ladybug_SunPath(
    location=importepw.location,
    hour=series,
    day=21,
    month="9",
    timeStep=1,
    centerPt=pt,
    sunPathScale=Slider(0.5, range=0..1),
    sunScale=Slider(0.5, range=0..1),
    dailyOrAnnualSunPath=True)  # -> readMe, sunVectors, sunAltitudes, sunAzimuths, port, sunSpheresMesh, sunPathCrvs, compassCrvs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; plug-in component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
ln = Line(StartPoint=pt, EndPoint=sunpath.sunPositions)
loft = Loft(Curves=ln, Options={Adjust=False, Closed=False, LoftEnds=0, LoftSimp=0, LoftType=0, Rebuild=10, Refit=0.01})

pt_2 = Point(<point referenced from the Rhino model>)
brep = Brep([<brep referenced from the Rhino model> x2])

solaradjusttemperature_2 = Ladybug_OutdoorSolarTemperatureAdjustor(
    location=importepw.location,
    cumSkyMtxOrDirNormRad=importepw.directNormalRadiation,
    diffuseHorizRad=importepw.diffuseHorizontalRadiation,
    baseTemperature=importepw.dryBulbTemperature,
    horizInfraredRad=importepw.horizontalInfraredRadiation,
    bodyPosture=Slider(1, range=0..10),
    bodyLocation=pt_2,
    contextShading=brep,
    runIt=Toggle(True))  # -> readMe, port, effectiveRadiantField, MRTDelta, solarAdjustedMRT, port_2, mannequinMesh, port_3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; plug-in component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
outdoorcomfortcalculator_3 = Ladybug_OutdoorComfortCalculator(
    dryBulbTemperature=importepw.dryBulbTemperature,
    meanRadiantTemperature=solaradjusttemperature_2.MRTDelta,
    windSpeed_tenMeters=importepw.windSpeed,
    relativeHumidity=importepw.relativeHumidity,
    runIt=Toggle(True))  # -> readMe, port, universalThermalClimateIndex, comfortableOrNot, thermalStress, conditionOfPerson, port_2, percentOfTimeComfortable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; plug-in component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

panel_2 = Panel(outdoorcomfortcalculator.percentOfTimeComfortable)
panel_3 = Panel(outdoorcomfortcalculator.percentHeatStress)

brep_2 = Brep([<brep referenced from the Rhino model> x3])
brep_3 = Brep([<brep referenced from the Rhino model> x36])
brep_4 = Brep(<brep referenced from the Rhino model>)
comfortshadebenefit = Ladybug_ComfortShadeBenefitEvaluator(
    location=importepw.location,
    temperatures=outdoorcomfortcalculator_2.universalThermalClimateIndex,
    testShades=brep_4,
    testRegion=brep_2,
    gridSize=Slider(0.5, range=0..10),
    context=brep_3,
    skyResolution=Slider(5, range=0..10),
    delNonIntersect=False,
    parallel=Toggle(True),
    runIt=Toggle(True))  # -> readMe, port, sunVectors, regionTestPts, shadeMesh, legend, legendBasePoint, port_2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; plug-in component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
meshselector = Ladybug_MeshThresholdSelector(
    inputMesh=comfortshadebenefit.shadeMesh,
    analysisResult=flatten(comfortshadebenefit.shadeNetEffect),
    percentToKeep=Slider(30, range=0..100))  # -> readMe, totalValue, areaMeetsThresh, newColoredMesh, newMeshOutline; plug-in component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

panel_4 = Panel(outdoorcomfortcalculator_2.percentHeatStress)
panel_5 = Panel(outdoorcomfortcalculator_2.percentOfTimeComfortable)
panel_6 = Panel(outdoorcomfortcalculator_3.percentOfTimeComfortable)
panel_7 = Panel(outdoorcomfortcalculator_3.percentComfForShortPeriod)
panel_8 = Panel(outdoorcomfortcalculator_3.percentHeatStress)

gradientlibrary = Ladybug_GradientLibrary(gradIndex=Slider(8, range=0..10))  # -> customColors; plug-in component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
pt_3 = Point(<point referenced from the Rhino model>)
legendpar = Ladybug_LegendParameters(lowBound="-3", highBound="3", numSegments="7", customColors=flatten(gradientlibrary))  # -> legendPar; plug-in component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
_3dchart = Ladybug_3DChart(
    inputData=flatten([outdoorcomfortcalculator_2.conditionOfPerson, outdoorcomfortcalculator.conditionOfPerson, outdoorcomfortcalculator_3.conditionOfPerson]),
    basePoint=pt_3,
    xScale="0.25",
    zScale="0",
    legendPar=legendpar)  # -> readMe, graphMesh, graphCurves, legend, legendBasePts, title, titleBasePts, dataPts, conditionalHOY; plug-in component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

crv = Curve([<curve referenced from the Rhino model> x6])
pipe = Pipe(Curve=crv, Radius=Slider(0.02, range=0..10), Caps=0)
brep_5 = Brep(meshselector.newMeshOutline)
demesh = DeconstructMesh(Mesh=brep_5)  # -> Vertices, Faces, Colours, Normals
pt_4 = Point(demesh.Vertices)
