# Grasshopper definition jeon_bosung.gh (Grasshopper 0.9.76)
# plug-ins: Python Interpreter

file_path = FilePath("E:\Jeon\02_UPenn\2017_Fall____02_Building_Performance_Simulation\170918\Philadelphia_weather_files\USA_PA_Philadelphia.Intl.AP.724080_TMY3.epw")
importepw = Ladybug_ImportEpw(epwFile=file_path)  # -> Output, latitude, location, dryBulbTemperature, dewPointTemperature, relativeHumidity, windSpeed, windDirection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; plug-in component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
ladybug = Ladybug_Ladybug()  # -> out; plug-in component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

brep = Brep([<brep referenced from the Rhino model> x43])
brep_2 = Brep([<brep referenced from the Rhino model> x3])
brep_3 = Brep([<brep referenced from the Rhino model> x55])
merge = Merge(Data1=brep_3, Data2=brep, Data3=brep_2)  # -> flatten(Result)
brep_4 = Brep(<brep referenced from the Rhino model>)
area = Area(Geometry=brep_4)  # -> Area, Centroid
unit_y = UnitY(Factor=1)
# Outdoor Comfort
# w/  Solar Radiation Effect
# w/  Meyerson Hall & Fisher Library
solaradjusttemperature = Ladybug_OutdoorSolarTemperatureAdjustor(
    location=importepw.location,
    cumSkyMtxOrDirNormRad=importepw.directNormalRadiation,
    diffuseHorizRad=importepw.diffuseHorizontalRadiation,
    baseTemperature=importepw.dryBulbTemperature,
    horizInfraredRad=importepw.horizontalInfraredRadiation,
    bodyLocation=area.Centroid,
    contextShading=merge,
    north=unit_y,
    runIt=Toggle(True))  # -> readMe, port, effectiveRadiantField, MRTDelta, solarAdjustedMRT, port_2, mannequinMesh, port_3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; plug-in component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
outdoorcomfortcalculator = Ladybug_OutdoorComfortCalculator(
    dryBulbTemperature=importepw.dryBulbTemperature,
    meanRadiantTemperature=solaradjusttemperature.solarAdjustedMRT,
    windSpeed_tenMeters=importepw.windSpeed,
    relativeHumidity=importepw.relativeHumidity,
    runIt=Toggle(True))  # -> out, port, universalThermalClimateIndex, comfortableOrNot, thermalStress, conditionOfPerson, port_2, percentOfTimeComfortable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; plug-in component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
strnum = Ladybug_SeparateData(inputList=flatten(outdoorcomfortcalculator.comfortableOrNot))  # -> numbers, strings; plug-in component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
mass_addition = MassAddition(Input=strnum.numbers)  # -> Result, PartialResults
panel = Panel([mass_addition.Result, outdoorcomfortcalculator.percentOfTimeComfortable])

unit_y_2 = UnitY(Factor=1)
# Outdoor Comfort
# w/  Solar Radiation Effect
solaradjusttemperature_2 = Ladybug_OutdoorSolarTemperatureAdjustor(
    location=importepw.location,
    cumSkyMtxOrDirNormRad=importepw.directNormalRadiation,
    diffuseHorizRad=importepw.diffuseHorizontalRadiation,
    baseTemperature=importepw.dryBulbTemperature,
    horizInfraredRad=importepw.horizontalInfraredRadiation,
    north=unit_y_2,
    runIt=Toggle(True))  # -> readMe, port, effectiveRadiantField, MRTDelta, solarAdjustedMRT, port_2, mannequinMesh, port_3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; plug-in component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
outdoorcomfortcalculator_2 = Ladybug_OutdoorComfortCalculator(
    dryBulbTemperature=importepw.dryBulbTemperature,
    meanRadiantTemperature=solaradjusttemperature_2.solarAdjustedMRT,
    windSpeed_tenMeters=importepw.windSpeed,
    relativeHumidity=importepw.relativeHumidity,
    runIt=Toggle(True))  # -> out, port, universalThermalClimateIndex, comfortableOrNot, thermalStress, conditionOfPerson, port_2, percentOfTimeComfortable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; plug-in component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
strnum_2 = Ladybug_SeparateData(inputList=flatten(outdoorcomfortcalculator_2.comfortableOrNot))  # -> numbers, strings; plug-in component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
mass_addition_2 = MassAddition(Input=strnum_2.numbers)  # -> Result, PartialResults
panel_2 = Panel([mass_addition_2.Result, outdoorcomfortcalculator_2.percentOfTimeComfortable])

# ----
# Outdoor Comfort
# w/o  Solar Radiation Effect
outdoorcomfortcalculator_3 = Ladybug_OutdoorComfortCalculator(
    dryBulbTemperature=importepw.dryBulbTemperature,
    windSpeed_tenMeters=importepw.windSpeed,
    relativeHumidity=importepw.relativeHumidity,
    runIt=Toggle(True))  # -> out, port, universalThermalClimateIndex, comfortableOrNot, thermalStress, conditionOfPerson, port_2, percentOfTimeComfortable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; plug-in component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
strnum_3 = Ladybug_SeparateData(inputList=flatten(outdoorcomfortcalculator_3.comfortableOrNot))  # -> numbers, strings; plug-in component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
mass_addition_3 = MassAddition(Input=strnum_3.numbers)  # -> Result, PartialResults
panel_3 = Panel([mass_addition_3.Result, outdoorcomfortcalculator_3.percentOfTimeComfortable])

brep_5 = Brep(<brep referenced from the Rhino model>)
brep_6 = Brep(<brep referenced from the Rhino model>)
comfortshadebenefit = Ladybug_ComfortShadeBenefitEvaluator(
    location=importepw.location,
    temperatures=outdoorcomfortcalculator.universalThermalClimateIndex,
    testShades=brep_5,
    testRegion=brep_6,
    gridSize="0.5",
    delNonIntersect=False,
    runIt=Toggle(True))  # -> out, port, sunVectors, regionTestPts, shadeMesh, legend, legendBasePoint, port_2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; plug-in component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
# Creating Shading
meshselector = Ladybug_MeshThresholdSelector(
    inputMesh=comfortshadebenefit.shadeMesh,
    analysisResult=flatten(comfortshadebenefit.shadeNetEffect),
    percentToKeep=Slider(30, range=0..100))  # -> out, totalValue, areaMeetsThresh, newColoredMesh, newMeshOutline; plug-in component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
surface = Surface(meshselector.newMeshOutline)
data_dam = DataDam(DataA=surface, BufferDelay=10000000, BufferMode=0)

brep_7 = Brep([<brep referenced from the Rhino model> x43])
brep_8 = Brep([<brep referenced from the Rhino model> x3])
brep_9 = Brep([<brep referenced from the Rhino model> x55])
merge_2 = Merge(Data1=brep_9, Data2=brep_7, Data3=brep_8, Data4=data_dam)  # -> flatten(Result)
brep_10 = Brep(<brep referenced from the Rhino model>)
area_2 = Area(Geometry=brep_10)  # -> Area, Centroid
unit_y_3 = UnitY(Factor=1)
# Outdoor Comfort
# w/  Solar Radiation Effect
# w/  Meyerson Hall & Fisher Library
# w/  New Shading
solaradjusttemperature_3 = Ladybug_OutdoorSolarTemperatureAdjustor(
    location=importepw.location,
    cumSkyMtxOrDirNormRad=importepw.directNormalRadiation,
    diffuseHorizRad=importepw.diffuseHorizontalRadiation,
    baseTemperature=importepw.dryBulbTemperature,
    horizInfraredRad=importepw.horizontalInfraredRadiation,
    bodyLocation=area_2.Centroid,
    contextShading=merge_2,
    north=unit_y_3,
    runIt=Toggle(True))  # -> readMe, port, effectiveRadiantField, MRTDelta, solarAdjustedMRT, port_2, mannequinMesh, port_3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; plug-in component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
outdoorcomfortcalculator_4 = Ladybug_OutdoorComfortCalculator(
    dryBulbTemperature=importepw.dryBulbTemperature,
    meanRadiantTemperature=solaradjusttemperature_3.solarAdjustedMRT,
    windSpeed_tenMeters=importepw.windSpeed,
    relativeHumidity=importepw.relativeHumidity,
    runIt=Toggle(True))  # -> out, port, universalThermalClimateIndex, comfortableOrNot, thermalStress, conditionOfPerson, port_2, percentOfTimeComfortable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; plug-in component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
strnum_4 = Ladybug_SeparateData(inputList=flatten(outdoorcomfortcalculator_4.comfortableOrNot))  # -> numbers, strings; plug-in component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
mass_addition_4 = MassAddition(Input=strnum_4.numbers)  # -> Result, PartialResults
panel_4 = Panel([mass_addition_4.Result, outdoorcomfortcalculator_4.percentOfTimeComfortable])

gradientlibrary = Ladybug_GradientLibrary(gradIndex="8")  # -> customColors; plug-in component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
legendpar = Ladybug_LegendParameters(lowBound="-3", highBound="3", numSegments="7", customColors=flatten(gradientlibrary))  # -> legendPar; plug-in component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
# Chart Visualization
# Overall
panel_5 = Panel("0.3")
_3dchart = Ladybug_3DChart(
    inputData=flatten([outdoorcomfortcalculator_3.conditionOfPerson, outdoorcomfortcalculator_2.conditionOfPerson, outdoorcomfortcalculator.conditionOfPerson, outdoorcomfortcalculator_4.conditionOfPerson]),
    xScale=panel_5,
    zScale="0",
    legendPar=legendpar)  # -> out, graphMesh, graphCurves, legend, legendBasePts, title, titleBasePts, dataPts, conditionalHOY; plug-in component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

_3dchart_2 = Ladybug_3DChart(
    inputData=flatten(outdoorcomfortcalculator_4.conditionOfPerson),
    xScale=panel_5,
    zScale="0",
    legendPar=legendpar,
    condStatement="-1<a<1")  # -> out, graphMesh, graphCurves, legend, legendBasePts, title, titleBasePts, dataPts, conditionalHOY; plug-in component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
# Chart Visualization
# Proportion of Improvement
_3dchart_3 = Ladybug_3DChart(
    inputData=flatten(outdoorcomfortcalculator_3.conditionOfPerson),
    xScale=panel_5,
    zScale="0",
    legendPar=legendpar,
    condStatement="-1<a<1")  # -> out, graphMesh, graphCurves, legend, legendBasePts, title, titleBasePts, dataPts, conditionalHOY; plug-in component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
_3dchart_4 = Ladybug_3DChart(
    inputData=flatten(outdoorcomfortcalculator.conditionOfPerson),
    xScale=panel_5,
    zScale="0",
    legendPar=legendpar,
    condStatement="-1<a<1")  # -> out, graphMesh, graphCurves, legend, legendBasePts, title, titleBasePts, dataPts, conditionalHOY; plug-in component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
_3dchart_5 = Ladybug_3DChart(
    inputData=flatten(outdoorcomfortcalculator_2.conditionOfPerson),
    xScale=panel_5,
    zScale="0",
    legendPar=legendpar,
    condStatement="-1<a<1")  # -> out, graphMesh, graphCurves, legend, legendBasePts, title, titleBasePts, dataPts, conditionalHOY; plug-in component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
list_length = ListLength(List=_3dchart_2.conditionalHOY)
list_length_2 = ListLength(List=_3dchart_3.conditionalHOY)
list_length_3 = ListLength(List=_3dchart_4.conditionalHOY)
list_length_4 = ListLength(List=_3dchart_5.conditionalHOY)
panel_6 = Panel(list_length)
panel_7 = Panel(list_length_2)
panel_8 = Panel(list_length_3)
panel_9 = Panel(list_length_4)
