# Grasshopper definition jiang_hewen.gh (Grasshopper 0.9.76)
# plug-ins: Python Interpreter

ladybug = Ladybug_Ladybug()  # -> Vviiiiiiiiiizzz; plug-in component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
path = FilePath("C:\Users\wen\Desktop\grasshopper class\ARCH 753\USA_PA_Philadelphia.Intl.AP.724080_TMY3.epw")
importepw = Ladybug_ImportEpw(epwFile=path)  # -> readMe, latitude, location, dryBulbTemperature, dewPointTemperature, relativeHumidity, windSpeed, windDirection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; plug-in component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
solaradjusttemperature = Ladybug_OutdoorSolarTemperatureAdjustor(
    location=importepw.location,
    cumSkyMtxOrDirNormRad=importepw.directNormalRadiation,
    diffuseHorizRad=importepw.diffuseHorizontalRadiation,
    baseTemperature=importepw.dryBulbTemperature,
    horizInfraredRad=importepw.horizontalInfraredRadiation,
    runIt=Toggle(True))  # -> readMe, port, effectiveRadiantField, MRTDelta, solarAdjustedMRT, port_2, mannequinMesh, port_3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; plug-in component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
outdoorcomfortcalculator = Ladybug_OutdoorComfortCalculator(
    dryBulbTemperature=importepw.dryBulbTemperature,
    meanRadiantTemperature=solaradjusttemperature.solarAdjustedMRT,
    windSpeed_tenMeters=importepw.windSpeed,
    relativeHumidity=importepw.relativeHumidity,
    runIt=Toggle(True))  # -> readMe, port, universalThermalClimateIndex, comfortableOrNot, thermalStress, conditionOfPerson, port_2, percentOfTimeComfortable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; plug-in component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

# ---- group: sun path
series = Series(Start=0, Step=1, Count=Slider(23, range=0..100))
series_2 = Series(Start=Slider(1, range=0..1), Step=1, Count=Slider(12, range=0..100))
sunpath = Ladybug_SunPath(
    location=importepw.location,
    hour=series,
    day=21,
    month=series_2,
    timeStep=Slider(3, range=0..10),
    annualHourlyData=flatten(outdoorcomfortcalculator.conditionOfPerson),
    conditionalStatement="a>1",
    dailyOrAnnualSunPath=True)  # -> readMe, sunVectors, sunAltitudes, sunAzimuths, port, sunSpheresMesh, sunPathCrvs, compassCrvs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; plug-in component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

# ---- group: comfort map
gradientlibrary = Ladybug_GradientLibrary(gradIndex="8")  # -> customColors; plug-in component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
legendpar = Ladybug_LegendParameters(lowBound="-3", highBound="3", numSegments="7", customColors=flatten(gradientlibrary))  # -> legendPar; plug-in component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
_3dchart = Ladybug_3DChart(
    inputData=flatten(outdoorcomfortcalculator.conditionOfPerson),
    xScale=Slider(0.25, range=0..1),
    zScale=Slider(0, range=0..100),
    legendPar=legendpar)  # -> readMe, graphMesh, graphCurves, legend, legendBasePts, title, titleBasePts, dataPts, conditionalHOY; plug-in component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

# ---- group: sun vec
amp = Amplitude(Vector=sunpath.sunVectors, Amplitude=Slider(75, range=0..100))
vdis = VectorDisplay(Anchor=sunpath.sunPositions, Vector=amp)

# ---- group: shade surface
crv = Curve(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)
Y = UnitY(Factor="-10")
extr = Extrude(Base=crv, Direction=Y)
srf = Surface(extr)

# ---- group: test region
srf_2 = Surface([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])

# ----
mesh = Mesh(srf)
rev = Reverse(Vector=sunpath.sunVectors)
debrep = DeconstructBrep(Brep=srf_2)  # -> Faces, Edges, Vertices
meshray = MeshRay(Mesh=mesh, Point=graft(debrep.Vertices), Direction=rev)  # -> flatten(Point), Hit
del = DelaunayMesh(Points=meshray.Point, Plane=PlaneXY(0, 0, 0))
comfortshadebenefit = Ladybug_ComfortShadeBenefitEvaluator(
    location=importepw.location,
    temperatures=importepw.dryBulbTemperature,
    testShades=del,
    testRegion=srf_2,
    delNonIntersect=False,
    runIt=Toggle(True))  # -> readMe, port, sunVectors, regionTestPts, shadeMesh, legend, legendBasePoint, port_2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; plug-in component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
ma = MassAddition(Input=comfortshadebenefit.shadeNetEffect)  # -> Result, PartialResults
panel = Panel(ma.Result)
mesh_2 = Mesh(comfortshadebenefit.shadeMesh)
