# Grasshopper definition kamath_ayodh.gh (Grasshopper 0.9.76)
# plug-ins: Python Interpreter

ladybug = Ladybug_Ladybug()  # -> Vviiiiiiiiiizzz; plug-in component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
path = FilePath("C:\Users\Ayodh\Documents\Us\Ayodh\UPenn\1709\753\USA_PA_Philadelphia.Intl.AP.724080_TMY3\USA_PA_Philadelphia.Intl.AP.724080_TMY3.epw")
importepw = Ladybug_ImportEpw(epwFile=path)  # -> readMe, latitude, location, dryBulbTemperature, dewPointTemperature, relativeHumidity, windSpeed, windDirection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; plug-in component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
toggle = BooleanToggle(True)
toggle_2 = BooleanToggle(True)
northvec = Vector(Vector(0.3717244132, 3.027452397, 0))
solaradjusttemperature = Ladybug_OutdoorSolarTemperatureAdjustor(
    location=importepw.location,
    cumSkyMtxOrDirNormRad=importepw.directNormalRadiation,
    diffuseHorizRad=importepw.diffuseHorizontalRadiation,
    baseTemperature=importepw.dryBulbTemperature,
    baseDryBulbOrMRT=toggle,
    horizInfraredRad=importepw.horizontalInfraredRadiation,
    north=northvec,
    runIt=toggle_2)  # -> readMe, port, effectiveRadiantField, MRTDelta, solarAdjustedMRT, port_2, mannequinMesh, port_3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; plug-in component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
toggle_3 = BooleanToggle(True)

# ---- group: With Radiation
outdoorcomfortcalculator = Ladybug_OutdoorComfortCalculator(
    dryBulbTemperature=importepw.dryBulbTemperature,
    meanRadiantTemperature=solaradjusttemperature.solarAdjustedMRT,
    windSpeed_tenMeters=importepw.windSpeed,
    relativeHumidity=importepw.relativeHumidity,
    runIt=toggle_3)  # -> readMe, port, universalThermalClimateIndex, comfortableOrNot, thermalStress, conditionOfPerson, port_2, percentOfTimeComfortable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; plug-in component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
panel = Panel(outdoorcomfortcalculator.percentOfTimeComfortable)
panel_2 = Panel(outdoorcomfortcalculator.percentComfForShortPeriod)
panel_3 = Panel(outdoorcomfortcalculator.percentHeatStress)
panel_4 = Panel(outdoorcomfortcalculator.percentColdStress)

# ---- group: Without Radiation
outdoorcomfortcalculator_2 = Ladybug_OutdoorComfortCalculator(
    dryBulbTemperature=importepw.dryBulbTemperature,
    windSpeed_tenMeters=importepw.windSpeed,
    relativeHumidity=importepw.relativeHumidity,
    runIt=toggle_3)  # -> readMe, port, universalThermalClimateIndex, comfortableOrNot, thermalStress, conditionOfPerson, port_2, percentOfTimeComfortable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; plug-in component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
panel_5 = Panel(outdoorcomfortcalculator_2.percentOfTimeComfortable)
panel_6 = Panel(outdoorcomfortcalculator_2.percentComfForShortPeriod)
panel_7 = Panel(outdoorcomfortcalculator_2.percentHeatStress)
panel_8 = Panel(outdoorcomfortcalculator_2.percentColdStress)

# ---- group: Without Radiation and without Wind
outdoorcomfortcalculator_3 = Ladybug_OutdoorComfortCalculator(dryBulbTemperature=importepw.dryBulbTemperature, relativeHumidity=importepw.relativeHumidity, runIt=toggle_3)  # -> readMe, port, universalThermalClimateIndex, comfortableOrNot, thermalStress, conditionOfPerson, port_2, percentOfTimeComfortable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; plug-in component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
panel_9 = Panel(outdoorcomfortcalculator_3.percentOfTimeComfortable)
panel_10 = Panel(outdoorcomfortcalculator_3.percentComfForShortPeriod)
panel_11 = Panel(outdoorcomfortcalculator_3.percentColdStress)
panel_12 = Panel(outdoorcomfortcalculator_3.percentHeatStress)

# ---- group: Shading Design
col = Colour([ColourSwatch(SwatchColor=RGB(0, 0, 0)), ColourSwatch(SwatchColor=RGB(255, 255, 255))])
srf = Surface(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)
testsrf = Surface(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)
bbox = BoundingBox(Content=testsrf, Plane=PlaneXY(0, 0, 0))  # -> Box, Box_2
box_corners = BoxCorners(Box=bbox.Box)  # -> CornerA, CornerB, CornerC, CornerD, CornerE, CornerF, CornerG, CornerH
legendpar = Ladybug_LegendParameters(customColors=reverse(flatten(col)), legendLocation=box_corners.CornerB)  # -> legendPar; plug-in component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
shdsrf = Surface(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)
brep = Brep([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])
toggle_4 = BooleanToggle(True)
comfortshadebenefit = Ladybug_ComfortShadeBenefitEvaluator(
    location=importepw.location,
    temperatures=outdoorcomfortcalculator.universalThermalClimateIndex,
    testShades=shdsrf,
    testRegion=srf,
    context=brep,
    north=northvec,
    delNonIntersect=toggle_4,
    legendPar=legendpar,
    runIt=toggle_4)  # -> readMe, port, sunVectors, regionTestPts, shadeMesh, legend, legendBasePoint, port_2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; plug-in component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
meshselector = Ladybug_MeshThresholdSelector(
    inputMesh=comfortshadebenefit.shadeMesh,
    analysisResult=flatten(comfortshadebenefit.shadeNetEffect),
    percentToKeep=Slider(25, range=0..100))  # -> readMe, totalValue, areaMeetsThresh, newColoredMesh, newMeshOutline; plug-in component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
crv = Curve(meshselector.newMeshOutline)
mesh = Mesh(comfortshadebenefit.shadeMesh)

# ---- group: Wind Speed
strnum = Ladybug_SeparateData(inputList=flatten(importepw.windSpeed))  # -> numbers, strings; plug-in component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

# ---- group: Wind Direction
strnum_2 = Ladybug_SeparateData(inputList=flatten(importepw.windDirection))  # -> numbers, strings; plug-in component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

# ---- group: Site Wind
lng = ListLength(List=strnum.numbers)
series = Series(Start=0, Step=0, Count=lng)
larger = LargerThan(FirstNumber=strnum_2.numbers, SecondNumber="180")  # -> LargerThan, OrEqualTo
smaller = SmallerThan(FirstNumber=strnum_2.numbers, SecondNumber="250")  # -> SmallerThan, OrEqualTo
larger_2 = LargerThan(FirstNumber=strnum_2.numbers, SecondNumber="300")  # -> LargerThan, OrEqualTo
smaller_2 = SmallerThan(FirstNumber=strnum_2.numbers, SecondNumber="360")  # -> SmallerThan, OrEqualTo
and = GateAnd(A=larger.LargerThan, B=smaller.SmallerThan)
and_2 = GateAnd(A=larger_2.LargerThan, B=smaller_2.SmallerThan)
or = GateOr(A=and, B=and_2)
p_n_c = PickNChoose(Pattern=or, Stream0=series, Stream1=strnum.numbers)

# ---- group: With Site Radiation and with Site Wind
# Context shading does not appear to have any effect.
# How to adjust Base Temperature to factor for context geometry?
solaradjusttemperature_2 = Ladybug_OutdoorSolarTemperatureAdjustor(
    location=importepw.location,
    cumSkyMtxOrDirNormRad=importepw.directNormalRadiation,
    diffuseHorizRad=importepw.diffuseHorizontalRadiation,
    baseTemperature=importepw.dryBulbTemperature,
    baseDryBulbOrMRT=toggle,
    horizInfraredRad=importepw.horizontalInfraredRadiation,
    contextShading=brep,
    north=northvec,
    runIt=toggle_2)  # -> readMe, port, effectiveRadiantField, MRTDelta, solarAdjustedMRT, port_2, mannequinMesh, port_3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; plug-in component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
outdoorcomfortcalculator_4 = Ladybug_OutdoorComfortCalculator(
    dryBulbTemperature=importepw.dryBulbTemperature,
    meanRadiantTemperature=solaradjusttemperature_2.solarAdjustedMRT,
    windSpeed_tenMeters=p_n_c,
    relativeHumidity=importepw.relativeHumidity,
    runIt=toggle_3)  # -> readMe, port, universalThermalClimateIndex, comfortableOrNot, thermalStress, conditionOfPerson, port_2, percentOfTimeComfortable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; plug-in component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
panel_13 = Panel(outdoorcomfortcalculator_4.percentComfForShortPeriod)
panel_14 = Panel(outdoorcomfortcalculator_4.percentColdStress)
panel_15 = Panel(outdoorcomfortcalculator_4.percentOfTimeComfortable)
panel_16 = Panel(outdoorcomfortcalculator_4.percentHeatStress)

# ---- group: With Site Radiation, Designed Shading and with Site Wind
# Context shading does not appear to have any effect.
# How to adjust Base Temperature to factor for context geometry?
solaradjusttemperature_3 = Ladybug_OutdoorSolarTemperatureAdjustor(
    location=importepw.location,
    cumSkyMtxOrDirNormRad=importepw.directNormalRadiation,
    diffuseHorizRad=importepw.diffuseHorizontalRadiation,
    baseTemperature=importepw.dryBulbTemperature,
    baseDryBulbOrMRT=toggle,
    horizInfraredRad=importepw.horizontalInfraredRadiation,
    contextShading=[brep, shdsrf],
    north=northvec,
    runIt=toggle_2)  # -> readMe, port, effectiveRadiantField, MRTDelta, solarAdjustedMRT, port_2, mannequinMesh, port_3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; plug-in component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
outdoorcomfortcalculator_5 = Ladybug_OutdoorComfortCalculator(
    dryBulbTemperature=importepw.dryBulbTemperature,
    meanRadiantTemperature=solaradjusttemperature_3.solarAdjustedMRT,
    windSpeed_tenMeters=p_n_c,
    relativeHumidity=importepw.relativeHumidity,
    runIt=toggle_3)  # -> readMe, port, universalThermalClimateIndex, comfortableOrNot, thermalStress, conditionOfPerson, port_2, percentOfTimeComfortable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; plug-in component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
panel_17 = Panel(outdoorcomfortcalculator_5.percentComfForShortPeriod)
panel_18 = Panel(outdoorcomfortcalculator_5.percentColdStress)
panel_19 = Panel(outdoorcomfortcalculator_5.percentOfTimeComfortable)
panel_20 = Panel(outdoorcomfortcalculator_5.percentHeatStress)

# ---- group: Without Radiation and with Site Wind
outdoorcomfortcalculator_6 = Ladybug_OutdoorComfortCalculator(
    dryBulbTemperature=importepw.dryBulbTemperature,
    windSpeed_tenMeters=p_n_c,
    relativeHumidity=importepw.relativeHumidity,
    runIt=toggle_3)  # -> readMe, port, universalThermalClimateIndex, comfortableOrNot, thermalStress, conditionOfPerson, port_2, percentOfTimeComfortable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; plug-in component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
panel_21 = Panel(outdoorcomfortcalculator_6.percentComfForShortPeriod)
panel_22 = Panel(outdoorcomfortcalculator_6.percentColdStress)
panel_23 = Panel(outdoorcomfortcalculator_6.percentOfTimeComfortable)
panel_24 = Panel(outdoorcomfortcalculator_6.percentHeatStress)

# ---- group: With Radiation and with Site Wind
outdoorcomfortcalculator_7 = Ladybug_OutdoorComfortCalculator(
    dryBulbTemperature=importepw.dryBulbTemperature,
    meanRadiantTemperature=solaradjusttemperature.solarAdjustedMRT,
    windSpeed_tenMeters=p_n_c,
    relativeHumidity=importepw.relativeHumidity,
    runIt=toggle_3)  # -> readMe, port, universalThermalClimateIndex, comfortableOrNot, thermalStress, conditionOfPerson, port_2, percentOfTimeComfortable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; plug-in component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
panel_25 = Panel(outdoorcomfortcalculator_7.percentComfForShortPeriod)
# No change in values after adding context geometry.
panel_26 = Panel(outdoorcomfortcalculator_7.percentColdStress)
panel_27 = Panel(outdoorcomfortcalculator_7.percentOfTimeComfortable)
panel_28 = Panel(outdoorcomfortcalculator_7.percentHeatStress)

# ---- group: Charts
col_2 = Colour([ColourSwatch(SwatchColor=RGB(255, 0, 0)), ColourSwatch(SwatchColor=RGB(255, 255, 255)), ColourSwatch(SwatchColor=RGB(0, 130, 255))])
legendpar_2 = Ladybug_LegendParameters(numSegments="7", customColors=reverse(flatten(col_2)))  # -> legendPar; plug-in component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
bbox_2 = BoundingBox(Content=comfortshadebenefit.legend, Plane=PlaneXY(0, 0, 0), UnionBox=True)  # -> Box, Box_2
box_corners_2 = BoxCorners(Box=bbox_2.Box)  # -> CornerA, CornerB, CornerC, CornerD, CornerE, CornerF, CornerG, CornerH
_3dchart = Ladybug_3DChart(
    inputData=flatten([outdoorcomfortcalculator_2.conditionOfPerson, outdoorcomfortcalculator.conditionOfPerson, outdoorcomfortcalculator_4.conditionOfPerson, outdoorcomfortcalculator_5.conditionOfPerson]),
    basePoint=box_corners_2.CornerB,
    xScale=".05",
    yScale=".1",
    zScale="0",
    legendPar=legendpar_2)  # -> readMe, graphMesh, graphCurves, legend, legendBasePts, title, titleBasePts, dataPts, conditionalHOY; plug-in component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
