# Grasshopper definition kamath_ayodh_2.gh (Grasshopper 0.9.76)
# plug-ins: Python Interpreter

ladybug = Ladybug_Ladybug()  # -> Vviiiiiiiiiizzz; plug-in component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
path = FilePath("C:\Users\Ayodh\Documents\Us\Ayodh\UPenn\1709\753\USA_PA_Philadelphia.Intl.AP.724080_TMY3\USA_PA_Philadelphia.Intl.AP.724080_TMY3.epw")
importepw = Ladybug_ImportEpw(epwFile=path)  # -> readMe, latitude, location, dryBulbTemperature, dewPointTemperature, relativeHumidity, windSpeed, windDirection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; plug-in component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
toggle = BooleanToggle(True)
toggle_2 = BooleanToggle(True)
northvec = Vector(Vector(0.3717244132, 3.027452397, 0))
solaradjusttemperature = Ladybug_OutdoorSolarTemperatureAdjustor(
    location=importepw.location,
    cumSkyMtxOrDirNormRad=importepw.directNormalRadiation,
    diffuseHorizRad=importepw.diffuseHorizontalRadiation,
    baseTemperature=importepw.dryBulbTemperature,
    baseDryBulbOrMRT=toggle,
    horizInfraredRad=importepw.horizontalInfraredRadiation,
    north=northvec,
    runIt=toggle_2)  # -> readMe, port, effectiveRadiantField, MRTDelta, solarAdjustedMRT, port_2, mannequinMesh, port_3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; plug-in component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
toggle_3 = BooleanToggle(True)

# ---- group: With Radiation
outdoorcomfortcalculator = Ladybug_OutdoorComfortCalculator(
    dryBulbTemperature=importepw.dryBulbTemperature,
    meanRadiantTemperature=solaradjusttemperature.solarAdjustedMRT,
    windSpeed_tenMeters=importepw.windSpeed,
    relativeHumidity=importepw.relativeHumidity,
    runIt=toggle_3)  # -> readMe, port, universalThermalClimateIndex, comfortableOrNot, thermalStress, conditionOfPerson, port_2, percentOfTimeComfortable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; plug-in component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
panel = Panel(outdoorcomfortcalculator.percentOfTimeComfortable)
panel_2 = Panel(outdoorcomfortcalculator.percentComfForShortPeriod)
panel_3 = Panel(outdoorcomfortcalculator.percentHeatStress)
panel_4 = Panel(outdoorcomfortcalculator.percentColdStress)

# ---- group: Without Radiation
outdoorcomfortcalculator_2 = Ladybug_OutdoorComfortCalculator(
    dryBulbTemperature=importepw.dryBulbTemperature,
    windSpeed_tenMeters=importepw.windSpeed,
    relativeHumidity=importepw.relativeHumidity,
    runIt=toggle_3)  # -> readMe, port, universalThermalClimateIndex, comfortableOrNot, thermalStress, conditionOfPerson, port_2, percentOfTimeComfortable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; plug-in component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
panel_5 = Panel(outdoorcomfortcalculator_2.percentOfTimeComfortable)
panel_6 = Panel(outdoorcomfortcalculator_2.percentComfForShortPeriod)
panel_7 = Panel(outdoorcomfortcalculator_2.percentHeatStress)
panel_8 = Panel(outdoorcomfortcalculator_2.percentColdStress)

# ---- group: Without Radiation and without Wind
outdoorcomfortcalculator_3 = Ladybug_OutdoorComfortCalculator(dryBulbTemperature=importepw.dryBulbTemperature, relativeHumidity=importepw.relativeHumidity, runIt=toggle_3)  # -> readMe, port, universalThermalClimateIndex, comfortableOrNot, thermalStress, conditionOfPerson, port_2, percentOfTimeComfortable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; plug-in component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
panel_9 = Panel(outdoorcomfortcalculator_3.percentOfTimeComfortable)
panel_10 = Panel(outdoorcomfortcalculator_3.percentComfForShortPeriod)
panel_11 = Panel(outdoorcomfortcalculator_3.percentColdStress)
panel_12 = Panel(outdoorcomfortcalculator_3.percentHeatStress)

# ---- group: Shading Design
col = Colour([ColourSwatch(SwatchColor=RGB(0, 0, 0)), ColourSwatch(SwatchColor=RGB(255, 255, 255))])
srf = Surface(<surface referenced from the Rhino model>)
testsrf = Surface(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)
bbox = BoundingBox(Content=testsrf, Plane=PlaneXY(0, 0, 0))  # -> Box, Box_2
box_corners = BoxCorners(Box=bbox.Box)  # -> CornerA, CornerB, CornerC, CornerD, CornerE, CornerF, CornerG, CornerH
legendpar = Ladybug_LegendParameters(customColors=reverse(flatten(col)), legendLocation=box_corners.CornerB)  # -> legendPar; plug-in component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
brep = Brep([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])
toggle_4 = BooleanToggle(True)
comfortshadebenefit = Ladybug_ComfortShadeBenefitEvaluator(
    location=importepw.location,
    temperatures=outdoorcomfortcalculator.universalThermalClimateIndex,
    testShades=testsrf,
    testRegion=srf,
    context=brep,
    north=northvec,
    delNonIntersect=toggle_4,
    legendPar=legendpar,
    runIt=toggle_4)  # -> readMe, port, sunVectors, regionTestPts, shadeMesh, legend, legendBasePoint, port_2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; plug-in component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
meshselector = Ladybug_MeshThresholdSelector(
    inputMesh=comfortshadebenefit.shadeMesh,
    analysisResult=flatten(comfortshadebenefit.shadeNetEffect),
    percentToKeep=Slider(15, range=0..100))  # -> readMe, totalValue, areaMeetsThresh, newColoredMesh, newMeshOutline; plug-in component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
crv = Curve(meshselector.newMeshOutline)
mesh = Mesh(comfortshadebenefit.shadeMesh)

# ---- group: Context Shading
series = Series(Start=0, Step=1, Count="24")
series_2 = Series(Start=0, Step=1, Count="31")
series_3 = Series(Start=0, Step=1, Count="12")
sunpath = Ladybug_SunPath(
    north=northvec,
    location=importepw.location,
    hour=series,
    day=series_2,
    month=series_3,
    timeStep=1,
    annualHourlyData=flatten(importepw.directNormalRadiation),
    dailyOrAnnualSunPath=True)  # -> readMe, sunVectors, sunAltitudes, sunAzimuths, port, sunSpheresMesh, sunPathCrvs, compassCrvs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; plug-in component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
debrep = DeconstructBrep(Brep=srf)  # -> Faces, Edges, Vertices
rev = Reverse(Vector=sunpath.sunVectors)
mesh_2 = Mesh(brep)
mjoin = MeshJoin(Meshes=flatten(mesh_2))
meshray = MeshRay(Mesh=mjoin, Point=debrep.Vertices, Direction=graft(rev))  # -> Point, Hit
lng = ListLength(List=debrep.Vertices)
ma = MassAddition(Input=meshray.Hit)  # -> flatten(Result), PartialResults
smaller = SmallerThan(FirstNumber=ma.Result, SecondNumber=lng)  # -> SmallerThan, OrEqualTo
dispatch = Dispatch(List=sunpath.selHourlyData, DispatchPattern=smaller.SmallerThan)  # -> ListA, ListB
dispatch_2 = Dispatch(List=sunpath.sunPositionsHOY, DispatchPattern=smaller.SmallerThan)  # -> ListA, ListB
series_4 = Series(Start=0, Step=0, Count="8760")
strnum = Ladybug_SeparateData(inputList=flatten(importepw.directNormalRadiation))  # -> numbers, strings; plug-in component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
replace = ReplaceItems(List=series_4, Item=dispatch.ListA, Indices=dispatch_2.ListA, Wrap=False)
ins = InsertItems(List=flatten(replace), Item=flatten(strnum.strings), Indices=flatten("0"), Wrap=False)

# ---- group: Wind Speed
strnum_2 = Ladybug_SeparateData(inputList=flatten(importepw.windSpeed))  # -> numbers, strings; plug-in component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

# ---- group: Wind Direction
strnum_3 = Ladybug_SeparateData(inputList=flatten(importepw.windDirection))  # -> numbers, strings; plug-in component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

# ----
line = LineSDL(Start=graft(debrep.Vertices), Direction=rev, Length=Slider(10, range=1..10))

# ---- group: Site Wind
lng_2 = ListLength(List=strnum_2.numbers)
series_5 = Series(Start=0, Step=0, Count=lng_2)
larger = LargerThan(FirstNumber=strnum_3.numbers, SecondNumber="180")  # -> LargerThan, OrEqualTo
smaller_2 = SmallerThan(FirstNumber=strnum_3.numbers, SecondNumber="250")  # -> SmallerThan, OrEqualTo
larger_2 = LargerThan(FirstNumber=strnum_3.numbers, SecondNumber="300")  # -> LargerThan, OrEqualTo
smaller_3 = SmallerThan(FirstNumber=strnum_3.numbers, SecondNumber="360")  # -> SmallerThan, OrEqualTo
and = GateAnd(A=larger.LargerThan, B=smaller_2.SmallerThan)
and_2 = GateAnd(A=larger_2.LargerThan, B=smaller_3.SmallerThan)
or = GateOr(A=and, B=and_2)
p_n_c = PickNChoose(Pattern=or, Stream0=series_5, Stream1=strnum_2.numbers)

# ---- group: With Site Radiation and with Site Wind
solaradjusttemperature_2 = Ladybug_OutdoorSolarTemperatureAdjustor(
    location=importepw.location,
    cumSkyMtxOrDirNormRad=ins,
    diffuseHorizRad=importepw.diffuseHorizontalRadiation,
    baseTemperature=importepw.dryBulbTemperature,
    baseDryBulbOrMRT=toggle,
    horizInfraredRad=importepw.horizontalInfraredRadiation,
    contextShading=brep,
    north=northvec,
    runIt=toggle_2)  # -> readMe, port, effectiveRadiantField, MRTDelta, solarAdjustedMRT, port_2, mannequinMesh, port_3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; plug-in component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
outdoorcomfortcalculator_4 = Ladybug_OutdoorComfortCalculator(
    dryBulbTemperature=importepw.dryBulbTemperature,
    meanRadiantTemperature=solaradjusttemperature_2.solarAdjustedMRT,
    windSpeed_tenMeters=p_n_c,
    relativeHumidity=importepw.relativeHumidity,
    runIt=toggle_3)  # -> readMe, port, universalThermalClimateIndex, comfortableOrNot, thermalStress, conditionOfPerson, port_2, percentOfTimeComfortable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; plug-in component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
panel_13 = Panel(outdoorcomfortcalculator_4.percentComfForShortPeriod)
panel_14 = Panel(outdoorcomfortcalculator_4.percentColdStress)
panel_15 = Panel(outdoorcomfortcalculator_4.percentOfTimeComfortable)
panel_16 = Panel(outdoorcomfortcalculator_4.percentHeatStress)

# ---- group: Without Radiation and with Site Wind
outdoorcomfortcalculator_5 = Ladybug_OutdoorComfortCalculator(
    dryBulbTemperature=importepw.dryBulbTemperature,
    windSpeed_tenMeters=p_n_c,
    relativeHumidity=importepw.relativeHumidity,
    runIt=toggle_3)  # -> readMe, port, universalThermalClimateIndex, comfortableOrNot, thermalStress, conditionOfPerson, port_2, percentOfTimeComfortable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; plug-in component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
panel_17 = Panel(outdoorcomfortcalculator_5.percentComfForShortPeriod)
panel_18 = Panel(outdoorcomfortcalculator_5.percentColdStress)
panel_19 = Panel(outdoorcomfortcalculator_5.percentOfTimeComfortable)
panel_20 = Panel(outdoorcomfortcalculator_5.percentHeatStress)

# ---- group: With Radiation and with Site Wind
outdoorcomfortcalculator_6 = Ladybug_OutdoorComfortCalculator(
    dryBulbTemperature=importepw.dryBulbTemperature,
    meanRadiantTemperature=solaradjusttemperature.solarAdjustedMRT,
    windSpeed_tenMeters=p_n_c,
    relativeHumidity=importepw.relativeHumidity,
    runIt=toggle_3)  # -> readMe, port, universalThermalClimateIndex, comfortableOrNot, thermalStress, conditionOfPerson, port_2, percentOfTimeComfortable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; plug-in component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
panel_21 = Panel(outdoorcomfortcalculator_6.percentComfForShortPeriod)
panel_22 = Panel(outdoorcomfortcalculator_6.percentColdStress)
panel_23 = Panel(outdoorcomfortcalculator_6.percentOfTimeComfortable)
panel_24 = Panel(outdoorcomfortcalculator_6.percentHeatStress)

# ----
boundary = BoundarySurfaces(Edges=crv)

# ---- group: Shading Device Shading
series_6 = Series(Start=0, Step=1, Count="24")
series_7 = Series(Start=0, Step=1, Count="31")
series_8 = Series(Start=0, Step=1, Count="12")
sunpath_2 = Ladybug_SunPath(
    north=northvec,
    location=importepw.location,
    hour=series_6,
    day=series_7,
    month=series_8,
    timeStep=1,
    annualHourlyData=flatten(importepw.directNormalRadiation),
    dailyOrAnnualSunPath=True)  # -> readMe, sunVectors, sunAltitudes, sunAzimuths, port, sunSpheresMesh, sunPathCrvs, compassCrvs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; plug-in component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
debrep_2 = DeconstructBrep(Brep=srf)  # -> Faces, Edges, Vertices
rev_2 = Reverse(Vector=sunpath_2.sunVectors)
mesh_3 = Mesh([brep, boundary])
mjoin_2 = MeshJoin(Meshes=flatten(mesh_3))
meshray_2 = MeshRay(Mesh=mjoin_2, Point=debrep_2.Vertices, Direction=graft(rev_2))  # -> Point, Hit
lng_3 = ListLength(List=debrep_2.Vertices)
ma_2 = MassAddition(Input=meshray_2.Hit)  # -> flatten(Result), PartialResults
smaller_4 = SmallerThan(FirstNumber=ma_2.Result, SecondNumber=lng_3)  # -> SmallerThan, OrEqualTo
dispatch_3 = Dispatch(List=sunpath_2.selHourlyData, DispatchPattern=smaller_4.SmallerThan)  # -> ListA, ListB
dispatch_4 = Dispatch(List=sunpath_2.sunPositionsHOY, DispatchPattern=smaller_4.SmallerThan)  # -> ListA, ListB
series_9 = Series(Start=0, Step=0, Count="8760")
strnum_4 = Ladybug_SeparateData(inputList=flatten(importepw.directNormalRadiation))  # -> numbers, strings; plug-in component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
replace_2 = ReplaceItems(List=series_9, Item=dispatch_3.ListA, Indices=dispatch_4.ListA, Wrap=False)
ins_2 = InsertItems(List=flatten(replace_2), Item=flatten(strnum_4.strings), Indices=flatten("0"), Wrap=False)

# ---- group: With Site Radiation, Designed Shading and with Site Wind
solaradjusttemperature_3 = Ladybug_OutdoorSolarTemperatureAdjustor(
    location=importepw.location,
    cumSkyMtxOrDirNormRad=ins_2,
    diffuseHorizRad=importepw.diffuseHorizontalRadiation,
    baseTemperature=importepw.dryBulbTemperature,
    baseDryBulbOrMRT=toggle,
    horizInfraredRad=importepw.horizontalInfraredRadiation,
    north=northvec,
    runIt=toggle_2)  # -> readMe, port, effectiveRadiantField, MRTDelta, solarAdjustedMRT, port_2, mannequinMesh, port_3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; plug-in component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
outdoorcomfortcalculator_7 = Ladybug_OutdoorComfortCalculator(
    dryBulbTemperature=importepw.dryBulbTemperature,
    meanRadiantTemperature=solaradjusttemperature_3.solarAdjustedMRT,
    windSpeed_tenMeters=p_n_c,
    relativeHumidity=importepw.relativeHumidity,
    runIt=toggle_3)  # -> readMe, port, universalThermalClimateIndex, comfortableOrNot, thermalStress, conditionOfPerson, port_2, percentOfTimeComfortable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; plug-in component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
panel_25 = Panel(outdoorcomfortcalculator_7.percentComfForShortPeriod)
panel_26 = Panel(outdoorcomfortcalculator_7.percentColdStress)
panel_27 = Panel(outdoorcomfortcalculator_7.percentOfTimeComfortable)
panel_28 = Panel(outdoorcomfortcalculator_7.percentHeatStress)

# ----
panel_29 = Panel(ma_2.Result)
sort = SortList(Keys=panel_29)  # -> Keys, ValuesA

# ---- group: Charts
bbox_2 = BoundingBox(Content=comfortshadebenefit.legend, Plane=PlaneXY(0, 0, 0), UnionBox=True)  # -> Box, Box_2
col_2 = Colour([ColourSwatch(SwatchColor=RGB(255, 0, 0)), ColourSwatch(SwatchColor=RGB(255, 255, 255)), ColourSwatch(SwatchColor=RGB(0, 130, 255))])
box_corners_2 = BoxCorners(Box=bbox_2.Box)  # -> CornerA, CornerB, CornerC, CornerD, CornerE, CornerF, CornerG, CornerH
legendpar_2 = Ladybug_LegendParameters(numSegments="7", customColors=reverse(flatten(col_2)))  # -> legendPar; plug-in component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
pdecon = Deconstruct(Point=box_corners_2.CornerB)  # -> XComponent, YComponent, ZComponent
addition = Addition(A="5", B=pdecon.XComponent)
pt = ConstructPoint(XCoordinate=addition, YCoordinate=pdecon.YComponent, ZCoordinate=pdecon.ZComponent)
_3dchart = Ladybug_3DChart(
    inputData=flatten([outdoorcomfortcalculator_2.conditionOfPerson, outdoorcomfortcalculator.conditionOfPerson, outdoorcomfortcalculator_4.conditionOfPerson, outdoorcomfortcalculator_7.conditionOfPerson]),
    basePoint=pt,
    xScale=".05",
    yScale=".1",
    zScale="0",
    legendPar=legendpar_2)  # -> readMe, graphMesh, graphCurves, legend, legendBasePts, title, titleBasePts, dataPts, conditionalHOY; plug-in component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

# ----
panel_30 = Panel(sort.Keys)
bbox_3 = BoundingBox(Content=_3dchart.legend, Plane=PlaneXY(0, 0, 0), UnionBox=True)  # -> Box, Box_2
box_corners_3 = BoxCorners(Box=bbox_3.Box)  # -> CornerA, CornerB, CornerC, CornerD, CornerE, CornerF, CornerG, CornerH
item = ListItem(List=flatten(box_corners_3.CornerD), Index=0, Wrap=True)
item_2 = ListItem(List=flatten(box_corners_3.CornerD), Index=1, Wrap=True)
item_3 = ListItem(List=flatten(box_corners_3.CornerD), Index=2, Wrap=True)
item_4 = ListItem(List=flatten(box_corners_3.CornerD), Index=3, Wrap=True)
pdecon_2 = Deconstruct(Point=item)  # -> XComponent, YComponent, ZComponent
pdecon_3 = Deconstruct(Point=item_2)  # -> XComponent, YComponent, ZComponent
pdecon_4 = Deconstruct(Point=item_3)  # -> XComponent, YComponent, ZComponent
pdecon_5 = Deconstruct(Point=item_4)  # -> XComponent, YComponent, ZComponent
panel_31 = Panel("% Time Comfortable with Context Shading of Radiation & Wind: ")
addition_2 = Addition(A=pdecon_2.YComponent, B=".5")
addition_3 = Addition(A=pdecon_3.YComponent, B=".5")
addition_4 = Addition(A=pdecon_4.YComponent, B="1")
addition_5 = Addition(A=pdecon_5.YComponent, B=".5")
txt = Text(outdoorcomfortcalculator_2.percentOfTimeComfortable)
txt_2 = Text(outdoorcomfortcalculator.percentOfTimeComfortable)
txt_3 = Text(outdoorcomfortcalculator_4.conditionOfPerson)
txt_4 = Text(outdoorcomfortcalculator_7.percentOfTimeComfortable)
pt_2 = ConstructPoint(XCoordinate=pdecon_2.XComponent, YCoordinate=addition_2, ZCoordinate=pdecon_2.ZComponent)
pt_3 = ConstructPoint(XCoordinate=pdecon_3.XComponent, YCoordinate=addition_3, ZCoordinate=pdecon_3.ZComponent)
pt_4 = ConstructPoint(XCoordinate=pdecon_4.XComponent, YCoordinate=addition_4, ZCoordinate=pdecon_4.ZComponent)
pt_5 = ConstructPoint(XCoordinate=pdecon_5.XComponent, YCoordinate=addition_5, ZCoordinate=pdecon_5.ZComponent)
concat = Concatenate(FragmentA="% Time Comfortable Fully Shaded: ", FragmentB=txt)
concat_2 = Concatenate(FragmentA="% Time Comfortable in an Open Field: ", FragmentB=txt_2)
concat_3 = Concatenate(FragmentA=panel_31, FragmentB=txt_3)
concat_4 = Concatenate(FragmentA="% Time Comfortable with Designed Shading Device:", FragmentB=txt_4)
tag = TextTag3D(Location=pt_2, Text=concat, Size=1, Colour=ColourSwatch(SwatchColor=RGB(0, 0, 0)), Justification=7)
tag_2 = TextTag3D(Location=pt_3, Text=concat_2, Size=1, Colour=ColourSwatch(SwatchColor=RGB(0, 0, 0)), Justification=7)
tag_3 = TextTag3D(Location=pt_4, Text=concat_3, Size=1, Colour=ColourSwatch(SwatchColor=RGB(0, 0, 0)), Justification=7)
tag_4 = TextTag3D(Location=pt_5, Text=concat_4, Size=1, Colour=ColourSwatch(SwatchColor=RGB(0, 0, 0)), Justification=7)
