# Grasshopper definition kennedy_kirin.gh (Grasshopper 0.9.76)
# plug-ins: Python Interpreter

panel = Panel("https://www.energyplus.net/weather-download/north_and_central_america_wmo_region_4/USA/PA/USA_PA_Philadelphia.Intl.AP.724080_TMY3/all")
ladybug = Ladybug_Ladybug()  # -> Vviiiiiiiiiizzz; plug-in component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
epw_stat = Ladybug_OpenEPWAndSTATWeatherFiles(weatherFileURL=panel)  # -> epwFile, statFile; plug-in component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
importepw = Ladybug_ImportEpw(epwFile=epw_stat.epwFile)  # -> readMe, latitude, location, dryBulbTemperature, dewPointTemperature, relativeHumidity, windSpeed, windDirection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; plug-in component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
legendpar = Ladybug_LegendParameters(numSegments=Slider(2, range=0..10))  # -> legendPar; plug-in component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
panel_2 = Panel("""7
14
21
28""")
toggle = BooleanToggle(True)
context_meyerson = Brep([<brep referenced from the Rhino model> x661])
series = Series(Start="1", Step=1, Count="24")
series_2 = Series(Start="1", Step=1, Count="12")
solaradjusttemperature = Ladybug_OutdoorSolarTemperatureAdjustor(
    location=importepw.location,
    cumSkyMtxOrDirNormRad=importepw.directNormalRadiation,
    diffuseHorizRad=importepw.diffuseHorizontalRadiation,
    baseTemperature=importepw.dryBulbTemperature,
    horizInfraredRad=importepw.horizontalInfraredRadiation,
    contextShading=context_meyerson,
    parallel=toggle,
    runIt=toggle)  # -> readMe, port, effectiveRadiantField, MRTDelta, solarAdjustedMRT, port_2, mannequinMesh, port_3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; plug-in component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
toggle_2 = BooleanToggle(True)
outdoorcomfortcalculator = Ladybug_OutdoorComfortCalculator(
    dryBulbTemperature=importepw.dryBulbTemperature,
    meanRadiantTemperature=solaradjusttemperature.solarAdjustedMRT,
    windSpeed_tenMeters=importepw.windSpeed,
    relativeHumidity=importepw.relativeHumidity,
    runIt=toggle_2)  # -> readMe, port, universalThermalClimateIndex, comfortableOrNot, thermalStress, conditionOfPerson, port_2, percentOfTimeComfortable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; plug-in component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
sunpath = Ladybug_SunPath(
    location=importepw.location,
    hour=series,
    day=panel_2,
    month=series_2,
    timeStep=1,
    annualHourlyData=flatten(outdoorcomfortcalculator.conditionOfPerson),
    conditionalStatement="a > 1",
    legendPar=legendpar,
    dailyOrAnnualSunPath=True)  # -> readMe, sunVectors, sunAltitudes, sunAzimuths, port, sunSpheresMesh, sunPathCrvs, compassCrvs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; plug-in component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
rev = Reverse(Vector=sunpath.sunVectors)
brep = Brep(<brep referenced from the Rhino model>)
intersection_plane = Brep(<brep referenced from the Rhino model>)
amp = Amplitude(Vector=rev, Amplitude=Slider(30, range=0..100))
debrep = DeconstructBrep(Brep=brep)  # -> Faces, Edges, Vertices
graft = GraftTree(Tree=debrep.Vertices, IncludeEmptyLists=True, IncludeNullItems=True)
meshray = MeshRay(Mesh=intersection_plane, Point=graft, Direction=rev)  # -> Point, Hit
vdis = VectorDisplay(Anchor=graft, Vector=amp)
panel_3 = Panel(outdoorcomfortcalculator.percentOfTimeComfortable)
panel_4 = Panel(outdoorcomfortcalculator.percentHeatStress)
panel_5 = Panel(outdoorcomfortcalculator.percentColdStress)
del = DelaunayMesh(Points=meshray.Point, Plane=intersection_plane)
brep_2 = Brep(<brep referenced from the Rhino model>)
patio = Brep(<brep referenced from the Rhino model>)
preview = CustomPreview(
    Geometry=del,
    Shader={ambient=RGB(0, 0, 0), diffuse=RGB(255, 105, 180), emission=RGB(76, 32, 54), shine=0.5, specular=RGB(255, 255, 255), transparency=0})
quad = Quadrangulate(Mesh=del, Angle=0.03490658504, Ratio=0.875)  # -> Mesh, Count
comfortshadebenefit = Ladybug_ComfortShadeBenefitEvaluator(
    location=importepw.location,
    temperatures=outdoorcomfortcalculator.universalThermalClimateIndex,
    testShades=flatten(brep_2),
    testRegion=patio,
    context=context_meyerson,
    delNonIntersect=False,
    runIt=Toggle(True))  # -> readMe, port, sunVectors, regionTestPts, shadeMesh, legend, legendBasePoint, port_2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; plug-in component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
meshselector = Ladybug_MeshThresholdSelector(inputMesh=comfortshadebenefit.shadeMesh, analysisResult=comfortshadebenefit.shadeNetEffect, levelOfPerform="0")  # -> readMe, totalValue, areaMeetsThresh, newColoredMesh, newMeshOutline; plug-in component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
solaradjusttemperature_2 = Ladybug_OutdoorSolarTemperatureAdjustor(
    location=importepw.location,
    cumSkyMtxOrDirNormRad=importepw.directNormalRadiation,
    diffuseHorizRad=importepw.diffuseHorizontalRadiation,
    baseTemperature=importepw.dryBulbTemperature,
    horizInfraredRad=importepw.horizontalInfraredRadiation,
    contextShading=flatten([context_meyerson, meshselector.newColoredMesh]),
    parallel=toggle,
    runIt=toggle)  # -> readMe, port, effectiveRadiantField, MRTDelta, solarAdjustedMRT, port_2, mannequinMesh, port_3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; plug-in component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
preview_2 = CustomPreview(
    Geometry=meshselector.newColoredMesh,
    Shader={ambient=RGB(0, 0, 0), diffuse=RGB(255, 105, 180), emission=RGB(76, 32, 54), shine=0.5, specular=RGB(255, 255, 255), transparency=0})
outdoorcomfortcalculator_2 = Ladybug_OutdoorComfortCalculator(
    dryBulbTemperature=importepw.dryBulbTemperature,
    meanRadiantTemperature=solaradjusttemperature_2.solarAdjustedMRT,
    windSpeed_tenMeters=importepw.windSpeed,
    relativeHumidity=importepw.relativeHumidity,
    runIt=toggle_2)  # -> readMe, port, universalThermalClimateIndex, comfortableOrNot, thermalStress, conditionOfPerson, port_2, percentOfTimeComfortable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; plug-in component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
legendpar_2 = Ladybug_LegendParameters(numSegments=Slider(7, range=0..10))  # -> legendPar; plug-in component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
panel_6 = Panel(outdoorcomfortcalculator_2.percentOfTimeComfortable)
_3dchart = Ladybug_3DChart(
    inputData=flatten([outdoorcomfortcalculator.conditionOfPerson, outdoorcomfortcalculator_2.conditionOfPerson]),
    basePoint="2000, 2000",
    xScale=".5",
    legendPar=legendpar_2)  # -> readMe, graphMesh, graphCurves, legend, legendBasePts, title, titleBasePts, dataPts, conditionalHOY; plug-in component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
panel_7 = Panel(outdoorcomfortcalculator_2.percentHeatStress)
panel_8 = Panel(outdoorcomfortcalculator_2.percentColdStress)
