# Grasshopper definition li_yunqian.gh (Grasshopper 0.9.76)
# plug-ins: Python Interpreter

ladybug = Ladybug_Ladybug()  # -> Vviiiiiiiiiizzz; plug-in component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
path = FilePath("C:\Users\Yunqian\Desktop\Course Fall2017\Building Performance Sim\Philadelphia_weather_files\USA_PA_Philadelphia.Intl.AP.724080_TMY3.epw")
importepw = Ladybug_ImportEpw(epwFile=path)  # -> readMe, latitude, location, dryBulbTemperature, dewPointTemperature, relativeHumidity, windSpeed, windDirection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; plug-in component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
pt = Point(Point(-48.87264727, 380.3107045, -257.2096947))
brep = Brep([<brep referenced from the Rhino model> x3])
brep_2 = Brep([<brep referenced from the Rhino model> x2])
pt_2 = Point(Point(-48.87264727, 380.3107045, -257.2096947))
pt_3 = Point(Point(-48.87264727, 380.3107045, -257.2096947))
solaradjusttemperature = Ladybug_OutdoorSolarTemperatureAdjustor(
    location=importepw.location,
    cumSkyMtxOrDirNormRad=importepw.directNormalRadiation,
    diffuseHorizRad=importepw.diffuseHorizontalRadiation,
    baseTemperature=importepw.dryBulbTemperature,
    horizInfraredRad=importepw.horizontalInfraredRadiation,
    bodyPosture=Slider(1, range=0..2),
    bodyLocation=pt,
    runIt=Toggle(True))  # -> readMe, port, effectiveRadiantField, MRTDelta, solarAdjustedMRT, port_2, mannequinMesh, port_3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; plug-in component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
solaradjusttemperature_2 = Ladybug_OutdoorSolarTemperatureAdjustor(
    location=importepw.location,
    cumSkyMtxOrDirNormRad=importepw.directNormalRadiation,
    diffuseHorizRad=importepw.diffuseHorizontalRadiation,
    baseTemperature=importepw.dryBulbTemperature,
    horizInfraredRad=importepw.horizontalInfraredRadiation,
    bodyPosture=Slider(1, range=0..2),
    bodyLocation=pt_2,
    contextShading=brep,
    runIt=Toggle(True))  # -> readMe, port, effectiveRadiantField, MRTDelta, solarAdjustedMRT, port_2, mannequinMesh, port_3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; plug-in component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
solaradjusttemperature_3 = Ladybug_OutdoorSolarTemperatureAdjustor(
    location=importepw.location,
    cumSkyMtxOrDirNormRad=importepw.directNormalRadiation,
    diffuseHorizRad=importepw.diffuseHorizontalRadiation,
    baseTemperature=importepw.dryBulbTemperature,
    horizInfraredRad=importepw.horizontalInfraredRadiation,
    bodyPosture=Slider(1, range=0..2),
    rotationAngle=Slider(70, range=0..180),
    bodyLocation=pt_3,
    contextShading=brep_2,
    runIt=Toggle(True))  # -> readMe, port, effectiveRadiantField, MRTDelta, solarAdjustedMRT, port_2, mannequinMesh, port_3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; plug-in component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
outdoorcomfortcalculator = Ladybug_OutdoorComfortCalculator(
    dryBulbTemperature=importepw.dryBulbTemperature,
    windSpeed_tenMeters=importepw.windSpeed,
    relativeHumidity=importepw.relativeHumidity,
    runIt=Toggle(True))  # -> readMe, port, universalThermalClimateIndex, comfortableOrNot, thermalStress, conditionOfPerson, port_2, percentOfTimeComfortable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; plug-in component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
outdoorcomfortcalculator_2 = Ladybug_OutdoorComfortCalculator(
    dryBulbTemperature=importepw.dryBulbTemperature,
    meanRadiantTemperature=solaradjusttemperature.solarAdjustedMRT,
    windSpeed_tenMeters=importepw.windSpeed,
    relativeHumidity=importepw.relativeHumidity,
    runIt=Toggle(True))  # -> readMe, port, universalThermalClimateIndex, comfortableOrNot, thermalStress, conditionOfPerson, port_2, percentOfTimeComfortable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; plug-in component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
outdoorcomfortcalculator_3 = Ladybug_OutdoorComfortCalculator(
    dryBulbTemperature=importepw.dryBulbTemperature,
    meanRadiantTemperature=solaradjusttemperature_2.solarAdjustedMRT,
    windSpeed_tenMeters=importepw.windSpeed,
    relativeHumidity=importepw.relativeHumidity,
    runIt=Toggle(True))  # -> readMe, port, universalThermalClimateIndex, comfortableOrNot, thermalStress, conditionOfPerson, port_2, percentOfTimeComfortable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; plug-in component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
outdoorcomfortcalculator_4 = Ladybug_OutdoorComfortCalculator(
    dryBulbTemperature=importepw.dryBulbTemperature,
    meanRadiantTemperature=solaradjusttemperature_3.solarAdjustedMRT,
    windSpeed_tenMeters=importepw.windSpeed,
    relativeHumidity=importepw.relativeHumidity,
    runIt=Toggle(True))  # -> readMe, port, universalThermalClimateIndex, comfortableOrNot, thermalStress, conditionOfPerson, port_2, percentOfTimeComfortable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; plug-in component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
panel = Panel(outdoorcomfortcalculator.percentOfTimeComfortable)
panel_2 = Panel(outdoorcomfortcalculator_2.percentOfTimeComfortable)
panel_3 = Panel(outdoorcomfortcalculator_3.percentOfTimeComfortable)
panel_4 = Panel(outdoorcomfortcalculator_4.percentOfTimeComfortable)
pt_4 = Point(Point(88.47226712, 166.2122937, 0))
brep_3 = Brep([<brep referenced from the Rhino model> x2])
_3dchart = Ladybug_3DChart(
    inputData=flatten([outdoorcomfortcalculator.conditionOfPerson, outdoorcomfortcalculator_2.conditionOfPerson, outdoorcomfortcalculator_4.conditionOfPerson, outdoorcomfortcalculator_3.conditionOfPerson]),
    basePoint=pt_4,
    xScale="0.25",
    zScale="0")  # -> readMe, graphMesh, graphCurves, legend, legendBasePts, title, titleBasePts, dataPts, conditionalHOY; plug-in component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
brep_4 = Brep(<brep referenced from the Rhino model>)
brep_5 = Brep([<brep referenced from the Rhino model> x3])
comfortshadebenefit = Ladybug_ComfortShadeBenefitEvaluator(
    location=importepw.location,
    temperatures=outdoorcomfortcalculator_2.universalThermalClimateIndex,
    testShades=brep_4,
    testRegion=brep_5,
    gridSize="1",
    context=brep_3,
    skyResolution="7",
    delNonIntersect=False,
    parallel=Toggle(True),
    runIt=Toggle(True))  # -> readMe, port, sunVectors, regionTestPts, shadeMesh, legend, legendBasePoint, port_2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; plug-in component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
preview = CustomPreview(Geometry=[_3dchart.graphCurves, _3dchart.legend], Shader=ColourSwatch(SwatchColor=RGB(0, 0, 0)))
