# Grasshopper definition ma_xiaoyu.gh (Grasshopper 0.9.76)
# plug-ins: Python Interpreter

ladybug = Ladybug_Ladybug()  # -> Vviiiiiiiiiizzz; plug-in component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
open_weather_file = Ladybug_OpenEPWWeatherFile(open=Toggle(True))  # -> epwFile; plug-in component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
importepw = Ladybug_ImportEpw(epwFile=open_weather_file)  # -> readMe, latitude, location, dryBulbTemperature, dewPointTemperature, relativeHumidity, windSpeed, windDirection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; plug-in component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
pt = Point([Point(-22.198125, 4.320482689, 1.5), Point(-22.198125, 3.693013584, 1.5), Point(-22.198125, 3.02875, 1.5), Point(-22.198125, 2.362058359, 1.5), Point(-22.198125, 1.691232731, 1.5), Point(-21.698125, 1.691232731, 1.5), Point(-21.698125, 2.356121963, 1.5), Point(-21.698125, 3.02875, 1.5), Point(-21.698125, 3.516802172, 1.5), Point(-21.698125, 4.367808023, 1.5), Point(-16.198125, 4.367808023, 1.5), Point(-15.698125, 4.367808023, 1.5), Point(-15.698125, 3.691091797, 1.5), Point(-16.198125, 3.691091797, 1.5), Point(-16.198125, 3.02875, 1.5), Point(-15.698125, 3.02875, 1.5), Point(-15.698125, 2.369465621, 1.5), Point(-16.198125, 2.369465621, 1.5), Point(-16.198125, 1.726237691, 1.5), Point(-15.698125, 1.726237691, 1.5)])
solaradjusttemperature = Ladybug_OutdoorSolarTemperatureAdjustor(
    location=importepw.location,
    cumSkyMtxOrDirNormRad=importepw.directNormalRadiation,
    diffuseHorizRad=importepw.diffuseHorizontalRadiation,
    baseTemperature=importepw.dryBulbTemperature,
    horizInfraredRad=importepw.horizontalInfraredRadiation,
    bodyPosture=Slider(1, range=0..2),
    rotationAngle=Slider(70, range=0..180),
    bodyLocation=pt,
    runIt=Toggle(True))  # -> readMe, port, effectiveRadiantField, MRTDelta, solarAdjustedMRT, port_2, mannequinMesh, port_3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; plug-in component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
outdoorcomfortcalculator = Ladybug_OutdoorComfortCalculator(
    dryBulbTemperature=importepw.dryBulbTemperature,
    meanRadiantTemperature=solaradjusttemperature.solarAdjustedMRT,
    windSpeed_tenMeters=importepw.windSpeed,
    relativeHumidity=importepw.relativeHumidity,
    runIt=Toggle(True))  # -> readMe, port, universalThermalClimateIndex, comfortableOrNot, thermalStress, conditionOfPerson, port_2, percentOfTimeComfortable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; plug-in component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
outdoorcomfortcalculator_2 = Ladybug_OutdoorComfortCalculator(
    dryBulbTemperature=importepw.dryBulbTemperature,
    windSpeed_tenMeters=importepw.windSpeed,
    relativeHumidity=importepw.relativeHumidity,
    runIt=Toggle(True))  # -> readMe, port, universalThermalClimateIndex, comfortableOrNot, thermalStress, conditionOfPerson, port_2, percentOfTimeComfortable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; plug-in component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
pt_2 = Point(Point(88.47226712, 166.2122937, 0))
busstop_shade = Brep(<brep referenced from the Rhino model>)
busstop_seat = Brep([<brep referenced from the Rhino model> x2])
_3dchart = Ladybug_3DChart(
    inputData=flatten([outdoorcomfortcalculator_2.conditionOfPerson, outdoorcomfortcalculator.conditionOfPerson]),
    basePoint=pt_2,
    xScale="0.25",
    zScale="0")  # -> readMe, graphMesh, graphCurves, legend, legendBasePts, title, titleBasePts, dataPts, conditionalHOY; plug-in component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
comfortshadebenefit = Ladybug_ComfortShadeBenefitEvaluator(
    location=importepw.location,
    temperatures=outdoorcomfortcalculator.universalThermalClimateIndex,
    testShades=busstop_shade,
    testRegion=busstop_seat,
    gridSize=".5",
    skyResolution="7",
    delNonIntersect=False,
    parallel=Toggle(True),
    runIt=Toggle(True))  # -> readMe, port, sunVectors, regionTestPts, shadeMesh, legend, legendBasePoint, port_2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; plug-in component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
meshselector = Ladybug_MeshThresholdSelector(inputMesh=comfortshadebenefit.shadeMesh, analysisResult=flatten(comfortshadebenefit.shadeNetEffect), percentToKeep="25")  # -> readMe, totalValue, areaMeetsThresh, newColoredMesh, newMeshOutline; plug-in component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
