# Grasshopper definition nelson_graham_sunpath_100917.gh (Grasshopper 0.9.76)
# plug-ins: Python Interpreter

ladybug = Ladybug_Ladybug(defaultFolder="c:\ladybug")  # -> Vviiiiiiiiiizzz; plug-in component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
constructlocation = Ladybug_ConstructLocation(locationName="Philadelpia", latitude="40.00754", longitude="-75.13387", timeZone="-5", elevation=0)  # -> location; plug-in component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
path = FilePath("C:\Users\Graham P Nelson\Documents\MEBD\Parametric Stuff MEBD\USA_PA_Philadelphia.Intl.AP.724080_TMY3\USA_PA_Philadelphia.Intl.AP.724080_TMY3.epw")
number_slider = Slider(12, range=1..12)
importepw = Ladybug_ImportEpw(epwFile=path)  # -> readMe, latitude, location, dryBulbTemperature, dewPointTemperature, relativeHumidity, windSpeed, windDirection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; plug-in component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
importlocation = Ladybug_ImportLocation(epwFile=path)  # -> location; plug-in component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
series = Series(Start="1", Step=1, Count="24")
series_2 = Series(Start="1", Step=1, Count="24")
sunpath = Ladybug_SunPath(
    location=importepw.location,
    hour=series,
    day=21,
    month=series_2,
    timeStep=1,
    conditionalStatement="a < 25",
    dailyOrAnnualSunPath=True)  # -> readMe, sunVectors, sunAltitudes, sunAzimuths, port, sunSpheresMesh, sunPathCrvs, legend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; plug-in component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
ln = Line(StartPoint=sunpath.sunPathCenPts, EndPoint=sunpath.sunPositions)
loft = Loft(Curves=ln, Options={Adjust=False, Closed=False, LoftEnds=0, LoftSimp=0, LoftType=0, Rebuild=10, Refit=0.01})
rev = Reverse(Vector=sunpath.sunVectors)
toggle = BooleanToggle(True)

brep = Brep(<brep referenced from the Rhino model>)
rev_2 = Reverse(Vector=sunpath.sunVectors)
debrep = DeconstructBrep(Brep=brep)  # -> Faces, Edges, Vertices
amp = Amplitude(Vector=rev_2, Amplitude=Slider(0.25, range=0..1))
graft = GraftTree(Tree=debrep.Vertices, IncludeEmptyLists=True, IncludeNullItems=True)
vdis = VectorDisplay(Anchor=graft, Vector=amp)
brep_2 = Brep(<brep referenced from the Rhino model>)
mesh = MeshBrep(
    Brep=brep_2,
    Settings={GridMaxCount=0, GridMinCount=16, JaggedSeams=False, MaxEdgeLength=0, MinEdgeLength=0.0001, MinTolerance=0, Refine=True, RefineAngle=0, RelativeTolerance=0.65, SimplePlanes=True, Tolerance=0})
meshray = MeshRay(Mesh=mesh, Point=graft, Direction=rev_2)  # -> Point, Hit
del = DelaunayMesh(Points=meshray.Point, Plane=PlaneXY(0, 0, 0))

brep_3 = Brep(<brep referenced from the Rhino model>)
panel = Panel("1")
shddesigner = Ladybug_ShadingDesigner(
    glzSrf=flatten(brep_3),
    depthOrVector=flatten(sunpath.sunVectors),
    numOfShds=Slider(1, range=0..1),
    runIt=Toggle(True),
    mergeVectors=False)  # -> readMe, shadingSrfs; plug-in component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
