# Grasshopper definition zhao_xiaoyu.gh (Grasshopper 0.9.76)
# plug-ins: Python Interpreter

ladybug = Ladybug_Ladybug()  # -> Vviiiiiiiiiizzz; plug-in component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
path = FilePath("K:\Dropbox\753 Building Performance Simulation\Philadelphia_weather_files\USA_PA_Philadelphia.Intl.AP.724080_TMY3.epw")
importepw = Ladybug_ImportEpw(epwFile=path)  # -> readMe, latitude, location, dryBulbTemperature, dewPointTemperature, relativeHumidity, windSpeed, windDirection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; plug-in component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
panel = Panel(ladybug)
solaradjusttemperature = Ladybug_OutdoorSolarTemperatureAdjustor(
    location=importepw.location,
    cumSkyMtxOrDirNormRad=importepw.directNormalRadiation,
    diffuseHorizRad=importepw.diffuseHorizontalRadiation,
    baseTemperature=importepw.dryBulbTemperature,
    horizInfraredRad=importepw.horizontalInfraredRadiation,
    runIt=Toggle(True))  # -> readMe, port, effectiveRadiantField, MRTDelta, solarAdjustedMRT, port_2, mannequinMesh, port_3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; plug-in component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
outdoorcomfortcalculator = Ladybug_OutdoorComfortCalculator(
    dryBulbTemperature=importepw.dryBulbTemperature,
    windSpeed_tenMeters=importepw.windSpeed,
    relativeHumidity=importepw.relativeHumidity,
    runIt=Toggle(True))  # -> readMe, port, universalThermalClimateIndex, comfortableOrNot, thermalStress, conditionOfPerson, port_2, percentOfTimeComfortable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; plug-in component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
outdoorcomfortcalculator_2 = Ladybug_OutdoorComfortCalculator(
    dryBulbTemperature=importepw.dryBulbTemperature,
    meanRadiantTemperature=solaradjusttemperature.MRTDelta,
    windSpeed_tenMeters=importepw.windSpeed,
    relativeHumidity=importepw.relativeHumidity,
    runIt=Toggle(True))  # -> readMe, port, universalThermalClimateIndex, comfortableOrNot, thermalStress, conditionOfPerson, port_2, percentOfTimeComfortable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; plug-in component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
brep = Brep(<brep referenced from the Rhino model>)
brep_2 = Brep([<brep referenced from the Rhino model> x2])
col = Colour([ColourSwatch(SwatchColor=RGB(36, 55, 112)), ColourSwatch(SwatchColor=RGB(255, 255, 255)), ColourSwatch(SwatchColor=RGB(240, 105, 128))])
comfortshadebenefit = Ladybug_ComfortShadeBenefitEvaluator(
    location=importepw.location,
    temperatures=importepw.dryBulbTemperature,
    testShades=brep,
    testRegion=brep_2,
    gridSize=".4",
    skyResolution="7",
    delNonIntersect=False,
    parallel=Toggle(True),
    runIt=Toggle(True))  # -> readMe, port, sunVectors, regionTestPts, shadeMesh, legend, legendBasePoint, port_2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; plug-in component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
legendpar = Ladybug_LegendParameters(lowBound="-3", highBound="3", numSegments="7", customColors=flatten(col))  # -> legendPar; plug-in component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
pt = Point(<point referenced from the Rhino model>)
_3dchart = Ladybug_3DChart(
    inputData=flatten([outdoorcomfortcalculator.conditionOfPerson, outdoorcomfortcalculator_2.conditionOfPerson]),
    basePoint=pt,
    xScale="0.3",
    zScale="0",
    legendPar=legendpar)  # -> readMe, graphMesh, graphCurves, legend, legendBasePts, title, titleBasePts, dataPts, conditionalHOY; plug-in component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
meshselector = Ladybug_MeshThresholdSelector(
    inputMesh=comfortshadebenefit.shadeMesh,
    analysisResult=flatten(comfortshadebenefit.shadeNetEffect),
    percentToKeep=Slider(55, range=0..100))  # -> readMe, totalValue, areaMeetsThresh, newColoredMesh, newMeshOutline; plug-in component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
preview = CustomPreview(Geometry=meshselector.newMeshOutline, Shader=ColourSwatch(SwatchColor=RGB(0, 0, 0)))
panel_2 = Panel(meshselector.totalValue)
panel_3 = Panel(meshselector.areaMeetsThresh)
