# Grasshopper definition chan_lokyunpriscilla.gh (Grasshopper 0.9.70)
# plug-ins: Python Interpreter

ladybug = Ladybug_Ladybug()  # -> Vviiiiiiiiiizzz; plug-in component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
honeybee = Honeybee_Honeybee()  # -> Vviiiiiiiiiizzz; plug-in component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
radopaquematerial = Honeybee_RadianceOpaqueMaterial(materialName="plastic_80", RReflectance="0.8", GReflectance="0.8", BReflectance="0.8", roughness=0.05, specularity=0)  # -> avrgRef, RADMaterial; plug-in component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
radglassmaterial = Honeybee_RadianceGlassMaterial(materialName="glass_80", RTransmittance="0.8", GTransmittance="0.8", BTransmittance="0.8", refractiveIndex=1.52)  # -> avrgTrans, RADMaterial; plug-in component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
panel = Panel(honeybee)

# ---- group: light shelf
brep = Brep([<brep referenced from the Rhino model> x9])

# ---- group: floor
brep_2 = Brep(<brep referenced from the Rhino model>)

# ---- group: ceiling
brep_3 = Brep(<brep referenced from the Rhino model>)

# ---- group: walls
brep_4 = Brep([<brep referenced from the Rhino model> x12])

# ---- group: Glass
brep_5 = Brep([<brep referenced from the Rhino model> x3])

# ----
createhbsrfs = Honeybee_createHBSrfs(geometry=brep, RADMaterial=radopaquematerial.RADMaterial)  # -> readMe, simplify(HBSurface); plug-in component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
createhbsrfs_2 = Honeybee_createHBSrfs(geometry=brep_5, RADMaterial=radglassmaterial.RADMaterial)  # -> readMe, simplify(HBSurface); plug-in component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
createhbsrfs_3 = Honeybee_createHBSrfs(geometry=[brep_4, brep_3, brep_2])  # -> readMe, simplify(HBSurface); plug-in component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
path = FilePath("C:\Users\Priscilla Chan\Documents\UPenn\Arch 753\USA_PA_Philadelphia.Intl.AP.724080_TMY3\USA_PA_Philadelphia.Intl.AP.724080_TMY3.epw")
wires = BrepWireframe(Brep=[createhbsrfs_2.HBSurface, createhbsrfs_3.HBSurface, createhbsrfs.HBSurface], Density=-1)
genclimatebasedsky = Honeybee_GenerateClimateBasedSky(weatherFile=path, month="12", day="21", hour="15")  # -> radiationValues, skyFilePath; plug-in component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
gentestpts = Honeybee_GenerateTestPoints(testGeometry=brep_2, gridSize="1", distBaseSrf="2.5")  # -> readMe, simplify(testPoints), simplify(ptsVectors), simplify(facesArea), simplify(mesh); plug-in component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
radparameters = Honeybee_RADParameters(quality=0, ab="3", ad="1024")  # -> readMe, radParameters; plug-in component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
panel_2 = Panel(genclimatebasedsky.skyFilePath)
gridbasedsimulation = Honeybee_GridBasedSimulation(
    skyFile=genclimatebasedsky.skyFilePath,
    testPoints=gentestpts.testPoints,
    ptsVectors=gentestpts.ptsVectors,
    radParameters=radparameters.radParameters)  # -> analysisRecipe; plug-in component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
panel_3 = Panel(radparameters.readMe)
toggle = BooleanToggle(False)
rundaylightanalysis = Honeybee_RunDaylightSimulation(
    HBObjects=flatten([createhbsrfs_2.HBSurface, createhbsrfs_3.HBSurface, createhbsrfs.HBSurface]),
    analysisRecipe=gridbasedsimulation,
    writeRad=toggle,
    runRad=toggle)  # -> readMe, analysisType, resultsUnit, results, testPts, resultFiles, radGeoFile, studyFolder, done; plug-in component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
legendpar = Ladybug_LegendParameters(lowBound="300", highBound="2000", decimalPlaces="0")  # -> legendPar; plug-in component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
panel_4 = Panel(rundaylightanalysis.results)
recolormesh = Ladybug_RecolorMesh(
    analysisResult=rundaylightanalysis.results,
    inputMesh=gentestpts.mesh,
    legendPar=legendpar,
    analysisTitle="Illuminance",
    legendTitle="lux",
    bakeIt=Toggle(False))  # -> readMe, newMesh, newLegend, legendBasePt, meshColors, legendColors; plug-in component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
