# Grasshopper definition farah_silmi.gh (Grasshopper 0.9.76)
# plug-ins: Python Interpreter

ladybug = Ladybug_Ladybug()  # -> Vviiiiiiiiiizzz; plug-in component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
honeybee = Honeybee_Honeybee()  # -> Vviiiiiiiiiizzz; plug-in component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

# ---- group: Brep floor
floor = Brep(<brep referenced from the Rhino model>)

# ---- group: Brep wall
wall = Brep(<brep referenced from the Rhino model>)

# ---- group: Brep ceiling
ceiling = Brep(<brep referenced from the Rhino model>)

# ----
shade = Brep([<brep referenced from the Rhino model> x13])
createhbsrfs = Honeybee_createHBSrfs(geometry=wall, srfType=Slider(0, range=0..6))  # -> readMe, simplify(HBSurface); plug-in component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
createhbsrfs_2 = Honeybee_createHBSrfs(geometry=ceiling, srfType=Slider(3, range=0..6))  # -> readMe, simplify(HBSurface); plug-in component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
createhbsrfs_3 = Honeybee_createHBSrfs(geometry=floor, srfType=Slider(2, range=0..6))  # -> readMe, simplify(HBSurface); plug-in component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
createhbsrfs_4 = Honeybee_createHBSrfs(geometry=shade, srfType=Slider(2, range=0..6))  # -> readMe, simplify(HBSurface); plug-in component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

# ---- group: Brep glass
glass = Brep(<brep referenced from the Rhino model>)

# ----
radglassmaterial = Honeybee_RadianceGlassMaterial(materialName="glas_60", RTransmittance=".6", GTransmittance=".6", BTransmittance=".6", refractiveIndex=1.52)  # -> avrgTrans, RADMaterial; plug-in component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
createhbsrfs_5 = Honeybee_createHBSrfs(geometry=glass, RADMaterial=radglassmaterial.RADMaterial)  # -> readMe, simplify(HBSurface); plug-in component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

wires = BrepWireframe(Brep=[createhbsrfs_5.HBSurface, createhbsrfs.HBSurface], Density=-1)

# ---- group: create sky
open_weather_file = Ladybug_OpenEPWWeatherFile(open=Toggle(True))  # -> epwFile; plug-in component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
genclimatebasedsky = Honeybee_GenerateClimateBasedSky(weatherFile=open_weather_file, month="12", day="21", hour="15")  # -> radiationValues, skyFilePath; plug-in component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

# ----
flip = Flip(Surface=floor)  # -> Surface, Result

radparameters = Honeybee_RADParameters(quality=0, ab="2")  # -> readMe, radParameters; plug-in component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

# ---- group: test points
gentestpts = Honeybee_GenerateTestPoints(testGeometry=flip.Surface, gridSize=".5", distBaseSrf=".75", moveTestMesh=True)  # -> readMe, simplify(testPoints), simplify(ptsVectors), simplify(facesArea), simplify(mesh); plug-in component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
gridbasedsimulation = Honeybee_GridBasedSimulation(
    skyFile=genclimatebasedsky.skyFilePath,
    testPoints=gentestpts.testPoints,
    ptsVectors=gentestpts.ptsVectors,
    simulationType=0,
    radParameters=radparameters.radParameters)  # -> analysisRecipe; plug-in component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

# ----
toggle = BooleanToggle(True)
rundaylightanalysis = Honeybee_RunDaylightSimulation(
    HBObjects=flatten([createhbsrfs_5.HBSurface, createhbsrfs.HBSurface, createhbsrfs_2.HBSurface, createhbsrfs_3.HBSurface, createhbsrfs_4.HBSurface]),
    analysisRecipe=gridbasedsimulation,
    writeRad=toggle,
    runRad=toggle,
    overwriteResults=True)  # -> readMe, analysisType, resultsUnit, results, testPts, resultFiles, radGeoFile, studyFolder, done; plug-in component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

legendpar = Ladybug_LegendParameters(lowBound="300", highBound="2000")  # -> legendPar; plug-in component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

recolormesh = Ladybug_RecolorMesh(analysisResult=rundaylightanalysis.results, inputMesh=gentestpts.mesh, legendPar=legendpar, legendTitle="lux")  # -> readMe, newMesh, newLegend, legendBasePt, meshColors, legendColors; plug-in component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
