# Grasshopper definition guarin_juan.gh (Grasshopper 0.9.76)
# plug-ins: Python Interpreter

ladybug = Ladybug_Ladybug()  # -> Vviiiiiiiiiizzz; plug-in component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
honeybee = Honeybee_Honeybee()  # -> Vviiiiiiiiiizzz; plug-in component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

# ---- group: glass
brep = Brep([<brep referenced from the Rhino model> x5])

# ---- group: walls
brep_2 = Brep([<brep referenced from the Rhino model> x94])

# ---- group: ceiling
brep_3 = Brep(<brep referenced from the Rhino model>)

# ---- group: floor
brep_4 = Brep(<brep referenced from the Rhino model>)

# ----
radglassmaterial = Honeybee_RadianceGlassMaterial(materialName="glass_60", RTransmittance="0.6", GTransmittance="0.6", BTransmittance="0.6", refractiveIndex=1.52)  # -> avrgTrans, RADMaterial; plug-in component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
createhbsrfs = Honeybee_createHBSrfs(geometry=brep, RADMaterial=radglassmaterial.RADMaterial)  # -> readMe, simplify(HBSurface); plug-in component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
createhbsrfs_2 = Honeybee_createHBSrfs(geometry=[brep_2, brep_3, brep_4])  # -> readMe, simplify(HBSurface); plug-in component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
wires = BrepWireframe(Brep=createhbsrfs.HBSurface, Density=createhbsrfs_2.HBSurface)
path = FilePath("E:\JDG\Documents\JDG\UPenn\1° Semester\Building Performance Simulation\Other\Weather Files\USA_OK_Oklahoma.City-Will.Rogers.World.AP.723530_TMY3.epw")

# ---- group: Honeybee General Standards CIE Sky
genstandardciesky = Honeybee_GenerateStandardCIESky(skyType=0)  # -> skyFilePath; plug-in component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

# ---- group: Honeybee General Climate Based Sky
genclimatebasedsky = Honeybee_GenerateClimateBasedSky(weatherFile=path, month="9", day="21", hour="9")  # -> radiationValues, skyFilePath; plug-in component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

# ----
gentestpts = Honeybee_GenerateTestPoints(testGeometry=brep_4, gridSize=".5", distBaseSrf="0.762", moveTestMesh=True)  # -> readMe, simplify(testPoints), simplify(ptsVectors), simplify(facesArea), simplify(mesh); plug-in component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
radparameters = Honeybee_RADParameters(quality=0, ab="5")  # -> readMe, radParameters; plug-in component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
gridbasedsimulation = Honeybee_GridBasedSimulation(
    skyFile=genclimatebasedsky.skyFilePath,
    testPoints=gentestpts.testPoints,
    ptsVectors=gentestpts.ptsVectors,
    simulationType=0,
    radParameters=radparameters.radParameters)  # -> analysisRecipe; plug-in component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
toggle = BooleanToggle(True)
brep_5 = Brep([<brep referenced from the Rhino model> x14])

# ---- group: Shading
createhbsrfs_3 = Honeybee_createHBSrfs(geometry=brep_5)  # -> readMe, simplify(HBSurface); plug-in component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

# ----
rundaylightanalysis = Honeybee_RunDaylightSimulation(
    HBObjects=flatten([createhbsrfs.HBSurface, createhbsrfs_2.HBSurface, createhbsrfs_3.HBSurface]),
    analysisRecipe=gridbasedsimulation,
    writeRad=toggle,
    runRad=toggle,
    overwriteResults=True)  # -> readMe, analysisType, resultsUnit, illuminance_values, testPts, illuminance_files, radGeoFile, studyFolder, done; plug-in component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
legendpar = Ladybug_LegendParameters(lowBound="0", highBound="4000")  # -> legendPar; plug-in component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
panel = Panel(rundaylightanalysis.illuminance_values)
recolormesh = Ladybug_RecolorMesh(
    analysisResult=rundaylightanalysis.illuminance_values,
    inputMesh=gentestpts.mesh,
    legendPar=legendpar,
    analysisTitle="Daylight Analysis",
    legendTitle="lux")  # -> readMe, newMesh, newLegend, legendBasePt, meshColors, legendColors; plug-in component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
