# Grasshopper definition gupta_naman.gh (Grasshopper 0.9.76)
# plug-ins: Python Interpreter

floor = Brep(<brep referenced from the Rhino model>)

# ---- group: CEILING
brep = Brep(<brep referenced from the Rhino model>)

# ---- group: WALL
brep_2 = Brep([<brep referenced from the Rhino model> x8])

# ----
brep_3 = Brep([<brep referenced from the Rhino model> x5])
createhbsrfs = Honeybee_createHBSrfs(geometry=brep_3, srfType="6")  # -> readMe, simplify(HBSurface); plug-in component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
radopaquematerial = Honeybee_RadianceOpaqueMaterial(materialName="CEILING_80", RReflectance=".8", GReflectance=".8", BReflectance=".8", roughness=0.05, specularity=0)  # -> avrgRef, RADMaterial; plug-in component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
radopaquematerial_2 = Honeybee_RadianceOpaqueMaterial(materialName="FLOOR_20", RReflectance=".2", GReflectance=".2", BReflectance=".2", roughness=0.05, specularity=0)  # -> avrgRef, RADMaterial; plug-in component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
radopaquematerial_3 = Honeybee_RadianceOpaqueMaterial(materialName="WALL_50", RReflectance=".5", GReflectance=".5", BReflectance=".5", roughness=0.05, specularity=0)  # -> avrgRef, RADMaterial; plug-in component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
createhbsrfs_2 = Honeybee_createHBSrfs(geometry=brep_2, RADMaterial=radopaquematerial_3.RADMaterial)  # -> readMe, simplify(HBSurface); plug-in component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
createhbsrfs_3 = Honeybee_createHBSrfs(geometry=brep, RADMaterial=radopaquematerial.RADMaterial)  # -> readMe, simplify(HBSurface); plug-in component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
createhbsrfs_4 = Honeybee_createHBSrfs(geometry=floor, RADMaterial=radopaquematerial_2.RADMaterial)  # -> readMe, simplify(HBSurface); plug-in component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

# ---- group: GLASS
brep_4 = Brep(<brep referenced from the Rhino model>)

# ----
radglassmaterial = Honeybee_RadianceGlassMaterial(materialName="GLASS_60", RTransmittance=".6", GTransmittance=".6", BTransmittance=".6", refractiveIndex=1.52)  # -> avrgTrans, RADMaterial; plug-in component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

number_slider = Slider(0, range=0..2)
month = Panel("""3
6
12""")
hour = Panel("""9
12
15""")
number_slider_2 = Slider(0, range=0..2)
item = ListItem(List=month, Index=number_slider_2, Wrap=True)
item_2 = ListItem(List=hour, Index=number_slider, Wrap=True)
path = FilePath("\\juno.design.upenn.edu\home\grad\arch\naman259\Desktop\Philadelphia_weather_files\USA_PA_Philadelphia.Intl.AP.724080_TMY3.epw")
fly = Ladybug_fly(inputSliders=flatten([number_slider_2, number_slider]), fly=Toggle(False))  # -> Vviiiiiiiiiizzz; plug-in component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
genclimatebasedsky = Honeybee_GenerateClimateBasedSky(weatherFile=path, month=item, day="21", hour=item_2)  # -> radiationValues, skyFilePath; plug-in component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

createhbsrfs_5 = Honeybee_createHBSrfs(geometry=brep_4, RADMaterial=radglassmaterial.RADMaterial)  # -> readMe, simplify(HBSurface); plug-in component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
askme = Honeybee_AskMe(HBObjects=createhbsrfs_5.HBSurface)  # -> readMe; plug-in component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
panel = Panel(createhbsrfs_5.HBSurface)

# ---- group: CEILING
brep_5 = Brep(<brep referenced from the Rhino model>)

# ----
floor_2 = Brep(<brep referenced from the Rhino model>)

# ---- group: WALL
brep_6 = Brep([<brep referenced from the Rhino model> x8])

# ----
# FIGURE OUT ON ITS OWN- WITH THE HELP MAKING A NORMAL TO THE FACE
createhbsrfs_6 = Honeybee_createHBSrfs(geometry=[brep_6, floor_2, brep_5, brep_3])  # -> readMe, simplify(HBSurface); plug-in component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
gentestpts = Honeybee_GenerateTestPoints(testGeometry=floor, gridSize=".5", distBaseSrf=".762", moveTestMesh=True)  # -> readMe, simplify(testPoints), simplify(ptsVectors), simplify(facesArea), simplify(mesh); plug-in component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
askme_2 = Honeybee_AskMe(HBObjects=createhbsrfs_6.HBSurface)  # -> readMe; plug-in component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
wires = BrepWireframe(Brep=[createhbsrfs_6.HBSurface, createhbsrfs_5.HBSurface], Density=-1)
panel_2 = Panel(askme_2)
radparameters = Honeybee_RADParameters(quality=0)  # -> readMe, radParameters; plug-in component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
gridbasedsimulation = Honeybee_GridBasedSimulation(
    skyFile=genclimatebasedsky.skyFilePath,
    testPoints=gentestpts.testPoints,
    ptsVectors=gentestpts.ptsVectors,
    simulationType=0,
    radParameters=radparameters.radParameters)  # -> analysisRecipe; plug-in component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
# if u have illumance value that mean u have done it right
panel_3 = Panel("shading device")
toggle = BooleanToggle(True)
rundaylightanalysis = Honeybee_RunDaylightSimulation(
    HBObjects=flatten([createhbsrfs_6.HBSurface, createhbsrfs_5.HBSurface]),
    analysisRecipe=gridbasedsimulation,
    writeRad=toggle,
    runRad=toggle,
    overwriteResults=True)  # -> readMe, analysisType, resultsUnit, results, testPts, resultFiles, radGeoFile, studyFolder, done; plug-in component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
# why the value are different everytime : based on random ness u get different everytime
doy_hoy = Ladybug_DOY_HOY(days="21", months=item, hours=item_2)  # -> HOY, DOY, date; plug-in component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

concat = Concatenate(FragmentA="Illuminance study", FragmentE=" Date: ", FragmentF=doy_hoy.date)
legendpar = Ladybug_LegendParameters(lowBound="500", highBound="4000")  # -> legendPar; plug-in component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

panel_4 = Panel("\\juno.design.upenn.edu\home\grad\arch\naman259\Desktop\illuminance_study")
concat_2 = Concatenate(FragmentC="_hoy_", FragmentD=doy_hoy.HOY)
captureview = Ladybug_CaptureView(fileName=concat_2, folder=panel_4, capture=rundaylightanalysis.done)  # -> imagePath; plug-in component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

recolormesh = Ladybug_RecolorMesh(
    analysisResult=rundaylightanalysis.results,
    inputMesh=gentestpts.mesh,
    legendPar=legendpar,
    analysisTitle=concat,
    legendTitle="lux")  # -> readMe, newMesh, newLegend, legendBasePt, meshColors, legendColors; plug-in component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
