# Grasshopper definition huang_weston.gh (Grasshopper 0.9.76)
# plug-ins: Python Interpreter

honeybee = Honeybee_Honeybee()  # -> Vviiiiiiiiiizzz; plug-in component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
ladybug = Ladybug_Ladybug()  # -> Vviiiiiiiiiizzz; plug-in component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

# ---- group: Ceiling
brep = Brep(<brep referenced from the Rhino model>)

# ---- group: Wall
brep_2 = Brep([<brep referenced from the Rhino model> x8])

# ---- group: Floor
brep_3 = Brep(<brep referenced from the Rhino model>)

# ---- group: Shade
brep_4 = Brep([<brep referenced from the Rhino model> x28])

# ---- group: Glass
brep_5 = Brep([<brep referenced from the Rhino model> x6])

# ----
radglassmaterial = Honeybee_RadianceGlassMaterial(materialName="glass_60", RTransmittance="0.6", GTransmittance="0.6", BTransmittance="0.6", refractiveIndex=1.52)  # -> avrgTrans, RADMaterial; plug-in component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
radopaquematerial = Honeybee_RadianceOpaqueMaterial(materialName="ceiling_80", RReflectance="0.8", GReflectance="0.8", BReflectance="0.8", roughness=0.05, specularity=0)  # -> avrgRef, RADMaterial; plug-in component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
radopaquematerial_2 = Honeybee_RadianceOpaqueMaterial(materialName="wall_50", RReflectance="0.5", GReflectance="0.5", BReflectance="0.5", roughness=0.05, specularity=0)  # -> avrgRef, RADMaterial; plug-in component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
radopaquematerial_3 = Honeybee_RadianceOpaqueMaterial(materialName="floor_20", RReflectance="0.2", GReflectance="0.2", BReflectance="0.2", roughness=0.05, specularity=0)  # -> avrgRef, RADMaterial; plug-in component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
radopaquematerial_4 = Honeybee_RadianceOpaqueMaterial(materialName="Shade_50", RReflectance="0.5", GReflectance="0.5", BReflectance="0.5", roughness=0.05, specularity=0)  # -> avrgRef, RADMaterial; plug-in component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
analysisperiod = Ladybug_AnalysisPeriod(fromMonth="6", toMonth="9")  # -> readMe, analysisPeriod; plug-in component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
series = Series(Start="1", Step=1, Count="24")
createhbsrfs = Honeybee_createHBSrfs(geometry=brep_5, RADMaterial=radglassmaterial.RADMaterial)  # -> readMe, simplify(HBSurface); plug-in component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
createhbsrfs_2 = Honeybee_createHBSrfs(geometry=brep, RADMaterial=radopaquematerial.RADMaterial)  # -> readMe, simplify(HBSurface); plug-in component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
createhbsrfs_3 = Honeybee_createHBSrfs(geometry=brep_2, RADMaterial=radopaquematerial_2.RADMaterial)  # -> readMe, simplify(HBSurface); plug-in component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
createhbsrfs_4 = Honeybee_createHBSrfs(geometry=brep_3, RADMaterial=radopaquematerial_3.RADMaterial)  # -> readMe, simplify(HBSurface); plug-in component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
createhbsrfs_5 = Honeybee_createHBSrfs(geometry=brep_4, RADMaterial=radopaquematerial_4.RADMaterial)  # -> readMe, simplify(HBSurface); plug-in component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
wires = BrepWireframe(
    Brep=[createhbsrfs.HBSurface, createhbsrfs_2.HBSurface, createhbsrfs_3.HBSurface, createhbsrfs_4.HBSurface, createhbsrfs_5.HBSurface],
    Density=-1)
Z = UnitZ(Factor=Slider(30, range=0..100))
flip = Flip()  # -> Surface, Result
item = ListItem(List=brep_3, Index=0, Wrap=True)
gentestpts = Honeybee_GenerateTestPoints(testGeometry=item, gridSize="0.5", distBaseSrf="0.3", moveTestMesh=True)  # -> readMe, simplify(testPoints), simplify(ptsVectors), simplify(facesArea), simplify(mesh); plug-in component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
radparameters = Honeybee_RADParameters(quality=0, ab="3")  # -> readMe, radParameters; plug-in component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
brep_glass = Brep([<brep referenced from the Rhino model> x6])  # disabled
brep_shade = Brep(<brep referenced from the Rhino model>)  # disabled
number_slider = Slider(4, range=0..10)
wires_2 = BrepWireframe(Brep=brep_shade, Density=-1)
smesh = SimpleMesh(Brep=brep_shade)
mjoin = MeshJoin(Meshes=smesh)
debrep = DeconstructBrep(Brep=brep_glass)  # -> Faces, Edges, Vertices
ext = ExtendCurve(Curve=wires_2, Type=0, Start=number_slider, End=number_slider)
preview = CustomPreview(Geometry=brep_glass, Shader=ColourSwatch(SwatchColor=RGB(0, 170, 255)))
path = FilePath("E:\UPenn MEBD\USA_PA_Philadelphia.Intl.AP.724080_TMY3.epw")
importepw = Ladybug_ImportEpw(epwFile=path)  # -> readMe, latitude, location, dryBulbTemperature, dewPointTemperature, relativeHumidity, windSpeed, windDirection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; disabled; plug-in component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
sunpath = Ladybug_SunPath(
    location=importepw.location,
    hour=12,
    day=21,
    month=12,
    timeStep=1,
    analysisPeriod=analysisperiod.analysisPeriod,
    sunScale=Slider(0.3, range=0..3),
    annualHourlyData=flatten([importepw.dryBulbTemperature, importepw.directNormalRadiation, importepw.relativeHumidity]),
    conditionalStatement="a>28 and b>80",
    dailyOrAnnualSunPath=True)  # -> readMe, sunVectors, sunAltitudes, sunAzimuths, port, sunSpheresMesh, sunPathCrvs, compassCrvs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; plug-in component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
mesh = Mesh(sunpath.sunSpheresMesh)  # disabled
geo = Geometry([sunpath.legend, sunpath.sunPathCrvs, sunpath.title])  # disabled
move = Move(Geometry=sunpath.sunPositions, Motion=Z)  # -> Geometry, Transform; disabled
ln = Line(StartPoint=sunpath.sunPathCenPts, EndPoint=sunpath.sunPositions)
preview_2 = CustomPreview(Geometry=geo, Shader=ColourSwatch(SwatchColor=RGB(194, 188, 188)))
tag = TextTag(Location=move.Geometry, Text=sunpath.sunPositionsInfo)  # disabled
preview_3 = CustomPreview(Geometry=[ln, mesh], Shader=ColourSwatch(SwatchColor=RGB(255, 255, 0)))
rev = Reverse(Vector=sunpath.sunVectors)
preview_4 = CustomPreview(Geometry=ext, Shader=ColourSwatch(SwatchColor=RGB(0, 0, 0)))
preview_5 = CustomPreview(Geometry=brep_shade, Shader=ColourSwatch(SwatchColor=RGB(255, 255, 255)))
meshray = MeshRay(Mesh=mjoin, Point=debrep.Vertices, Direction=rev)  # -> Point, Hit
ma = MassAddition(Input=meshray.Hit)  # -> Result, PartialResults
genclimatebasedsky = Honeybee_GenerateClimateBasedSky(weatherFile=path, month="6", day="21", hour="9")  # -> radiationValues, skyFilePath; plug-in component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
gridbasedsimulation = Honeybee_GridBasedSimulation(
    skyFile=genclimatebasedsky.skyFilePath,
    testPoints=gentestpts.testPoints,
    ptsVectors=gentestpts.ptsVectors,
    testMesh=gentestpts.mesh,
    simulationType=0,
    radParameters=radparameters.radParameters)  # -> analysisRecipe; plug-in component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
swatch = ColourSwatch(SwatchColor=RGB(0, 0, 0))
smaller = SmallerThan(FirstNumber=ma.Result, SecondNumber="4")  # -> SmallerThan, OrEqualTo
swatch_2 = ColourSwatch(SwatchColor=RGB(255, 255, 255))
toggle = BooleanToggle(False)
dispatch = Dispatch(List=sunpath.sunVectors, DispatchPattern=smaller.SmallerThan)  # -> ListA, ListB
dispatch_2 = Dispatch(List=sunpath.selHourlyData, DispatchPattern=smaller.SmallerThan)  # -> ListA, ListB
bnd = Bounds(Numbers=dispatch_2.ListA)
legendpar = Ladybug_LegendParameters(
    lowBound="0",
    highBound="2100",
    numSegments="8",
    customColors=reverse(flatten([ColourSwatch(SwatchColor=RGB(255, 255, 255)), ColourSwatch(SwatchColor=RGB(255, 153, 0)), ColourSwatch(SwatchColor=RGB(0, 0, 0))])),
    legendLocation="3,10,0")  # -> legendPar; plug-in component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
rundaylightanalysis = Honeybee_RunDaylightSimulation(
    HBObjects=flatten([createhbsrfs.HBSurface, createhbsrfs_2.HBSurface, createhbsrfs_3.HBSurface, createhbsrfs_4.HBSurface, createhbsrfs_5.HBSurface]),
    analysisRecipe=gridbasedsimulation,
    writeRad=toggle,
    runRad=toggle,
    overwriteResults=True)  # -> readMe, analysisType, resultsUnit, results, testPts, resultFiles, radGeoFile, studyFolder, done; plug-in component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
remap = RemapNumbers(Value=dispatch_2.ListA, Source=bnd, Target=Domain(0, 1))  # -> Mapped, Clipped
gradient = Gradient(
    LowerLimit=0,
    UpperLimit=1,
    Parameter=remap.Mapped,
    stops=[0: RGB(234, 38, 0), 0.25: RGB(234, 126, 0), 0.5: RGB(254, 244, 84), 0.75: RGB(173, 203, 249), 1: RGB(75, 107, 169)])
shddesigner = Ladybug_ShadingDesigner(glzSrf=flatten(brep_glass), depthOrVector=flatten(dispatch.ListA), numOfShds="1", runIt=Toggle(True), mergeVectors=False)  # -> readMe, shadingSrfs; plug-in component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
tag_2 = TextTag3D(Location=rundaylightanalysis.testPts, Text=rundaylightanalysis.results, Size=1, Justification=7)
material = CreateMaterial(Diffuse=gradient, Specular=RGB(255, 255, 255), Emission=RGB(0, 0, 0), Transparency=Slider(0.8, range=0..1), Shine=0)
preview_6 = CustomPreview(Geometry=shddesigner.shadingSrfs, Shader=material)
recolormesh = Ladybug_RecolorMesh(
    analysisResult=rundaylightanalysis.results,
    inputMesh=gentestpts.mesh,
    legendPar=legendpar,
    analysisTitle="Illuminance",
    legendTitle="Lux")  # -> readMe, newMesh, newLegend, legendBasePt, meshColors, legendColors; plug-in component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
