# Grasshopper definition hwang_youngjin.gh (Grasshopper 0.9.76)
# plug-ins: Python Interpreter

ladybug = Ladybug_Ladybug()  # -> Vviiiiiiiiiizzz; plug-in component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
honeybee = Honeybee_Honeybee()  # -> Vviiiiiiiiiizzz; plug-in component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
ceiling = Brep(<brep referenced from the Rhino model>)
floor = Brep(<brep referenced from the Rhino model>)
wall = Brep([<brep referenced from the Rhino model> x2])
radglassmaterial = Honeybee_RadianceGlassMaterial(materialName="glass_60", RTransmittance="0.6", GTransmittance="0.6", BTransmittance="0.6", refractiveIndex=1.52)  # -> avrgTrans, RADMaterial; plug-in component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
pt = Point(<point referenced from the Rhino model>)
pt_2 = Point(<point referenced from the Rhino model>)
vec2pt = Vector2Pt(PointA=pt_2, PointB=pt, Unitize=False)  # -> Vector, Length
path = FilePath("C:\Users\himyn\OneDrive - PennO365\MEBD-2017-1ST\BUILDING PERFORMANCE SIMULATION\Class\Philadelphia_weather_files\USA_PA_Philadelphia.Intl.AP.724080_TMY3.epw")
window = Brep(<brep referenced from the Rhino model>)
panel = Panel("""0
3
2""")
shading = Brep([<brep referenced from the Rhino model> x6])
createhbsrfs = Honeybee_createHBSrfs(geometry=window, RADMaterial=radglassmaterial.RADMaterial)  # -> readMe, simplify(HBSurface); plug-in component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
createhbsrfs_2 = Honeybee_createHBSrfs(geometry=shading, srfType="6")  # -> readMe, simplify(HBSurface); plug-in component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
createhbsrfs_3 = Honeybee_createHBSrfs(geometry=[ceiling, wall], srfType=panel)  # -> readMe, simplify(HBSurface); plug-in component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
gentestpts = Honeybee_GenerateTestPoints(testGeometry=floor, gridSize=Slider(0.3, range=0..10), distBaseSrf=Slider(0.75, range=0..3), moveTestMesh=True)  # -> readMe, simplify(testPoints), simplify(ptsVectors), simplify(facesArea), simplify(mesh); plug-in component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
genclimatebasedsky = Honeybee_GenerateClimateBasedSky(north=vec2pt.Vector, weatherFile=path, month="12", day="21", hour="15")  # -> radiationValues, skyFilePath; plug-in component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
radparameters = Honeybee_RADParameters(quality=0)  # -> readMe, radParameters; plug-in component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
panel_2 = Panel(radparameters.readMe)
preview = CustomPreview(
    Geometry=gentestpts.testPoints,
    Shader={ambient=RGB(0, 0, 0), diffuse=RGB(255, 105, 180), emission=RGB(76, 32, 54), shine=0.5, specular=RGB(255, 255, 255), transparency=0})
wires = BrepWireframe(Brep=[createhbsrfs_3.HBSurface, createhbsrfs.HBSurface], Density=-1)
gridbasedsimulation = Honeybee_GridBasedSimulation(
    skyFile=genclimatebasedsky.skyFilePath,
    testPoints=gentestpts.testPoints,
    ptsVectors=gentestpts.ptsVectors,
    simulationType=0,
    radParameters=radparameters.radParameters)  # -> analysisRecipe; plug-in component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
toggle = BooleanToggle(False)
rundaylightanalysis = Honeybee_RunDaylightSimulation(
    HBObjects=flatten([createhbsrfs.HBSurface, createhbsrfs_3.HBSurface, createhbsrfs_2.HBSurface]),
    analysisRecipe=gridbasedsimulation,
    writeRad=toggle,
    runRad=toggle,
    overwriteResults=True)  # -> readMe, analysisType, resultsUnit, results, testPts, resultFiles, radGeoFile, studyFolder, done; plug-in component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
pt_3 = Point(Point(8.017198265, -4.24, 0))
legendpar = Ladybug_LegendParameters(
    lowBound="300",
    highBound="2000",
    numSegments="11",
    legendLocation=pt_3,
    font="Arial",
    decimalPlaces=Slider(0, range=0..100))  # -> legendPar; plug-in component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
panel_3 = Panel(rundaylightanalysis.results)
recolormesh = Ladybug_RecolorMesh(analysisResult=rundaylightanalysis.results, inputMesh=gentestpts.mesh, legendPar=legendpar, legendTitle="Lux(lx/sqm)")  # -> readMe, newMesh, newLegend, legendBasePt, meshColors, legendColors; plug-in component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
num = Number(panel_3)

# ---- group: LAGER THAN / SMALLER THAN
faceb = FaceBoundaries(Mesh=gentestpts.mesh)
smaller = SmallerThan(FirstNumber=num, SecondNumber="300")  # -> SmallerThan, OrEqualTo
larger = LargerThan(FirstNumber=num, SecondNumber="2000")  # -> LargerThan, OrEqualTo
cullf = CullFaces(Mesh=gentestpts.mesh, Pattern=smaller.SmallerThan)
area = Area(Geometry=cullf)  # -> Area, Centroid
area_2 = Area(Geometry=gentestpts.mesh)  # -> Area, Centroid
panel_4 = Panel(area.Area)
panel_5 = Panel(area_2.Area)
division = Division(A=panel_4, B=panel_5)
panel_6 = Panel(division)
