# Grasshopper definition jeon_bosung.gh (Grasshopper 0.9.76)
# plug-ins: Python Interpreter

ladybug = Ladybug_Ladybug()  # -> out; plug-in component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
honeybee = Honeybee_Honeybee()  # -> out; plug-in component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
panel = Panel("GLASS_60")  # disabled
panel_2 = Panel("0.6")  # disabled
panel_3 = Panel("0.5")  # disabled
panel_4 = Panel("WALL_50")  # disabled
radglassmaterial = Honeybee_RadianceGlassMaterial(materialName=panel, RTransmittance=panel_2, GTransmittance=panel_2, BTransmittance=panel_2, refractiveIndex=1.52)  # -> avrgTrans, RADMaterial; disabled; plug-in component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
radopaquematerial = Honeybee_RadianceOpaqueMaterial(materialName="CEILING_80", RReflectance="0.8", GReflectance="0.8", BReflectance="0.8", roughness=0.05, specularity=0)  # -> avrgRef, RADMaterial; plug-in component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
radopaquematerial_2 = Honeybee_RadianceOpaqueMaterial(materialName=panel_4, RReflectance=panel_3, GReflectance=panel_3, BReflectance=panel_3, roughness=0.05, specularity=0)  # -> avrgRef, RADMaterial; disabled; plug-in component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
radopaquematerial_3 = Honeybee_RadianceOpaqueMaterial(materialName="FLOOR_20", RReflectance="0.2", GReflectance="0.2", BReflectance="0.2", roughness=0.05, specularity=0)  # -> avrgRef, RADMaterial; plug-in component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

# ---- group: CEILING
brep = Brep(<brep referenced from the Rhino model>)

# ---- group: GLASS
brep_2 = Brep(<brep referenced from the Rhino model>)  # disabled

# ---- group: WALL
brep_3 = Brep([<brep referenced from the Rhino model> x14])  # disabled

# ---- group: FLOOR
brep_4 = Brep(<brep referenced from the Rhino model>)

# ----
# Geometries_And_Materials
createhbsrfs = Honeybee_createHBSrfs(geometry=brep_2, RADMaterial=radglassmaterial.RADMaterial)  # -> out, simplify(HBSurface); disabled; plug-in component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
createhbsrfs_2 = Honeybee_createHBSrfs(geometry=brep, RADMaterial=radopaquematerial.RADMaterial)  # -> out, simplify(HBSurface); plug-in component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
createhbsrfs_3 = Honeybee_createHBSrfs(geometry=brep_3, RADMaterial=radopaquematerial_2.RADMaterial)  # -> out, simplify(HBSurface); disabled; plug-in component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
createhbsrfs_4 = Honeybee_createHBSrfs(geometry=brep_4, RADMaterial=radopaquematerial_3.RADMaterial)  # -> out, simplify(HBSurface); plug-in component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
file_path = FilePath("E:\Jeon\02_UPenn\2017_Fall____02_Building_Performance_Simulation\170918\Philadelphia_weather_files\USA_PA_Philadelphia.Intl.AP.724080_TMY3.epw")
# Preparation_of_Simulations
gentestpts = Honeybee_GenerateTestPoints(testGeometry=brep_4, gridSize="0.5", distBaseSrf="0.1", moveTestMesh=True)  # -> out, simplify(testPoints), simplify(ptsVectors), simplify(facesArea), simplify(mesh); plug-in component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
radparameters = Honeybee_RADParameters(quality=0, ab="2")  # -> out, radParameters; plug-in component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
# Sky_And_Period
genclimatebasedsky = Honeybee_GenerateClimateBasedSky(weatherFile=file_path, month="12", day="21", hour="15")  # -> out, skyFilePath; plug-in component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
gridbasedsimulation = Honeybee_GridBasedSimulation(
    skyFile=genclimatebasedsky.skyFilePath,
    testPoints=gentestpts.testPoints,
    ptsVectors=gentestpts.ptsVectors,
    simulationType=0,
    radParameters=radparameters.radParameters)  # -> analysisRecipe; plug-in component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
panel_5 = Panel("GLASS_60")  # disabled
panel_6 = Panel("0.6")  # disabled
panel_7 = Panel("0.5")  # disabled
panel_8 = Panel("WALL_50")  # disabled
radglassmaterial_2 = Honeybee_RadianceGlassMaterial(materialName=panel_5, RTransmittance=panel_6, GTransmittance=panel_6, BTransmittance=panel_6, refractiveIndex=1.52)  # -> avrgTrans, RADMaterial; disabled; plug-in component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
radopaquematerial_4 = Honeybee_RadianceOpaqueMaterial(materialName=panel_8, RReflectance=panel_7, GReflectance=panel_7, BReflectance=panel_7, roughness=0.05, specularity=0)  # -> avrgRef, RADMaterial; disabled; plug-in component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
boolean_toggle = BooleanToggle(True)

# ---- group: GLASS
# Geometries_And_Materials
# Remodelled_1
brep_5 = Brep(<brep referenced from the Rhino model>)  # disabled

# ---- group: WALL
brep_6 = Brep([<brep referenced from the Rhino model> x14])  # disabled

# ----
createhbsrfs_5 = Honeybee_createHBSrfs(geometry=brep_6, RADMaterial=radopaquematerial_4.RADMaterial)  # -> out, simplify(HBSurface); disabled; plug-in component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
createhbsrfs_6 = Honeybee_createHBSrfs(geometry=brep_5, RADMaterial=radglassmaterial_2.RADMaterial)  # -> out, simplify(HBSurface); disabled; plug-in component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
legendpar = Ladybug_LegendParameters(lowBound="100", highBound="4000")  # -> legendPar; plug-in component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
radglassmaterial_3 = Honeybee_RadianceGlassMaterial(materialName="GLASS_60", RTransmittance="0.6", GTransmittance="0.6", BTransmittance="0.6", refractiveIndex=1.52)  # -> avrgTrans, RADMaterial; plug-in component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
radopaquematerial_5 = Honeybee_RadianceOpaqueMaterial(materialName="WALL_50", RReflectance="0.5", GReflectance="0.5", BReflectance="0.5", roughness=0.05, specularity=0)  # -> avrgRef, RADMaterial; plug-in component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

# ---- group: GLASS
# Geometries_And_Materials
# Remodelled_2
brep_7 = Brep([<brep referenced from the Rhino model> x2])

# ---- group: WALL
brep_8 = Brep([<brep referenced from the Rhino model> x15])

# ----
createhbsrfs_7 = Honeybee_createHBSrfs(geometry=brep_8, RADMaterial=radopaquematerial_5.RADMaterial)  # -> out, simplify(HBSurface); plug-in component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
createhbsrfs_8 = Honeybee_createHBSrfs(geometry=brep_7, RADMaterial=radglassmaterial_3.RADMaterial)  # -> out, simplify(HBSurface); plug-in component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
radopaquematerial_6 = Honeybee_RadianceOpaqueMaterial(materialName="WALL_50", RReflectance="0.5", GReflectance="0.5", BReflectance="0.5", roughness=0.05, specularity=0)  # -> avrgRef, RADMaterial; plug-in component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

# ---- group: WALL
# Geometries_And_Materials
# Shading
brep_9 = Brep([<brep referenced from the Rhino model> x10])

# ----
createhbsrfs_9 = Honeybee_createHBSrfs(geometry=brep_9, RADMaterial=radopaquematerial_6.RADMaterial)  # -> out, simplify(HBSurface); plug-in component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
# Run_Simulation
rundaylightanalysis = Honeybee_RunDaylightSimulation(
    HBObjects=flatten([createhbsrfs.HBSurface, createhbsrfs_2.HBSurface, createhbsrfs_3.HBSurface, createhbsrfs_4.HBSurface, createhbsrfs_6.HBSurface, createhbsrfs_5.HBSurface, createhbsrfs_8.HBSurface, createhbsrfs_7.HBSurface, createhbsrfs_9.HBSurface]),
    analysisRecipe=gridbasedsimulation,
    writeRad=boolean_toggle,
    runRad=boolean_toggle,
    overwriteResults=True)  # -> out, analysisType, resultsUnit, illuminance_values, testPts, illuminance_files, radGeoFile, studyFolder, done; plug-in component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
# Visualization
recolormesh = Ladybug_RecolorMesh(
    analysisResult=rundaylightanalysis.illuminance_values,
    inputMesh=gentestpts.mesh,
    legendPar=legendpar,
    analysisTitle="ILLUMINANCE",
    legendTitle="LUX")  # -> out, newMesh, newLegend, legendBasePt, meshColors, legendColors; plug-in component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
