# Grasshopper definition jiang_hewen.gh (Grasshopper 0.9.76)
# plug-ins: Python Interpreter

honeybee = Honeybee_Honeybee()  # -> Vviiiiiiiiiizzz; plug-in component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
ladybug = Ladybug_Ladybug()  # -> Vviiiiiiiiiizzz; plug-in component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
number_slider = Slider(0.6, range=0..1)

# ---- group: floor
brep = Brep(<brep referenced from the Rhino model>)

# ---- group: ceiling
srf = Surface(<surface referenced from the Rhino model>)

# ---- group: wall
brep_2 = Brep([<brep referenced from the Rhino model> x7])

# ---- group: add
srf_2 = Surface([<surface referenced from the Rhino model> x33])

# ----
debrep = DeconstructBrep(Brep=brep)  # -> Faces, Edges, Vertices
radglassmaterial = Honeybee_RadianceGlassMaterial(
    materialName="glass_60",
    RTransmittance=number_slider,
    GTransmittance=number_slider,
    BTransmittance=number_slider,
    refractiveIndex=1.52)  # -> avrgTrans, RADMaterial; plug-in component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

# ---- group: glass
srf_3 = Surface([<surface referenced from the Rhino model> x7])

# ----
item = ListItem(List=debrep.Faces, Index=0, Wrap=True)
wires = BrepWireframe(Brep=[srf, brep_2, item, srf_2], Density=-1)
createhbsrfs = Honeybee_createHBSrfs(geometry=[srf, brep_2, item])  # -> readMe, simplify(HBSurface); plug-in component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
createhbsrfs_2 = Honeybee_createHBSrfs(geometry=srf_3, RADMaterial=radglassmaterial.RADMaterial)  # -> readMe, simplify(HBSurface); plug-in component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
createhbsrfs_3 = Honeybee_createHBSrfs(geometry=srf_2)  # -> readMe, simplify(HBSurface); plug-in component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
preview = CustomPreview(Geometry=wires, Shader=ColourSwatch(SwatchColor=RGB(255, 255, 255)))
gentestpts = Honeybee_GenerateTestPoints(testGeometry=item, gridSize=Slider(0.3, range=0..1), distBaseSrf=Slider(0.75, range=0..1), moveTestMesh=True)  # -> readMe, simplify(testPoints), simplify(ptsVectors), simplify(facesArea), simplify(mesh); plug-in component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
path = FilePath("C:\Users\wen\Desktop\grasshopper class\ARCH 753\USA_PA_Philadelphia.Intl.AP.724080_TMY3.epw")
genclimatebasedsky = Honeybee_GenerateClimateBasedSky(weatherFile=path, month="6", day="21", hour="12")  # -> radiationValues, skyFilePath; plug-in component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
radparameters = Honeybee_RADParameters(quality=0, ab=Slider(3, range=0..10))  # -> readMe, radParameters; plug-in component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
gridbasedsimulation = Honeybee_GridBasedSimulation(
    skyFile=genclimatebasedsky.skyFilePath,
    testPoints=gentestpts.testPoints,
    ptsVectors=gentestpts.ptsVectors,
    simulationType=0,
    radParameters=radparameters.radParameters)  # -> analysisRecipe; plug-in component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
toggle = BooleanToggle(True)
rundaylightanalysis = Honeybee_RunDaylightSimulation(
    HBObjects=flatten([createhbsrfs_2.HBSurface, createhbsrfs.HBSurface, createhbsrfs_3.HBSurface]),
    analysisRecipe=gridbasedsimulation,
    writeRad=toggle,
    runRad=toggle,
    overwriteResults=True)  # -> readMe, analysisType, resultsUnit, illuminance_values, testPts, illuminance_files, radGeoFile, studyFolder, done; plug-in component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
legendpar = Ladybug_LegendParameters(lowBound="100", highBound="4000")  # -> legendPar; plug-in component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
recolormesh = Ladybug_RecolorMesh(
    analysisResult=rundaylightanalysis.illuminance_values,
    inputMesh=gentestpts.mesh,
    legendPar=legendpar,
    analysisTitle="illuminance",
    legendTitle="lux")  # -> readMe, newMesh, newLegend, legendBasePt, meshColors, legendColors; plug-in component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
