# Grasshopper definition kamath_ayodh.gh (Grasshopper 0.9.76)
# plug-ins: Python Interpreter

ladybug = Ladybug_Ladybug()  # -> Vviiiiiiiiiizzz; plug-in component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
honeybee = Honeybee_Honeybee()  # -> Vviiiiiiiiiizzz; plug-in component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
path = FilePath("C:\Users\Ayodh\Documents\Us\Ayodh\UPenn\1709\753\USA_PA_Philadelphia.Intl.AP.724080_TMY3\USA_PA_Philadelphia.Intl.AP.724080_TMY3.epw")

# ---- group: Internalized Geometry
ceilingbrep = Brep(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)
shadebrep = Brep(<brep referenced from the Rhino model>)
glassbrep = Brep(<brep referenced from the Rhino model>)
floorbrep = Brep(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)
wallbrep = Brep([<brep referenced from the Rhino model> x94])

# ----
toggle = BooleanToggle(False)

# ---- group: Sky
panel = Panel("12")
panel_2 = Panel("21")
panel_3 = Panel("15")
genclimatebasedsky = Honeybee_GenerateClimateBasedSky(weatherFile=path, month=panel, day=panel_2, hour=panel_3)  # -> radiationValues, skyFilePath; plug-in component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

# ---- group: Optimized Shading Geometry
bottompt = Point(<point referenced from the Rhino model>)
number_slider = Slider(0.52, range=0..1)
toppt = Point(<point referenced from the Rhino model>)
number_slider_2 = Slider(1.4, range=0..1.5)
pt1 = Point(<point referenced from the Rhino model>)
pt2 = Point(<point referenced from the Rhino model>)
xy = XYPlane(Origin=pt1)
xy_2 = XYPlane(Origin=pt2)
pdecon = Deconstruct(Point=toppt)  # -> XComponent, YComponent, ZComponent
pdecon_2 = Deconstruct(Point=bottompt)  # -> XComponent, YComponent, ZComponent
pt = ConstructPoint(XCoordinate=pdecon.XComponent, YCoordinate=pdecon.YComponent, ZCoordinate=pdecon_2.ZComponent)
ln = Line(StartPoint=toppt, EndPoint=pt)
eval = EvaluateCurve(Curve=ln, Parameter=number_slider)  # -> Point, Tangent, Angle
X = UnitX(Factor="-1")
ln_2 = Line(StartPoint=bottompt, EndPoint=pt)
line = LineSDL(Start=eval.Point, Direction=X, Length=number_slider_2)
end = EndPoints(Curve=line)  # -> Start, End
intcrv = Interpolate(Vertices=[toppt, end.End, bottompt], Degree=3, Periodic=False, KnotStyle=1)  # -> Curve, Length, Domain
bbox = BoundingBox(Content=glassbrep, Plane=PlaneXY(0, 0, 0))  # -> Box, Box_2
join = JoinCurves(Curves=[intcrv.Curve, ln_2], Preserve=False)
box_corners = BoxCorners(Box=bbox.Box)  # -> CornerA, CornerB, CornerC, CornerD, CornerE, CornerF, CornerG, CornerH
end_2 = EndPoints(Curve=join)  # -> Start, End
ln_3 = Line(StartPoint=end_2.Start, EndPoint=end_2.End)
join_2 = JoinCurves(Curves=[ln_3, join], Preserve=False)
ln_4 = Line(StartPoint=box_corners.CornerA, EndPoint=box_corners.CornerC)
divide = DivideCurve(Curve=ln_4, Count=8, Kinks=False)  # -> Points, Tangents, Parameters
swp1 = Sweep1(Rail=ln_4, Sections=join_2, Miter=1)
xz = XZPlane(Origin=divide.Points)
sec = BrepPlane(Brep=swp1, Plane=xy)  # -> Curves, Points
sec_2 = BrepPlane(Brep=swp1, Plane=xy_2)  # -> Curves, Points
item = ListItem(List=sec.Curves, Index=0, Wrap=True)
item_2 = ListItem(List=sec.Curves, Index=1, Wrap=True)
item_3 = ListItem(List=sec_2.Curves, Index=0, Wrap=True)
item_4 = ListItem(List=sec_2.Curves, Index=1, Wrap=True)
flip = FlipCurve(Curve=item)  # -> Curve, Flag
sec_3 = BrepPlane(Brep=swp1, Plane=xz)  # -> Curves, Points
flip_2 = FlipCurve(Curve=item_3)  # -> Curve, Flag
rulesrf = RuledSurface(CurveA=flip.Curve, CurveB=item_2)
boundary = BoundarySurfaces(Edges=sec_3.Curves)
rulesrf_2 = RuledSurface(CurveA=flip_2.Curve, CurveB=item_4)
split = SplitBrep(Brep=boundary, Cutter=rulesrf)
item_5 = ListItem(List=split, Index=1, Wrap=True)  # -> flatten(Item)

# ----
radglassmaterial = Honeybee_RadianceGlassMaterial(materialName="glass_60", RTransmittance="0.6", GTransmittance="0.6", BTransmittance="0.6", refractiveIndex=1.52)  # -> avrgTrans, RADMaterial; plug-in component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

# ---- group: Connect to "_geometry" for Galapagos Optimization
brep = Brep(flatten([rulesrf_2, rulesrf, item_5]))

# ----
createhbsrfs = Honeybee_createHBSrfs(geometry=glassbrep, RADMaterial=radglassmaterial.RADMaterial)  # -> readMe, simplify(HBSurface); plug-in component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
createhbsrfs_2 = Honeybee_createHBSrfs(geometry=[wallbrep, ceilingbrep, floorbrep])  # -> readMe, simplify(HBSurface); plug-in component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
createhbsrfs_3 = Honeybee_createHBSrfs(geometry=[brep, shadebrep], srfType="6")  # -> readMe, simplify(HBSurface); plug-in component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

# ---- group: Sun Vector
importepw = Ladybug_ImportEpw(epwFile=path)  # -> readMe, latitude, location, dryBulbTemperature, dewPointTemperature, relativeHumidity, windSpeed, windDirection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; plug-in component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
sunpath = Ladybug_SunPath(location=importepw.location, hour=panel_3, day=panel_2, month=panel, timeStep=1, dailyOrAnnualSunPath=True)  # -> readMe, sunVectors, sunAltitudes, sunAzimuths, port, sunSpheresMesh, sunPathCrvs, compassCrvs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; plug-in component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
rev = Reverse(Vector=sunpath.sunVectors)
vdisex = VectorDisplayEx(Point=[toppt, pt1, pt2, pt], Vector=rev, Colour=RGB(0, 0, 0), Width=2)

# ----
gentestpts = Honeybee_GenerateTestPoints(testGeometry=floorbrep, gridSize=".5", distBaseSrf="0.762", moveTestMesh=True)  # -> readMe, simplify(testPoints), simplify(ptsVectors), simplify(facesArea), simplify(mesh); plug-in component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
radparameters = Honeybee_RADParameters(quality=0, ab="3")  # -> readMe, radParameters; plug-in component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
gridbasedsimulation = Honeybee_GridBasedSimulation(
    skyFile=genclimatebasedsky.skyFilePath,
    testPoints=gentestpts.testPoints,
    ptsVectors=gentestpts.ptsVectors,
    testMesh=gentestpts.mesh,
    simulationType=0,
    radParameters=radparameters.radParameters)  # -> analysisRecipe; plug-in component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
bbox_2 = BoundingBox(Content=ceilingbrep, Plane=PlaneXY(0, 0, 0))  # -> Box, Box_2
box_corners_2 = BoxCorners(Box=bbox_2.Box)  # -> CornerA, CornerB, CornerC, CornerD, CornerE, CornerF, CornerG, CornerH
pdecon_3 = Deconstruct(Point=box_corners_2.CornerB)  # -> XComponent, YComponent, ZComponent
concat = Concatenate(FragmentA=panel, FragmentB=panel_2, FragmentC=panel_3)
concat_2 = Concatenate(FragmentA="MM/DD/HH: ", FragmentB=concat)
multiplication = Multiplication(A="0.15", B=5)
addition = Addition(A=pdecon_3.YComponent, B=multiplication)
pt_2 = ConstructPoint(XCoordinate=pdecon_3.XComponent, YCoordinate=addition, ZCoordinate=pdecon_3.ZComponent)
col = Colour([ColourSwatch(SwatchColor=RGB(0, 0, 0)), ColourSwatch(SwatchColor=RGB(255, 212, 0)), ColourSwatch(SwatchColor=RGB(255, 255, 255))])
pdecon_4 = Deconstruct(Point=pt_2)  # -> XComponent, YComponent, ZComponent
rundaylightanalysis = Honeybee_RunDaylightSimulation(
    HBObjects=flatten([createhbsrfs.HBSurface, createhbsrfs_2.HBSurface, createhbsrfs_3.HBSurface]),
    analysisRecipe=gridbasedsimulation,
    writeRad=toggle,
    runRad=toggle,
    overwriteResults=True)  # -> readMe, analysisType, resultsUnit, results, testPts, resultFiles, radGeoFile, studyFolder, done; plug-in component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
legendpar = Ladybug_LegendParameters(
    lowBound="300",
    highBound="2000",
    numSegments="18",
    customColors=flatten(col),
    legendLocation=pt_2,
    legendScale=Slider(0.5, range=0..1))  # -> legendPar; plug-in component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
multiplication_2 = Multiplication(A="0.15", B=2)
addition_2 = Addition(A=pdecon_4.XComponent, B=multiplication_2)
subtraction = Subtraction(A=pdecon_4.YComponent, B=multiplication_2)
multiplication_3 = Multiplication(A="0.15", B=3)
recolormesh = Ladybug_RecolorMesh(
    analysisResult=rundaylightanalysis.results,
    inputMesh=gentestpts.mesh,
    legendPar=legendpar,
    analysisTitle="Illumination",
    legendTitle="Illumination in lux")  # -> readMe, newMesh, newLegend, legendBasePt, meshColors, legendColors; plug-in component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
pt_3 = ConstructPoint(XCoordinate=addition_2, YCoordinate=subtraction, ZCoordinate=pdecon_4.ZComponent)
pdecon_5 = Deconstruct(Point=pt_3)  # -> XComponent, YComponent, ZComponent
subtraction_2 = Subtraction(A=pdecon_5.YComponent, B=multiplication_3)
pt_4 = ConstructPoint(XCoordinate=pdecon_5.XComponent, YCoordinate=subtraction_2, ZCoordinate=pdecon_5.ZComponent)
tag = TextTag3D(Location=pt_4, Text=concat_2, Size="0.15", Colour=RGB(0, 0, 0), Justification=7)

# ---- group: Lighting Quality Score
larger = LargerThan(FirstNumber=rundaylightanalysis.results, SecondNumber="2000")  # -> LargerThan, OrEqualTo
smaller = SmallerThan(FirstNumber=rundaylightanalysis.results, SecondNumber="300")  # -> SmallerThan, OrEqualTo
num = Number(larger.LargerThan)
num_2 = Number(smaller.SmallerThan)
ma = MassAddition(Input=num)  # -> Result, PartialResults
ma_2 = MassAddition(Input=num_2)  # -> Result, PartialResults
addition_3 = Addition(A=ma.Result, B=ma_2.Result)
galapagos = Galapagos(fitness=addition_3, gene=[number_slider, number_slider_2])

# ----
panel_4 = Panel(addition_3)
concat_3 = Concatenate(FragmentA="Light index:", FragmentB=panel_4)
tag_2 = TextTag3D(Location=pt_3, Text=concat_3, Size="0.15", Colour=RGB(0, 0, 0), Justification=7)
