# Grasshopper definition katta-adiseshaiah_aishwarya.gh (Grasshopper 0.9.76)
# plug-ins: Python Interpreter

honeybee = Honeybee_Honeybee()  # -> Vviiiiiiiiiizzz; plug-in component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
ladybug = Ladybug_Ladybug()  # -> Vviiiiiiiiiizzz; plug-in component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
radglassmaterial = Honeybee_RadianceGlassMaterial(materialName="glass_60", RTransmittance="0.6", GTransmittance="0.6", BTransmittance="0.6", refractiveIndex=1.52)  # -> avrgTrans, RADMaterial; plug-in component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

# ---- group: cieling
brep = Brep([<brep referenced from the Rhino model> x2])

# ---- group: wall
brep_2 = Brep([<brep referenced from the Rhino model> x19])

# ---- group: floor
brep_3 = Brep([<brep referenced from the Rhino model> x2])

# ---- group: glass
brep_4 = Brep(<brep referenced from the Rhino model>)

# ----
panel = Panel("6")  # disabled
brep_5 = Brep(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)  # disabled
createhbsrfs = Honeybee_createHBSrfs(geometry=brep_5, srfType=panel)  # -> readMe, simplify(HBSurface); disabled; plug-in component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
createhbsrfs_2 = Honeybee_createHBSrfs(geometry=[brep_2, brep, brep_3])  # -> readMe, simplify(HBSurface); plug-in component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
createhbsrfs_3 = Honeybee_createHBSrfs(geometry=brep_4, RADMaterial=radglassmaterial.RADMaterial)  # -> readMe, simplify(HBSurface); plug-in component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
panel_2 = Panel("3")
wires = BrepWireframe(Brep=[createhbsrfs_3.HBSurface, createhbsrfs_2.HBSurface], Density=-1)
flip = Flip(Surface=brep_3)  # -> Surface, Result
path = FilePath("C:\Users\aishu\Desktop\MEBD\2. Building Simulation\Assignment 1& 2\USA_PA_Philadelphia.Intl.AP.724080_TMY3\USA_PA_Philadelphia.Intl.AP.724080_TMY3.epw")
genclimatebasedsky = Honeybee_GenerateClimateBasedSky(weatherFile=path, month="3", day="21", hour="12")  # -> radiationValues, skyFilePath; plug-in component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
gentestpts = Honeybee_GenerateTestPoints(testGeometry=brep_3, gridSize="0.1", distBaseSrf="0", moveTestMesh=True)  # -> readMe, simplify(testPoints), simplify(ptsVectors), simplify(facesArea), simplify(mesh); plug-in component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
radparameters = Honeybee_RADParameters(quality=0, ab="3")  # -> readMe, radParameters; plug-in component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
panel_3 = Panel(radparameters.readMe)
panel_4 = Panel(genclimatebasedsky.skyFilePath)
gridbasedsimulation = Honeybee_GridBasedSimulation(
    skyFile=genclimatebasedsky.skyFilePath,
    testPoints=gentestpts.testPoints,
    ptsVectors=gentestpts.ptsVectors,
    simulationType=0,
    radParameters=radparameters.radParameters)  # -> analysisRecipe; plug-in component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
toggle = BooleanToggle(True)
rundaylightanalysis = Honeybee_RunDaylightSimulation(
    HBObjects=flatten([createhbsrfs_3.HBSurface, createhbsrfs_2.HBSurface, createhbsrfs.HBSurface]),
    analysisRecipe=gridbasedsimulation,
    writeRad=toggle,
    runRad=toggle,
    overwriteResults=True)  # -> readMe, analysisType, resultsUnit, illuminance_values, testPts, illuminance_files, radGeoFile, studyFolder, done; plug-in component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
panel_5 = Panel("2000")
panel_6 = Panel("300")
legendpar = Ladybug_LegendParameters()  # -> legendPar; plug-in component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
panel_7 = Panel(rundaylightanalysis.done)
recolormesh = Ladybug_RecolorMesh(
    analysisResult=rundaylightanalysis.illuminance_values,
    inputMesh=gentestpts.mesh,
    legendPar=legendpar,
    analysisTitle="illuminance",
    legendTitle="lux")  # -> readMe, newMesh, newLegend, legendBasePt, meshColors, legendColors; plug-in component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
