# Grasshopper definition kennedy_kirin.gh (Grasshopper 0.9.76)
# plug-ins: Python Interpreter

ladybug = Ladybug_Ladybug()  # -> Vviiiiiiiiiizzz; plug-in component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
honeybee = Honeybee_Honeybee()  # -> Vviiiiiiiiiizzz; plug-in component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
panel = Panel("https://www.energyplus.net/weather-download/north_and_central_america_wmo_region_4/USA/PA/USA_PA_Philadelphia.Intl.AP.724080_TMY3/all")
epw_stat = Ladybug_OpenEPWAndSTATWeatherFiles(weatherFileURL=panel)  # -> epwFile, statFile; plug-in component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
window = Brep([<brep referenced from the Rhino model> x2])
light_shelf = Brep([<brep referenced from the Rhino model> x4])
floor = Brep(<brep referenced from the Rhino model>)
walls = Brep([<brep referenced from the Rhino model> x6])
ceiling = Brep(<brep referenced from the Rhino model>)
radglassmaterial = Honeybee_RadianceGlassMaterial(materialName="glass_60", RTransmittance="0.6", GTransmittance="0.6", BTransmittance="0.6", refractiveIndex=1.52)  # -> avrgTrans, RADMaterial; plug-in component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
radmetalmaterial = Honeybee_RadianceMetalMaterial(materialName="Light Shelf", RReflectance="1", GReflectance="1", BReflectance="1", roughness="0", specularity="1")  # -> RADMaterial; plug-in component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
genclimatebasedsky = Honeybee_GenerateClimateBasedSky(weatherFile=epw_stat.epwFile, month="6", day="21", hour="15")  # -> radiationValues, skyFilePath; plug-in component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
createhbsrfs = Honeybee_createHBSrfs(geometry=window, RADMaterial=radglassmaterial.RADMaterial)  # -> readMe, simplify(HBSurface); plug-in component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
flip = Flip(Surface=floor)  # -> Surface, Result
createhbsrfs_2 = Honeybee_createHBSrfs(geometry=[walls, ceiling, floor])  # -> readMe, simplify(HBSurface); plug-in component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
createhbsrfs_3 = Honeybee_createHBSrfs(geometry=light_shelf, RADMaterial=radmetalmaterial)  # -> readMe, simplify(HBSurface); plug-in component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
gentestpts = Honeybee_GenerateTestPoints(testGeometry=flip.Surface, gridSize=".25", distBaseSrf=".762", moveTestMesh=True)  # -> readMe, simplify(testPoints), simplify(ptsVectors), simplify(facesArea), simplify(mesh); plug-in component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
wires = BrepWireframe(Brep=[createhbsrfs_2.HBSurface, createhbsrfs.HBSurface], Density=-1)
radparameters = Honeybee_RADParameters(quality=0, ab="5", ad="600", ar="22")  # -> readMe, radParameters; plug-in component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
gridbasedsimulation = Honeybee_GridBasedSimulation(
    skyFile=genclimatebasedsky.skyFilePath,
    testPoints=gentestpts.testPoints,
    ptsVectors=gentestpts.ptsVectors,
    simulationType=0,
    radParameters=radparameters.radParameters)  # -> analysisRecipe; plug-in component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
toggle = BooleanToggle(True)
rundaylightanalysis = Honeybee_RunDaylightSimulation(
    HBObjects=flatten([createhbsrfs_2.HBSurface, createhbsrfs.HBSurface, createhbsrfs_3.HBSurface]),
    analysisRecipe=gridbasedsimulation,
    writeRad=toggle,
    runRad=toggle,
    overwriteResults=True)  # -> readMe, analysisType, resultsUnit, illuminance_values, testPts, illuminance_files, radGeoFile, studyFolder, done; plug-in component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
panel_2 = Panel(rundaylightanalysis.illuminance_values)
legendpar = Ladybug_LegendParameters(lowBound="100", highBound="3000")  # -> legendPar; plug-in component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
recolormesh = Ladybug_RecolorMesh(
    analysisResult=rundaylightanalysis.illuminance_values,
    inputMesh=gentestpts.mesh,
    legendPar=legendpar,
    analysisTitle="June 21, 3PM",
    legendTitle="Lux")  # -> readMe, newMesh, newLegend, legendBasePt, meshColors, legendColors; plug-in component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
