# Grasshopper definition li_yunqian.gh (Grasshopper 0.9.76)
# plug-ins: Python Interpreter

radglassmaterial = Honeybee_RadianceGlassMaterial(materialName="glass_60", RTransmittance="0.6", GTransmittance="0.6", BTransmittance="0.6", refractiveIndex=1.52)  # -> avrgTrans, RADMaterial; plug-in component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
brep = Brep(<brep referenced from the Rhino model>)
brep_2 = Brep(<brep referenced from the Rhino model>)
brep_3 = Brep(<brep referenced from the Rhino model>)
brep_4 = Brep([<brep referenced from the Rhino model> x3])
ladybug = Ladybug_Ladybug()  # -> Vviiiiiiiiiizzz; plug-in component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
honeybee = Honeybee_Honeybee()  # -> Vviiiiiiiiiizzz; plug-in component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
createhbsrfs = Honeybee_createHBSrfs(geometry=[brep_4, brep_3, brep_2])  # -> readMe, simplify(HBSurface); plug-in component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
createhbsrfs_2 = Honeybee_createHBSrfs(geometry=brep, RADMaterial=radglassmaterial.RADMaterial)  # -> readMe, simplify(HBSurface); plug-in component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
wires = BrepWireframe(Brep=[createhbsrfs_2.HBSurface, createhbsrfs.HBSurface], Density=-1)
flip = Flip(Surface=brep_2)  # -> Surface, Result
path = FilePath("C:\Users\Yunqian\Desktop\Course Fall2017\Building Performance Sim\Philadelphia_weather_files\USA_PA_Philadelphia.Intl.AP.724080_TMY3.epw")
genclimatebasedsky = Honeybee_GenerateClimateBasedSky(weatherFile=path, month="12", day="21", hour="15")  # -> radiationValues, skyFilePath; plug-in component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
gentestpts = Honeybee_GenerateTestPoints(testGeometry=flip.Surface, gridSize="0.5", distBaseSrf="0.762", moveTestMesh=True)  # -> readMe, simplify(testPoints), simplify(ptsVectors), simplify(facesArea), simplify(mesh); plug-in component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
brep_5 = Brep([<brep referenced from the Rhino model> x5])
gridbasedsimulation = Honeybee_GridBasedSimulation(
    skyFile=genclimatebasedsky.skyFilePath,
    testPoints=gentestpts.testPoints,
    ptsVectors=gentestpts.ptsVectors,
    simulationType=0)  # -> analysisRecipe; plug-in component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
createhbsrfs_3 = Honeybee_createHBSrfs(geometry=brep_5, srfType="6")  # -> readMe, simplify(HBSurface); plug-in component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
toggle = BooleanToggle(False)
rundaylightanalysis = Honeybee_RunDaylightSimulation(
    HBObjects=flatten([createhbsrfs_2.HBSurface, createhbsrfs.HBSurface, createhbsrfs_3.HBSurface]),
    analysisRecipe=gridbasedsimulation,
    writeRad=toggle,
    runRad=toggle,
    overwriteResults=True)  # -> readMe, analysisType, resultsUnit, results, testPts, resultFiles, radGeoFile, studyFolder, done; plug-in component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
legendpar = Ladybug_LegendParameters(lowBound="300", highBound="4000")  # -> legendPar; plug-in component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
recolormesh = Ladybug_RecolorMesh(
    analysisResult=rundaylightanalysis.results,
    inputMesh=gentestpts.mesh,
    legendPar=legendpar,
    analysisTitle="illuminance",
    legendTitle="lux")  # -> readMe, newMesh, newLegend, legendBasePt, meshColors, legendColors; plug-in component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
