# Grasshopper definition ma_xiaoyu.gh (Grasshopper 0.9.76)
# plug-ins: Python Interpreter

honeybee = Honeybee_Honeybee()  # -> Vviiiiiiiiiizzz; plug-in component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
ladybug = Ladybug_Ladybug()  # -> Vviiiiiiiiiizzz; plug-in component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
radglassmaterial = Honeybee_RadianceGlassMaterial(materialName="Glass_60", RTransmittance="0.6", GTransmittance="0.6", BTransmittance="0.6", refractiveIndex=1.52)  # -> avrgTrans, RADMaterial; plug-in component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

# ---- group: Wall
brep = Brep([<brep referenced from the Rhino model> x4])

# ---- group: Ceiling
brep_2 = Brep(<brep referenced from the Rhino model>)

# ---- group: Shade
brep_3 = Brep(<brep referenced from the Rhino model>)

# ---- group: Floor
brep_4 = Brep(<brep referenced from the Rhino model>)

# ----
flip = Flip(Surface=brep_4)  # -> Surface, Result

# ---- group: Window
brep_5 = Brep(<brep referenced from the Rhino model>)

# ----
createhbsrfs = Honeybee_createHBSrfs(geometry=brep_5, RADMaterial=radglassmaterial.RADMaterial)  # -> readMe, simplify(HBSurface); plug-in component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
createhbsrfs_2 = Honeybee_createHBSrfs(geometry=[brep_4, brep, brep_2])  # -> readMe, simplify(HBSurface); plug-in component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
createhbsrfs_3 = Honeybee_createHBSrfs(geometry=brep_3, srfType="6")  # -> readMe, simplify(HBSurface); plug-in component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
panel = Panel("https://www.energyplus.net/weather-download/north_and_central_america_wmo_region_4/USA/PA/USA_PA_Philadelphia.Intl.AP.724080_TMY3/all")
epw_stat = Ladybug_OpenEPWAndSTATWeatherFiles(weatherFileURL=panel)  # -> epwFile, statFile; plug-in component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
gentestpts = Honeybee_GenerateTestPoints(testGeometry=flip.Surface, gridSize="0.1", distBaseSrf="0.765", moveTestMesh=True)  # -> readMe, simplify(testPoints), simplify(ptsVectors), simplify(facesArea), simplify(mesh); plug-in component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
radparameters = Honeybee_RADParameters(quality=0)  # -> readMe, radParameters; plug-in component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
genclimatebasedsky = Honeybee_GenerateClimateBasedSky(weatherFile=epw_stat.epwFile, month="3", day="21", hour="9")  # -> radiationValues, skyFilePath; plug-in component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
gridbasedsimulation = Honeybee_GridBasedSimulation(
    skyFile=genclimatebasedsky.skyFilePath,
    testPoints=gentestpts.testPoints,
    ptsVectors=gentestpts.ptsVectors,
    simulationType=0,
    radParameters=radparameters.radParameters)  # -> analysisRecipe; plug-in component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
toggle = BooleanToggle(False)
rundaylightanalysis = Honeybee_RunDaylightSimulation(
    HBObjects=flatten([createhbsrfs.HBSurface, createhbsrfs_2.HBSurface, createhbsrfs_3.HBSurface]),
    analysisRecipe=gridbasedsimulation,
    writeRad=toggle,
    runRad=toggle,
    overwriteResults=True)  # -> readMe, analysisType, resultsUnit, results, testPts, resultFiles, radGeoFile, studyFolder, done; plug-in component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
wires = BrepWireframe(Brep=[createhbsrfs.HBSurface, createhbsrfs_2.HBSurface, createhbsrfs_3.HBSurface], Density=-1)
legendpar = Ladybug_LegendParameters(lowBound="300", highBound="2000")  # -> legendPar; plug-in component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
recolormesh = Ladybug_RecolorMesh(
    analysisResult=rundaylightanalysis.results,
    inputMesh=gentestpts.mesh,
    legendPar=legendpar,
    analysisTitle="Illuminance",
    legendTitle="LUX")  # -> readMe, newMesh, newLegend, legendBasePt, meshColors, legendColors; plug-in component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
