# Grasshopper definition nelson_graham.gh (Grasshopper 0.9.76)
# plug-ins: Python Interpreter

brep = Brep([<brep referenced from the Rhino model> x5])
brep_2 = Brep([<brep referenced from the Rhino model> x52])
brep_3 = Brep(<brep referenced from the Rhino model>)
radopaquematerial = Honeybee_RadianceOpaqueMaterial(materialName="floor_20", RReflectance=".2", GReflectance=".2", BReflectance=".2", roughness=0.05, specularity=0)  # -> avrgRef, RADMaterial; plug-in component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
radopaquematerial_2 = Honeybee_RadianceOpaqueMaterial(materialName="ceiling_70", RReflectance=".7", GReflectance=".7", BReflectance=".7", roughness=0.05, specularity=0)  # -> avrgRef, RADMaterial; plug-in component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
brep_4 = Brep(<brep referenced from the Rhino model>)
ladybug = Ladybug_Ladybug()  # -> Vviiiiiiiiiizzz; plug-in component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
honeybee = Honeybee_Honeybee(defaultFolder="C:\ladybug")  # -> Vviiiiiiiiiizzz; plug-in component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
radopaquematerial_3 = Honeybee_RadianceOpaqueMaterial(materialName="wall_50", RReflectance=".5", GReflectance=".5", BReflectance=".5", roughness=0.05, specularity=0)  # -> avrgRef, RADMaterial; plug-in component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
radglassmaterial = Honeybee_RadianceGlassMaterial(materialName="glass_60", RTransmittance="0.6", GTransmittance="0.6", BTransmittance="0.6", refractiveIndex=1.52)  # -> avrgTrans, RADMaterial; plug-in component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
createhbsrfs = Honeybee_createHBSrfs(geometry=brep_4, RADMaterial=radopaquematerial.RADMaterial)  # -> readMe, simplify(HBSurface); plug-in component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
createhbsrfs_2 = Honeybee_createHBSrfs(geometry=brep_3, RADMaterial=radopaquematerial_2.RADMaterial)  # -> readMe, simplify(HBSurface); plug-in component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
panel = Panel(honeybee)
createhbsrfs_3 = Honeybee_createHBSrfs(geometry=brep, RADMaterial=radglassmaterial.RADMaterial)  # -> readMe, simplify(HBSurface); plug-in component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
createhbsrfs_4 = Honeybee_createHBSrfs(geometry=brep_2, RADMaterial=radopaquematerial_3.RADMaterial)  # -> readMe, simplify(HBSurface); plug-in component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
flip = Flip(Surface=brep_4)  # -> Surface, Result
gentestpts = Honeybee_GenerateTestPoints(testGeometry=brep_4, gridSize=".5", distBaseSrf=".762", moveTestMesh=True)  # -> readMe, simplify(testPoints), simplify(ptsVectors), simplify(facesArea), simplify(mesh); plug-in component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
merge = Merge(
    Data1=createhbsrfs_3.HBSurface,
    Data2=createhbsrfs_4.HBSurface,
    Data3=createhbsrfs_2.HBSurface,
    Data4=createhbsrfs.HBSurface)
preview = CustomPreview(
    Geometry=gentestpts.testPoints,
    Shader={ambient=RGB(0, 0, 0), diffuse=RGB(255, 105, 180), emission=RGB(76, 32, 54), shine=0.5, specular=RGB(255, 255, 255), transparency=0})
path = FilePath("C:\Users\Graham P Nelson\Documents\MEBD\Mostapha Class\USA_PA_Philadelphia.Intl.AP.724080_TMY3\USA_PA_Philadelphia.Intl.AP.724080_TMY3.epw")
genclimatebasedsky = Honeybee_GenerateClimateBasedSky(weatherFile=path, month="6", day="21", hour="9")  # -> radiationValues, skyFilePath; plug-in component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
radparameters = Honeybee_RADParameters(quality=0, ab="3")  # -> readMe, radParameters; plug-in component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
gridbasedsimulation = Honeybee_GridBasedSimulation(
    skyFile=genclimatebasedsky.skyFilePath,
    testPoints=gentestpts.testPoints,
    ptsVectors=gentestpts.ptsVectors,
    simulationType=0,
    radParameters=radparameters.radParameters)  # -> analysisRecipe; plug-in component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
toggle = BooleanToggle(True)
panel_2 = Panel(radparameters.readMe)
rundaylightanalysis = Honeybee_RunDaylightSimulation(
    HBObjects=flatten(merge),
    analysisRecipe=gridbasedsimulation,
    writeRad=toggle,
    runRad=toggle,
    workingDir="C:\ladybug",
    radFileName="test",
    overwriteResults=True)  # -> readMe, analysisType, resultsUnit, illuminance_values, testPts, illuminance_files, radGeoFile, studyFolder, done; plug-in component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
legendpar = Ladybug_LegendParameters(lowBound="100", highBound="4000")  # -> legendPar; plug-in component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
panel_3 = Panel(rundaylightanalysis.illuminance_values)
recolormesh = Ladybug_RecolorMesh(
    analysisResult=rundaylightanalysis.illuminance_values,
    inputMesh=gentestpts.mesh,
    legendPar=legendpar,
    analysisTitle="Illuminance",
    legendTitle="lux")  # -> readMe, newMesh, newLegend, legendBasePt, meshColors, legendColors; plug-in component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
