# Grasshopper definition peng_yunzhongda.gh (Grasshopper 0.9.76)
# plug-ins: Python Interpreter, Bifocals

radglassmaterial = Honeybee_RadianceGlassMaterial(materialName="glass_60", RTransmittance="0.6", GTransmittance="0.6", BTransmittance="0.6", refractiveIndex=1.52)  # -> avrgTrans, RADMaterial; plug-in component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
ladybug = Ladybug_Ladybug()  # -> Vviiiiiiiiiizzz; plug-in component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
honeybee = Honeybee_Honeybee()  # -> Vviiiiiiiiiizzz; plug-in component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

# ---- group: glass
brep = Brep(<brep referenced from the Rhino model>)

# ---- group: floor
brep_2 = Brep(<brep referenced from the Rhino model>)

# ---- group: ceiling
brep_3 = Brep(<brep referenced from the Rhino model>)

# ---- group: wall
brep_4 = Brep(<brep referenced from the Rhino model>)

# ----
createhbsrfs = Honeybee_createHBSrfs(geometry=[brep_4, brep_3, brep_2])  # -> readMe, simplify(HBSurface); plug-in component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
createhbsrfs_2 = Honeybee_createHBSrfs(geometry=brep, RADMaterial=radglassmaterial.RADMaterial)  # -> readMe, simplify(HBSurface); plug-in component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
panel = Panel("C:\Users\weslie\Downloads\USA_PA_Philadelphia.Intl.AP.724080_TMY3.epw")
brep_5 = Brep(<brep referenced from the Rhino model>)
panel_2 = Panel("3")
wires = BrepWireframe(Brep=[createhbsrfs_2.HBSurface, createhbsrfs.HBSurface], Density=-1)
flip = Flip(Surface=brep_2)  # -> Surface, Result
path = FilePath(panel)
createhbsrfs_3 = Honeybee_createHBSrfs(geometry=brep_5, srfType="6")  # -> readMe, simplify(HBSurface); plug-in component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
gentestpts = Honeybee_GenerateTestPoints(testGeometry=brep_2, gridSize="0.1", distBaseSrf="0.762", moveTestMesh=True)  # -> readMe, simplify(testPoints), simplify(ptsVectors), simplify(facesArea), simplify(mesh); plug-in component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
radparameters = Honeybee_RADParameters(quality=0)  # -> readMe, radParameters; plug-in component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
panel_3 = Panel(radparameters.readMe)
toggle = BooleanToggle(True)
panel_4 = Panel("4000")
legendpar = Ladybug_LegendParameters(lowBound="100")  # -> legendPar; plug-in component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
num = Number([26828.52, 25830.13, 24876.81, 23895.21, 22498.48, 21016.93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])
panel_5 = Panel(num)
genclimatebasedsky = Honeybee_GenerateClimateBasedSky(weatherFile=path, month="6", day="21", hour="9")  # -> radiationValues, skyFilePath; plug-in component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
panel_6 = Panel(genclimatebasedsky.skyFilePath)
gridbasedsimulation = Honeybee_GridBasedSimulation(
    skyFile=genclimatebasedsky.skyFilePath,
    testPoints=gentestpts.testPoints,
    ptsVectors=gentestpts.ptsVectors,
    simulationType=0,
    radParameters=radparameters.radParameters)  # -> analysisRecipe; plug-in component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
rundaylightanalysis = Honeybee_RunDaylightSimulation(
    HBObjects=flatten([createhbsrfs_2.HBSurface, createhbsrfs.HBSurface, createhbsrfs_3.HBSurface]),
    analysisRecipe=gridbasedsimulation,
    writeRad=toggle,
    runRad=toggle,
    overwriteResults=True)  # -> readMe, analysisType, resultsUnit, illuminance_values, testPts, illuminance_files, radGeoFile, studyFolder, done; plug-in component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
recolormesh = Ladybug_RecolorMesh(
    analysisResult=rundaylightanalysis.illuminance_values,
    inputMesh=gentestpts.mesh,
    legendPar=legendpar,
    analysisTitle="illuminance",
    legendTitle="lux",
    bakeIt=Slider(2, range=0..10))  # -> readMe, newMesh, newLegend, legendBasePt, meshColors, legendColors; plug-in component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
panel_7 = Panel(rundaylightanalysis.illuminance_values)
mjoin = MeshJoin(Meshes=[recolormesh.newMesh, recolormesh.newLegend])
