# Grasshopper definition wang_yuchi.gh (Grasshopper 0.9.76)
# plug-ins: Python Interpreter

ladybug = Ladybug_Ladybug()  # -> Vviiiiiiiiiizzz; plug-in component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
honeybee = Honeybee_Honeybee()  # -> Vviiiiiiiiiizzz; plug-in component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
panel = Panel(honeybee)
radglassmaterial = Honeybee_RadianceGlassMaterial(materialName=" Glass_60", RTransmittance="0.6", GTransmittance="0.6", BTransmittance="0.6", refractiveIndex=1.52)  # -> avrgTrans, RADMaterial; plug-in component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

# ---- group: Ceiling
brep = Brep(<brep referenced from the Rhino model>)

# ---- group: Floor
brep_2 = Brep(<brep referenced from the Rhino model>)

# ---- group: Wall
brep_3 = Brep([<brep referenced from the Rhino model> x7])

# ----
brep_4 = Brep([<brep referenced from the Rhino model> x4])

# ---- group: Glass
brep_5 = Brep([<brep referenced from the Rhino model> x20])

# ----
createhbsrfs = Honeybee_createHBSrfs(geometry=brep_5, RADMaterial=radglassmaterial.RADMaterial)  # -> readMe, simplify(HBSurface); plug-in component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
createhbsrfs_2 = Honeybee_createHBSrfs(geometry=[brep, brep_2, brep_3])  # -> readMe, simplify(HBSurface); plug-in component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
createhbsrfs_3 = Honeybee_createHBSrfs(geometry=brep_4, srfType="6")  # -> readMe, simplify(HBSurface); plug-in component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
path = FilePath("\\juno.design.upenn.edu\home\grad\arch\yuchwang\Desktop\BuildingSimulation\Philadelphia_weather_files\USA_PA_Philadelphia.Intl.AP.724080_TMY3.epw")
num = Number("12")
num_2 = Number("21")
num_3 = Number("15")
genstandardciesky = Honeybee_GenerateStandardCIESky(skyType=0)  # -> skyFilePath; plug-in component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
genclimatebasedsky = Honeybee_GenerateClimateBasedSky(weatherFile=path, month=num, day=num_2, hour=num_3)  # -> radiationValues, skyFilePath; plug-in component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
wires = BrepWireframe(Brep=[createhbsrfs_2.HBSurface, createhbsrfs.HBSurface, createhbsrfs_3.HBSurface], Density=-1)
panel_2 = Panel(createhbsrfs_3.readMe)
preview = CustomPreview(Geometry=wires, Shader=ColourSwatch(SwatchColor=RGB(0, 0, 0)))
flip = Flip(Surface=brep_2)  # -> Surface, Result
panel_3 = Panel(genclimatebasedsky.skyFilePath)
gentestpts = Honeybee_GenerateTestPoints(testGeometry=flip.Surface, gridSize="0.5", distBaseSrf="0.75", moveTestMesh=True)  # -> readMe, simplify(testPoints), simplify(ptsVectors), simplify(facesArea), simplify(mesh); plug-in component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
radparameters = Honeybee_RADParameters(quality="0")  # -> readMe, radParameters; plug-in component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
preview_2 = CustomPreview(Geometry=brep_2, Shader=ColourSwatch(SwatchColor=RGB(212, 212, 212)))
gridbasedsimulation = Honeybee_GridBasedSimulation(
    skyFile=genclimatebasedsky.skyFilePath,
    testPoints=gentestpts.testPoints,
    ptsVectors=gentestpts.ptsVectors,
    simulationType=0,
    radParameters=radparameters.radParameters)  # -> analysisRecipe; plug-in component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
toggle = BooleanToggle(False)
rundaylightanalysis = Honeybee_RunDaylightSimulation(
    HBObjects=flatten([createhbsrfs.HBSurface, createhbsrfs_2.HBSurface, createhbsrfs_3.HBSurface]),
    analysisRecipe=gridbasedsimulation,
    writeRad=toggle,
    runRad=toggle,
    overwriteResults=True)  # -> readMe, analysisType, resultsUnit, results, testPts, resultFiles, radGeoFile, studyFolder, done; plug-in component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
legendpar = Ladybug_LegendParameters(lowBound="300", highBound="2000")  # -> legendPar; plug-in component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
recolormesh = Ladybug_RecolorMesh(
    analysisResult=rundaylightanalysis.results,
    inputMesh=gentestpts.mesh,
    legendPar=legendpar,
    analysisTitle="21st Dec., 3p",
    legendTitle="Lux")  # -> readMe, newMesh, newLegend, legendBasePt, meshColors, legendColors; plug-in component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
panel_4 = Panel(rundaylightanalysis.results)
