# Grasshopper definition zhang_yunlong.gh (Grasshopper 0.9.76)
# plug-ins: Python Interpreter

honeybee = Honeybee_Honeybee()  # -> out; plug-in component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
ladybug = Ladybug_Ladybug()  # -> out; plug-in component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
radglassmaterial = Honeybee_RadianceGlassMaterial(materialName="glass_60", RTransmittance="0.6", GTransmittance="0.6", BTransmittance="0.6", refractiveIndex=1.52)  # -> avrgTrans, RADMaterial; plug-in component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

# ----
# roof
brep = Brep(<brep referenced from the Rhino model>)

# ----
# wall
brep_2 = Brep([<brep referenced from the Rhino model> x71])

# ----
# floor
brep_3 = Brep(<brep referenced from the Rhino model>)

# ----
# window
brep_4 = Brep([<brep referenced from the Rhino model> x25])

createhbsrfs = Honeybee_createHBSrfs(geometry=brep_4, RADMaterial=radglassmaterial.RADMaterial)  # -> readMe, simplify(HBSurface); plug-in component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
createhbsrfs_2 = Honeybee_createHBSrfs(geometry=[brep_2, brep, brep_3])  # -> readMe, simplify(HBSurface); plug-in component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

panel = Panel("6")
panel_2 = Panel("21")
panel_3 = Panel("9")

panel_6 = Panel("3")

panel_7 = Panel("12")

gentestpts = Honeybee_GenerateTestPoints(testGeometry=brep_3, gridSize="0.5", distBaseSrf="0.75", moveTestMesh=True)  # -> out, simplify(testPoints), simplify(ptsVectors), simplify(facesArea), simplify(mesh); plug-in component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
file_path = FilePath("D:\zyunlong\Philadelphia_weather_files\USA_PA_Philadelphia.Intl.AP.724080_TMY3.epw")
radparameters = Honeybee_RADParameters(quality="0")  # -> out, radParameters; plug-in component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

panel_18 = Panel("15")

genclimatebasedsky = Honeybee_GenerateClimateBasedSky(weatherFile=file_path, month="3", day="21", hour="12")  # -> out, skyFilePath; plug-in component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
gridbasedsimulation = Honeybee_GridBasedSimulation(
    skyFile=genclimatebasedsky.skyFilePath,
    testPoints=gentestpts.testPoints,
    ptsVectors=gentestpts.ptsVectors,
    simulationType=0,
    radParameters=radparameters.radParameters)  # -> analysisRecipe; plug-in component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
legendpar = Ladybug_LegendParameters(lowBound="100", highBound="2000")  # -> legendPar; plug-in component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
rundaylightanalysis = Honeybee_RunDaylightSimulation(
    HBObjects=flatten([createhbsrfs_2.HBSurface, createhbsrfs.HBSurface]),
    analysisRecipe=gridbasedsimulation,
    writeRad=Toggle(True),
    runRad=Toggle(True),
    overwriteResults=True)  # -> out, analysisType, resultsUnit, illuminance_values, testPts, illuminance_files, radGeoFile, studyFolder, done; plug-in component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

panel_25 = Panel("March.21st.12pm")

panel_26 = Panel("Dec.21st.9am")

recolormesh = Ladybug_RecolorMesh(
    analysisResult=rundaylightanalysis.illuminance_values,
    inputMesh=gentestpts.mesh,
    legendPar=legendpar,
    analysisTitle="June.21st.12pm",
    legendTitle="LUX")  # -> out, newMesh, newLegend, legendBasePt, meshColors, legendColors; plug-in component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
