# Grasshopper definition zhao_xiaoyu.gh (Grasshopper 0.9.76)
# plug-ins: Python Interpreter

ladybug = Ladybug_Ladybug()  # -> Vviiiiiiiiiizzz; plug-in component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
honeybee = Honeybee_Honeybee()  # -> Vviiiiiiiiiizzz; plug-in component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

# ---- group: glass
brep = Brep(<brep referenced from the Rhino model>)

# ---- group: wall
brep_2 = Brep([<brep referenced from the Rhino model> x4])

# ---- group: ceiling
brep_3 = Brep(<brep referenced from the Rhino model>)

# ---- group: ground
brep_4 = Brep(<brep referenced from the Rhino model>)

# ----
radglassmaterial = Honeybee_RadianceGlassMaterial(materialName="glass_60", RTransmittance="0.6", GTransmittance="0.6", BTransmittance="0.6", refractiveIndex=1.52)  # -> avrgTrans, RADMaterial; plug-in component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
panel = Panel(honeybee)
panel_2 = Panel(ladybug)
createhbsrfs = Honeybee_createHBSrfs(geometry=[brep_2, brep_3, brep_4])  # -> readMe, simplify(HBSurface); plug-in component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
createhbsrfs_2 = Honeybee_createHBSrfs(geometry=brep, RADMaterial=radglassmaterial.RADMaterial)  # -> readMe, simplify(HBSurface); plug-in component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
askme = Honeybee_AskMe(HBObjects=createhbsrfs.HBSurface)  # -> readMe; plug-in component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
panel_3 = Panel(askme)
path = FilePath("\\juno.design.upenn.edu\home\grad\arch\xiaoyuz\Desktop\Philadelphia_weather_files\USA_PA_Philadelphia.Intl.AP.724080_TMY3.epw")
genclimatebasedsky = Honeybee_GenerateClimateBasedSky(weatherFile=path, month=Slider(10, range=1..12), day=Slider(20, range=1..31), hour=Slider(12, range=1..24))  # -> radiationValues, skyFilePath; plug-in component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
gentestpts = Honeybee_GenerateTestPoints(testGeometry=brep_4, gridSize="0.5", distBaseSrf="0.762", moveTestMesh=True)  # -> readMe, simplify(testPoints), simplify(ptsVectors), simplify(facesArea), simplify(mesh); plug-in component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
radparameters = Honeybee_RADParameters(quality=Slider(0, range=0..2))  # -> readMe, radParameters; plug-in component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
gridbasedsimulation = Honeybee_GridBasedSimulation(
    skyFile=genclimatebasedsky.skyFilePath,
    testPoints=gentestpts.testPoints,
    ptsVectors=gentestpts.ptsVectors,
    simulationType=gentestpts.mesh,
    radParameters=radparameters.radParameters)  # -> analysisRecipe; plug-in component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
toggle = BooleanToggle(False)
rundaylightanalysis = Honeybee_RunDaylightSimulation(
    HBObjects=flatten([createhbsrfs.HBSurface, createhbsrfs_2.HBSurface]),
    analysisRecipe=gridbasedsimulation,
    writeRad=toggle,
    runRad=toggle,
    overwriteResults=True)  # -> readMe, analysisType, resultsUnit, results, testPts, resultFiles, radGeoFile, studyFolder, done; plug-in component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
legendpar = Ladybug_LegendParameters(lowBound="100", highBound="40000")  # -> legendPar; plug-in component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
panel_4 = Panel(rundaylightanalysis.results)
recolormesh = Ladybug_RecolorMesh(analysisResult=rundaylightanalysis.results, legendPar=legendpar)  # -> readMe, newMesh, newLegend, legendBasePt, meshColors, legendColors; plug-in component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
