# Grasshopper definition chan_lokyunpriscilla.gh (Grasshopper 0.9.70)
# plug-ins: Python Interpreter, Ironbug

ladybug = Ladybug_Ladybug()  # -> Vviiiiiiiiiizzz; plug-in component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
honeybee = Honeybee_Honeybee()  # -> Vviiiiiiiiiizzz; plug-in component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

# ---- group: Set geometry materials & preview / floor
brep = Brep(<brep referenced from the Rhino model>)

# ---- group: Set geometry materials & preview / walls
brep_2 = Brep([<brep referenced from the Rhino model> x11])

# ---- group: Set geometry materials & preview / ceiling
brep_3 = Brep(<brep referenced from the Rhino model>)

# ----
panel = Panel(honeybee)
radopaquematerial = Honeybee_RadianceOpaqueMaterial(materialName="floor_60", RReflectance="0.6", GReflectance="0.6", BReflectance="0.6", roughness=0.05, specularity=0)  # -> avrgRef, RADMaterial; plug-in component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

# ---- group: Set geometry materials & preview / light shelf
brep_4 = Brep([<brep referenced from the Rhino model> x3])

# ---- group: Set geometry materials & preview / Glass
brep_5 = Brep([<brep referenced from the Rhino model> x3])

# ----
createhbsrfs = Honeybee_createHBSrfs(geometry=brep, RADMaterial=radopaquematerial.RADMaterial)  # -> readMe, simplify(HBSurface); plug-in component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

# ---- group: Set geometry materials & preview
radopaquematerial_2 = Honeybee_RadianceOpaqueMaterial(materialName="plastic_80", RReflectance="0.8", GReflectance="0.8", BReflectance="0.8", roughness=0.05, specularity=0)  # -> avrgRef, RADMaterial; plug-in component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
radglassmaterial = Honeybee_RadianceGlassMaterial(materialName="glass_80", RTransmittance="0.8", GTransmittance="0.8", BTransmittance="0.8", refractiveIndex=1.52)  # -> avrgTrans, RADMaterial; plug-in component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
radopaquematerial_3 = Honeybee_RadianceOpaqueMaterial(materialName="walls_80", RReflectance="0.8", GReflectance="0.8", BReflectance="0.8", roughness=0.05, specularity=0)  # -> avrgRef, RADMaterial; plug-in component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
createhbsrfs_2 = Honeybee_createHBSrfs(geometry=brep_4, RADMaterial=radopaquematerial_2.RADMaterial)  # -> readMe, simplify(HBSurface); plug-in component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
createhbsrfs_3 = Honeybee_createHBSrfs(geometry=brep_5, RADMaterial=radglassmaterial.RADMaterial)  # -> readMe, simplify(HBSurface); plug-in component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
createhbsrfs_4 = Honeybee_createHBSrfs(geometry=[brep_2, brep_3], RADMaterial=radopaquematerial_3.RADMaterial)  # -> readMe, simplify(HBSurface); plug-in component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
wires = BrepWireframe(Brep=[createhbsrfs_3.HBSurface, createhbsrfs_4.HBSurface, createhbsrfs_2.HBSurface, createhbsrfs.HBSurface], Density=-1)

# ----
path = FilePath("C:\Users\Priscilla Chan\Documents\UPenn\Arch 753\USA_PA_Philadelphia.Intl.AP.724080_TMY3\USA_PA_Philadelphia.Intl.AP.724080_TMY3.epw")

# ---- group: rad parameters
radparameters = Honeybee_RADParameters(quality=0, ab="2", ad="1024", as="256", aa="0.2")  # -> readMe, radParameters; plug-in component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
panel_2 = Panel(radparameters.readMe)

# ---- group: Image-based simulation for glare analysis
panel_3 = Panel("""3
6
12""")
panel_4 = Panel("""9
12
15""")
item = ListItem(List=panel_3, Index=Slider(2, range=0..2), Wrap=True)
item_2 = ListItem(List=panel_4, Index=Slider(2, range=0..2), Wrap=True)
genclimatebasedsky = Honeybee_GenerateClimateBasedSky(weatherFile=path, month=item, day="21", hour=item_2)  # -> radiationValues, skyFilePath; plug-in component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
doy_hoy = Ladybug_DOY_HOY(days="21", months=item, hours=item_2)  # -> HOY, DOY, date; plug-in component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
imagebasedsimulation = Honeybee_ImageBasedSimulation(
    skyFile=genclimatebasedsky.skyFilePath,
    cameraType="1",
    simulationType=2,
    radParameters=radparameters.radParameters,
    backupImages=0)  # -> analysisRecipe; plug-in component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
concat = Concatenate(FragmentA="lightshelf_III_", FragmentB=doy_hoy.date)

# ---- group: Grid-based annual daylight analysis
gentestpts = Honeybee_GenerateTestPoints(testGeometry=brep, gridSize="1", distBaseSrf="2.5")  # -> readMe, simplify(testPoints), simplify(ptsVectors), simplify(facesArea), simplify(mesh); plug-in component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
annualdaylightsimulation = Honeybee_AnnualDaylightSimulation(
    epwWeatherFile=path,
    testPoints=gentestpts.testPoints,
    ptsVectors=gentestpts.ptsVectors,
    radParameters=radparameters.radParameters)  # -> analysisRecipe; plug-in component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

# ---- group: Daylight simulation
toggle = BooleanToggle(False)
rundaylightanalysis = Honeybee_RunDaylightSimulation(
    HBObjects=flatten([createhbsrfs_3.HBSurface, createhbsrfs_4.HBSurface, createhbsrfs_2.HBSurface, createhbsrfs.HBSurface]),
    analysisRecipe=annualdaylightsimulation,
    writeRad=toggle,
    runRad=toggle)  # -> readMe, analysisType, resultsUnit, results, testPts, resultFiles, radGeoFile, studyFolder, done; plug-in component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

# ---- group: Interpret annual daylight simulation results
analysisperiod = Ladybug_AnalysisPeriod(fromMonth="8", fromDay="24", toMonth="5")  # -> readMe, analysisPeriod; plug-in component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
series = Series(Start="9", Step=1, Count="8")
occupancygenerator = Honeybee_DaysimOccupancyGenerator(occupancyPeriod=analysisperiod.analysisPeriod, dailyOffHours=series, weekendDays="0", writeTheOcc=Toggle(False))  # -> occupancyFile; plug-in component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
legendpar = Ladybug_LegendParameters(decimalPlaces="0")  # -> legendPar; plug-in component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
readannualresultsi = Honeybee_ReadAnnualResultI(
    illFilesAddress=rundaylightanalysis.resultFiles,
    testPoints=simplify(gentestpts.testPoints),
    ptsVectors=gentestpts.ptsVectors,
    occupancyFiles=occupancygenerator,
    DLAIllumThresholds=300,
    runIt=Toggle(False))  # -> DLA, UDLI_Less_100, UDLI_100_2000, UDLI_More_2000, CDA, sDA, annualProfiles, htmReport; plug-in component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
recolormesh = Ladybug_RecolorMesh(
    analysisResult=readannualresultsi.UDLI_More_2000,
    inputMesh=gentestpts.mesh,
    legendPar=legendpar,
    analysisTitle="UDI",
    legendTitle="%",
    bakeIt=Toggle(False))  # -> readMe, newMesh, newLegend, legendBasePt, meshColors, legendColors; plug-in component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

# ---- group: Glare analysis
glareanalysis = Honeybee_GlareAnalysis(runIt=Toggle(True))  # -> readMe, glareCheckImage, DGP, DGI, glareComfortRange, imageWithTaskArea; plug-in component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
panel_5 = Panel(glareanalysis.DGP)
hdr_tif = Honeybee_ConvertHDRToTIF(HDRFilePath=glareanalysis.glareCheckImage, adjustExposure=False)  # -> TIFFFilePath; plug-in component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
viewer = Ladybug_ImageViewer(ImagePath_=hdr_tif, _scale_=1, DisableClickable=False, SaveImgWithCoords=False, scale=1)  # -> ImagePath, Colors, GIF
