# Grasshopper definition farah_silmi.gh (Grasshopper 0.9.76)
# plug-ins: Python Interpreter, Ironbug

ladybug = Ladybug_Ladybug()  # -> Vviiiiiiiiiizzz; plug-in component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
honeybee = Honeybee_Honeybee()  # -> Vviiiiiiiiiizzz; plug-in component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

# ---- group: MAterials / Brep floor
floor = Brep(<brep referenced from the Rhino model>)

# ---- group: MAterials / Brep wall
wall = Brep(<brep referenced from the Rhino model>)

# ---- group: MAterials / Brep ceiling
ceiling = Brep(<brep referenced from the Rhino model>)

# ---- group: MAterials
shade = Brep([<brep referenced from the Rhino model> x17])
createhbsrfs = Honeybee_createHBSrfs(geometry=wall, srfType=Slider(0, range=0..6))  # -> readMe, simplify(HBSurface); plug-in component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
createhbsrfs_2 = Honeybee_createHBSrfs(geometry=ceiling, srfType=Slider(3, range=0..6))  # -> readMe, simplify(HBSurface); plug-in component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
createhbsrfs_3 = Honeybee_createHBSrfs(geometry=floor, srfType=Slider(2, range=0..6))  # -> readMe, simplify(HBSurface); plug-in component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
createhbsrfs_4 = Honeybee_createHBSrfs(srfType=Slider(2, range=0..6))  # -> readMe, simplify(HBSurface); plug-in component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

radmetalmaterial = Honeybee_RadianceMetalMaterial(materialName="reflec_10", RReflectance=".9", GReflectance=".9", BReflectance=".9", roughness=0, specularity=0.9)  # -> RADMaterial; plug-in component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
createhbsrfs_5 = Honeybee_createHBSrfs(geometry=shade, RADMaterial=radmetalmaterial)  # -> readMe, simplify(HBSurface); plug-in component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

# ---- group: MAterials / Brep glass
glass = Brep(<brep referenced from the Rhino model>)

# ---- group: MAterials
radglassmaterial = Honeybee_RadianceGlassMaterial(materialName="glas_60", RTransmittance=".6", GTransmittance=".6", BTransmittance=".6", refractiveIndex=1.52)  # -> avrgTrans, RADMaterial; plug-in component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
createhbsrfs_6 = Honeybee_createHBSrfs(geometry=glass, RADMaterial=radglassmaterial.RADMaterial)  # -> readMe, simplify(HBSurface); plug-in component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

# ----
brep = Brep([createhbsrfs_6.HBSurface, createhbsrfs.HBSurface, createhbsrfs_2.HBSurface, createhbsrfs_3.HBSurface, createhbsrfs_5.HBSurface])
wires = BrepWireframe(Brep=brep, Density=-1)
open_weather_file = Ladybug_OpenEPWWeatherFile(open=Toggle(True))  # -> epwFile; plug-in component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

# ---- group: Recipe
number_slider = Slider(45, range=0..100)
northarrow = Ladybug_North(north=number_slider, scale=".05")  # -> northSign; plug-in component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
genclimatebasedsky = Honeybee_GenerateClimateBasedSky(north=number_slider, weatherFile=open_weather_file, month="12", day="21", hour="12")  # -> radiationValues, skyFilePath; plug-in component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
genavgsky = Honeybee_GenerateAverageSky(north=number_slider, weatherFile=open_weather_file, month="12", hour="12")  # -> radiationValues, skyFilePath; plug-in component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
panel = Panel(genclimatebasedsky.radiationValues)
radparameters = Honeybee_RADParameters(quality=0, ab="3")  # -> readMe, radParameters; plug-in component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
set_the_view_to_fisheye_for_glare_analys = Panel("1")  # "set the view to FishEye for Glare Analysis"
doy_hoy = Ladybug_DOY_HOY(days="21", months="12", hours="12")  # -> HOY, DOY, date; plug-in component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
imagebasedsimulation = Honeybee_ImageBasedSimulation(
    skyFile=genavgsky.skyFilePath,
    cameraType=set_the_view_to_fisheye_for_glare_analys,
    simulationType=2,
    radParameters=radparameters.radParameters,
    backupImages=0)  # -> analysisRecipe; plug-in component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

# ----
toggle = BooleanToggle(True)
rundaylightanalysis = Honeybee_RunDaylightSimulation(
    HBObjects=flatten(brep),
    analysisRecipe=imagebasedsimulation,
    writeRad=toggle,
    runRad=toggle,
    numOfCPUs="4",
    workingDir="F:\MEBD\glare_analysis",
    radFileName=doy_hoy.date,
    overwriteResults=True)  # -> readMe, analysisType, resultsUnit, results, testPts, luminance_files, radGeoFile, studyFolder, done; plug-in component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
falsecolor = Honeybee_FalseColor(contourBands=False, maskThreshold=0.1, useAlterColors=False)  # -> outputFilePath; plug-in component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
glareanalysis = Honeybee_GlareAnalysis(HDRImagePath=rundaylightanalysis.luminance_files, runIt=Toggle(True))  # -> readMe, glareCheckImage, DGP, DGI, glareComfortRange, imageWithTaskArea; plug-in component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
falsecolor_2 = Honeybee_FalseColor(
    HDRFilePath=rundaylightanalysis.luminance_files,
    legendUnit="lux",
    legendMax="3000",
    contourBands=False,
    maskThreshold=0.1,
    useAlterColors=False,
    render=Toggle(True))  # -> outputFilePath; plug-in component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
hdr_gif = Honeybee_ConvertHDRToGIF(HDRFilePath=glareanalysis.glareCheckImage, adjustExposure=False)  # -> GIFFilePath; plug-in component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
hdr_gif_2 = Honeybee_ConvertHDRToGIF(HDRFilePath=falsecolor_2, adjustExposure=False)  # -> GIFFilePath; plug-in component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
hdr_tif = Honeybee_ConvertHDRToTIF(HDRFilePath=falsecolor_2, adjustExposure=False)  # -> TIFFFilePath; plug-in component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
viewer = Ladybug_ImageViewer(ImagePath=hdr_tif, ViewportScale=Slider(1.1, range=0..10), DisableClickable=False, SaveImgWithCoords=True, scale=1.1)  # -> ImagePath, ColorValues, AnimatedGIFImage
viewer_2 = Ladybug_ImageViewer(ImagePath=hdr_gif, ViewportScale=".8", DisableClickable=False, SaveImgWithCoords=True, scale=0.8)  # -> ImagePath, ColorValues, AnimatedGIFImage
panel_2 = Panel(viewer.ImagePath)
