# Grasshopper definition guarin_juan_glare.gh (Grasshopper 0.9.76)
# plug-ins: Python Interpreter, Ironbug

honeybee = Honeybee_Honeybee()  # -> Vviiiiiiiiiizzz; plug-in component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
ladybug = Ladybug_Ladybug()  # -> Vviiiiiiiiiizzz; plug-in component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
box = DomainBox(Base=PlaneXY(0, 0, 0), X="3.12", Y="2.6", Z="2.75")
number_slider = Slider(1.69, range=1..5)
number_slider_2 = Slider(1.93, range=1..5)
glzparamlist = Honeybee_GlazingParametersList(northGlzParam=0, westGlzParam=Slider(0.35, range=0..1), southGlzParam=0, eastGlzParam=0)  # -> glzParamList; plug-in component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
mass2zone = Honeybee_Masses2Zones(zoneMasses=flatten(box), isConditioned=True, maxRoofAngle=30, createHBZones=Toggle(True))  # -> readMe, HBZones; plug-in component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
glazingcreator = Honeybee_GlazingBasedOnRatio(HBObjects=mass2zone.HBZones, glzRatio=glzparamlist, sillHeight=Slider(0.57, range=0..1), runIt=Toggle(True))  # -> readMe, HBObjWGLZ; plug-in component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
panel = Panel("metal_90%")
genhbzonetestpts = Honeybee_GenerateZoneTestPoints(HBZone=glazingcreator.HBObjWGLZ, gridSize=".5", distBaseSrf=".762", moveTestMesh=True)  # -> readMe, simplify(testPoints), simplify(ptsVectors), simplify(facesArea), simplify(mesh); plug-in component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
path = FilePath("E:\JDG\Documents\JDG\UPenn\1° Semester\Building Performance Simulation\Other\Weather Files\USA_OK_Oklahoma.City-Will.Rogers.World.AP.723530_TMY3.epw")
genclimatebasedsky = Honeybee_GenerateClimateBasedSky(weatherFile=path, month="12", day="21", hour="15")  # -> radiationValues, skyFilePath; plug-in component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
wires = BrepWireframe(Brep=glazingcreator.HBObjWGLZ, Density=-1)
path_2 = FilePath("E:\JDG\Documents\JDG\UPenn\1° Semester\Building Performance Simulation\Other\Weather Files\USA_PA_Philadelphia.Intl.AP.724080_TMY3.epw")
radmetalmaterial = Honeybee_RadianceMetalMaterial(materialName="metal_90%", RReflectance=".90", GReflectance=".90", BReflectance=".90", roughness=".1", specularity=".90")  # -> RADMaterial; plug-in component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
imagebasedsimulation = Honeybee_ImageBasedSimulation(skyFile=genclimatebasedsky.skyFilePath, cameraType="1", simulationType=2, backupImages=0)  # -> analysisRecipe; plug-in component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
panel_2 = Panel(genclimatebasedsky.skyFilePath)
brep = Brep([<brep referenced from the Rhino model> x8])
toggle = BooleanToggle(True)
createhbsrfs = Honeybee_createHBSrfs(geometry=brep, RADMaterial=radmetalmaterial)  # -> readMe, simplify(HBSurface); plug-in component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
rundaylightanalysis = Honeybee_RunDaylightSimulation(
    HBObjects=flatten([glazingcreator.HBObjWGLZ, createhbsrfs.HBSurface]),
    analysisRecipe=imagebasedsimulation,
    writeRad=toggle,
    runRad=toggle,
    overwriteResults=True)  # -> readMe, analysisType, resultsUnit, results, testPts, luminance_files, radGeoFile, studyFolder, done; plug-in component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
glareanalysis = Honeybee_GlareAnalysis(HDRImagePath=rundaylightanalysis.luminance_files, runIt=Toggle(True))  # -> readMe, glareCheckImage, DGP, DGI, glareComfortRange, imageWithTaskArea; plug-in component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
hdr_tif = Honeybee_ConvertHDRToTIF(HDRFilePath=glareanalysis.glareCheckImage, adjustExposure=Toggle(True))  # -> TIFFFilePath; plug-in component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
viewer = Ladybug_ImageViewer(ImagePath_=hdr_tif, _scale_=1, DisableClickable=False, SaveImgWithCoords=False, scale=1)  # -> ImagePath, Colors, GIF
panel_3 = Panel(viewer.ImagePath)
