# Grasshopper definition guarin_juan_image_based.gh (Grasshopper 0.9.76)
# plug-ins: Python Interpreter

number_slider = Slider(0.35, range=0.2..1.2)
panel = Panel("2.6")
honeybee = Honeybee_Honeybee()  # -> Vviiiiiiiiiizzz; plug-in component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
ladybug = Ladybug_Ladybug()  # -> Vviiiiiiiiiizzz; plug-in component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
box = DomainBox(Base=PlaneXY(0, 0, 0), X="3.12", Y="2.6", Z="2.75")
glzparamlist = Honeybee_GlazingParametersList(northGlzParam=0, westGlzParam=number_slider, southGlzParam=0, eastGlzParam=0)  # -> glzParamList; plug-in component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
panel_2 = Panel(glzparamlist)
month = Panel("""3
6
12""")
mass2zone = Honeybee_Masses2Zones(zoneMasses=flatten(box), isConditioned=True, maxRoofAngle=30, createHBZones=Toggle(True))  # -> readMe, HBZones; plug-in component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
hour = Panel("""9
12
15""")
number_slider_2 = Slider(2, range=0..2)
number_slider_3 = Slider(2, range=0..2)
number_slider_4 = Slider(1.69, range=1..5)
item = ListItem(List=month, Index=number_slider_3, Wrap=True)
item_2 = ListItem(List=hour, Index=number_slider_2, Wrap=True)
glazingcreator = Honeybee_GlazingBasedOnRatio(
    HBObjects=mass2zone.HBZones,
    glzRatio=glzparamlist,
    windowHeight=Slider(1.93, range=1..5),
    sillHeight=Slider(0.57, range=0..1),
    runIt=Toggle(True))  # -> readMe, HBObjWGLZ; plug-in component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
path = FilePath("E:\JDG\Documents\JDG\UPenn\1° Semester\Building Performance Simulation\Other\Weather Files\USA_OK_Oklahoma.City-Will.Rogers.World.AP.723530_TMY3.epw")
wires = BrepWireframe(Brep=glazingcreator.HBObjWGLZ, Density=-1)
genclimatebasedsky = Honeybee_GenerateClimateBasedSky(weatherFile=path, month=item, day="21", hour=item_2)  # -> radiationValues, skyFilePath; plug-in component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
genhbzonetestpts = Honeybee_GenerateZoneTestPoints(HBZone=glazingcreator.HBObjWGLZ, gridSize="0.25", distBaseSrf="0.762", moveTestMesh=True)  # -> readMe, simplify(testPoints), simplify(ptsVectors), simplify(facesArea), simplify(mesh); plug-in component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
panel_3 = Panel(genclimatebasedsky.skyFilePath)
gridbasedsimulation = Honeybee_GridBasedSimulation(
    skyFile=genclimatebasedsky.skyFilePath,
    testPoints=genhbzonetestpts.testPoints,
    ptsVectors=genhbzonetestpts.ptsVectors,
    simulationType=0)  # -> analysisRecipe; plug-in component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
radmetalmaterial = Honeybee_RadianceMetalMaterial(materialName="metal_90%", RReflectance=".90", GReflectance=".90", BReflectance=".90", roughness=".1", specularity=".90")  # -> RADMaterial; plug-in component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
brep = Brep([<brep referenced from the Rhino model> x8])
toggle = BooleanToggle(True)
createhbsrfs = Honeybee_createHBSrfs(geometry=brep, RADMaterial=radmetalmaterial)  # -> readMe, simplify(HBSurface); plug-in component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
rundaylightanalysis = Honeybee_RunDaylightSimulation(
    HBObjects=flatten([glazingcreator.HBObjWGLZ, createhbsrfs.HBSurface]),
    analysisRecipe=gridbasedsimulation,
    writeRad=toggle,
    runRad=toggle,
    overwriteResults=True)  # -> readMe, analysisType, resultsUnit, results, testPts, resultFiles, radGeoFile, studyFolder, done; plug-in component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
fly = Ladybug_fly(inputSliders=[number_slider, number_slider_3, number_slider_2], fly=Toggle(False))  # -> Vviiiiiiiiiizzz; plug-in component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
doy_hoy = Ladybug_DOY_HOY(days="21", months=item, hours=item_2)  # -> HOY, DOY, date; plug-in component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
legendpar = Ladybug_LegendParameters(lowBound="0", highBound="2000")  # -> legendPar; plug-in component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
panel_4 = Panel(doy_hoy.date)
concat = Concatenate(
    FragmentA="Illuminance study",
    FragmentB="WWR:",
    FragmentD=number_slider,
    FragmentE=" Date: ",
    FragmentF=panel_4,
    FragmentH="Material:",
    FragmentI="metal_90%")
recolormesh = Ladybug_RecolorMesh(
    analysisResult=rundaylightanalysis.results,
    inputMesh=genhbzonetestpts.mesh,
    legendPar=legendpar,
    analysisTitle=concat,
    legendTitle="lux")  # -> readMe, newMesh, newLegend, legendBasePt, meshColors, legendColors; plug-in component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
panel_5 = Panel(rundaylightanalysis.results)
smaller = SmallerThan(FirstNumber=panel_5, SecondNumber="300")  # -> SmallerThan, OrEqualTo
mesh = Mesh(recolormesh.newMesh)
larger = LargerThan(FirstNumber=rundaylightanalysis.results, SecondNumber="2000")  # -> LargerThan, OrEqualTo
or = GateOr(A=smaller.SmallerThan, B=larger.LargerThan)
cullf = CullFaces(Mesh=mesh, Pattern=or)
area = Area(Geometry=cullf)  # -> Area, Centroid
area_2 = Area(Geometry=mesh)  # -> Area, Centroid
division = Division(A=area.Area, B=area_2.Area)
multiplication = Multiplication(A=division, B="100")
concat_2 = Concatenate(FragmentA="ill_wwr_", FragmentB=number_slider, FragmentC="_hoy_", FragmentD=doy_hoy.HOY)
round = Round(Number=multiplication)  # -> Nearest, Floor, Ceiling
panel_6 = Panel(concat_2)
captureview = Ladybug_CaptureView(fileName=concat_2, folder="c:\ladybug\illuminance_study", capture=rundaylightanalysis.done)  # -> imagePath; plug-in component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
pt = Point(Point(-0.01124030582, -0.8577596263, 0.7587104392))
concat_3 = Concatenate(FragmentA=round.Nearest, FragmentB="% met the criteria")
tag = TextTag3D(Location=pt, Text=concat_3, Size=Slider(0.15, range=0..1), Justification=7)
