# Grasshopper definition gupta_naman.gh (Grasshopper 0.9.76)
# plug-ins: Python Interpreter, Ironbug

# ----
# geometery-base
panel = Panel("GLASS_60")
brep = Brep(<brep referenced from the Rhino model>)
brep_2 = Brep(<brep referenced from the Rhino model>)
brep_3 = Brep([<brep referenced from the Rhino model> x8])
brep_4 = Brep([<brep referenced from the Rhino model> x10])
# geometery- first proposal
brep_5 = Brep([<brep referenced from the Rhino model> x2])
radopaquematerial = Honeybee_RadianceOpaqueMaterial(materialName="CEILING_80", RReflectance=".8", GReflectance=".8", BReflectance=".8", roughness=0.05, specularity=0)  # -> avrgRef, RADMaterial; plug-in component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
radglassmaterial = Honeybee_RadianceGlassMaterial(materialName=panel, RTransmittance=".6", GTransmittance=".6", BTransmittance=".6", refractiveIndex=1.52)  # -> avrgTrans, RADMaterial; plug-in component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
radopaquematerial_2 = Honeybee_RadianceOpaqueMaterial(materialName="WALL_50", RReflectance=".5", GReflectance=".5", BReflectance=".5", roughness=0.05, specularity=0)  # -> avrgRef, RADMaterial; plug-in component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
radopaquematerial_3 = Honeybee_RadianceOpaqueMaterial(materialName="FLOOR_20", RReflectance=".2", GReflectance=".2", BReflectance=".2", roughness=0.05, specularity=0)  # -> avrgRef, RADMaterial; plug-in component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
createhbsrfs = Honeybee_createHBSrfs(geometry=brep_3, RADMaterial=radopaquematerial_2.RADMaterial)  # -> readMe, simplify(HBSurface); plug-in component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
createhbsrfs_2 = Honeybee_createHBSrfs(geometry=brep, RADMaterial=radopaquematerial_3.RADMaterial)  # -> readMe, simplify(HBSurface); plug-in component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
createhbsrfs_3 = Honeybee_createHBSrfs(geometry=brep_5, RADMaterial=radglassmaterial.RADMaterial)  # -> readMe, simplify(HBSurface); plug-in component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
createhbsrfs_4 = Honeybee_createHBSrfs(geometry=brep_4, srfType="6")  # -> readMe, simplify(HBSurface); plug-in component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
createhbsrfs_5 = Honeybee_createHBSrfs(geometry=brep_2, RADMaterial=radopaquematerial.RADMaterial)  # -> readMe, simplify(HBSurface); plug-in component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

honeybee = Honeybee_Honeybee()  # -> Vviiiiiiiiiizzz; plug-in component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
ladybug = Ladybug_Ladybug()  # -> Vviiiiiiiiiizzz; plug-in component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

brep_6 = Brep(<brep referenced from the Rhino model>)
brep_7 = Brep(<brep referenced from the Rhino model>)
brep_8 = Brep([<brep referenced from the Rhino model> x11])
brep_9 = Brep([<brep referenced from the Rhino model> x10])
brep_10 = Brep([<brep referenced from the Rhino model> x4])
radopaquematerial_4 = Honeybee_RadianceOpaqueMaterial(materialName="CEILING_80", RReflectance=".8", GReflectance=".8", BReflectance=".8", roughness=0.05, specularity=0)  # -> avrgRef, RADMaterial; plug-in component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
radglassmaterial_2 = Honeybee_RadianceGlassMaterial(materialName="GLASS_60", RTransmittance=".6", GTransmittance=".6", BTransmittance=".6", refractiveIndex=1.52)  # -> avrgTrans, RADMaterial; plug-in component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
radopaquematerial_5 = Honeybee_RadianceOpaqueMaterial(materialName="WALL_50", RReflectance=".5", GReflectance=".5", BReflectance=".5", roughness=0.05, specularity=0)  # -> avrgRef, RADMaterial; plug-in component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
radopaquematerial_6 = Honeybee_RadianceOpaqueMaterial(materialName="FLOOR_20", RReflectance=".2", GReflectance=".2", BReflectance=".2", roughness=0.05, specularity=0)  # -> avrgRef, RADMaterial; plug-in component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
createhbsrfs_6 = Honeybee_createHBSrfs(geometry=brep_8, RADMaterial=radopaquematerial_5.RADMaterial)  # -> readMe, simplify(HBSurface); plug-in component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
createhbsrfs_7 = Honeybee_createHBSrfs(geometry=brep_6, RADMaterial=radopaquematerial_6.RADMaterial)  # -> readMe, simplify(HBSurface); plug-in component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
createhbsrfs_8 = Honeybee_createHBSrfs(geometry=brep_10, RADMaterial=radglassmaterial_2.RADMaterial)  # -> readMe, simplify(HBSurface); plug-in component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
createhbsrfs_9 = Honeybee_createHBSrfs(geometry=brep_9, srfType="6")  # -> readMe, simplify(HBSurface); plug-in component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
createhbsrfs_10 = Honeybee_createHBSrfs(geometry=brep_7, RADMaterial=radopaquematerial_4.RADMaterial)  # -> readMe, simplify(HBSurface); plug-in component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

brep_11 = Brep(<brep referenced from the Rhino model>)
brep_12 = Brep(<brep referenced from the Rhino model>)
brep_13 = Brep([<brep referenced from the Rhino model> x11])
brep_14 = Brep([<brep referenced from the Rhino model> x10])
brep_15 = Brep([<brep referenced from the Rhino model> x4])
radopaquematerial_7 = Honeybee_RadianceOpaqueMaterial(materialName="CEILING_90", RReflectance=".9", GReflectance=".9", BReflectance=".9", roughness=0.05, specularity=0)  # -> avrgRef, RADMaterial; plug-in component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
# geometery- final proposal
radglassmaterial_3 = Honeybee_RadianceGlassMaterial(materialName="GLASS_single_pane", RTransmittance=".96", GTransmittance=".96", BTransmittance=".96", refractiveIndex=1.52)  # -> avrgTrans, RADMaterial; plug-in component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
radopaquematerial_8 = Honeybee_RadianceOpaqueMaterial(materialName="WALL_70", RReflectance=".7", GReflectance=".7", BReflectance=".7", roughness=0.05, specularity=0)  # -> avrgRef, RADMaterial; plug-in component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
radopaquematerial_9 = Honeybee_RadianceOpaqueMaterial(materialName="FLOOR_20", RReflectance=".2", GReflectance=".2", BReflectance=".2", roughness=0.05, specularity=0)  # -> avrgRef, RADMaterial; plug-in component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
createhbsrfs_11 = Honeybee_createHBSrfs(geometry=brep_13, RADMaterial=radopaquematerial_8.RADMaterial)  # -> readMe, simplify(HBSurface); plug-in component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
createhbsrfs_12 = Honeybee_createHBSrfs(geometry=brep_12, RADMaterial=radopaquematerial_9.RADMaterial)  # -> readMe, simplify(HBSurface); plug-in component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
createhbsrfs_13 = Honeybee_createHBSrfs(geometry=brep_15, RADMaterial=radglassmaterial_3.RADMaterial)  # -> readMe, simplify(HBSurface); plug-in component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
createhbsrfs_14 = Honeybee_createHBSrfs(geometry=brep_14, srfType="6")  # -> readMe, simplify(HBSurface); plug-in component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
createhbsrfs_15 = Honeybee_createHBSrfs(geometry=brep_11, RADMaterial=radopaquematerial_7.RADMaterial)  # -> readMe, simplify(HBSurface); plug-in component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

brep_16 = Brep(flatten([createhbsrfs_11.HBSurface, createhbsrfs_13.HBSurface, createhbsrfs_12.HBSurface, createhbsrfs_15.HBSurface, createhbsrfs_14.HBSurface]))

# ----
# DGP: Daylight glare probability:
# Imperceptible Glare [0.35 > DGP]
# Perceptible Glare [0.4 > DGP >= 0.35]
# Disturbing Glare [0.45 > DGP >= 0.4]
# Intolerable Glare [DGP >= 0.45]
panel_2 = Panel("https://www.energyplus.net/weather-download/north_and_central_america_wmo_region_4/USA/PA/USA_PA_Philadelphia.Intl.AP.724080_TMY3/all")
epw_stat = Ladybug_OpenEPWAndSTATWeatherFiles(weatherFileURL=panel_2)  # -> epwFile, statFile; plug-in component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
number_slider = Slider(45, range=0..100)
importlocation = Ladybug_ImportLocation(epwFile=epw_stat.epwFile)  # -> location; plug-in component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
genavgsky = Honeybee_GenerateAverageSky(north=number_slider, weatherFile=epw_stat.epwFile, month="12", hour="9")  # -> radiationValues, skyFilePath; plug-in component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
sunpath = Ladybug_SunPath(north=number_slider, location=importlocation, hour="9", day="21", month="12", timeStep=1, dailyOrAnnualSunPath=True)  # -> readMe, sunVectors, sunAltitudes, sunAzimuths, port, sunSpheresMesh, sunPathCrvs, compassCrvs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; plug-in component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
radparameters = Honeybee_RADParameters(quality=0, ab="3")  # -> readMe, radParameters; plug-in component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
doy_hoy = Ladybug_DOY_HOY(days="21", months="12", hours="9")  # -> HOY, DOY, date; plug-in component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
set_the_view_to_fisheye_for_glare_analys = Panel("1")  # "set the view to FishEye for Glare Analysis"
imagebasedsimulation = Honeybee_ImageBasedSimulation(
    skyFile=genavgsky.skyFilePath,
    cameraType=set_the_view_to_fisheye_for_glare_analys,
    simulationType=2,
    radParameters=radparameters.radParameters,
    backupImages=0)  # -> analysisRecipe; plug-in component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
toggle = BooleanToggle(True)
# glare analysis
panel_3 = Panel("4")
rundaylightanalysis = Honeybee_RunDaylightSimulation(
    HBObjects=flatten(brep_16),
    analysisRecipe=imagebasedsimulation,
    writeRad=toggle,
    runRad=toggle,
    numOfCPUs=panel_3,
    radFileName=doy_hoy.date,
    overwriteResults=True)  # -> readMe, analysisType, resultsUnit, results, testPts, luminance_files, radGeoFile, studyFolder, done; plug-in component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
falsecolor = Honeybee_FalseColor(
    HDRFilePath=rundaylightanalysis.luminance_files,
    contourBands=False,
    maskThreshold=0.1,
    useAlterColors=False,
    render=Toggle(True))  # -> outputFilePath; plug-in component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
glareanalysis = Honeybee_GlareAnalysis(HDRImagePath=rundaylightanalysis.luminance_files, runIt=Toggle(True))  # -> readMe, glareCheckImage, DGP, DGI, glareComfortRange, imageWithTaskArea; plug-in component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
hdr_gif = Honeybee_ConvertHDRToGIF(HDRFilePath=falsecolor, adjustExposure=False)  # -> GIFFilePath; plug-in component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
hdr_gif_2 = Honeybee_ConvertHDRToGIF(HDRFilePath=glareanalysis.glareCheckImage, adjustExposure=Toggle(True))  # -> GIFFilePath; plug-in component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
number_slider_2 = Slider(1, range=0..1)
viewer = Ladybug_ImageViewer(ImagePath=hdr_gif_2, ViewportScale=number_slider_2, DisableClickable=False, SaveImgWithCoords=False, scale=1)  # -> ImagePath, ColorValues, AnimatedGIFImage
viewer_2 = Ladybug_ImageViewer(ImagePath=hdr_gif, ViewportScale=number_slider_2, DisableClickable=True, SaveImgWithCoords=False, scale=1)  # -> ImagePath, ColorValues, AnimatedGIFImage

wires = BrepWireframe(Brep=brep_16, Density=-1)
radparameters_2 = Honeybee_RADParameters(quality=0, ab="3")  # -> readMe, radParameters; plug-in component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

# ---- group: annual daylight analysis
gentestpts = Honeybee_GenerateTestPoints(testGeometry=brep_12, gridSize=Slider(0.3, range=0..1), distBaseSrf=Slider(0.762, range=0..1), moveTestMesh=True)  # -> readMe, simplify(testPoints), simplify(ptsVectors), simplify(facesArea), simplify(mesh); plug-in component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
path = FilePath("\\juno.design.upenn.edu\home\grad\arch\naman259\Desktop\Philadelphia_weather_files\USA_PA_Philadelphia.Intl.AP.724080_TMY3.epw")
annualdaylightsimulation = Honeybee_AnnualDaylightSimulation(
    epwWeatherFile=path,
    testPoints=gentestpts.testPoints,
    ptsVectors=gentestpts.ptsVectors,
    radParameters=radparameters_2.radParameters)  # -> analysisRecipe; plug-in component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
# annual daylight analysis
toggle_2 = BooleanToggle(True)
rundaylightanalysis_2 = Honeybee_RunDaylightSimulation(
    HBObjects=flatten(brep_16),
    analysisRecipe=annualdaylightsimulation,
    writeRad=toggle_2,
    runRad=toggle_2,
    overwriteResults=True)  # -> readMe, analysisType, resultsUnit, results, testPts, annual_analysis_files, radGeoFile, studyFolder, done; plug-in component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
occupancygenerator = Honeybee_DaysimOccupancyGenerator(weekendDays=[1, 2], writeTheOcc=Toggle(True))  # -> occupancyFile; plug-in component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
gradientlibrary = Ladybug_GradientLibrary(gradIndex="1")  # -> customColors; plug-in component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
readannualresultsi = Honeybee_ReadAnnualResultI(
    illFilesAddress=rundaylightanalysis_2.annual_analysis_files,
    testPoints=simplify(rundaylightanalysis_2.testPts),
    occupancyFiles=occupancygenerator,
    DLAIllumThresholds=300,
    runIt=Toggle(True))  # -> DLA, UDLI_Less_100, UDLI_100_2000, UDLI_More_2000, CDA, sDA, annualProfiles, htmReport; plug-in component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
legendpar = Ladybug_LegendParameters(lowBound="0", highBound="100", customColors=flatten(gradientlibrary))  # -> legendPar; plug-in component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
dom = ConstructDomain(DomainStart=0, DomainEnd=Slider(1, range=0..1))
recolormesh = Ladybug_RecolorMesh(
    analysisResult=readannualresultsi.DLA,
    inputMesh=gentestpts.mesh,
    heightDomain=dom,
    legendPar=legendpar,
    analysisTitle="Daylight Autonomy",
    legendTitle="%")  # -> readMe, newMesh, newLegend, legendBasePt, meshColors, legendColors; plug-in component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
