# Grasshopper definition huang_weston.gh (Grasshopper 0.9.76)
# plug-ins: Python Interpreter, DIVA Daylight, Ironbug

number_slider = Slider(0, range=0..100)
ladybug = Ladybug_Ladybug()  # -> Vviiiiiiiiiizzz; plug-in component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
honeybee = Honeybee_Honeybee()  # -> Vviiiiiiiiiizzz; plug-in component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

# ---- group: Ceiling
brep = Brep(<brep referenced from the Rhino model>)

# ---- group: EPW
path = FilePath("E:\UPenn MEBD\USA_PA_Philadelphia.Intl.AP.724080_TMY3.epw")

# ---- group: Wall
brep_2 = Brep([<brep referenced from the Rhino model> x8])

# ---- group: Floor
brep_3 = Brep(<brep referenced from the Rhino model>)

# ---- group: Shade
brep_4 = Brep([<brep referenced from the Rhino model> x28])

# ---- group: Glass
brep_5 = Brep([<brep referenced from the Rhino model> x6])

# ---- group: Time
panel = Panel("12")
panel_2 = Panel("21")
panel_3 = Panel("15")

# ----
importepw = Ladybug_ImportEpw(epwFile=path)  # -> readMe, latitude, location, dryBulbTemperature, dewPointTemperature, relativeHumidity, windSpeed, windDirection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; disabled; plug-in component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
northarrow = Ladybug_North(north=number_slider, scale=".05")  # -> northSign; plug-in component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
radglassmaterial = Honeybee_RadianceGlassMaterial(materialName="glass_60", RTransmittance="0.6", GTransmittance="0.6", BTransmittance="0.6", refractiveIndex=1.52)  # -> avrgTrans, RADMaterial; plug-in component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
radopaquematerial = Honeybee_RadianceOpaqueMaterial(materialName="ceiling_80", RReflectance="0.8", GReflectance="0.8", BReflectance="0.8", roughness=0.05, specularity=0)  # -> avrgRef, RADMaterial; plug-in component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
radopaquematerial_2 = Honeybee_RadianceOpaqueMaterial(materialName="wall_50", RReflectance="0.5", GReflectance="0.5", BReflectance="0.5", roughness=0.05, specularity=0)  # -> avrgRef, RADMaterial; plug-in component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
radopaquematerial_3 = Honeybee_RadianceOpaqueMaterial(materialName="floor_20", RReflectance="0.2", GReflectance="0.2", BReflectance="0.2", roughness=0.05, specularity=0)  # -> avrgRef, RADMaterial; plug-in component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
radopaquematerial_4 = Honeybee_RadianceOpaqueMaterial(materialName="Shade_50", RReflectance="0.5", GReflectance="0.5", BReflectance="0.5", roughness=0.05, specularity=0)  # -> avrgRef, RADMaterial; plug-in component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
genavgsky = Honeybee_GenerateAverageSky(north=number_slider, weatherFile=path, month=panel, hour=panel_3)  # -> radiationValues, skyFilePath; plug-in component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
genclimatebasedsky = Honeybee_GenerateClimateBasedSky(north=number_slider, weatherFile=path, month=panel, day=panel_2, hour=panel_3)  # -> radiationValues, skyFilePath; plug-in component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
doy_hoy = Ladybug_DOY_HOY(days=panel_2, months=panel, hours=panel_3)  # -> HOY, DOY, date; plug-in component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

# ---- group: Sun Path
analysisperiod = Ladybug_AnalysisPeriod(fromMonth="6", toMonth="9")  # -> readMe, analysisPeriod; plug-in component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
series = Series(Start="1", Step=1, Count="24")
sunpath = Ladybug_SunPath(
    north=number_slider,
    location=importepw.location,
    hour=12,
    day=21,
    month=12,
    timeStep=1,
    analysisPeriod=analysisperiod.analysisPeriod,
    sunScale=Slider(0.3, range=0..3),
    annualHourlyData=flatten([importepw.dryBulbTemperature, importepw.directNormalRadiation, importepw.relativeHumidity]),
    conditionalStatement="a>28 and b>80",
    dailyOrAnnualSunPath=True)  # -> readMe, sunVectors, sunAltitudes, sunAzimuths, port, sunSpheresMesh, sunPathCrvs, compassCrvs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; plug-in component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
Z = UnitZ(Factor=Slider(30, range=0..100))
mesh = Mesh(sunpath.sunSpheresMesh)  # disabled
geo = Geometry([sunpath.legend, sunpath.sunPathCrvs, sunpath.title])  # disabled
move = Move(Geometry=sunpath.sunPositions, Motion=Z)  # -> Geometry, Transform; disabled
ln = Line(StartPoint=sunpath.sunPathCenPts, EndPoint=sunpath.sunPositions)
preview = CustomPreview(Geometry=geo, Shader=ColourSwatch(SwatchColor=RGB(194, 188, 188)))
tag = TextTag(Location=move.Geometry, Text=sunpath.sunPositionsInfo)  # disabled
preview_2 = CustomPreview(Geometry=[ln, mesh], Shader=ColourSwatch(SwatchColor=RGB(255, 255, 0)))

# ----
createhbsrfs = Honeybee_createHBSrfs(geometry=brep_5, RADMaterial=radglassmaterial.RADMaterial)  # -> readMe, simplify(HBSurface); plug-in component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
createhbsrfs_2 = Honeybee_createHBSrfs(geometry=brep, RADMaterial=radopaquematerial.RADMaterial)  # -> readMe, simplify(HBSurface); plug-in component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
createhbsrfs_3 = Honeybee_createHBSrfs(geometry=brep_2, RADMaterial=radopaquematerial_2.RADMaterial)  # -> readMe, simplify(HBSurface); plug-in component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
createhbsrfs_4 = Honeybee_createHBSrfs(geometry=brep_3, RADMaterial=radopaquematerial_3.RADMaterial)  # -> readMe, simplify(HBSurface); plug-in component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
createhbsrfs_5 = Honeybee_createHBSrfs(geometry=brep_4, RADMaterial=radopaquematerial_4.RADMaterial)  # -> readMe, simplify(HBSurface); plug-in component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
brep_6 = Brep(flatten([createhbsrfs.HBSurface, createhbsrfs_2.HBSurface, createhbsrfs_3.HBSurface, createhbsrfs_4.HBSurface, createhbsrfs_5.HBSurface]))

# ---- group: Glare
radparameters = Honeybee_RADParameters(quality=0, ab="3")  # -> readMe, radParameters; disabled; plug-in component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
imagebasedsimulation = Honeybee_ImageBasedSimulation(
    skyFile=genavgsky.skyFilePath,
    cameraType="1",
    simulationType=2,
    radParameters=radparameters.radParameters,
    backupImages=0)  # -> analysisRecipe; disabled; plug-in component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
toggle = BooleanToggle(False)
rundaylightanalysis = Honeybee_RunDaylightSimulation(
    HBObjects=flatten(brep_6),
    analysisRecipe=imagebasedsimulation,
    writeRad=toggle,
    runRad=toggle,
    numOfCPUs="4",
    radFileName=doy_hoy.date,
    overwriteResults=True)  # -> readMe, analysisType, resultsUnit, results, testPts, resultFiles, radGeoFile, studyFolder, done; disabled; plug-in component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
glareanalysis = Honeybee_GlareAnalysis(HDRImagePath=rundaylightanalysis.resultFiles, runIt=Toggle(True))  # -> readMe, glareCheckImage, DGP, DGI, glareComfortRange, imageWithTaskArea; disabled; plug-in component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
falsecolor = Honeybee_FalseColor(
    HDRFilePath=rundaylightanalysis.resultFiles,
    contourBands=False,
    maskThreshold=0.1,
    useAlterColors=False,
    render=Toggle(True))  # -> outputFilePath; disabled; plug-in component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
# DGP: Daylight glare probability:
# Imperceptible Glare [0.35 > DGP]
# Perceptible Glare [0.4 > DGP >= 0.35]
# Disturbing Glare [0.45 > DGP >= 0.4]
# Intolerable Glare [DGP >= 0.45]
panel_4 = Panel(glareanalysis.DGP)
hdr_gif = Honeybee_ConvertHDRToGIF(HDRFilePath=falsecolor, adjustExposure=False)  # -> GIFFilePath; plug-in component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
hdr_gif_2 = Honeybee_ConvertHDRToGIF(HDRFilePath=glareanalysis.glareCheckImage, adjustExposure=Toggle(True))  # -> GIFFilePath; plug-in component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
number_slider_2 = Slider(0.8, range=0..1)
viewer = Ladybug_ImageViewer(ImagePath_=hdr_gif_2, _scale_=number_slider_2, DisableClickable=False, SaveImgWithCoords=False, scale=0.8)  # -> ImagePath, Colors, GIF
viewer_2 = Ladybug_ImageViewer(ImagePath_=number_slider_2, _scale_=hdr_gif, DisableClickable=False, SaveImgWithCoords=False, scale=1)  # -> ImagePath, Colors, GIF

# ----
flip = Flip()  # -> Surface, Result
item = ListItem(List=brep_3, Index=0, Wrap=True)
wires = BrepWireframe(Brep=brep_6, Density=-1)
gentestpts = Honeybee_GenerateTestPoints(testGeometry=item, gridSize="0.5", distBaseSrf="0.3", moveTestMesh=True)  # -> readMe, simplify(testPoints), simplify(ptsVectors), simplify(facesArea), simplify(mesh); plug-in component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
radparameters_2 = Honeybee_RADParameters(quality=0, ab="3")  # -> readMe, radParameters; plug-in component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

# ---- group: Shading Designer
brep_glass = Brep([<brep referenced from the Rhino model> x6])  # disabled
brep_shade = Brep(<brep referenced from the Rhino model>)  # disabled
number_slider_3 = Slider(4, range=0..10)
wires_2 = BrepWireframe(Brep=brep_shade, Density=-1)
smesh = SimpleMesh(Brep=brep_shade)
mjoin = MeshJoin(Meshes=smesh)
debrep = DeconstructBrep(Brep=brep_glass)  # -> Faces, Edges, Vertices
ext = ExtendCurve(Curve=wires_2, Type=0, Start=number_slider_3, End=number_slider_3)
preview_3 = CustomPreview(Geometry=brep_glass, Shader=ColourSwatch(SwatchColor=RGB(0, 170, 255)))
rev = Reverse(Vector=sunpath.sunVectors)
preview_4 = CustomPreview(Geometry=ext, Shader=ColourSwatch(SwatchColor=RGB(0, 0, 0)))
preview_5 = CustomPreview(Geometry=brep_shade, Shader=ColourSwatch(SwatchColor=RGB(255, 255, 255)))
meshray = MeshRay(Mesh=mjoin, Point=debrep.Vertices, Direction=rev)  # -> Point, Hit
ma = MassAddition(Input=meshray.Hit)  # -> Result, PartialResults
smaller = SmallerThan(FirstNumber=ma.Result, SecondNumber="4")  # -> SmallerThan, OrEqualTo
dispatch = Dispatch(List=sunpath.sunVectors, DispatchPattern=smaller.SmallerThan)  # -> ListA, ListB
dispatch_2 = Dispatch(List=sunpath.selHourlyData, DispatchPattern=smaller.SmallerThan)  # -> ListA, ListB
bnd = Bounds(Numbers=dispatch_2.ListA)
remap = RemapNumbers(Value=dispatch_2.ListA, Source=bnd, Target=Domain(0, 1))  # -> Mapped, Clipped
gradient = Gradient(
    LowerLimit=0,
    UpperLimit=1,
    Parameter=remap.Mapped,
    stops=[0: RGB(234, 38, 0), 0.25: RGB(234, 126, 0), 0.5: RGB(254, 244, 84), 0.75: RGB(173, 203, 249), 1: RGB(75, 107, 169)])
shddesigner = Ladybug_ShadingDesigner(glzSrf=flatten(brep_glass), depthOrVector=flatten(dispatch.ListA), numOfShds="1", runIt=Toggle(True), mergeVectors=False)  # -> readMe, shadingSrfs; plug-in component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
material = CreateMaterial(Diffuse=gradient, Specular=RGB(255, 255, 255), Emission=RGB(0, 0, 0), Transparency=Slider(0.8, range=0..1), Shine=0)
preview_6 = CustomPreview(Geometry=shddesigner.shadingSrfs, Shader=material)

# ---- group: Day Simulation
gridbasedsimulation = Honeybee_GridBasedSimulation(
    skyFile=genclimatebasedsky.skyFilePath,
    testPoints=gentestpts.testPoints,
    ptsVectors=gentestpts.ptsVectors,
    testMesh=gentestpts.mesh,
    simulationType=0,
    radParameters=radparameters_2.radParameters)  # -> analysisRecipe; disabled; plug-in component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
toggle_2 = BooleanToggle(False)
rundaylightanalysis_2 = Honeybee_RunDaylightSimulation(HBObjects=flatten(brep_6), analysisRecipe=gridbasedsimulation, writeRad=toggle_2, runRad=toggle_2, overwriteResults=True)  # -> readMe, analysisType, resultsUnit, results, testPts, resultFiles, radGeoFile, studyFolder, done; disabled; plug-in component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
tag_2 = TextTag3D(Location=rundaylightanalysis_2.testPts, Text=rundaylightanalysis_2.results, Size=1, Justification=7)

# ---- group: Image
imagebasedsimulation_2 = Honeybee_ImageBasedSimulation(skyFile=genclimatebasedsky.skyFilePath, simulationType=2, backupImages=0)  # -> analysisRecipe; disabled; plug-in component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
toggle_3 = BooleanToggle(False)
rundaylightanalysis_3 = Honeybee_RunDaylightSimulation(
    HBObjects=flatten(brep_6),
    analysisRecipe=imagebasedsimulation_2,
    writeRad=toggle_3,
    runRad=toggle_3,
    overwriteResults=True)  # -> readMe, analysisType, resultsUnit, results, testPts, resultFiles, radGeoFile, studyFolder, done; disabled; plug-in component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
hdr_tif = Honeybee_ConvertHDRToTIF(HDRFilePath=rundaylightanalysis_3.resultFiles, adjustExposure=Toggle(True))  # -> TIFFFilePath; plug-in component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
image_viewer = ImageViewer(
    ImagePath=hdr_tif,
    Scale=Slider(0.4, range=0..1),
    enable_regions=False,
    save_tags=False,
    show_max=False,
    show_min=False,
    tag_size=-1)

# ---- group: Annual Simulation
annualdaylightsimulation = Honeybee_AnnualDaylightSimulation(epwWeatherFile=path, testPoints=gentestpts.testPoints, ptsVectors=gentestpts.ptsVectors)  # -> analysisRecipe; plug-in component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
toggle_4 = BooleanToggle(False)
occupancygenerator = Honeybee_DaysimOccupancyGenerator(weekendDays=[1, 2], writeTheOcc=Toggle(True))  # -> occupancyFile; plug-in component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
rundaylightanalysis_4 = Honeybee_RunDaylightSimulation(
    HBObjects=flatten(brep_6),
    analysisRecipe=annualdaylightsimulation,
    writeRad=toggle_4,
    runRad=toggle_4,
    overwriteResults=True)  # -> readMe, analysisType, resultsUnit, results, testPts, resultFiles, radGeoFile, studyFolder, done; plug-in component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
readannualresultsi = Honeybee_ReadAnnualResultI(
    illFilesAddress=rundaylightanalysis_4.resultFiles,
    testPoints=simplify(rundaylightanalysis_4.testPts),
    occupancyFiles=occupancygenerator,
    DLAIllumThresholds=300,
    runIt=Toggle(True))  # -> DLA, UDLI_Less_100, UDLI_100_2000, UDLI_More_2000, CDA, sDA, annualProfiles, htmReport; plug-in component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

# ---- group: Visualize Result
swatch = ColourSwatch(SwatchColor=RGB(0, 0, 0))
swatch_2 = ColourSwatch(SwatchColor=RGB(255, 255, 255))
panel_5 = Panel("2100")
panel_6 = Panel("8")
legendpar = Ladybug_LegendParameters(
    lowBound="0",
    highBound="90",
    numSegments="10",
    customColors=reverse(flatten([ColourSwatch(SwatchColor=RGB(255, 255, 255)), ColourSwatch(SwatchColor=RGB(255, 153, 0)), ColourSwatch(SwatchColor=RGB(0, 0, 0))])),
    legendLocation="3,10,0")  # -> legendPar; plug-in component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
panel_7 = Panel("Illuminance")
panel_8 = Panel("Lux")
recolormesh = Ladybug_RecolorMesh(
    analysisResult=readannualresultsi.UDLI_100_2000,
    inputMesh=gentestpts.mesh,
    legendPar=legendpar,
    analysisTitle="Daylight Autonomy",
    legendTitle="%")  # -> readMe, newMesh, newLegend, legendBasePt, meshColors, legendColors; plug-in component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
