# Grasshopper definition hwang_youngjin.gh (Grasshopper 0.9.76)
# plug-ins: Python Interpreter

ladybug = Ladybug_Ladybug()  # -> Vviiiiiiiiiizzz; plug-in component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
honeybee = Honeybee_Honeybee()  # -> Vviiiiiiiiiizzz; plug-in component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
north_wall = Brep(<brep referenced from the Rhino model>)
east_wall = Brep(<brep referenced from the Rhino model>)
number_slider = Slider(0.2, range=0.1..0.3)

# ---- group: SHADING
shading = Brep([<brep referenced from the Rhino model> x10])
createhbsrfs = Honeybee_createHBSrfs(geometry=shading, srfType="6")  # -> readMe, simplify(HBSurface); plug-in component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

# ----
number_slider_2 = Slider(0.1, range=0.1..0.3)

# ---- group: WINDOW-1
radglassmaterial = Honeybee_RadianceGlassMaterial(materialName="glass_60", RTransmittance="0.6", GTransmittance="0.6", BTransmittance="0.6", refractiveIndex=1.52)  # -> avrgTrans, RADMaterial; plug-in component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
createhbsrfs_2 = Honeybee_createHBSrfs(geometry=east_wall, srfType="0")  # -> readMe, simplify(HBSurface); plug-in component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
glazingcreator = Honeybee_GlazingBasedOnRatio(
    HBObjects=createhbsrfs_2.HBSurface,
    glzRatio=number_slider_2,
    breakUpWindow=Toggle(True),
    windowHeight="1.5",
    runIt=Toggle(True))  # -> readMe, HBObjWGLZ; plug-in component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

# ----
ceiling = Brep(<brep referenced from the Rhino model>)
wall = Brep(<brep referenced from the Rhino model>)
floor = Brep(<brep referenced from the Rhino model>)
createhbsrfs_3 = Honeybee_createHBSrfs(geometry=ceiling, srfType="3")  # -> readMe, simplify(HBSurface); plug-in component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
createhbsrfs_4 = Honeybee_createHBSrfs(geometry=wall, srfType="0")  # -> readMe, simplify(HBSurface); plug-in component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
createhbsrfs_5 = Honeybee_createHBSrfs(geometry=floor, srfType="2")  # -> readMe, simplify(HBSurface); plug-in component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

fly = Ladybug_fly(inputSliders=[number_slider, number_slider_2], fly=Toggle(False))  # -> Vviiiiiiiiiizzz; plug-in component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

# ---- group: WINDOW-1 / WINDOW-2
radglassmaterial_2 = Honeybee_RadianceGlassMaterial(materialName="glass_60", RTransmittance="0.6", GTransmittance="0.6", BTransmittance="0.6", refractiveIndex=1.52)  # -> avrgTrans, RADMaterial; plug-in component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
createhbsrfs_6 = Honeybee_createHBSrfs(geometry=north_wall, srfType="0")  # -> readMe, simplify(HBSurface); plug-in component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
glazingcreator_2 = Honeybee_GlazingBasedOnRatio(
    HBObjects=createhbsrfs_6.HBSurface,
    glzRatio=number_slider,
    breakUpWindow=Toggle(True),
    breakUpDist="1.5",
    windowHeight="1.5",
    runIt=Toggle(True))  # -> readMe, HBObjWGLZ; plug-in component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

# ----
geo = Geometry([<brep referenced from the Rhino model> x2])
pt = Point(<point referenced from the Rhino model>)
pt_2 = Point(<point referenced from the Rhino model>)
gentestpts = Honeybee_GenerateTestPoints(
    testGeometry=createhbsrfs_5.HBSurface,
    gridSize=Slider(0.3, range=0..10),
    distBaseSrf=Slider(0.75, range=0..3),
    moveTestMesh=True)  # -> readMe, simplify(testPoints), simplify(ptsVectors), simplify(facesArea), simplify(mesh); plug-in component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

radparameters = Honeybee_RADParameters(quality=0, ab="5", ad="1000")  # -> readMe, radParameters; plug-in component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
panel = Panel(radparameters.readMe)

wires = BrepWireframe(
    Brep=[glazingcreator.HBObjWGLZ, glazingcreator_2.HBObjWGLZ, createhbsrfs_5.HBSurface, createhbsrfs_4.HBSurface, createhbsrfs_3.HBSurface, geo],
    Density=-1)
vec2pt = Vector2Pt(PointA=pt_2, PointB=pt, Unitize=False)  # -> Vector, Length
path = FilePath("D:\#Onedrive\OneDrive - PennO365 1\MEBD-2017-1ST\BUILDING PERFORMANCE SIMULATION\Class\Philadelphia_weather_files\USA_PA_Philadelphia.Intl.AP.724080_TMY3.epw")
preview = CustomPreview(
    Geometry=vec2pt.Vector,
    Shader={ambient=RGB(0, 0, 0), diffuse=RGB(255, 105, 180), emission=RGB(76, 32, 54), shine=0.5, specular=RGB(255, 255, 255), transparency=0})
annualdaylightsimulation = Honeybee_AnnualDaylightSimulation(
    north=vec2pt.Vector,
    epwWeatherFile=path,
    testPoints=gentestpts.testPoints,
    ptsVectors=gentestpts.ptsVectors,
    radParameters=radparameters.radParameters)  # -> analysisRecipe; plug-in component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
brep = Brep(flatten([createhbsrfs_5.HBSurface, createhbsrfs_4.HBSurface, createhbsrfs_3.HBSurface, glazingcreator.HBObjWGLZ, glazingcreator_2.HBObjWGLZ, createhbsrfs.HBSurface]))
preview_2 = CustomPreview(
    Geometry=gentestpts.testPoints,
    Shader={ambient=RGB(0, 0, 0), diffuse=RGB(255, 105, 180), emission=RGB(76, 32, 54), shine=0.5, specular=RGB(255, 255, 255), transparency=0})
toggle = BooleanToggle(True)
panel_2 = Panel(brep)
rundaylightanalysis = Honeybee_RunDaylightSimulation(HBObjects=flatten(brep), analysisRecipe=annualdaylightsimulation, writeRad=toggle, runRad=toggle, overwriteResults=True)  # -> readMe, analysisType, resultsUnit, results, testPts, annual_analysis_files, radGeoFile, studyFolder, done; plug-in component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
occupancygenerator = Honeybee_DaysimOccupancyGenerator(weekendDays="0", writeTheOcc=Toggle(True))  # -> occupancyFile; plug-in component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
readannualresultsi = Honeybee_ReadAnnualResultI(
    illFilesAddress=rundaylightanalysis.annual_analysis_files,
    testPoints=simplify(gentestpts.testPoints),
    ptsVectors=gentestpts.ptsVectors,
    occupancyFiles=occupancygenerator,
    DLAIllumThresholds=300,
    runIt=Toggle(True))  # -> DLA, UDLI_Less_100, UDLI_100_2000, UDLI_More_2000, CDA, sDA, annualProfiles, htmReport; plug-in component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

# ---- group: Value Account
panel_3 = Panel(readannualresultsi.UDLI_100_2000)
num = Number(panel_3)
ma = MassAddition(Input=panel_3)  # -> Result, PartialResults
smaller = SmallerThan(FirstNumber=num, SecondNumber="75")  # -> SmallerThan, OrEqualTo
panel_4 = Panel(ma.Result)
cullf = CullFaces(Mesh=gentestpts.mesh, Pattern=smaller.SmallerThan)
division = Division(A=panel_4, B="205")
area = Area(Geometry=gentestpts.mesh)  # -> Area, Centroid
area_2 = Area(Geometry=cullf)  # -> Area, Centroid
panel_5 = Panel(division)
division_2 = Division(A=area_2.Area, B=area.Area)
round = Round(Number=panel_5)  # -> Nearest, Floor, Ceiling
multiplication = Multiplication(A=division_2, B="100")
panel_6 = Panel(round.Nearest)
round_2 = Round(Number=multiplication)  # -> Nearest, Floor, Ceiling
panel_7 = Panel(round_2.Nearest)

# ----
multiplication_2 = Multiplication(A=number_slider, B="100")
multiplication_3 = Multiplication(A=number_slider_2, B="100")
concat = Concatenate(FragmentA="nor_", FragmentB=multiplication_2, FragmentC="_est_", FragmentD=multiplication_3)
captureview = Ladybug_CaptureView(fileName=concat, folder="c:\ladybug\UDI")  # -> imagePath; plug-in component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

# ---- group: VISUALIZATION
panel_8 = Panel("UDI >2000lux")
panel_9 = Panel("UDI <100lux")
panel_10 = Panel("C-DAYLIGHT AUTONOMY")
panel_11 = Panel("DAYLIGHT AUTONOMY")
pt_3 = Point(<point referenced from the Rhino model>)
legendpar = Ladybug_LegendParameters(lowBound="0", highBound="100", numSegments="11", legendLocation=pt_3, font="Arial", fontSize="0.15")  # -> legendPar; plug-in component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
multiplication_4 = Multiplication(A=number_slider, B="100")
multiplication_5 = Multiplication(A=number_slider_2, B="100")
concat_2 = Concatenate(
    FragmentA="UDI 100lux-2000lux",
    FragmentC="Ave.% of total area: ",
    FragmentD=panel_6,
    FragmentE="%",
    FragmentG="% of area above 75%: ",
    FragmentH=panel_7,
    FragmentI="%",
    FragmentK="WWR(north): ",
    FragmentL=multiplication_4,
    FragmentM=" / ",
    FragmentN="WWR(east): ",
    FragmentO=multiplication_5)
recolormesh = Ladybug_RecolorMesh(
    analysisResult=readannualresultsi.UDLI_100_2000,
    inputMesh=gentestpts.mesh,
    legendPar=legendpar,
    analysisTitle=concat_2,
    legendTitle="%")  # -> readMe, newMesh, newLegend, legendBasePt, meshColors, legendColors; plug-in component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
