# Grasshopper definition hwang_youngjin_glare.gh (Grasshopper 0.9.76)
# plug-ins: Python Interpreter, Ironbug

ladybug = Ladybug_Ladybug()  # -> Vviiiiiiiiiizzz; plug-in component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
honeybee = Honeybee_Honeybee()  # -> Vviiiiiiiiiizzz; plug-in component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

# ---- group: WINDOW
radglassmaterial = Honeybee_RadianceGlassMaterial(materialName="glass_60", RTransmittance="0.6", GTransmittance="0.6", BTransmittance="0.6", refractiveIndex=1.52)  # -> avrgTrans, RADMaterial; plug-in component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
window = Brep(<brep referenced from the Rhino model>)
createhbsrfs = Honeybee_createHBSrfs(geometry=window, RADMaterial=radglassmaterial.RADMaterial)  # -> readMe, simplify(HBSurface); plug-in component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

# ----
pt = Point(<point referenced from the Rhino model>)
pt_2 = Point(<point referenced from the Rhino model>)
wall = Brep([<brep referenced from the Rhino model> x3])
ceiling = Brep(<brep referenced from the Rhino model>)
floor = Brep(<brep referenced from the Rhino model>)
vec2pt = Vector2Pt(PointA=pt_2, PointB=pt, Unitize=False)  # -> Vector, Length
path = FilePath("D:\One Drive\OneDrive - PennO365\MEBD-2017-1ST\BUILDING PERFORMANCE SIMULATION\Class\Philadelphia_weather_files\USA_PA_Philadelphia.Intl.AP.724080_TMY3.epw")

# ---- group: SHADING
shading = Brep([<brep referenced from the Rhino model> x6])
createhbsrfs_2 = Honeybee_createHBSrfs(geometry=shading, srfType="6")  # -> readMe, simplify(HBSurface); plug-in component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

# ----
preview = CustomPreview(
    Geometry=vec2pt.Vector,
    Shader={ambient=RGB(0, 0, 0), diffuse=RGB(255, 105, 180), emission=RGB(76, 32, 54), shine=0.5, specular=RGB(255, 255, 255), transparency=0})
gentestpts = Honeybee_GenerateTestPoints(testGeometry=floor, gridSize=Slider(0.3, range=0..10), distBaseSrf=Slider(0.75, range=0..3), moveTestMesh=True)  # -> readMe, simplify(testPoints), simplify(ptsVectors), simplify(facesArea), simplify(mesh); plug-in component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
genclimatebasedsky = Honeybee_GenerateClimateBasedSky(north=vec2pt.Vector, weatherFile=path, month="3", day="21", hour="15")  # -> radiationValues, skyFilePath; plug-in component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
createhbsrfs_3 = Honeybee_createHBSrfs(geometry=[ceiling, wall, floor])  # -> readMe, simplify(HBSurface); plug-in component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
preview_2 = CustomPreview(
    Geometry=gentestpts.testPoints,
    Shader={ambient=RGB(0, 0, 0), diffuse=RGB(255, 105, 180), emission=RGB(76, 32, 54), shine=0.5, specular=RGB(255, 255, 255), transparency=0})
wires = BrepWireframe(Brep=[createhbsrfs_3.HBSurface, createhbsrfs.HBSurface], Density=-1)
radparameters = Honeybee_RADParameters(quality=0, ab="4")  # -> readMe, radParameters; plug-in component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
panel = Panel(radparameters.readMe)
imagebasedsimulation = Honeybee_ImageBasedSimulation(
    skyFile=genclimatebasedsky.skyFilePath,
    cameraType="1",
    simulationType=2,
    radParameters=radparameters.radParameters,
    backupImages=0)  # -> analysisRecipe; plug-in component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
toggle = BooleanToggle(True)

# ---- group: VISUALIZATION
pt_3 = Point(Point(8.017198265, -4.24, 0))
legendpar = Ladybug_LegendParameters(
    lowBound="300",
    highBound="2000",
    numSegments="11",
    legendLocation=pt_3,
    font="Arial",
    decimalPlaces=Slider(0, range=0..100))  # -> legendPar; plug-in component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
recolormesh = Ladybug_RecolorMesh(legendPar=legendpar, legendTitle="Lux(lx/sqm)")  # -> readMe, newMesh, newLegend, legendBasePt, meshColors, legendColors; plug-in component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

# ----
rundaylightanalysis = Honeybee_RunDaylightSimulation(
    HBObjects=flatten([createhbsrfs.HBSurface, createhbsrfs_3.HBSurface]),
    analysisRecipe=imagebasedsimulation,
    writeRad=toggle,
    runRad=toggle,
    radFileName="Glare_Analysis",
    overwriteResults=True)  # -> readMe, analysisType, resultsUnit, results, testPts, luminance_files, radGeoFile, studyFolder, done; plug-in component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
falsecolor = Honeybee_FalseColor(
    HDRFilePath=rundaylightanalysis.luminance_files,
    contourBands=False,
    maskThreshold=0.1,
    useAlterColors=False,
    render=Toggle(True))  # -> outputFilePath; plug-in component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
glareanalysis = Honeybee_GlareAnalysis(HDRImagePath=rundaylightanalysis.luminance_files, runIt=Toggle(True))  # -> readMe, glareCheckImage, DGP, DGI, glareComfortRange, imageWithTaskArea; plug-in component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
num = Number([93.61, 99.33, 108.42, 165.33, 131.49, 132.94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])

# ---- group: LAGER THAN / SMALLER THAN
smaller = SmallerThan(FirstNumber=num, SecondNumber="300")  # -> SmallerThan, OrEqualTo
larger = LargerThan(FirstNumber=num, SecondNumber="2000")  # -> LargerThan, OrEqualTo
cullf = CullFaces(Pattern=smaller.SmallerThan)
area = Area(Geometry=cullf)  # -> Area, Centroid
area_2 = Area()  # -> Area, Centroid
panel_2 = Panel(area.Area)
panel_3 = Panel(area_2.Area)
division = Division(A=panel_2, B=panel_3)
panel_4 = Panel(division)

# ----
viewer = Ladybug_ImageViewer(ImagePath_=falsecolor, _scale_=1, DisableClickable=False, SaveImgWithCoords=False, scale=1)  # -> ImagePath, Colors, GIF
panel_5 = Panel(glareanalysis.readMe)
hdr_gif = Honeybee_ConvertHDRToGIF(HDRFilePath=[glareanalysis.imageWithTaskArea, glareanalysis.glareCheckImage], adjustExposure=Toggle(True))  # -> GIFFilePath; plug-in component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
panel_6 = Panel(hdr_gif)
viewer_2 = Ladybug_ImageViewer(ImagePath_=hdr_gif, _scale_=1, DisableClickable=False, SaveImgWithCoords=False, scale=1)  # -> ImagePath, Colors, GIF
exportladybug = Ladybug_ExportLadybug()  # -> readMe; plug-in component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
