# Grasshopper definition jeon_bosung.gh (Grasshopper 0.9.76)
# plug-ins: Python Interpreter, Ironbug

ladybug = Ladybug_Ladybug()  # -> out; plug-in component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
honeybee = Honeybee_Honeybee()  # -> out; plug-in component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

# ----
# Sky_And_Period
number_slider = Slider(0, range=0..2)
number_slider_2 = Slider(0, range=0..2)
panel = Panel("""9
12
15""")
panel_2 = Panel("""3
6
12""")
file_path = FilePath("E:\Jeon\02_UPenn\2017_Fall____02_Building_Performance_Simulation\170918\Philadelphia_weather_files\USA_PA_Philadelphia.Intl.AP.724080_TMY3.epw")
list_item = ListItem(List=panel, Index=number_slider, Wrap=True)
list_item_2 = ListItem(List=panel_2, Index=number_slider_2, Wrap=True)
genclimatebasedsky = Honeybee_GenerateClimateBasedSky(weatherFile=file_path, month=list_item_2, day="21", hour=list_item)  # -> out, skyFilePath; plug-in component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
doy_hoy = Ladybug_DOY_HOY(days="21", months=list_item_2, hours=list_item)  # -> HOY, DOY, date; plug-in component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
panel_3 = Panel(doy_hoy.date)

# ----
# Recipe_of_Image_Simulation
panel_4 = Panel("1")
imagebasedsimulation = Honeybee_ImageBasedSimulation(skyFile=genclimatebasedsky.skyFilePath, cameraType=panel_4, simulationType=2, backupImages=0)  # -> analysisRecipe; plug-in component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

# ---- group: FLOOR
brep = Brep(<brep referenced from the Rhino model>)

# ----
# Recipe_of_Annual_Daylight
panel_5 = Panel("0.5")  # disabled
panel_6 = Panel("0.1")  # disabled
panel_7 = Panel("2")  # disabled
gentestpts = Honeybee_GenerateTestPoints(testGeometry=brep, gridSize=panel_5, distBaseSrf=panel_6, moveTestMesh=True)  # -> out, simplify(testPoints), simplify(ptsVectors), simplify(facesArea), simplify(mesh); disabled; plug-in component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
radparameters = Honeybee_RADParameters(quality=0, ab=panel_7)  # -> out, radParameters; disabled; plug-in component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
annualdaylightsimulation = Honeybee_AnnualDaylightSimulation(
    epwWeatherFile=file_path,
    testPoints=gentestpts.testPoints,
    ptsVectors=gentestpts.ptsVectors,
    radParameters=radparameters.radParameters)  # -> analysisRecipe; disabled; plug-in component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

# ---- group: CEILING
brep_2 = Brep(<brep referenced from the Rhino model>)

# ---- group: GLASS
brep_3 = Brep(<brep referenced from the Rhino model>)  # disabled

# ---- group: WALL
brep_4 = Brep([<brep referenced from the Rhino model> x14])  # disabled

# ----
# Geometries_And_Materials
panel_8 = Panel("GLASS_60")  # disabled
panel_9 = Panel("0.6")  # disabled
panel_10 = Panel("0.5")  # disabled
panel_11 = Panel("WALL_50")  # disabled
radopaquematerial = Honeybee_RadianceOpaqueMaterial(materialName="FLOOR_20", RReflectance="0.2", GReflectance="0.2", BReflectance="0.2", roughness=0.05, specularity=0)  # -> avrgRef, RADMaterial; plug-in component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
radopaquematerial_2 = Honeybee_RadianceOpaqueMaterial(
    materialName=panel_11,
    RReflectance=panel_10,
    GReflectance=panel_10,
    BReflectance=panel_10,
    roughness=0.05,
    specularity=0)  # -> avrgRef, RADMaterial; disabled; plug-in component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
radglassmaterial = Honeybee_RadianceGlassMaterial(materialName=panel_8, RTransmittance=panel_9, GTransmittance=panel_9, BTransmittance=panel_9, refractiveIndex=1.52)  # -> avrgTrans, RADMaterial; disabled; plug-in component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
radopaquematerial_3 = Honeybee_RadianceOpaqueMaterial(materialName="CEILING_80", RReflectance="0.8", GReflectance="0.8", BReflectance="0.8", roughness=0.05, specularity=0)  # -> avrgRef, RADMaterial; plug-in component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
createhbsrfs = Honeybee_createHBSrfs(geometry=brep_4, RADMaterial=radopaquematerial_2.RADMaterial)  # -> out, simplify(HBSurface); disabled; plug-in component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
createhbsrfs_2 = Honeybee_createHBSrfs(geometry=brep_2, RADMaterial=radopaquematerial_3.RADMaterial)  # -> out, simplify(HBSurface); plug-in component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
createhbsrfs_3 = Honeybee_createHBSrfs(geometry=brep_3, RADMaterial=radglassmaterial.RADMaterial)  # -> out, simplify(HBSurface); disabled; plug-in component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
createhbsrfs_4 = Honeybee_createHBSrfs(geometry=brep, RADMaterial=radopaquematerial.RADMaterial)  # -> out, simplify(HBSurface); plug-in component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

# ---- group: GLASS
brep_5 = Brep(<brep referenced from the Rhino model>)  # disabled

# ---- group: WALL
brep_6 = Brep([<brep referenced from the Rhino model> x14])  # disabled

# ----
# Geometries_And_Materials
# Remodelled_1
panel_12 = Panel("0.6")  # disabled
panel_13 = Panel("GLASS_60")  # disabled
panel_14 = Panel("0.5")  # disabled
panel_15 = Panel("WALL_50")  # disabled
radopaquematerial_4 = Honeybee_RadianceOpaqueMaterial(
    materialName=panel_15,
    RReflectance=panel_14,
    GReflectance=panel_14,
    BReflectance=panel_14,
    roughness=0.05,
    specularity=0)  # -> avrgRef, RADMaterial; disabled; plug-in component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
radglassmaterial_2 = Honeybee_RadianceGlassMaterial(materialName=panel_13, RTransmittance=panel_12, GTransmittance=panel_12, BTransmittance=panel_12, refractiveIndex=1.52)  # -> avrgTrans, RADMaterial; disabled; plug-in component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
createhbsrfs_5 = Honeybee_createHBSrfs(geometry=brep_6, RADMaterial=radopaquematerial_4.RADMaterial)  # -> out, simplify(HBSurface); disabled; plug-in component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
createhbsrfs_6 = Honeybee_createHBSrfs(geometry=brep_5, RADMaterial=radglassmaterial_2.RADMaterial)  # -> out, simplify(HBSurface); disabled; plug-in component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

# ---- group: WALL
brep_7 = Brep([<brep referenced from the Rhino model> x8])

# ---- group: GLASS
brep_8 = Brep([<brep referenced from the Rhino model> x2])

# ----
# Geometries_And_Materials
# Remodelled_2
panel_16 = Panel("WALL_50")
radopaquematerial_5 = Honeybee_RadianceOpaqueMaterial(materialName=panel_16, RReflectance="0.5", GReflectance="0.5", BReflectance="0.5", roughness=0.05, specularity=0)  # -> avrgRef, RADMaterial; plug-in component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
radglassmaterial_3 = Honeybee_RadianceGlassMaterial(materialName="GLASS_60", RTransmittance="0.6", GTransmittance="0.6", BTransmittance="0.6", refractiveIndex=1.52)  # -> avrgTrans, RADMaterial; plug-in component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
createhbsrfs_7 = Honeybee_createHBSrfs(geometry=brep_7, RADMaterial=radopaquematerial_5.RADMaterial)  # -> out, simplify(HBSurface); plug-in component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
createhbsrfs_8 = Honeybee_createHBSrfs(geometry=brep_8, RADMaterial=radglassmaterial_3.RADMaterial)  # -> out, simplify(HBSurface); plug-in component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

# ---- group: WALL
brep_9 = Brep([<brep referenced from the Rhino model> x10])

# ----
# Geometries_And_Materials
# Shading
panel_17 = Panel("0.5")
radopaquematerial_6 = Honeybee_RadianceOpaqueMaterial(
    materialName="WALL_50",
    RReflectance=panel_17,
    GReflectance=panel_17,
    BReflectance=panel_17,
    roughness=0.05,
    specularity=0)  # -> avrgRef, RADMaterial; plug-in component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
createhbsrfs_9 = Honeybee_createHBSrfs(geometry=brep_9, RADMaterial=radopaquematerial_6.RADMaterial)  # -> out, simplify(HBSurface); plug-in component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

# ----
# Run_Simulation
boolean_toggle = BooleanToggle(False)
rundaylightanalysis = Honeybee_RunDaylightSimulation(
    HBObjects=flatten([createhbsrfs_2.HBSurface, createhbsrfs_4.HBSurface, createhbsrfs_8.HBSurface, createhbsrfs_7.HBSurface, createhbsrfs_9.HBSurface]),
    analysisRecipe=[imagebasedsimulation, annualdaylightsimulation],
    writeRad=boolean_toggle,
    runRad=boolean_toggle,
    overwriteResults=True)  # -> out, analysisType, resultsUnit, results, testPts, resultFiles, radGeoFile, studyFolder, done; plug-in component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

# ----
# Annual_Result
boolean_toggle_2 = BooleanToggle(False)
readannualresultsi = Honeybee_ReadAnnualResultI(
    illFilesAddress=rundaylightanalysis.resultFiles,
    testPoints=simplify(rundaylightanalysis.testPts),
    DLAIllumThresholds=300,
    runIt=boolean_toggle_2)  # -> DLA, UDLI_Less_100, UDLI_100_2000, UDLI_More_2000, CDA, sDA, annualProfiles, htmReport; plug-in component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
number = Number(readannualresultsi.sDA)
panel_18 = Panel(number)

# ----
# Glare_Result
boolean_toggle_3 = BooleanToggle(True)
glareanalysis = Honeybee_GlareAnalysis(HDRImagePath=rundaylightanalysis.resultFiles, runIt=boolean_toggle_3)  # -> readMe, glareCheckImage, DGP, DGI, glareComfortRange, imageWithTaskArea; plug-in component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
falsecolor = Honeybee_FalseColor(
    HDRFilePath=rundaylightanalysis.resultFiles,
    contourBands=False,
    maskThreshold=0.1,
    useAlterColors=False,
    render=Toggle(False))  # -> outputFilePath; plug-in component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
panel_19 = Panel(glareanalysis.glareComfortRange)
hdr_gif = Honeybee_ConvertHDRToGIF(HDRFilePath=falsecolor, adjustExposure=Toggle(True))  # -> GIFFilePath; plug-in component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
hdr_gif_2 = Honeybee_ConvertHDRToGIF(HDRFilePath=glareanalysis.glareCheckImage, adjustExposure=Toggle(True))  # -> GIFFilePath; plug-in component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

# ----
# Visualization
panel_20 = Panel("sDA(%):  ")
concatenate = Concatenate(
    Fragment_A="Annual UDI 100<2000",
    Fragment_B="Material Name & Reflectance(%)",
    A="Ceiling:  ",
    B="CEILING_80",
    C="Wall:  ",
    D=panel_16,
    E="Floor:  ",
    F="FLOOR_20",
    G="Glazing:  ",
    H="GLASS_60",
    I="Shading:  ",
    J="WALL_50",
    K="Radiance Parameter  ",
    L="Ambient Bounces:  ",
    M=panel_7,
    N=panel_20,
    O=panel_18)
recolormesh = Ladybug_RecolorMesh(analysisResult=readannualresultsi.UDLI_100_2000, inputMesh=gentestpts.mesh, analysisTitle=concatenate, legendTitle="%")  # -> out, newMesh, newLegend, legendBasePt, meshColors, legendColors; plug-in component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

# ----
# Image Visualization
ladybug_imageviewer = Ladybug_ImageViewer(ImagePath_=hdr_gif_2, _scale_=1, DisableClickable=True, SaveImgWithCoords=False, scale=1)  # -> ImagePath, Colors, GIF
ladybug_imageviewer_2 = Ladybug_ImageViewer(ImagePath_=hdr_gif, _scale_=1, DisableClickable=False, SaveImgWithCoords=False, scale=1)  # -> ImagePath, Colors, GIF
file_path_2 = FilePath(ladybug_imageviewer.ImagePath)
panel_21 = Panel(file_path_2)

# ----
# Image Visualization
panel_22 = Panel("E:\Jeon\02_UPenn\2017_Fall____02_Building_Performance_Simulation\Assignment_5")
concatenate_2 = Concatenate(A="Glare_Simulation____", Fragment_A="Date: ", Fragment_B=panel_3)
captureview = Ladybug_CaptureView(fileName=concatenate_2, folder=panel_22, capture=rundaylightanalysis.done)  # -> Output; plug-in component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

# ----
# Fly
boolean_toggle_4 = BooleanToggle(False)
fly = Ladybug_fly(inputSliders=[number_slider, number_slider_2], fly=boolean_toggle_4)  # -> Vviiiiiiiiiizzz; plug-in component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
