# Grasshopper definition kamath_ayodh.gh (Grasshopper 0.9.76)
# plug-ins: Python Interpreter

honeybee = Honeybee_Honeybee()  # -> Vviiiiiiiiiizzz; plug-in component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
ladybug = Ladybug_Ladybug()  # -> Vviiiiiiiiiizzz; plug-in component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

# ---- group: Context
brep = Brep([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])

# ---- group: Walls
brep_2 = Brep([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])

# ---- group: Glass
brep_3 = Brep(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)

# ---- group: Floor
brep_4 = Brep(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)

# ---- group: Ceiling
brep_5 = Brep(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)

# ---- group: Shading
brep_6 = Brep([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])

# ---- group: Shading Curves
crv = Curve([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])

# ----
createhbsrfs = Honeybee_createHBSrfs(geometry=brep, srfType="0")  # -> readMe, simplify(HBSurface); plug-in component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
createhbsrfs_2 = Honeybee_createHBSrfs(geometry=brep_5, srfType="3")  # -> readMe, simplify(HBSurface); plug-in component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
createhbsrfs_3 = Honeybee_createHBSrfs(geometry=brep_2, srfType="0")  # -> readMe, simplify(HBSurface); plug-in component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
createhbsrfs_4 = Honeybee_createHBSrfs(geometry=brep_3, srfType="5")  # -> readMe, simplify(HBSurface); plug-in component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
createhbsrfs_5 = Honeybee_createHBSrfs(geometry=brep_4, srfType="2")  # -> readMe, simplify(HBSurface); plug-in component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
glzparamlist = Honeybee_GlazingParametersList(northGlzParam=0, westGlzParam=Slider(0.9, range=0..1), southGlzParam=0, eastGlzParam=0)  # -> glzParamList; plug-in component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

# ---- group: Optimized Values = -0.8, -0.35
number_slider = Slider(-0.4, range=-1..0)
number_slider_2 = Slider(-0.4, range=-1..0)

# ----
bbox = BoundingBox(Content=brep_3, Plane=PlaneXY(0, 0, 0))  # -> Box, Box_2
glazingcreator = Honeybee_GlazingBasedOnRatio(HBObjects=createhbsrfs_4.HBSurface, glzRatio=glzparamlist, runIt=Toggle(True))  # -> readMe, HBObjWGLZ; plug-in component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
smaller = SmallerThan(FirstNumber=number_slider, SecondNumber=number_slider_2)  # -> SmallerThan, OrEqualTo
box_corners = BoxCorners(Box=bbox.Box)  # -> CornerA, CornerB, CornerC, CornerD, CornerE, CornerF, CornerG, CornerH
X = UnitX(Factor=number_slider)
X_2 = UnitX(Factor=number_slider_2)
move = Move(Geometry=box_corners.CornerA, Motion=X)  # -> Geometry, Transform
move_2 = Move(Geometry=box_corners.CornerE, Motion=X_2)  # -> Geometry, Transform
vec2pt = Vector2Pt(PointA=box_corners.CornerB, PointB=box_corners.CornerC, Unitize=False)  # -> Vector, Length
p_n_c = PickNChoose(Pattern=smaller.SmallerThan, Stream0=X_2, Stream1=X)
ln = Line(StartPoint=move.Geometry, EndPoint=move_2.Geometry)
glazingcreator_2 = Honeybee_GlazingBasedOnRatio(HBObjects=glazingcreator.HBObjWGLZ, glzRatio=glzparamlist, runIt=Toggle(True))  # -> readMe, HBObjWGLZ; plug-in component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
pl = ConstructPlane(Origin=move.Geometry, XAxis=ln, YAxis=vec2pt.Vector)
extr = Extrude(Base=crv, Direction=p_n_c)
sec = BrepPlane(Brep=extr, Plane=pl)  # -> Curves, Points
flip = Flip(Surface=brep_4)  # -> Surface, Result
short = ShortestList(ListA=crv, ListB=flatten(sec.Curves), TrimMode=2)  # -> ListA, ListB
gentestpts = Honeybee_GenerateTestPoints(
    testGeometry=flip.Surface,
    gridSize=Slider(0.5, range=0..1),
    distBaseSrf=Slider(0.762, range=0..1),
    moveTestMesh=Toggle(True))  # -> readMe, simplify(testPoints), simplify(ptsVectors), simplify(facesArea), simplify(mesh); plug-in component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
flip_2 = FlipCurve(Curve=short.ListB)  # -> Curve, Flag
rulesrf = RuledSurface(CurveA=short.ListA, CurveB=flip_2.Curve)
createhbsrfs_6 = Honeybee_createHBSrfs(geometry=rulesrf, srfType="6")  # -> readMe, simplify(HBSurface); plug-in component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
brep_7 = Brep([glazingcreator_2.HBObjWGLZ, createhbsrfs_3.HBSurface, createhbsrfs_5.HBSurface, createhbsrfs_2.HBSurface, createhbsrfs_6.HBSurface, createhbsrfs.HBSurface])

# ---- group: Radiance parameter adjustments do not appear to make significant differences in output
radparameters = Honeybee_RADParameters(quality=0, ab="3", ar="128")  # -> readMe, radParameters; plug-in component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

# ----
preview = CustomPreview(Geometry=brep_3, Shader=ColourSwatch(SwatchColor=RGB(0, 200, 255)))
preview_2 = CustomPreview(Geometry=brep_7, Shader=ColourSwatch(SwatchColor=RGBA(128, 128, 128, 128)))
path = FilePath("C:\Users\Ayodh\Documents\Us\Ayodh\UPenn\1709\753\USA_PA_Philadelphia.Intl.AP.724080_TMY3\USA_PA_Philadelphia.Intl.AP.724080_TMY3.epw")
annualdaylightsimulation = Honeybee_AnnualDaylightSimulation(epwWeatherFile=path, testPoints=gentestpts.testPoints, ptsVectors=gentestpts.ptsVectors, testMesh=gentestpts.mesh)  # -> analysisRecipe; plug-in component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
bbox_2 = BoundingBox(Content=gentestpts.mesh, Plane=PlaneXY(0, 0, 0))  # -> Box, Box_2
analysisperiod = Ladybug_AnalysisPeriod(fromMonth="1", fromDay="1", fromHour="7", toMonth="12", toDay="31", toHour="17")  # -> readMe, analysisPeriod; plug-in component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
toggle = BooleanToggle(False)
box_corners_2 = BoxCorners(Box=bbox_2.Box)  # -> CornerA, CornerB, CornerC, CornerD, CornerE, CornerF, CornerG, CornerH
dist = Distance(PointA=box_corners_2.CornerA, PointB=box_corners_2.CornerB)
rundaylightanalysis = Honeybee_RunDaylightSimulation(
    HBObjects=flatten(brep_7),
    analysisRecipe=annualdaylightsimulation,
    writeRad=toggle,
    runRad=toggle,
    overwriteResults=True)  # -> readMe, analysisType, resultsUnit, results, testPts, resultFiles, radGeoFile, studyFolder, done; plug-in component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
multiplication = Multiplication(A=dist, B="1.75")
occupancygenerator = Honeybee_DaysimOccupancyGenerator(occupancyPeriod=analysisperiod.analysisPeriod, dailyOffHours="-1", weekendDays="0", writeTheOcc=Toggle(True))  # -> occupancyFile; plug-in component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
X_3 = UnitX(Factor=multiplication)
move_3 = Move(Geometry=gentestpts.mesh, Motion=X_3)  # -> Geometry, Transform
multiplication_2 = Multiplication(A=X_3, B=2)
readannualresultsi = Honeybee_ReadAnnualResultI(
    illFilesAddress=rundaylightanalysis.resultFiles,
    testPoints=simplify(rundaylightanalysis.testPts),
    occupancyFiles=occupancygenerator,
    DLAIllumThresholds=300,
    runIt=Toggle(True))  # -> DLA, UDLI_Less_100, UDLI_100_2000, UDLI_More_2000, CDA, sDA, annualProfiles, htmReport; plug-in component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
move_4 = Move(Geometry=gentestpts.mesh, Motion=multiplication_2)  # -> Geometry, Transform
ma = MassAddition(Input=readannualresultsi.UDLI_100_2000)  # -> Result, PartialResults
panel = Panel(ma.Result)
ma_2 = MassAddition(Input=readannualresultsi.UDLI_More_2000)  # -> Result, PartialResults
ma_3 = MassAddition(Input=readannualresultsi.UDLI_Less_100)  # -> Result, PartialResults
legendpar = Ladybug_LegendParameters(
    lowBound="0",
    highBound="100",
    customColors=reverse(flatten([ColourSwatch(SwatchColor=RGB(0, 0, 0)), ColourSwatch(SwatchColor=RGB(255, 255, 255))])))  # -> legendPar; plug-in component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
legendpar_2 = Ladybug_LegendParameters(
    lowBound="0",
    highBound="100",
    customColors=flatten([ColourSwatch(SwatchColor=RGB(0, 0, 255)), ColourSwatch(SwatchColor=RGB(255, 255, 0))]))  # -> legendPar; plug-in component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
legendpar_3 = Ladybug_LegendParameters(
    lowBound="0",
    highBound="100",
    customColors=flatten([ColourSwatch(SwatchColor=RGB(0, 0, 0)), ColourSwatch(SwatchColor=RGB(255, 255, 255))]))  # -> legendPar; plug-in component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
galapagos = Galapagos(fitness=ma, gene=[number_slider, number_slider_2])
concat = Concatenate(FragmentA="UDLI:100-2000 lux = ", FragmentB=panel)
concat_2 = Concatenate(FragmentA="UDLI<100 lux = ", FragmentB=ma_3.Result)
concat_3 = Concatenate(FragmentA="UDLI>2000 lux = ", FragmentB=ma_2.Result)
recolormesh = Ladybug_RecolorMesh(
    analysisResult=readannualresultsi.UDLI_100_2000,
    inputMesh=gentestpts.mesh,
    legendPar=legendpar_2,
    analysisTitle="Annual Daylight: Usable Areas",
    legendTitle=concat)  # -> readMe, newMesh, newLegend, legendBasePt, meshColors, legendColors; plug-in component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
recolormesh_2 = Ladybug_RecolorMesh(
    analysisResult=readannualresultsi.UDLI_Less_100,
    inputMesh=move_3.Geometry,
    legendPar=legendpar,
    analysisTitle="Annual Daylight: Dark Areas",
    legendTitle=concat_2)  # -> readMe, newMesh, newLegend, legendBasePt, meshColors, legendColors; plug-in component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
recolormesh_3 = Ladybug_RecolorMesh(
    analysisResult=readannualresultsi.UDLI_More_2000,
    inputMesh=move_4.Geometry,
    legendPar=legendpar_3,
    analysisTitle="Annual Daylight: Glare Areas",
    legendTitle=concat_3)  # -> readMe, newMesh, newLegend, legendBasePt, meshColors, legendColors; plug-in component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
