# Grasshopper definition katta-adiseshaiah_aishwarya.gh (Grasshopper 0.9.76)
# plug-ins: Python Interpreter, Archsim, Ironbug

radglassmaterial = Honeybee_RadianceGlassMaterial(materialName="Wall_90", RTransmittance="0.1", GTransmittance="0.1", BTransmittance="0.1", refractiveIndex=1.52)  # -> avrgTrans, RADMaterial; plug-in component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
radglassmaterial_2 = Honeybee_RadianceGlassMaterial(materialName="Ceiling_90", RTransmittance="0.1", GTransmittance="0.1", BTransmittance="0.1", refractiveIndex=1.52)  # -> avrgTrans, RADMaterial; plug-in component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
radglassmaterial_3 = Honeybee_RadianceGlassMaterial(refractiveIndex=1.52)  # -> avrgTrans, RADMaterial; plug-in component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
ladybug = Ladybug_Ladybug()  # -> Vviiiiiiiiiizzz; plug-in component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
honeybee = Honeybee_Honeybee()  # -> Vviiiiiiiiiizzz; plug-in component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
epglassmat = Honeybee_EnergyPlusGlassMaterial()  # -> EPMaterial; plug-in component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
opaque_material = OpaqueMaterial(
    MaterialName="Concrete",
    Roughness=1,
    MaterialConductivity=2.3,
    MaterialDensity=2400,
    MaterialSpecificHeat=840,
    MaterialThermalAbsorptance=0.9,
    MaterialSolarAbsorptance=0.7,
    MaterialVisibleAbsorptance=0.7)

# ---- group: ceiling
brep = Brep(<brep referenced from the Rhino model>)

# ---- group: floor
brep_2 = Brep(<brep referenced from the Rhino model>)

# ---- group: wall
brep_3 = Brep([<brep referenced from the Rhino model> x11])

# ---- group: glass
brep_4 = Brep([<brep referenced from the Rhino model> x3])

# ----
createhbsrfs = Honeybee_createHBSrfs(geometry=brep_2, srfType="2")  # -> readMe, simplify(HBSurface); plug-in component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
createhbsrfs_2 = Honeybee_createHBSrfs(geometry=brep, srfType="3", RADMaterial=radglassmaterial_2.RADMaterial)  # -> readMe, simplify(HBSurface); plug-in component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

radglassmaterial_4 = Honeybee_RadianceGlassMaterial(materialName="glass_60", RTransmittance="0.49", GTransmittance="0.49", BTransmittance="0.49", refractiveIndex=1.52)  # -> avrgTrans, RADMaterial; plug-in component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
# PROPOSED DESIGN
brep_5 = Brep([<brep referenced from the Rhino model> x9])
createhbsrfs_3 = Honeybee_createHBSrfs(geometry=brep_5, srfType="6")  # -> readMe, simplify(HBSurface); plug-in component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
createhbsrfs_4 = Honeybee_createHBSrfs(geometry=brep_4, RADMaterial=radglassmaterial_4.RADMaterial)  # -> readMe, simplify(HBSurface); plug-in component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
createhbsrfs_5 = Honeybee_createHBSrfs(geometry=brep_3, srfType="0", RADMaterial=radglassmaterial.RADMaterial)  # -> readMe, simplify(HBSurface); plug-in component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
flip = Flip(Surface=brep_2)  # -> Surface, Result
wires = BrepWireframe(
    Brep=[createhbsrfs_4.HBSurface, createhbsrfs_5.HBSurface, createhbsrfs_3.HBSurface, createhbsrfs_2.HBSurface, createhbsrfs.HBSurface],
    Density=-1)

brep_6 = Brep(flatten([createhbsrfs_3.HBSurface, createhbsrfs_5.HBSurface, createhbsrfs_4.HBSurface, createhbsrfs_2.HBSurface, createhbsrfs.HBSurface]))

number_slider = Slider(0, range=0..2)  # disabled
number_slider_2 = Slider(0, range=0..2)  # disabled
# Animate sliders
button = Button()  # disabled
hours = Panel("""9
12
15""")  # disabled
months = Panel("""3
6
12""")  # disabled
fly = Ladybug_fly(inputSliders=[number_slider, number_slider_2], fly=button)  # -> Vviiiiiiiiiizzz; disabled; plug-in component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
panel = Panel("21")  # disabled
item = ListItem(List=hours, Index=number_slider_2, Wrap=True)  # disabled
item_2 = ListItem(List=months, Index=number_slider, Wrap=True)  # disabled

panel_2 = Panel("https://www.energyplus.net/weather-download/north_and_central_america_wmo_region_4/USA/PA/USA_PA_Philadelphia.Intl.AP.724080_TMY3/all")  # disabled
honeybee_2 = Honeybee_Honeybee()  # -> Vviiiiiiiiiizzz; disabled; plug-in component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
epw_stat = Ladybug_OpenEPWAndSTATWeatherFiles(weatherFileURL=panel_2)  # -> epwFile, statFile; disabled; plug-in component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
ladybug_2 = Ladybug_Ladybug()  # -> Vviiiiiiiiiizzz; disabled; plug-in component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
panel_3 = Panel("12")  # disabled
panel_4 = Panel("21")  # disabled
panel_5 = Panel("9")  # disabled

# ---- group: ceiling
brep_7 = Brep(<brep referenced from the Rhino model>)

# ---- group: floor
brep_8 = Brep(<brep referenced from the Rhino model>)

# ---- group: wall
brep_9 = Brep([<brep referenced from the Rhino model> x7])

# ---- group: glass
brep_10 = Brep(<brep referenced from the Rhino model>)

# ----
createhbsrfs_6 = Honeybee_createHBSrfs(geometry=brep_8, srfType="2")  # -> readMe, simplify(HBSurface); plug-in component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
createhbsrfs_7 = Honeybee_createHBSrfs(geometry=brep_7, srfType="3")  # -> readMe, simplify(HBSurface); plug-in component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

radglassmaterial_5 = Honeybee_RadianceGlassMaterial(materialName="glass_60", RTransmittance="0.6", GTransmittance="0.6", BTransmittance="0.6", refractiveIndex=1.52)  # -> avrgTrans, RADMaterial; plug-in component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
brep_11 = Brep([<brep referenced from the Rhino model> x4])
# DESIGN W/ SHADING
createhbsrfs_8 = Honeybee_createHBSrfs(geometry=brep_11, srfType="6")  # -> readMe, simplify(HBSurface); plug-in component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
createhbsrfs_9 = Honeybee_createHBSrfs(geometry=brep_10, RADMaterial=radglassmaterial_5.RADMaterial)  # -> readMe, simplify(HBSurface); plug-in component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
createhbsrfs_10 = Honeybee_createHBSrfs(geometry=brep_9, srfType="0")  # -> readMe, simplify(HBSurface); plug-in component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
flip_2 = Flip(Surface=brep_8)  # -> Surface, Result
wires_2 = BrepWireframe(
    Brep=[createhbsrfs_9.HBSurface, createhbsrfs_10.HBSurface, createhbsrfs_8.HBSurface, createhbsrfs_7.HBSurface, createhbsrfs_6.HBSurface],
    Density=-1)

genclimatebasedsky = Honeybee_GenerateClimateBasedSky(weatherFile=epw_stat.epwFile, month=[item_2, panel_3], day=[panel, panel_4], hour=[item, panel_5])  # -> radiationValues, skyFilePath; disabled; plug-in component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
doy_hoy = Ladybug_DOY_HOY(days=[panel, panel_3], months=[item_2, panel_4], hours=[item, panel_5])  # -> HOY, DOY, date; disabled; plug-in component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
panel_6 = Panel(genclimatebasedsky.radiationValues)  # disabled

brep_12 = Brep(flatten([createhbsrfs_8.HBSurface, createhbsrfs_10.HBSurface, createhbsrfs_9.HBSurface, createhbsrfs_7.HBSurface, createhbsrfs_6.HBSurface]))

panel_7 = Panel("_")  # disabled
# capture the viewport to an image
join = TextJoin(Text=[item_2, panel, item], Join=panel_7)  # disabled
panel_8 = Panel("C:\Users\aishu\Desktop\MEBD\2. Building Simulation\Assignment 5 - Annual Analysis\Glare Images")  # disabled
panel_9 = Panel(join)  # disabled
toggle = BooleanToggle(True)  # disabled
panel_10 = Panel("1600")  # disabled
panel_11 = Panel("800")  # disabled
captureview = Ladybug_CaptureView(fileName=panel_9, folder=panel_8, imageWidth=panel_10, imageHeight=panel_11, capture=toggle)  # -> imagePath; disabled; plug-in component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
panel_12 = Panel(captureview)  # disabled

panel_13 = Panel("3")  # disabled
set_the_view_to_fisheye_for_glare_analys = Panel("1")  # "set the view to FishEye for Glare Analysis"; disabled
radparameters = Honeybee_RADParameters(quality=0, ab=panel_13)  # -> readMe, radParameters; disabled; plug-in component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
imagebasedsimulation = Honeybee_ImageBasedSimulation(
    skyFile=genclimatebasedsky.skyFilePath,
    cameraType=set_the_view_to_fisheye_for_glare_analys,
    simulationType=2,
    radParameters=radparameters.radParameters,
    backupImages=0)  # -> analysisRecipe; disabled; plug-in component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
toggle_2 = BooleanToggle(True)  # disabled
rundaylightanalysis = Honeybee_RunDaylightSimulation(
    HBObjects=flatten(brep_6),
    analysisRecipe=imagebasedsimulation,
    writeRad=toggle_2,
    runRad=toggle_2,
    radFileName=doy_hoy.date,
    overwriteResults=True)  # -> readMe, analysisType, resultsUnit, results, testPts, luminance_files, radGeoFile, studyFolder, done; disabled; plug-in component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

# ---- group: ceiling
brep_13 = Brep(<brep referenced from the Rhino model>)

# ---- group: floor
brep_14 = Brep(<brep referenced from the Rhino model>)

# ---- group: wall
brep_15 = Brep([<brep referenced from the Rhino model> x7])

# ---- group: glass
brep_16 = Brep(<brep referenced from the Rhino model>)

# ----
gentestpts = Honeybee_GenerateTestPoints(testGeometry=brep_2, gridSize="0.1", distBaseSrf="0.1", moveTestMesh=True)  # -> readMe, simplify(testPoints), simplify(ptsVectors), simplify(facesArea), simplify(mesh); plug-in component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
path = FilePath("C:\Users\aishu\Desktop\MEBD\2. Building Simulation\Assignment 1 & 2\USA_PA_Philadelphia.Intl.AP.724080_TMY3\USA_PA_Philadelphia.Intl.AP.724080_TMY3.epw")
annualdaylightsimulation = Honeybee_AnnualDaylightSimulation(epwWeatherFile=path, testPoints=gentestpts.testPoints, ptsVectors=gentestpts.ptsVectors)  # -> analysisRecipe; plug-in component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
toggle_3 = BooleanToggle(True)
rundaylightanalysis_2 = Honeybee_RunDaylightSimulation(
    HBObjects=flatten(brep_6),
    analysisRecipe=annualdaylightsimulation,
    writeRad=toggle_3,
    runRad=toggle_3,
    overwriteResults=True)  # -> readMe, analysisType, resultsUnit, results, testPts, annual_analysis_files, radGeoFile, studyFolder, done; plug-in component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

createhbsrfs_11 = Honeybee_createHBSrfs(geometry=brep_14, srfType="2")  # -> readMe, simplify(HBSurface); plug-in component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
createhbsrfs_12 = Honeybee_createHBSrfs(geometry=brep_13, srfType="3")  # -> readMe, simplify(HBSurface); plug-in component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

radglassmaterial_6 = Honeybee_RadianceGlassMaterial(materialName="glass_60", RTransmittance="0.6", GTransmittance="0.6", BTransmittance="0.6", refractiveIndex=1.52)  # -> avrgTrans, RADMaterial; plug-in component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
brep_17 = Brep()  # disabled
panel_14 = Panel("6")  # disabled
# BASELINE
createhbsrfs_13 = Honeybee_createHBSrfs(geometry=brep_17, srfType=panel_14)  # -> readMe, simplify(HBSurface); disabled; plug-in component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
createhbsrfs_14 = Honeybee_createHBSrfs(geometry=brep_16, RADMaterial=radglassmaterial_6.RADMaterial)  # -> readMe, simplify(HBSurface); plug-in component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
createhbsrfs_15 = Honeybee_createHBSrfs(geometry=brep_15, srfType="0")  # -> readMe, simplify(HBSurface); plug-in component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
flip_3 = Flip(Surface=brep_14)  # -> Surface, Result
wires_3 = BrepWireframe(
    Brep=[createhbsrfs_14.HBSurface, createhbsrfs_15.HBSurface, createhbsrfs_13.HBSurface, createhbsrfs_12.HBSurface, createhbsrfs_11.HBSurface],
    Density=-1)

md_slider = MDSlider(
    slider_value=Point(0.4544874982, 0.4957573123, 0.5),
    SliderMode=0,
    x_domain=Domain(-1, 1),
    y_domain=Domain(-1, 1),
    z_domain=Domain(0, 1))  # disabled
brep_18 = Brep(flatten([createhbsrfs_13.HBSurface, createhbsrfs_15.HBSurface, createhbsrfs_14.HBSurface, createhbsrfs_12.HBSurface, createhbsrfs_11.HBSurface]))
toggle_4 = BooleanToggle(True)  # disabled

# ----
# DGP: Daylight glare probability:
# Imperceptible Glare [0.35 > DGP]
# Perceptible Glare [0.4 > DGP >= 0.35]
# Disturbing Glare [0.45 > DGP >= 0.4]
# Intolerable Glare [DGP >= 0.45]
toggle_5 = BooleanToggle(True)  # disabled
glareanalysis = Honeybee_GlareAnalysis(HDRImagePath=rundaylightanalysis.luminance_files, runIt=toggle_5)  # -> readMe, glareCheckImage, DGP, DGI, glareComfortRange, imageWithTaskArea; disabled; plug-in component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
panel_15 = Panel(glareanalysis.DGP)  # disabled
toggle_6 = BooleanToggle(True)  # disabled
hdr_gif = Honeybee_ConvertHDRToGIF(HDRFilePath=glareanalysis.glareCheckImage, adjustExposure=toggle_6)  # -> GIFFilePath; disabled; plug-in component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
number_slider_3 = Slider(1, range=0..1)  # disabled

falsecolor = Honeybee_FalseColor(
    HDRFilePath=rundaylightanalysis.luminance_files,
    contourBands=False,
    maskThreshold=0.1,
    useAlterColors=False,
    render=toggle_4)  # -> outputFilePath; disabled; plug-in component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
analysisperiod = Ladybug_AnalysisPeriod(fromHour="9", toHour="15")  # -> readMe, analysisPeriod; plug-in component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

occupancygenerator = Honeybee_DaysimOccupancyGenerator(occupancyPeriod=analysisperiod.analysisPeriod, weekendDays=[1, 2], writeTheOcc=Toggle(True))  # -> occupancyFile; plug-in component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
readannualresultsi = Honeybee_ReadAnnualResultI(
    illFilesAddress=rundaylightanalysis_2.annual_analysis_files,
    testPoints=simplify(rundaylightanalysis_2.testPts),
    occupancyFiles=occupancygenerator,
    DLAIllumThresholds=300,
    runIt=Toggle(True))  # -> DLA, UDLI_Less_100, UDLI_100_2000, UDLI_More_2000, CDA, sDA, annualProfiles, htmReport; plug-in component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

hdr_gif_2 = Honeybee_ConvertHDRToGIF(HDRFilePath=falsecolor, adjustExposure=False)  # -> GIFFilePath; disabled; plug-in component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
dom = ConstructDomain(DomainStart=Slider(1, range=1..5), DomainEnd=Slider(2, range=1..5))

gradientlibrary = Ladybug_GradientLibrary(gradIndex="13")  # -> customColors; plug-in component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
legendpar = Ladybug_LegendParameters(lowBound="0", highBound="100", customColors=flatten(gradientlibrary))  # -> legendPar; plug-in component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
recolormesh = Ladybug_RecolorMesh(
    analysisResult=readannualresultsi.DLA,
    inputMesh=gentestpts.mesh,
    heightDomain=dom,
    legendPar=legendpar,
    analysisTitle="Daylight Autonomy",
    legendTitle="%",
    bakeIt=Toggle(True))  # -> readMe, newMesh, newLegend, legendBasePt, meshColors, legendColors; plug-in component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

viewer = Ladybug_ImageViewer(ImagePath=hdr_gif_2, ViewportScale=number_slider_3, DisableClickable=False, SaveImgWithCoords=False, scale=1)  # -> ImagePath, ColorValues, AnimatedGIFImage; disabled
viewer_2 = Ladybug_ImageViewer(ImagePath=hdr_gif, ViewportScale=number_slider_3, DisableClickable=False, SaveImgWithCoords=False, scale=1)  # -> ImagePath, ColorValues, AnimatedGIFImage; disabled

panel_16 = Panel("0")  # disabled
pt = Point(Point(-24.44489897, 10.91929985, 0))  # disabled
# set the view
comfortmannequin = Ladybug_ComfortMannequin(rotationAngle=panel_16, bodyLocation=pt)  # -> mannequinMesh, legend, legendBasePt; disabled; plug-in component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
swatch = ColourSwatch(SwatchColor=RGB(255, 0, 0))  # disabled

# ---- group: Person's face!
item_3 = ListItem(List=comfortmannequin.mannequinMesh, Index=121, Wrap=True)  # disabled

# ----
preview = CustomPreview(Geometry=item_3, Shader=swatch)  # disabled

facen = FaceNormals(Mesh=item_3)  # -> Centers, Normals; disabled
settheview = Ladybug_SetTheView(cameraLocation=facen.Centers, cameraDirection=facen.Normals, uvLookAround=md_slider)  # disabled; plug-in component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
