# Grasshopper definition kennedy_kirin.gh (Grasshopper 0.9.76)
# plug-ins: Python Interpreter, Ironbug

number_slider = Slider(0.4, range=0.2..0.9)
honeybee = Honeybee_Honeybee()  # -> Vviiiiiiiiiizzz; plug-in component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
ladybug = Ladybug_Ladybug()  # -> Vviiiiiiiiiizzz; plug-in component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
panel = Panel("3.362")
panel_2 = Panel("2.11")
box = DomainBox(Base=PlaneXY(0, 0, 0), X="3.362", Y="4.8662", Z="3.658")
fly = Ladybug_fly(inputSliders=number_slider, fly=Toggle(False))  # -> Vviiiiiiiiiizzz; plug-in component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
planesrf = PlaneSurface(Plane="0,-2.11,1.899", XSize="3.362", YSize="4.56")
planesrf_2 = PlaneSurface(Plane=["0,-1.11,1.59", "0,-1.11,1.139", "0,-1.11,.762"], XSize="3.362", YSize="1.11")
glzparamlist = Honeybee_GlazingParametersList(northGlzParam=0, westGlzParam=0, southGlzParam=number_slider, eastGlzParam=0)  # -> glzParamList; plug-in component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
mass2zone = Honeybee_Masses2Zones(zoneMasses=flatten(box), isConditioned=True, maxRoofAngle=30, createHBZones=Toggle(True))  # -> readMe, HBZones; plug-in component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
radmetalmaterial = Honeybee_RadianceMetalMaterial(materialName="Light Shelf", RReflectance="1", GReflectance="1", BReflectance="1", roughness="0", specularity="1")  # -> RADMaterial; plug-in component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
glazingcreator = Honeybee_GlazingBasedOnRatio(HBObjects=mass2zone.HBZones, glzRatio=glzparamlist, sillHeight=".762", runIt=Toggle(True))  # -> readMe, HBObjWGLZ; plug-in component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
createhbsrfs = Honeybee_createHBSrfs(geometry=[planesrf_2, planesrf], RADMaterial=radmetalmaterial)  # -> readMe, simplify(HBSurface); plug-in component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
genhbzonetestpts = Honeybee_GenerateZoneTestPoints(HBZone=glazingcreator.HBObjWGLZ, gridSize="0.5", distBaseSrf="0.762", moveTestMesh=True)  # -> readMe, simplify(testPoints), simplify(ptsVectors), simplify(facesArea), simplify(mesh); plug-in component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
panel_5 = Panel("https://www.energyplus.net/weather-download/north_and_central_america_wmo_region_4/USA/PA/USA_PA_Philadelphia.Intl.AP.724080_TMY3/all")
brep = Brep(flatten([glazingcreator.HBObjWGLZ, createhbsrfs.HBSurface]))
epw_stat = Ladybug_OpenEPWAndSTATWeatherFiles(weatherFileURL=panel_5)  # -> epwFile, statFile; plug-in component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

importlocation = Ladybug_ImportLocation(epwFile=epw_stat.epwFile)  # -> location; plug-in component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
genclimatebasedsky = Honeybee_GenerateClimateBasedSky(weatherFile=epw_stat.epwFile, month="12", day="21", hour="9")  # -> radiationValues, skyFilePath; plug-in component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
genavgsky = Honeybee_GenerateAverageSky(weatherFile=epw_stat.epwFile, month="12", hour="9")  # -> radiationValues, skyFilePath; plug-in component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
sunpath = Ladybug_SunPath(location=importlocation, hour=12, day=21, month=12, timeStep=1, sunPathScale=".2", dailyOrAnnualSunPath=True)  # -> readMe, sunVectors, sunAltitudes, sunAzimuths, port, sunSpheresMesh, sunPathCrvs, compassCrvs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; plug-in component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
panel_6 = Panel([genavgsky.radiationValues, genclimatebasedsky.radiationValues])
radparameters = Honeybee_RADParameters(quality=0, ab="4")  # -> readMe, radParameters; plug-in component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
imagebasedsimulation = Honeybee_ImageBasedSimulation(
    skyFile=genavgsky.skyFilePath,
    cameraType="1",
    simulationType=2,
    radParameters=radparameters.radParameters,
    backupImages=0)  # -> analysisRecipe; plug-in component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
toggle = BooleanToggle(False)
rundaylightanalysis = Honeybee_RunDaylightSimulation(HBObjects=flatten(brep), analysisRecipe=imagebasedsimulation, writeRad=toggle, runRad=toggle, overwriteResults=True)  # -> readMe, analysisType, resultsUnit, results, testPts, resultFiles, radGeoFile, studyFolder, done; plug-in component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
glareanalysis = Honeybee_GlareAnalysis(HDRImagePath=rundaylightanalysis.resultFiles, runIt=Toggle(True))  # -> readMe, glareCheckImage, DGP, DGI, glareComfortRange, imageWithTaskArea; plug-in component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
falsecolor = Honeybee_FalseColor(HDRFilePath=rundaylightanalysis.resultFiles, contourBands=False, maskThreshold=0.1, useAlterColors=False)  # -> outputFilePath; plug-in component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
panel_7 = Panel(glareanalysis.DGP)
hdr_tif = Honeybee_ConvertHDRToTIF(HDRFilePath=glareanalysis.glareCheckImage, adjustExposure=Toggle(True))  # -> TIFFFilePath; plug-in component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
hdr_tif_2 = Honeybee_ConvertHDRToTIF(HDRFilePath=falsecolor, adjustExposure=False)  # -> TIFFFilePath; plug-in component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
viewer = Ladybug_ImageViewer(ImagePath=hdr_tif, ViewportScale=1, DisableClickable=True, SaveImgWithCoords=False, scale=1)  # -> ImagePath, ColorValues, AnimatedGIFImage
viewer_2 = Ladybug_ImageViewer(ViewportScale=hdr_tif_2, DisableClickable=False, SaveImgWithCoords=False, scale=1)  # -> ImagePath, ColorValues, AnimatedGIFImage
panel_8 = Panel(viewer.ImagePath)

wires = BrepWireframe(Brep=brep, Density=-1)

planesrf_3 = PlaneSurface(Plane="-30,-30,0", XSize="60", YSize="60")
createhbsrfs_2 = Honeybee_createHBSrfs(geometry=planesrf_3)  # -> readMe, simplify(HBSurface); plug-in component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
genclimatebasedsky_2 = Honeybee_GenerateClimateBasedSky(weatherFile=epw_stat.epwFile, month="12", day="21", hour="9")  # -> radiationValues, skyFilePath; plug-in component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
imagebasedsimulation_2 = Honeybee_ImageBasedSimulation(skyFile=genclimatebasedsky_2.skyFilePath, simulationType=2, backupImages=0)  # -> analysisRecipe; plug-in component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
toggle_2 = BooleanToggle(True)
rundaylightanalysis_2 = Honeybee_RunDaylightSimulation(
    HBObjects=flatten([brep, createhbsrfs_2.HBSurface]),
    analysisRecipe=imagebasedsimulation_2,
    writeRad=toggle_2,
    runRad=toggle_2,
    overwriteResults=True)  # -> readMe, analysisType, resultsUnit, results, testPts, luminance_files, radGeoFile, studyFolder, done; plug-in component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
hdr_tif_3 = Honeybee_ConvertHDRToTIF(HDRFilePath=rundaylightanalysis_2.luminance_files, adjustExposure=Toggle(True))  # -> TIFFFilePath; plug-in component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
viewer_3 = Ladybug_ImageViewer(ImagePath=hdr_tif_3, ViewportScale=1, DisableClickable=False, SaveImgWithCoords=True, scale=1)  # -> ImagePath, ColorValues, AnimatedGIFImage
panel_9 = Panel(viewer_3.ImagePath)

legendpar = Ladybug_LegendParameters(lowBound="30", highBound="90")  # -> legendPar; plug-in component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

annualdaylightsimulation = Honeybee_AnnualDaylightSimulation(epwWeatherFile=epw_stat.epwFile, testPoints=genhbzonetestpts.testPoints, ptsVectors=genhbzonetestpts.ptsVectors)  # -> analysisRecipe; plug-in component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
toggle_3 = BooleanToggle(False)
rundaylightanalysis_3 = Honeybee_RunDaylightSimulation(
    HBObjects=flatten(glazingcreator.HBObjWGLZ),
    analysisRecipe=annualdaylightsimulation,
    writeRad=toggle_3,
    runRad=toggle_3,
    overwriteResults=True)  # -> readMe, analysisType, resultsUnit, results, testPts, resultFiles, radGeoFile, studyFolder, done; plug-in component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
occupancygenerator = Honeybee_DaysimOccupancyGenerator(weekendDays=[1, 2], writeTheOcc=Toggle(True))  # -> occupancyFile; plug-in component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
readannualresultsi = Honeybee_ReadAnnualResultI(
    illFilesAddress=rundaylightanalysis_3.resultFiles,
    testPoints=simplify(rundaylightanalysis_3.testPts),
    occupancyFiles=occupancygenerator,
    DLAIllumThresholds=300,
    runIt=Toggle(True))  # -> DLA, UDLI_Less_100, UDLI_100_2000, UDLI_More_2000, CDA, sDA, annualProfiles, htmReport; plug-in component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
concat = Concatenate(FragmentA="Annual Daylight Analysis", FragmentB="WWR: ", FragmentC=number_slider)
recolormesh = Ladybug_RecolorMesh(
    analysisResult=readannualresultsi.UDLI_100_2000,
    inputMesh=genhbzonetestpts.mesh,
    legendPar=legendpar,
    analysisTitle=concat,
    legendTitle="%")  # -> readMe, newMesh, newLegend, legendBasePt, meshColors, legendColors; plug-in component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
concat_2 = Concatenate(FragmentA="Annual_Daylight_Analysis_", FragmentB="WWR_", FragmentC=number_slider)
captureview = Ladybug_CaptureView(fileName=concat_2, folder="C:\Users\Kirin\Desktop\Fall 2017\Simulations\1023\Test 3", capture=rundaylightanalysis_3.done)  # -> imagePath; plug-in component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

daylighfactorsimulation = Honeybee_DaylightFactorSimulation(testPoints=genhbzonetestpts.testPoints, ptsVectors=genhbzonetestpts.ptsVectors, uniformSky=False)  # -> analysisRecipe; disabled; plug-in component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
toggle_4 = BooleanToggle(False)
rundaylightanalysis_4 = Honeybee_RunDaylightSimulation(
    HBObjects=flatten(glazingcreator.HBObjWGLZ),
    analysisRecipe=daylighfactorsimulation,
    writeRad=toggle_4,
    runRad=toggle_4,
    overwriteResults=True)  # -> readMe, analysisType, resultsUnit, results, testPts, resultFiles, radGeoFile, studyFolder, done; disabled; plug-in component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
panel_10 = Panel(rundaylightanalysis_4.results)
legendpar_2 = Ladybug_LegendParameters(lowBound="0", highBound="5")  # -> legendPar; plug-in component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
concat_3 = Concatenate(FragmentA="Illuminance", FragmentC="WWR:", FragmentD=number_slider, FragmentE="Date:")
recolormesh_2 = Ladybug_RecolorMesh(
    analysisResult=rundaylightanalysis_4.results,
    inputMesh=genhbzonetestpts.mesh,
    legendPar=legendpar_2,
    analysisTitle=concat_3,
    legendTitle="Lux")  # -> readMe, newMesh, newLegend, legendBasePt, meshColors, legendColors; plug-in component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
smaller = SmallerThan(FirstNumber=rundaylightanalysis_4.results, SecondNumber=0)  # -> SmallerThan, OrEqualTo; disabled
mesh = Mesh()  # disabled
cullf = CullFaces(Mesh=mesh, Pattern=smaller.OrEqualTo)  # disabled
area = Area(Geometry=cullf)  # -> Area, Centroid; disabled
area_2 = Area(Geometry=mesh)  # -> Area, Centroid; disabled
division = Division(A=area.Area, B=area_2.Area)  # disabled
panel_11 = Panel(division)  # disabled
panel_12 = Panel("100")  # disabled
multiplication = Multiplication(A=panel_11, B=panel_12)  # disabled
panel_13 = Panel("% Area of the Room: ")  # disabled
round = Round(Number=multiplication)  # -> Nearest, Floor, Ceiling; disabled
concat_4 = Concatenate(FragmentA=panel_13, FragmentB=round.Nearest)
number_slider_2 = Slider(0.8, range=0..1)  # disabled
pt = Point(Point(0.136135123, -2.963640869, 0))  # disabled
tag = TextTag3D(Location=pt, Text=concat_4, Size=number_slider_2, Justification=7)  # disabled
