# Grasshopper definition li_yunqian.gh (Grasshopper 0.9.76)
# plug-ins: Python Interpreter, FalseStartToggle, Ironbug

panel = Panel("glass_60")  # disabled
panel_2 = Panel("0.6")  # disabled
panel_3 = Panel("wood")  # disabled
panel_4 = Panel("0.6")  # disabled
brep = Brep([<brep referenced from the Rhino model> x6])  # disabled
radglassmaterial = Honeybee_RadianceGlassMaterial(materialName=panel, RTransmittance=panel_2, GTransmittance=panel_2, BTransmittance=panel_2, refractiveIndex=1.52)  # -> avrgTrans, RADMaterial; disabled; plug-in component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
radopaquematerial = Honeybee_RadianceOpaqueMaterial(materialName=panel_3, RReflectance=panel_4, GReflectance=panel_4, BReflectance=panel_4, roughness=0.05, specularity=0)  # -> avrgRef, RADMaterial; disabled; plug-in component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
ladybug = Ladybug_Ladybug()  # -> Vviiiiiiiiiizzz; plug-in component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
honeybee = Honeybee_Honeybee()  # -> Vviiiiiiiiiizzz; plug-in component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

# ---- group: glass
brep_2 = Brep(<brep referenced from the Rhino model>)  # disabled

# ---- group: floor
brep_3 = Brep(<brep referenced from the Rhino model>)  # disabled

# ---- group: ceiling
brep_4 = Brep(<brep referenced from the Rhino model>)  # disabled

# ---- group: wall
brep_5 = Brep([<brep referenced from the Rhino model> x3])  # disabled

# ----
number_slider = Slider(0.5, range=0.2..0.9)  # disabled
panel_5 = Panel("12")  # disabled
panel_6 = Panel("30")  # disabled
panel_7 = Panel("20")  # disabled
toggle = BooleanToggle(True)  # disabled
createhbsrfs = Honeybee_createHBSrfs(geometry=[brep_5, brep_4, brep_3])  # -> readMe, simplify(HBSurface); disabled; plug-in component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
createhbsrfs_2 = Honeybee_createHBSrfs(geometry=brep_2, RADMaterial=radglassmaterial.RADMaterial)  # -> readMe, simplify(HBSurface); disabled; plug-in component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
number_slider_2 = Slider(0.2, range=0.2..0.9)  # disabled
box = DomainBox(Base=PlaneXY(0, 0, 0), X=panel_6, Y=panel_7, Z=panel_5)  # disabled
panel_8 = Panel("20")  # disabled
panel_9 = Panel("12")  # disabled
panel_10 = Panel("30")  # disabled
glzparamlist = Honeybee_GlazingParametersList(northGlzParam=0, westGlzParam=0, southGlzParam=number_slider, eastGlzParam=0)  # -> glzParamList; disabled; plug-in component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
flip = Flip(Surface=brep_3)  # -> Surface, Result; disabled
false_start_toggle = FalseStartToggle(False)  # disabled
msh2rad = Honeybee_MSH2RAD(mesh=brep, RADMaterial=radopaquematerial.RADMaterial, writeRAD=false_start_toggle)  # -> materialFile, radianceFile; disabled; plug-in component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
panel_11 = Panel(glzparamlist)  # disabled
mass2zone = Honeybee_Masses2Zones(zoneMasses=flatten(box), isConditioned=True, maxRoofAngle=30, createHBZones=toggle)  # -> readMe, HBZones; disabled; plug-in component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
box_2 = DomainBox(Base=PlaneXY(0, 0, 0), X=panel_10, Y=panel_8, Z=panel_9)  # disabled
toggle_2 = BooleanToggle(True)  # disabled
glzparamlist_2 = Honeybee_GlazingParametersList(northGlzParam=0, westGlzParam=0, southGlzParam=number_slider_2, eastGlzParam=0)  # -> glzParamList; disabled; plug-in component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
panel_12 = Panel("0.762")  # disabled
wires = BrepWireframe(Brep=[createhbsrfs_2.HBSurface, createhbsrfs.HBSurface], Density=-1)  # disabled
panel_13 = Panel("0.5")  # disabled
panel_14 = Panel(glzparamlist_2)  # disabled
toggle_3 = BooleanToggle(True)  # disabled
panel_15 = Panel("wood")  # disabled
panel_16 = Panel("0.6")  # disabled
panel_17 = Panel("https://www.energyplus.net/weather-download/north_and_central_america_wmo_region_4/USA/PA/USA_PA_Philadelphia.Intl.AP.724080_TMY3/all")  # disabled
mass2zone_2 = Honeybee_Masses2Zones(zoneMasses=flatten(box_2), isConditioned=True, maxRoofAngle=30, createHBZones=toggle_2)  # -> readMe, HBZones; disabled; plug-in component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
panel_18 = Panel("wood")  # disabled
panel_19 = Panel("0.5")  # disabled
brep_6 = Brep([<brep referenced from the Rhino model> x8])  # disabled
number_slider_3 = Slider(0, range=0..2)  # disabled
merge = Merge(Data1=msh2rad.materialFile, Data2=msh2rad.radianceFile)  # disabled
month = Panel("""3
6
12""")  # disabled
hour = Panel("""9
12
15""")  # disabled
number_slider_4 = Slider(0, range=0..2)  # disabled
brep_7 = Brep([<brep referenced from the Rhino model> x6])  # disabled
gentestpts = Honeybee_GenerateTestPoints(testGeometry=flip.Surface, gridSize=panel_13, distBaseSrf=panel_12, moveTestMesh=True)  # -> out, simplify(testPoints), simplify(ptsVectors), simplify(facesArea), simplify(mesh); disabled; plug-in component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
glazingcreator = Honeybee_GlazingBasedOnRatio(HBObjects=mass2zone.HBZones, glzRatio=glzparamlist, runIt=toggle_3)  # -> readMe, HBObjWGLZ; disabled; plug-in component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
radopaquematerial_2 = Honeybee_RadianceOpaqueMaterial(
    materialName=panel_15,
    RReflectance=panel_16,
    GReflectance=panel_16,
    BReflectance=panel_16,
    roughness=0.05,
    specularity=0)  # -> avrgRef, RADMaterial; disabled; plug-in component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
radopaquematerial_3 = Honeybee_RadianceOpaqueMaterial(
    materialName=panel_18,
    RReflectance=panel_19,
    GReflectance=panel_19,
    BReflectance=panel_19,
    roughness=0.05,
    specularity=0)  # -> avrgRef, RADMaterial; disabled; plug-in component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
epw_stat = Ladybug_OpenEPWAndSTATWeatherFiles(weatherFileURL=panel_17)  # -> epwFile, statFile; disabled; plug-in component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
toggle_4 = BooleanToggle(True)  # disabled
panel_20 = Panel("glass_.65")  # disabled
wires_2 = BrepWireframe(Brep=glazingcreator.HBObjWGLZ, Density=-1)  # disabled
panel_21 = Panel(".65")  # disabled
number_slider_5 = Slider(0, range=0..2)  # disabled
month_2 = Panel("""3
6
12""")  # disabled
hour_2 = Panel("""9
12
15""")  # disabled
number_slider_6 = Slider(0, range=0..2)  # disabled
panel_22 = Panel("21")  # disabled
panel_23 = Panel("0.762")  # disabled
glazingcreator_2 = Honeybee_GlazingBasedOnRatio(HBObjects=mass2zone_2.HBZones, glzRatio=glzparamlist_2, runIt=toggle_4)  # -> readMe, HBObjWGLZ; disabled; plug-in component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
panel_24 = Panel("0.5")  # disabled
item = ListItem(List=month, Index=number_slider_4, Wrap=True)  # disabled
item_2 = ListItem(List=hour, Index=number_slider_3, Wrap=True)  # disabled
path = FilePath("C:\Users\Yunqian\Desktop\Course Fall2017\Building Performance Sim\Philadelphia_weather_files\USA_PA_Philadelphia.Intl.AP.724080_TMY3.epw")  # disabled
radglassmaterial_2 = Honeybee_RadianceGlassMaterial(materialName=panel_20, RTransmittance=panel_21, GTransmittance=panel_21, BTransmittance=panel_21, refractiveIndex=1.52)  # -> avrgTrans, RADMaterial; disabled; plug-in component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
wires_3 = BrepWireframe(Brep=glazingcreator_2.HBObjWGLZ, Density=-1)  # disabled
false_start_toggle_2 = FalseStartToggle(True)  # disabled

# ---- group: glass facade
glass = Brep(<brep referenced from the Rhino model>)  # disabled

# ----
msh2rad_2 = Honeybee_MSH2RAD(mesh=brep_6, RADMaterial=radopaquematerial_2.RADMaterial, writeRAD=false_start_toggle_2)  # -> materialFile, radianceFile; disabled; plug-in component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

# ---- group: ceiling
ceiling = Brep(<brep referenced from the Rhino model>)  # disabled

# ---- group: floor
floor = Brep(<brep referenced from the Rhino model>)  # disabled

# ----
walls = Brep([<brep referenced from the Rhino model> x3])  # disabled
genhbzonetestpts = Honeybee_GenerateZoneTestPoints(HBZone=glazingcreator.HBObjWGLZ, gridSize=panel_24, distBaseSrf=panel_23, moveTestMesh=True)  # -> readMe, simplify(testPoints), simplify(ptsVectors), simplify(facesArea), simplify(mesh); disabled; plug-in component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
panel_25 = Panel("3")  # disabled
panel_26 = Panel("21")  # disabled
panel_27 = Panel("9")  # disabled
false_start_toggle_3 = FalseStartToggle(False)  # disabled
msh2rad_3 = Honeybee_MSH2RAD(mesh=brep_7, RADMaterial=radopaquematerial_3.RADMaterial, writeRAD=false_start_toggle_3)  # -> materialFile, radianceFile; disabled; plug-in component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
panel_28 = Panel("0.762")  # disabled
panel_29 = Panel("0.5")  # disabled
genclimatebasedsky = Honeybee_GenerateClimateBasedSky(weatherFile=path, month=item, day=panel_22, hour=item_2)  # -> radiationValues, skyFilePath; disabled; plug-in component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
panel_30 = Panel("21")  # disabled
item_3 = ListItem(List=month_2, Index=number_slider_6, Wrap=True)  # disabled
item_4 = ListItem(List=hour_2, Index=number_slider_5, Wrap=True)  # disabled
path_2 = FilePath("C:\Users\Yunqian\Desktop\Course Fall2017\Building Performance Sim\Philadelphia_weather_files\USA_PA_Philadelphia.Intl.AP.724080_TMY3.epw")  # disabled
annualdaylightsimulation = Honeybee_AnnualDaylightSimulation(epwWeatherFile=path_2, testPoints=gentestpts.testPoints, ptsVectors=gentestpts.ptsVectors, testMesh=gentestpts.mesh)  # -> analysisRecipe; disabled; plug-in component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
path_3 = FilePath("\\Juno\Courses\ARCH\ARCH-753-001-Building Performance Sim (Sadeghipour)\Distribution\Philadelphia_weather_files\USA_PA_Philadelphia.Intl.AP.724080_TMY3.epw")  # disabled
number_slider_7 = Slider(45, range=0..100)  # disabled
genhbzonetestpts_2 = Honeybee_GenerateZoneTestPoints(HBZone=glazingcreator_2.HBObjWGLZ, gridSize=panel_29, distBaseSrf=panel_28, moveTestMesh=True)  # -> readMe, simplify(testPoints), simplify(ptsVectors), simplify(facesArea), simplify(mesh); disabled; plug-in component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
file_path = FilePath("C:\Users\Yunqian\Desktop\Course Fall2017\Building Performance Sim\Philadelphia_weather_files\USA_PA_Philadelphia.Intl.AP.724080_TMY3.epw")  # disabled

# ---- group: For better visualization - Doesn't effect the results of the analysis
importlocation = Ladybug_ImportLocation(epwFile=epw_stat.epwFile)  # -> location; disabled; plug-in component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
number_slider_8 = Slider(0.2, range=0..1)  # disabled
sunpath = Ladybug_SunPath(
    north=number_slider_7,
    location=importlocation,
    hour=panel_27,
    day=panel_26,
    month=panel_25,
    timeStep=1,
    sunPathScale=number_slider_8,
    dailyOrAnnualSunPath=True)  # -> readMe, sunVectors, sunAltitudes, sunAzimuths, port, sunSpheresMesh, sunPathCrvs, compassCrvs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; disabled; plug-in component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

# ----
panel_31 = Panel(".05")  # disabled
genclimatebasedsky_2 = Honeybee_GenerateClimateBasedSky(weatherFile=path_3, month=item_3, day=panel_30, hour=item_4)  # -> radiationValues, skyFilePath; disabled; plug-in component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
# Geometry Preparation
panel_32 = Panel("0")  # disabled
panel_33 = Panel("2")  # disabled
panel_34 = Panel("3")  # disabled
toggle_5 = BooleanToggle(True)  # disabled
merge_2 = Merge(Data1=msh2rad_2.materialFile, Data2=msh2rad_2.radianceFile)  # disabled
annualdaylightsimulation_2 = Honeybee_AnnualDaylightSimulation(epwWeatherFile=file_path, testPoints=genhbzonetestpts.testPoints, ptsVectors=genhbzonetestpts.ptsVectors)  # -> analysisRecipe; disabled; plug-in component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
merge_3 = Merge(Data1=msh2rad_3.materialFile, Data2=msh2rad_3.radianceFile)  # disabled
panel_35 = Panel(genclimatebasedsky.skyFilePath)  # disabled
createhbsrfs_3 = Honeybee_createHBSrfs(geometry=glass, RADMaterial=radglassmaterial_2.RADMaterial)  # -> readMe, simplify(HBSurface); disabled; plug-in component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
createhbsrfs_4 = Honeybee_createHBSrfs(geometry=floor, srfType=panel_33)  # -> readMe, simplify(HBSurface); disabled; plug-in component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
createhbsrfs_5 = Honeybee_createHBSrfs(geometry=ceiling, srfType=panel_34)  # -> readMe, simplify(HBSurface); disabled; plug-in component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
createhbsrfs_6 = Honeybee_createHBSrfs(geometry=walls, srfType=panel_32)  # -> readMe, simplify(HBSurface); disabled; plug-in component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
northarrow = Ladybug_North(north=number_slider_7, scale=panel_31)  # -> northSign; disabled; plug-in component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
genclimatebasedsky_3 = Honeybee_GenerateClimateBasedSky(north=number_slider_7, weatherFile=epw_stat.epwFile, month=panel_25, day=panel_26, hour=panel_27)  # -> radiationValues, skyFilePath; disabled; plug-in component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
genavgsky = Honeybee_GenerateAverageSky(north=number_slider_7, weatherFile=epw_stat.epwFile, month=panel_25, hour=panel_27)  # -> radiationValues, skyFilePath; disabled; plug-in component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
rundaylightanalysis = Honeybee_RunDaylightSimulation(
    HBObjects=flatten([createhbsrfs_2.HBSurface, createhbsrfs.HBSurface]),
    analysisRecipe=annualdaylightsimulation,
    writeRad=toggle_5,
    runRad=toggle_5,
    overwriteResults=True)  # -> readMe, analysisType, resultsUnit, results, testPts, annual_analysis_files, radGeoFile, studyFolder, done; disabled; plug-in component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
gridbasedsimulation = Honeybee_GridBasedSimulation(
    skyFile=genclimatebasedsky.skyFilePath,
    testPoints=genhbzonetestpts_2.testPoints,
    ptsVectors=genhbzonetestpts_2.ptsVectors,
    simulationType=0)  # -> analysisRecipe; disabled; plug-in component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
toggle_6 = BooleanToggle(True)  # disabled
panel_36 = Panel(genclimatebasedsky_2.skyFilePath)  # disabled
panel_37 = Panel(genclimatebasedsky_3.radiationValues)  # disabled
rundaylightanalysis_2 = Honeybee_RunDaylightSimulation(
    HBObjects=flatten(glazingcreator.HBObjWGLZ),
    analysisRecipe=annualdaylightsimulation_2,
    writeRad=toggle_6,
    runRad=toggle_6,
    additionalRadFiles=merge_3,
    overwriteResults=True)  # -> readMe, analysisType, resultsUnit, results, testPts, resultFiles, radGeoFile, studyFolder, done; disabled; plug-in component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
panel_38 = Panel("3")  # disabled
toggle_7 = BooleanToggle(True)  # disabled
toggle_8 = BooleanToggle(False)  # disabled
set_the_view_to_fisheye_for_glare_analys = Panel("1")  # "set the view to FishEye for Glare Analysis"; disabled
radparameters = Honeybee_RADParameters(quality=0, ab=panel_38)  # -> readMe, radParameters; disabled; plug-in component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
toggle_9 = BooleanToggle(True)  # disabled
panel_39 = Panel("0")  # disabled
panel_40 = Panel("2000")  # disabled
panel_41 = Panel(rundaylightanalysis.annual_analysis_files)  # disabled
rundaylightanalysis_3 = Honeybee_RunDaylightSimulation(
    HBObjects=flatten(glazingcreator_2.HBObjWGLZ),
    analysisRecipe=gridbasedsimulation,
    writeRad=toggle_7,
    runRad=toggle_7,
    additionalRadFiles=merge_2,
    overwriteResults=True)  # -> readMe, analysisType, resultsUnit, illuminance_values, testPts, illuminance_files, radGeoFile, studyFolder, done; disabled; plug-in component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
doy_hoy = Ladybug_DOY_HOY(days=panel_26, months=panel_25, hours=panel_27)  # -> HOY, DOY, date; disabled; plug-in component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
occupancygenerator = Honeybee_DaysimOccupancyGenerator(weekendDays=[1, 2], writeTheOcc=toggle_9)  # -> occupancyFile; disabled; plug-in component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
fly = Ladybug_fly(inputSliders=[number_slider_2, number_slider_4, number_slider_3], fly=toggle_8)  # -> Vviiiiiiiiiizzz; disabled; plug-in component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
legendpar = Ladybug_LegendParameters(lowBound=panel_39, highBound=panel_40)  # -> legendPar; disabled; plug-in component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
toggle_10 = BooleanToggle(True)  # disabled
doy_hoy_2 = Ladybug_DOY_HOY(days=panel_22, months=item, hours=item_2)  # -> HOY, DOY, date; disabled; plug-in component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
point = Point(Point(13.10910788, 4.996545786, 0))  # disabled
toggle_11 = BooleanToggle(True)  # disabled
# Analysis Recipe
imagebasedsimulation = Honeybee_ImageBasedSimulation(
    skyFile=genavgsky.skyFilePath,
    cameraType=set_the_view_to_fisheye_for_glare_analys,
    simulationType=2,
    radParameters=radparameters.radParameters,
    backupImages=0)  # -> analysisRecipe; disabled; plug-in component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

# ---- group: collect all honeybee surfaces
brep_8 = Brep(flatten([createhbsrfs_6.HBSurface, createhbsrfs_5.HBSurface, createhbsrfs_4.HBSurface, createhbsrfs_3.HBSurface]))  # disabled

# ----
panel_42 = Panel(doy_hoy_2.date)  # disabled
occupancygenerator_2 = Honeybee_DaysimOccupancyGenerator(weekendDays=[1, 2], writeTheOcc=toggle_10)  # -> occupancyFile; disabled; plug-in component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
readannualresultsi = Honeybee_ReadAnnualResultI(
    illFilesAddress=rundaylightanalysis.annual_analysis_files,
    testPoints=simplify(rundaylightanalysis.testPts),
    occupancyFiles=occupancygenerator,
    DLAIllumThresholds=300,
    runIt=toggle_11)  # -> DLA, UDLI_Less_100, UDLI_100_2000, UDLI_More_2000, CDA, sDA, annualProfiles, htmReport; disabled; plug-in component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
toggle_12 = BooleanToggle(True)  # disabled
panel_43 = Panel("WWR:")  # disabled
panel_44 = Panel("Illuminance study")  # disabled
panel_45 = Panel(" Date: ")  # disabled
panel_46 = Panel("")  # disabled
wires_4 = BrepWireframe(Brep=brep_8, Density=-1)  # disabled
panel_47 = Panel("0")  # disabled
panel_48 = Panel("2000")  # disabled
toggle_13 = BooleanToggle(True)  # disabled
panel_49 = Panel("4")  # disabled
concat = Concatenate(
    FragmentA=panel_44,
    FragmentC=panel_46,
    FragmentB=panel_43,
    FragmentD=number_slider_2,
    FragmentE=panel_45,
    FragmentF=panel_42)  # disabled
readannualresultsi_2 = Honeybee_ReadAnnualResultI(
    illFilesAddress=rundaylightanalysis_2.resultFiles,
    testPoints=simplify(rundaylightanalysis_2.testPts),
    occupancyFiles=occupancygenerator_2,
    DLAIllumThresholds=300,
    runIt=toggle_12)  # -> DLA, UDLI_Less_100, UDLI_100_2000, UDLI_More_2000, CDA, sDA, annualProfiles, htmReport; disabled; plug-in component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
panel_50 = Panel("lux")  # disabled
legendpar_2 = Ladybug_LegendParameters(lowBound=panel_47, highBound=panel_48)  # -> legendPar; disabled; plug-in component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
panel_51 = Panel("Daylight Atunomy")  # disabled
panel_52 = Panel("%")  # disabled
recolormesh = Ladybug_RecolorMesh(
    analysisResult=rundaylightanalysis_3.illuminance_values,
    inputMesh=genhbzonetestpts_2.mesh,
    legendPar=legendpar,
    analysisTitle=concat,
    legendTitle=panel_50)  # -> readMe, newMesh, newLegend, legendBasePt, meshColors, legendColors; disabled; plug-in component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
panel_53 = Panel(readannualresultsi.sDA)  # disabled
# Run the analysis
rundaylightanalysis_4 = Honeybee_RunDaylightSimulation(
    HBObjects=flatten(brep_8),
    analysisRecipe=imagebasedsimulation,
    writeRad=toggle_13,
    runRad=toggle_13,
    numOfCPUs=panel_49,
    radFileName=doy_hoy.date,
    additionalRadFiles=merge,
    overwriteResults=True)  # -> readMe, analysisType, resultsUnit, results, testPts, luminance_files, radGeoFile, studyFolder, done; disabled; plug-in component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
panel_54 = Panel(rundaylightanalysis_3.illuminance_values)  # disabled
panel_55 = Panel("""Radiance
Grasshopper
Honeybee
Glare
Daylight
Set View
HBExampleFiles""")  # disabled
panel_56 = Panel("""This file shows how to run a glare analysis using Honeybee. This example is using same geometry as the other daylighting examples [[1](http://hydrashare.github.io/hydra/viewer?owner=mostaphaRoudsari&fork=hydra_1&id=Surface_by_surface_geometry_preparation_for_daylight_simulation_II), [2](http://hydrashare.github.io/hydra/viewer?owner=mostaphaRoudsari&fork=hydra_1&id=Find_when_sun_is_visible_to_a_point)].
The example is uses Averaged Climate-based Sky for glare analysis which uses the average value for that hour during the whole month.""")  # disabled
panel_57 = Panel("C:\Users\Administrator\Documents\GitHub\hydra_1")  # disabled
recolormesh_2 = Ladybug_RecolorMesh(analysisResult=readannualresultsi.UDLI_100_2000, analysisTitle=panel_51, legendTitle=panel_52)  # -> readMe, newMesh, newLegend, legendBasePt, meshColors, legendColors; disabled; plug-in component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
md_slider = MDSlider(
    slider_value=Point(0.5215606689, 0.5079524343, 0.5),
    SliderMode=0,
    x_domain=Domain(-1, 1),
    y_domain=Domain(-1, 1),
    z_domain=Domain(0, 1))  # disabled
panel_58 = Panel("Glare Analysis")  # disabled
panel_59 = Panel("%")  # disabled
panel_60 = Panel("100")  # disabled
panel_61 = Panel("2000")  # disabled
panel_62 = Panel("lux")  # disabled
panel_63 = Panel("C:\Users\Administrator\Dropbox\ladybug\helpDesk\PennDesign2015\Daylight_Glare_Analysis.png")  # disabled
toggle_14 = BooleanToggle(False)  # disabled
toggle_15 = BooleanToggle(True)  # disabled
panel_64 = Panel(readannualresultsi_2.sDA)  # disabled
smaller = SmallerThan(FirstNumber=panel_54, SecondNumber=panel_60)  # -> SmallerThan, OrEqualTo; disabled
mesh = Mesh(recolormesh.newMesh)  # disabled
larger = LargerThan(FirstNumber=rundaylightanalysis_3.illuminance_values, SecondNumber=panel_61)  # -> LargerThan, OrEqualTo; disabled
toggle_16 = BooleanToggle(True)  # disabled
toggle_17 = BooleanToggle(True)  # disabled
recolormesh_3 = Ladybug_RecolorMesh(
    analysisResult=readannualresultsi_2.UDLI_100_2000,
    inputMesh=genhbzonetestpts.mesh,
    legendPar=legendpar_2,
    analysisTitle=panel_62,
    legendTitle=panel_59)  # -> readMe, newMesh, newLegend, legendBasePt, meshColors, legendColors; disabled; plug-in component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
or = GateOr(A=smaller.SmallerThan, B=larger.LargerThan)  # disabled
exporthydra = Hydra_ExportFile(
    fileName=panel_58,
    fileDescription=panel_56,
    fileTags=panel_55,
    targetFolder=panel_57,
    includeRhino=toggle_15,
    additionalImgs=panel_63,
    export=toggle_14)  # -> readMe; inputs fileDescription: list, changeLog: list, fileTags: list, includeRhino: Boolean, GHForThumb: Boolean, additionalImgs: list, export: Boolean; disabled; plug-in component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
glareanalysis = Honeybee_GlareAnalysis(HDRImagePath=rundaylightanalysis_4.luminance_files, runIt=toggle_17)  # -> readMe, glareCheckImage, DGP, DGI, glareComfortRange, imageWithTaskArea; disabled; plug-in component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
cullf = CullFaces(Mesh=mesh, Pattern=or)  # disabled
falsecolor = Honeybee_FalseColor(
    HDRFilePath=rundaylightanalysis_4.luminance_files,
    contourBands=False,
    maskThreshold=0.1,
    useAlterColors=False,
    render=toggle_16)  # -> outputFilePath; disabled; plug-in component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
area = Area(Geometry=cullf)  # -> Area, Centroid; disabled
area_2 = Area(Geometry=mesh)  # -> Area, Centroid; disabled
panel_65 = Panel("100")  # disabled
division = Division(A=area.Area, B=area_2.Area)  # disabled
panel_66 = Panel("_hoy_")  # disabled
panel_67 = Panel("ill_wwr_")  # disabled
multiplication = Multiplication(A=division, B=panel_65)  # disabled
panel_68 = Panel("c:\ladybug\illuminance_study")  # disabled
# DGP: Daylight glare probability:
# Imperceptible Glare [0.35 > DGP]
# Perceptible Glare [0.4 > DGP >= 0.35]
# Disturbing Glare [0.45 > DGP >= 0.4]
# Intolerable Glare [DGP >= 0.45]
panel_69 = Panel(glareanalysis.DGP)  # disabled
toggle_18 = BooleanToggle(True)  # disabled
concat_2 = Concatenate(FragmentA=panel_67, FragmentB=number_slider_2, FragmentC=panel_66, FragmentD=doy_hoy_2.HOY)  # disabled
panel_70 = Panel("% met the criteria")  # disabled
round = Round(Number=multiplication)  # -> Nearest, Floor, Ceiling; disabled
number_slider_9 = Slider(0.8, range=0..1)  # disabled
captureview = Ladybug_CaptureView(fileName=concat_2, folder=panel_68, capture=rundaylightanalysis_3.done)  # -> imagePath; disabled; plug-in component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
hdr_gif = Honeybee_ConvertHDRToGIF(HDRFilePath=glareanalysis.glareCheckImage, adjustExposure=toggle_18)  # -> GIFFilePath; disabled; plug-in component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
hdr_gif_2 = Honeybee_ConvertHDRToGIF(HDRFilePath=falsecolor, adjustExposure=False)  # -> GIFFilePath; disabled; plug-in component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
panel_71 = Panel(concat_2)  # disabled
number_slider_10 = Slider(0.8, range=0..1)  # disabled
pt = Point(Point(0, -6, 0))  # disabled
concat_3 = Concatenate(FragmentA=round.Nearest, FragmentB=panel_70)  # disabled
tag = TextTag3D(Location=pt, Text=concat_3, Size=number_slider_9, Justification=7)  # disabled
viewer = Ladybug_ImageViewer(ImagePath=hdr_gif, ViewportScale=number_slider_10, DisableClickable=False, SaveImgWithCoords=False, scale=0.8)  # -> ImagePath, ColorValues, AnimatedGIFImage; disabled
number_slider_11 = Slider(0.5, range=0.2..0.9)  # disabled
panel_72 = Panel("12")  # disabled
panel_73 = Panel("30")  # disabled
panel_74 = Panel("20")  # disabled
viewer_2 = Ladybug_ImageViewer(ViewportScale=hdr_gif_2, DisableClickable=False, SaveImgWithCoords=False, scale=0.8)  # -> ImagePath, ColorValues, AnimatedGIFImage; disabled
box_3 = DomainBox(Base=PlaneXY(0, 0, 0), X=panel_73, Y=panel_74, Z=panel_72)  # disabled
toggle_19 = BooleanToggle(True)  # disabled
glzparamlist_3 = Honeybee_GlazingParametersList(northGlzParam=0, westGlzParam=0, southGlzParam=number_slider_11, eastGlzParam=0)  # -> glzParamList; disabled; plug-in component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
panel_75 = Panel(glzparamlist_3)  # disabled
mass2zone_3 = Honeybee_Masses2Zones(zoneMasses=flatten(box_3), isConditioned=True, maxRoofAngle=30, createHBZones=toggle_19)  # -> readMe, HBZones; disabled; plug-in component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
toggle_20 = BooleanToggle(True)  # disabled
panel_76 = Panel("wood")  # disabled
panel_77 = Panel("0.5")  # disabled
brep_9 = Brep([<brep referenced from the Rhino model> x6])  # disabled
glazingcreator_3 = Honeybee_GlazingBasedOnRatio(HBObjects=mass2zone_3.HBZones, glzRatio=glzparamlist_3, runIt=toggle_20)  # -> readMe, HBObjWGLZ; disabled; plug-in component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
radopaquematerial_4 = Honeybee_RadianceOpaqueMaterial(
    materialName=panel_76,
    RReflectance=panel_77,
    GReflectance=panel_77,
    BReflectance=panel_77,
    roughness=0.05,
    specularity=0)  # -> avrgRef, RADMaterial; disabled; plug-in component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
wires_5 = BrepWireframe(Brep=glazingcreator_3.HBObjWGLZ, Density=-1)  # disabled
panel_78 = Panel("0.762")  # disabled
panel_79 = Panel("0.5")  # disabled
genhbzonetestpts_3 = Honeybee_GenerateZoneTestPoints(HBZone=glazingcreator_3.HBObjWGLZ, gridSize=panel_79, distBaseSrf=panel_78, moveTestMesh=True)  # -> readMe, simplify(testPoints), simplify(ptsVectors), simplify(facesArea), simplify(mesh); disabled; plug-in component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
false_start_toggle_4 = FalseStartToggle(False)  # disabled
msh2rad_4 = Honeybee_MSH2RAD(mesh=brep_9, RADMaterial=radopaquematerial_4.RADMaterial, writeRAD=false_start_toggle_4)  # -> materialFile, radianceFile; disabled; plug-in component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
annualdaylightsimulation_3 = Honeybee_AnnualDaylightSimulation(testPoints=genhbzonetestpts_3.testPoints, ptsVectors=genhbzonetestpts_3.ptsVectors)  # -> analysisRecipe; plug-in component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
merge_4 = Merge(Data1=msh2rad_4.materialFile, Data2=msh2rad_4.radianceFile)  # disabled
toggle_21 = BooleanToggle(False)  # disabled
rundaylightanalysis_5 = Honeybee_RunDaylightSimulation(
    HBObjects=flatten(glazingcreator_3.HBObjWGLZ),
    analysisRecipe=annualdaylightsimulation_3,
    writeRad=toggle_21,
    runRad=toggle_21,
    additionalRadFiles=merge_4,
    overwriteResults=True)  # -> readMe, analysisType, resultsUnit, results, testPts, annual_analysis_files, radGeoFile, studyFolder, done; disabled; plug-in component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
toggle_22 = BooleanToggle(True)  # disabled
occupancygenerator_3 = Honeybee_DaysimOccupancyGenerator(weekendDays=[1, 2], writeTheOcc=toggle_22)  # -> occupancyFile; disabled; plug-in component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
panel_80 = Panel(rundaylightanalysis_5.annual_analysis_files)  # disabled
panel_81 = Panel("0")  # disabled
panel_82 = Panel("2000")  # disabled
toggle_23 = BooleanToggle(True)  # disabled
readannualresultsi_3 = Honeybee_ReadAnnualResultI(
    illFilesAddress=rundaylightanalysis_5.annual_analysis_files,
    testPoints=simplify(rundaylightanalysis_5.testPts),
    occupancyFiles=occupancygenerator_3,
    DLAIllumThresholds=300,
    runIt=toggle_23)  # -> DLA, UDLI_Less_100, UDLI_100_2000, UDLI_More_2000, CDA, sDA, annualProfiles, htmReport; disabled; plug-in component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
legendpar_3 = Ladybug_LegendParameters(lowBound=panel_81, highBound=panel_82)  # -> legendPar; disabled; plug-in component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
panel_83 = Panel("%")  # disabled
panel_84 = Panel("lux")  # disabled
panel_85 = Panel(readannualresultsi_3.sDA)  # disabled
recolormesh_4 = Ladybug_RecolorMesh(
    analysisResult=readannualresultsi_3.UDLI_100_2000,
    inputMesh=genhbzonetestpts_3.mesh,
    legendPar=legendpar_3,
    analysisTitle=panel_84,
    legendTitle=panel_83)  # -> readMe, newMesh, newLegend, legendBasePt, meshColors, legendColors; disabled; plug-in component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

panel_86 = Panel("175")  # disabled
# set the view
comfortmannequin = Ladybug_ComfortMannequin(rotationAngle=panel_86, bodyLocation=point)  # -> mannequinMesh, legend, legendBasePt; disabled; plug-in component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
swatch = ColourSwatch(SwatchColor=RGB(255, 0, 0))  # disabled

# ---- group: Person's face!
item_5 = ListItem(List=comfortmannequin.mannequinMesh, Index=121, Wrap=True)  # disabled

# ----
preview = CustomPreview(Geometry=item_5, Shader=swatch)  # disabled

facen = FaceNormals(Mesh=item_5)  # -> Centers, Normals; disabled
settheview = Ladybug_SetTheView(cameraLocation=facen.Centers, cameraDirection=facen.Normals, uvLookAround=md_slider)  # disabled; plug-in component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
