# Grasshopper definition ma_xiaoyu_shade.gh (Grasshopper 0.9.76)
# plug-ins: Python Interpreter

# ---- group: SHADE
brep = Brep(<brep referenced from the Rhino model>)
number_slider = Slider(0.1, range=0.1..2)
edges = BrepEdges(Brep=brep)  # -> Naked, Interior, NonManifold
item = ListItem(List=edges.Naked, Index=0, Wrap=True)
Y = UnitY(Factor=number_slider)
extr = Extrude(Base=item, Direction=Y)

# ----
fly = Ladybug_fly(inputSliders=number_slider, fly=Toggle(False))  # -> Vviiiiiiiiiizzz; plug-in component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
radglassmaterial = Honeybee_RadianceGlassMaterial(materialName="GLASS_60", RTransmittance="0.6", GTransmittance="0.6", BTransmittance="0.6", refractiveIndex=1.52)  # -> avrgTrans, RADMaterial; plug-in component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

# ---- group: CEILING
brep_2 = Brep(<brep referenced from the Rhino model>)

# ---- group: WALL
brep_3 = Brep([<brep referenced from the Rhino model> x4])

# ---- group: FLOOR
brep_4 = Brep(<brep referenced from the Rhino model>)

# ----
honeybee = Honeybee_Honeybee()  # -> Vviiiiiiiiiizzz; plug-in component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
ladybug = Ladybug_Ladybug()  # -> Vviiiiiiiiiizzz; plug-in component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

# ---- group: WINDOW
brep_5 = Brep(<brep referenced from the Rhino model>)

# ----
createhbsrfs = Honeybee_createHBSrfs(geometry=brep_5, RADMaterial=radglassmaterial.RADMaterial)  # -> readMe, simplify(HBSurface); plug-in component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
createhbsrfs_2 = Honeybee_createHBSrfs(geometry=[brep_2, brep_3, brep_4])  # -> readMe, simplify(HBSurface); plug-in component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
createhbsrfs_3 = Honeybee_createHBSrfs(geometry=extr, srfType="6")  # -> readMe, simplify(HBSurface); plug-in component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
panel = Panel("https://www.energyplus.net/weather-download/north_and_central_america_wmo_region_4/USA/PA/USA_PA_Philadelphia.Intl.AP.724080_TMY3/all")
wires = BrepWireframe(Brep=[brep_2, brep_5, brep_3, brep_4, extr], Density=-1)
gentestpts = Honeybee_GenerateTestPoints(testGeometry=brep_4, gridSize="0.5", distBaseSrf="0.762", moveTestMesh=True)  # -> readMe, simplify(testPoints), simplify(ptsVectors), simplify(facesArea), simplify(mesh); plug-in component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
radparameters = Honeybee_RADParameters(quality=0)  # -> readMe, radParameters; plug-in component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
epw_stat = Ladybug_OpenEPWAndSTATWeatherFiles(weatherFileURL=panel)  # -> epwFile, statFile; plug-in component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
setradmaterials = Honeybee_SetRadianceMaterials(HBObject=[createhbsrfs_3.HBSurface, createhbsrfs_2.HBSurface, createhbsrfs.HBSurface])  # -> simplify(modifiedHBObject); plug-in component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
annualdaylightsimulation = Honeybee_AnnualDaylightSimulation(
    epwWeatherFile=epw_stat.epwFile,
    testPoints=gentestpts.testPoints,
    ptsVectors=gentestpts.ptsVectors,
    radParameters=radparameters.radParameters)  # -> analysisRecipe; plug-in component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
toggle = BooleanToggle(False)
rundaylightanalysis = Honeybee_RunDaylightSimulation(
    HBObjects=flatten(setradmaterials),
    analysisRecipe=annualdaylightsimulation,
    writeRad=toggle,
    runRad=toggle,
    overwriteResults=True)  # -> readMe, analysisType, resultsUnit, results, testPts, resultFiles, radGeoFile, studyFolder, done; plug-in component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
occupancygenerator = Honeybee_DaysimOccupancyGenerator(weekendDays=[1, 2], writeTheOcc=Toggle(False))  # -> occupancyFile; plug-in component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
readannualresultsi = Honeybee_ReadAnnualResultI(
    illFilesAddress=rundaylightanalysis.resultFiles,
    testPoints=simplify(rundaylightanalysis.testPts),
    occupancyFiles=occupancygenerator,
    DLAIllumThresholds=300,
    runIt=Toggle(False))  # -> DLA, UDLI_Less_100, UDLI_100_2000, UDLI_More_2000, CDA, sDA, annualProfiles, htmReport; plug-in component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
legendpar = Ladybug_LegendParameters(lowBound="60", highBound="100", numSegments="11")  # -> legendPar; plug-in component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
item_2 = ListItem(List=number_slider, Index=0, Wrap=True)
concat = Concatenate(FragmentA="Useful Daylight Illuminance", FragmentD="Width of Shade: ", FragmentB=item_2, FragmentE="m")
concat_2 = Concatenate(FragmentA="Width of Shade: ", FragmentB=number_slider)
recolormesh = Ladybug_RecolorMesh(
    analysisResult=readannualresultsi.UDLI_100_2000,
    inputMesh=gentestpts.mesh,
    legendPar=legendpar,
    analysisTitle=concat,
    legendTitle="%")  # -> readMe, newMesh, newLegend, legendBasePt, meshColors, legendColors; plug-in component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
captureview = Ladybug_CaptureView(fileName=concat_2, folder="D:\XMA\img", viewNames="top", capture=Toggle(True))  # -> imagePath; plug-in component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
panel_2 = Panel(concat_2)
panel_3 = Panel(captureview)
