# Grasshopper definition nelson_graham.gh (Grasshopper 0.9.76)
# plug-ins: Python Interpreter

number_slider = Slider(1, range=1..10)
honeybee = Honeybee_Honeybee(defaultFolder="C:\ladybug")  # -> Vviiiiiiiiiizzz; plug-in component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
ladybug = Ladybug_Ladybug()  # -> Vviiiiiiiiiizzz; plug-in component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
box = DomainBox(Base=PlaneXY(0, 0, 0), X="6", Y="12", Z="3.2")
mass2zone = Honeybee_Masses2Zones(zoneMasses=flatten(box), maxRoofAngle=30, createHBZones=Toggle(True))  # -> readMe, HBZones; plug-in component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
panel = Panel(honeybee)
number_slider_2 = Slider(0.2, range=0.2..0.9)
number_slider_3 = Slider(0.4, range=0.1..0.9)
panel_2 = Panel(ladybug)
panel_3 = Panel("0.4")
number_slider_4 = Slider(0.6, range=0.2..0.9)
glzparamlist = Honeybee_GlazingParametersList(northGlzParam=0, westGlzParam=0, southGlzParam=number_slider_2, eastGlzParam=0)  # -> glzParamList; plug-in component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
fly = Ladybug_fly(inputSliders=number_slider_2, fly=Toggle(False))  # -> Vviiiiiiiiiizzz; plug-in component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
glazingcreator = Honeybee_GlazingBasedOnRatio(HBObjects=mass2zone.HBZones, glzRatio=glzparamlist, runIt=Toggle(True))  # -> readMe, HBObjWGLZ; plug-in component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
wires = BrepWireframe(Brep=glazingcreator.HBObjWGLZ, Density=-1)
genhbzonetestpts = Honeybee_GenerateZoneTestPoints(HBZone=glazingcreator.HBObjWGLZ, gridSize="0.2", distBaseSrf="0.762", moveTestMesh=True)  # -> readMe, simplify(testPoints), simplify(ptsVectors), simplify(facesArea), simplify(mesh); plug-in component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
daylighfactorsimulation = Honeybee_DaylightFactorSimulation(testPoints=genhbzonetestpts.testPoints, ptsVectors=genhbzonetestpts.ptsVectors, uniformSky=False)  # -> analysisRecipe; plug-in component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
toggle = BooleanToggle(True)
path = FilePath("C:\Users\Graham P Nelson\Documents\MEBD\Mostapha Class\USA_PA_Philadelphia.Intl.AP.724080_TMY3\USA_PA_Philadelphia.Intl.AP.724080_TMY3.epw")
genclimatebasedsky = Honeybee_GenerateClimateBasedSky(weatherFile=path, month="12", day="21", hour="5")  # -> radiationValues, skyFilePath; plug-in component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
rundaylightanalysis = Honeybee_RunDaylightSimulation(
    HBObjects=flatten(glazingcreator.HBObjWGLZ),
    analysisRecipe=daylighfactorsimulation,
    writeRad=toggle,
    runRad=toggle,
    overwriteResults=True)  # -> readMe, analysisType, resultsUnit, DF_values, testPts, DF_files, radGeoFile, studyFolder, done; plug-in component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
brep = Brep(<brep referenced from the Rhino model>)
legendpar = Ladybug_LegendParameters(lowBound="0", highBound="5")  # -> legendPar; plug-in component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
wires_2 = BrepWireframe(Brep=brep, Density=-1)
imagebasedsimulation = Honeybee_ImageBasedSimulation(skyFile=genclimatebasedsky.skyFilePath, simulationType=2, backupImages=0)  # -> analysisRecipe; plug-in component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
createhbsrfs = Honeybee_createHBSrfs(geometry=brep)  # -> readMe, simplify(HBSurface); plug-in component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
toggle_2 = BooleanToggle(False)
concat = Concatenate(FragmentA="Daylight Factor", FragmentB="WWR", FragmentD=number_slider_2)
recolormesh = Ladybug_RecolorMesh(
    analysisResult=rundaylightanalysis.DF_values,
    inputMesh=genhbzonetestpts.mesh,
    legendPar=legendpar,
    analysisTitle=concat,
    legendTitle="%")  # -> readMe, newMesh, newLegend, legendBasePt, meshColors, legendColors; plug-in component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
rundaylightanalysis_2 = Honeybee_RunDaylightSimulation(
    HBObjects=flatten(createhbsrfs.HBSurface),
    analysisRecipe=imagebasedsimulation,
    writeRad=toggle_2,
    runRad=toggle_2,
    overwriteResults=True)  # -> readMe, analysisType, resultsUnit, results, testPts, resultFiles, radGeoFile, studyFolder, done; plug-in component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
larger = LargerThan(FirstNumber=rundaylightanalysis.DF_values, SecondNumber="5")  # -> LargerThan, OrEqualTo
mesh = Mesh(recolormesh.newMesh)
cullf = CullFaces(Mesh=mesh, Pattern=larger.OrEqualTo)
hdr_gif = Honeybee_ConvertHDRToGIF(HDRFilePath=rundaylightanalysis_2.resultFiles, adjustExposure=Toggle(False))  # -> GIFFilePath; plug-in component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
glareanalysis = Honeybee_GlareAnalysis()  # -> readMe, glareCheckImage, DGP, DGI, glareComfortRange, imageWithTaskArea; plug-in component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
area = Area(Geometry=mesh)  # -> Area, Centroid
area_2 = Area(Geometry=cullf)  # -> Area, Centroid
division = Division(A=area_2.Area, B=area.Area)
multiplication = Multiplication(A=division, B="100")
round = Round(Number=multiplication)  # -> Nearest, Floor, Ceiling
concat_2 = Concatenate(FragmentA="\"% AREA OF THE ROOM", FragmentB=round.Nearest)
pt = Point(<point referenced from the Rhino model>)
panel_4 = Panel("C:\Users\Graham P Nelson\Documents\MEBD\Mostapha Class\102317")
concat_3 = Concatenate(FragmentA="DF_WWR", FragmentB=number_slider_2)
tag = TextTag3D(Location=pt, Text=concat_2, Size=Slider(0.8, range=0..1), Justification=7)
captureview = Ladybug_CaptureView(fileName=concat_3, folder=panel_4, capture=Toggle(True))  # -> imagePath; plug-in component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
