# Grasshopper definition peng_yunzhongda_1028.gh (Grasshopper 0.9.76)
# plug-ins: Python Interpreter

number_slider = Slider(0.02, range=0..1)
radtransmaterial = Honeybee_RadianceTransMaterial(
    materialName="glass",
    RDiffReflectance=number_slider,
    GDiffReflectance=number_slider,
    BDiffReflectance=number_slider,
    specularReflection=Slider(0.06, range=0..0.1),
    diffuseTransmission=Slider(0.8, range=0..1),
    specularTransmission=Slider(0.1, range=0..0.1),
    roughness=Slider(0.02, range=0..0.1))  # -> transMaterial; plug-in component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

number_slider_2 = Slider(0.22, range=0..1)
panel = Panel("This file shows the minimum steps to set up a daylight model for a room in Honeybee. This example uses mass2zones component to prepare the geometries however you can create the geometries surface by surface using createHBSurface.")
panel_2 = Panel("""Grasshopper
Daylighting
Annual
Radiance
Daysim
Honeybee
HBExampleFiles""")
# Convert the box to Honeybee zone
# All the material will be set to default
# In case you want to change them search
# for Honeybee_Set Radiance Materials
# component.
honeybee = Honeybee_Honeybee()  # -> Vviiiiiiiiiizzz; plug-in component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
ladybug = Ladybug_Ladybug()  # -> Vviiiiiiiiiizzz; plug-in component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
brep = Brep(<brep referenced from the Rhino model>)
mass2zone = Honeybee_Masses2Zones(zoneMasses=flatten(brep), isConditioned=True, maxRoofAngle=30, createHBZones=Toggle(True))  # -> readMe, HBZones; plug-in component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
glzparamlist = Honeybee_GlazingParametersList(northGlzParam=0, westGlzParam=0, southGlzParam=number_slider_2, eastGlzParam=0)  # -> glzParamList; plug-in component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
number_slider_3 = Slider(4.2, range=0..10)
number_slider_4 = Slider(7, range=0..10)
exporthydra = Hydra_ExportFile(
    fileName="Honeybee Annual Daylight Simulation Example",
    fileDescription=panel,
    fileTags=panel_2,
    targetFolder="C:\Users\Administrator\Documents\GitHub\hydra_1",
    export=Toggle(False))  # -> readMe; inputs fileDescription: list, changeLog: list, fileTags: list, includeRhino: Boolean, GHForThumb: Boolean, additionalImgs: list, export: Boolean; plug-in component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
box = DomainBox(Base=PlaneXY(0, 0, 0), X=number_slider_3, Y=number_slider_4, Z=Slider(3.2, range=0..10))
# Add glazing based on percentage
# In case you want to add custom windows
# use Honeybee_addHBGlz component.
glazingcreator = Honeybee_GlazingBasedOnRatio(HBObjects=mass2zone.HBZones, glzRatio=glzparamlist, RADMaterials=radtransmaterial, runIt=Toggle(True))  # -> readMe, HBObjWGLZ; plug-in component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
panel_3 = Panel("https://www.energyplus.net/weather-download/north_and_central_america_wmo_region_4/USA/PA/USA_PA_Philadelphia.Intl.AP.724080_TMY3/all")
epw_stat = Ladybug_OpenEPWAndSTATWeatherFiles(weatherFileURL=panel_3)  # -> epwFile, statFile; plug-in component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

# ---- group: HB Zone With Glazing
brep_2 = Brep(glazingcreator.HBObjWGLZ)

# ----
genhbzonetestpts = Honeybee_GenerateZoneTestPoints(HBZone=brep_2, gridSize=Slider(0.5, range=0..1), distBaseSrf=Slider(0.762, range=0..1), moveTestMesh=Toggle(True))  # -> readMe, simplify(testPoints), simplify(ptsVectors), simplify(facesArea), simplify(mesh); plug-in component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
pt = ConstructPoint(XCoordinate=number_slider_3, YCoordinate=expr("-x", number_slider_4), ZCoordinate=0)
pt_2 = ConstructPoint(XCoordinate=0, YCoordinate=0, ZCoordinate=0)
# Put the recipie together!
annualdaylightsimulation = Honeybee_AnnualDaylightSimulation(
    epwWeatherFile=epw_stat.epwFile,
    testPoints=genhbzonetestpts.testPoints,
    ptsVectors=genhbzonetestpts.ptsVectors,
    testMesh=genhbzonetestpts.mesh)  # -> analysisRecipe; plug-in component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
# Create ground in front of the room
# for more accurate analysis
rec_2pt = Rectangle2Pt(Plane=PlaneXY(0, 0, 0), PointA=pt_2, PointB=pt, Radius=0)  # -> Rectangle, Length
wires = BrepWireframe(Brep=brep_2, Density=-1)
toggle = BooleanToggle(True)
boundary = BoundarySurfaces(Edges=rec_2pt.Rectangle)
srf = Surface(<surface referenced from the Rhino model>)
createhbsrfs = Honeybee_createHBSrfs(geometry=srf)  # -> readMe, simplify(HBSurface); plug-in component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
# Run the analysis
rundaylightanalysis = Honeybee_RunDaylightSimulation(
    HBObjects=flatten([brep_2, createhbsrfs.HBSurface]),
    analysisRecipe=annualdaylightsimulation,
    writeRad=toggle,
    runRad=toggle,
    numOfCPUs=Slider(4, range=0..10),
    overwriteResults=True)  # -> readMe, analysisType, resultsUnit, results, testPts, annual_analysis_files, radGeoFile, studyFolder, done; plug-in component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
occupancygenerator = Honeybee_DaysimOccupancyGenerator(weekendDays=[1, 2], writeTheOcc=Toggle(True))  # -> occupancyFile; plug-in component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
# Generate annual results
readannualresultsi = Honeybee_ReadAnnualResultI(
    illFilesAddress=rundaylightanalysis.annual_analysis_files,
    testPoints=simplify(rundaylightanalysis.testPts),
    occupancyFiles=occupancygenerator,
    DLAIllumThresholds=300,
    runIt=Toggle(True))  # -> DLA, UDLI_Less_100, UDLI_100_2000, UDLI_More_2000, CDA, sDA, annualProfiles, htmReport; plug-in component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
gradientlibrary = Ladybug_GradientLibrary(gradIndex=Slider(1, range=0..10))  # -> customColors; plug-in component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
avr = Average(Input=readannualresultsi.UDLI_100_2000)
galapagos = Galapagos(fitness=avr, gene=number_slider_2)
legendpar = Ladybug_LegendParameters(
    lowBound=Slider(0, range=0..100),
    highBound=Slider(100, range=0..100),
    numSegments=Slider(6, range=0..10),
    customColors=flatten(gradientlibrary))  # -> legendPar; plug-in component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
number_slider_5 = Slider(1, range=0..1)
concat = Concatenate(FragmentA=avr, FragmentB="%")
concat_2 = Concatenate(FragmentA="annual_UDI mat @RGB", FragmentB=number_slider)
captureview = Ladybug_CaptureView(fileName=concat_2, folder="c:\ladybug\illuminance_study", capture=rundaylightanalysis.done)  # -> imagePath; plug-in component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
# Visualize the results
recolormesh = Ladybug_RecolorMesh(
    analysisResult=readannualresultsi.UDLI_100_2000,
    inputMesh=genhbzonetestpts.mesh,
    legendPar=legendpar,
    analysisTitle=rundaylightanalysis.analysisType,
    legendTitle=concat)  # -> readMe, newMesh, newLegend, legendBasePt, meshColors, legendColors; plug-in component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
