# Grasshopper definition peng_yunzhongda_1028_pro.gh (Grasshopper 0.9.76)
# plug-ins: Python Interpreter

brep = Brep(<brep referenced from the Rhino model>)
number_slider = Slider(0.22, range=0..1)
panel = Panel("This file shows the minimum steps to set up a daylight model for a room in Honeybee. This example uses mass2zones component to prepare the geometries however you can create the geometries surface by surface using createHBSurface.")
panel_2 = Panel("""Grasshopper
Daylighting
Annual
Radiance
Daysim
Honeybee
HBExampleFiles""")
# Convert the box to Honeybee zone
# All the material will be set to default
# In case you want to change them search
# for Honeybee_Set Radiance Materials
# component.
honeybee = Honeybee_Honeybee()  # -> Vviiiiiiiiiizzz; plug-in component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
ladybug = Ladybug_Ladybug()  # -> Vviiiiiiiiiizzz; plug-in component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
brep_2 = Brep(<brep referenced from the Rhino model>)
mass2zone = Honeybee_Masses2Zones(zoneMasses=flatten(brep), isConditioned=True, maxRoofAngle=30, createHBZones=Toggle(True))  # -> readMe, HBZones; plug-in component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
# Add glazing based on percentage
# In case you want to add custom windows
# use Honeybee_addHBGlz component.
glzparamlist = Honeybee_GlazingParametersList(northGlzParam=0, westGlzParam=0, southGlzParam=number_slider, eastGlzParam=0)  # -> glzParamList; plug-in component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
exporthydra = Hydra_ExportFile(
    fileName="Honeybee Annual Daylight Simulation Example",
    fileDescription=panel,
    fileTags=panel_2,
    targetFolder="C:\Users\Administrator\Documents\GitHub\hydra_1",
    export=Toggle(False))  # -> readMe; inputs fileDescription: list, changeLog: list, fileTags: list, includeRhino: Boolean, GHForThumb: Boolean, additionalImgs: list, export: Boolean; plug-in component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
toggle = BooleanToggle(True)
toggle_2 = BooleanToggle(False)
panel_3 = Panel("https://www.energyplus.net/weather-download/north_and_central_america_wmo_region_4/USA/PA/USA_PA_Philadelphia.Intl.AP.724080_TMY3/all")
epw_stat = Ladybug_OpenEPWAndSTATWeatherFiles(weatherFileURL=panel_3)  # -> epwFile, statFile; plug-in component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
genhbzonetestpts = Honeybee_GenerateZoneTestPoints(
    HBZone=mass2zone.HBZones,
    gridSize=Slider(0.5, range=0..1),
    distBaseSrf=Slider(0.762, range=0..1),
    moveTestMesh=Toggle(True))  # -> readMe, simplify(testPoints), simplify(ptsVectors), simplify(facesArea), simplify(mesh); plug-in component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
number_slider_2 = Slider(0, range=0..10)
srf = Surface(<surface referenced from the Rhino model>)
wires = BrepWireframe(Brep=brep, Density=-1)
radparameters = Honeybee_RADParameters(quality=number_slider_2)  # -> readMe, radParameters; plug-in component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
# Put the recipie together!
annualdaylightsimulation = Honeybee_AnnualDaylightSimulation(
    epwWeatherFile=epw_stat.epwFile,
    testPoints=genhbzonetestpts.testPoints,
    ptsVectors=genhbzonetestpts.ptsVectors,
    testMesh=genhbzonetestpts.mesh,
    radParameters=radparameters.radParameters)  # -> analysisRecipe; plug-in component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
createhbsrfs = Honeybee_createHBSrfs(geometry=srf, srfType=Slider(5, range=0..10))  # -> readMe, simplify(HBSurface); plug-in component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
toggle_3 = BooleanToggle(True)
srf_2 = Surface([<surface referenced from the Rhino model> x3])
createhbsrfs_2 = Honeybee_createHBSrfs(geometry=srf_2, srfType=Slider(6, range=0..10))  # -> readMe, simplify(HBSurface); plug-in component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
# Run the analysis
rundaylightanalysis = Honeybee_RunDaylightSimulation(
    HBObjects=flatten([mass2zone.HBZones, createhbsrfs.HBSurface]),
    analysisRecipe=annualdaylightsimulation,
    writeRad=toggle_3,
    runRad=toggle_3,
    numOfCPUs=Slider(4, range=0..10),
    overwriteResults=True)  # -> readMe, analysisType, resultsUnit, results, testPts, annual_analysis_files, radGeoFile, studyFolder, done; plug-in component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
occupancygenerator = Honeybee_DaysimOccupancyGenerator(weekendDays=[1, 2], writeTheOcc=Toggle(True))  # -> occupancyFile; plug-in component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
# Generate annual results
readannualresultsi = Honeybee_ReadAnnualResultI(
    illFilesAddress=rundaylightanalysis.annual_analysis_files,
    testPoints=simplify(rundaylightanalysis.testPts),
    occupancyFiles=occupancygenerator,
    DLAIllumThresholds=300,
    runIt=Toggle(True))  # -> DLA, UDLI_Less_100, UDLI_100_2000, UDLI_More_2000, CDA, sDA, annualProfiles, htmReport; plug-in component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
gradientlibrary = Ladybug_GradientLibrary(gradIndex=Slider(1, range=0..10))  # -> customColors; plug-in component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
avr = Average(Input=readannualresultsi.UDLI_100_2000)
galapagos = Galapagos(fitness=avr, gene=number_slider)
legendpar = Ladybug_LegendParameters(
    lowBound=Slider(0, range=0..100),
    highBound=Slider(100, range=0..100),
    numSegments=Slider(6, range=0..10),
    customColors=flatten(gradientlibrary))  # -> legendPar; plug-in component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
number_slider_3 = Slider(1, range=0..1)
concat = Concatenate(FragmentA=avr, FragmentB="%")
concat_2 = Concatenate(FragmentA="annual_UDI mat @self window1", FragmentB=number_slider_2)
captureview = Ladybug_CaptureView(fileName=concat_2, folder="c:\ladybug\illuminance_study", capture=rundaylightanalysis.done)  # -> imagePath; plug-in component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
# Visualize the results
recolormesh = Ladybug_RecolorMesh(
    analysisResult=readannualresultsi.UDLI_100_2000,
    inputMesh=genhbzonetestpts.mesh,
    legendPar=legendpar,
    analysisTitle=rundaylightanalysis.analysisType,
    legendTitle=concat)  # -> readMe, newMesh, newLegend, legendBasePt, meshColors, legendColors; plug-in component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
