# Grasshopper definition wang_yuchi.gh (Grasshopper 0.9.76)
# plug-ins: Python Interpreter

radglassmaterial = Honeybee_RadianceGlassMaterial(materialName=" Glass_60", RTransmittance="0.6", GTransmittance="0.6", BTransmittance="0.6", refractiveIndex=1.52)  # -> avrgTrans, RADMaterial; plug-in component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

# ---- group: Ceiling
brep = Brep(<brep referenced from the Rhino model>)

# ---- group: Floor
brep_2 = Brep(<brep referenced from the Rhino model>)

# ---- group: Wall
brep_3 = Brep([<brep referenced from the Rhino model> x7])

# ---- group: Glass
brep_4 = Brep([<brep referenced from the Rhino model> x11])

# ----
createhbsrfs = Honeybee_createHBSrfs(geometry=brep_4, RADMaterial=radglassmaterial.RADMaterial)  # -> readMe, simplify(HBSurface); plug-in component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
createhbsrfs_2 = Honeybee_createHBSrfs(geometry=[brep, brep_2, brep_3])  # -> readMe, simplify(HBSurface); plug-in component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
wires = BrepWireframe(Brep=[createhbsrfs_2.HBSurface, createhbsrfs.HBSurface], Density=-1)
flip = Flip(Surface=brep_2)  # -> Surface, Result
preview = CustomPreview(Geometry=wires, Shader=ColourSwatch(SwatchColor=RGB(0, 0, 0)))
gentestpts = Honeybee_GenerateTestPoints(testGeometry=flip.Surface, gridSize="1", distBaseSrf="0.75", moveTestMesh=True)  # -> readMe, simplify(testPoints), simplify(ptsVectors), simplify(facesArea), simplify(mesh); plug-in component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
radparameters = Honeybee_RADParameters(quality="0")  # -> readMe, radParameters; plug-in component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
preview_2 = CustomPreview(Geometry=brep_2, Shader=ColourSwatch(SwatchColor=RGB(212, 212, 212)))
path = FilePath("\\juno.design.upenn.edu\home\grad\arch\yuchwang\Desktop\Philadelphia_weather_files\USA_PA_Philadelphia.Intl.AP.724080_TMY3.epw")
annualdaylightsimulation = Honeybee_AnnualDaylightSimulation(epwWeatherFile=path, testPoints=gentestpts.testPoints, ptsVectors=gentestpts.ptsVectors)  # -> analysisRecipe; plug-in component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
toggle = BooleanToggle(True)
rundaylightanalysis = Honeybee_RunDaylightSimulation(
    HBObjects=flatten([createhbsrfs.HBSurface, createhbsrfs_2.HBSurface]),
    analysisRecipe=annualdaylightsimulation,
    writeRad=toggle,
    runRad=toggle,
    overwriteResults=True)  # -> readMe, analysisType, resultsUnit, results, testPts, annual_analysis_files, radGeoFile, studyFolder, done; plug-in component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
occupancygenerator = Honeybee_DaysimOccupancyGenerator(weekendDays=[1, 2], writeTheOcc=Toggle(True))  # -> occupancyFile; plug-in component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
readannualresultsi = Honeybee_ReadAnnualResultI(
    illFilesAddress=rundaylightanalysis.annual_analysis_files,
    testPoints=simplify(rundaylightanalysis.testPts),
    occupancyFiles=occupancygenerator,
    DLAIllumThresholds=300,
    runIt=Toggle(True))  # -> DLA, UDLI_Less_100, UDLI_100_2000, UDLI_More_2000, CDA, sDA, annualProfiles, htmReport; plug-in component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
legendpar = Ladybug_LegendParameters(lowBound="0", highBound="100")  # -> legendPar; plug-in component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
concat = Concatenate(FragmentA="Useful Daylight Illuminance", FragmentC="sDA: ", FragmentB=readannualresultsi.sDA)
recolormesh = Ladybug_RecolorMesh(
    analysisResult=readannualresultsi.UDLI_More_2000,
    inputMesh=gentestpts.mesh,
    legendPar=legendpar,
    analysisTitle=concat,
    legendTitle="%")  # -> readMe, newMesh, newLegend, legendBasePt, meshColors, legendColors; plug-in component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
panel = Panel(readannualresultsi.sDA)
