# Grasshopper definition zhang_yunlong.gh (Grasshopper 0.9.76)
# plug-ins: Python Interpreter, Ironbug

ladybug = Ladybug_Ladybug()  # -> out; plug-in component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
honeybee = Honeybee_Honeybee()  # -> out; plug-in component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

domain_box = DomainBox(Base=PlaneXY(0, 0, 0), X=Slider(6, range=0..10), Y=Slider(12, range=0..100), Z=Slider(3.2, range=0..10))
mass2zone = Honeybee_Masses2Zones(zoneMasses=flatten(domain_box), isConditioned=True, maxRoofAngle=30, createHBZones=Toggle(True))  # -> out, HBZones; plug-in component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

# ----
# make sure the surface
decomposebytype = Honeybee_DecomposeBasedOnType(HBZone=mass2zone.HBZones)  # -> walls, interiorWalls, airWalls, windows, interiorWindows, skylights, roofs, ceilings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; plug-in component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
brep = Brep(decomposebytype.walls)

# ----
# See Geometry
brep_wireframe = BrepWireframe(Brep=mass2zone.HBZones, Density=-1)

# ----
# Make a value list of windows
# S N E W
number_slider = Slider(-0.1, range=-0.1..0.9)
glzparamlist = Honeybee_GlazingParametersList(northGlzParam=0, westGlzParam=0, southGlzParam=number_slider, eastGlzParam=0)  # -> glzParamList; plug-in component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
panel = Panel(glzparamlist)

panel_2 = Panel(mass2zone.out)

# ----
# movie
boolean_toggle = BooleanToggle(False)
fly = Ladybug_fly(inputSliders=number_slider, fly=boolean_toggle)  # -> Vviiiiiiiiiizzz; plug-in component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

# ----
# Geometry
# Add window
# Ratio
boolean_toggle_2 = BooleanToggle(True)
addhbglz = Honeybee_addHBGlz()  # -> HBObjWGLZ; plug-in component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
glazingcreator = Honeybee_GlazingBasedOnRatio(HBObjects=mass2zone.HBZones, glzRatio=glzparamlist, runIt=boolean_toggle_2)  # -> out, HBObjWGLZ; plug-in component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
brep_wireframe_2 = BrepWireframe(Brep=glazingcreator.HBObjWGLZ, Density=-1)

# ----
# Zone Test points
number_slider_2 = Slider(0.5, range=0..1)
genhbzonetestpts = Honeybee_GenerateZoneTestPoints(HBZone=glazingcreator.HBObjWGLZ, gridSize=number_slider_2, distBaseSrf=Slider(0.75, range=0..1), moveTestMesh=True)  # -> out, simplify(testPoints), simplify(ptsVectors), simplify(facesArea), simplify(mesh); plug-in component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

file_path = FilePath("D:\zyunlong\Philadelphia_weather_files\USA_PA_Philadelphia.Intl.AP.724080_TMY3.epw")
genclimatebasedsky = Honeybee_GenerateClimateBasedSky(weatherFile=file_path, month=Slider(12, range=0..100), day=Slider(12, range=0..100), hour=Slider(14, range=0..100))  # -> out, skyFilePath; plug-in component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
gridbasedsimulation = Honeybee_GridBasedSimulation(
    skyFile=genclimatebasedsky.skyFilePath,
    testPoints=genhbzonetestpts.testPoints,
    ptsVectors=genhbzonetestpts.ptsVectors,
    simulationType=0)  # -> analysisRecipe; plug-in component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
imagebasedsimulation = Honeybee_ImageBasedSimulation(skyFile=genclimatebasedsky.skyFilePath, simulationType=2, backupImages=0)  # -> analysisRecipe; plug-in component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

# ----
# Legen title,number...
number_slider_3 = Slider(5, range=0..100)
number_slider_4 = Slider(0, range=0..100)

legendpar = Ladybug_LegendParameters()  # -> legendPar; plug-in component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

# ----
# Plus two title together
panel_3 = Panel("Daylight factor")
concatenate = Concatenate(Fragment_A=panel_3, Fragment_B="WWR:", A=number_slider)

# ----
# show the analysis images
boolean_toggle_3 = BooleanToggle(True)
rundaylightanalysis = Honeybee_RunDaylightSimulation(
    HBObjects=flatten(glazingcreator.HBObjWGLZ),
    analysisRecipe=gridbasedsimulation,
    writeRad=boolean_toggle_3,
    runRad=boolean_toggle_3,
    overwriteResults=True)  # -> out, analysisType, resultsUnit, illuminance_values, testPts, illuminance_files, radGeoFile, studyFolder, done; plug-in component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
recolormesh = Ladybug_RecolorMesh(
    analysisResult=rundaylightanalysis.illuminance_values,
    inputMesh=genhbzonetestpts.mesh,
    analysisTitle=concatenate,
    legendTitle="%")  # -> out, newMesh, newLegend, legendBasePt, meshColors, legendColors; plug-in component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

panel_4 = Panel(rundaylightanalysis.illuminance_files)
panel_5 = Panel(rundaylightanalysis.illuminance_values)
mesh = Mesh(recolormesh.newMesh)
glareanalysis = Honeybee_GlareAnalysis(HDRImagePath=rundaylightanalysis.illuminance_files, runIt=Toggle(True))  # -> readMe, glareCheckImage, DGP, DGI, glareComfortRange, imageWithTaskArea; plug-in component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

# ----
# way:one
number_slider_5 = Slider(5, range=0..10)
# 5%
larger_than = LargerThan(FirstNumber=panel_5, SecondNumber=number_slider_5)  # -> LargerThan, OrEqualTo
cull_faces = CullFaces(Mesh=mesh, Pattern=larger_than.OrEqualTo)

# ----
# way:2
number_slider_6 = Slider(5, range=0..100)
meshselector = Ladybug_MeshThresholdSelector(analysisResult=flatten(rundaylightanalysis.illuminance_values), levelOfPerform=number_slider_6)  # -> out, totalValue, areaMeetsThresh, newColoredMesh, newMeshOutline; plug-in component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

hdr_gif = Honeybee_ConvertHDRToGIF(HDRFilePath=rundaylightanalysis.illuminance_files, adjustExposure=False)  # -> GIFFilePath; plug-in component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
ladybug_imageviewer = Ladybug_ImageViewer(ImagePath_=hdr_gif, _scale_=1, DisableClickable=True, SaveImgWithCoords=False, scale=1)  # -> ImagePath, Colors, GIF
area = Area(Geometry=mesh)  # -> Area, Centroid
area_2 = Area(Geometry=cull_faces)  # -> Area, Centroid
division = Division(A=area_2.Area, B=area.Area)

# ----
# use point add title
number_slider_7 = Slider(100, range=0..100)
multiplication = Multiplication(A=division, B=number_slider_7)
panel_6 = Panel(multiplication)
round = Round(Number=multiplication)  # -> Nearest, Floor, Ceiling
point = Point(<point referenced from the Rhino model>)
concatenate_2 = Concatenate(FragmentA="% area of the room:", FragmentB=round.Nearest)
text_tag_3d = TextTag3D(Location=point, Text=concatenate_2, Size=Slider(0.8, range=0..1), Justification=7)

# ----
# pint screen and save images
panel_7 = Panel("DF_wwf_")
concatenate_3 = Concatenate(FragmentA=panel_7, FragmentB=number_slider)
captureview = Ladybug_CaptureView(fileName=concatenate_3, folder="D:\zyunlong\1023note", capture=rundaylightanalysis.done)  # -> Output; plug-in component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
