# Grasshopper definition zhao_xiaoyu.gh (Grasshopper 0.9.76)
# plug-ins: Python Interpreter

ladybug = Ladybug_Ladybug()  # -> Vviiiiiiiiiizzz; plug-in component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
honeybee = Honeybee_Honeybee()  # -> Vviiiiiiiiiizzz; plug-in component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

# ----
# Question1: why create ground for more accurate simulation?
# Question2: what's the realationship between these data
# Question3: grid based simulation and annual daylight simulation?
panel = Panel("4")
panel_2 = Panel("4.9")
cluster = Cluster(X=panel, Y=1, Z="3")
mass2zone = Honeybee_Masses2Zones(zoneMasses=flatten(cluster), isConditioned=True, maxRoofAngle=30, createHBZones=Toggle(True))  # -> readMe, HBZones; plug-in component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
glzparamlist = Honeybee_GlazingParametersList(northGlzParam=0, westGlzParam=0, southGlzParam=Slider(0.6, range=0.1..1), eastGlzParam=0)  # -> glzParamList; plug-in component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
glazingcreator = Honeybee_GlazingBasedOnRatio(HBObjects=mass2zone.HBZones, glzRatio=glzparamlist, runIt=Toggle(True))  # -> readMe, HBObjWGLZ; plug-in component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
brep = Brep(glazingcreator.HBObjWGLZ)
wires = BrepWireframe(Brep=brep, Density=-1)
genhbzonetestpts = Honeybee_GenerateZoneTestPoints(HBZone=brep, gridSize=Slider(0.6, range=0.1..1), distBaseSrf="0.762", moveTestMesh=Toggle(True))  # -> readMe, simplify(testPoints), simplify(ptsVectors), simplify(facesArea), simplify(mesh); plug-in component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
path = FilePath("\\juno.design.upenn.edu\home\grad\arch\xiaoyuz\Desktop\Philadelphia_weather_files\USA_PA_Philadelphia.Intl.AP.724080_TMY3.epw")
annualdaylightsimulation = Honeybee_AnnualDaylightSimulation(
    epwWeatherFile=path,
    testPoints=genhbzonetestpts.testPoints,
    ptsVectors=genhbzonetestpts.ptsVectors,
    testMesh=genhbzonetestpts.mesh)  # -> analysisRecipe; plug-in component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
toggle = BooleanToggle(True)
rundaylightanalysis = Honeybee_RunDaylightSimulation(HBObjects=flatten(brep), analysisRecipe=annualdaylightsimulation, writeRad=toggle, runRad=toggle, overwriteResults=True)  # -> readMe, analysisType, resultsUnit, results, testPts, annual_analysis_files, radGeoFile, studyFolder, done; plug-in component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
occupancygenerator = Honeybee_DaysimOccupancyGenerator(weekendDays=[1, 2], writeTheOcc=Toggle(True))  # -> occupancyFile; plug-in component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
readannualresultsi = Honeybee_ReadAnnualResultI(
    illFilesAddress=rundaylightanalysis.annual_analysis_files,
    testPoints=simplify(rundaylightanalysis.testPts),
    occupancyFiles=occupancygenerator,
    DLAIllumThresholds=300,
    runIt=Toggle(False))  # -> DLA, UDLI_Less_100, UDLI_100_2000, UDLI_More_2000, CDA, sDA, annualProfiles, htmReport; plug-in component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
col = Colour([ColourSwatch(SwatchColor=RGB(0, 24, 153)), ColourSwatch(SwatchColor=RGB(255, 255, 255)), ColourSwatch(SwatchColor=RGB(235, 73, 136))])
legendpar = Ladybug_LegendParameters(lowBound="0", highBound="100", numSegments="6", customColors=flatten(col))  # -> legendPar; plug-in component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
panel_3 = Panel(readannualresultsi.DLA)
dom = ConstructDomain(DomainStart=0, DomainEnd="1")
panel_4 = Panel(readannualresultsi.UDLI_Less_100)
panel_5 = Panel(readannualresultsi.UDLI_100_2000)
recolormesh = Ladybug_RecolorMesh(
    analysisResult=readannualresultsi.DLA,
    inputMesh=genhbzonetestpts.mesh,
    heightDomain=dom,
    legendPar=legendpar,
    analysisTitle=rundaylightanalysis.analysisType,
    legendTitle="%")  # -> readMe, newMesh, newLegend, legendBasePt, meshColors, legendColors; plug-in component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
panel_6 = Panel(readannualresultsi.UDLI_More_2000)

number_slider = Slider(0.1, range=0.1..2)

# ---- group: wall
brep_2 = Brep([<brep referenced from the Rhino model> x4])

# ---- group: ground
brep_3 = Brep(<brep referenced from the Rhino model>)

# ---- group: shading
brep_4 = Brep()

# ---- group: glass
brep_5 = Brep(<brep referenced from the Rhino model>)

# ---- group: ceiling
brep_6 = Brep(<brep referenced from the Rhino model>)

# ----
# Annual Daylight Analysis Steps:
# create a honeybee zone - glaze - generate zone test points - annual daylight simulation - run daylight simulation - read annual daylight simulation results - recolor mesh
panel_7 = Panel([honeybee, ladybug])
radglassmaterial = Honeybee_RadianceGlassMaterial(materialName="glass_60", RTransmittance="0.6", GTransmittance="0.6", BTransmittance="0.6", refractiveIndex=1.52)  # -> avrgTrans, RADMaterial; plug-in component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
createhbsrfs = Honeybee_createHBSrfs(geometry=brep_5, RADMaterial=radglassmaterial.RADMaterial)  # -> readMe, simplify(HBSurface); plug-in component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
createhbsrfs_2 = Honeybee_createHBSrfs(geometry=brep_4, srfType="6")  # -> readMe, simplify(HBSurface); plug-in component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
createhbsrfs_3 = Honeybee_createHBSrfs(geometry=[brep_2, brep_3, brep_6])  # -> readMe, simplify(HBSurface); plug-in component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
gentestpts = Honeybee_GenerateTestPoints(testGeometry=brep_3, gridSize="0.5", distBaseSrf="0.762", moveTestMesh=True)  # -> readMe, simplify(testPoints), simplify(ptsVectors), simplify(facesArea), simplify(mesh); plug-in component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
path_2 = FilePath("\\juno.design.upenn.edu\home\grad\arch\xiaoyuz\Desktop\Philadelphia_weather_files\USA_PA_Philadelphia.Intl.AP.724080_TMY3.epw")
annualdaylightsimulation_2 = Honeybee_AnnualDaylightSimulation(epwWeatherFile=path_2, testPoints=gentestpts.testPoints, ptsVectors=gentestpts.ptsVectors, testMesh=gentestpts.mesh)  # -> analysisRecipe; plug-in component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
toggle_2 = BooleanToggle(True)
rundaylightanalysis_2 = Honeybee_RunDaylightSimulation(
    HBObjects=flatten([createhbsrfs.HBSurface, createhbsrfs_3.HBSurface, createhbsrfs_2.HBSurface]),
    analysisRecipe=annualdaylightsimulation_2,
    writeRad=toggle_2,
    runRad=toggle_2,
    overwriteResults=True)  # -> readMe, analysisType, resultsUnit, results, testPts, resultFiles, radGeoFile, studyFolder, done; plug-in component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
occupancygenerator_2 = Honeybee_DaysimOccupancyGenerator(weekendDays=[1, 2], writeTheOcc=Toggle(True))  # -> occupancyFile; plug-in component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
col_2 = Colour([ColourSwatch(SwatchColor=RGB(0, 24, 153)), ColourSwatch(SwatchColor=RGB(255, 255, 255)), ColourSwatch(SwatchColor=RGB(235, 73, 136))])
legendpar_2 = Ladybug_LegendParameters(lowBound="0", highBound="100", numSegments="6", customColors=flatten(col_2))  # -> legendPar; plug-in component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
panel_9 = Panel("Illuminance Threshold:2000lux")
readannualresultsi_2 = Honeybee_ReadAnnualResultI(
    illFilesAddress=rundaylightanalysis_2.resultFiles,
    testPoints=simplify(rundaylightanalysis_2.testPts),
    DLAIllumThresholds="2000",
    runIt=Toggle(False))  # -> DLA, UDLI_Less_100, UDLI_100_2000, UDLI_More_2000, CDA, sDA, annualProfiles, htmReport; plug-in component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
concat = Concatenate(FragmentA="UDI:100-2000LUX")
panel_10 = Panel(readannualresultsi_2.UDLI_More_2000)
recolormesh_2 = Ladybug_RecolorMesh(
    analysisResult=readannualresultsi_2.UDLI_100_2000,
    inputMesh=gentestpts.mesh,
    legendPar=legendpar_2,
    analysisTitle=concat,
    legendTitle="%")  # -> readMe, newMesh, newLegend, legendBasePt, meshColors, legendColors; plug-in component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
larger = LargerThan(FirstNumber=panel_10, SecondNumber="80")  # -> LargerThan, OrEqualTo
ma = MassAddition(Input=larger.LargerThan)  # -> Result, PartialResults
division = Division(A=ma.Result, B="72")
panel_11 = Panel(division)

# ==== cluster Cluster
X = ClusterInput()
Y = ClusterInput()
Z = ClusterInput()
box = CenterBox(Base=PlaneXY(0, 0, 0), X=X, Y=Y, Z=Z)
B = ClusterOutput(box)
