# Grasshopper definition nelson_graham_051117.gh (Grasshopper 0.9.76)
# plug-ins: Python Interpreter

r_value_h_ft2_f_btu = Panel("30")
construction_name = Panel("Baseline Roof")
rip2rsi = Ladybug_rIP2rSI(R_IP=r_value_h_ft2_f_btu)  # -> R_SI; plug-in component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
epnomassmat = Honeybee_EnergyPlusNoMassOpaqueMaterial(name=construction_name, R_Value=rip2rsi)  # -> EPMaterial; plug-in component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
epconstruction = Honeybee_EnergyPlusConstruction(name=construction_name, layer_1=epnomassmat)  # -> EPConstruction; plug-in component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

r_value_h_ft2_f_btu_2 = Panel("30")
construction_name_2 = Panel("Baseline Floor")
rip2rsi_2 = Ladybug_rIP2rSI(R_IP=r_value_h_ft2_f_btu_2)  # -> R_SI; plug-in component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
epnomassmat_2 = Honeybee_EnergyPlusNoMassOpaqueMaterial(name=construction_name_2, R_Value=rip2rsi_2)  # -> EPMaterial; plug-in component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
epconstruction_2 = Honeybee_EnergyPlusConstruction(name=construction_name_2, layer_1=epnomassmat_2)  # -> EPConstruction; plug-in component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

r_value_h_ft2_f_btu_3 = Panel("20")
construction_name_3 = Panel("Baseline Wall")
rip2rsi_3 = Ladybug_rIP2rSI(R_IP=r_value_h_ft2_f_btu_3)  # -> R_SI; plug-in component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
epnomassmat_3 = Honeybee_EnergyPlusNoMassOpaqueMaterial(name=construction_name_3, R_Value=rip2rsi_3)  # -> EPMaterial; plug-in component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
epconstruction_3 = Honeybee_EnergyPlusConstruction(name=construction_name_3, layer_1=epnomassmat_3)  # -> EPConstruction; plug-in component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

ladybug = Ladybug_Ladybug()  # -> Vviiiiiiiiiizzz; plug-in component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
honeybee = Honeybee_Honeybee()  # -> Vviiiiiiiiiizzz; plug-in component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

# ---- group: ceiling
ceiling = Brep(<brep referenced from the Rhino model>)

# ----
walls = Brep([<brep referenced from the Rhino model> x2])

# ---- group: floor
floor = Brep(<brep referenced from the Rhino model>)

# ----
construction_name_4 = Panel("Baseline Triple Pane")
u_value_btu_h_ft2_f = Panel("0.65")
shgc = Panel("0.55")
uip2usi = Ladybug_uIP2uSI(U_IP=u_value_btu_h_ft2_f)  # -> U_SI; plug-in component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
vt = Panel("0.6")
epwindowmat = Honeybee_EnergyPlusWindowMaterial(name=construction_name_4, U_Value=uip2usi, SHGC=shgc, VT=vt)  # -> EPMaterial; plug-in component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
epconstruction_4 = Honeybee_EnergyPlusConstruction(name=construction_name_4, layer_1=epwindowmat)  # -> EPConstruction; plug-in component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

createhbsrfs = Honeybee_createHBSrfs(geometry=flatten(floor), srfType="2", EPConstruction=epconstruction_2)  # -> readMe, simplify(HBSurface); plug-in component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
createhbsrfs_2 = Honeybee_createHBSrfs(geometry=ceiling, srfType="3", EPConstruction=epconstruction)  # -> readMe, simplify(HBSurface); plug-in component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
createhbsrfs_3 = Honeybee_createHBSrfs(geometry=walls, srfType="0", EPConstruction=epconstruction_3)  # -> readMe, simplify(HBSurface); plug-in component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
wall_surface_with_opening = Brep([<brep referenced from the Rhino model> x2])
glass = Brep([<brep referenced from the Rhino model> x4])
createhbsrfs_4 = Honeybee_createHBSrfs(geometry=wall_surface_with_opening, srfType="0")  # -> readMe, simplify(HBSurface); plug-in component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
preview = CustomPreview(Geometry=glass, Shader=ColourSwatch(SwatchColor=RGBA(80, 222, 255, 160)))
addhbglz = Honeybee_addHBGlz(HBObj=createhbsrfs_4.HBSurface, childSurfaces=flatten(glass), EPConstructions=epconstruction_4)  # -> simplify(HBObjWGLZ); plug-in component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

# ---- group: collect all honeybee surfaces
brep = Brep(flatten([createhbsrfs_2.HBSurface, createhbsrfs_3.HBSurface, createhbsrfs.HBSurface, addhbglz]))

# ----
bldgprograms = Honeybee_bldgPrograms({"Office": 0, "Retail": 1, "MidriseApartment": 2, "PrimarySchool": 3, "SecondarySchool": 4, "SmallHotel": 5, "LargeHotel": 6, "Hospital": 7, "Outpatient": 8, "Warehouse": 9, "SuperMarket": 10, "FullServiceRestaurant": 11, "QuickServiceRestaurant": 12}, selected="MidriseApartment")
listzoneprograms = Honeybee_ListZonePrograms(bldgProgram=bldgprograms)  # -> MidriseApartmentZonePrograms; plug-in component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
item = ListItem(List=listzoneprograms, Index=0, Wrap=True)
panel = Panel(item)
createhbzones = Honeybee_createHBZones(name="test_room", zoneProgram=item, HBSurfaces=flatten(brep), isConditioned=True)  # -> readMe, HBZone; plug-in component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

hvacsystemslist = Honeybee_HVACSystemsList({"-1. Thermostat Only": -1, "0. Ideal Air Loads": 0, "1. PTAC | Residential": 1, "2. PTHP | Residential": 2, "3. Packaged Single Zone - AC": 3, "4. Packaged Single Zone - HP": 4, "5. Packaged VAV w/ Reheat": 5, "6. Packaged VAV w/ PFP Boxes": 6, "7. VAV w/ Reheat": 7, "8. VAV w/ PFP Boxes": 8, "9. Warm Air Furnace - Gas Fired": 9, "10.Warm Air Furnace - Electric": 10, "11.Fan Coil Units + DOAS": 11, "12.Active Chilled Beams + DOAS": 12, "13.Radiant Floors + DOAS": 13, "14.Radiant Ceilings + DOAS": 14, "15.Heated Floors + VAV Cooling": 15, "16.VRF + DOAS": 16, "17.Ground Source WSHP + DOAS": 17, "18.Ground Source VRF + DOAS": 18}, selected="11.Fan Coil Units + DOAS")
geo = Geometry(flatten(createhbzones.HBZone))
airdetails = Honeybee_HVACAirDetails(fanPressureRise="2737", heatRecovery="1", recoveryEffectiveness="0.5")  # -> airDetails; plug-in component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
hvacsystem = Honeybee_AssignHVACSystem(HBZones=flatten(geo), HVACSystems=hvacsystemslist, airDetails=airdetails)  # -> readMe, HBZones; plug-in component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

epoutput = Honeybee_GenerateEPOutput(
    zoneEnergyUse=Toggle(True),
    zoneGainsAndLosses="False",
    zoneComfortMetrics="False",
    surfaceTempAnalysis="False",
    timestep="annual")  # -> report, flatten(simulationOutputs); plug-in component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

brep_2 = Brep(<brep referenced from the Rhino model>)
preview_2 = CustomPreview(Geometry=brep_2, Shader=ColourSwatch(SwatchColor=RGBA(199, 185, 98, 160)))
hb_epcontextsrf = HoneybeeEPContextSurfaces(shdSurfaces=flatten(brep_2))  # -> HBContext; inputs shdSurfaces: list of GeometryBase, justBoundingBox: Boolean
# ---------- hb_epcontextsrf: Python ----------
"""
prepare shading/context geometries

    Args:
        northVectorOrRotation: A vector that shows North or a number that shows
                               the rotation of the North from the Y axis
        bldgMasses: List of closed Breps as thermal zones.
    Returns:
        report: ...
        thermalZones: Thermal zone's geometries for visualiza
"""

ghenv.Component.Name = 'Honeybee EP context Surfaces'
ghenv.Component.NickName = 'HB_EPContextSrf'
ghenv.Component.Message = 'VER 0.0.60\nNOV_04_2016'
ghenv.Component.IconDisplayMode = ghenv.Component.IconDisplayMode.application
ghenv.Component.Category = "Honeybee"
ghenv.Component.SubCategory = "10 | Energy | Energy"
#compatibleHBVersion = VER 0.0.57\nNOV_04_2016
#compatibleLBVersion = VER 0.0.59\nFEB_01_2015
ghenv.Component.AdditionalHelpFromDocStrings = "2"

import rhinoscriptsyntax as rs
import Rhino as rc
import scriptcontext as sc
import os
import System
import Grasshopper.Kernel as gh
import uuid

tolerance = sc.doc.ModelAbsoluteTolerance
import math


def main(shdSurfaces, EPTransSchedule, meshingSettings, justBoundingBox):
    
    # import the classes
    if sc.sticky.has_key('honeybee_release'):

        try:
            if not sc.sticky['honeybee_release'].isCompatible(ghenv.Component): return -1
            if sc.sticky['honeybee_release'].isInputMissing(ghenv.Component): return -1
        except:
            warning = "You need a newer version of Honeybee to use this compoent." + \
            " Use updateHoneybee component to update userObjects.\n" + \
            "If you have already updated userObjects drag Honeybee_Honeybee component " + \
            "into canvas and try again."
            w = gh.GH_RuntimeMessageLevel.Warning
            ghenv.Component.AddRuntimeMessage(w, warning)
            return -1
        
        # don't customize this part
        hb_EPSrf = sc.sticky["honeybee_EPSurface"]
        hb_EPSHDSurface = sc.sticky["honeybee_EPShdSurface"]
        hb_RADMaterialAUX = sc.sticky["honeybee_RADMaterialAUX"]
        hb_EPObjectsAux = sc.sticky["honeybee_EPObjectsAUX"]()
        HBScheduleList = sc.sticky["honeybee_ScheduleLib"].keys()

        ########################################################################
        #----------------------------------------------------------------------#
        shdBreps = []
        # create bounding box of shading geometries
        if justBoundingBox:
            for brep in shdSurfaces:
                if brep.Faces.Count>1 or not brep.Faces[0].IsPlanar(sc.doc.ModelAbsoluteTolerance):
                    shdBreps.append(brep.GetBoundingBox(True).ToBrep())
                else:
                    shdBreps.append(brep)
        else:
            shdBreps = shdSurfaces
        
        shadingClasses = []
        shadingMeshPreview = []
        
        if meshingSettings == None:
            mp = rc.Geometry.MeshingParameters.Minimal
            mp.SimplePlanes = True
        else:
            mp = meshingSettings
        
        def getRadMaterialName(radMaterial):
            nameStr = radMaterial.split(" ")[2]
            name =  nameStr.split("\n")[0]
            return name
        
        for brepCount, brep in enumerate(shdBreps):
            if brep != None:
                isPlanar = True
                # check planarity
                for face in brep.Faces:
                    if not face.IsPlanar(tolerance):
                        isPlanar = False
                        break
                
                shadingBreps = []
                if not isPlanar:
                    meshArray = rc.Geometry.Mesh.CreateFromBrep(brep, mp)
                    for mesh in meshArray:
                        for meshFace in range(mesh.Faces.Count):
                            vertices = list(mesh.Faces.GetFaceVertices(meshFace))[1:]
                            vertices = vertices + [sc.doc.ModelAbsoluteTolerance]
                            # create the brep from mesh
                            shdBrep = rc.Geometry.Brep.CreateFromCornerPoints(*vertices)
                            shadingBreps.append(shdBrep)
                else:
                    for face in brep.Faces:
                        shadingBreps.append(face.DuplicateFace(False))
                
                for faceCount, shdBrep in enumerate(shadingBreps):
                        thisShading = hb_EPSHDSurface(shdBrep, 1000*brepCount + faceCount, 'shdSrf_' + `brepCount` + '_' + `faceCount` + "_" + str(uuid.uuid4()))
                        
                        # add transmittance schedule if any
                        if EPTransSchedule!=None:
                            schedule= EPTransSchedule.upper()
                            if schedule!=None and not schedule.lower().endswith(".csv") and schedule not in HBScheduleList:
                                msg = "Cannot find " + schedule + " in Honeybee schedule library."
                                print msg
                                ghenv.Component.AddRuntimeMessage(gh.GH_RuntimeMessageLevel.Warning, msg)
                                return -1
                            elif schedule!=None and schedule.lower().endswith(".csv"):
                                # check if csv file is existed
                                if not os.path.isfile(schedule):
                                    msg = "Cannot find the shchedule file: " + schedule
                                    print msg
                                    ghenv.Component.AddRuntimeMessage(gh.GH_RuntimeMessageLevel.Warning, msg)
                                    return -1
                            
                            thisShading.TransmittanceSCH = schedule
                        
                        # add the Rad Material if any
                        if RADMaterial!=None:
                            # if it is just the name of the material make sure it is already defined
                            if len(RADMaterial.split(" ")) == 1:
                                # if the material is not in the library add it to the library
                                if not hb_RADMaterialAUX.isMatrialExistInLibrary(RADMaterial):
                                    warningMsg = "Can't find " + RADMaterial + " in RAD Material Library.\n" + \
                                                "Add the material to the library and try again."
                                    ghenv.Component.AddRuntimeMessage(gh.GH_RuntimeMessageLevel.Warning, warningMsg)
                                    return
                                
                                try:
                                    thisShading.setRADMaterial(RADMaterial)
                                except Exception, e:
                                    print e
                                    warningMsg = "You are using an old version of Honeybee_Honeybee! Update your files and try again."
                                    print warningMsg
                                    ghenv.Component.AddRuntimeMessage(gh.GH_RuntimeMessageLevel.Warning, warningMsg)
                                    return
                                
                                addedToLib = True
                            else:
                                
                                # try to add the material to the library
                                addedToLib, thisShading.RadMaterial = hb_RADMaterialAUX.analyseRadMaterials(RADMaterial, True)
                                
                            if addedToLib==False:
                                warningMsg = "Failed to add " + RADMaterial + " to the Library."
                                ghenv.Component.AddRuntimeMessage(gh.GH_RuntimeMessageLevel.Warning, warningMsg)
                                return
                        
                        # add shading to the list
                        shadingClasses.append(thisShading)
                
        # add to the hive
        hb_hive = sc.sticky["honeybee_Hive"]()
        HBContext  = hb_hive.addToHoneybeeHive(shadingClasses, ghenv.Component)
        return HBContext
        ################################################################################################
    else:
        print "You should first let Honeybee to fly..."
        w = gh.GH_RuntimeMessageLevel.Warning
        ghenv.Component.AddRuntimeMessage(w, "You should first let Honeybee to fly...")
        return -1
        

if _shdSurfaces and _shdSurfaces[0]!=None:
    # add cleaning function
    result= main(_shdSurfaces, EPTransSchedule_, meshingSettings_, justBoundingBox_)
    
    if result != -1: HBContext = result
# ---------- end hb_epcontextsrf ----------

energysimpar = Honeybee_EnergySimulationPar(timestep=6, solarDistribution="4")  # -> energySimPar; plug-in component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
panel_2 = Panel("https://www.energyplus.net/weather-download/north_and_central_america_wmo_region_4/USA/PA/USA_PA_Philadelphia.Intl.AP.724080_TMY3/all")
wires = BrepWireframe(Brep=createhbzones.HBZone, Density=-1)
epw_stat = Ladybug_OpenEPWAndSTATWeatherFiles(weatherFileURL=panel_2)  # -> epwFile, statFile; plug-in component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
epoutput_2 = Honeybee_GenerateEPOutput(zoneEnergyUse=Toggle(False), zoneGainsAndLosses="False", zoneComfortMetrics="False", surfaceTempAnalysis="False")  # -> report, flatten(simulationOutputs); plug-in component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
geo_2 = Geometry(flatten(hvacsystem.HBZones))
toggle = BooleanToggle(True)
toggle_2 = BooleanToggle(True)
number_slider = Slider(45, range=0..100)
exporttoopenstudio = Honeybee_ExportToOpenStudio(
    epwWeatherFile=epw_stat.epwFile,
    energySimPar=energysimpar,
    HBZones=flatten(geo_2),
    simulationOutputs=flatten(epoutput.simulationOutputs),
    writeOSM=toggle,
    runSimulation=toggle)  # -> readMe, osmFileAddress, idfFileAddress, resultFileAddress, eioFileAddress, rddFileAddress, htmlReport, studyFolder, model; plug-in component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
runenergysimulation = Honeybee_RunEnergySimulation(
    north=number_slider,
    epwFile=epw_stat.epwFile,
    HBZones=flatten(createhbzones.HBZone),
    HBContext=flatten(hb_epcontextsrf),
    simulationOutputs=flatten(epoutput_2.simulationOutputs),
    writeIdf=toggle_2,
    runEnergyPlus=toggle_2)  # -> report, idfFileAddress, htmlReport, resultFileAddress; plug-in component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
northarrow = Ladybug_North(north=number_slider, scale=".05")  # -> northSign; plug-in component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

readepresult = Honeybee_ReadEPResult(resultFileAddress=exporttoopenstudio.resultFileAddress)  # -> totalThermalLoad, thermalLoadBalance, cooling, heating, electricLight, electricEquip, fanElectric, pumpElectric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; plug-in component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
flrnorm = Honeybee_NormalizeDataByFloorArea(simData=readepresult.fanElectric, HBZones=flatten(geo_2))  # -> totNormData, zoneNormData; plug-in component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
flrnorm_2 = Honeybee_NormalizeDataByFloorArea(simData=readepresult.cooling, HBZones=flatten(geo_2))  # -> totNormData, zoneNormData; plug-in component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
flrnorm_3 = Honeybee_NormalizeDataByFloorArea(simData=readepresult.heating, HBZones=flatten(geo_2))  # -> totNormData, zoneNormData; plug-in component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
flrnorm_4 = Honeybee_NormalizeDataByFloorArea(simData=readepresult.electricLight, HBZones=flatten(geo_2))  # -> totNormData, zoneNormData; plug-in component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
flrnorm_5 = Honeybee_NormalizeDataByFloorArea(simData=readepresult.electricEquip, HBZones=flatten(geo_2))  # -> totNormData, zoneNormData; plug-in component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
flrnorm_6 = Honeybee_NormalizeDataByFloorArea(simData=readepresult.pumpElectric, HBZones=flatten(geo_2))  # -> totNormData, zoneNormData; plug-in component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
strnum = Ladybug_SeparateData(inputList=flatten(flrnorm_2.totNormData))  # -> numbers, strings; plug-in component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
strnum_2 = Ladybug_SeparateData(inputList=flatten(flrnorm_3.totNormData))  # -> numbers, strings; plug-in component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
strnum_3 = Ladybug_SeparateData(inputList=flatten(flrnorm_4.totNormData))  # -> numbers, strings; plug-in component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
strnum_4 = Ladybug_SeparateData(inputList=flatten(flrnorm_5.totNormData))  # -> numbers, strings; plug-in component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
strnum_5 = Ladybug_SeparateData(inputList=flatten(flrnorm.totNormData))  # -> numbers, strings; plug-in component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
strnum_6 = Ladybug_SeparateData(inputList=flatten(flrnorm_6.totNormData))  # -> numbers, strings; plug-in component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
ma = MassAddition(Input=flatten(strnum.numbers))  # -> Result, PartialResults
ma_2 = MassAddition(Input=flatten(strnum_2.numbers))  # -> Result, PartialResults
ma_3 = MassAddition(Input=flatten(strnum_3.numbers))  # -> Result, PartialResults
ma_4 = MassAddition(Input=flatten(strnum_4.numbers))  # -> Result, PartialResults
ma_5 = MassAddition(Input=flatten(strnum_5.numbers))  # -> Result, PartialResults
ma_6 = MassAddition(Input=flatten(strnum_6.numbers))  # -> Result, PartialResults
wh2btu = Ladybug_Whm2BTUft(Wh_m2=[ma.Result, ma_2.Result, ma_3.Result, ma_4.Result, ma_5.Result, ma_6.Result])  # -> BTU_ft2; plug-in component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
eui_breakdown_kbtu_sf = Panel(wh2btu)
ma_7 = MassAddition(Input=eui_breakdown_kbtu_sf)  # -> Result, PartialResults
eui_kbtu_sf = Panel(ma_7.Result)

readeio = Honeybee_ReadHVACSizing(eioFile=exporttoopenstudio.eioFileAddress)  # -> zonePeakLoadObjs, zonePeakLoadVals, zoneSizingObjs, zoneSizingValues, systemSizingObjs, systemSizingVals, componentSizObjs, componentSizVals; plug-in component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
flip = FlipMatrix(Data=readeio.zoneSizingValues)
ma_8 = MassAddition(Input=flip)  # -> flatten(Result), PartialResults
panel_3 = Panel(ma_8.Result)

readepresult_2 = Honeybee_ReadEPResult(resultFileAddress=runenergysimulation.resultFileAddress)  # -> totalThermalLoad, thermalLoadBalance, cooling, heating, electricLight, electricEquip, fanElectric, pumpElectric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; plug-in component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
strnum_7 = Ladybug_SeparateData(inputList=flatten(readepresult_2.cooling))  # -> numbers, strings; plug-in component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
strnum_8 = Ladybug_SeparateData(inputList=flatten(readepresult_2.heating))  # -> numbers, strings; plug-in component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
ma_9 = MassAddition(Input=strnum_8.numbers)  # -> Result, PartialResults
ma_10 = MassAddition(Input=strnum_7.numbers)  # -> Result, PartialResults
barchart = Ladybug_MonthlyBarChart(
    inputData=flatten([readepresult_2.cooling, readepresult_2.heating]),
    stackValues=Toggle(True),
    altYAxisTitle="Cooling and Heating Loads",
    basePoint="20, 0, 0",
    xScale=Slider(0.5, range=0..1),
    yScale=Slider(0.7, range=0..1))  # -> readMe, dataMesh, dataCurves, dataCrvColors, graphAxes, graphLabels, title, titleBasePt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; plug-in component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
total_cooling = Panel(ma_10.Result)
total_heating = Panel(ma_9.Result)
