# Grasshopper definition chan_lokyunpriscilla.gh (Grasshopper 0.9.70)
# plug-ins: Python Interpreter

callfromepconstrlibrary = Honeybee_CallFromEPConstructionLibrary()  # -> ThermMaterials, EPMaterials, EPWindowMaterials, EPConstructions; plug-in component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
panel = Panel(callfromepconstrlibrary.EPConstructions)
ladybug = Ladybug_Ladybug()  # -> Vviiiiiiiiiizzz; plug-in component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
honeybee = Honeybee_Honeybee()  # -> Vviiiiiiiiiizzz; plug-in component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

# ---- group: geometry setup, construction, adiabatic / Exterior wall
brep = Brep(<brep referenced from the Rhino model>)

# ---- group: geometry setup, construction, adiabatic / Floor
brep_2 = Brep(<brep referenced from the Rhino model>)

# ---- group: geometry setup, construction, adiabatic / Interior walls
brep_3 = Brep([<brep referenced from the Rhino model> x5])

# ---- group: geometry setup, construction, adiabatic / ceiling
brep_4 = Brep(<brep referenced from the Rhino model>)

# ----
panel_2 = Panel(honeybee)

# ---- group: geometry setup, construction, adiabatic / Glazing
brep_5 = Brep([<brep referenced from the Rhino model> x3])

# ---- group: geometry setup, construction, adiabatic
item = ListItem(List=callfromepconstrlibrary.EPConstructions, Index="191", Wrap=True)
item_2 = ListItem(List=callfromepconstrlibrary.EPConstructions, Index="431", Wrap=True)
item_3 = ListItem(List=callfromepconstrlibrary.EPConstructions, Index="433", Wrap=True)
item_4 = ListItem(List=callfromepconstrlibrary.EPConstructions, Index="429", Wrap=True)
createhbsrfs = Honeybee_createHBSrfs(geometry=brep, EPConstruction=item)  # -> readMe, simplify(HBSurface); plug-in component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
bldgprograms = Honeybee_bldgPrograms({"Office": 0, "Retail": 1, "MidriseApartment": 2, "PrimarySchool": 3, "SecondarySchool": 4, "SmallHotel": 5, "LargeHotel": 6, "Hospital": 7, "Outpatient": 8, "Warehouse": 9, "SuperMarket": 10, "FullServiceRestaurant": 11, "QuickServiceRestaurant": 12}, selected="MidriseApartment")
createhbsrfs_2 = Honeybee_createHBSrfs(geometry=brep_4, srfType="3", EPConstruction=item_4)  # -> readMe, simplify(HBSurface); plug-in component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
createhbsrfs_3 = Honeybee_createHBSrfs(geometry=brep_2, srfType="2", EPConstruction=item_2)  # -> readMe, simplify(HBSurface); plug-in component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
createhbsrfs_4 = Honeybee_createHBSrfs(geometry=brep_3, EPConstruction=item_3)  # -> readMe, simplify(HBSurface); plug-in component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
item_5 = ListItem(List=callfromepconstrlibrary.EPConstructions, Index="230", Wrap=True)
addhbglz = Honeybee_addHBGlz(HBObj=createhbsrfs.HBSurface, childSurfaces=flatten(brep_5), EPConstructions=item_5)  # -> HBObjWGLZ; plug-in component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
listzoneprograms = Honeybee_ListZonePrograms(bldgProgram=bldgprograms)  # -> MidriseApartmentZonePrograms; plug-in component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
makeadiabatic = Honeybee_MakeAdiabatic(HBSrfs=[createhbsrfs_4.HBSurface, createhbsrfs_3.HBSurface, createhbsrfs_2.HBSurface])  # -> HBSrfs; plug-in component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
item_6 = ListItem(List=listzoneprograms, Index="0", Wrap=True)
wires = BrepWireframe(Brep=[addhbglz, createhbsrfs_4.HBSurface, createhbsrfs_3.HBSurface, createhbsrfs_2.HBSurface], Density=-1)
createhbzones = Honeybee_createHBZones(name="Sansom_room", zoneProgram=item_6, HBSurfaces=flatten([addhbglz, makeadiabatic]), isConditioned=Toggle(False))  # -> readMe, HBZone; plug-in component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

# ---- group: ventilation, infiltration, loads, etc.
setepzoneloads = Honeybee_SetEnergyPlusZoneLoads(
    HBZones=createhbzones.HBZone,
    equipmentLoadPerArea="2",
    infiltrationRatePerArea="0.0003",
    lightingDensityPerArea="9",
    numOfPeoplePerArea="0.061")  # -> loads, HBZones; plug-in component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
setepnatvent = Honeybee_SetEPAirFlow(
    HBZones=flatten(setepzoneloads.HBZones),
    naturalVentilationType="1",
    minIndoorTempForNatVent="24",
    maxIndoorTempForNatVent="44",
    minOutdoorTempForNatVent="16",
    maxOutdoorTempForNatVent="28")  # -> readMe, simplify(HBZones); plug-in component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

# ----
path = FilePath("C:\DIVA\WeatherData\USA_Philadelphia.International.Ap_HadCM3-A2-2050.epw")

# ---- group: Run energy simulation
epoutput = Honeybee_GenerateEPOutput(zoneComfortMetrics=Toggle(True))  # -> report, flatten(simulationOutputs); plug-in component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
toggle = BooleanToggle(False)
runenergysimulation = Honeybee_RunEnergySimulation(
    epwFile=path,
    HBZones=flatten(setepnatvent.HBZones),
    simulationOutputs=flatten(epoutput.simulationOutputs),
    writeIdf=toggle,
    runEnergyPlus=toggle)  # -> report, idfFileAddress, htmlReport, resultFileAddress; plug-in component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

# ---- group: baseline, no ventilation, %comfort, %hotcold
panel_3 = Panel("""16.997717
48.401826
34.600457""")

# ---- group: w/ ventilation, %comfort, %hotcold
panel_4 = Panel("""44.714612
20.43379
34.851598""")

# ---- group: changed construction w/ ventilation, %comfort, %hotcold
panel_5 = Panel("""51.860731
18.105023
30.034247""")

# ---- group: changed const w/ max ventilation, %comfort, %hotcold
panel_6 = Panel("""52.819635
17.146119
30.034247""")

# ----
legendpar = Ladybug_LegendParameters(numSegments="3", decimalPlaces="0")  # -> legendPar; plug-in component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

# ---- group: interpret energy comfort results
importepw = Ladybug_ImportEpw(epwFile=path)  # -> readMe, latitude, location, dryBulbTemperature, dewPointTemperature, relativeHumidity, windSpeed, windDirection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; plug-in component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
readepresult = Honeybee_ReadEPResult(resultFileAddress=runenergysimulation.resultFileAddress)  # -> totalThermalLoad, thermalLoadBalance, cooling, heating, electricLight, electricEquip, fanElectric, pumpElectric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; plug-in component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
adaptivecomfortcalculator = Ladybug_AdaptiveComfortCalculator(
    dryBulbTemperature=readepresult.airTemperature,
    meanRadiantTemperature=readepresult.meanRadTemperature,
    prevailingOutdoorTemp=importepw.dryBulbTemperature,
    runIt=Toggle(True))  # -> readMe, port, comfortableOrNot, conditionOfPerson, degreesFromTarget, port_2, targetTemperature, upperTemperatureBound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; plug-in component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
panel_7 = Panel([adaptivecomfortcalculator.percentOfTimeComfortable, adaptivecomfortcalculator.percentHotCold])
_3dchart = Ladybug_3DChart(
    inputData=flatten(adaptivecomfortcalculator.conditionOfPerson),
    xScale="0.25",
    zScale="0",
    legendPar=legendpar,
    bakeIt=Toggle(False))  # -> readMe, graphMesh, graphCurves, legend, legendBasePts, title, titleBasePts, dataPts, conditionalHOY; plug-in component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
