# Grasshopper definition guarin_juan.gh (Grasshopper 0.9.76)
# plug-ins: Python Interpreter

walls = Brep(<brep referenced from the Rhino model>)

# ---- group: floor
floor = Brep(<brep referenced from the Rhino model>)

# ---- group: ceiling
ceiling = Brep(<brep referenced from the Rhino model>)

# ----
walls_2 = Brep(<brep referenced from the Rhino model>)
wall_surface_with_opening = Brep([<brep referenced from the Rhino model> x2])
honeybee = Honeybee_Honeybee()  # -> Vviiiiiiiiiizzz; plug-in component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
ladybug = Ladybug_Ladybug()  # -> Vviiiiiiiiiizzz; plug-in component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
# Geometry
createhbsrfs = Honeybee_createHBSrfs(geometry=walls, EPConstruction="Interior Wall")  # -> readMe, simplify(HBSurface); plug-in component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
createhbsrfs_2 = Honeybee_createHBSrfs(geometry=flatten(floor), srfType="2")  # -> readMe, simplify(HBSurface); plug-in component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
createhbsrfs_3 = Honeybee_createHBSrfs(geometry=walls_2, EPConstruction="Exterior Wall")  # -> readMe, simplify(HBSurface); plug-in component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
createhbsrfs_4 = Honeybee_createHBSrfs(geometry=wall_surface_with_opening, srfType="0")  # -> readMe, simplify(HBSurface); plug-in component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
createhbsrfs_5 = Honeybee_createHBSrfs(geometry=ceiling, srfType="3")  # -> readMe, simplify(HBSurface); plug-in component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
glass = Brep([<brep referenced from the Rhino model> x2])
addhbglz = Honeybee_addHBGlz(HBObj=createhbsrfs_4.HBSurface, childSurfaces=flatten(glass))  # -> simplify(HBObjWGLZ); plug-in component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
preview = CustomPreview(Geometry=glass, Shader=ColourSwatch(SwatchColor=RGBA(80, 222, 255, 160)))
bldgprograms = Honeybee_bldgPrograms({"Office": 0, "Retail": 1, "MidriseApartment": 2, "PrimarySchool": 3, "SecondarySchool": 4, "SmallHotel": 5, "LargeHotel": 6, "Hospital": 7, "Outpatient": 8, "Warehouse": 9, "SuperMarket": 10, "FullServiceRestaurant": 11, "QuickServiceRestaurant": 12}, selected="MidriseApartment")
panel = Panel("""0
4
1
2""")
listzoneprograms = Honeybee_ListZonePrograms(bldgProgram=bldgprograms)  # -> MidriseApartmentZonePrograms; plug-in component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
item = ListItem(List=listzoneprograms, Index=0, Wrap=True)
brep = Brep(flatten([addhbglz, createhbsrfs_5.HBSurface, createhbsrfs_2.HBSurface, createhbsrfs.HBSurface, createhbsrfs_3.HBSurface]))
callfromepconstrlibrary = Honeybee_CallFromEPConstructionLibrary()  # -> ThermMaterials, EPMaterials, EPWindowMaterials, EPConstructions; plug-in component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
srfattributelist = Honeybee_SurfaceAttributeList({"Name": "name", "Radiance Material": "RadMaterial", "EnergyPlus Construction": "EPConstruction", "Surface Type": "type", "Boundary Condition": "BC", "Sun Exposure": "sunExposure", "Wind Exposure": "windExposure", "Has Child Surface": "hasChild", "Is Child Surface": "isChild", "Is Planar": "isPlanar", "Srf Type Set By User": "srfTypeByUser", "Boundary Condition Set By User": "srfBCByUser", "Shade Material Name": "shadeMaterialName", "Shading Control Name": "shadingControlName", "Shcading Schedule Name": "shadingSchName"}, selected="EnergyPlus Construction")
panel_2 = Panel(item)
createhbzones = Honeybee_createHBZones(name="test_room", zoneProgram=item, HBSurfaces=flatten(brep), isConditioned=Toggle(False))  # -> readMe, HBZone; plug-in component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
searchepconstruction = Honeybee_SearchEPConstruction(EPConstrList=callfromepconstrlibrary.EPConstructions, standard="2", climateZone="4", surfaceType=panel)  # -> EPSelectedConstr; plug-in component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
labelsurfaces = Honeybee_LabelZoneSurfaces(HBObjects=flatten(createhbzones.HBZone), attribute=srfattributelist)  # -> surfaceTxtLabels, labelBasePts, brepTxtLabels, surfaceWireFrames; plug-in component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
item_2 = ListItem(List=searchepconstruction, Index=0, Wrap=True)
bang = ExplodeTree(Data=item_2)  # -> Branch0, Branch1, Branch2, Branch3
flatten = FlattenTree(Tree=item_2, Path="{0}")
item_3 = ListItem(List=flatten, Index=0, Wrap=True)  # -> Item, Item1, Item2, Item3
panel_3 = Panel(bang.Branch0)
panel_4 = Panel(item_3.Item1)
panel_5 = Panel(item_2)
setepzonecnstr = Honeybee_SetEPZoneConstruction(
    HBZones=flatten(createhbzones.HBZone),
    wallEPConstruction=item_3.Item,
    windowEPConstruction=item_3.Item1,
    roofEPConstruction=item_3.Item2,
    floorEPConstruction=item_3.Item3)  # -> simplify(modifiedHBZones); plug-in component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
epoutput = Honeybee_GenerateEPOutput(zoneGainsAndLosses="False", zoneComfortMetrics=Toggle(True), surfaceTempAnalysis="False")  # -> report, flatten(simulationOutputs); plug-in component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
setepnatvent = Honeybee_SetEPAirFlow(
    HBZones=flatten(setepzonecnstr),
    naturalVentilationType="1",
    minIndoorTempForNatVent="24",
    maxIndoorTempForNatVent="27",
    minOutdoorTempForNatVent="25",
    maxOutdoorTempForNatVent="30")  # -> readMe, simplify(HBZones); plug-in component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
brep_2 = Brep([<brep referenced from the Rhino model> x10])
hb_epcontextsrf = HoneybeeEPContextSurfaces(shdSurfaces=flatten(brep_2))  # -> HBContext; inputs shdSurfaces: list of Brep, justBoundingBox: Boolean
# ---------- hb_epcontextsrf: Python ----------
"""
prepare shading/context geometries

    Args:
        northVectorOrRotation: A vector that shows North or a number that shows
                               the rotation of the North from the Y axis
        bldgMasses: List of closed Breps as thermal zones.
    Returns:
        report: ...
        thermalZones: Thermal zone's geometries for visualiza
"""

ghenv.Component.Name = 'Honeybee EP context Surfaces'
ghenv.Component.NickName = 'HB_EPContextSrf'
ghenv.Component.Message = 'VER 0.0.62\nJUL_28_2017'
ghenv.Component.IconDisplayMode = ghenv.Component.IconDisplayMode.application
ghenv.Component.Category = "Honeybee"
ghenv.Component.SubCategory = "10 | Energy | Energy"
#compatibleHBVersion = VER 0.0.57\nNOV_04_2016
#compatibleLBVersion = VER 0.0.59\nFEB_01_2015
ghenv.Component.AdditionalHelpFromDocStrings = "2"

import rhinoscriptsyntax as rs
import Rhino as rc
import scriptcontext as sc
import os
import System
import Grasshopper.Kernel as gh
import uuid

tolerance = sc.doc.ModelAbsoluteTolerance
import math


def main(shdSurfaces, EPTransSchedule, meshingSettings, justBoundingBox):
    
    # import the classes
    if sc.sticky.has_key('honeybee_release'):

        try:
            if not sc.sticky['honeybee_release'].isCompatible(ghenv.Component): return -1
            if sc.sticky['honeybee_release'].isInputMissing(ghenv.Component): return -1
        except:
            warning = "You need a newer version of Honeybee to use this compoent." + \
            " Use updateHoneybee component to update userObjects.\n" + \
            "If you have already updated userObjects drag Honeybee_Honeybee component " + \
            "into canvas and try again."
            w = gh.GH_RuntimeMessageLevel.Warning
            ghenv.Component.AddRuntimeMessage(w, warning)
            return -1
        
        # don't customize this part
        hb_EPSrf = sc.sticky["honeybee_EPSurface"]
        hb_EPSHDSurface = sc.sticky["honeybee_EPShdSurface"]
        hb_RADMaterialAUX = sc.sticky["honeybee_RADMaterialAUX"]
        hb_EPObjectsAux = sc.sticky["honeybee_EPObjectsAUX"]()
        HBScheduleList = sc.sticky["honeybee_ScheduleLib"].keys()

        ########################################################################
        #----------------------------------------------------------------------#
        shdBreps = []
        # create bounding box of shading geometries
        if justBoundingBox:
            for brep in shdSurfaces:
                if brep.Faces.Count>1 or not brep.Faces[0].IsPlanar(sc.doc.ModelAbsoluteTolerance):
                    shdBreps.append(brep.GetBoundingBox(True).ToBrep())
                else:
                    shdBreps.append(brep)
        else:
            shdBreps = shdSurfaces
        
        shadingClasses = []
        shadingMeshPreview = []
        
        if meshingSettings == None:
            mp = rc.Geometry.MeshingParameters.Minimal
            mp.SimplePlanes = True
        else:
            mp = meshingSettings
        
        def getRadMaterialName(radMaterial):
            nameStr = radMaterial.split(" ")[2]
            name =  nameStr.split("\n")[0]
            return name
        
        for brepCount, brep in enumerate(shdBreps):
            if brep != None:
                isPlanar = True
                # check planarity
                for face in brep.Faces:
                    if not face.IsPlanar(tolerance):
                        isPlanar = False
                        break
                
                shadingBreps = []
                if not isPlanar:
                    meshArray = rc.Geometry.Mesh.CreateFromBrep(brep, mp)
                    for mesh in meshArray:
                        for meshFace in range(mesh.Faces.Count):
                            vertices = list(mesh.Faces.GetFaceVertices(meshFace))[1:]
                            vertices = vertices + [sc.doc.ModelAbsoluteTolerance]
                            # create the brep from mesh
                            shdBrep = rc.Geometry.Brep.CreateFromCornerPoints(*vertices)
                            shadingBreps.append(shdBrep)
                else:
                    for face in brep.Faces:
                        shadingBreps.append(face.DuplicateFace(False))
                
                for faceCount, shdBrep in enumerate(shadingBreps):
                        thisShading = hb_EPSHDSurface(shdBrep, 1000*brepCount + faceCount, 'shdSrf_' + `brepCount` + '_' + `faceCount` + "_" + str(uuid.uuid4()))
                        
                        # add transmittance schedule if any
                        if EPTransSchedule!=None:
                            schedule= EPTransSchedule.upper()
                            if schedule!=None and not schedule.lower().endswith(".csv") and schedule not in HBScheduleList:
                                msg = "Cannot find " + schedule + " in Honeybee schedule library."
                                print msg
                                ghenv.Component.AddRuntimeMessage(gh.GH_RuntimeMessageLevel.Warning, msg)
                                return -1
                            elif schedule!=None and schedule.lower().endswith(".csv"):
                                # check if csv file is existed
                                if not os.path.isfile(schedule):
                                    msg = "Cannot find the shchedule file: " + schedule
                                    print msg
                                    ghenv.Component.AddRuntimeMessage(gh.GH_RuntimeMessageLevel.Warning, msg)
                                    return -1
                            
                            thisShading.TransmittanceSCH = schedule
                        
                        # add the Rad Material if any
                        if RADMaterial!=None:
                            # if it is just the name of the material make sure it is already defined
                            if len(RADMaterial.split(" ")) == 1:
                                # if the material is not in the library add it to the library
                                if not hb_RADMaterialAUX.isMatrialExistInLibrary(RADMaterial):
                                    warningMsg = "Can't find " + RADMaterial + " in RAD Material Library.\n" + \
                                                "Add the material to the library and try again."
                                    ghenv.Component.AddRuntimeMessage(gh.GH_RuntimeMessageLevel.Warning, warningMsg)
                                    return
                                
                                try:
                                    thisShading.setRADMaterial(RADMaterial)
                                except Exception, e:
                                    print e
                                    warningMsg = "You are using an old version of Honeybee_Honeybee! Update your files and try again."
                                    print warningMsg
                                    ghenv.Component.AddRuntimeMessage(gh.GH_RuntimeMessageLevel.Warning, warningMsg)
                                    return
                                
                                addedToLib = True
                            else:
                                
                                # try to add the material to the library
                                addedToLib, thisShading.RadMaterial = hb_RADMaterialAUX.analyseRadMaterials(RADMaterial, True)
                                
                            if addedToLib==False:
                                warningMsg = "Failed to add " + RADMaterial + " to the Library."
                                ghenv.Component.AddRuntimeMessage(gh.GH_RuntimeMessageLevel.Warning, warningMsg)
                                return
                        
                        # add shading to the list
                        shadingClasses.append(thisShading)
                
        # add to the hive
        hb_hive = sc.sticky["honeybee_Hive"]()
        HBContext  = hb_hive.addToHoneybeeHive(shadingClasses, ghenv.Component)
        return HBContext
        ################################################################################################
    else:
        print "You should first let Honeybee to fly..."
        w = gh.GH_RuntimeMessageLevel.Warning
        ghenv.Component.AddRuntimeMessage(w, "You should first let Honeybee to fly...")
        return -1
        

if _shdSurfaces and _shdSurfaces[0]!=None:
    # add cleaning function
    result= main(_shdSurfaces, EPTransSchedule_, meshingSettings_, justBoundingBox_)
    
    if result != -1: HBContext = result
# ---------- end hb_epcontextsrf ----------
toggle = BooleanToggle(True)
path = FilePath("E:\JDG\Downloads\EPW\USA_OK_Oklahoma.City-Will.Rogers.World.AP.723530_TMY3.epw")
# Run
runenergysimulation = Honeybee_RunEnergySimulation(
    epwFile=path,
    HBZones=flatten(setepnatvent.HBZones),
    HBContext=flatten(hb_epcontextsrf),
    simulationOutputs=flatten(epoutput.simulationOutputs),
    writeIdf=toggle,
    runEnergyPlus=toggle)  # -> report, idfFileAddress, htmlReport, resultFileAddress; plug-in component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
setepzoneloads = Honeybee_SetEnergyPlusZoneLoads()  # -> loads, HBZones; plug-in component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
readepresult = Honeybee_ReadEPResult(resultFileAddress=runenergysimulation.resultFileAddress)  # -> port, port_2, port_3, port_4, port_5, port_6, port_7, port_8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; plug-in component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
importepw = Ladybug_ImportEpw(epwFile=path)  # -> readMe, latitude, location, dryBulbTemperature, dewPointTemperature, relativeHumidity, windSpeed, windDirection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; plug-in component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

# ---- group: winter
panel_6 = Panel("12")
panel_7 = Panel("1")
panel_8 = Panel("2")
panel_9 = Panel("28")

# ---- group: spring
panel_10 = Panel("03")
panel_12 = Panel("5")
panel_13 = Panel("31")

# ---- group: summer
panel_14 = Panel("06")
panel_15 = Panel("1")
panel_16 = Panel("8")
panel_17 = Panel("31")

# ---- group: fall
panel_18 = Panel("09")
panel_20 = Panel("11")
panel_21 = Panel("30")

# ----
analysisperiod = Ladybug_AnalysisPeriod(fromMonth=panel_14, fromDay=panel_15, toMonth=panel_16, toDay=panel_17)  # -> readMe, analysisPeriod; plug-in component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
adaptivecomfortcalculator = Ladybug_AdaptiveComfortCalculator(
    dryBulbTemperature=readepresult.airTemperature,
    meanRadiantTemperature=readepresult.meanRadTemperature,
    prevailingOutdoorTemp=importepw.dryBulbTemperature,
    analysisPeriod=analysisperiod.analysisPeriod,
    runIt=Toggle(True))  # -> readMe, port, comfortableOrNot, conditionOfPerson, degreesFromTarget, port_2, targetTemperature, upperTemperatureBound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; plug-in component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
panel_22 = Panel([adaptivecomfortcalculator.percentOfTimeComfortable, adaptivecomfortcalculator.percentHotCold])
# Post-Processing
panel_23 = Panel(".25")
windrose = Ladybug_WindRose(
    north=0,
    hourlyWindDirection=importepw.windDirection,
    hourlyWindSpeed=importepw.windSpeed,
    annualHourlyData=flatten(importepw.dryBulbTemperature),
    runIt=Toggle(True))  # -> readMe, calmRoseMesh, windRoseMesh, windRoseCrvs, windRoseCenPts, legend, legendBasePts, title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; plug-in component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
_3dchart = Ladybug_3DChart(
    inputData=flatten([importepw.dryBulbTemperature, importepw.globalHorizontalRadiation, importepw.relativeHumidity]),
    basePoint="0, -320, 0",
    xScale=panel_23,
    zScale="0")  # -> readMe, graphMesh, graphCurves, legend, legendBasePts, title, titleBasePts, dataPts, conditionalHOY; plug-in component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
_3dchart_2 = Ladybug_3DChart(inputData=flatten(adaptivecomfortcalculator.conditionOfPerson), xScale=".25", zScale="0")  # -> readMe, graphMesh, graphCurves, legend, legendBasePts, title, titleBasePts, dataPts, conditionalHOY; plug-in component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
