# Grasshopper definition hwang_youngjin.gh (Grasshopper 0.9.76)
# plug-ins: Python Interpreter

ladybug = Ladybug_Ladybug()  # -> Vviiiiiiiiiizzz; plug-in component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
honeybee = Honeybee_Honeybee()  # -> Vviiiiiiiiiizzz; plug-in component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
callfromepconstrlibrary = Honeybee_CallFromEPConstructionLibrary()  # -> ThermMaterials, EPMaterials, EPWindowMaterials, EPConstructions; plug-in component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
panel = Panel(honeybee)
panel_2 = Panel(callfromepconstrlibrary.EPConstructions)

# ----
# wall material
callfromepconstrlibrary_2 = Honeybee_CallFromEPConstructionLibrary()  # -> ThermMaterials, EPMaterials, EPWindowMaterials, EPConstructions; plug-in component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
searchepconstruction = Honeybee_SearchEPConstruction(EPConstrList=callfromepconstrlibrary_2.EPConstructions, standard="2", surfaceType="0")  # -> EPSelectedConstr; plug-in component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
panel_3 = Panel(searchepconstruction)
decomposeepconstruction = Honeybee_DecomposeEPConstruction(cnstrName=searchepconstruction)  # -> materials, comments, UValue_SI, UValue_IP, RValue_SI, RValue_IP; plug-in component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
panel_4 = Panel(decomposeepconstruction.RValue_SI)
sort = SortList(Keys=panel_4, ValuesA=panel_3)  # -> Keys, ValuesA
rev = ReverseList(List=sort.ValuesA)
panel_5 = Panel(sort.Keys)
item = ListItem(List=rev, Index=0, Wrap=True)

# ----
# window material
callfromepconstrlibrary_3 = Honeybee_CallFromEPConstructionLibrary()  # -> ThermMaterials, EPMaterials, EPWindowMaterials, EPConstructions; plug-in component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
searchepconstruction_2 = Honeybee_SearchEPConstruction(EPConstrList=callfromepconstrlibrary_3.EPConstructions, standard="2", surfaceType="4")  # -> EPSelectedConstr; plug-in component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
panel_6 = Panel(searchepconstruction_2)
decomposeepconstruction_2 = Honeybee_DecomposeEPConstruction(cnstrName=searchepconstruction_2)  # -> materials, comments, UValue_SI, UValue_IP, RValue_SI, RValue_IP; plug-in component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
panel_7 = Panel(decomposeepconstruction_2.UValue_SI)
sort_2 = SortList(Keys=panel_7, ValuesA=panel_6)  # -> Keys, ValuesA
item_2 = ListItem(List=sort_2.ValuesA, Index=0, Wrap=True)
panel_8 = Panel(sort_2.ValuesA)

# ----
# CEILING
# INTFLOOR
# INTWALL
# EXTWALL
wall_non_exposed = Brep(<brep referenced from the Rhino model>)
exterior_wall = Brep(<brep referenced from the Rhino model>)
ceiling = Brep(<brep referenced from the Rhino model>)
floor = Brep(<brep referenced from the Rhino model>)
# creating surface
createhbsrfs = Honeybee_createHBSrfs(geometry=ceiling, srfType="3")  # -> readMe, simplify(HBSurface); plug-in component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
createhbsrfs_2 = Honeybee_createHBSrfs(geometry=floor, srfType="2")  # -> readMe, simplify(HBSurface); plug-in component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
createhbsrfs_3 = Honeybee_createHBSrfs(geometry=wall_non_exposed, srfType="0")  # -> readMe, simplify(HBSurface); plug-in component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
createhbsrfs_4 = Honeybee_createHBSrfs(geometry=exterior_wall, srfType="0", EPConstruction=item)  # -> readMe, simplify(HBSurface); plug-in component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
window = Brep(flatten([<brep referenced from the Rhino model> x5]))
makeadiabatic = Honeybee_MakeAdiabatic(HBSrfs=flatten([createhbsrfs.HBSurface, createhbsrfs_2.HBSurface, createhbsrfs_3.HBSurface]))  # -> HBSrfs; plug-in component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
addhbglz = Honeybee_addHBGlz(HBObj=createhbsrfs_4.HBSurface, childSurfaces=flatten(window), EPConstructions=item_2)  # -> HBObjWGLZ; plug-in component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

bldgprograms = Honeybee_bldgPrograms({"Office": 0, "Retail": 1, "MidriseApartment": 2, "PrimarySchool": 3, "SecondarySchool": 4, "SmallHotel": 5, "LargeHotel": 6, "Hospital": 7, "Outpatient": 8, "Warehouse": 9, "SuperMarket": 10, "FullServiceRestaurant": 11, "QuickServiceRestaurant": 12}, selected="MidriseApartment")
# creating hbZone
listzoneprograms = Honeybee_ListZonePrograms(bldgProgram=bldgprograms)  # -> flatten(MidriseApartmentZonePrograms); plug-in component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
brep = Brep(flatten([makeadiabatic, addhbglz]))
item_3 = ListItem(List=listzoneprograms, Index="0", Wrap=True)  # -> flatten(Item)
createhbzones = Honeybee_createHBZones(name="my_room", zoneProgram=item_3, HBSurfaces=flatten(brep), isConditioned=Toggle(False))  # -> readMe, HBZone; plug-in component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
wires = BrepWireframe(Brep=createhbzones.HBZone, Density=-1)

decomposebytype = Honeybee_DecomposeBasedOnType(HBZone=createhbzones.HBZone)  # -> walls, interiorWalls, airWalls, windows, interiorWindows, skylights, roofs, ceilings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; plug-in component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
preview = CustomPreview(
    Geometry=decomposebytype.windows,
    Shader={ambient=RGB(0, 0, 0), diffuse=RGB(255, 105, 180), emission=RGB(76, 32, 54), shine=0.5, specular=RGB(255, 255, 255), transparency=0})
panel_9 = Panel(listzoneprograms)
setepnatvent = Honeybee_SetEPAirFlow(
    HBZones=flatten(createhbzones.HBZone),
    naturalVentilationType="1",
    minIndoorTempForNatVent="21",
    maxIndoorTempForNatVent="29",
    minOutdoorTempForNatVent="17",
    maxOutdoorTempForNatVent="30")  # -> readMe, simplify(HBZones); plug-in component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

# ----
# shading context
shading = Brep([<brep referenced from the Rhino model> x10])
hb_epcontextsrf = HoneybeeEPContextSurfaces(shdSurfaces=flatten(shading))  # -> HBContext; inputs shdSurfaces: list of Brep, justBoundingBox: Boolean
# ---------- hb_epcontextsrf: Python ----------
"""
prepare shading/context geometries

    Args:
        northVectorOrRotation: A vector that shows North or a number that shows
                               the rotation of the North from the Y axis
        bldgMasses: List of closed Breps as thermal zones.
    Returns:
        report: ...
        thermalZones: Thermal zone's geometries for visualiza
"""

ghenv.Component.Name = 'Honeybee EP context Surfaces'
ghenv.Component.NickName = 'HB_EPContextSrf'
ghenv.Component.Message = 'VER 0.0.62\nJUL_28_2017'
ghenv.Component.IconDisplayMode = ghenv.Component.IconDisplayMode.application
ghenv.Component.Category = "Honeybee"
ghenv.Component.SubCategory = "10 | Energy | Energy"
#compatibleHBVersion = VER 0.0.57\nNOV_04_2016
#compatibleLBVersion = VER 0.0.59\nFEB_01_2015
ghenv.Component.AdditionalHelpFromDocStrings = "2"

import rhinoscriptsyntax as rs
import Rhino as rc
import scriptcontext as sc
import os
import System
import Grasshopper.Kernel as gh
import uuid

tolerance = sc.doc.ModelAbsoluteTolerance
import math


def main(shdSurfaces, EPTransSchedule, meshingSettings, justBoundingBox):
    
    # import the classes
    if sc.sticky.has_key('honeybee_release'):

        try:
            if not sc.sticky['honeybee_release'].isCompatible(ghenv.Component): return -1
            if sc.sticky['honeybee_release'].isInputMissing(ghenv.Component): return -1
        except:
            warning = "You need a newer version of Honeybee to use this compoent." + \
            " Use updateHoneybee component to update userObjects.\n" + \
            "If you have already updated userObjects drag Honeybee_Honeybee component " + \
            "into canvas and try again."
            w = gh.GH_RuntimeMessageLevel.Warning
            ghenv.Component.AddRuntimeMessage(w, warning)
            return -1
        
        # don't customize this part
        hb_EPSrf = sc.sticky["honeybee_EPSurface"]
        hb_EPSHDSurface = sc.sticky["honeybee_EPShdSurface"]
        hb_RADMaterialAUX = sc.sticky["honeybee_RADMaterialAUX"]
        hb_EPObjectsAux = sc.sticky["honeybee_EPObjectsAUX"]()
        HBScheduleList = sc.sticky["honeybee_ScheduleLib"].keys()

        ########################################################################
        #----------------------------------------------------------------------#
        shdBreps = []
        # create bounding box of shading geometries
        if justBoundingBox:
            for brep in shdSurfaces:
                if brep.Faces.Count>1 or not brep.Faces[0].IsPlanar(sc.doc.ModelAbsoluteTolerance):
                    shdBreps.append(brep.GetBoundingBox(True).ToBrep())
                else:
                    shdBreps.append(brep)
        else:
            shdBreps = shdSurfaces
        
        shadingClasses = []
        shadingMeshPreview = []
        
        if meshingSettings == None:
            mp = rc.Geometry.MeshingParameters.Minimal
            mp.SimplePlanes = True
        else:
            mp = meshingSettings
        
        def getRadMaterialName(radMaterial):
            nameStr = radMaterial.split(" ")[2]
            name =  nameStr.split("\n")[0]
            return name
        
        for brepCount, brep in enumerate(shdBreps):
            if brep != None:
                isPlanar = True
                # check planarity
                for face in brep.Faces:
                    if not face.IsPlanar(tolerance):
                        isPlanar = False
                        break
                
                shadingBreps = []
                if not isPlanar:
                    meshArray = rc.Geometry.Mesh.CreateFromBrep(brep, mp)
                    for mesh in meshArray:
                        for meshFace in range(mesh.Faces.Count):
                            vertices = list(mesh.Faces.GetFaceVertices(meshFace))[1:]
                            vertices = vertices + [sc.doc.ModelAbsoluteTolerance]
                            # create the brep from mesh
                            shdBrep = rc.Geometry.Brep.CreateFromCornerPoints(*vertices)
                            shadingBreps.append(shdBrep)
                else:
                    for face in brep.Faces:
                        shadingBreps.append(face.DuplicateFace(False))
                
                for faceCount, shdBrep in enumerate(shadingBreps):
                        thisShading = hb_EPSHDSurface(shdBrep, 1000*brepCount + faceCount, 'shdSrf_' + `brepCount` + '_' + `faceCount` + "_" + str(uuid.uuid4()))
                        
                        # add transmittance schedule if any
                        if EPTransSchedule!=None:
                            schedule= EPTransSchedule.upper()
                            if schedule!=None and not schedule.lower().endswith(".csv") and schedule not in HBScheduleList:
                                msg = "Cannot find " + schedule + " in Honeybee schedule library."
                                print msg
                                ghenv.Component.AddRuntimeMessage(gh.GH_RuntimeMessageLevel.Warning, msg)
                                return -1
                            elif schedule!=None and schedule.lower().endswith(".csv"):
                                # check if csv file is existed
                                if not os.path.isfile(schedule):
                                    msg = "Cannot find the shchedule file: " + schedule
                                    print msg
                                    ghenv.Component.AddRuntimeMessage(gh.GH_RuntimeMessageLevel.Warning, msg)
                                    return -1
                            
                            thisShading.TransmittanceSCH = schedule
                        
                        # add the Rad Material if any
                        if RADMaterial!=None:
                            # if it is just the name of the material make sure it is already defined
                            if len(RADMaterial.split(" ")) == 1:
                                # if the material is not in the library add it to the library
                                if not hb_RADMaterialAUX.isMatrialExistInLibrary(RADMaterial):
                                    warningMsg = "Can't find " + RADMaterial + " in RAD Material Library.\n" + \
                                                "Add the material to the library and try again."
                                    ghenv.Component.AddRuntimeMessage(gh.GH_RuntimeMessageLevel.Warning, warningMsg)
                                    return
                                
                                try:
                                    thisShading.setRADMaterial(RADMaterial)
                                except Exception, e:
                                    print e
                                    warningMsg = "You are using an old version of Honeybee_Honeybee! Update your files and try again."
                                    print warningMsg
                                    ghenv.Component.AddRuntimeMessage(gh.GH_RuntimeMessageLevel.Warning, warningMsg)
                                    return
                                
                                addedToLib = True
                            else:
                                
                                # try to add the material to the library
                                addedToLib, thisShading.RadMaterial = hb_RADMaterialAUX.analyseRadMaterials(RADMaterial, True)
                                
                            if addedToLib==False:
                                warningMsg = "Failed to add " + RADMaterial + " to the Library."
                                ghenv.Component.AddRuntimeMessage(gh.GH_RuntimeMessageLevel.Warning, warningMsg)
                                return
                        
                        # add shading to the list
                        shadingClasses.append(thisShading)
                
        # add to the hive
        hb_hive = sc.sticky["honeybee_Hive"]()
        HBContext  = hb_hive.addToHoneybeeHive(shadingClasses, ghenv.Component)
        return HBContext
        ################################################################################################
    else:
        print "You should first let Honeybee to fly..."
        w = gh.GH_RuntimeMessageLevel.Warning
        ghenv.Component.AddRuntimeMessage(w, "You should first let Honeybee to fly...")
        return -1
        

if _shdSurfaces and _shdSurfaces[0]!=None:
    # add cleaning function
    result= main(_shdSurfaces, EPTransSchedule_, meshingSettings_, justBoundingBox_)
    
    if result != -1: HBContext = result
# ---------- end hb_epcontextsrf ----------

setepzoneloads = Honeybee_SetEnergyPlusZoneLoads(HBZones=setepnatvent.HBZones, infiltrationRatePerArea="0.0002")  # -> loads, HBZones; plug-in component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
epoutput = Honeybee_GenerateEPOutput(zoneGainsAndLosses="False", zoneComfortMetrics=Toggle(True), surfaceTempAnalysis="False")  # -> report, flatten(simulationOutputs); plug-in component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
toggle = BooleanToggle(False)
path = FilePath("C:\Users\User\Desktop\USA_PA_Philadelphia.Intl.AP.724080_TMY3.epw")
runenergysimulation = Honeybee_RunEnergySimulation(
    epwFile=path,
    HBZones=flatten(setepzoneloads.HBZones),
    HBContext=flatten(hb_epcontextsrf),
    simulationOutputs=flatten(epoutput.simulationOutputs),
    writeIdf=toggle,
    runEnergyPlus=toggle)  # -> report, idfFileAddress, htmlReport, resultFileAddress, eioFileAddress; plug-in component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
importepw = Ladybug_ImportEpw(epwFile=path)  # -> readMe, latitude, location, dryBulbTemperature, dewPointTemperature, relativeHumidity, windSpeed, windDirection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; plug-in component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
readepresult = Honeybee_ReadEPResult(resultFileAddress=runenergysimulation.resultFileAddress)  # -> totalThermalLoad, thermalLoadBalance, cooling, heating, electricLight, electricEquip, fanElectric, pumpElectric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; plug-in component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

# ----
# Psychometric Chart
activitieslist = Ladybug_ActivitiesMetList({"Sleeping": 0.7, "Reclining": 0.8, "Sitting": 1.0, "Typing": 1.1, "Standing": 1.2, "Driving": 1.5, "Cooking": 1.8, "House Cleaning": 2.7, "Strolling": 1.7, "Walking 2mph": 2.0, "Walking 3mph": 2.6, "Walking 4mph": 3.8, "Running 9mph": 9.5, "Lifting 10lbs": 2.1, "Lifting 100lbs": 4.0, "Shoveling": 4.4, "Dancing": 3.4, "Basketball": 6.3}, selected="Standing")
activitieslist_2 = Ladybug_ActivitiesMetList({"Sleeping": 0.7, "Reclining": 0.8, "Sitting": 1.0, "Typing": 1.1, "Standing": 1.2, "Driving": 1.5, "Cooking": 1.8, "House Cleaning": 2.7, "Strolling": 1.7, "Walking 2mph": 2.0, "Walking 3mph": 2.6, "Walking 4mph": 3.8, "Running 9mph": 9.5, "Lifting 10lbs": 2.1, "Lifting 100lbs": 4.0, "Shoveling": 4.4, "Dancing": 3.4, "Basketball": 6.3}, selected="Sleeping")
activitieslist_3 = Ladybug_ActivitiesMetList({"Sleeping": 0.7, "Reclining": 0.8, "Sitting": 1.0, "Typing": 1.1, "Standing": 1.2, "Driving": 1.5, "Cooking": 1.8, "House Cleaning": 2.7, "Strolling": 1.7, "Walking 2mph": 2.0, "Walking 3mph": 2.6, "Walking 4mph": 3.8, "Running 9mph": 9.5, "Lifting 10lbs": 2.1, "Lifting 100lbs": 4.0, "Shoveling": 4.4, "Dancing": 3.4, "Basketball": 6.3}, selected="Sitting")
psychchart = Ladybug_PsychrometricChart(
    dryBulbTemperature=readepresult.airTemperature,
    relativeHumidity=readepresult.relativeHumidity,
    barometricPressure=importepw.barometricPressure,
    metabolicRate=[activitieslist, activitieslist_3, activitieslist_2, "0.8"],
    clothingLevel="0.8",
    mergeComfPolygons=Toggle(True),
    runIt=Toggle(True))  # -> readMe, port, totalComfortPercent, totalComfortOrNot, strategyNames, strategyPercentOfTime, strategyOrNot, port_2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; plug-in component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
panel_10 = Panel(psychchart.totalComfortPercent)

# ----
# Energy Balance Graph
toggle_2 = BooleanToggle(True)
epoutput_2 = Honeybee_GenerateEPOutput(
    zoneEnergyUse=toggle_2,
    zoneGainsAndLosses=toggle_2,
    zoneComfortMetrics="False",
    surfaceTempAnalysis="False",
    surfaceEnergyAnalysis=toggle_2)  # -> report, flatten(simulationOutputs); plug-in component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
toggle_3 = BooleanToggle(True)
runenergysimulation_2 = Honeybee_RunEnergySimulation(
    epwFile=path,
    HBZones=flatten(setepzoneloads.HBZones),
    HBContext=flatten(hb_epcontextsrf),
    simulationOutputs=flatten(epoutput_2.simulationOutputs),
    writeIdf=toggle_3,
    runEnergyPlus=toggle_3)  # -> report, idfFileAddress, htmlReport, resultFileAddress, eioFileAddress; plug-in component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
readepresult_2 = Honeybee_ReadEPResult(resultFileAddress=runenergysimulation_2.resultFileAddress)  # -> port, port_2, port_3, port_4, electricLight, electricEquip, fanElectric, port_5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; plug-in component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
readepsrfresult = Honeybee_ReadEPSurfaceResult(resultFileAddress=runenergysimulation_2.resultFileAddress)  # -> port, port_2, surfaceEnergyFlow, opaqueEnergyFlow, glazEnergyFlow, port_3, port_4, port_5, port_6, port_7; plug-in component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
energybalance = Honeybee_ConstructEnergyBalance(
    HBZones=flatten(setepzoneloads.HBZones),
    electricLight=readepresult_2.electricLight,
    electricEquip=readepresult_2.electricEquip,
    peopleGains=readepresult_2.peopleGains,
    totalSolarGain=readepresult_2.totalSolarGain,
    infiltrationEnergy=readepresult_2.infiltrationEnergy,
    natVentEnergy=readepresult_2.natVentEnergy,
    surfaceEnergyFlow=readepsrfresult.surfaceEnergyFlow)  # -> readMe, port, flrNormEnergyBal, flrNormBalWStorage, port_2, modelEnergyBalance, energyBalWithStorage; plug-in component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
gradientlibrary = Ladybug_GradientLibrary(gradIndex="19")  # -> customColors; plug-in component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
legendpar = Ladybug_LegendParameters(lowBound="-20", highBound="20", numSegments="11", customColors=flatten(gradientlibrary))  # -> legendPar; plug-in component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
selectandaveragedata = Ladybug_AverageData(annualHourlyData=energybalance.flrNormBalWStorage, totalOrAverage=Toggle(True))  # -> readMe, selHourlyData, totaledDaily, totaledMonthly, totMonthlyPerHour, totAnalysisPeriod; plug-in component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
barchart = Ladybug_MonthlyBarChart(
    inputData=flatten(selectandaveragedata.totaledMonthly),
    stackValues=Toggle(True),
    altTitle="My Room Energy Balance",
    altYAxisTitle="Energy (kWh)",
    legendPar=legendpar)  # -> readMe, dataMesh, dataCurves, dataCrvColors, graphAxes, graphLabels, title, titleBasePt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; plug-in component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

# ----
# Comfort Analysis
adaptivecomfortcalculator = Ladybug_AdaptiveComfortCalculator(
    dryBulbTemperature=readepresult.airTemperature,
    meanRadiantTemperature=readepresult.meanRadTemperature,
    prevailingOutdoorTemp=importepw.dryBulbTemperature,
    runIt=Toggle(True))  # -> readMe, port, comfortableOrNot, conditionOfPerson, degreesFromTarget, port_2, targetTemperature, upperTemperatureBound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; plug-in component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
panel_11 = Panel(adaptivecomfortcalculator.percentOfTimeComfortable)
legendpar_2 = Ladybug_LegendParameters(lowBound="-1", highBound="1", numSegments="3", fontSize="8", decimalPlaces="0")  # -> legendPar; plug-in component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
_3dchart = Ladybug_3DChart(inputData=flatten(adaptivecomfortcalculator.conditionOfPerson), xScale="0.2", legendPar=legendpar_2)  # -> readMe, graphMesh, graphCurves, legend, legendBasePts, title, titleBasePts, dataPts, conditionalHOY; plug-in component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
