# Grasshopper definition kamath_ayodh_2.gh (Grasshopper 0.9.76)
# plug-ins: Python Interpreter

ladybug = Ladybug_Ladybug()  # -> Vviiiiiiiiiizzz; plug-in component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
honeybee = Honeybee_Honeybee()  # -> Vviiiiiiiiiizzz; plug-in component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

# ---- group: Shading Curves
crv = Curve([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])

# ----
callfromepconstrlibrary = Honeybee_CallFromEPConstructionLibrary(keywords="wood")  # -> ThermMaterials, EPMaterials, EPWindowMaterials, EPConstructions; plug-in component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
callfromepconstrlibrary_2 = Honeybee_CallFromEPConstructionLibrary(keywords="window")  # -> ThermMaterials, EPMaterials, EPWindowMaterials, EPConstructions; plug-in component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
item = ListItem(List=callfromepconstrlibrary.EPConstructions, Index="24", Wrap=True)
item_2 = ListItem(List=callfromepconstrlibrary_2.EPConstructions, Index="66", Wrap=True)
panel = Panel(callfromepconstrlibrary.EPConstructions)
panel_2 = Panel(callfromepconstrlibrary_2.EPConstructions)

# ---- group: My best guess about the window construction
panel_3 = Panel(item_2)

# ---- group: My best guess about the wall construction
panel_4 = Panel(item)

# ---- group: Optimized Values = -0.8, -0.35
number_slider = Slider(-0.8, range=-1..0)
number_slider_2 = Slider(-0.35, range=-1..0)

# ----
brep = Brep(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)
brep_2 = Brep(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)
brep_3 = Brep(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)
brep_4 = Brep(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)
brep_5 = Brep([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])
brep_6 = Brep([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])
bbox = BoundingBox(Content=brep_2, Plane=PlaneXY(0, 0, 0))  # -> Box, Box_2
createhbsrfs = Honeybee_createHBSrfs(geometry=brep_5, srfName="internalWalls", srfType="0")  # -> readMe, simplify(HBSurface); plug-in component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
createhbsrfs_2 = Honeybee_createHBSrfs(geometry=brep_3, srfName="floor", srfType="2")  # -> readMe, simplify(HBSurface); plug-in component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
createhbsrfs_3 = Honeybee_createHBSrfs(geometry=brep_4, srfName="ceiling", srfType="3")  # -> readMe, simplify(HBSurface); plug-in component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
createhbsrfs_4 = Honeybee_createHBSrfs(geometry=brep, srfName="externalWall", srfType="0", EPConstruction=item)  # -> readMe, simplify(HBSurface); plug-in component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
createhbsrfs_5 = Honeybee_createHBSrfs(geometry=brep_2, srfName="windows", srfType="5", EPConstruction=item_2)  # -> readMe, simplify(HBSurface); plug-in component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
smaller = SmallerThan(FirstNumber=number_slider, SecondNumber=number_slider_2)  # -> SmallerThan, OrEqualTo
box_corners = BoxCorners(Box=bbox.Box)  # -> CornerA, CornerB, CornerC, CornerD, CornerE, CornerF, CornerG, CornerH
X = UnitX(Factor=number_slider)
X_2 = UnitX(Factor=number_slider_2)
move = Move(Geometry=box_corners.CornerA, Motion=X)  # -> Geometry, Transform
move_2 = Move(Geometry=box_corners.CornerE, Motion=X_2)  # -> Geometry, Transform
vec2pt = Vector2Pt(PointA=box_corners.CornerB, PointB=box_corners.CornerC, Unitize=False)  # -> Vector, Length
p_n_c = PickNChoose(Pattern=smaller.SmallerThan, Stream0=X_2, Stream1=X)
ln = Line(StartPoint=move.Geometry, EndPoint=move_2.Geometry)
addhbglz = Honeybee_addHBGlz(HBObj=createhbsrfs_4.HBSurface, childSurfaces=flatten(createhbsrfs_5.HBSurface))  # -> HBObjWGLZ; plug-in component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

# ---- group: Assumes neighbours + corridor @ same temperature
makeadiabatic = Honeybee_MakeAdiabatic(HBSrfs=[createhbsrfs.HBSurface, createhbsrfs_2.HBSurface, createhbsrfs_3.HBSurface])  # -> HBSrfs; plug-in component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

# ----
pl = ConstructPlane(Origin=move.Geometry, XAxis=ln, YAxis=vec2pt.Vector)
extr = Extrude(Base=crv, Direction=p_n_c)
sec = BrepPlane(Brep=extr, Plane=pl)  # -> Curves, Points
bldgprograms = Honeybee_bldgPrograms({"Office": 0, "Retail": 1, "MidriseApartment": 2, "PrimarySchool": 3, "SecondarySchool": 4, "SmallHotel": 5, "LargeHotel": 6, "Hospital": 7, "Outpatient": 8, "Warehouse": 9, "SuperMarket": 10, "FullServiceRestaurant": 11, "QuickServiceRestaurant": 12}, selected="MidriseApartment")
brep_7 = Brep(flatten([makeadiabatic, addhbglz]))
short = ShortestList(ListA=crv, ListB=flatten(sec.Curves), TrimMode=2)  # -> ListA, ListB
flip = FlipCurve(Curve=short.ListB)  # -> Curve, Flag
listzoneprograms = Honeybee_ListZonePrograms(bldgProgram=bldgprograms)  # -> MidriseApartmentZonePrograms; plug-in component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
rulesrf = RuledSurface(CurveA=short.ListA, CurveB=flip.Curve)
hb_epcontextsrf = HoneybeeEPContextSurfaces(shdSurfaces=flatten([brep_6, rulesrf]), justBoundingBox=Toggle(True))  # -> HBContext; inputs shdSurfaces: list of Brep, justBoundingBox: Boolean
# ---------- hb_epcontextsrf: Python ----------
"""
prepare shading/context geometries

    Args:
        northVectorOrRotation: A vector that shows North or a number that shows
                               the rotation of the North from the Y axis
        bldgMasses: List of closed Breps as thermal zones.
    Returns:
        report: ...
        thermalZones: Thermal zone's geometries for visualiza
"""

ghenv.Component.Name = 'Honeybee EP context Surfaces'
ghenv.Component.NickName = 'HB_EPContextSrf'
ghenv.Component.Message = 'VER 0.0.62\nJUL_28_2017'
ghenv.Component.IconDisplayMode = ghenv.Component.IconDisplayMode.application
ghenv.Component.Category = "Honeybee"
ghenv.Component.SubCategory = "10 | Energy | Energy"
#compatibleHBVersion = VER 0.0.57\nNOV_04_2016
#compatibleLBVersion = VER 0.0.59\nFEB_01_2015
ghenv.Component.AdditionalHelpFromDocStrings = "2"

import rhinoscriptsyntax as rs
import Rhino as rc
import scriptcontext as sc
import os
import System
import Grasshopper.Kernel as gh
import uuid

tolerance = sc.doc.ModelAbsoluteTolerance
import math


def main(shdSurfaces, EPTransSchedule, meshingSettings, justBoundingBox):
    
    # import the classes
    if sc.sticky.has_key('honeybee_release'):

        try:
            if not sc.sticky['honeybee_release'].isCompatible(ghenv.Component): return -1
            if sc.sticky['honeybee_release'].isInputMissing(ghenv.Component): return -1
        except:
            warning = "You need a newer version of Honeybee to use this compoent." + \
            " Use updateHoneybee component to update userObjects.\n" + \
            "If you have already updated userObjects drag Honeybee_Honeybee component " + \
            "into canvas and try again."
            w = gh.GH_RuntimeMessageLevel.Warning
            ghenv.Component.AddRuntimeMessage(w, warning)
            return -1
        
        # don't customize this part
        hb_EPSrf = sc.sticky["honeybee_EPSurface"]
        hb_EPSHDSurface = sc.sticky["honeybee_EPShdSurface"]
        hb_RADMaterialAUX = sc.sticky["honeybee_RADMaterialAUX"]
        hb_EPObjectsAux = sc.sticky["honeybee_EPObjectsAUX"]()
        HBScheduleList = sc.sticky["honeybee_ScheduleLib"].keys()

        ########################################################################
        #----------------------------------------------------------------------#
        shdBreps = []
        # create bounding box of shading geometries
        if justBoundingBox:
            for brep in shdSurfaces:
                if brep.Faces.Count>1 or not brep.Faces[0].IsPlanar(sc.doc.ModelAbsoluteTolerance):
                    shdBreps.append(brep.GetBoundingBox(True).ToBrep())
                else:
                    shdBreps.append(brep)
        else:
            shdBreps = shdSurfaces
        
        shadingClasses = []
        shadingMeshPreview = []
        
        if meshingSettings == None:
            mp = rc.Geometry.MeshingParameters.Minimal
            mp.SimplePlanes = True
        else:
            mp = meshingSettings
        
        def getRadMaterialName(radMaterial):
            nameStr = radMaterial.split(" ")[2]
            name =  nameStr.split("\n")[0]
            return name
        
        for brepCount, brep in enumerate(shdBreps):
            if brep != None:
                isPlanar = True
                # check planarity
                for face in brep.Faces:
                    if not face.IsPlanar(tolerance):
                        isPlanar = False
                        break
                
                shadingBreps = []
                if not isPlanar:
                    meshArray = rc.Geometry.Mesh.CreateFromBrep(brep, mp)
                    for mesh in meshArray:
                        for meshFace in range(mesh.Faces.Count):
                            vertices = list(mesh.Faces.GetFaceVertices(meshFace))[1:]
                            vertices = vertices + [sc.doc.ModelAbsoluteTolerance]
                            # create the brep from mesh
                            shdBrep = rc.Geometry.Brep.CreateFromCornerPoints(*vertices)
                            shadingBreps.append(shdBrep)
                else:
                    for face in brep.Faces:
                        shadingBreps.append(face.DuplicateFace(False))
                
                for faceCount, shdBrep in enumerate(shadingBreps):
                        thisShading = hb_EPSHDSurface(shdBrep, 1000*brepCount + faceCount, 'shdSrf_' + `brepCount` + '_' + `faceCount` + "_" + str(uuid.uuid4()))
                        
                        # add transmittance schedule if any
                        if EPTransSchedule!=None:
                            schedule= EPTransSchedule.upper()
                            if schedule!=None and not schedule.lower().endswith(".csv") and schedule not in HBScheduleList:
                                msg = "Cannot find " + schedule + " in Honeybee schedule library."
                                print msg
                                ghenv.Component.AddRuntimeMessage(gh.GH_RuntimeMessageLevel.Warning, msg)
                                return -1
                            elif schedule!=None and schedule.lower().endswith(".csv"):
                                # check if csv file is existed
                                if not os.path.isfile(schedule):
                                    msg = "Cannot find the shchedule file: " + schedule
                                    print msg
                                    ghenv.Component.AddRuntimeMessage(gh.GH_RuntimeMessageLevel.Warning, msg)
                                    return -1
                            
                            thisShading.TransmittanceSCH = schedule
                        
                        # add the Rad Material if any
                        if RADMaterial!=None:
                            # if it is just the name of the material make sure it is already defined
                            if len(RADMaterial.split(" ")) == 1:
                                # if the material is not in the library add it to the library
                                if not hb_RADMaterialAUX.isMatrialExistInLibrary(RADMaterial):
                                    warningMsg = "Can't find " + RADMaterial + " in RAD Material Library.\n" + \
                                                "Add the material to the library and try again."
                                    ghenv.Component.AddRuntimeMessage(gh.GH_RuntimeMessageLevel.Warning, warningMsg)
                                    return
                                
                                try:
                                    thisShading.setRADMaterial(RADMaterial)
                                except Exception, e:
                                    print e
                                    warningMsg = "You are using an old version of Honeybee_Honeybee! Update your files and try again."
                                    print warningMsg
                                    ghenv.Component.AddRuntimeMessage(gh.GH_RuntimeMessageLevel.Warning, warningMsg)
                                    return
                                
                                addedToLib = True
                            else:
                                
                                # try to add the material to the library
                                addedToLib, thisShading.RadMaterial = hb_RADMaterialAUX.analyseRadMaterials(RADMaterial, True)
                                
                            if addedToLib==False:
                                warningMsg = "Failed to add " + RADMaterial + " to the Library."
                                ghenv.Component.AddRuntimeMessage(gh.GH_RuntimeMessageLevel.Warning, warningMsg)
                                return
                        
                        # add shading to the list
                        shadingClasses.append(thisShading)
                
        # add to the hive
        hb_hive = sc.sticky["honeybee_Hive"]()
        HBContext  = hb_hive.addToHoneybeeHive(shadingClasses, ghenv.Component)
        return HBContext
        ################################################################################################
    else:
        print "You should first let Honeybee to fly..."
        w = gh.GH_RuntimeMessageLevel.Warning
        ghenv.Component.AddRuntimeMessage(w, "You should first let Honeybee to fly...")
        return -1
        

if _shdSurfaces and _shdSurfaces[0]!=None:
    # add cleaning function
    result= main(_shdSurfaces, EPTransSchedule_, meshingSettings_, justBoundingBox_)
    
    if result != -1: HBContext = result
# ---------- end hb_epcontextsrf ----------
index = ItemIndex(List=listzoneprograms, Item=0)
createhbzones = Honeybee_createHBZones(name="room", zoneProgram=index, HBSurfaces=flatten(brep_7), isConditioned=Toggle(False))  # -> readMe, HBZone; plug-in component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
setepnatvent = Honeybee_SetEPAirFlow(
    HBZones=flatten(createhbzones.HBZone),
    naturalVentilationType="1",
    minIndoorTempForNatVent="20",
    maxOutdoorTempForNatVent="30",
    fractionOfGlzHeightOperable="0.5")  # -> readMe, simplify(HBZones); plug-in component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

# ---- group: 4 x 6W LED bulbs
multiplication = Multiplication(A="4", B="6")
area = Area(Geometry=brep_3)  # -> Area, Centroid
division = Division(A=multiplication, B=area.Area)

# ---- group: Tight windows
area_2 = Area(Geometry=brep)  # -> Area, Centroid
multiplication_2 = Multiplication(A="0.0001", B=area_2.Area)

# ---- group: One occupant
area_3 = Area(Geometry=brep_3)  # -> Area, Centroid
division_2 = Division(A="1", B=area_3.Area)

# ---- group: Laptop + Refrigerator
panel_5 = Panel("2")

# ----
setepzoneloads = Honeybee_SetEnergyPlusZoneLoads(
    HBZones=setepnatvent.HBZones,
    equipmentLoadPerArea=panel_5,
    infiltrationRatePerArea=multiplication_2,
    lightingDensityPerArea=division,
    numOfPeoplePerArea=division_2,
    ventilationPerArea="0",
    ventilationPerPerson="0",
    recirculatedAirPerArea="0")  # -> loads, HBZones; plug-in component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
changehbobjname = Honeybee_ChangeHBObjName(HBObjects=createhbzones.HBZone, names="Fixed Windows")  # -> HBObjects; plug-in component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
changehbobjname_2 = Honeybee_ChangeHBObjName(HBObjects=setepnatvent.HBZones, names="Openable Windows+No Infiltration")  # -> HBObjects; plug-in component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
changehbobjname_3 = Honeybee_ChangeHBObjName(HBObjects=setepzoneloads.HBZones, names="Openable Windows+Internal Loads+Minimum Infiltration")  # -> HBObjects; plug-in component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
toggle = BooleanToggle(True)
epoutput = Honeybee_GenerateEPOutput(
    zoneEnergyUse=toggle,
    zoneGainsAndLosses=toggle,
    zoneComfortMetrics=toggle,
    surfaceTempAnalysis="False",
    surfaceEnergyAnalysis=toggle)  # -> report, flatten(simulationOutputs); plug-in component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

# ---- group: Run
toggle_2 = BooleanToggle(False)

# ----
# Make sure there are no spaces in the file path
path = FilePath("C:\Users\Ayodh\Documents\Us\Ayodh\UPenn\1709\753\USA_PA_Philadelphia.Intl.AP.724080_TMY3\USA_PA_Philadelphia.Intl.AP.724080_TMY3.epw")

runenergysimulation = Honeybee_RunEnergySimulation(
    epwFile=path,
    HBZones=flatten(changehbobjname_3),
    HBContext=flatten(hb_epcontextsrf),
    simulationOutputs=flatten(epoutput.simulationOutputs),
    writeIdf=toggle_2,
    runEnergyPlus=toggle_2)  # -> report, idfFileAddress, htmlReport, resultFileAddress; plug-in component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
importepw = Ladybug_ImportEpw(epwFile=path)  # -> readMe, latitude, location, dryBulbTemperature, dewPointTemperature, relativeHumidity, windSpeed, windDirection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; plug-in component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
readepsrfresult = Honeybee_ReadEPSurfaceResult(resultFileAddress=runenergysimulation.resultFileAddress)  # -> surfaceIndoorTemp, surfaceOutdoorTemp, surfaceEnergyFlow, opaqueEnergyFlow, glazEnergyFlow, windowTotalSolarEnergy, windowBeamEnergy, windowDiffEnergy, windowTransmissivity, otherSurfaceData; plug-in component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
readepresult = Honeybee_ReadEPResult(resultFileAddress=runenergysimulation.resultFileAddress)  # -> totalThermalLoad, thermalLoadBalance, cooling, heating, electricLight, electricEquip, fanElectric, pumpElectric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; plug-in component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
adaptivecomfortcalculator = Ladybug_AdaptiveComfortCalculator(
    dryBulbTemperature=readepresult.airTemperature,
    meanRadiantTemperature=readepresult.meanRadTemperature,
    prevailingOutdoorTemp=importepw.dryBulbTemperature,
    runIt=Toggle(True))  # -> readMe, port, comfortableOrNot, conditionOfPerson, degreesFromTarget, port_2, targetTemperature, upperTemperatureBound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; plug-in component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
energybalance = Honeybee_ConstructEnergyBalance(
    HBZones=flatten(setepzoneloads.HBZones),
    electricLight=readepresult.electricLight,
    electricEquip=readepresult.electricEquip,
    peopleGains=readepresult.peopleGains,
    totalSolarGain=readepresult.totalSolarGain,
    infiltrationEnergy=readepresult.infiltrationEnergy,
    natVentEnergy=readepresult.natVentEnergy,
    surfaceEnergyFlow=readepsrfresult.surfaceEnergyFlow)  # -> readMe, port, flrNormEnergyBal, flrNormBalWStorage, port_2, modelEnergyBalance, energyBalWithStorage; plug-in component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
legendpar = Ladybug_LegendParameters(
    numSegments="3",
    customColors=reverse(flatten([ColourSwatch(SwatchColor=RGB(255, 0, 0)), ColourSwatch(SwatchColor=RGB(255, 255, 255)), ColourSwatch(SwatchColor=RGB(0, 0, 255))])))  # -> legendPar; plug-in component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
interior_temperature = Panel(readepresult.airTemperature)
panel_6 = Panel(adaptivecomfortcalculator.percentOfTimeComfortable)
gradientlibrary = Ladybug_GradientLibrary(gradIndex="19")  # -> customColors; plug-in component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
selectandaveragedata = Ladybug_AverageData(annualHourlyData=energybalance.modelEnergyBalance, totalOrAverage=Toggle(True))  # -> readMe, selHourlyData, totaledDaily, totaledMonthly, totMonthlyPerHour, totMonthlyMinPerHour, totMonthlyMaxPerHour; plug-in component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
exterior_teperature = Panel(importepw.dryBulbTemperature)
_3dchart = Ladybug_3DChart(inputData=flatten(adaptivecomfortcalculator.conditionOfPerson), xScale="0.25", zScale="0", legendPar=legendpar)  # -> readMe, graphMesh, graphCurves, legend, legendBasePts, title, titleBasePts, dataPts, conditionalHOY; plug-in component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
pdecon = Deconstruct(Point=_3dchart.legendBasePts)  # -> XComponent, YComponent, ZComponent
txt = Text(panel_6)
bbox_2 = BoundingBox(Content=_3dchart.graphMesh, Plane=PlaneXY(0, 0, 0))  # -> Box, Box_2
subtraction = Subtraction(A=pdecon.YComponent, B="10")
concat = Concatenate(FragmentA="Time of year comfortable: ", FragmentB=txt, FragmentC="%")
box_corners_2 = BoxCorners(Box=bbox_2.Box)  # -> CornerA, CornerB, CornerC, CornerD, CornerE, CornerF, CornerG, CornerH
addition = Addition(A=pdecon.XComponent, B="15")
dist = Distance(PointA=box_corners_2.CornerA, PointB=box_corners_2.CornerB)
dist_2 = Distance(PointA=box_corners_2.CornerB, PointB=box_corners_2.CornerC)
pt = ConstructPoint(XCoordinate=addition, YCoordinate=subtraction, ZCoordinate=pdecon.ZComponent)
pdecon_2 = Deconstruct(Point=box_corners_2.CornerD)  # -> XComponent, YComponent, ZComponent
tag = TextTag3D(Location=pt, Text=concat, Size="5", Colour=ColourSwatch(SwatchColor=RGB(0, 0, 0)), Justification=7)
toggle_3 = BooleanToggle(True)
barchart = Ladybug_MonthlyBarChart(inputData=flatten(selectandaveragedata.totaledMonthly), stackValues=toggle_3)  # -> readMe, dataMesh, dataCurves, dataCrvColors, graphAxes, graphLabels, title, titleBasePt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; plug-in component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
bbox_3 = BoundingBox(Content=barchart.graphAxes, Plane=PlaneXY(0, 0, 0), UnionBox=True)  # -> Box, Box_2
box_corners_3 = BoxCorners(Box=bbox_3.Box)  # -> CornerA, CornerB, CornerC, CornerD, CornerE, CornerF, CornerG, CornerH
dist_3 = Distance(PointA=box_corners_3.CornerA, PointB=box_corners_3.CornerB)
dist_4 = Distance(PointA=box_corners_3.CornerB, PointB=box_corners_3.CornerC)
division_3 = Division(A=dist, B=dist_3)
division_4 = Division(A=dist_2, B=dist_4)
legendpar_2 = Ladybug_LegendParameters(highBound="350", customColors=reverse(flatten(gradientlibrary)), fontSize=division_4)  # -> legendPar; plug-in component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
addition_2 = Addition(A=pdecon_2.YComponent, B=division_3)
multiplication_3 = Multiplication(A=addition_2, B="1.25")
pt_2 = ConstructPoint(XCoordinate=pdecon_2.XComponent, YCoordinate=multiplication_3, ZCoordinate=pdecon_2.ZComponent)
barchart_2 = Ladybug_MonthlyBarChart(
    inputData=flatten(selectandaveragedata.totaledMonthly),
    stackValues=toggle_3,
    altTitle="Studio Apartment Energy Balance",
    altYAxisTitle="Energy (kWh)",
    basePoint=pt_2,
    xScale=division_3,
    yScale=division_4,
    legendPar=legendpar_2)  # -> readMe, dataMesh, dataCurves, dataCrvColors, graphAxes, graphLabels, title, titleBasePt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; plug-in component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
preview = CustomPreview(Geometry=[barchart_2.graphAxes, _3dchart.graphCurves], Shader=ColourSwatch(SwatchColor=RGB(0, 0, 0)))
