# Grasshopper definition kennedy_kirin.gh (Grasshopper 0.9.76)
# plug-ins: Python Interpreter

ladybug = Ladybug_Ladybug()  # -> Vviiiiiiiiiizzz; plug-in component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
honeybee = Honeybee_Honeybee()  # -> Vviiiiiiiiiizzz; plug-in component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

# ---- group: ceiling
ceiling = Brep(<brep referenced from the Rhino model>)

# ---- group: floor
floor = Brep(<brep referenced from the Rhino model>)

# ----
r_value_h_ft2_f_btu = Panel("26")
r_value_h_ft2_f_btu_2 = Panel("25")
r_value_h_ft2_f_btu_3 = Panel("25")
construction_name = Panel("Baseline Roof")
construction_name_2 = Panel("Baseline Wall")
construction_name_3 = Panel("Baseline Floor")
uip2usi = Ladybug_uIP2uSI(U_IP=".22")  # -> U_SI; plug-in component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
rip2rsi = Ladybug_rIP2rSI(R_IP=r_value_h_ft2_f_btu_2)  # -> R_SI; plug-in component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
rip2rsi_2 = Ladybug_rIP2rSI(R_IP=r_value_h_ft2_f_btu)  # -> R_SI; plug-in component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
rip2rsi_3 = Ladybug_rIP2rSI(R_IP=r_value_h_ft2_f_btu_3)  # -> R_SI; plug-in component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
panel = Panel(uip2usi)
epnomassmat = Honeybee_EnergyPlusNoMassOpaqueMaterial(name=construction_name, R_Value=rip2rsi)  # -> EPMaterial; plug-in component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
epnomassmat_2 = Honeybee_EnergyPlusNoMassOpaqueMaterial(name=construction_name_2, R_Value=rip2rsi_2)  # -> EPMaterial; plug-in component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
epnomassmat_3 = Honeybee_EnergyPlusNoMassOpaqueMaterial(name=construction_name_3, R_Value=rip2rsi_3)  # -> EPMaterial; plug-in component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
wall_surface_with_opening = Brep(<brep referenced from the Rhino model>)
walls = Brep([<brep referenced from the Rhino model> x3])
epwindowmat = Honeybee_EnergyPlusWindowMaterial(name="Low_e_Argon_Vinyl", U_Value=uip2usi, SHGC=".22", VT=".5")  # -> EPMaterial; plug-in component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
epconstruction = Honeybee_EnergyPlusConstruction(name=construction_name, layer_1=epnomassmat)  # -> EPConstruction; plug-in component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
epconstruction_2 = Honeybee_EnergyPlusConstruction(name=construction_name_2, layer_1=epnomassmat_2)  # -> EPConstruction; plug-in component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
epconstruction_3 = Honeybee_EnergyPlusConstruction(name=construction_name_3, layer_1=epnomassmat_3)  # -> EPConstruction; plug-in component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
area = Area(Geometry=floor)  # -> Area, Centroid
epconstruction_4 = Honeybee_EnergyPlusConstruction(name="Low_e_Argon_Vinyl", layer_1=epwindowmat)  # -> EPConstruction; plug-in component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
panel_2 = Panel(epwindowmat)
createhbsrfs = Honeybee_createHBSrfs(geometry=wall_surface_with_opening, srfType="0", EPConstruction=epconstruction_2)  # -> readMe, simplify(HBSurface); plug-in component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
createhbsrfs_2 = Honeybee_createHBSrfs(geometry=walls, srfType="0", EPConstruction=epconstruction_2)  # -> readMe, simplify(HBSurface); plug-in component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
createhbsrfs_3 = Honeybee_createHBSrfs(geometry=flatten(floor), srfType="2", EPConstruction=epconstruction_3)  # -> readMe, simplify(HBSurface); plug-in component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
createhbsrfs_4 = Honeybee_createHBSrfs(geometry=ceiling, srfType="3", EPConstruction=epconstruction)  # -> readMe, simplify(HBSurface); plug-in component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
panel_3 = Panel(area.Area)
glass = Brep([<brep referenced from the Rhino model> x2])
preview = CustomPreview(Geometry=glass, Shader=ColourSwatch(SwatchColor=RGBA(80, 222, 255, 160)))
addhbglz = Honeybee_addHBGlz(HBObj=createhbsrfs.HBSurface, childSurfaces=flatten(glass), EPConstructions=epconstruction_4)  # -> simplify(HBObjWGLZ); plug-in component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
makeadiabatic = Honeybee_MakeAdiabatic(HBSrfs=[createhbsrfs_2.HBSurface, createhbsrfs_4.HBSurface, createhbsrfs_3.HBSurface])  # -> HBSrfs; plug-in component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

# ---- group: collect all honeybee surfaces
brep = Brep(flatten([makeadiabatic, addhbglz]))

# ----
gradientlibrary = Ladybug_GradientLibrary(gradIndex="19")  # -> customColors; plug-in component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
legendpar = Ladybug_LegendParameters(lowBound="-55", highBound="55", customColors=flatten(gradientlibrary))  # -> legendPar; plug-in component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
legendpar_2 = Ladybug_LegendParameters(lowBound="-1", highBound="1", numSegments="3")  # -> legendPar; plug-in component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
legendpar_3 = Ladybug_LegendParameters(lowBound="-1", highBound="1", numSegments="3")  # -> legendPar; plug-in component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
item = ListItem(Index=0, Wrap=True)
pt = Point(<point referenced from the Rhino model>)
pt_2 = Point(<point referenced from the Rhino model>)

panel_4 = Panel("1.893")
panel_5 = Panel("2.27")
pt_3 = ConstructPoint(XCoordinate="1", YCoordinate="-.1", ZCoordinate=["1.139", "1.516", ".762"])
panel_6 = Panel("1,0,1.516")
planesrf = PlaneSurface(Plane=pt_3, XSize="3.362", YSize="1.1")

planesrf_2 = PlaneSurface(Plane="1,-2.11,1.899", XSize="3.362", YSize="4.56")

geo = Geometry([planesrf, planesrf_2])
createhbsrfs_5 = Honeybee_createHBSrfs(geometry=flatten([planesrf, planesrf_2]), srfType="6")  # -> readMe, simplify(HBSurface); plug-in component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
hb_epcontextsrf = HoneybeeEPContextSurfaces(shdSurfaces=flatten(geo))  # -> HBContext; inputs shdSurfaces: list of GeometryBase, justBoundingBox: Boolean
# ---------- hb_epcontextsrf: Python ----------
"""
prepare shading/context geometries

    Args:
        northVectorOrRotation: A vector that shows North or a number that shows
                               the rotation of the North from the Y axis
        bldgMasses: List of closed Breps as thermal zones.
    Returns:
        report: ...
        thermalZones: Thermal zone's geometries for visualiza
"""

ghenv.Component.Name = 'Honeybee EP context Surfaces'
ghenv.Component.NickName = 'HB_EPContextSrf'
ghenv.Component.Message = 'VER 0.0.60\nNOV_04_2016'
ghenv.Component.IconDisplayMode = ghenv.Component.IconDisplayMode.application
ghenv.Component.Category = "Honeybee"
ghenv.Component.SubCategory = "10 | Energy | Energy"
#compatibleHBVersion = VER 0.0.57\nNOV_04_2016
#compatibleLBVersion = VER 0.0.59\nFEB_01_2015
ghenv.Component.AdditionalHelpFromDocStrings = "2"

import rhinoscriptsyntax as rs
import Rhino as rc
import scriptcontext as sc
import os
import System
import Grasshopper.Kernel as gh
import uuid

tolerance = sc.doc.ModelAbsoluteTolerance
import math


def main(shdSurfaces, EPTransSchedule, meshingSettings, justBoundingBox):
    
    # import the classes
    if sc.sticky.has_key('honeybee_release'):

        try:
            if not sc.sticky['honeybee_release'].isCompatible(ghenv.Component): return -1
            if sc.sticky['honeybee_release'].isInputMissing(ghenv.Component): return -1
        except:
            warning = "You need a newer version of Honeybee to use this compoent." + \
            " Use updateHoneybee component to update userObjects.\n" + \
            "If you have already updated userObjects drag Honeybee_Honeybee component " + \
            "into canvas and try again."
            w = gh.GH_RuntimeMessageLevel.Warning
            ghenv.Component.AddRuntimeMessage(w, warning)
            return -1
        
        # don't customize this part
        hb_EPSrf = sc.sticky["honeybee_EPSurface"]
        hb_EPSHDSurface = sc.sticky["honeybee_EPShdSurface"]
        hb_RADMaterialAUX = sc.sticky["honeybee_RADMaterialAUX"]
        hb_EPObjectsAux = sc.sticky["honeybee_EPObjectsAUX"]()
        HBScheduleList = sc.sticky["honeybee_ScheduleLib"].keys()

        ########################################################################
        #----------------------------------------------------------------------#
        shdBreps = []
        # create bounding box of shading geometries
        if justBoundingBox:
            for brep in shdSurfaces:
                if brep.Faces.Count>1 or not brep.Faces[0].IsPlanar(sc.doc.ModelAbsoluteTolerance):
                    shdBreps.append(brep.GetBoundingBox(True).ToBrep())
                else:
                    shdBreps.append(brep)
        else:
            shdBreps = shdSurfaces
        
        shadingClasses = []
        shadingMeshPreview = []
        
        if meshingSettings == None:
            mp = rc.Geometry.MeshingParameters.Minimal
            mp.SimplePlanes = True
        else:
            mp = meshingSettings
        
        def getRadMaterialName(radMaterial):
            nameStr = radMaterial.split(" ")[2]
            name =  nameStr.split("\n")[0]
            return name
        
        for brepCount, brep in enumerate(shdBreps):
            if brep != None:
                isPlanar = True
                # check planarity
                for face in brep.Faces:
                    if not face.IsPlanar(tolerance):
                        isPlanar = False
                        break
                
                shadingBreps = []
                if not isPlanar:
                    meshArray = rc.Geometry.Mesh.CreateFromBrep(brep, mp)
                    for mesh in meshArray:
                        for meshFace in range(mesh.Faces.Count):
                            vertices = list(mesh.Faces.GetFaceVertices(meshFace))[1:]
                            vertices = vertices + [sc.doc.ModelAbsoluteTolerance]
                            # create the brep from mesh
                            shdBrep = rc.Geometry.Brep.CreateFromCornerPoints(*vertices)
                            shadingBreps.append(shdBrep)
                else:
                    for face in brep.Faces:
                        shadingBreps.append(face.DuplicateFace(False))
                
                for faceCount, shdBrep in enumerate(shadingBreps):
                        thisShading = hb_EPSHDSurface(shdBrep, 1000*brepCount + faceCount, 'shdSrf_' + `brepCount` + '_' + `faceCount` + "_" + str(uuid.uuid4()))
                        
                        # add transmittance schedule if any
                        if EPTransSchedule!=None:
                            schedule= EPTransSchedule.upper()
                            if schedule!=None and not schedule.lower().endswith(".csv") and schedule not in HBScheduleList:
                                msg = "Cannot find " + schedule + " in Honeybee schedule library."
                                print msg
                                ghenv.Component.AddRuntimeMessage(gh.GH_RuntimeMessageLevel.Warning, msg)
                                return -1
                            elif schedule!=None and schedule.lower().endswith(".csv"):
                                # check if csv file is existed
                                if not os.path.isfile(schedule):
                                    msg = "Cannot find the shchedule file: " + schedule
                                    print msg
                                    ghenv.Component.AddRuntimeMessage(gh.GH_RuntimeMessageLevel.Warning, msg)
                                    return -1
                            
                            thisShading.TransmittanceSCH = schedule
                        
                        # add the Rad Material if any
                        if RADMaterial!=None:
                            # if it is just the name of the material make sure it is already defined
                            if len(RADMaterial.split(" ")) == 1:
                                # if the material is not in the library add it to the library
                                if not hb_RADMaterialAUX.isMatrialExistInLibrary(RADMaterial):
                                    warningMsg = "Can't find " + RADMaterial + " in RAD Material Library.\n" + \
                                                "Add the material to the library and try again."
                                    ghenv.Component.AddRuntimeMessage(gh.GH_RuntimeMessageLevel.Warning, warningMsg)
                                    return
                                
                                try:
                                    thisShading.setRADMaterial(RADMaterial)
                                except Exception, e:
                                    print e
                                    warningMsg = "You are using an old version of Honeybee_Honeybee! Update your files and try again."
                                    print warningMsg
                                    ghenv.Component.AddRuntimeMessage(gh.GH_RuntimeMessageLevel.Warning, warningMsg)
                                    return
                                
                                addedToLib = True
                            else:
                                
                                # try to add the material to the library
                                addedToLib, thisShading.RadMaterial = hb_RADMaterialAUX.analyseRadMaterials(RADMaterial, True)
                                
                            if addedToLib==False:
                                warningMsg = "Failed to add " + RADMaterial + " to the Library."
                                ghenv.Component.AddRuntimeMessage(gh.GH_RuntimeMessageLevel.Warning, warningMsg)
                                return
                        
                        # add shading to the list
                        shadingClasses.append(thisShading)
                
        # add to the hive
        hb_hive = sc.sticky["honeybee_Hive"]()
        HBContext  = hb_hive.addToHoneybeeHive(shadingClasses, ghenv.Component)
        return HBContext
        ################################################################################################
    else:
        print "You should first let Honeybee to fly..."
        w = gh.GH_RuntimeMessageLevel.Warning
        ghenv.Component.AddRuntimeMessage(w, "You should first let Honeybee to fly...")
        return -1
        

if _shdSurfaces and _shdSurfaces[0]!=None:
    # add cleaning function
    result= main(_shdSurfaces, EPTransSchedule_, meshingSettings_, justBoundingBox_)
    
    if result != -1: HBContext = result
# ---------- end hb_epcontextsrf ----------

bldgprograms = Honeybee_bldgPrograms({"Office": 0, "Retail": 1, "MidriseApartment": 2, "PrimarySchool": 3, "SecondarySchool": 4, "SmallHotel": 5, "LargeHotel": 6, "Hospital": 7, "Outpatient": 8, "Warehouse": 9, "SuperMarket": 10, "FullServiceRestaurant": 11, "QuickServiceRestaurant": 12}, selected="MidriseApartment")
listzoneprograms = Honeybee_ListZonePrograms(bldgProgram=bldgprograms)  # -> MidriseApartmentZonePrograms; plug-in component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
item_2 = ListItem(List=listzoneprograms, Index=0, Wrap=True)
createhbzones = Honeybee_createHBZones(name="test_room", zoneProgram=item_2, HBSurfaces=flatten(brep), isConditioned=True)  # -> readMe, HBZone; plug-in component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
wires = BrepWireframe(Brep=[createhbzones.HBZone, createhbsrfs_5.HBSurface], Density=-1)

setepzoneloads = Honeybee_SetEnergyPlusZoneLoads(
    HBZones=createhbzones.HBZone,
    equipmentLoadPerArea="2",
    infiltrationRatePerArea=".0002",
    lightingDensityPerArea="10",
    numOfPeoplePerArea=".02",
    ventilationPerArea=".0002")  # -> loads, flatten(HBZones); plug-in component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
setepnatvent = Honeybee_SetEPAirFlow(
    HBZones=flatten([createhbzones.HBZone, setepzoneloads.HBZones]),
    naturalVentilationType="1",
    minIndoorTempForNatVent="24",
    maxIndoorTempForNatVent="27",
    minOutdoorTempForNatVent="22",
    maxOutdoorTempForNatVent="30")  # -> readMe, simplify(flatten(HBZones)); plug-in component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

toggle = BooleanToggle(True)
epoutput = Honeybee_GenerateEPOutput(
    zoneEnergyUse=toggle,
    zoneGainsAndLosses=toggle,
    zoneComfortMetrics="False",
    surfaceTempAnalysis="False",
    surfaceEnergyAnalysis=toggle)  # -> report, flatten(simulationOutputs); plug-in component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
panel_7 = Panel("https://www.energyplus.net/weather-download/north_and_central_america_wmo_region_4/USA/PA/USA_PA_Philadelphia.Intl.AP.724080_TMY3/all")
epoutput_2 = Honeybee_GenerateEPOutput(zoneGainsAndLosses="False", zoneComfortMetrics=Toggle(True), surfaceTempAnalysis="False")  # -> report, flatten(simulationOutputs); plug-in component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
toggle_2 = BooleanToggle(True)
epw_stat = Ladybug_OpenEPWAndSTATWeatherFiles(weatherFileURL=panel_7)  # -> epwFile, statFile; plug-in component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
exporttoopenstudio = Honeybee_ExportToOpenStudio(
    epwWeatherFile=epw_stat.epwFile,
    HBZones=flatten(setepnatvent.HBZones),
    HBContext=flatten(hb_epcontextsrf),
    simulationOutputs=flatten(epoutput.simulationOutputs),
    writeOSM=toggle_2,
    runSimulation=toggle_2)  # -> readMe, osmFileAddress, idfFileAddress, resultFileAddress, eioFileAddress, rddFileAddress, htmlReport, studyFolder, model; plug-in component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
toggle_3 = BooleanToggle(True)
importepw = Ladybug_ImportEpw(epwFile=epw_stat.epwFile)  # -> readMe, latitude, location, dryBulbTemperature, dewPointTemperature, relativeHumidity, windSpeed, windDirection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; plug-in component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
readepresult = Honeybee_ReadEPResult(resultFileAddress=exporttoopenstudio.resultFileAddress)  # -> totalThermalLoad, thermalLoadBalance, cooling, heating, electricLight, electricEquip, fanElectric, port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; plug-in component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
readepsrfresult = Honeybee_ReadEPSurfaceResult(resultFileAddress=exporttoopenstudio.resultFileAddress)  # -> port, port_2, surfaceEnergyFlow, opaqueEnergyFlow, glazEnergyFlow, port_3, port_4, port_5, port_6, port_7; plug-in component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
runenergysimulation = Honeybee_RunEnergySimulation(
    epwFile=epw_stat.epwFile,
    HBZones=flatten(setepnatvent.HBZones),
    HBContext=flatten(hb_epcontextsrf),
    simulationOutputs=flatten(epoutput_2.simulationOutputs),
    writeIdf=toggle_3,
    runEnergyPlus=toggle_3)  # -> report, idfFileAddress, htmlReport, resultFileAddress; plug-in component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
readepresult_2 = Honeybee_ReadEPResult(resultFileAddress=runenergysimulation.resultFileAddress)  # -> port, port_2, port_3, port_4, port_5, port_6, port_7, port_8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; plug-in component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

strnum = Ladybug_SeparateData(inputList=flatten(readepresult.cooling))  # -> numbers, strings; plug-in component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
strnum_2 = Ladybug_SeparateData(inputList=flatten(readepresult.heating))  # -> numbers, strings; plug-in component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
energybalance = Honeybee_ConstructEnergyBalance(
    HBZones=flatten(setepnatvent.HBZones),
    cooling=readepresult.cooling,
    heating=readepresult.heating,
    electricLight=readepresult.electricLight,
    electricEquip=readepresult.electricEquip,
    fanElectric=readepresult.fanElectric,
    peopleGains=readepresult.peopleGains,
    totalSolarGain=readepresult.totalSolarGain,
    infiltrationEnergy=readepresult.infiltrationEnergy,
    mechVentilationEnergy=readepresult.mechVentilationEnergy,
    natVentEnergy=readepresult.natVentEnergy,
    surfaceEnergyFlow=readepsrfresult.surfaceEnergyFlow)  # -> readMe, port, flrNormEnergyBal, flrNormBalWStorage, port_2, modelEnergyBalance, energyBalWithStorage; plug-in component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
ma = MassAddition(Input=strnum.numbers)  # -> Result, PartialResults
ma_2 = MassAddition(Input=strnum_2.numbers)  # -> Result, PartialResults
panel_8 = Panel(ma_2.Result)
panel_9 = Panel(ma.Result)
selectandaveragedata = Ladybug_AverageData(annualHourlyData=energybalance.flrNormBalWStorage, totalOrAverage=Toggle(True))  # -> readMe, selHourlyData, totaledDaily, totaledMonthly, totMonthlyPerHour, totAnalysisPeriod; plug-in component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
division = Division(A=[panel_9, panel_8], B=area.Area)
adaptivecomfortcalculator = Ladybug_AdaptiveComfortCalculator(
    dryBulbTemperature=readepresult_2.airTemperature,
    meanRadiantTemperature=readepresult_2.meanRadTemperature,
    prevailingOutdoorTemp=importepw.dryBulbTemperature,
    runIt=Toggle(True))  # -> readMe, port, comfortableOrNot, conditionOfPerson, degreesFromTarget, port_2, targetTemperature, upperTemperatureBound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; plug-in component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
item_3 = ListItem(List=division, Index="0", Wrap=True)
item_4 = ListItem(List=division, Index="1", Wrap=True)
ma_3 = MassAddition(Input=flatten(item_3))  # -> Result, PartialResults
panel_10 = Panel(division)
ma_4 = MassAddition(Input=flatten(item_4))  # -> Result, PartialResults
panel_11 = Panel(ma_3.Result)
panel_12 = Panel(ma_4.Result)
_3dchart = Ladybug_3DChart(
    inputData=flatten([importepw.dryBulbTemperature, importepw.globalHorizontalRadiation]),
    basePoint="0,-800,0",
    xScale="0.25",
    zScale="0")  # -> readMe, graphMesh, graphCurves, legend, legendBasePts, title, titleBasePts, dataPts, conditionalHOY; plug-in component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
_3dchart_2 = Ladybug_3DChart(
    inputData=flatten(adaptivecomfortcalculator.conditionOfPerson),
    basePoint="2000,-800,0",
    xScale="0.25",
    zScale="0",
    legendPar=legendpar_3)  # -> readMe, graphMesh, graphCurves, legend, legendBasePts, title, titleBasePts, dataPts, conditionalHOY; plug-in component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
item_5 = ListItem(List=panel_10, Index="0", Wrap=True)  # -> flatten(Item)
panel_13 = Panel(item_5)
strnum_3 = Ladybug_SeparateData(inputList=flatten(adaptivecomfortcalculator.conditionOfPerson))  # -> numbers, strings; plug-in component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
concat = Concatenate(FragmentA="Total Load:", FragmentB=ma_3.Result)
item_6 = ListItem(List=item_5, Index="0", Wrap=True)
concat_2 = Concatenate(FragmentA="Cooling Load:", FragmentB=item_6)
item_7 = ListItem(List=item_5, Index="1", Wrap=True)
concat_3 = Concatenate(FragmentA="Heating Load:", FragmentB=item_7)
panel_14 = Panel(item_7)
panel_15 = Panel(item_6)
concat_4 = Concatenate(FragmentA=concat_2, FragmentB=concat_3, FragmentC=concat)
concat_5 = Concatenate(FragmentA="Room Energy Balance", FragmentB=concat_4)
barchart = Ladybug_MonthlyBarChart(
    inputData=flatten(selectandaveragedata.totaledMonthly),
    stackValues=Toggle(True),
    altTitle=concat_5,
    altYAxisTitle="Energy (kWh)",
    legendPar=legendpar)  # -> readMe, dataMesh, dataCurves, dataCrvColors, graphAxes, graphLabels, title, titleBasePt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; plug-in component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
preview_2 = CustomPreview(Geometry=[barchart.graphAxes, barchart.title], Shader=ColourSwatch(SwatchColor=RGB(0, 0, 0)))
panel_16 = Panel(barchart.legend)
larger = LargerThan(FirstNumber=strnum_3.numbers, SecondNumber="0")  # -> LargerThan, OrEqualTo
equals = Equality(FirstNumber=strnum_3.numbers, SecondNumber="0")  # -> Equality, Inequality
smaller = SmallerThan(FirstNumber=strnum_3.numbers, SecondNumber="0")  # -> SmallerThan, OrEqualTo
ma_5 = MassAddition(Input=smaller.SmallerThan)  # -> flatten(Result), PartialResults
ma_6 = MassAddition(Input=larger.LargerThan)  # -> flatten(Result), PartialResults
ma_7 = MassAddition(Input=equals.Equality)  # -> flatten(Result), PartialResults
panel_17 = Panel(ma_6.Result)
panel_18 = Panel(ma_7.Result)
panel_19 = Panel(ma_5.Result)
item_8 = ListItem(List=panel_17, Index="0", Wrap=True)
item_9 = ListItem(List=panel_17, Index="1", Wrap=True)
item_10 = ListItem(List=panel_18, Index="0", Wrap=True)
item_11 = ListItem(List=panel_18, Index="1", Wrap=True)
item_12 = ListItem(List=panel_19, Index="0", Wrap=True)
item_13 = ListItem(List=panel_19, Index="1", Wrap=True)
concat_6 = Concatenate(
    FragmentA="Hours Hot:",
    FragmentB=item_8,
    FragmentD="Hours Comfortable:",
    FragmentE=item_10,
    FragmentG="Hours Cold:",
    FragmentH=item_12)
concat_7 = Concatenate(
    FragmentA="Hours Hot:",
    FragmentB=item_9,
    FragmentD="Hours Comfortable:",
    FragmentE=item_11,
    FragmentG="Hours Cold:",
    FragmentH=item_13)
tag = TextTag(Location=pt, Text=concat_6)
tag_2 = TextTag(Location=pt_2, Text=concat_7)
