# Grasshopper definition nelson_graham_111217.gh (Grasshopper 0.9.76)
# plug-ins: Python Interpreter

r_value_h_ft2_f_btu = Panel("25")
construction_name = Panel("Baseline Floor")
rip2rsi = Ladybug_rIP2rSI(R_IP=r_value_h_ft2_f_btu)  # -> R_SI; plug-in component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
epnomassmat = Honeybee_EnergyPlusNoMassOpaqueMaterial(name=construction_name, R_Value=rip2rsi)  # -> EPMaterial; plug-in component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
epconstruction = Honeybee_EnergyPlusConstruction(name=construction_name, layer_1=epnomassmat)  # -> EPConstruction; plug-in component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

r_value_h_ft2_f_btu_2 = Panel("25")
construction_name_2 = Panel("Baseline Roof")
rip2rsi_2 = Ladybug_rIP2rSI(R_IP=r_value_h_ft2_f_btu_2)  # -> R_SI; plug-in component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
epnomassmat_2 = Honeybee_EnergyPlusNoMassOpaqueMaterial(name=construction_name_2, R_Value=rip2rsi_2)  # -> EPMaterial; plug-in component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
epconstruction_2 = Honeybee_EnergyPlusConstruction(name=construction_name_2, layer_1=epnomassmat_2)  # -> EPConstruction; plug-in component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

r_value_h_ft2_f_btu_3 = Panel("35")
construction_name_3 = Panel("Baseline Wall")
rip2rsi_3 = Ladybug_rIP2rSI(R_IP=r_value_h_ft2_f_btu_3)  # -> R_SI; plug-in component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
epnomassmat_3 = Honeybee_EnergyPlusNoMassOpaqueMaterial(name=construction_name_3, R_Value=rip2rsi_3)  # -> EPMaterial; plug-in component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
epconstruction_3 = Honeybee_EnergyPlusConstruction(name=construction_name_3, layer_1=epnomassmat_3)  # -> EPConstruction; plug-in component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

construction_name_4 = Panel("Baseline Triple Pane")
u_value_btu_h_ft2_f = Panel("0.7")
shgc = Panel("0.55")
uip2usi = Ladybug_uIP2uSI(U_IP=u_value_btu_h_ft2_f)  # -> U_SI; plug-in component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
vt = Panel("0.6")
epwindowmat = Honeybee_EnergyPlusWindowMaterial(name=construction_name_4, U_Value=uip2usi, SHGC=shgc, VT=vt)  # -> EPMaterial; plug-in component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
epconstruction_4 = Honeybee_EnergyPlusConstruction(name=construction_name_4, layer_1=epwindowmat)  # -> EPConstruction; plug-in component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

adiabaticfloor = Brep(<brep referenced from the Rhino model>)
adiabaticceiling = Brep(<brep referenced from the Rhino model>)
adiabaticwall = Brep([<brep referenced from the Rhino model> x2])
try_it_in_a_cold_climate = Panel("https://www.energyplus.net/weather-download/north_and_central_america_wmo_region_4/USA/PA/USA_PA_Philadelphia.Intl.AP.724080_TMY3/all")
exteriorwall = Brep([<brep referenced from the Rhino model> x2])
honeybee = Honeybee_Honeybee()  # -> Vviiiiiiiiiizzz; plug-in component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
ladybug = Ladybug_Ladybug()  # -> Vviiiiiiiiiizzz; plug-in component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
epw_stat = Ladybug_OpenEPWAndSTATWeatherFiles(weatherFileURL=try_it_in_a_cold_climate)  # -> epwFile, statFile; plug-in component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
picturewindow = Brep([<brep referenced from the Rhino model> x3])

bldgprograms = Honeybee_bldgPrograms({"Office": 0, "Retail": 1, "MidriseApartment": 2, "PrimarySchool": 3, "SecondarySchool": 4, "SmallHotel": 5, "LargeHotel": 6, "Hospital": 7, "Outpatient": 8, "Warehouse": 9, "SuperMarket": 10, "FullServiceRestaurant": 11, "QuickServiceRestaurant": 12}, selected="Hospital")
createhbsrfs = Honeybee_createHBSrfs(geometry=exteriorwall, srfType="0", EPConstruction=epconstruction_3)  # -> readMe, simplify(HBSurface); plug-in component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
createhbsrfs_2 = Honeybee_createHBSrfs(geometry=adiabaticceiling, srfType="3", EPConstruction=epconstruction_2)  # -> readMe, simplify(HBSurface); plug-in component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
createhbsrfs_3 = Honeybee_createHBSrfs(geometry=adiabaticfloor, srfType="2", EPConstruction=epconstruction)  # -> readMe, simplify(HBSurface); plug-in component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
createhbsrfs_4 = Honeybee_createHBSrfs(geometry=adiabaticwall, srfType="0")  # -> readMe, simplify(HBSurface); plug-in component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
listzoneprograms = Honeybee_ListZonePrograms(bldgProgram=bldgprograms)  # -> HospitalZonePrograms; plug-in component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
addhbglz = Honeybee_addHBGlz(HBObj=createhbsrfs.HBSurface, childSurfaces=flatten(picturewindow), EPConstructions=epconstruction_4)  # -> simplify(HBObjWGLZ); plug-in component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
item = ListItem(List=listzoneprograms, Index=10, Wrap=True)
createhbzones = Honeybee_createHBZones(
    name="PatientRoom",
    zoneProgram=item,
    HBSurfaces=flatten([createhbsrfs_3.HBSurface, createhbsrfs_2.HBSurface, createhbsrfs_4.HBSurface, addhbglz]),
    isConditioned=Toggle(True))  # -> readMe, HBZone; plug-in component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

hvacsystemslist = Honeybee_HVACSystemsList({"-1. Thermostat Only": -1, "0. Ideal Air Loads": 0, "1. PTAC | Residential": 1, "2. PTHP | Residential": 2, "3. Packaged Single Zone - AC": 3, "4. Packaged Single Zone - HP": 4, "5. Packaged VAV w/ Reheat": 5, "6. Packaged VAV w/ PFP Boxes": 6, "7. VAV w/ Reheat": 7, "8. VAV w/ PFP Boxes": 8, "9. Warm Air Furnace - Gas Fired": 9, "10.Warm Air Furnace - Electric": 10, "11.Fan Coil Units + DOAS": 11, "12.Active Chilled Beams + DOAS": 12, "13.Radiant Floors + DOAS": 13, "14.Radiant Ceilings + DOAS": 14, "15.Heated Floors + VAV Cooling": 15, "16.VRF + DOAS": 16, "17.Ground Source WSHP + DOAS": 17, "18.Ground Source VRF + DOAS": 18}, selected="11.Fan Coil Units + DOAS")
geo = Geometry()
airdetails = Honeybee_HVACAirDetails(fanPressureRise="2737", heatRecovery="1", recoveryEffectiveness="0.5")  # -> airDetails; plug-in component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
hvacsystem = Honeybee_AssignHVACSystem(HBZones=flatten(geo), HVACSystems=hvacsystemslist, airDetails=airdetails)  # -> readMe, HBZones; plug-in component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

epoutput = Honeybee_GenerateEPOutput(
    zoneEnergyUse=Toggle(True),
    zoneGainsAndLosses="False",
    zoneComfortMetrics="False",
    surfaceTempAnalysis="False",
    timestep="annual")  # -> report, flatten(simulationOutputs); plug-in component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
energysimpar = Honeybee_EnergySimulationPar(timestep=6, solarDistribution="4")  # -> energySimPar; plug-in component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

ach2m3_s_m2_calculator = HoneybeeInfORventPerAreaCalculator(HBZones=flatten(createhbzones.HBZone), airChangeHour="1.5")  # -> out, infORventPerArea, allFloors; plug-in component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
setepzoneloads = Honeybee_SetEnergyPlusZoneLoads(HBZones=createhbzones.HBZone, numOfPeoplePerArea="0.15", ventilationPerArea=ach2m3_s_m2_calculator.infORventPerArea)  # -> loads, HBZones; plug-in component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

geo_2 = Geometry(flatten(hvacsystem.HBZones))
toggle = BooleanToggle(True)
exporttoopenstudio = Honeybee_ExportToOpenStudio(
    energySimPar=energysimpar,
    HBZones=flatten(geo_2),
    simulationOutputs=flatten(epoutput.simulationOutputs),
    writeOSM=toggle,
    runSimulation=toggle)  # -> readMe, osmFileAddress, idfFileAddress, resultFileAddress, eioFileAddress, rddFileAddress, htmlReport, studyFolder, model; plug-in component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

toggle_2 = BooleanToggle(True)
epoutput_2 = Honeybee_GenerateEPOutput(
    zoneEnergyUse=toggle_2,
    zoneGainsAndLosses=toggle_2,
    zoneComfortMetrics="False",
    surfaceTempAnalysis="False",
    surfaceEnergyAnalysis=toggle_2)  # -> report, flatten(simulationOutputs); plug-in component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

readepresult = Honeybee_ReadEPResult(resultFileAddress=exporttoopenstudio.resultFileAddress)  # -> totalThermalLoad, thermalLoadBalance, cooling, heating, electricLight, electricEquip, fanElectric, pumpElectric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; plug-in component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
flrnorm = Honeybee_NormalizeDataByFloorArea(simData=readepresult.fanElectric, HBZones=flatten(geo_2))  # -> totNormData, zoneNormData; plug-in component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
flrnorm_2 = Honeybee_NormalizeDataByFloorArea(simData=readepresult.cooling, HBZones=flatten(geo_2))  # -> totNormData, zoneNormData; plug-in component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
flrnorm_3 = Honeybee_NormalizeDataByFloorArea(simData=readepresult.heating, HBZones=flatten(geo_2))  # -> totNormData, zoneNormData; plug-in component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
flrnorm_4 = Honeybee_NormalizeDataByFloorArea(simData=readepresult.electricLight, HBZones=flatten(geo_2))  # -> totNormData, zoneNormData; plug-in component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
flrnorm_5 = Honeybee_NormalizeDataByFloorArea(simData=readepresult.electricEquip, HBZones=flatten(geo_2))  # -> totNormData, zoneNormData; plug-in component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
flrnorm_6 = Honeybee_NormalizeDataByFloorArea(simData=readepresult.pumpElectric, HBZones=flatten(geo_2))  # -> totNormData, zoneNormData; plug-in component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
strnum = Ladybug_SeparateData(inputList=flatten(flrnorm_2.totNormData))  # -> numbers, strings; plug-in component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
strnum_2 = Ladybug_SeparateData(inputList=flatten(flrnorm_3.totNormData))  # -> numbers, strings; plug-in component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
strnum_3 = Ladybug_SeparateData(inputList=flatten(flrnorm_4.totNormData))  # -> numbers, strings; plug-in component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
strnum_4 = Ladybug_SeparateData(inputList=flatten(flrnorm_5.totNormData))  # -> numbers, strings; plug-in component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
strnum_5 = Ladybug_SeparateData(inputList=flatten(flrnorm.totNormData))  # -> numbers, strings; plug-in component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
strnum_6 = Ladybug_SeparateData(inputList=flatten(flrnorm_6.totNormData))  # -> numbers, strings; plug-in component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
ma = MassAddition(Input=flatten(strnum.numbers))  # -> Result, PartialResults
ma_2 = MassAddition(Input=flatten(strnum_2.numbers))  # -> Result, PartialResults
ma_3 = MassAddition(Input=flatten(strnum_3.numbers))  # -> Result, PartialResults
ma_4 = MassAddition(Input=flatten(strnum_4.numbers))  # -> Result, PartialResults
ma_5 = MassAddition(Input=flatten(strnum_5.numbers))  # -> Result, PartialResults
ma_6 = MassAddition(Input=flatten(strnum_6.numbers))  # -> Result, PartialResults
wh2btu = Ladybug_Whm2BTUft(Wh_m2=[ma.Result, ma_2.Result, ma_3.Result, ma_4.Result, ma_5.Result, ma_6.Result])  # -> BTU_ft2; plug-in component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
eui_breakdown_kbtu_sf = Panel(wh2btu)
ma_7 = MassAddition(Input=eui_breakdown_kbtu_sf)  # -> Result, PartialResults
eui_kbtu_sf = Panel(ma_7.Result)

readeio = Honeybee_ReadHVACSizing(eioFile=exporttoopenstudio.eioFileAddress)  # -> zonePeakLoadObjs, zonePeakLoadVals, zoneSizingObjs, zoneSizingValues, systemSizingObjs, systemSizingVals, componentSizObjs, componentSizVals; plug-in component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
flip = FlipMatrix(Data=readeio.zoneSizingValues)
ma_8 = MassAddition(Input=flip)  # -> flatten(Result), PartialResults
panel = Panel(ma_8.Result)

toggle_3 = BooleanToggle(True)

exporttoopenstudio_2 = Honeybee_ExportToOpenStudio(
    epwWeatherFile=epw_stat.epwFile,
    HBZones=flatten(setepzoneloads.HBZones),
    simulationOutputs=flatten(epoutput_2.simulationOutputs),
    writeOSM=toggle_3,
    runSimulation=toggle_3)  # -> readMe, osmFileAddress, idfFileAddress, resultFileAddress, eioFileAddress, rddFileAddress, htmlReport, studyFolder, model; plug-in component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
readepresult_2 = Honeybee_ReadEPResult(resultFileAddress=exporttoopenstudio_2.resultFileAddress)  # -> totalThermalLoad, thermalLoadBalance, cooling, heating, electricLight, electricEquip, port, port_2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; plug-in component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
readepsrfresult = Honeybee_ReadEPSurfaceResult(resultFileAddress=exporttoopenstudio_2.resultFileAddress)  # -> port, port_2, surfaceEnergyFlow, opaqueEnergyFlow, glazEnergyFlow, port_3, port_4, port_5, port_6, port_7; plug-in component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

energybalance = Honeybee_ConstructEnergyBalance(
    HBZones=flatten(setepzoneloads.HBZones),
    cooling=readepresult_2.cooling,
    heating=readepresult_2.heating,
    electricLight=readepresult_2.electricLight,
    electricEquip=readepresult_2.electricEquip,
    fanElectric=readepresult_2.port,
    peopleGains=readepresult_2.peopleGains,
    totalSolarGain=readepresult_2.totalSolarGain,
    infiltrationEnergy=readepresult_2.infiltrationEnergy,
    mechVentilationEnergy=readepresult_2.mechVentilationEnergy,
    natVentEnergy=readepresult_2.port_3,
    surfaceEnergyFlow=readepsrfresult.surfaceEnergyFlow)  # -> readMe, port, flrNormEnergyBal, flrNormBalWStorage, port_2, modelEnergyBalance, energyBalWithStorage; plug-in component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
gradientlibrary = Ladybug_GradientLibrary(gradIndex="19")  # -> customColors; plug-in component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
legendpar = Ladybug_LegendParameters(customColors=flatten(gradientlibrary))  # -> legendPar; plug-in component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

selectandaveragedata = Ladybug_AverageData(annualHourlyData=energybalance.flrNormBalWStorage, totalOrAverage=Toggle(True))  # -> readMe, selHourlyData, totaledDaily, totaledMonthly, totMonthlyPerHour, totAnalysisPeriod; plug-in component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
barchart = Ladybug_MonthlyBarChart(
    inputData=flatten(selectandaveragedata.totaledMonthly),
    stackValues=Toggle(True),
    altTitle="Patient Room Energy Balance",
    altYAxisTitle="Energy (kWh)",
    legendPar=legendpar)  # -> readMe, dataMesh, dataCurves, dataCrvColors, graphAxes, graphLabels, title, titleBasePt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; plug-in component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

preview = CustomPreview(Geometry=barchart.graphAxes, Shader=ColourSwatch(SwatchColor=RGB(0, 0, 0)))
