# Grasshopper definition zhang_yunlong.gh (Grasshopper 0.9.76)
# plug-ins: Python Interpreter

ladybug = Ladybug_Ladybug()  # -> Vviiiiiiiiiizzz; plug-in component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
honeybee = Honeybee_Honeybee()  # -> Vviiiiiiiiiizzz; plug-in component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

brep = Brep(<brep referenced from the Rhino model>)
brep_2 = Brep(<brep referenced from the Rhino model>)
brep_3 = Brep(<brep referenced from the Rhino model>)
brep_4 = Brep(<brep referenced from the Rhino model>)
mass2zone = Honeybee_Masses2Zones(zoneMasses=flatten(brep), isConditioned=Toggle(False), maxRoofAngle=30, createHBZones=Toggle(True))  # -> readMe, HBZones; plug-in component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
mass2zone_2 = Honeybee_Masses2Zones(zoneMasses=flatten(brep_2), isConditioned=Toggle(False), maxRoofAngle=30, createHBZones=Toggle(True))  # -> readMe, HBZones; plug-in component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
mass2zone_3 = Honeybee_Masses2Zones(zoneMasses=flatten(brep_3), isConditioned=Toggle(False), maxRoofAngle=30, createHBZones=Toggle(True))  # -> readMe, HBZones; plug-in component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
mass2zone_4 = Honeybee_Masses2Zones(zoneMasses=flatten(brep_4), isConditioned=Toggle(False), maxRoofAngle=30, createHBZones=Toggle(True))  # -> readMe, HBZones; plug-in component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

panel = Panel(honeybee)

radglassmaterial = Honeybee_RadianceGlassMaterial(materialName="GLASS0.6", RTransmittance="0.6", GTransmittance="0.6", BTransmittance="0.6", refractiveIndex=1.52)  # -> avrgTrans, RADMaterial; plug-in component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

r_value_h_ft2_f_btu = Panel("40")
construction_name = Panel("Wall")
rip2rsi = Ladybug_rIP2rSI(R_IP=r_value_h_ft2_f_btu)  # -> R_SI; plug-in component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
epnomassmat = Honeybee_EnergyPlusNoMassOpaqueMaterial(name=construction_name, R_Value=rip2rsi)  # -> EPMaterial; plug-in component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
epconstruction = Honeybee_EnergyPlusConstruction(name=construction_name, layer_1=epnomassmat)  # -> EPConstruction; plug-in component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

glass = Brep([<brep referenced from the Rhino model> x9])
preview = CustomPreview(Geometry=glass, Shader=ColourSwatch(SwatchColor=RGBA(80, 222, 255, 160)))
addhbglz = Honeybee_addHBGlz(HBObj=mass2zone_3.HBZones, childSurfaces=flatten(glass))  # -> simplify(HBObjWGLZ); plug-in component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

r_value_h_ft2_f_btu_2 = Panel("60")
construction_name_2 = Panel("Floor")
rip2rsi_2 = Ladybug_rIP2rSI(R_IP=r_value_h_ft2_f_btu_2)  # -> R_SI; plug-in component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
epnomassmat_2 = Honeybee_EnergyPlusNoMassOpaqueMaterial(name=construction_name_2, R_Value=rip2rsi_2)  # -> EPMaterial; plug-in component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
epconstruction_2 = Honeybee_EnergyPlusConstruction(name=construction_name_2, layer_1=epnomassmat_2)  # -> EPConstruction; plug-in component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

r_value_h_ft2_f_btu_3 = Panel("60")
construction_name_3 = Panel("Roof")
rip2rsi_3 = Ladybug_rIP2rSI(R_IP=r_value_h_ft2_f_btu_3)  # -> R_SI; plug-in component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
epnomassmat_3 = Honeybee_EnergyPlusNoMassOpaqueMaterial(name=construction_name_3, R_Value=rip2rsi_3)  # -> EPMaterial; plug-in component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
epconstruction_3 = Honeybee_EnergyPlusConstruction(name=construction_name_3, layer_1=epnomassmat_3)  # -> EPConstruction; plug-in component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

glass_2 = Brep([<brep referenced from the Rhino model> x4])
preview_2 = CustomPreview(Geometry=glass_2, Shader=ColourSwatch(SwatchColor=RGBA(80, 222, 255, 160)))
addhbglz_2 = Honeybee_addHBGlz(HBObj=mass2zone.HBZones, childSurfaces=flatten(glass_2))  # -> simplify(HBObjWGLZ); plug-in component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

construction_name_4 = Panel("Triple Pane")
u_value_btu_h_ft2_f = Panel("0.6")
shgc = Panel("0.6")
uip2usi = Ladybug_uIP2uSI(U_IP=u_value_btu_h_ft2_f)  # -> U_SI; plug-in component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
vt = Panel("0.8")
epwindowmat = Honeybee_EnergyPlusWindowMaterial(name=construction_name_4, U_Value=uip2usi, SHGC=shgc, VT=vt)  # -> EPMaterial; plug-in component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
epconstruction_4 = Honeybee_EnergyPlusConstruction(name=construction_name_4, layer_1=epwindowmat)  # -> EPConstruction; plug-in component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

glass_3 = Brep([<brep referenced from the Rhino model> x4])
preview_3 = CustomPreview(Geometry=glass_3, Shader=ColourSwatch(SwatchColor=RGBA(80, 222, 255, 160)))
addhbglz_3 = Honeybee_addHBGlz(HBObj=mass2zone_2.HBZones, childSurfaces=flatten(glass_3))  # -> simplify(HBObjWGLZ); plug-in component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

glass_4 = Brep([<brep referenced from the Rhino model> x8])
preview_4 = CustomPreview(Geometry=glass_4, Shader=ColourSwatch(SwatchColor=RGBA(80, 222, 255, 160)))
addhbglz_4 = Honeybee_addHBGlz(HBObj=mass2zone_4.HBZones, childSurfaces=flatten(glass_4))  # -> simplify(HBObjWGLZ); plug-in component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

# ----
# OLD
glass_5 = Brep(<brep referenced from the Rhino model>)

# ----
# OLD
glass_6 = Brep(<brep referenced from the Rhino model>)

# ----
# OLD
glass_7 = Brep(<brep referenced from the Rhino model>)

# ----
# OLD
glass_8 = Brep([<brep referenced from the Rhino model> x2])

all_zones = Geometry(flatten([addhbglz_4, addhbglz_2, addhbglz_3, addhbglz]))
wires = BrepWireframe(Brep=[addhbglz_3, addhbglz_2, addhbglz_4, addhbglz], Density=-1)
solveadjc = Honeybee_SolveAdjacencies(HBZones=flatten(all_zones), removeCurrentAdjc=False, findAdjc=Toggle(True))  # -> readMe, HBZonesWADJ; plug-in component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

setepzonecnstr = Honeybee_SetEPZoneConstruction(
    HBZones=flatten(solveadjc.HBZonesWADJ),
    wallEPConstruction=epconstruction,
    windowEPConstruction=epconstruction_4,
    roofEPConstruction=epconstruction_3,
    expFloorEPConstruction=epconstruction_2)  # -> simplify(modifiedHBZones); plug-in component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

callfromepconstrlibrary = Honeybee_CallFromEPConstructionLibrary()  # -> ThermMaterials, EPMaterials, EPWindowMaterials, EPConstructions; plug-in component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
panel_2 = Panel("""0
4
1
2""")
searchepconstruction = Honeybee_SearchEPConstruction(EPConstrList=callfromepconstrlibrary.EPConstructions, standard="2", climateZone="4", surfaceType=panel_2)  # -> EPSelectedConstr; plug-in component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
decomposeepconstruction = Honeybee_DecomposeEPConstruction(cnstrName=searchepconstruction)  # -> materials, comments, UValue_SI, UValue_IP, RValue_SI, RValue_IP; plug-in component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
sort = SortList(Keys=decomposeepconstruction.RValue_SI, ValuesA=searchepconstruction)  # -> Keys, ValuesA
item = ListItem(List=sort.ValuesA, Index="-1", Wrap=True)
flatten = FlattenTree(Tree=item, Path="{0}")
item_2 = ListItem(List=flatten, Index=0, Wrap=True)  # -> Item, Item1, Item2, Item3
setepzonecnstr_2 = Honeybee_SetEPZoneConstruction(
    wallEPConstruction=item_2.Item,
    windowEPConstruction=item_2.Item1,
    roofEPConstruction=item_2.Item2,
    floorEPConstruction=item_2.Item3)  # -> simplify(modifiedHBZones); plug-in component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

ach2m3_s_m2_calculator = HoneybeeInfORventPerAreaCalculator(HBZones=flatten(setepzonecnstr), airChangeHour="1")  # -> out, infORventPerArea, allFloors; plug-in component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
setepzoneloads = Honeybee_SetEnergyPlusZoneLoads(HBZones=setepzonecnstr, numOfPeoplePerArea="0.12", ventilationPerArea=ach2m3_s_m2_calculator.infORventPerArea)  # -> loads, HBZones; plug-in component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

toggle = BooleanToggle(True)
epoutput = Honeybee_GenerateEPOutput(
    zoneEnergyUse=toggle,
    zoneGainsAndLosses=toggle,
    zoneComfortMetrics="False",
    surfaceTempAnalysis="False",
    surfaceEnergyAnalysis=toggle)  # -> report, flatten(simulationOutputs); plug-in component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

brep_5 = Brep([<brep referenced from the Rhino model> x30])
hb_epcontextsrf = HoneybeeEPContextSurfaces(shdSurfaces=flatten(brep_5))  # -> HBContext; inputs shdSurfaces: list of Brep, justBoundingBox: Boolean
# ---------- hb_epcontextsrf: Python ----------
"""
prepare shading/context geometries

    Args:
        northVectorOrRotation: A vector that shows North or a number that shows
                               the rotation of the North from the Y axis
        bldgMasses: List of closed Breps as thermal zones.
    Returns:
        report: ...
        thermalZones: Thermal zone's geometries for visualiza
"""

ghenv.Component.Name = 'Honeybee EP context Surfaces'
ghenv.Component.NickName = 'HB_EPContextSrf'
ghenv.Component.Message = 'VER 0.0.62\nJUL_28_2017'
ghenv.Component.IconDisplayMode = ghenv.Component.IconDisplayMode.application
ghenv.Component.Category = "Honeybee"
ghenv.Component.SubCategory = "10 | Energy | Energy"
#compatibleHBVersion = VER 0.0.57\nNOV_04_2016
#compatibleLBVersion = VER 0.0.59\nFEB_01_2015
ghenv.Component.AdditionalHelpFromDocStrings = "2"

import rhinoscriptsyntax as rs
import Rhino as rc
import scriptcontext as sc
import os
import System
import Grasshopper.Kernel as gh
import uuid

tolerance = sc.doc.ModelAbsoluteTolerance
import math


def main(shdSurfaces, EPTransSchedule, meshingSettings, justBoundingBox):
    
    # import the classes
    if sc.sticky.has_key('honeybee_release'):

        try:
            if not sc.sticky['honeybee_release'].isCompatible(ghenv.Component): return -1
            if sc.sticky['honeybee_release'].isInputMissing(ghenv.Component): return -1
        except:
            warning = "You need a newer version of Honeybee to use this compoent." + \
            " Use updateHoneybee component to update userObjects.\n" + \
            "If you have already updated userObjects drag Honeybee_Honeybee component " + \
            "into canvas and try again."
            w = gh.GH_RuntimeMessageLevel.Warning
            ghenv.Component.AddRuntimeMessage(w, warning)
            return -1
        
        # don't customize this part
        hb_EPSrf = sc.sticky["honeybee_EPSurface"]
        hb_EPSHDSurface = sc.sticky["honeybee_EPShdSurface"]
        hb_RADMaterialAUX = sc.sticky["honeybee_RADMaterialAUX"]
        hb_EPObjectsAux = sc.sticky["honeybee_EPObjectsAUX"]()
        HBScheduleList = sc.sticky["honeybee_ScheduleLib"].keys()

        ########################################################################
        #----------------------------------------------------------------------#
        shdBreps = []
        # create bounding box of shading geometries
        if justBoundingBox:
            for brep in shdSurfaces:
                if brep.Faces.Count>1 or not brep.Faces[0].IsPlanar(sc.doc.ModelAbsoluteTolerance):
                    shdBreps.append(brep.GetBoundingBox(True).ToBrep())
                else:
                    shdBreps.append(brep)
        else:
            shdBreps = shdSurfaces
        
        shadingClasses = []
        shadingMeshPreview = []
        
        if meshingSettings == None:
            mp = rc.Geometry.MeshingParameters.Minimal
            mp.SimplePlanes = True
        else:
            mp = meshingSettings
        
        def getRadMaterialName(radMaterial):
            nameStr = radMaterial.split(" ")[2]
            name =  nameStr.split("\n")[0]
            return name
        
        for brepCount, brep in enumerate(shdBreps):
            if brep != None:
                isPlanar = True
                # check planarity
                for face in brep.Faces:
                    if not face.IsPlanar(tolerance):
                        isPlanar = False
                        break
                
                shadingBreps = []
                if not isPlanar:
                    meshArray = rc.Geometry.Mesh.CreateFromBrep(brep, mp)
                    for mesh in meshArray:
                        for meshFace in range(mesh.Faces.Count):
                            vertices = list(mesh.Faces.GetFaceVertices(meshFace))[1:]
                            vertices = vertices + [sc.doc.ModelAbsoluteTolerance]
                            # create the brep from mesh
                            shdBrep = rc.Geometry.Brep.CreateFromCornerPoints(*vertices)
                            shadingBreps.append(shdBrep)
                else:
                    for face in brep.Faces:
                        shadingBreps.append(face.DuplicateFace(False))
                
                for faceCount, shdBrep in enumerate(shadingBreps):
                        thisShading = hb_EPSHDSurface(shdBrep, 1000*brepCount + faceCount, 'shdSrf_' + `brepCount` + '_' + `faceCount` + "_" + str(uuid.uuid4()))
                        
                        # add transmittance schedule if any
                        if EPTransSchedule!=None:
                            schedule= EPTransSchedule.upper()
                            if schedule!=None and not schedule.lower().endswith(".csv") and schedule not in HBScheduleList:
                                msg = "Cannot find " + schedule + " in Honeybee schedule library."
                                print msg
                                ghenv.Component.AddRuntimeMessage(gh.GH_RuntimeMessageLevel.Warning, msg)
                                return -1
                            elif schedule!=None and schedule.lower().endswith(".csv"):
                                # check if csv file is existed
                                if not os.path.isfile(schedule):
                                    msg = "Cannot find the shchedule file: " + schedule
                                    print msg
                                    ghenv.Component.AddRuntimeMessage(gh.GH_RuntimeMessageLevel.Warning, msg)
                                    return -1
                            
                            thisShading.TransmittanceSCH = schedule
                        
                        # add the Rad Material if any
                        if RADMaterial!=None:
                            # if it is just the name of the material make sure it is already defined
                            if len(RADMaterial.split(" ")) == 1:
                                # if the material is not in the library add it to the library
                                if not hb_RADMaterialAUX.isMatrialExistInLibrary(RADMaterial):
                                    warningMsg = "Can't find " + RADMaterial + " in RAD Material Library.\n" + \
                                                "Add the material to the library and try again."
                                    ghenv.Component.AddRuntimeMessage(gh.GH_RuntimeMessageLevel.Warning, warningMsg)
                                    return
                                
                                try:
                                    thisShading.setRADMaterial(RADMaterial)
                                except Exception, e:
                                    print e
                                    warningMsg = "You are using an old version of Honeybee_Honeybee! Update your files and try again."
                                    print warningMsg
                                    ghenv.Component.AddRuntimeMessage(gh.GH_RuntimeMessageLevel.Warning, warningMsg)
                                    return
                                
                                addedToLib = True
                            else:
                                
                                # try to add the material to the library
                                addedToLib, thisShading.RadMaterial = hb_RADMaterialAUX.analyseRadMaterials(RADMaterial, True)
                                
                            if addedToLib==False:
                                warningMsg = "Failed to add " + RADMaterial + " to the Library."
                                ghenv.Component.AddRuntimeMessage(gh.GH_RuntimeMessageLevel.Warning, warningMsg)
                                return
                        
                        # add shading to the list
                        shadingClasses.append(thisShading)
                
        # add to the hive
        hb_hive = sc.sticky["honeybee_Hive"]()
        HBContext  = hb_hive.addToHoneybeeHive(shadingClasses, ghenv.Component)
        return HBContext
        ################################################################################################
    else:
        print "You should first let Honeybee to fly..."
        w = gh.GH_RuntimeMessageLevel.Warning
        ghenv.Component.AddRuntimeMessage(w, "You should first let Honeybee to fly...")
        return -1
        

if _shdSurfaces and _shdSurfaces[0]!=None:
    # add cleaning function
    result= main(_shdSurfaces, EPTransSchedule_, meshingSettings_, justBoundingBox_)
    
    if result != -1: HBContext = result
# ---------- end hb_epcontextsrf ----------
setepnatvent = Honeybee_SetEPAirFlow(
    HBZones=flatten(setepzonecnstr),
    naturalVentilationType="1",
    minIndoorTempForNatVent="24",
    maxIndoorTempForNatVent="27",
    minOutdoorTempForNatVent="25",
    maxOutdoorTempForNatVent="30")  # -> readMe, simplify(HBZones); plug-in component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
toggle_2 = BooleanToggle(True)
path = FilePath("D:\zyunlong\Philadelphia_weather_files\USA_PA_Philadelphia.Intl.AP.724080_TMY3.epw")

exporttoopenstudio = Honeybee_ExportToOpenStudio(
    epwWeatherFile=path,
    HBZones=flatten(setepzoneloads.HBZones),
    HBContext=flatten(hb_epcontextsrf),
    simulationOutputs=flatten(epoutput.simulationOutputs),
    writeOSM=toggle_2,
    runSimulation=toggle_2)  # -> readMe, osmFileAddress, idfFileAddress, resultFileAddress, eioFileAddress, rddFileAddress, htmlReport, studyFolder, model; plug-in component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
readepsrfresult = Honeybee_ReadEPSurfaceResult(resultFileAddress=exporttoopenstudio.resultFileAddress)  # -> port, port_2, surfaceEnergyFlow, opaqueEnergyFlow, glazEnergyFlow, port_3, port_4, port_5, port_6, port_7; plug-in component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
readepresult = Honeybee_ReadEPResult(resultFileAddress=exporttoopenstudio.resultFileAddress)  # -> port, port_2, port_3, port_4, electricLight, electricEquip, port_5, port_6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; plug-in component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

epoutput_2 = Honeybee_GenerateEPOutput(zoneGainsAndLosses="False", zoneComfortMetrics=Toggle(True), surfaceTempAnalysis="False")  # -> report, flatten(simulationOutputs); plug-in component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
brep_6 = Brep([<brep referenced from the Rhino model> x30])
hb_epcontextsrf_2 = HoneybeeEPContextSurfaces(shdSurfaces=flatten(brep_6))  # -> HBContext; inputs shdSurfaces: list of Brep, justBoundingBox: Boolean; same code as hb_epcontextsrf
toggle_3 = BooleanToggle(True)
importepw = Ladybug_ImportEpw(epwFile=path)  # -> readMe, latitude, location, dryBulbTemperature, dewPointTemperature, relativeHumidity, windSpeed, windDirection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; plug-in component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
runenergysimulation = Honeybee_RunEnergySimulation(
    epwFile=path,
    HBZones=flatten([setepnatvent.HBZones, setepzonecnstr]),
    HBContext=flatten(hb_epcontextsrf_2),
    simulationOutputs=flatten(epoutput_2.simulationOutputs),
    writeIdf=toggle_3,
    runEnergyPlus=toggle_3)  # -> report, idfFileAddress, htmlReport, resultFileAddress; plug-in component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
readepresult_2 = Honeybee_ReadEPResult(resultFileAddress=runenergysimulation.resultFileAddress)  # -> port, port_2, port_3, port_4, port_5, port_6, port_7, port_8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; plug-in component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
point = Point(<point referenced from the Rhino model>)
adaptivecomfortcalculator = Ladybug_AdaptiveComfortCalculator(
    dryBulbTemperature=readepresult_2.airTemperature,
    meanRadiantTemperature=readepresult_2.meanRadTemperature,
    prevailingOutdoorTemp=importepw.dryBulbTemperature,
    runIt=Toggle(True))  # -> readMe, port, comfortableOrNot, conditionOfPerson, degreesFromTarget, port_2, targetTemperature, upperTemperatureBound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; plug-in component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
_3dchart = Ladybug_3DChart(
    inputData=flatten([adaptivecomfortcalculator.conditionOfPerson, importepw.globalHorizontalRadiation]),
    xScale="0.2",
    zScale="0")  # -> readMe, graphMesh, graphCurves, legend, legendBasePts, title, titleBasePts, dataPts, conditionalHOY; plug-in component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

energybalance = Honeybee_ConstructEnergyBalance(
    HBZones=flatten(setepzoneloads.HBZones),
    cooling=readepresult.port_3,
    heating=readepresult.port_4,
    electricLight=readepresult.electricLight,
    electricEquip=readepresult.electricEquip,
    fanElectric=readepresult.port_5,
    peopleGains=readepresult.peopleGains,
    totalSolarGain=readepresult.totalSolarGain,
    infiltrationEnergy=readepresult.infiltrationEnergy,
    mechVentilationEnergy=readepresult.port_7,
    natVentEnergy=readepresult.port_8,
    surfaceEnergyFlow=readepsrfresult.surfaceEnergyFlow)  # -> readMe, port, flrNormEnergyBal, flrNormBalWStorage, port_2, modelEnergyBalance, energyBalWithStorage; plug-in component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
gradientlibrary = Ladybug_GradientLibrary(gradIndex="19")  # -> customColors; plug-in component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
legendpar = Ladybug_LegendParameters(customColors=flatten(gradientlibrary))  # -> legendPar; plug-in component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

selectandaveragedata = Ladybug_AverageData(annualHourlyData=energybalance.flrNormBalWStorage, totalOrAverage=Toggle(True))  # -> readMe, selHourlyData, totaledDaily, totaledMonthly, totMonthlyPerHour, totAnalysisPeriod; plug-in component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
barchart = Ladybug_MonthlyBarChart(
    inputData=flatten(selectandaveragedata.totaledMonthly),
    stackValues=Toggle(True),
    altTitle="Patient Room Energy Balance",
    altYAxisTitle="Energy (kWh)",
    basePoint=point,
    legendPar=legendpar)  # -> readMe, dataMesh, dataCurves, dataCrvColors, graphAxes, graphLabels, title, titleBasePt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; plug-in component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

preview_5 = CustomPreview(Geometry=barchart.graphAxes, Shader=ColourSwatch(SwatchColor=RGB(0, 0, 0)))
