# Grasshopper definition chan_lokyunpriscilla.gh (Grasshopper 0.9.70)
# plug-ins: Python Interpreter

callfromepconstrlibrary = Honeybee_CallFromEPConstructionLibrary()  # -> ThermMaterials, EPMaterials, EPWindowMaterials, EPConstructions; plug-in component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
panel = Panel(callfromepconstrlibrary.EPConstructions)
ladybug = Ladybug_Ladybug()  # -> Vviiiiiiiiiizzz; plug-in component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
honeybee = Honeybee_Honeybee()  # -> Vviiiiiiiiiizzz; plug-in component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

# ---- group: geometry setup, construction, adiabatic / Exterior wall
brep = Brep(<brep referenced from the Rhino model>)

# ---- group: geometry setup, construction, adiabatic / Floor
brep_2 = Brep(<brep referenced from the Rhino model>)

# ---- group: geometry setup, construction, adiabatic / Interior walls
brep_3 = Brep([<brep referenced from the Rhino model> x6])

# ---- group: geometry setup, construction, adiabatic / ceiling
brep_4 = Brep(<brep referenced from the Rhino model>)

# ---- group: geometry setup, construction, adiabatic / light shelves
brep_5 = Brep(<brep referenced from the Rhino model>)

# ----
panel_2 = Panel(honeybee)

# ---- group: geometry setup, construction, adiabatic / Glazing
brep_6 = Brep([<brep referenced from the Rhino model> x6])

# ---- group: geometry setup, construction, adiabatic
radopaquematerial = Honeybee_RadianceOpaqueMaterial(materialName="lightshelf_80", RReflectance="0.8", GReflectance="0.8", BReflectance="0.8", roughness=0.05, specularity=0)  # -> avrgRef, RADMaterial; plug-in component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
radopaquematerial_2 = Honeybee_RadianceOpaqueMaterial(materialName="wall_80", RReflectance="0.8", GReflectance="0.8", BReflectance="0.8", roughness=0.05, specularity=0)  # -> avrgRef, RADMaterial; plug-in component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
item = ListItem(List=callfromepconstrlibrary.EPConstructions, Index="191", Wrap=True)
item_2 = ListItem(List=callfromepconstrlibrary.EPConstructions, Index="431", Wrap=True)
radopaquematerial_3 = Honeybee_RadianceOpaqueMaterial(materialName="floor_40", RReflectance="0.4", GReflectance="0.4", BReflectance="0.4", roughness=0.05, specularity=0)  # -> avrgRef, RADMaterial; plug-in component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
item_3 = ListItem(List=callfromepconstrlibrary.EPConstructions, Index="433", Wrap=True)
item_4 = ListItem(List=callfromepconstrlibrary.EPConstructions, Index="429", Wrap=True)
createhbsrfs = Honeybee_createHBSrfs(geometry=brep, EPConstruction=item, RADMaterial=radopaquematerial_2.RADMaterial)  # -> readMe, simplify(HBSurface); plug-in component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
createhbsrfs_2 = Honeybee_createHBSrfs(geometry=brep_2, srfType="2", EPConstruction=item_2, RADMaterial=radopaquematerial_3.RADMaterial)  # -> readMe, simplify(HBSurface); plug-in component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
bldgprograms = Honeybee_bldgPrograms({"Office": 0, "Retail": 1, "MidriseApartment": 2, "PrimarySchool": 3, "SecondarySchool": 4, "SmallHotel": 5, "LargeHotel": 6, "Hospital": 7, "Outpatient": 8, "Warehouse": 9, "SuperMarket": 10, "FullServiceRestaurant": 11, "QuickServiceRestaurant": 12}, selected="MidriseApartment")
createhbsrfs_3 = Honeybee_createHBSrfs(geometry=brep_4, srfType="3", EPConstruction=item_4, RADMaterial=radopaquematerial_2.RADMaterial)  # -> readMe, simplify(HBSurface); plug-in component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
createhbsrfs_4 = Honeybee_createHBSrfs(geometry=brep_3, EPConstruction=item_3, RADMaterial=radopaquematerial_2.RADMaterial)  # -> readMe, simplify(HBSurface); plug-in component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
hb_epcontextsrf = HoneybeeEPContextSurfaces(shdSurfaces=flatten(brep_5), RADMaterial=radopaquematerial.RADMaterial)  # -> HBContext; inputs shdSurfaces: list of Brep, justBoundingBox: Boolean
# ---------- hb_epcontextsrf: Python ----------
"""
prepare shading/context geometries

    Args:
        northVectorOrRotation: A vector that shows North or a number that shows
                               the rotation of the North from the Y axis
        bldgMasses: List of closed Breps as thermal zones.
    Returns:
        report: ...
        thermalZones: Thermal zone's geometries for visualiza
"""

ghenv.Component.Name = 'Honeybee EP context Surfaces'
ghenv.Component.NickName = 'HB_EPContextSrf'
ghenv.Component.Message = 'VER 0.0.62\nJUL_28_2017'
ghenv.Component.IconDisplayMode = ghenv.Component.IconDisplayMode.application
ghenv.Component.Category = "Honeybee"
ghenv.Component.SubCategory = "10 | Energy | Energy"
#compatibleHBVersion = VER 0.0.57\nNOV_04_2016
#compatibleLBVersion = VER 0.0.59\nFEB_01_2015
ghenv.Component.AdditionalHelpFromDocStrings = "2"

import rhinoscriptsyntax as rs
import Rhino as rc
import scriptcontext as sc
import os
import System
import Grasshopper.Kernel as gh
import uuid

tolerance = sc.doc.ModelAbsoluteTolerance
import math


def main(shdSurfaces, EPTransSchedule, meshingSettings, justBoundingBox):
    
    # import the classes
    if sc.sticky.has_key('honeybee_release'):

        try:
            if not sc.sticky['honeybee_release'].isCompatible(ghenv.Component): return -1
            if sc.sticky['honeybee_release'].isInputMissing(ghenv.Component): return -1
        except:
            warning = "You need a newer version of Honeybee to use this compoent." + \
            " Use updateHoneybee component to update userObjects.\n" + \
            "If you have already updated userObjects drag Honeybee_Honeybee component " + \
            "into canvas and try again."
            w = gh.GH_RuntimeMessageLevel.Warning
            ghenv.Component.AddRuntimeMessage(w, warning)
            return -1
        
        # don't customize this part
        hb_EPSrf = sc.sticky["honeybee_EPSurface"]
        hb_EPSHDSurface = sc.sticky["honeybee_EPShdSurface"]
        hb_RADMaterialAUX = sc.sticky["honeybee_RADMaterialAUX"]
        hb_EPObjectsAux = sc.sticky["honeybee_EPObjectsAUX"]()
        HBScheduleList = sc.sticky["honeybee_ScheduleLib"].keys()

        ########################################################################
        #----------------------------------------------------------------------#
        shdBreps = []
        # create bounding box of shading geometries
        if justBoundingBox:
            for brep in shdSurfaces:
                if brep.Faces.Count>1 or not brep.Faces[0].IsPlanar(sc.doc.ModelAbsoluteTolerance):
                    shdBreps.append(brep.GetBoundingBox(True).ToBrep())
                else:
                    shdBreps.append(brep)
        else:
            shdBreps = shdSurfaces
        
        shadingClasses = []
        shadingMeshPreview = []
        
        if meshingSettings == None:
            mp = rc.Geometry.MeshingParameters.Minimal
            mp.SimplePlanes = True
        else:
            mp = meshingSettings
        
        def getRadMaterialName(radMaterial):
            nameStr = radMaterial.split(" ")[2]
            name =  nameStr.split("\n")[0]
            return name
        
        for brepCount, brep in enumerate(shdBreps):
            if brep != None:
                isPlanar = True
                # check planarity
                for face in brep.Faces:
                    if not face.IsPlanar(tolerance):
                        isPlanar = False
                        break
                
                shadingBreps = []
                if not isPlanar:
                    meshArray = rc.Geometry.Mesh.CreateFromBrep(brep, mp)
                    for mesh in meshArray:
                        for meshFace in range(mesh.Faces.Count):
                            vertices = list(mesh.Faces.GetFaceVertices(meshFace))[1:]
                            vertices = vertices + [sc.doc.ModelAbsoluteTolerance]
                            # create the brep from mesh
                            shdBrep = rc.Geometry.Brep.CreateFromCornerPoints(*vertices)
                            shadingBreps.append(shdBrep)
                else:
                    for face in brep.Faces:
                        shadingBreps.append(face.DuplicateFace(False))
                
                for faceCount, shdBrep in enumerate(shadingBreps):
                        thisShading = hb_EPSHDSurface(shdBrep, 1000*brepCount + faceCount, 'shdSrf_' + `brepCount` + '_' + `faceCount` + "_" + str(uuid.uuid4()))
                        
                        # add transmittance schedule if any
                        if EPTransSchedule!=None:
                            schedule= EPTransSchedule.upper()
                            if schedule!=None and not schedule.lower().endswith(".csv") and schedule not in HBScheduleList:
                                msg = "Cannot find " + schedule + " in Honeybee schedule library."
                                print msg
                                ghenv.Component.AddRuntimeMessage(gh.GH_RuntimeMessageLevel.Warning, msg)
                                return -1
                            elif schedule!=None and schedule.lower().endswith(".csv"):
                                # check if csv file is existed
                                if not os.path.isfile(schedule):
                                    msg = "Cannot find the shchedule file: " + schedule
                                    print msg
                                    ghenv.Component.AddRuntimeMessage(gh.GH_RuntimeMessageLevel.Warning, msg)
                                    return -1
                            
                            thisShading.TransmittanceSCH = schedule
                        
                        # add the Rad Material if any
                        if RADMaterial!=None:
                            # if it is just the name of the material make sure it is already defined
                            if len(RADMaterial.split(" ")) == 1:
                                # if the material is not in the library add it to the library
                                if not hb_RADMaterialAUX.isMatrialExistInLibrary(RADMaterial):
                                    warningMsg = "Can't find " + RADMaterial + " in RAD Material Library.\n" + \
                                                "Add the material to the library and try again."
                                    ghenv.Component.AddRuntimeMessage(gh.GH_RuntimeMessageLevel.Warning, warningMsg)
                                    return
                                
                                try:
                                    thisShading.setRADMaterial(RADMaterial)
                                except Exception, e:
                                    print e
                                    warningMsg = "You are using an old version of Honeybee_Honeybee! Update your files and try again."
                                    print warningMsg
                                    ghenv.Component.AddRuntimeMessage(gh.GH_RuntimeMessageLevel.Warning, warningMsg)
                                    return
                                
                                addedToLib = True
                            else:
                                
                                # try to add the material to the library
                                addedToLib, thisShading.RadMaterial = hb_RADMaterialAUX.analyseRadMaterials(RADMaterial, True)
                                
                            if addedToLib==False:
                                warningMsg = "Failed to add " + RADMaterial + " to the Library."
                                ghenv.Component.AddRuntimeMessage(gh.GH_RuntimeMessageLevel.Warning, warningMsg)
                                return
                        
                        # add shading to the list
                        shadingClasses.append(thisShading)
                
        # add to the hive
        hb_hive = sc.sticky["honeybee_Hive"]()
        HBContext  = hb_hive.addToHoneybeeHive(shadingClasses, ghenv.Component)
        return HBContext
        ################################################################################################
    else:
        print "You should first let Honeybee to fly..."
        w = gh.GH_RuntimeMessageLevel.Warning
        ghenv.Component.AddRuntimeMessage(w, "You should first let Honeybee to fly...")
        return -1
        

if _shdSurfaces and _shdSurfaces[0]!=None:
    # add cleaning function
    result= main(_shdSurfaces, EPTransSchedule_, meshingSettings_, justBoundingBox_)
    
    if result != -1: HBContext = result
# ---------- end hb_epcontextsrf ----------
item_5 = ListItem(List=callfromepconstrlibrary.EPConstructions, Index="230", Wrap=True)
radglassmaterial = Honeybee_RadianceGlassMaterial(materialName="glass_80", RTransmittance="0.8", GTransmittance="0.8", BTransmittance="0.8", refractiveIndex=1.52)  # -> avrgTrans, RADMaterial; plug-in component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
listzoneprograms = Honeybee_ListZonePrograms(bldgProgram=bldgprograms)  # -> MidriseApartmentZonePrograms; plug-in component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
addhbglz = Honeybee_addHBGlz(
    HBObj=createhbsrfs.HBSurface,
    childSurfaces=flatten(brep_6),
    EPConstructions=item_5,
    RADMaterials=radglassmaterial.RADMaterial)  # -> HBObjWGLZ; plug-in component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
makeadiabatic = Honeybee_MakeAdiabatic(HBSrfs=[createhbsrfs_4.HBSurface, createhbsrfs_2.HBSurface, createhbsrfs_3.HBSurface])  # -> HBSrfs; plug-in component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
wires = BrepWireframe(
    Brep=[addhbglz, createhbsrfs_4.HBSurface, createhbsrfs_2.HBSurface, createhbsrfs_3.HBSurface, hb_epcontextsrf],
    Density=-1)
item_6 = ListItem(List=listzoneprograms, Index="0", Wrap=True)
createhbzones = Honeybee_createHBZones(name="Sansom_room", zoneProgram=item_6, HBSurfaces=flatten([addhbglz, makeadiabatic]), isConditioned=Toggle(False))  # -> readMe, HBZone; plug-in component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

# ---- group: Custom occupancy schedule
lb_schedule = GenePool(
    Decimals=1,
    Maximum=1,
    Minimum=0,
    Value=[0, 0, 0, 0, 0, 0.1, 0.2, 0.8, 0.5, 0.2, 0.1, 0.1, 0.1, 0.1, 0.1, 0.1, 0.1, 0.1, 0.1, 0.2, 0.5, 0.8, 1, 0.1])
lb_schedule_2 = GenePool(Decimals=1, Maximum=1, Minimum=0, Value=[0, 0, 0, 0, 0, 0, 0, 0, 0, 0, 0, 0, 0, 0, 0, 0, 0, 0, 0, 0, 0, 0, 0, 0])
lb_schedule_3 = GenePool(
    Decimals=1,
    Maximum=1,
    Minimum=0,
    Value=[0, 0, 0, 0, 0, 0, 0.1, 0.2, 0.5, 0.8, 0.5, 0.5, 0.1, 0.1, 0.5, 0.5, 0.5, 0.5, 0.5, 0.1, 0.1, 0.8, 1, 0.1])
constantschedule = Honeybee_ConstantSchedule(value=lb_schedule_2, scheduleName="summer_break")  # -> readMe, schedule, weekSched, schedIDFText; plug-in component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
annualschedule = Honeybee_AnnualSchedule(
    sun=lb_schedule_3,
    mon=lb_schedule,
    tue=lb_schedule,
    wed=lb_schedule,
    thu=lb_schedule,
    fri=lb_schedule,
    sat=lb_schedule_3,
    scheduleName="school_week",
    runIt=Toggle(True))  # -> readMe, port, schedule, port_2, weekSched, schedIDFText; plug-in component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
analysisperiod = Ladybug_AnalysisPeriod(fromMonth="1", fromDay="1", toMonth="1", toDay="8")  # -> readMe, analysisPeriod; plug-in component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
analysisperiod_2 = Ladybug_AnalysisPeriod(fromMonth="12", fromDay="22", toMonth="12", toDay="31")  # -> readMe, analysisPeriod; plug-in component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
analysisperiod_3 = Ladybug_AnalysisPeriod(fromMonth="6", fromDay="1", toMonth="8", toDay="30")  # -> readMe, analysisPeriod; plug-in component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
honeybee_seasonalschedule = Honeybee_SeasonalSchedule(
    scheduleName="dorm_room",
    baseWeekSched=annualschedule.weekSched,
    seasonWeekSched1=constantschedule.weekSched,
    analysisPeriod1=analysisperiod_3.analysisPeriod,
    seasonWeekSched2=constantschedule.weekSched,
    analysisPeriod2=analysisperiod_2.analysisPeriod,
    seasonWeekSched3=constantschedule.weekSched,
    analysisPeriod3=analysisperiod.analysisPeriod)  # -> readMe, schedule, schedIDFText; plug-in component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

lb_schedule_4 = GenePool(
    Decimals=1,
    Maximum=1,
    Minimum=0,
    Value=[1, 1, 1, 1, 1, 1, 1, 0.8, 0.5, 0.2, 0.1, 0.1, 0.1, 0.1, 0.1, 0.1, 0.1, 0.1, 0.1, 0.2, 0.5, 0.8, 1, 1])
lb_schedule_5 = GenePool(Decimals=1, Maximum=1, Minimum=0, Value=[0, 0, 0, 0, 0, 0, 0, 0, 0, 0, 0, 0, 0, 0, 0, 0, 0, 0, 0, 0, 0, 0, 0, 0])
lb_schedule_6 = GenePool(
    Decimals=1,
    Maximum=1,
    Minimum=0,
    Value=[1, 1, 1, 1, 1, 1, 1, 1, 1, 0.8, 0.5, 0.5, 0.1, 0.1, 0.5, 0.5, 0.5, 0.5, 0.5, 0.1, 0.1, 0.8, 1, 1])
constantschedule_2 = Honeybee_ConstantSchedule(value=lb_schedule_5, scheduleName="summer_break")  # -> readMe, schedule, weekSched, schedIDFText; plug-in component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
annualschedule_2 = Honeybee_AnnualSchedule(
    sun=lb_schedule_6,
    mon=lb_schedule_4,
    tue=lb_schedule_4,
    wed=lb_schedule_4,
    thu=lb_schedule_4,
    fri=lb_schedule_4,
    sat=lb_schedule_6,
    scheduleName="school_week",
    runIt=Toggle(True))  # -> readMe, port, schedule, port_2, weekSched, schedIDFText; plug-in component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
analysisperiod_4 = Ladybug_AnalysisPeriod(fromMonth="1", fromDay="1", toMonth="1", toDay="8")  # -> readMe, analysisPeriod; plug-in component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
analysisperiod_5 = Ladybug_AnalysisPeriod(fromMonth="12", fromDay="22", toMonth="12", toDay="31")  # -> readMe, analysisPeriod; plug-in component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
analysisperiod_6 = Ladybug_AnalysisPeriod(fromMonth="6", fromDay="1", toMonth="8", toDay="30")  # -> readMe, analysisPeriod; plug-in component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
honeybee_seasonalschedule_2 = Honeybee_SeasonalSchedule(
    scheduleName="dorm_room",
    baseWeekSched=annualschedule_2.weekSched,
    seasonWeekSched1=constantschedule_2.weekSched,
    analysisPeriod1=analysisperiod_6.analysisPeriod,
    seasonWeekSched2=constantschedule_2.weekSched,
    analysisPeriod2=analysisperiod_5.analysisPeriod,
    seasonWeekSched3=constantschedule_2.weekSched,
    analysisPeriod3=analysisperiod_4.analysisPeriod)  # -> readMe, schedule, schedIDFText; plug-in component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

# ---- group: ventilation, infiltration, loads, etc.
setepzoneloads = Honeybee_SetEnergyPlusZoneLoads(
    HBZones=createhbzones.HBZone,
    equipmentLoadPerArea="2",
    infiltrationRatePerArea="0.0003",
    lightingDensityPerArea="9",
    numOfPeoplePerArea="0.061")  # -> loads, HBZones; plug-in component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
setepzoneschedules = Honeybee_SetEnergyPlusZoneSchedules(
    HBZones=setepzoneloads.HBZones,
    occupancySchedules=honeybee_seasonalschedule_2.schedule,
    occupancyActivitySchs=honeybee_seasonalschedule_2.schedule,
    lightingSchedules=honeybee_seasonalschedule.schedule)  # -> schedules, simplify(HBZones); plug-in component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
setepnatvent = Honeybee_SetEPAirFlow(
    HBZones=flatten(setepzoneschedules.HBZones),
    naturalVentilationType="1",
    minIndoorTempForNatVent="24",
    maxIndoorTempForNatVent="44",
    minOutdoorTempForNatVent="16",
    maxOutdoorTempForNatVent="28",
    fractionOfGlzAreaOperable="0.33")  # -> readMe, simplify(HBZones); plug-in component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

# ----
path = FilePath("C:\DIVA\WeatherData\USA_Philadelphia.International.Ap_HadCM3-A2-2050.epw")

# ---- group: Run energy simulation
epoutput = Honeybee_GenerateEPOutput(zoneComfortMetrics=Toggle(True))  # -> report, flatten(simulationOutputs); plug-in component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
toggle = BooleanToggle(False)
runenergysimulation = Honeybee_RunEnergySimulation(
    epwFile=path,
    HBZones=flatten(setepnatvent.HBZones),
    HBContext=flatten(hb_epcontextsrf),
    simulationOutputs=flatten(epoutput.simulationOutputs),
    writeIdf=toggle,
    runEnergyPlus=toggle)  # -> report, idfFileAddress, htmlReport, resultFileAddress; plug-in component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

# ---- group: Daylight simulation
gentestpts = Honeybee_GenerateTestPoints(testGeometry=createhbsrfs_2.HBSurface, gridSize="0.5", distBaseSrf="0.762", moveTestMesh=True)  # -> readMe, simplify(testPoints), simplify(ptsVectors), simplify(facesArea), simplify(mesh); plug-in component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
radparameters = Honeybee_RADParameters(quality=0, ab="3", ad="1024", as="256")  # -> readMe, radParameters; plug-in component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
annualdaylightsimulation = Honeybee_AnnualDaylightSimulation(
    epwWeatherFile=path,
    testPoints=gentestpts.testPoints,
    ptsVectors=gentestpts.ptsVectors,
    radParameters=radparameters.radParameters)  # -> analysisRecipe; plug-in component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
toggle_2 = BooleanToggle(False)
rundaylightanalysis = Honeybee_RunDaylightSimulation(
    HBObjects=flatten([addhbglz, createhbsrfs_4.HBSurface, createhbsrfs_2.HBSurface, createhbsrfs_3.HBSurface, hb_epcontextsrf]),
    analysisRecipe=annualdaylightsimulation,
    writeRad=toggle_2,
    runRad=toggle_2)  # -> readMe, analysisType, resultsUnit, results, testPts, resultFiles, radGeoFile, studyFolder, done; plug-in component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
readannualresultsi = Honeybee_ReadAnnualResultI(
    illFilesAddress=rundaylightanalysis.resultFiles,
    testPoints=simplify(rundaylightanalysis.testPts),
    occupancyFiles=honeybee_seasonalschedule_2.schedule,
    DLAIllumThresholds=300,
    runIt=Toggle(True))  # -> DLA, UDLI_Less_100, UDLI_100_2000, UDLI_More_2000, CDA, sDA, annualProfiles, htmReport; plug-in component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
legendpar = Ladybug_LegendParameters(decimalPlaces="0")  # -> legendPar; plug-in component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
recolormesh = Ladybug_RecolorMesh(
    analysisResult=readannualresultsi.UDLI_100_2000,
    inputMesh=gentestpts.mesh,
    legendPar=legendpar,
    analysisTitle="UDI 100<2000",
    legendTitle="lux",
    bakeIt=Toggle(False))  # -> readMe, newMesh, newLegend, legendBasePt, meshColors, legendColors; plug-in component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

# ----
path_2 = FilePath("C:\DIVA\WeatherData\USA_PA_Philadelphia.Intl.AP.724080_TMY3.stat")
importstat = Ladybug_ImportStat(statFile=path_2)  # -> readMe, ashraeClimateZone, koppenClimateZone, port, heatingDesignTemp, coolingDesignTemp, port_2, extremeHotWeek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; plug-in component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

# ---- group: interpret energy comfort results
importepw = Ladybug_ImportEpw(epwFile=path)  # -> readMe, latitude, location, dryBulbTemperature, dewPointTemperature, relativeHumidity, windSpeed, windDirection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; plug-in component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
readepresult = Honeybee_ReadEPResult(resultFileAddress=runenergysimulation.resultFileAddress)  # -> totalThermalLoad, thermalLoadBalance, cooling, heating, electricLight, electricEquip, fanElectric, pumpElectric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; plug-in component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
adaptivecomfortcalculator = Ladybug_AdaptiveComfortCalculator(
    dryBulbTemperature=readepresult.airTemperature,
    meanRadiantTemperature=readepresult.meanRadTemperature,
    prevailingOutdoorTemp=importepw.dryBulbTemperature,
    runIt=Toggle(True))  # -> readMe, port, comfortableOrNot, conditionOfPerson, degreesFromTarget, port_2, targetTemperature, upperTemperatureBound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; plug-in component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
panel_3 = Panel("3")
panel_4 = Panel([adaptivecomfortcalculator.percentOfTimeComfortable, adaptivecomfortcalculator.percentHotCold])
legendpar_2 = Ladybug_LegendParameters(highBound="22")  # -> legendPar; plug-in component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
panel_5 = Panel("0.25")
_3dchart = Ladybug_3DChart(inputData=flatten(readepresult.airTemperature), zScale="0", legendPar=legendpar_2, bakeIt=Toggle(False))  # -> readMe, graphMesh, graphCurves, legend, legendBasePts, title, titleBasePts, dataPts, conditionalHOY; plug-in component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

# ---- group: separate glazing, %comfort, %hotcold
panel_6 = Panel("""42.100457
12.899543
45.0""")

# ---- group: changed const w/ max ventilation, %comfort, %hotcold
panel_7 = Panel("""42.716895
12.865297
44.417808""")

# ---- group: baseline, no ventilation, %comfort, %hotcold
panel_8 = Panel("""15.924658
39.246575
44.828767""")
