# Grasshopper definition farah_silmi.gh (Grasshopper 0.9.76)
# plug-ins: Python Interpreter

# ---- group: epconstructionfor exterior
callfromepconstrlibrary = Honeybee_CallFromEPConstructionLibrary(keywords="extwindow")  # -> ThermMaterials, EPMaterials, EPWindowMaterials, EPConstructions; plug-in component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
panel = Panel(callfromepconstrlibrary.EPConstructions)
decomposeepconstruction = Honeybee_DecomposeEPConstruction(cnstrName=callfromepconstrlibrary.EPConstructions)  # -> materials, comments, UValue_SI, UValue_IP, RValue_SI, RValue_IP; plug-in component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
panel_2 = Panel(decomposeepconstruction.RValue_SI)
sort = SortList(Keys=decomposeepconstruction.RValue_SI, ValuesA=panel)  # -> Keys, ValuesA
panel_3 = Panel(sort.ValuesA)
item = ListItem(List=sort.ValuesA, Index="-1", Wrap=True)
list_item = ListItem(List=panel_3, Index="61", Wrap=True)
panel_4 = Panel(item)
panel_5 = Panel(list_item)

# ---- group: ladybug+honeybee flying
# Honeybee default materials will be assigned
# based on surface type
honeybee = Honeybee_Honeybee()  # -> out; plug-in component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
ladybug = Ladybug_Ladybug()  # -> out; plug-in component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

# ---- group: surface preparation
exterior_wall = Brep(<brep referenced from the Rhino model>)
floor = Brep(<brep referenced from the Rhino model>)
shade_w_context = Brep([<brep referenced from the Rhino model> x15])
wall = Brep(<brep referenced from the Rhino model>)
ceiling = Brep(<brep referenced from the Rhino model>)
glass = Brep(<brep referenced from the Rhino model>)
createhbsrfs = Honeybee_createHBSrfs(geometry=exterior_wall, srfType="0")  # -> readMe, simplify(HBSurface); plug-in component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
preview = CustomPreview(Geometry=shade_w_context, Shader=ColourSwatch(SwatchColor=RGBA(199, 185, 98, 160)))
preview_2 = CustomPreview(Geometry=glass, Shader=ColourSwatch(SwatchColor=RGBA(80, 222, 255, 160)))
createhbsrfs_2 = Honeybee_createHBSrfs(geometry=ceiling, srfType=Slider(3, range=0..6))  # -> readMe, simplify(HBSurface); plug-in component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
hb_epcontextsrf = HoneybeeEPContextSurfaces(shdSurfaces=flatten(shade_w_context))  # -> HBContext; inputs shdSurfaces: list of GeometryBase, justBoundingBox: Boolean
# ---------- hb_epcontextsrf: Python ----------
"""
prepare shading/context geometries

    Args:
        northVectorOrRotation: A vector that shows North or a number that shows
                               the rotation of the North from the Y axis
        bldgMasses: List of closed Breps as thermal zones.
    Returns:
        report: ...
        thermalZones: Thermal zone's geometries for visualiza
"""

ghenv.Component.Name = 'Honeybee EP context Surfaces'
ghenv.Component.NickName = 'HB_EPContextSrf'
ghenv.Component.Message = 'VER 0.0.60\nNOV_04_2016'
ghenv.Component.IconDisplayMode = ghenv.Component.IconDisplayMode.application
ghenv.Component.Category = "Honeybee"
ghenv.Component.SubCategory = "10 | Energy | Energy"
#compatibleHBVersion = VER 0.0.57\nNOV_04_2016
#compatibleLBVersion = VER 0.0.59\nFEB_01_2015
ghenv.Component.AdditionalHelpFromDocStrings = "2"

import rhinoscriptsyntax as rs
import Rhino as rc
import scriptcontext as sc
import os
import System
import Grasshopper.Kernel as gh
import uuid

tolerance = sc.doc.ModelAbsoluteTolerance
import math


def main(shdSurfaces, EPTransSchedule, meshingSettings, justBoundingBox):
    
    # import the classes
    if sc.sticky.has_key('honeybee_release'):

        try:
            if not sc.sticky['honeybee_release'].isCompatible(ghenv.Component): return -1
            if sc.sticky['honeybee_release'].isInputMissing(ghenv.Component): return -1
        except:
            warning = "You need a newer version of Honeybee to use this compoent." + \
            " Use updateHoneybee component to update userObjects.\n" + \
            "If you have already updated userObjects drag Honeybee_Honeybee component " + \
            "into canvas and try again."
            w = gh.GH_RuntimeMessageLevel.Warning
            ghenv.Component.AddRuntimeMessage(w, warning)
            return -1
        
        # don't customize this part
        hb_EPSrf = sc.sticky["honeybee_EPSurface"]
        hb_EPSHDSurface = sc.sticky["honeybee_EPShdSurface"]
        hb_RADMaterialAUX = sc.sticky["honeybee_RADMaterialAUX"]
        hb_EPObjectsAux = sc.sticky["honeybee_EPObjectsAUX"]()
        HBScheduleList = sc.sticky["honeybee_ScheduleLib"].keys()

        ########################################################################
        #----------------------------------------------------------------------#
        shdBreps = []
        # create bounding box of shading geometries
        if justBoundingBox:
            for brep in shdSurfaces:
                if brep.Faces.Count>1 or not brep.Faces[0].IsPlanar(sc.doc.ModelAbsoluteTolerance):
                    shdBreps.append(brep.GetBoundingBox(True).ToBrep())
                else:
                    shdBreps.append(brep)
        else:
            shdBreps = shdSurfaces
        
        shadingClasses = []
        shadingMeshPreview = []
        
        if meshingSettings == None:
            mp = rc.Geometry.MeshingParameters.Minimal
            mp.SimplePlanes = True
        else:
            mp = meshingSettings
        
        def getRadMaterialName(radMaterial):
            nameStr = radMaterial.split(" ")[2]
            name =  nameStr.split("\n")[0]
            return name
        
        for brepCount, brep in enumerate(shdBreps):
            if brep != None:
                isPlanar = True
                # check planarity
                for face in brep.Faces:
                    if not face.IsPlanar(tolerance):
                        isPlanar = False
                        break
                
                shadingBreps = []
                if not isPlanar:
                    meshArray = rc.Geometry.Mesh.CreateFromBrep(brep, mp)
                    for mesh in meshArray:
                        for meshFace in range(mesh.Faces.Count):
                            vertices = list(mesh.Faces.GetFaceVertices(meshFace))[1:]
                            vertices = vertices + [sc.doc.ModelAbsoluteTolerance]
                            # create the brep from mesh
                            shdBrep = rc.Geometry.Brep.CreateFromCornerPoints(*vertices)
                            shadingBreps.append(shdBrep)
                else:
                    for face in brep.Faces:
                        shadingBreps.append(face.DuplicateFace(False))
                
                for faceCount, shdBrep in enumerate(shadingBreps):
                        thisShading = hb_EPSHDSurface(shdBrep, 1000*brepCount + faceCount, 'shdSrf_' + `brepCount` + '_' + `faceCount` + "_" + str(uuid.uuid4()))
                        
                        # add transmittance schedule if any
                        if EPTransSchedule!=None:
                            schedule= EPTransSchedule.upper()
                            if schedule!=None and not schedule.lower().endswith(".csv") and schedule not in HBScheduleList:
                                msg = "Cannot find " + schedule + " in Honeybee schedule library."
                                print msg
                                ghenv.Component.AddRuntimeMessage(gh.GH_RuntimeMessageLevel.Warning, msg)
                                return -1
                            elif schedule!=None and schedule.lower().endswith(".csv"):
                                # check if csv file is existed
                                if not os.path.isfile(schedule):
                                    msg = "Cannot find the shchedule file: " + schedule
                                    print msg
                                    ghenv.Component.AddRuntimeMessage(gh.GH_RuntimeMessageLevel.Warning, msg)
                                    return -1
                            
                            thisShading.TransmittanceSCH = schedule
                        
                        # add the Rad Material if any
                        if RADMaterial!=None:
                            # if it is just the name of the material make sure it is already defined
                            if len(RADMaterial.split(" ")) == 1:
                                # if the material is not in the library add it to the library
                                if not hb_RADMaterialAUX.isMatrialExistInLibrary(RADMaterial):
                                    warningMsg = "Can't find " + RADMaterial + " in RAD Material Library.\n" + \
                                                "Add the material to the library and try again."
                                    ghenv.Component.AddRuntimeMessage(gh.GH_RuntimeMessageLevel.Warning, warningMsg)
                                    return
                                
                                try:
                                    thisShading.setRADMaterial(RADMaterial)
                                except Exception, e:
                                    print e
                                    warningMsg = "You are using an old version of Honeybee_Honeybee! Update your files and try again."
                                    print warningMsg
                                    ghenv.Component.AddRuntimeMessage(gh.GH_RuntimeMessageLevel.Warning, warningMsg)
                                    return
                                
                                addedToLib = True
                            else:
                                
                                # try to add the material to the library
                                addedToLib, thisShading.RadMaterial = hb_RADMaterialAUX.analyseRadMaterials(RADMaterial, True)
                                
                            if addedToLib==False:
                                warningMsg = "Failed to add " + RADMaterial + " to the Library."
                                ghenv.Component.AddRuntimeMessage(gh.GH_RuntimeMessageLevel.Warning, warningMsg)
                                return
                        
                        # add shading to the list
                        shadingClasses.append(thisShading)
                
        # add to the hive
        hb_hive = sc.sticky["honeybee_Hive"]()
        HBContext  = hb_hive.addToHoneybeeHive(shadingClasses, ghenv.Component)
        return HBContext
        ################################################################################################
    else:
        print "You should first let Honeybee to fly..."
        w = gh.GH_RuntimeMessageLevel.Warning
        ghenv.Component.AddRuntimeMessage(w, "You should first let Honeybee to fly...")
        return -1
        

if _shdSurfaces and _shdSurfaces[0]!=None:
    # add cleaning function
    result= main(_shdSurfaces, EPTransSchedule_, meshingSettings_, justBoundingBox_)
    
    if result != -1: HBContext = result
# ---------- end hb_epcontextsrf ----------
addhbglz = Honeybee_addHBGlz(HBObj=createhbsrfs.HBSurface, childSurfaces=flatten(glass), EPConstructions=list_item)  # -> simplify(HBObjWGLZ); plug-in component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
createhbsrfs_3 = Honeybee_createHBSrfs(geometry=wall, srfType=Slider(0, range=0..6))  # -> readMe, simplify(HBSurface); plug-in component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
createhbsrfs_4 = Honeybee_createHBSrfs(geometry=floor, srfType=Slider(2, range=0..6))  # -> readMe, simplify(HBSurface); plug-in component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

# ---- group: zone
bldgprograms = Honeybee_bldgPrograms({"Office": 0, "Retail": 1, "MidriseApartment": 2, "PrimarySchool": 3, "SecondarySchool": 4, "SmallHotel": 5, "LargeHotel": 6, "Hospital": 7, "Outpatient": 8, "Warehouse": 9, "SuperMarket": 10, "FullServiceRestaurant": 11, "QuickServiceRestaurant": 12}, selected="MidriseApartment")
listzoneprograms = Honeybee_ListZonePrograms(bldgProgram=bldgprograms)  # -> MidriseApartmentZonePrograms; plug-in component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
item_2 = ListItem(List=listzoneprograms, Index=0, Wrap=True)
panel_6 = Panel(item_2)

# ----
makeadiabatic = Honeybee_MakeAdiabatic(HBSrfs=flatten([createhbsrfs_2.HBSurface, createhbsrfs_3.HBSurface, createhbsrfs_4.HBSurface]))  # -> HBSrfs; plug-in component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
createhbzones = Honeybee_createHBZones(name="room", zoneProgram=panel_6, HBSurfaces=flatten([makeadiabatic, addhbglz]), isConditioned=Toggle(False))  # -> out, HBZone; plug-in component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

# ---- group: ventilation and infilteration
setepnatvent = Honeybee_SetEPAirFlow(
    HBZones=flatten(createhbzones.HBZone),
    naturalVentilationType="1",
    minIndoorTempForNatVent="20",
    maxIndoorTempForNatVent="40",
    minOutdoorTempForNatVent="18",
    maxOutdoorTempForNatVent="38")  # -> readMe, simplify(HBZones); plug-in component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
setepzoneloads = Honeybee_SetEnergyPlusZoneLoads(
    HBZones=setepnatvent.HBZones,
    equipmentLoadPerArea="2",
    infiltrationRatePerArea=".0003",
    lightingDensityPerArea="3",
    numOfPeoplePerArea=".056",
    ventilationPerArea=".0002",
    ventilationPerPerson=".001")  # -> loads, HBZones; plug-in component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

# ---- group: weather input
open_weather_file = Ladybug_OpenEPWWeatherFile(open=Toggle(True))  # -> epwFile; plug-in component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
importepw = Ladybug_ImportEpw(epwFile=open_weather_file)  # -> readMe, latitude, location, dryBulbTemperature, dewPointTemperature, relativeHumidity, windSpeed, windDirection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; plug-in component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

# ----
flip = Flip(Surface=floor)  # -> Surface, Result
gentestpts = Honeybee_GenerateTestPoints(testGeometry=flip.Surface, gridSize=".5", distBaseSrf=".762", moveTestMesh=True)  # -> readMe, simplify(testPoints), simplify(ptsVectors), simplify(facesArea), simplify(mesh); plug-in component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
radparameters = Honeybee_RADParameters(quality="1")  # -> readMe, radParameters; plug-in component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
item_3 = ListItem(List=gentestpts.testPoints, Index="58", Wrap=True)
annualdaylightsimulation = Honeybee_AnnualDaylightSimulation(
    epwWeatherFile=open_weather_file,
    testPoints=gentestpts.testPoints,
    ptsVectors=gentestpts.ptsVectors,
    testMesh=gentestpts.mesh,
    radParameters=radparameters.radParameters)  # -> analysisRecipe; plug-in component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
toggle = BooleanToggle(True)
lightingcontrol = Honeybee_LightingControlRecipe(
    controlType="4",
    sensorPoints=item_3,
    lightingPower=250,
    lightingSetpoint=300,
    ballastLossFactor=20,
    standbyPower=3,
    delayTime=5)  # -> lightingControlGroup; plug-in component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
gethbzoneepschedules = Honeybee_GetZoneEnergyPlusSchedules(HBZone=createhbzones.HBZone)  # -> occupancySchedule, occupancyActivitySch, heatingSetPtSchedule, coolingSetPtSchedule, lightingSchedule, equipmentSchedule, infiltrationSchedule; plug-in component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
rundaylightanalysis = Honeybee_RunDaylightSimulation(
    HBObjects=flatten(createhbzones.HBZone),
    analysisRecipe=annualdaylightsimulation,
    writeRad=toggle,
    runRad=toggle,
    numOfCPUs=Slider(4, range=0..10),
    overwriteResults=True)  # -> readMe, analysisType, resultsUnit, results, testPts, annual_analysis_files, radGeoFile, studyFolder, done; plug-in component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
panel_7 = Panel(gethbzoneepschedules.lightingSchedule)
readannualresultsi = Honeybee_ReadAnnualResultI(
    illFilesAddress=rundaylightanalysis.annual_analysis_files,
    testPoints=simplify(gentestpts.testPoints),
    ptsVectors=gentestpts.ptsVectors,
    occupancyFiles=gethbzoneepschedules.lightingSchedule,
    DLAIllumThresholds=300,
    lightingControlGroups=lightingcontrol,
    runIt=Toggle(True))  # -> DLA, UDLI_Less_100, UDLI_100_2000, UDLI_More_2000, CDA, sDA, annualProfiles, htmReport; plug-in component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
point = Point(<point referenced from the Rhino model>)
_3dchart = Ladybug_3DChart(inputData=flatten(readannualresultsi.DLA), basePoint=point, zScale="0")  # -> out, graphMesh, graphCurves, legend, legendBasePts, title, titleBasePts, dataPts, conditionalHOY; plug-in component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
dsannualprofiles = Honeybee_DaysimAnnualProfiles(annualProfiles=readannualresultsi.annualProfiles)  # -> simplify(occupancyProfile), simplify(shadingProfiles), simplify(lightingControlProfiles), simplify(dgpProfile); plug-in component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
convertepschvalues = Honeybee_ConvertEnergyPlusScheduleToValues(schName=gethbzoneepschedules.lightingSchedule, epwFileForHol=open_weather_file)  # -> values, holidays; plug-in component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
pt = ConstructPoint(XCoordinate="120", YCoordinate=0, ZCoordinate=0)
point_2 = Point(<point referenced from the Rhino model>)
_3dchart_2 = Ladybug_3DChart(
    inputData=flatten([dsannualprofiles.lightingControlProfiles, convertepschvalues.values]),
    basePoint=point_2,
    xScale="0.02",
    yScale=".15",
    zScale="0")  # -> readMe, graphMesh, graphCurves, legend, legendBasePts, title, titleBasePts, dataPts, conditionalHOY; plug-in component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

# ---- group: output
epoutput = Honeybee_GenerateEPOutput(zoneGainsAndLosses="False", zoneComfortMetrics=Toggle(True), surfaceTempAnalysis="False")  # -> report, flatten(simulationOutputs); plug-in component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

# ----
# update lighting schedule
geometry = Geometry(createhbzones.HBZone)
setepzoneschedules = Honeybee_SetEnergyPlusZoneSchedules(HBZones=setepzoneloads.HBZones, lightingSchedules=readannualresultsi.annualProfiles)  # -> schedules, simplify(HBZones); plug-in component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

# ---- group: simulation
toggle_2 = BooleanToggle(True)
runenergysimulation = Honeybee_RunEnergySimulation(
    epwFile=open_weather_file,
    HBZones=flatten(setepzoneschedules.HBZones),
    HBContext=flatten(hb_epcontextsrf),
    simulationOutputs=flatten(epoutput.simulationOutputs),
    writeIdf=toggle_2,
    runEnergyPlus=toggle_2)  # -> report, idfFileAddress, htmlReport, resultFileAddress; plug-in component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

# ----
readepresult = Honeybee_ReadEPResult(resultFileAddress=runenergysimulation.resultFileAddress)  # -> port, port_2, port_3, port_4, port_5, port_6, port_7, port_8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; plug-in component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
adaptivecomfortcalculator = Ladybug_AdaptiveComfortCalculator(
    dryBulbTemperature=readepresult.airTemperature,
    meanRadiantTemperature=readepresult.meanRadTemperature,
    prevailingOutdoorTemp=importepw.dryBulbTemperature,
    windSpeed=importepw.windSpeed,
    runIt=Toggle(True))  # -> readMe, port, comfortableOrNot, conditionOfPerson, degreesFromTarget, port_2, targetTemperature, upperTemperatureBound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; plug-in component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
panel_8 = Panel([adaptivecomfortcalculator.percentOfTimeComfortable, adaptivecomfortcalculator.percentHotCold])
_3dchart_3 = Ladybug_3DChart(
    inputData=flatten([adaptivecomfortcalculator.degreesFromTarget, adaptivecomfortcalculator.conditionOfPerson]),
    xScale=".25",
    zScale="0")  # -> readMe, graphMesh, graphCurves, legend, legendBasePts, title, titleBasePts, dataPts, conditionalHOY; plug-in component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
