# Grasshopper definition jiang_hewen.gh (Grasshopper 0.9.76)
# plug-ins: Python Interpreter

honeybee = Honeybee_Honeybee()  # -> Vviiiiiiiiiizzz; plug-in component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
ladybug = Ladybug_Ladybug()  # -> Vviiiiiiiiiizzz; plug-in component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
srf = Surface(<surface referenced from the Rhino model>)

# ---- group: shading2
srf_2 = Surface([<surface referenced from the Rhino model> x49])

# ----
srf_3 = Surface(<surface referenced from the Rhino model>)
srf_4 = Surface(<surface referenced from the Rhino model>)

# ---- group: sahding
srf_5 = Surface([<surface referenced from the Rhino model> x33])

# ----
srf_6 = Surface([<surface referenced from the Rhino model> x2])
srf_7 = Surface([<surface referenced from the Rhino model> x4])
srf_8 = Surface(<surface referenced from the Rhino model>)
srf_9 = Surface([<surface referenced from the Rhino model> x3])
createhbsrfs = Honeybee_createHBSrfs(geometry=srf, srfType="2")  # -> readMe, simplify(HBSurface); plug-in component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
createhbsrfs_2 = Honeybee_createHBSrfs(geometry=srf_4, srfType="0")  # -> readMe, simplify(HBSurface); plug-in component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
createhbsrfs_3 = Honeybee_createHBSrfs(geometry=srf_3, srfType="3")  # -> readMe, simplify(HBSurface); plug-in component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
createhbsrfs_4 = Honeybee_createHBSrfs(geometry=srf_6, srfType="0")  # -> readMe, simplify(HBSurface); plug-in component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
createhbsrfs_5 = Honeybee_createHBSrfs(geometry=srf_8, srfType="0")  # -> readMe, simplify(HBSurface); plug-in component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
hb_epcontextsrf = HoneybeeEPContextSurfaces(shdSurfaces=flatten(srf_2))  # -> HBContext; inputs shdSurfaces: list of Brep, justBoundingBox: Boolean
# ---------- hb_epcontextsrf: Python ----------
"""
prepare shading/context geometries

    Args:
        northVectorOrRotation: A vector that shows North or a number that shows
                               the rotation of the North from the Y axis
        bldgMasses: List of closed Breps as thermal zones.
    Returns:
        report: ...
        thermalZones: Thermal zone's geometries for visualiza
"""

ghenv.Component.Name = 'Honeybee EP context Surfaces'
ghenv.Component.NickName = 'HB_EPContextSrf'
ghenv.Component.Message = 'VER 0.0.62\nJUL_28_2017'
ghenv.Component.IconDisplayMode = ghenv.Component.IconDisplayMode.application
ghenv.Component.Category = "Honeybee"
ghenv.Component.SubCategory = "10 | Energy | Energy"
#compatibleHBVersion = VER 0.0.57\nNOV_04_2016
#compatibleLBVersion = VER 0.0.59\nFEB_01_2015
ghenv.Component.AdditionalHelpFromDocStrings = "2"

import rhinoscriptsyntax as rs
import Rhino as rc
import scriptcontext as sc
import os
import System
import Grasshopper.Kernel as gh
import uuid

tolerance = sc.doc.ModelAbsoluteTolerance
import math


def main(shdSurfaces, EPTransSchedule, meshingSettings, justBoundingBox):
    
    # import the classes
    if sc.sticky.has_key('honeybee_release'):

        try:
            if not sc.sticky['honeybee_release'].isCompatible(ghenv.Component): return -1
            if sc.sticky['honeybee_release'].isInputMissing(ghenv.Component): return -1
        except:
            warning = "You need a newer version of Honeybee to use this compoent." + \
            " Use updateHoneybee component to update userObjects.\n" + \
            "If you have already updated userObjects drag Honeybee_Honeybee component " + \
            "into canvas and try again."
            w = gh.GH_RuntimeMessageLevel.Warning
            ghenv.Component.AddRuntimeMessage(w, warning)
            return -1
        
        # don't customize this part
        hb_EPSrf = sc.sticky["honeybee_EPSurface"]
        hb_EPSHDSurface = sc.sticky["honeybee_EPShdSurface"]
        hb_RADMaterialAUX = sc.sticky["honeybee_RADMaterialAUX"]
        hb_EPObjectsAux = sc.sticky["honeybee_EPObjectsAUX"]()
        HBScheduleList = sc.sticky["honeybee_ScheduleLib"].keys()

        ########################################################################
        #----------------------------------------------------------------------#
        shdBreps = []
        # create bounding box of shading geometries
        if justBoundingBox:
            for brep in shdSurfaces:
                if brep.Faces.Count>1 or not brep.Faces[0].IsPlanar(sc.doc.ModelAbsoluteTolerance):
                    shdBreps.append(brep.GetBoundingBox(True).ToBrep())
                else:
                    shdBreps.append(brep)
        else:
            shdBreps = shdSurfaces
        
        shadingClasses = []
        shadingMeshPreview = []
        
        if meshingSettings == None:
            mp = rc.Geometry.MeshingParameters.Minimal
            mp.SimplePlanes = True
        else:
            mp = meshingSettings
        
        def getRadMaterialName(radMaterial):
            nameStr = radMaterial.split(" ")[2]
            name =  nameStr.split("\n")[0]
            return name
        
        for brepCount, brep in enumerate(shdBreps):
            if brep != None:
                isPlanar = True
                # check planarity
                for face in brep.Faces:
                    if not face.IsPlanar(tolerance):
                        isPlanar = False
                        break
                
                shadingBreps = []
                if not isPlanar:
                    meshArray = rc.Geometry.Mesh.CreateFromBrep(brep, mp)
                    for mesh in meshArray:
                        for meshFace in range(mesh.Faces.Count):
                            vertices = list(mesh.Faces.GetFaceVertices(meshFace))[1:]
                            vertices = vertices + [sc.doc.ModelAbsoluteTolerance]
                            # create the brep from mesh
                            shdBrep = rc.Geometry.Brep.CreateFromCornerPoints(*vertices)
                            shadingBreps.append(shdBrep)
                else:
                    for face in brep.Faces:
                        shadingBreps.append(face.DuplicateFace(False))
                
                for faceCount, shdBrep in enumerate(shadingBreps):
                        thisShading = hb_EPSHDSurface(shdBrep, 1000*brepCount + faceCount, 'shdSrf_' + `brepCount` + '_' + `faceCount` + "_" + str(uuid.uuid4()))
                        
                        # add transmittance schedule if any
                        if EPTransSchedule!=None:
                            schedule= EPTransSchedule.upper()
                            if schedule!=None and not schedule.lower().endswith(".csv") and schedule not in HBScheduleList:
                                msg = "Cannot find " + schedule + " in Honeybee schedule library."
                                print msg
                                ghenv.Component.AddRuntimeMessage(gh.GH_RuntimeMessageLevel.Warning, msg)
                                return -1
                            elif schedule!=None and schedule.lower().endswith(".csv"):
                                # check if csv file is existed
                                if not os.path.isfile(schedule):
                                    msg = "Cannot find the shchedule file: " + schedule
                                    print msg
                                    ghenv.Component.AddRuntimeMessage(gh.GH_RuntimeMessageLevel.Warning, msg)
                                    return -1
                            
                            thisShading.TransmittanceSCH = schedule
                        
                        # add the Rad Material if any
                        if RADMaterial!=None:
                            # if it is just the name of the material make sure it is already defined
                            if len(RADMaterial.split(" ")) == 1:
                                # if the material is not in the library add it to the library
                                if not hb_RADMaterialAUX.isMatrialExistInLibrary(RADMaterial):
                                    warningMsg = "Can't find " + RADMaterial + " in RAD Material Library.\n" + \
                                                "Add the material to the library and try again."
                                    ghenv.Component.AddRuntimeMessage(gh.GH_RuntimeMessageLevel.Warning, warningMsg)
                                    return
                                
                                try:
                                    thisShading.setRADMaterial(RADMaterial)
                                except Exception, e:
                                    print e
                                    warningMsg = "You are using an old version of Honeybee_Honeybee! Update your files and try again."
                                    print warningMsg
                                    ghenv.Component.AddRuntimeMessage(gh.GH_RuntimeMessageLevel.Warning, warningMsg)
                                    return
                                
                                addedToLib = True
                            else:
                                
                                # try to add the material to the library
                                addedToLib, thisShading.RadMaterial = hb_RADMaterialAUX.analyseRadMaterials(RADMaterial, True)
                                
                            if addedToLib==False:
                                warningMsg = "Failed to add " + RADMaterial + " to the Library."
                                ghenv.Component.AddRuntimeMessage(gh.GH_RuntimeMessageLevel.Warning, warningMsg)
                                return
                        
                        # add shading to the list
                        shadingClasses.append(thisShading)
                
        # add to the hive
        hb_hive = sc.sticky["honeybee_Hive"]()
        HBContext  = hb_hive.addToHoneybeeHive(shadingClasses, ghenv.Component)
        return HBContext
        ################################################################################################
    else:
        print "You should first let Honeybee to fly..."
        w = gh.GH_RuntimeMessageLevel.Warning
        ghenv.Component.AddRuntimeMessage(w, "You should first let Honeybee to fly...")
        return -1
        

if _shdSurfaces and _shdSurfaces[0]!=None:
    # add cleaning function
    result= main(_shdSurfaces, EPTransSchedule_, meshingSettings_, justBoundingBox_)
    
    if result != -1: HBContext = result
# ---------- end hb_epcontextsrf ----------
addhbglz = Honeybee_addHBGlz(HBObj=createhbsrfs_5.HBSurface, childSurfaces=flatten(srf_7))  # -> HBObjWGLZ; plug-in component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
addhbglz_2 = Honeybee_addHBGlz(HBObj=createhbsrfs_2.HBSurface, childSurfaces=flatten(srf_9))  # -> HBObjWGLZ; plug-in component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
srfattributelist = Honeybee_SurfaceAttributeList({"Name": "name", "Radiance Material": "RadMaterial", "EnergyPlus Construction": "EPConstruction", "Surface Type": "type", "Boundary Condition": "BC", "Sun Exposure": "sunExposure", "Wind Exposure": "windExposure", "Has Child Surface": "hasChild", "Is Child Surface": "isChild", "Is Planar": "isPlanar", "Srf Type Set By User": "srfTypeByUser", "Boundary Condition Set By User": "srfBCByUser", "Shade Material Name": "shadeMaterialName", "Shading Control Name": "shadingControlName", "Shcading Schedule Name": "shadingSchName"}, selected="EnergyPlus Construction")
createhbzones = Honeybee_createHBZones(
    name="home",
    HBSurfaces=flatten([createhbsrfs_3.HBSurface, createhbsrfs.HBSurface, createhbsrfs_4.HBSurface, createhbsrfs_5.HBSurface, createhbsrfs_2.HBSurface]),
    isConditioned=Toggle(False))  # -> readMe, HBZone; plug-in component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
# MODEL
addhbglz_3 = Honeybee_addHBGlz(HBObj=createhbzones.HBZone, childSurfaces=flatten([srf_7, srf_9]))  # -> HBObjWGLZ; plug-in component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

# ---- group: pic construction
callfromepconstrlibrary = Honeybee_CallFromEPConstructionLibrary()  # -> ThermMaterials, EPMaterials, EPWindowMaterials, EPConstructions; plug-in component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
panel = Panel("""0
4
1
2""")
searchepconstruction = Honeybee_SearchEPConstruction(EPConstrList=callfromepconstrlibrary.EPConstructions, standard="2", climateZone="4", surfaceType=panel)  # -> EPSelectedConstr; plug-in component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
panel_2 = Panel(searchepconstruction)
decomposeepconstruction = Honeybee_DecomposeEPConstruction(cnstrName=searchepconstruction)  # -> materials, comments, UValue_SI, UValue_IP, RValue_SI, RValue_IP; plug-in component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
sort = SortList(Keys=decomposeepconstruction.RValue_SI, ValuesA=searchepconstruction)  # -> Keys, reverse(ValuesA)
sort_2 = SortList(Keys=decomposeepconstruction.RValue_SI, ValuesA=searchepconstruction)  # -> Keys, ValuesA
item = ListItem(List=sort_2.ValuesA, Index=0, Wrap=True)  # -> flatten(Item)
item_2 = ListItem(List=sort.ValuesA, Index=0, Wrap=True)  # -> flatten(Item)
item_3 = ListItem(List=item_2, Index=0, Wrap=True)  # -> Item, Item1, Item2, Item3
item_4 = ListItem(List=item, Index=0, Wrap=True)  # -> Item, Item1, Item2, Item3
setepzonecnstr = Honeybee_SetEPZoneConstruction(
    HBZones=flatten(addhbglz_3),
    wallEPConstruction=item_3.Item,
    windowEPConstruction=item_3.Item1,
    roofEPConstruction=item_3.Item2,
    floorEPConstruction=item_3.Item3)  # -> simplify(modifiedHBZones); plug-in component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
setepzonecnstr_2 = Honeybee_SetEPZoneConstruction(
    HBZones=flatten(addhbglz_3),
    wallEPConstruction=item_4.Item,
    windowEPConstruction=item_4.Item1,
    roofEPConstruction=item_4.Item2,
    floorEPConstruction=item_4.Item3)  # -> simplify(modifiedHBZones); plug-in component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

# ----
labelsurfaces = Honeybee_LabelZoneSurfaces(HBObjects=flatten(addhbglz_3), attribute=srfattributelist)  # -> surfaceTxtLabels, labelBasePts, brepTxtLabels, surfaceWireFrames; plug-in component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
decomposeepconstruction_2 = Honeybee_DecomposeEPConstruction(cnstrName=searchepconstruction)  # -> materials, comments, UValue_SI, UValue_IP, RValue_SI, RValue_IP; plug-in component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
sort_3 = SortList(Keys=decomposeepconstruction_2.RValue_SI, ValuesA=searchepconstruction)  # -> Keys, ValuesA
panel_3 = Panel("""0
-1
0
0""")
item_5 = ListItem(List=sort_3.ValuesA, Index=graft(panel_3), Wrap=True)  # -> flatten(Item)
item_6 = ListItem(List=item_5, Index=0, Wrap=True)  # -> Item, Item1, Item2, Item3
setepzonecnstr_3 = Honeybee_SetEPZoneConstruction(
    HBZones=flatten(addhbglz_3),
    wallEPConstruction=item_6.Item,
    windowEPConstruction=item_6.Item1,
    roofEPConstruction=item_6.Item2,
    floorEPConstruction=item_6.Item3)  # -> simplify(modifiedHBZones); plug-in component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

# ----
# CONSTRUCTION
list = ValueList({"default": 0, "low R value": 1, "high R value": 2, "mannual": 3}, selected="mannual")
filter = StreamFilter(Gate=list, Stream0=addhbglz_3, Stream1=setepzonecnstr_2, Stream2=setepzonecnstr, Stream3=setepzonecnstr_3)

# ---- group: ventilation
# VENRILATION
setepnatvent = Honeybee_SetEPAirFlow(
    HBZones=flatten(filter),
    naturalVentilationType="1",
    minIndoorTempForNatVent="23",
    maxIndoorTempForNatVent="27",
    minOutdoorTempForNatVent="17",
    maxOutdoorTempForNatVent="28")  # -> readMe, simplify(HBZones); plug-in component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

# ---- group: infiltration
ach2m3_s_m2_calculator = Honeybee_infORventPerAreaCalculator(HBZones=flatten(setepnatvent.HBZones), airFlowRate=Slider(1, range=0..10))  # -> readMe, infORventPerArea, allFloors; plug-in component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
# INFILTRATION
setepzoneloads = Honeybee_SetEnergyPlusZoneLoads(HBZones=setepnatvent.HBZones, infiltrationRatePerArea=ach2m3_s_m2_calculator.infORventPerArea)  # -> loads, HBZones; plug-in component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

# ----
panel_4 = Panel("""1
1
1
1
1
1
1
1
1
1
1
0
0
0
0
0
0
0
0
1
1
1
1
1""")
# MY SCHEDULE
dup = DuplicateData(Data=panel_4, Number="365", Order=True)
csvschedule = Honeybee_CreateCSVSchedule(values=dup, scheduleName="dorm_occ.csv", writeFile=Toggle(True))  # -> readMe, csvSchedule; plug-in component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
panel_5 = Panel(csvschedule.csvSchedule)

toggle = BooleanToggle(False)
toggle_2 = BooleanToggle(True)
# ADIABATIC
merge = Merge(Data1=toggle, Data2=Toggle(True), Data3=toggle, Data4=toggle)
makeadiabaticbytype = Honeybee_MakeAdiabaticByType(HBZones=setepzoneloads.HBZones, walls=merge, roofs=toggle_2, ceilings=toggle_2, floors=toggle_2)  # -> HBZones; plug-in component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

toggle_3 = BooleanToggle(True)
epoutput = Honeybee_GenerateEPOutput(
    zoneEnergyUse=toggle_3,
    zoneGainsAndLosses=toggle_3,
    zoneComfortMetrics=toggle_3,
    surfaceTempAnalysis="False",
    surfaceEnergyAnalysis=toggle_3)  # -> report, flatten(simulationOutputs); plug-in component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
path = FilePath("C:\Users\wen\Desktop\Philadelphia_weather_files\USA_PA_Philadelphia.Intl.AP.724080_TMY3.epw")
toggle_4 = BooleanToggle(True)
importepw = Ladybug_ImportEpw(epwFile=path)  # -> readMe, latitude, location, dryBulbTemperature, dewPointTemperature, relativeHumidity, windSpeed, windDirection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; plug-in component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

genhbzonetestpts = Honeybee_GenerateZoneTestPoints(HBZone=makeadiabaticbytype, gridSize="1", distBaseSrf="0.76", moveTestMesh=True)  # -> readMe, simplify(testPoints), simplify(ptsVectors), simplify(facesArea), simplify(mesh); plug-in component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
annualdaylightsimulation = Honeybee_AnnualDaylightSimulation(
    epwWeatherFile=path,
    testPoints=genhbzonetestpts.testPoints,
    ptsVectors=genhbzonetestpts.ptsVectors,
    testMesh=genhbzonetestpts.mesh)  # -> analysisRecipe; plug-in component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
toggle_5 = BooleanToggle(True)
rundaylightanalysis = Honeybee_RunDaylightSimulation(
    HBObjects=flatten([hb_epcontextsrf, makeadiabaticbytype]),
    analysisRecipe=annualdaylightsimulation,
    writeRad=toggle_5,
    runRad=toggle_5,
    overwriteResults=True)  # -> readMe, analysisType, resultsUnit, results, testPts, annual_analysis_files, radGeoFile, studyFolder, done; plug-in component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
# POST PROCESS
# Annual daylight UDLI
occupancygenerator = Honeybee_DaysimOccupancyGenerator(weekendDays=[1, 2], writeTheOcc=Toggle(True))  # -> occupancyFile; plug-in component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
readannualresultsi = Honeybee_ReadAnnualResultI(
    illFilesAddress=rundaylightanalysis.annual_analysis_files,
    testPoints=simplify(rundaylightanalysis.testPts),
    ptsVectors=genhbzonetestpts.ptsVectors,
    occupancyFiles=occupancygenerator,
    DLAIllumThresholds=300,
    runIt=Toggle(True))  # -> DLA, UDLI_Less_100, UDLI_100_2000, UDLI_More_2000, CDA, sDA, annualProfiles, htmReport; plug-in component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
recolormesh = Ladybug_RecolorMesh(
    analysisResult=readannualresultsi.UDLI_100_2000,
    inputMesh=genhbzonetestpts.mesh,
    analysisTitle="UDLI 100-2000",
    legendTitle="%")  # -> readMe, newMesh, newLegend, legendBasePt, meshColors, legendColors; plug-in component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

# ----
# Schedule
setepzoneschedules = Honeybee_SetEnergyPlusZoneSchedules(
    HBZones=makeadiabaticbytype,
    occupancySchedules=csvschedule.csvSchedule,
    lightingSchedules=readannualresultsi.annualProfiles)  # -> schedules, simplify(HBZones); plug-in component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
runenergysimulation = Honeybee_RunEnergySimulation(
    epwFile=path,
    HBZones=flatten(setepzoneschedules.HBZones),
    HBContext=flatten(hb_epcontextsrf),
    simulationOutputs=flatten(epoutput.simulationOutputs),
    writeIdf=toggle_4,
    runEnergyPlus=toggle_4)  # -> report, idfFileAddress, htmlReport, resultFileAddress; plug-in component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

readepresult = Honeybee_ReadEPResult(resultFileAddress=runenergysimulation.resultFileAddress)  # -> port, port_2, port_3, port_4, electricLight, electricEquip, fanElectric, port_5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; plug-in component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
adaptivecomfortcalculator = Ladybug_AdaptiveComfortCalculator(
    dryBulbTemperature=readepresult.airTemperature,
    meanRadiantTemperature=readepresult.meanRadTemperature,
    prevailingOutdoorTemp=importepw.dryBulbTemperature,
    runIt=Toggle(True))  # -> readMe, port, comfortableOrNot, conditionOfPerson, degreesFromTarget, port_2, targetTemperature, upperTemperatureBound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; plug-in component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
legendpar = Ladybug_LegendParameters(lowBound="-1", highBound="1", numSegments="3")  # -> legendPar; plug-in component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
panel_6 = Panel(adaptivecomfortcalculator.percentOfTimeComfortable)
# COMFORT
number_slider = Slider(0.25, range=0..1)
_3dchart = Ladybug_3DChart(inputData=flatten(adaptivecomfortcalculator.conditionOfPerson), xScale=number_slider, zScale="0", legendPar=legendpar)  # -> readMe, graphMesh, graphCurves, legend, legendBasePts, title, titleBasePts, dataPts, conditionalHOY; plug-in component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
concat = Concatenate(FragmentA="comfortable% :", FragmentB=panel_6)
pt = Point(<point referenced from the Rhino model>)
tag = TextTag3D(Location=pt, Text=concat, Size="20", Justification=7)

readepsrfresult = Honeybee_ReadEPSurfaceResult(resultFileAddress=runenergysimulation.resultFileAddress)  # -> port, port_2, surfaceEnergyFlow, opaqueEnergyFlow, glazEnergyFlow, port_3, port_4, port_5, port_6, port_7; plug-in component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
energybalance = Honeybee_ConstructEnergyBalance(
    HBZones=flatten(setepzoneschedules.HBZones),
    electricLight=readepresult.electricLight,
    electricEquip=readepresult.electricEquip,
    fanElectric=readepresult.fanElectric,
    peopleGains=readepresult.peopleGains,
    totalSolarGain=readepresult.totalSolarGain,
    infiltrationEnergy=readepresult.infiltrationEnergy,
    natVentEnergy=readepresult.natVentEnergy,
    surfaceEnergyFlow=readepsrfresult.surfaceEnergyFlow)  # -> readMe, port, flrNormEnergyBal, flrNormBalWStorage, port_2, modelEnergyBalance, energyBalWithStorage; plug-in component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
selectandaveragedata = Ladybug_AverageData(annualHourlyData=energybalance.flrNormBalWStorage, totalOrAverage=Toggle(True))  # -> readMe, selHourlyData, totaledDaily, totaledMonthly, totMonthlyPerHour, totAnalysisPeriod; plug-in component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
gradientlibrary = Ladybug_GradientLibrary(gradIndex="19")  # -> customColors; plug-in component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
legendpar_2 = Ladybug_LegendParameters(customColors=flatten(gradientlibrary))  # -> legendPar; plug-in component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
# Energy Balance
barchart = Ladybug_MonthlyBarChart(
    inputData=flatten(selectandaveragedata.totaledMonthly),
    stackValues=Toggle(True),
    altTitle="house energy balance",
    altYAxisTitle="energy kWh",
    legendPar=legendpar_2)  # -> readMe, dataMesh, dataCurves, dataCrvColors, graphAxes, graphLabels, title, titleBasePt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; plug-in component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
geo = Geometry([barchart.dataMesh, barchart.dataCurves, barchart.dataCrvColors, barchart.graphAxes, barchart.title, barchart.graphLabels, barchart.legend])
pt_2 = Point(<point referenced from the Rhino model>)
move = Move(Geometry=geo, Motion=pt_2)  # -> Geometry, Transform
scale = Scale(Geometry=move.Geometry, Center=pt_2, Factor=Slider(5, range=0..10))  # -> Geometry, Transform

# ----
# NORMAL DAYLIGHT
_3dchart_2 = Ladybug_3DChart(inputData=flatten(readepresult.electricLight), xScale="0.25", zScale="0")  # -> readMe, graphMesh, graphCurves, legend, legendBasePts, title, titleBasePts, dataPts, conditionalHOY; plug-in component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
geo_2 = Geometry([_3dchart_2.graphMesh, _3dchart_2.graphCurves, _3dchart_2.legend, _3dchart_2.title])
pt_3 = Point(<point referenced from the Rhino model>)
move_2 = Move(Geometry=geo_2, Motion=pt_3)  # -> Geometry, Transform

pt_4 = Point(<point referenced from the Rhino model>)
geo_3 = Geometry([recolormesh.newMesh, recolormesh.newLegend])
pt_5 = Point(<point referenced from the Rhino model>)
move_3 = Move(Geometry=geo_3, Motion=pt_5)  # -> Geometry, Transform
avr = Average(Input=readannualresultsi.UDLI_100_2000)
concat_2 = Concatenate(FragmentA="Average:", FragmentB=avr, FragmentC="%")
scale_2 = Scale(Geometry=move_3.Geometry, Center=pt_5, Factor="40")  # -> Geometry, Transform
tag_2 = TextTag3D(Location=pt_4, Text=concat_2, Size="17", Justification=7)
