# Grasshopper definition kamath_ayodh.gh (Grasshopper 0.9.76)
# plug-ins: Python Interpreter

ladybug = Ladybug_Ladybug()  # -> Vviiiiiiiiiizzz; plug-in component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
honeybee = Honeybee_Honeybee()  # -> Vviiiiiiiiiizzz; plug-in component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

# ---- group: Tabletop
srf = Surface(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)

# ---- group: Shading Curves
crv = Curve([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])

# ---- group: Shading Surfaces / Optimized Values = -0.8, -0.35
number_slider = Slider(-0.8, range=-1..0)
number_slider_2 = Slider(-0.35, range=-1..0)

# ---- group: Loading and Ventilation / Laptop + Refrigerator
panel = Panel("2")

# ---- group: DaylightingSimulation
# Make sure there are no spaces in the file path
path = FilePath("C:\Users\Ayodh\Documents\Us\Ayodh\UPenn\1709\753\USA_PA_Philadelphia.Intl.AP.724080_TMY3\USA_PA_Philadelphia.Intl.AP.724080_TMY3.epw")

# ---- group: Run
toggle = BooleanToggle(True)

# ---- group: OccupancySchedule
panel_2 = Panel("""1
1
1
1
1
1
1
1
1
0
0
0
0
0
0
0
1
1
1
1
1
1
1
1""")
dup = DuplicateData(Data=panel_2, Number="365", Order=True)
csvschedule = Honeybee_CreateCSVSchedule(values=dup, scheduleName="PhDHomeStudy.csv", writeFile=Toggle(True))  # -> readMe, csvSchedule; plug-in component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

# ----
legendpar = Ladybug_LegendParameters(customColors=reverse(flatten([ColourSwatch(SwatchColor=RGB(255, 175, 0)), ColourSwatch(SwatchColor=RGB(0, 0, 255))])))  # -> legendPar; plug-in component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

# ---- group: HB Setup
callfromepconstrlibrary = Honeybee_CallFromEPConstructionLibrary(keywords="wood")  # -> ThermMaterials, EPMaterials, EPWindowMaterials, EPConstructions; plug-in component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
callfromepconstrlibrary_2 = Honeybee_CallFromEPConstructionLibrary(keywords="window")  # -> ThermMaterials, EPMaterials, EPWindowMaterials, EPConstructions; plug-in component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
item = ListItem(List=callfromepconstrlibrary.EPConstructions, Index="12", Wrap=True)
item_2 = ListItem(List=callfromepconstrlibrary_2.EPConstructions, Index="46", Wrap=True)
panel_3 = Panel(callfromepconstrlibrary.EPConstructions)
panel_4 = Panel(callfromepconstrlibrary_2.EPConstructions)
brep = Brep(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)
brep_2 = Brep(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)
brep_3 = Brep(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)
brep_4 = Brep(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)
brep_5 = Brep([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])
createhbsrfs = Honeybee_createHBSrfs(geometry=brep_5, srfName="internalWalls", srfType="0")  # -> readMe, simplify(HBSurface); plug-in component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
createhbsrfs_2 = Honeybee_createHBSrfs(geometry=brep_3, srfName="floor", srfType="2")  # -> readMe, simplify(HBSurface); plug-in component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
createhbsrfs_3 = Honeybee_createHBSrfs(geometry=brep_4, srfName="ceiling", srfType="3")  # -> readMe, simplify(HBSurface); plug-in component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
createhbsrfs_4 = Honeybee_createHBSrfs(geometry=brep, srfName="externalWall", srfType="0", EPConstruction=item)  # -> readMe, simplify(HBSurface); plug-in component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
createhbsrfs_5 = Honeybee_createHBSrfs(geometry=brep_2, srfName="windows", srfType="5", EPConstruction=item_2)  # -> readMe, simplify(HBSurface); plug-in component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
addhbglz = Honeybee_addHBGlz(HBObj=createhbsrfs_4.HBSurface, childSurfaces=flatten(createhbsrfs_5.HBSurface))  # -> HBObjWGLZ; plug-in component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
bldgprograms = Honeybee_bldgPrograms({"Office": 0, "Retail": 1, "MidriseApartment": 2, "PrimarySchool": 3, "SecondarySchool": 4, "SmallHotel": 5, "LargeHotel": 6, "Hospital": 7, "Outpatient": 8, "Warehouse": 9, "SuperMarket": 10, "FullServiceRestaurant": 11, "QuickServiceRestaurant": 12}, selected="MidriseApartment")
listzoneprograms = Honeybee_ListZonePrograms(bldgProgram=bldgprograms)  # -> MidriseApartmentZonePrograms; plug-in component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
index = ItemIndex(List=listzoneprograms, Item=0)
brep_6 = Brep([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])

# ---- group: HB Setup / Improved window construction
panel_5 = Panel(item_2)

# ---- group: HB Setup / Improved wall construction
panel_6 = Panel(item)

# ---- group: Shading Surfaces
bbox = BoundingBox(Content=brep_2, Plane=PlaneXY(0, 0, 0))  # -> Box, Box_2
smaller = SmallerThan(FirstNumber=number_slider, SecondNumber=number_slider_2)  # -> SmallerThan, OrEqualTo
box_corners = BoxCorners(Box=bbox.Box)  # -> CornerA, CornerB, CornerC, CornerD, CornerE, CornerF, CornerG, CornerH
X = UnitX(Factor=number_slider)
X_2 = UnitX(Factor=number_slider_2)
move = Move(Geometry=box_corners.CornerA, Motion=X)  # -> Geometry, Transform
move_2 = Move(Geometry=box_corners.CornerE, Motion=X_2)  # -> Geometry, Transform
vec2pt = Vector2Pt(PointA=box_corners.CornerB, PointB=box_corners.CornerC, Unitize=False)  # -> Vector, Length
p_n_c = PickNChoose(Pattern=smaller.SmallerThan, Stream0=X_2, Stream1=X)
ln = Line(StartPoint=move.Geometry, EndPoint=move_2.Geometry)
pl = ConstructPlane(Origin=move.Geometry, XAxis=ln, YAxis=vec2pt.Vector)
extr = Extrude(Base=crv, Direction=p_n_c)
sec = BrepPlane(Brep=extr, Plane=pl)  # -> Curves, Points
short = ShortestList(ListA=crv, ListB=flatten(sec.Curves), TrimMode=2)  # -> ListA, ListB
flip = FlipCurve(Curve=short.ListB)  # -> Curve, Flag
rulesrf = RuledSurface(CurveA=short.ListA, CurveB=flip.Curve)

# ---- group: HB Setup / Assumes neighbours + corridor @ same temperature
makeadiabatic = Honeybee_MakeAdiabatic(HBSrfs=[createhbsrfs.HBSurface, createhbsrfs_2.HBSurface, createhbsrfs_3.HBSurface])  # -> HBSrfs; plug-in component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

# ---- group: HB Setup (continued)
brep_7 = Brep(flatten([makeadiabatic, addhbglz]))
hb_epcontextsrf = HoneybeeEPContextSurfaces(shdSurfaces=flatten([brep_6, rulesrf]), justBoundingBox=Toggle(False))  # -> HBContext; inputs shdSurfaces: list of Brep, justBoundingBox: Boolean
# ---------- hb_epcontextsrf: Python ----------
"""
prepare shading/context geometries

    Args:
        northVectorOrRotation: A vector that shows North or a number that shows
                               the rotation of the North from the Y axis
        bldgMasses: List of closed Breps as thermal zones.
    Returns:
        report: ...
        thermalZones: Thermal zone's geometries for visualiza
"""

ghenv.Component.Name = 'Honeybee EP context Surfaces'
ghenv.Component.NickName = 'HB_EPContextSrf'
ghenv.Component.Message = 'VER 0.0.62\nJUL_28_2017'
ghenv.Component.IconDisplayMode = ghenv.Component.IconDisplayMode.application
ghenv.Component.Category = "Honeybee"
ghenv.Component.SubCategory = "10 | Energy | Energy"
#compatibleHBVersion = VER 0.0.57\nNOV_04_2016
#compatibleLBVersion = VER 0.0.59\nFEB_01_2015
ghenv.Component.AdditionalHelpFromDocStrings = "2"

import rhinoscriptsyntax as rs
import Rhino as rc
import scriptcontext as sc
import os
import System
import Grasshopper.Kernel as gh
import uuid

tolerance = sc.doc.ModelAbsoluteTolerance
import math


def main(shdSurfaces, EPTransSchedule, meshingSettings, justBoundingBox):
    
    # import the classes
    if sc.sticky.has_key('honeybee_release'):

        try:
            if not sc.sticky['honeybee_release'].isCompatible(ghenv.Component): return -1
            if sc.sticky['honeybee_release'].isInputMissing(ghenv.Component): return -1
        except:
            warning = "You need a newer version of Honeybee to use this compoent." + \
            " Use updateHoneybee component to update userObjects.\n" + \
            "If you have already updated userObjects drag Honeybee_Honeybee component " + \
            "into canvas and try again."
            w = gh.GH_RuntimeMessageLevel.Warning
            ghenv.Component.AddRuntimeMessage(w, warning)
            return -1
        
        # don't customize this part
        hb_EPSrf = sc.sticky["honeybee_EPSurface"]
        hb_EPSHDSurface = sc.sticky["honeybee_EPShdSurface"]
        hb_RADMaterialAUX = sc.sticky["honeybee_RADMaterialAUX"]
        hb_EPObjectsAux = sc.sticky["honeybee_EPObjectsAUX"]()
        HBScheduleList = sc.sticky["honeybee_ScheduleLib"].keys()

        ########################################################################
        #----------------------------------------------------------------------#
        shdBreps = []
        # create bounding box of shading geometries
        if justBoundingBox:
            for brep in shdSurfaces:
                if brep.Faces.Count>1 or not brep.Faces[0].IsPlanar(sc.doc.ModelAbsoluteTolerance):
                    shdBreps.append(brep.GetBoundingBox(True).ToBrep())
                else:
                    shdBreps.append(brep)
        else:
            shdBreps = shdSurfaces
        
        shadingClasses = []
        shadingMeshPreview = []
        
        if meshingSettings == None:
            mp = rc.Geometry.MeshingParameters.Minimal
            mp.SimplePlanes = True
        else:
            mp = meshingSettings
        
        def getRadMaterialName(radMaterial):
            nameStr = radMaterial.split(" ")[2]
            name =  nameStr.split("\n")[0]
            return name
        
        for brepCount, brep in enumerate(shdBreps):
            if brep != None:
                isPlanar = True
                # check planarity
                for face in brep.Faces:
                    if not face.IsPlanar(tolerance):
                        isPlanar = False
                        break
                
                shadingBreps = []
                if not isPlanar:
                    meshArray = rc.Geometry.Mesh.CreateFromBrep(brep, mp)
                    for mesh in meshArray:
                        for meshFace in range(mesh.Faces.Count):
                            vertices = list(mesh.Faces.GetFaceVertices(meshFace))[1:]
                            vertices = vertices + [sc.doc.ModelAbsoluteTolerance]
                            # create the brep from mesh
                            shdBrep = rc.Geometry.Brep.CreateFromCornerPoints(*vertices)
                            shadingBreps.append(shdBrep)
                else:
                    for face in brep.Faces:
                        shadingBreps.append(face.DuplicateFace(False))
                
                for faceCount, shdBrep in enumerate(shadingBreps):
                        thisShading = hb_EPSHDSurface(shdBrep, 1000*brepCount + faceCount, 'shdSrf_' + `brepCount` + '_' + `faceCount` + "_" + str(uuid.uuid4()))
                        
                        # add transmittance schedule if any
                        if EPTransSchedule!=None:
                            schedule= EPTransSchedule.upper()
                            if schedule!=None and not schedule.lower().endswith(".csv") and schedule not in HBScheduleList:
                                msg = "Cannot find " + schedule + " in Honeybee schedule library."
                                print msg
                                ghenv.Component.AddRuntimeMessage(gh.GH_RuntimeMessageLevel.Warning, msg)
                                return -1
                            elif schedule!=None and schedule.lower().endswith(".csv"):
                                # check if csv file is existed
                                if not os.path.isfile(schedule):
                                    msg = "Cannot find the shchedule file: " + schedule
                                    print msg
                                    ghenv.Component.AddRuntimeMessage(gh.GH_RuntimeMessageLevel.Warning, msg)
                                    return -1
                            
                            thisShading.TransmittanceSCH = schedule
                        
                        # add the Rad Material if any
                        if RADMaterial!=None:
                            # if it is just the name of the material make sure it is already defined
                            if len(RADMaterial.split(" ")) == 1:
                                # if the material is not in the library add it to the library
                                if not hb_RADMaterialAUX.isMatrialExistInLibrary(RADMaterial):
                                    warningMsg = "Can't find " + RADMaterial + " in RAD Material Library.\n" + \
                                                "Add the material to the library and try again."
                                    ghenv.Component.AddRuntimeMessage(gh.GH_RuntimeMessageLevel.Warning, warningMsg)
                                    return
                                
                                try:
                                    thisShading.setRADMaterial(RADMaterial)
                                except Exception, e:
                                    print e
                                    warningMsg = "You are using an old version of Honeybee_Honeybee! Update your files and try again."
                                    print warningMsg
                                    ghenv.Component.AddRuntimeMessage(gh.GH_RuntimeMessageLevel.Warning, warningMsg)
                                    return
                                
                                addedToLib = True
                            else:
                                
                                # try to add the material to the library
                                addedToLib, thisShading.RadMaterial = hb_RADMaterialAUX.analyseRadMaterials(RADMaterial, True)
                                
                            if addedToLib==False:
                                warningMsg = "Failed to add " + RADMaterial + " to the Library."
                                ghenv.Component.AddRuntimeMessage(gh.GH_RuntimeMessageLevel.Warning, warningMsg)
                                return
                        
                        # add shading to the list
                        shadingClasses.append(thisShading)
                
        # add to the hive
        hb_hive = sc.sticky["honeybee_Hive"]()
        HBContext  = hb_hive.addToHoneybeeHive(shadingClasses, ghenv.Component)
        return HBContext
        ################################################################################################
    else:
        print "You should first let Honeybee to fly..."
        w = gh.GH_RuntimeMessageLevel.Warning
        ghenv.Component.AddRuntimeMessage(w, "You should first let Honeybee to fly...")
        return -1
        

if _shdSurfaces and _shdSurfaces[0]!=None:
    # add cleaning function
    result= main(_shdSurfaces, EPTransSchedule_, meshingSettings_, justBoundingBox_)
    
    if result != -1: HBContext = result
# ---------- end hb_epcontextsrf ----------
createhbzones = Honeybee_createHBZones(name="room", zoneProgram=index, HBSurfaces=flatten(brep_7), isConditioned=Toggle(False))  # -> readMe, HBZone; plug-in component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

# ---- group: Loading and Ventilation / 4 x 6W LED bulbs
multiplication = Multiplication(A="4", B="6")
area = Area(Geometry=brep_3)  # -> Area, Centroid
division = Division(A=multiplication, B=area.Area)

# ---- group: Loading and Ventilation / Tight windows
area_2 = Area(Geometry=brep)  # -> Area, Centroid
multiplication_2 = Multiplication(A="0.0001", B=area_2.Area)

# ---- group: Loading and Ventilation / One occupant
area_3 = Area(Geometry=brep_3)  # -> Area, Centroid
division_2 = Division(A="1", B=area_3.Area)

# ---- group: Loading and Ventilation
setepnatvent = Honeybee_SetEPAirFlow(
    HBZones=flatten(createhbzones.HBZone),
    naturalVentilationType="1",
    minIndoorTempForNatVent="20",
    maxOutdoorTempForNatVent="30",
    fractionOfGlzHeightOperable="1")  # -> readMe, simplify(HBZones); plug-in component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
setepzoneloads = Honeybee_SetEnergyPlusZoneLoads(
    HBZones=setepnatvent.HBZones,
    equipmentLoadPerArea=panel,
    infiltrationRatePerArea=multiplication_2,
    lightingDensityPerArea=division,
    numOfPeoplePerArea=division_2,
    ventilationPerArea="0",
    ventilationPerPerson="0",
    recirculatedAirPerArea="0")  # -> loads, HBZones; plug-in component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
changehbobjname = Honeybee_ChangeHBObjName(HBObjects=setepzoneloads.HBZones, names="Openable Windows+Internal Loads+Minimum Infiltration")  # -> HBObjects; plug-in component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

# ---- group: Preview
wires = BrepWireframe(Brep=[hb_epcontextsrf, createhbzones.HBZone], Density=-1)
preview = CustomPreview(Geometry=wires, Shader=ColourSwatch(SwatchColor=RGB(0, 0, 0)))

# ---- group: DaylightingSimulation
gentestpts = Honeybee_GenerateTestPoints(testGeometry=brep_3, gridSize="0.5", distBaseSrf="0.762", moveTestMesh=True)  # -> readMe, simplify(testPoints), simplify(ptsVectors), simplify(facesArea), simplify(mesh); plug-in component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
annualdaylightsimulation = Honeybee_AnnualDaylightSimulation(epwWeatherFile=path, testPoints=gentestpts.testPoints, ptsVectors=gentestpts.ptsVectors, testMesh=gentestpts.mesh)  # -> analysisRecipe; plug-in component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
rundaylightanalysis = Honeybee_RunDaylightSimulation(
    HBObjects=flatten(changehbobjname),
    analysisRecipe=annualdaylightsimulation,
    writeRad=toggle,
    runRad=toggle,
    overwriteResults=True)  # -> readMe, analysisType, resultsUnit, results, testPts, annual_analysis_files, radGeoFile, studyFolder, done; plug-in component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
readannualresultsi = Honeybee_ReadAnnualResultI(
    illFilesAddress=rundaylightanalysis.annual_analysis_files,
    testPoints=simplify(gentestpts.testPoints),
    DLAIllumThresholds=300,
    runIt=toggle)  # -> DLA, UDLI_Less_100, UDLI_100_2000, UDLI_More_2000, CDA, sDA, annualProfiles, htmReport; plug-in component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
setepzoneschedules = Honeybee_SetEnergyPlusZoneSchedules(HBZones=changehbobjname, occupancySchedules=csvschedule.csvSchedule, lightingSchedules=readannualresultsi.annualProfiles)  # -> schedules, simplify(HBZones); plug-in component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

# ---- group: EnergySimulation
toggle_2 = BooleanToggle(True)
epoutput = Honeybee_GenerateEPOutput(
    zoneEnergyUse=toggle_2,
    zoneGainsAndLosses=toggle_2,
    zoneComfortMetrics=toggle_2,
    surfaceTempAnalysis="False",
    surfaceEnergyAnalysis=toggle_2)  # -> report, flatten(simulationOutputs); plug-in component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
runenergysimulation = Honeybee_RunEnergySimulation(
    epwFile=path,
    HBZones=flatten(setepzoneschedules.HBZones),
    HBContext=flatten(hb_epcontextsrf),
    simulationOutputs=flatten(epoutput.simulationOutputs),
    writeIdf=toggle,
    runEnergyPlus=toggle)  # -> report, idfFileAddress, htmlReport, resultFileAddress; plug-in component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
importepw = Ladybug_ImportEpw(epwFile=path)  # -> readMe, latitude, location, dryBulbTemperature, dewPointTemperature, relativeHumidity, windSpeed, windDirection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; plug-in component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
readepsrfresult = Honeybee_ReadEPSurfaceResult(resultFileAddress=runenergysimulation.resultFileAddress)  # -> port, port_2, surfaceEnergyFlow, opaqueEnergyFlow, glazEnergyFlow, port_3, port_4, port_5, port_6, port_7; plug-in component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
readepresult = Honeybee_ReadEPResult(resultFileAddress=runenergysimulation.resultFileAddress)  # -> port, port_2, port_3, port_4, electricLight, electricEquip, fanElectric, port_5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; plug-in component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
adaptivecomfortcalculator = Ladybug_AdaptiveComfortCalculator(
    dryBulbTemperature=readepresult.airTemperature,
    meanRadiantTemperature=readepresult.meanRadTemperature,
    prevailingOutdoorTemp=importepw.dryBulbTemperature,
    runIt=Toggle(True))  # -> readMe, port, comfortableOrNot, conditionOfPerson, degreesFromTarget, port_2, targetTemperature, upperTemperatureBound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; plug-in component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
energybalance = Honeybee_ConstructEnergyBalance(
    HBZones=flatten(setepzoneloads.HBZones),
    electricLight=readepresult.electricLight,
    electricEquip=readepresult.electricEquip,
    peopleGains=readepresult.peopleGains,
    totalSolarGain=readepresult.totalSolarGain,
    infiltrationEnergy=readepresult.infiltrationEnergy,
    natVentEnergy=readepresult.natVentEnergy,
    surfaceEnergyFlow=readepsrfresult.surfaceEnergyFlow)  # -> readMe, port, flrNormEnergyBal, flrNormBalWStorage, port_2, modelEnergyBalance, energyBalWithStorage; plug-in component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
panel_7 = Panel(adaptivecomfortcalculator.percentOfTimeComfortable)

# ---- group: There's something wrong here
strnum = Ladybug_SeparateData(inputList=flatten(readepresult.electricLight))  # -> numbers, strings; plug-in component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
ma = MassAddition(Input=strnum.numbers)  # -> Result, PartialResults
panel_8 = Panel(ma.Result)

# ---- group: Display
interior_temperature = Panel(readepresult.airTemperature)
legendpar_2 = Ladybug_LegendParameters(
    numSegments="3",
    customColors=reverse(flatten([ColourSwatch(SwatchColor=RGB(255, 0, 0)), ColourSwatch(SwatchColor=RGB(255, 255, 255)), ColourSwatch(SwatchColor=RGB(0, 0, 255))])))  # -> legendPar; plug-in component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
xscale = Panel("0.005")
yscale = Panel("0.025")
selectandaveragedata = Ladybug_AverageData(annualHourlyData=energybalance.modelEnergyBalance, totalOrAverage=Toggle(True))  # -> readMe, selHourlyData, totaledDaily, totaledMonthly, totMonthlyPerHour, totMonthlyMinPerHour, totMonthlyMaxPerHour; plug-in component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
recolormesh = Ladybug_RecolorMesh(
    analysisResult=readannualresultsi.UDLI_100_2000,
    inputMesh=gentestpts.mesh,
    legendPar=legendpar,
    analysisTitle="UDLI 100-2000",
    legendTitle="%")  # -> readMe, newMesh, newLegend, legendBasePt, meshColors, legendColors; plug-in component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
exterior_teperature = Panel(importepw.dryBulbTemperature)
bbox_2 = BoundingBox(Content=recolormesh.newLegend, Plane=PlaneXY(0, 0, 0), UnionBox=True)  # -> flatten(Box), Box_2
box_corners_2 = BoxCorners(Box=bbox_2.Box)  # -> CornerA, CornerB, CornerC, CornerD, CornerE, CornerF, CornerG, CornerH
pdecon = Deconstruct(Point=box_corners_2.CornerB)  # -> XComponent, YComponent, ZComponent
addition = Addition(A=pdecon.XComponent, B="2")
pt = ConstructPoint(XCoordinate=addition, YCoordinate=pdecon.YComponent, ZCoordinate=pdecon.ZComponent)
_3dchart = Ladybug_3DChart(
    inputData=flatten(adaptivecomfortcalculator.conditionOfPerson),
    basePoint=pt,
    xScale=xscale,
    yScale=yscale,
    zScale="0",
    legendPar=legendpar_2)  # -> readMe, graphMesh, graphCurves, legend, legendBasePts, title, titleBasePts, dataPts, conditionalHOY; plug-in component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
pdecon_2 = Deconstruct(Point=_3dchart.legendBasePts)  # -> XComponent, YComponent, ZComponent
txt = Text(panel_7)
bbox_3 = BoundingBox(Content=_3dchart.graphMesh, Plane=PlaneXY(0, 0, 0))  # -> Box, Box_2
subtraction = Subtraction(A=pdecon_2.YComponent, B="-1.5")
concat = Concatenate(FragmentA="Time of year comfortable: ", FragmentB=txt, FragmentC="%")
box_corners_3 = BoxCorners(Box=bbox_3.Box)  # -> CornerA, CornerB, CornerC, CornerD, CornerE, CornerF, CornerG, CornerH
addition_2 = Addition(A=pdecon_2.XComponent, B="0.125")
dist = Distance(PointA=box_corners_3.CornerA, PointB=box_corners_3.CornerB)
dist_2 = Distance(PointA=box_corners_3.CornerB, PointB=box_corners_3.CornerC)
pt_2 = ConstructPoint(XCoordinate=addition_2, YCoordinate=subtraction, ZCoordinate=pdecon_2.ZComponent)
pdecon_3 = Deconstruct(Point=box_corners_3.CornerD)  # -> XComponent, YComponent, ZComponent
tag = TextTag3D(Location=pt_2, Text=concat, Size="0.25", Colour=ColourSwatch(SwatchColor=RGB(0, 0, 0)), Justification=7)
gradientlibrary = Ladybug_GradientLibrary(gradIndex="19")  # -> customColors; plug-in component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
toggle_3 = BooleanToggle(True)
barchart = Ladybug_MonthlyBarChart(inputData=flatten(selectandaveragedata.totaledMonthly), stackValues=toggle_3)  # -> readMe, dataMesh, dataCurves, dataCrvColors, graphAxes, graphLabels, title, titleBasePt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; plug-in component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
bbox_4 = BoundingBox(Content=barchart.graphAxes, Plane=PlaneXY(0, 0, 0), UnionBox=True)  # -> Box, Box_2
box_corners_4 = BoxCorners(Box=bbox_4.Box)  # -> CornerA, CornerB, CornerC, CornerD, CornerE, CornerF, CornerG, CornerH
dist_3 = Distance(PointA=box_corners_4.CornerA, PointB=box_corners_4.CornerB)
dist_4 = Distance(PointA=box_corners_4.CornerB, PointB=box_corners_4.CornerC)
division_3 = Division(A=dist, B=dist_3)
division_4 = Division(A=dist_2, B=dist_4)
addition_3 = Addition(A=pdecon_3.YComponent, B=division_3)
multiplication_3 = Multiplication(A=addition_3, B="1.25")
legendpar_3 = Ladybug_LegendParameters(highBound="400", customColors=reverse(flatten(gradientlibrary)), fontSize=division_4)  # -> legendPar; plug-in component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
pt_3 = ConstructPoint(XCoordinate=pdecon_3.XComponent, YCoordinate=multiplication_3, ZCoordinate=pdecon_3.ZComponent)
barchart_2 = Ladybug_MonthlyBarChart(
    inputData=flatten(selectandaveragedata.totaledMonthly),
    stackValues=toggle_3,
    altTitle="Studio Apartment Energy Balance",
    altYAxisTitle="Energy (kWh)",
    basePoint=pt_3,
    xScale=division_3,
    yScale=division_4,
    legendPar=legendpar_3)  # -> readMe, dataMesh, dataCurves, dataCrvColors, graphAxes, graphLabels, title, titleBasePt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; plug-in component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
preview_2 = CustomPreview(Geometry=[barchart_2.graphAxes, _3dchart.graphCurves], Shader=ColourSwatch(SwatchColor=RGB(0, 0, 0)))
