# Grasshopper definition katta-adiseshaiah_aishwarya.gh (Grasshopper 0.9.76)
# plug-ins: Python Interpreter

# ---- group: Component for checking the values using the name of the material
panel = Panel("Exterior Roof")  # disabled
decomposeepconstruction = Honeybee_DecomposeEPConstruction(cnstrName=panel)  # -> materials, comments, UValue_SI, UValue_IP, RValue_SI, RValue_IP; disabled; plug-in component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
panel_2 = Panel(decomposeepconstruction.RValue_SI)  # disabled

# ---- group: Construct material from scratch
epopaquemat = Honeybee_EnergyPlusOpaqueMaterial()  # -> EPMaterial; plug-in component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
epconstruction = Honeybee_EnergyPlusConstruction(layer_1=epopaquemat)  # -> EPConstruction; plug-in component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

# ---- group: Use these components to label the parts - can also find the default values
# Type BALANCE in Hydra for examples
srfattributelist = Honeybee_SurfaceAttributeList({"Name": "name", "Radiance Material": "RadMaterial", "EnergyPlus Construction": "EPConstruction", "Surface Type": "type", "Boundary Condition": "BC", "Sun Exposure": "sunExposure", "Wind Exposure": "windExposure", "Has Child Surface": "hasChild", "Is Child Surface": "isChild", "Is Planar": "isPlanar", "Srf Type Set By User": "srfTypeByUser", "Boundary Condition Set By User": "srfBCByUser", "Shade Material Name": "shadeMaterialName", "Shading Control Name": "shadingControlName", "Shcading Schedule Name": "shadingSchName"}, selected="EnergyPlus Construction")  # disabled
toggle = BooleanToggle(True)  # disabled
labelsurfaces = Honeybee_LabelZoneSurfaces(attribute=srfattributelist, windows=toggle)  # -> surfaceTxtLabels, labelBasePts, brepTxtLabels, surfaceWireFrames; disabled; plug-in component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

# ----
setepzoneloads = Honeybee_SetEnergyPlusZoneLoads()  # -> loads, HBZones; disabled; plug-in component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
setloadsandschedules = Honeybee_SetLoadsAndSchedules()  # -> currentSchedules, currentLoads, HBZones; disabled; plug-in component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

callfromepconstrlibrary = Honeybee_CallFromEPConstructionLibrary()  # -> ThermMaterials, EPMaterials, EPWindowMaterials, EPConstructions; disabled; plug-in component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
panel_3 = Panel(callfromepconstrlibrary.EPConstructions)  # disabled
callfromepconstrlibrary_2 = Honeybee_CallFromEPConstructionLibrary()  # -> ThermMaterials, EPMaterials, EPWindowMaterials, EPConstructions; disabled; plug-in component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
panel_4 = Panel(callfromepconstrlibrary_2.EPConstructions)  # disabled
callfromepconstrlibrary_3 = Honeybee_CallFromEPConstructionLibrary()  # -> ThermMaterials, EPMaterials, EPWindowMaterials, EPConstructions; disabled; plug-in component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
panel_5 = Panel(callfromepconstrlibrary_3.EPConstructions)  # disabled
panel_6 = Panel("433")  # disabled
panel_7 = Panel("429")  # disabled
panel_8 = Panel("431")  # disabled
panel_9 = Panel("423")  # disabled
panel_10 = Panel("433")  # disabled
panel_11 = Panel("431")  # disabled
panel_12 = Panel("429")  # disabled
panel_13 = Panel("423")  # disabled
panel_14 = Panel("417")  # disabled
panel_15 = Panel("417")  # disabled
panel_16 = Panel("433")  # disabled
panel_17 = Panel("431")  # disabled
panel_18 = Panel("429")  # disabled
panel_19 = Panel("423")  # disabled
panel_20 = Panel("417")  # disabled
item = ListItem(List=callfromepconstrlibrary.EPConstructions, Index=panel_6, Wrap=True)  # disabled
item_2 = ListItem(List=callfromepconstrlibrary.EPConstructions, Index=panel_7, Wrap=True)  # disabled
item_3 = ListItem(List=callfromepconstrlibrary.EPConstructions, Index=panel_8, Wrap=True)  # disabled
item_4 = ListItem(List=callfromepconstrlibrary.EPConstructions, Index=panel_9, Wrap=True)  # disabled
item_5 = ListItem(List=callfromepconstrlibrary_2.EPConstructions, Index=panel_10, Wrap=True)  # disabled
item_6 = ListItem(List=callfromepconstrlibrary_2.EPConstructions, Index=panel_12, Wrap=True)  # disabled
item_7 = ListItem(List=callfromepconstrlibrary_2.EPConstructions, Index=panel_11, Wrap=True)  # disabled
item_8 = ListItem(List=callfromepconstrlibrary_2.EPConstructions, Index=panel_13, Wrap=True)  # disabled
item_9 = ListItem(List=callfromepconstrlibrary.EPConstructions, Index=panel_14, Wrap=True)  # disabled
item_10 = ListItem(List=callfromepconstrlibrary_2.EPConstructions, Index=panel_15, Wrap=True)  # disabled
item_11 = ListItem(List=callfromepconstrlibrary_3.EPConstructions, Index=panel_16, Wrap=True)  # disabled
item_12 = ListItem(List=callfromepconstrlibrary_3.EPConstructions, Index=panel_18, Wrap=True)  # disabled
item_13 = ListItem(List=callfromepconstrlibrary_3.EPConstructions, Index=panel_17, Wrap=True)  # disabled
item_14 = ListItem(List=callfromepconstrlibrary_3.EPConstructions, Index=panel_19, Wrap=True)  # disabled
item_15 = ListItem(List=callfromepconstrlibrary_3.EPConstructions, Index=panel_20, Wrap=True)  # disabled

# ---- group: glass
brep = Brep(<brep referenced from the Rhino model>)

# ---- group: ceiling
# Baseline
brep_2 = Brep(<brep referenced from the Rhino model>)

# ---- group: floor
brep_3 = Brep(<brep referenced from the Rhino model>)

# ---- group: wall
brep_4 = Brep([<brep referenced from the Rhino model> x3])

# ---- group: wall that has glazing
brep_5 = Brep(<brep referenced from the Rhino model>)

# ---- group: glass
brep_6 = Brep([<brep referenced from the Rhino model> x3])

# ---- group: ceiling
# Proposed Design
brep_7 = Brep(<brep referenced from the Rhino model>)

# ---- group: floor
brep_8 = Brep(<brep referenced from the Rhino model>)

# ---- group: wall that has glazing
brep_9 = Brep(<brep referenced from the Rhino model>)

# ---- group: wall
brep_10 = Brep([<brep referenced from the Rhino model> x3])

# ---- group: glass
brep_11 = Brep(<brep referenced from the Rhino model>)

# ---- group: ceiling
# Design
brep_12 = Brep(<brep referenced from the Rhino model>)

# ---- group: floor
brep_13 = Brep(<brep referenced from the Rhino model>)

# ---- group: wall that has glazing
brep_14 = Brep(<brep referenced from the Rhino model>)

# ---- group: wall
brep_15 = Brep([<brep referenced from the Rhino model> x3])

# ----
createhbsrfs = Honeybee_createHBSrfs(geometry=brep_5, srfType="0", EPConstruction=item_4)  # -> readMe, simplify(HBSurface); plug-in component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
createhbsrfs_2 = Honeybee_createHBSrfs(geometry=brep_3, srfType="2", EPConstruction=item_3)  # -> readMe, simplify(HBSurface); plug-in component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
createhbsrfs_3 = Honeybee_createHBSrfs(geometry=brep_2, srfType="3", EPConstruction=item_2)  # -> readMe, simplify(HBSurface); plug-in component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
createhbsrfs_4 = Honeybee_createHBSrfs(geometry=brep_4, srfType="0", EPConstruction=item)  # -> readMe, simplify(HBSurface); plug-in component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
flip = Flip(Surface=brep_3)  # -> Surface, Result

createhbsrfs_5 = Honeybee_createHBSrfs(geometry=brep_9, srfType="0", EPConstruction=item_8)  # -> readMe, simplify(HBSurface); plug-in component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
createhbsrfs_6 = Honeybee_createHBSrfs(geometry=brep_8, srfType="2", EPConstruction=item_7)  # -> readMe, simplify(HBSurface); plug-in component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
createhbsrfs_7 = Honeybee_createHBSrfs(geometry=brep_7, srfType="3", EPConstruction=item_6)  # -> readMe, simplify(HBSurface); plug-in component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
createhbsrfs_8 = Honeybee_createHBSrfs(geometry=brep_10, srfType="0", EPConstruction=item_5)  # -> readMe, simplify(HBSurface); plug-in component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
flip_2 = Flip(Surface=brep_8)  # -> Surface, Result

createhbsrfs_9 = Honeybee_createHBSrfs(geometry=brep_14, srfType="0", EPConstruction=item_14)  # -> readMe, simplify(HBSurface); plug-in component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
createhbsrfs_10 = Honeybee_createHBSrfs(geometry=brep_13, srfType="2", EPConstruction=item_13)  # -> readMe, simplify(HBSurface); plug-in component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
createhbsrfs_11 = Honeybee_createHBSrfs(geometry=brep_12, srfType="3", EPConstruction=item_12)  # -> readMe, simplify(HBSurface); plug-in component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
createhbsrfs_12 = Honeybee_createHBSrfs(geometry=brep_15, srfType="0", EPConstruction=item_11)  # -> readMe, simplify(HBSurface); plug-in component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
flip_3 = Flip(Surface=brep_13)  # -> Surface, Result

ladybug = Ladybug_Ladybug()  # -> Vviiiiiiiiiizzz; plug-in component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
# Geometry
# Modifications
honeybee = Honeybee_Honeybee()  # -> Vviiiiiiiiiizzz; plug-in component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
addhbglz = Honeybee_addHBGlz(HBObj=createhbsrfs.HBSurface, childSurfaces=flatten(brep), EPConstructions=item_9)  # -> simplify(HBObjWGLZ); plug-in component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
addhbglz_2 = Honeybee_addHBGlz(HBObj=createhbsrfs_5.HBSurface, childSurfaces=flatten(brep_6), EPConstructions=item_10)  # -> simplify(HBObjWGLZ); plug-in component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
addhbglz_3 = Honeybee_addHBGlz(HBObj=createhbsrfs_9.HBSurface, childSurfaces=flatten(brep_11), EPConstructions=item_15)  # -> simplify(HBObjWGLZ); plug-in component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
callfromepconstrlibrary_4 = Honeybee_CallFromEPConstructionLibrary()  # -> ThermMaterials, EPMaterials, EPWindowMaterials, EPConstructions; plug-in component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
callfromepconstrlibrary_5 = Honeybee_CallFromEPConstructionLibrary()  # -> ThermMaterials, EPMaterials, EPWindowMaterials, EPConstructions; plug-in component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
wires = BrepWireframe(Brep=[createhbsrfs_4.HBSurface, createhbsrfs_3.HBSurface, createhbsrfs_2.HBSurface, createhbsrfs.HBSurface], Density=-1)
makeadiabatic = Honeybee_MakeAdiabatic(HBSrfs=flatten([createhbsrfs_3.HBSurface, createhbsrfs_2.HBSurface, createhbsrfs_4.HBSurface]))  # -> HBSrfs; plug-in component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
wires_2 = BrepWireframe(
    Brep=[createhbsrfs_8.HBSurface, createhbsrfs_7.HBSurface, createhbsrfs_6.HBSurface, createhbsrfs_5.HBSurface],
    Density=-1)
makeadiabatic_2 = Honeybee_MakeAdiabatic(HBSrfs=flatten([createhbsrfs_7.HBSurface, createhbsrfs_6.HBSurface, createhbsrfs_8.HBSurface]))  # -> HBSrfs; plug-in component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
wires_3 = BrepWireframe(
    Brep=[createhbsrfs_12.HBSurface, createhbsrfs_11.HBSurface, createhbsrfs_10.HBSurface, createhbsrfs_9.HBSurface],
    Density=-1)
makeadiabatic_3 = Honeybee_MakeAdiabatic(HBSrfs=flatten([createhbsrfs_11.HBSurface, createhbsrfs_10.HBSurface, createhbsrfs_12.HBSurface]))  # -> HBSrfs; plug-in component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
panel_21 = Panel("""0
1
2
3
4""")
ladybug_2 = Ladybug_Ladybug()  # -> Vviiiiiiiiiizzz; plug-in component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
honeybee_2 = Honeybee_Honeybee()  # -> Vviiiiiiiiiizzz; plug-in component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
searchepconstruction = Honeybee_SearchEPConstruction(EPConstrList=callfromepconstrlibrary_4.EPConstructions, standard="2", climateZone="4", surfaceType=panel_21)  # -> EPSelectedConstr; plug-in component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
searchepconstruction_2 = Honeybee_SearchEPConstruction(EPConstrList=callfromepconstrlibrary_5.EPConstructions, standard="2", climateZone="4", surfaceType="1")  # -> EPSelectedConstr; plug-in component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
panel_22 = Panel("""interior Ceiling
Interior Floor
Interior Wall
Exterior Wall
CBECS BBefore-1980 Extwindow Climatezone 1-4""")

bldgprograms = Honeybee_bldgPrograms({"Office": 0, "Retail": 1, "MidriseApartment": 2, "PrimarySchool": 3, "SecondarySchool": 4, "SmallHotel": 5, "LargeHotel": 6, "Hospital": 7, "Outpatient": 8, "Warehouse": 9, "SuperMarket": 10, "FullServiceRestaurant": 11, "QuickServiceRestaurant": 12}, selected="MidriseApartment")
listzoneprograms = Honeybee_ListZonePrograms(bldgProgram=bldgprograms)  # -> MidriseApartmentZonePrograms; plug-in component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
item_16 = ListItem(List=listzoneprograms, Index="0", Wrap=True)
createhbzones = Honeybee_createHBZones(name="Bedroom", zoneProgram=item_16, HBSurfaces=flatten([makeadiabatic, addhbglz]), isConditioned=Toggle(False))  # -> readMe, HBZone; plug-in component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

bldgprograms_2 = Honeybee_bldgPrograms({"Office": 0, "Retail": 1, "MidriseApartment": 2, "PrimarySchool": 3, "SecondarySchool": 4, "SmallHotel": 5, "LargeHotel": 6, "Hospital": 7, "Outpatient": 8, "Warehouse": 9, "SuperMarket": 10, "FullServiceRestaurant": 11, "QuickServiceRestaurant": 12}, selected="MidriseApartment")
listzoneprograms_2 = Honeybee_ListZonePrograms(bldgProgram=bldgprograms_2)  # -> MidriseApartmentZonePrograms; plug-in component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
item_17 = ListItem(List=listzoneprograms_2, Index="0", Wrap=True)
createhbzones_2 = Honeybee_createHBZones(name="Bedroom", zoneProgram=item_17, HBSurfaces=flatten([makeadiabatic_2, addhbglz_2]), isConditioned=Toggle(False))  # -> readMe, HBZone; plug-in component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

bldgprograms_3 = Honeybee_bldgPrograms({"Office": 0, "Retail": 1, "MidriseApartment": 2, "PrimarySchool": 3, "SecondarySchool": 4, "SmallHotel": 5, "LargeHotel": 6, "Hospital": 7, "Outpatient": 8, "Warehouse": 9, "SuperMarket": 10, "FullServiceRestaurant": 11, "QuickServiceRestaurant": 12}, selected="MidriseApartment")
listzoneprograms_3 = Honeybee_ListZonePrograms(bldgProgram=bldgprograms_3)  # -> MidriseApartmentZonePrograms; plug-in component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
item_18 = ListItem(List=listzoneprograms_3, Index="0", Wrap=True)
createhbzones_3 = Honeybee_createHBZones(name="Bedroom", zoneProgram=item_18, HBSurfaces=flatten([makeadiabatic_3, addhbglz_3]), isConditioned=Toggle(False))  # -> readMe, HBZone; plug-in component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

panel_23 = Panel(searchepconstruction_2)
decomposeepconstruction_2 = Honeybee_DecomposeEPConstruction(cnstrName=panel_22)  # -> materials, comments, UValue_SI, UValue_IP, RValue_SI, RValue_IP; plug-in component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
decomposeepconstruction_3 = Honeybee_DecomposeEPConstruction(cnstrName=searchepconstruction_2)  # -> materials, comments, UValue_SI, UValue_IP, RValue_SI, RValue_IP; plug-in component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
decomposeepconstruction_4 = Honeybee_DecomposeEPConstruction(cnstrName=searchepconstruction)  # -> materials, comments, UValue_SI, UValue_IP, RValue_SI, RValue_IP; plug-in component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
item_19 = ListItem(List=searchepconstruction, Index=0, Wrap=True)
panel_24 = Panel(decomposeepconstruction_2.RValue_SI)
panel_25 = Panel(searchepconstruction)
panel_26 = Panel(decomposeepconstruction_4.RValue_IP)
panel_27 = Panel(decomposeepconstruction_4.RValue_SI)
panel_28 = Panel(decomposeepconstruction_3.RValue_SI)
sort = SortList(Keys=panel_27, ValuesA=panel_25)  # -> Keys, ValuesA

# ---- group: last item of the list
rev = ReverseList(List=sort.ValuesA)
item_20 = ListItem(List=rev, Index="-1", Wrap=True)
panel_29 = Panel(item_20)

# ----
item_21 = ListItem(List=sort.ValuesA, Index="-1", Wrap=True)
panel_30 = Panel(item_21)

panel_31 = Panel(sort.ValuesA)
panel_32 = Panel("https://www.energyplus.net/weather-download/north_and_central_america_wmo_region_4/USA/PA/USA_PA_Philadelphia.Intl.AP.724080_TMY3/all")
gentestpts = Honeybee_GenerateTestPoints(testGeometry=brep_8, gridSize=".5", distBaseSrf=".762", moveTestMesh=True)  # -> readMe, simplify(testPoints), simplify(ptsVectors), simplify(facesArea), simplify(mesh); plug-in component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
radparameters = Honeybee_RADParameters(quality=0)  # -> readMe, radParameters; plug-in component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
epw_stat = Ladybug_OpenEPWAndSTATWeatherFiles(weatherFileURL=panel_32)  # -> epwFile, statFile; plug-in component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
annualdaylightsimulation = Honeybee_AnnualDaylightSimulation(
    epwWeatherFile=epw_stat.epwFile,
    testPoints=gentestpts.testPoints,
    ptsVectors=gentestpts.ptsVectors,
    testMesh=gentestpts.mesh,
    radParameters=radparameters.radParameters)  # -> analysisRecipe; plug-in component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
item_22 = ListItem(List=gentestpts.testPoints, Index="58", Wrap=True)
sph = Sphere(Base=item_22, Radius=Slider(0.1, range=0..0.1))
# Run Annual Daylight
toggle_2 = BooleanToggle(True)
lightingcontrol = Honeybee_LightingControlRecipe(
    controlType="4",
    sensorPoints=item_22,
    lightingPower=250,
    lightingSetpoint=300,
    ballastLossFactor=20,
    standbyPower=3,
    delayTime=5)  # -> lightingControlGroup; plug-in component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
rundaylightanalysis = Honeybee_RunDaylightSimulation(
    HBObjects=flatten(createhbzones_2.HBZone),
    analysisRecipe=annualdaylightsimulation,
    writeRad=toggle_2,
    runRad=toggle_2,
    numOfCPUs=Slider(3, range=0..10),
    overwriteResults=True)  # -> readMe, analysisType, resultsUnit, results, testPts, annual_analysis_files, radGeoFile, studyFolder, done; plug-in component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
gethbzoneepschedules = Honeybee_GetZoneEnergyPlusSchedules(HBZone=createhbzones_2.HBZone)  # -> occupancySchedule, occupancyActivitySch, heatingSetPtSchedule, coolingSetPtSchedule, lightingSchedule, equipmentSchedule, infiltrationSchedule; plug-in component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
panel_33 = Panel(gethbzoneepschedules.lightingSchedule)
# Generate lighting Schedule
toggle_3 = BooleanToggle(True)
readannualresultsi = Honeybee_ReadAnnualResultI(
    illFilesAddress=rundaylightanalysis.annual_analysis_files,
    testPoints=simplify(rundaylightanalysis.testPts),
    occupancyFiles=gethbzoneepschedules.lightingSchedule,
    DLAIllumThresholds=300,
    lightingControlGroups=lightingcontrol,
    runIt=toggle_3)  # -> DLA, UDLI_Less_100, UDLI_100_2000, UDLI_More_2000, CDA, sDA, annualProfiles, htmReport; plug-in component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
gradientlibrary = Ladybug_GradientLibrary(gradIndex="13")  # -> customColors; plug-in component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

# ---- group: just for visualization
# Compare Schedules!
dsannualprofiles = Honeybee_DaysimAnnualProfiles(annualProfiles=readannualresultsi.annualProfiles)  # -> simplify(occupancyProfile), simplify(shadingProfiles), simplify(lightingControlProfiles), simplify(dgpProfile); plug-in component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
panel_34 = Panel("0.02")
panel_35 = Panel("0")
panel_36 = Panel(".15")
pt = ConstructPoint(XCoordinate="120", YCoordinate=0, ZCoordinate=0)

# ----
convertepschvalues = Honeybee_ConvertEnergyPlusScheduleToValues(schName=gethbzoneepschedules.lightingSchedule)  # -> values, holidays; plug-in component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
# update lighting schedule
setepzoneschedules = Honeybee_SetEnergyPlusZoneSchedules(lightingSchedules=readannualresultsi.annualProfiles)  # -> schedules, simplify(HBZones); plug-in component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
legendpar = Ladybug_LegendParameters(
    lowBound=Slider(0, range=0..100),
    highBound=Slider(1, range=0..1),
    numSegments="2",
    customColors=flatten(gradientlibrary))  # -> legendPar; plug-in component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
_3dchart = Ladybug_3DChart(
    inputData=flatten([dsannualprofiles.lightingControlProfiles, convertepschvalues.values]),
    basePoint=pt,
    xScale=panel_34,
    yScale=panel_36,
    zScale=panel_35,
    legendPar=legendpar)  # -> readMe, graphMesh, graphCurves, legend, legendBasePts, title, titleBasePts, dataPts, conditionalHOY; plug-in component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

callfromepconstrlibrary_6 = Honeybee_CallFromEPConstructionLibrary()  # -> ThermMaterials, EPMaterials, EPWindowMaterials, EPConstructions; plug-in component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
panel_37 = Panel("""0
1
2
4""")
searchepconstruction_3 = Honeybee_SearchEPConstruction(EPConstrList=callfromepconstrlibrary_6.EPConstructions, standard="3", climateZone="4", surfaceType=panel_37)  # -> EPSelectedConstr; plug-in component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
panel_38 = Panel(searchepconstruction_3)
flatten = FlattenTree(Tree=searchepconstruction_3, Path="{0}")
panel_39 = Panel(flatten)
item_23 = ListItem(List=flatten, Index=0, Wrap=True)  # -> Item, Item1, Item2, Item3, Item4, Item5, Item6, Item7, Item8, Item9
setepzonecnstr = Honeybee_SetEPZoneConstruction(
    HBZones=flatten(setepzoneschedules.HBZones),
    wallEPConstruction=item_23.Item2,
    windowEPConstruction=item_23.Item8,
    roofEPConstruction=item_23.Item6,
    floorEPConstruction=item_23.Item7)  # -> simplify(modifiedHBZones); plug-in component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

decomposeepconstruction_5 = Honeybee_DecomposeEPConstruction(cnstrName=searchepconstruction_3)  # -> materials, comments, UValue_SI, UValue_IP, RValue_SI, RValue_IP; plug-in component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
panel_40 = Panel(decomposeepconstruction_5.RValue_SI)

# ----
# geometry is not considered in airflow
# - volume is
# - surface is
# 
# these are simplified calculations done, not CFT calculations
# - can be more accurate than CFT
panel_41 = Panel("1")
setepnatvent = Honeybee_SetEPAirFlow(
    HBZones=flatten(setepzonecnstr),
    naturalVentilationType=panel_41,
    minIndoorTempForNatVent="24",
    maxIndoorTempForNatVent="35",
    minOutdoorTempForNatVent="16",
    maxOutdoorTempForNatVent="28")  # -> readMe, simplify(HBZones); plug-in component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

setepzoneloads_2 = Honeybee_SetEnergyPlusZoneLoads(
    HBZones=setepnatvent.HBZones,
    equipmentLoadPerArea="2",
    infiltrationRatePerArea="0.0003",
    lightingDensityPerArea="5",
    numOfPeoplePerArea=".03")  # -> loads, HBZones; plug-in component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

brep_16 = Brep([<brep referenced from the Rhino model> x12])
path = FilePath("C:\Users\aishu\Desktop\MEBD\2. Building Simulation\Assignment 1 & 2\USA_PA_Philadelphia.Intl.AP.724080_TMY3\USA_PA_Philadelphia.Intl.AP.724080_TMY3.stat")
importstat = Ladybug_ImportStat(statFile=path)  # -> readMe, ashraeClimateZone, ashraeZoneDescription, koppenClimateZone, koppenZoneDescription, port, heatingDesignDay, coolingDesignDay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; plug-in component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
hb_epcontextsrf = HoneybeeEPContextSurfaces(shdSurfaces=flatten(brep_16))  # -> HBContext; inputs shdSurfaces: list of Brep, justBoundingBox: Boolean
# ---------- hb_epcontextsrf: Python ----------
"""
prepare shading/context geometries

    Args:
        northVectorOrRotation: A vector that shows North or a number that shows
                               the rotation of the North from the Y axis
        bldgMasses: List of closed Breps as thermal zones.
    Returns:
        report: ...
        thermalZones: Thermal zone's geometries for visualiza
"""

ghenv.Component.Name = 'Honeybee EP context Surfaces'
ghenv.Component.NickName = 'HB_EPContextSrf'
ghenv.Component.Message = 'VER 0.0.62\nJUL_28_2017'
ghenv.Component.IconDisplayMode = ghenv.Component.IconDisplayMode.application
ghenv.Component.Category = "Honeybee"
ghenv.Component.SubCategory = "10 | Energy | Energy"
#compatibleHBVersion = VER 0.0.57\nNOV_04_2016
#compatibleLBVersion = VER 0.0.59\nFEB_01_2015
ghenv.Component.AdditionalHelpFromDocStrings = "2"

import rhinoscriptsyntax as rs
import Rhino as rc
import scriptcontext as sc
import os
import System
import Grasshopper.Kernel as gh
import uuid

tolerance = sc.doc.ModelAbsoluteTolerance
import math


def main(shdSurfaces, EPTransSchedule, meshingSettings, justBoundingBox):
    
    # import the classes
    if sc.sticky.has_key('honeybee_release'):

        try:
            if not sc.sticky['honeybee_release'].isCompatible(ghenv.Component): return -1
            if sc.sticky['honeybee_release'].isInputMissing(ghenv.Component): return -1
        except:
            warning = "You need a newer version of Honeybee to use this compoent." + \
            " Use updateHoneybee component to update userObjects.\n" + \
            "If you have already updated userObjects drag Honeybee_Honeybee component " + \
            "into canvas and try again."
            w = gh.GH_RuntimeMessageLevel.Warning
            ghenv.Component.AddRuntimeMessage(w, warning)
            return -1
        
        # don't customize this part
        hb_EPSrf = sc.sticky["honeybee_EPSurface"]
        hb_EPSHDSurface = sc.sticky["honeybee_EPShdSurface"]
        hb_RADMaterialAUX = sc.sticky["honeybee_RADMaterialAUX"]
        hb_EPObjectsAux = sc.sticky["honeybee_EPObjectsAUX"]()
        HBScheduleList = sc.sticky["honeybee_ScheduleLib"].keys()

        ########################################################################
        #----------------------------------------------------------------------#
        shdBreps = []
        # create bounding box of shading geometries
        if justBoundingBox:
            for brep in shdSurfaces:
                if brep.Faces.Count>1 or not brep.Faces[0].IsPlanar(sc.doc.ModelAbsoluteTolerance):
                    shdBreps.append(brep.GetBoundingBox(True).ToBrep())
                else:
                    shdBreps.append(brep)
        else:
            shdBreps = shdSurfaces
        
        shadingClasses = []
        shadingMeshPreview = []
        
        if meshingSettings == None:
            mp = rc.Geometry.MeshingParameters.Minimal
            mp.SimplePlanes = True
        else:
            mp = meshingSettings
        
        def getRadMaterialName(radMaterial):
            nameStr = radMaterial.split(" ")[2]
            name =  nameStr.split("\n")[0]
            return name
        
        for brepCount, brep in enumerate(shdBreps):
            if brep != None:
                isPlanar = True
                # check planarity
                for face in brep.Faces:
                    if not face.IsPlanar(tolerance):
                        isPlanar = False
                        break
                
                shadingBreps = []
                if not isPlanar:
                    meshArray = rc.Geometry.Mesh.CreateFromBrep(brep, mp)
                    for mesh in meshArray:
                        for meshFace in range(mesh.Faces.Count):
                            vertices = list(mesh.Faces.GetFaceVertices(meshFace))[1:]
                            vertices = vertices + [sc.doc.ModelAbsoluteTolerance]
                            # create the brep from mesh
                            shdBrep = rc.Geometry.Brep.CreateFromCornerPoints(*vertices)
                            shadingBreps.append(shdBrep)
                else:
                    for face in brep.Faces:
                        shadingBreps.append(face.DuplicateFace(False))
                
                for faceCount, shdBrep in enumerate(shadingBreps):
                        thisShading = hb_EPSHDSurface(shdBrep, 1000*brepCount + faceCount, 'shdSrf_' + `brepCount` + '_' + `faceCount` + "_" + str(uuid.uuid4()))
                        
                        # add transmittance schedule if any
                        if EPTransSchedule!=None:
                            schedule= EPTransSchedule.upper()
                            if schedule!=None and not schedule.lower().endswith(".csv") and schedule not in HBScheduleList:
                                msg = "Cannot find " + schedule + " in Honeybee schedule library."
                                print msg
                                ghenv.Component.AddRuntimeMessage(gh.GH_RuntimeMessageLevel.Warning, msg)
                                return -1
                            elif schedule!=None and schedule.lower().endswith(".csv"):
                                # check if csv file is existed
                                if not os.path.isfile(schedule):
                                    msg = "Cannot find the shchedule file: " + schedule
                                    print msg
                                    ghenv.Component.AddRuntimeMessage(gh.GH_RuntimeMessageLevel.Warning, msg)
                                    return -1
                            
                            thisShading.TransmittanceSCH = schedule
                        
                        # add the Rad Material if any
                        if RADMaterial!=None:
                            # if it is just the name of the material make sure it is already defined
                            if len(RADMaterial.split(" ")) == 1:
                                # if the material is not in the library add it to the library
                                if not hb_RADMaterialAUX.isMatrialExistInLibrary(RADMaterial):
                                    warningMsg = "Can't find " + RADMaterial + " in RAD Material Library.\n" + \
                                                "Add the material to the library and try again."
                                    ghenv.Component.AddRuntimeMessage(gh.GH_RuntimeMessageLevel.Warning, warningMsg)
                                    return
                                
                                try:
                                    thisShading.setRADMaterial(RADMaterial)
                                except Exception, e:
                                    print e
                                    warningMsg = "You are using an old version of Honeybee_Honeybee! Update your files and try again."
                                    print warningMsg
                                    ghenv.Component.AddRuntimeMessage(gh.GH_RuntimeMessageLevel.Warning, warningMsg)
                                    return
                                
                                addedToLib = True
                            else:
                                
                                # try to add the material to the library
                                addedToLib, thisShading.RadMaterial = hb_RADMaterialAUX.analyseRadMaterials(RADMaterial, True)
                                
                            if addedToLib==False:
                                warningMsg = "Failed to add " + RADMaterial + " to the Library."
                                ghenv.Component.AddRuntimeMessage(gh.GH_RuntimeMessageLevel.Warning, warningMsg)
                                return
                        
                        # add shading to the list
                        shadingClasses.append(thisShading)
                
        # add to the hive
        hb_hive = sc.sticky["honeybee_Hive"]()
        HBContext  = hb_hive.addToHoneybeeHive(shadingClasses, ghenv.Component)
        return HBContext
        ################################################################################################
    else:
        print "You should first let Honeybee to fly..."
        w = gh.GH_RuntimeMessageLevel.Warning
        ghenv.Component.AddRuntimeMessage(w, "You should first let Honeybee to fly...")
        return -1
        

if _shdSurfaces and _shdSurfaces[0]!=None:
    # add cleaning function
    result= main(_shdSurfaces, EPTransSchedule_, meshingSettings_, justBoundingBox_)
    
    if result != -1: HBContext = result
# ---------- end hb_epcontextsrf ----------

panel_42 = Panel("https://www.energyplus.net/weather-download/north_and_central_america_wmo_region_4/USA/PA/USA_PA_Philadelphia.Intl.AP.724080_TMY3/all")
toggle_4 = BooleanToggle(True)
toggle_5 = BooleanToggle(True)
epw_stat_2 = Ladybug_OpenEPWAndSTATWeatherFiles(weatherFileURL=panel_42)  # -> epwFile, statFile; plug-in component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
epoutput = Honeybee_GenerateEPOutput(zoneEnergyUse=toggle_5, zoneGainsAndLosses=toggle_5, zoneComfortMetrics=toggle_5, surfaceTempAnalysis="False")  # -> report, flatten(simulationOutputs); plug-in component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
runenergysimulation = Honeybee_RunEnergySimulation(
    epwFile=flatten(epw_stat_2.epwFile),
    analysisPeriod=flatten(importstat.typicalWeek),
    HBZones=flatten(setepzoneloads_2.HBZones),
    HBContext=flatten(hb_epcontextsrf),
    simulationOutputs=flatten(epoutput.simulationOutputs),
    writeIdf=flatten(toggle_4),
    runEnergyPlus=flatten(toggle_4))  # -> report, idfFileAddress, htmlReport, resultFileAddress; plug-in component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

importepw = Ladybug_ImportEpw(epwFile=epw_stat_2.epwFile)  # -> readMe, latitude, location, dryBulbTemperature, dewPointTemperature, relativeHumidity, windSpeed, windDirection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; plug-in component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
readepresult = Honeybee_ReadEPResult(resultFileAddress=runenergysimulation.resultFileAddress)  # -> totalThermalLoad, thermalLoadBalance, cooling, heating, electricLight, electricEquip, fanElectric, pumpElectric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; plug-in component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
adaptivecomfortcalculator = Ladybug_AdaptiveComfortCalculator(
    dryBulbTemperature=readepresult.airTemperature,
    meanRadiantTemperature=readepresult.meanRadTemperature,
    prevailingOutdoorTemp=importepw.dryBulbTemperature,
    windSpeed=importepw.windSpeed,
    runIt=Toggle(True))  # -> readMe, port, comfortableOrNot, conditionOfPerson, degreesFromTarget, port_2, targetTemperature, upperTemperatureBound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; plug-in component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
panel_43 = Panel([adaptivecomfortcalculator.percentOfTimeComfortable, adaptivecomfortcalculator.percentHotCold])

panel_44 = Panel("""Cooling, Heating
& Lighting Loads""")
barchart = Ladybug_MonthlyBarChart(
    inputData=flatten([readepresult.cooling, readepresult.heating, readepresult.electricLight]),
    altTitle=panel_44,
    basePoint="20, 0, 0",
    xScale=Slider(0.5, range=0..1),
    yScale=Slider(0.7, range=0..1))  # -> readMe, dataMesh, dataCurves, dataCrvColors, graphAxes, graphLabels, title, titleBasePt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; plug-in component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
gradientlibrary_2 = Ladybug_GradientLibrary(gradIndex="19")  # -> customColors; plug-in component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

legendpar_2 = Ladybug_LegendParameters(numSegments="3", customColors=flatten(gradientlibrary_2))  # -> legendPar; plug-in component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
_3dchart_2 = Ladybug_3DChart(inputData=flatten(adaptivecomfortcalculator.conditionOfPerson), xScale=0.25, zScale="0", legendPar=legendpar_2)  # -> readMe, graphMesh, graphCurves, legend, legendBasePts, title, titleBasePts, dataPts, conditionalHOY; plug-in component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
# Visualization
_3dchart_3 = Ladybug_3DChart(
    inputData=flatten([importepw.dryBulbTemperature, importepw.globalHorizontalRadiation]),
    basePoint="0,-320,0",
    xScale=0.25,
    zScale="0")  # -> readMe, graphMesh, graphCurves, legend, legendBasePts, title, titleBasePts, dataPts, conditionalHOY; plug-in component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
