# Grasshopper definition kennedy_kirin.gh (Grasshopper 0.9.76)
# plug-ins: Python Interpreter

honeybee = Honeybee_Honeybee()  # -> Vviiiiiiiiiizzz; plug-in component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
ladybug = Ladybug_Ladybug()  # -> Vviiiiiiiiiizzz; plug-in component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
r_value_h_ft2_f_btu = Panel("25")
r_value_h_ft2_f_btu_2 = Panel("13")
r_value_h_ft2_f_btu_3 = Panel("25")
construction_name = Panel("Baseline Roof")
construction_name_2 = Panel("Baseline Wall")
construction_name_3 = Panel("Baseline Floor")
uip2usi = Ladybug_uIP2uSI(U_IP=".22")  # -> U_SI; plug-in component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
rip2rsi = Ladybug_rIP2rSI(R_IP=r_value_h_ft2_f_btu)  # -> R_SI; plug-in component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
rip2rsi_2 = Ladybug_rIP2rSI(R_IP=r_value_h_ft2_f_btu_2)  # -> R_SI; plug-in component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
rip2rsi_3 = Ladybug_rIP2rSI(R_IP=r_value_h_ft2_f_btu_3)  # -> R_SI; plug-in component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
panel = Panel(uip2usi)
epnomassmat = Honeybee_EnergyPlusNoMassOpaqueMaterial(name=construction_name, R_Value=rip2rsi)  # -> EPMaterial; plug-in component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
epnomassmat_2 = Honeybee_EnergyPlusNoMassOpaqueMaterial(name=construction_name_2, R_Value=rip2rsi_2)  # -> EPMaterial; plug-in component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
epnomassmat_3 = Honeybee_EnergyPlusNoMassOpaqueMaterial(name=construction_name_3, R_Value=rip2rsi_3)  # -> EPMaterial; plug-in component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
pt = ConstructPoint(XCoordinate="1", YCoordinate="-.1", ZCoordinate=["1.139", "1.516", ".762", "1.893", "2.27", "2.64"])
wall_surface_with_opening = Brep(<brep referenced from the Rhino model>)
panel_2 = Panel("1,0,1.516")
walls = Brep([<brep referenced from the Rhino model> x3])

# ---- group: ceiling
ceiling = Brep(<brep referenced from the Rhino model>)

# ---- group: floor
floor = Brep(<brep referenced from the Rhino model>)

# ----
epwindowmat = Honeybee_EnergyPlusWindowMaterial(name="Low_e_Argon_Vinyl", U_Value=uip2usi, SHGC=".22", VT=".5")  # -> EPMaterial; plug-in component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
epconstruction = Honeybee_EnergyPlusConstruction(name=construction_name, layer_1=epnomassmat)  # -> EPConstruction; plug-in component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
epconstruction_2 = Honeybee_EnergyPlusConstruction(name=construction_name_2, layer_1=epnomassmat_2)  # -> EPConstruction; plug-in component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
epconstruction_3 = Honeybee_EnergyPlusConstruction(name=construction_name_3, layer_1=epnomassmat_3)  # -> EPConstruction; plug-in component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
epconstruction_4 = Honeybee_EnergyPlusConstruction(name="Low_e_Argon_Vinyl", layer_1=epwindowmat)  # -> EPConstruction; plug-in component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
planesrf = PlaneSurface(Plane="1,-2.11,1.899", XSize="3.362", YSize="4.56")
planesrf_2 = PlaneSurface(Plane=pt, XSize="3.362", YSize="1.1")
createhbsrfs = Honeybee_createHBSrfs(geometry=wall_surface_with_opening, srfType="0", EPConstruction=epconstruction_2)  # -> readMe, simplify(HBSurface); plug-in component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
panel_3 = Panel(epwindowmat)
createhbsrfs_2 = Honeybee_createHBSrfs(geometry=walls, srfType="0", EPConstruction=epconstruction_2)  # -> readMe, simplify(HBSurface); plug-in component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
createhbsrfs_3 = Honeybee_createHBSrfs(geometry=flatten(floor), srfType="2", EPConstruction=epconstruction_3)  # -> readMe, simplify(HBSurface); plug-in component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
createhbsrfs_4 = Honeybee_createHBSrfs(geometry=ceiling, srfType="3", EPConstruction=epconstruction)  # -> readMe, simplify(HBSurface); plug-in component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
glass = Brep([<brep referenced from the Rhino model> x2])
preview = CustomPreview(Geometry=glass, Shader=ColourSwatch(SwatchColor=RGBA(80, 222, 255, 160)))
geo = Geometry(planesrf_2)
addhbglz = Honeybee_addHBGlz(HBObj=createhbsrfs.HBSurface, childSurfaces=flatten(glass), EPConstructions=epconstruction_4)  # -> simplify(HBObjWGLZ); plug-in component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
bldgprograms = Honeybee_bldgPrograms({"Office": 0, "Retail": 1, "MidriseApartment": 2, "PrimarySchool": 3, "SecondarySchool": 4, "SmallHotel": 5, "LargeHotel": 6, "Hospital": 7, "Outpatient": 8, "Warehouse": 9, "SuperMarket": 10, "FullServiceRestaurant": 11, "QuickServiceRestaurant": 12}, selected="MidriseApartment")
makeadiabatic = Honeybee_MakeAdiabatic(HBSrfs=[createhbsrfs_2.HBSurface, createhbsrfs_4.HBSurface, createhbsrfs_3.HBSurface])  # -> HBSrfs; plug-in component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
hb_epcontextsrf = HoneybeeEPContextSurfaces(shdSurfaces=flatten(geo))  # -> HBContext; inputs shdSurfaces: list of GeometryBase, justBoundingBox: Boolean
# ---------- hb_epcontextsrf: Python ----------
"""
prepare shading/context geometries

    Args:
        northVectorOrRotation: A vector that shows North or a number that shows
                               the rotation of the North from the Y axis
        bldgMasses: List of closed Breps as thermal zones.
    Returns:
        report: ...
        thermalZones: Thermal zone's geometries for visualiza
"""

ghenv.Component.Name = 'Honeybee EP context Surfaces'
ghenv.Component.NickName = 'HB_EPContextSrf'
ghenv.Component.Message = 'VER 0.0.60\nNOV_04_2016'
ghenv.Component.IconDisplayMode = ghenv.Component.IconDisplayMode.application
ghenv.Component.Category = "Honeybee"
ghenv.Component.SubCategory = "10 | Energy | Energy"
#compatibleHBVersion = VER 0.0.57\nNOV_04_2016
#compatibleLBVersion = VER 0.0.59\nFEB_01_2015
ghenv.Component.AdditionalHelpFromDocStrings = "2"

import rhinoscriptsyntax as rs
import Rhino as rc
import scriptcontext as sc
import os
import System
import Grasshopper.Kernel as gh
import uuid

tolerance = sc.doc.ModelAbsoluteTolerance
import math


def main(shdSurfaces, EPTransSchedule, meshingSettings, justBoundingBox):
    
    # import the classes
    if sc.sticky.has_key('honeybee_release'):

        try:
            if not sc.sticky['honeybee_release'].isCompatible(ghenv.Component): return -1
            if sc.sticky['honeybee_release'].isInputMissing(ghenv.Component): return -1
        except:
            warning = "You need a newer version of Honeybee to use this compoent." + \
            " Use updateHoneybee component to update userObjects.\n" + \
            "If you have already updated userObjects drag Honeybee_Honeybee component " + \
            "into canvas and try again."
            w = gh.GH_RuntimeMessageLevel.Warning
            ghenv.Component.AddRuntimeMessage(w, warning)
            return -1
        
        # don't customize this part
        hb_EPSrf = sc.sticky["honeybee_EPSurface"]
        hb_EPSHDSurface = sc.sticky["honeybee_EPShdSurface"]
        hb_RADMaterialAUX = sc.sticky["honeybee_RADMaterialAUX"]
        hb_EPObjectsAux = sc.sticky["honeybee_EPObjectsAUX"]()
        HBScheduleList = sc.sticky["honeybee_ScheduleLib"].keys()

        ########################################################################
        #----------------------------------------------------------------------#
        shdBreps = []
        # create bounding box of shading geometries
        if justBoundingBox:
            for brep in shdSurfaces:
                if brep.Faces.Count>1 or not brep.Faces[0].IsPlanar(sc.doc.ModelAbsoluteTolerance):
                    shdBreps.append(brep.GetBoundingBox(True).ToBrep())
                else:
                    shdBreps.append(brep)
        else:
            shdBreps = shdSurfaces
        
        shadingClasses = []
        shadingMeshPreview = []
        
        if meshingSettings == None:
            mp = rc.Geometry.MeshingParameters.Minimal
            mp.SimplePlanes = True
        else:
            mp = meshingSettings
        
        def getRadMaterialName(radMaterial):
            nameStr = radMaterial.split(" ")[2]
            name =  nameStr.split("\n")[0]
            return name
        
        for brepCount, brep in enumerate(shdBreps):
            if brep != None:
                isPlanar = True
                # check planarity
                for face in brep.Faces:
                    if not face.IsPlanar(tolerance):
                        isPlanar = False
                        break
                
                shadingBreps = []
                if not isPlanar:
                    meshArray = rc.Geometry.Mesh.CreateFromBrep(brep, mp)
                    for mesh in meshArray:
                        for meshFace in range(mesh.Faces.Count):
                            vertices = list(mesh.Faces.GetFaceVertices(meshFace))[1:]
                            vertices = vertices + [sc.doc.ModelAbsoluteTolerance]
                            # create the brep from mesh
                            shdBrep = rc.Geometry.Brep.CreateFromCornerPoints(*vertices)
                            shadingBreps.append(shdBrep)
                else:
                    for face in brep.Faces:
                        shadingBreps.append(face.DuplicateFace(False))
                
                for faceCount, shdBrep in enumerate(shadingBreps):
                        thisShading = hb_EPSHDSurface(shdBrep, 1000*brepCount + faceCount, 'shdSrf_' + `brepCount` + '_' + `faceCount` + "_" + str(uuid.uuid4()))
                        
                        # add transmittance schedule if any
                        if EPTransSchedule!=None:
                            schedule= EPTransSchedule.upper()
                            if schedule!=None and not schedule.lower().endswith(".csv") and schedule not in HBScheduleList:
                                msg = "Cannot find " + schedule + " in Honeybee schedule library."
                                print msg
                                ghenv.Component.AddRuntimeMessage(gh.GH_RuntimeMessageLevel.Warning, msg)
                                return -1
                            elif schedule!=None and schedule.lower().endswith(".csv"):
                                # check if csv file is existed
                                if not os.path.isfile(schedule):
                                    msg = "Cannot find the shchedule file: " + schedule
                                    print msg
                                    ghenv.Component.AddRuntimeMessage(gh.GH_RuntimeMessageLevel.Warning, msg)
                                    return -1
                            
                            thisShading.TransmittanceSCH = schedule
                        
                        # add the Rad Material if any
                        if RADMaterial!=None:
                            # if it is just the name of the material make sure it is already defined
                            if len(RADMaterial.split(" ")) == 1:
                                # if the material is not in the library add it to the library
                                if not hb_RADMaterialAUX.isMatrialExistInLibrary(RADMaterial):
                                    warningMsg = "Can't find " + RADMaterial + " in RAD Material Library.\n" + \
                                                "Add the material to the library and try again."
                                    ghenv.Component.AddRuntimeMessage(gh.GH_RuntimeMessageLevel.Warning, warningMsg)
                                    return
                                
                                try:
                                    thisShading.setRADMaterial(RADMaterial)
                                except Exception, e:
                                    print e
                                    warningMsg = "You are using an old version of Honeybee_Honeybee! Update your files and try again."
                                    print warningMsg
                                    ghenv.Component.AddRuntimeMessage(gh.GH_RuntimeMessageLevel.Warning, warningMsg)
                                    return
                                
                                addedToLib = True
                            else:
                                
                                # try to add the material to the library
                                addedToLib, thisShading.RadMaterial = hb_RADMaterialAUX.analyseRadMaterials(RADMaterial, True)
                                
                            if addedToLib==False:
                                warningMsg = "Failed to add " + RADMaterial + " to the Library."
                                ghenv.Component.AddRuntimeMessage(gh.GH_RuntimeMessageLevel.Warning, warningMsg)
                                return
                        
                        # add shading to the list
                        shadingClasses.append(thisShading)
                
        # add to the hive
        hb_hive = sc.sticky["honeybee_Hive"]()
        HBContext  = hb_hive.addToHoneybeeHive(shadingClasses, ghenv.Component)
        return HBContext
        ################################################################################################
    else:
        print "You should first let Honeybee to fly..."
        w = gh.GH_RuntimeMessageLevel.Warning
        ghenv.Component.AddRuntimeMessage(w, "You should first let Honeybee to fly...")
        return -1
        

if _shdSurfaces and _shdSurfaces[0]!=None:
    # add cleaning function
    result= main(_shdSurfaces, EPTransSchedule_, meshingSettings_, justBoundingBox_)
    
    if result != -1: HBContext = result
# ---------- end hb_epcontextsrf ----------
listzoneprograms = Honeybee_ListZonePrograms(bldgProgram=bldgprograms)  # -> MidriseApartmentZonePrograms; plug-in component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
panel_4 = Panel("test_room")
wires = BrepWireframe(Brep=hb_epcontextsrf, Density=-1)
item = ListItem(List=listzoneprograms, Index=0, Wrap=True)

# ---- group: collect all honeybee surfaces
brep = Brep(flatten([makeadiabatic, addhbglz]))

# ----
bldgprograms_2 = Honeybee_bldgPrograms({"Office": 0, "Retail": 1, "MidriseApartment": 2, "PrimarySchool": 3, "SecondarySchool": 4, "SmallHotel": 5, "LargeHotel": 6, "Hospital": 7, "Outpatient": 8, "Warehouse": 9, "SuperMarket": 10, "FullServiceRestaurant": 11, "QuickServiceRestaurant": 12}, selected="MidriseApartment")
listzoneprograms_2 = Honeybee_ListZonePrograms(bldgProgram=bldgprograms_2)  # -> MidriseApartmentZonePrograms; plug-in component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
item_2 = ListItem(List=listzoneprograms_2, Index=0, Wrap=True)

panel_5 = Panel("https://www.energyplus.net/weather-download/north_and_central_america_wmo_region_4/USA/PA/USA_PA_Philadelphia.Intl.AP.724080_TMY3/all")
epw_stat = Ladybug_OpenEPWAndSTATWeatherFiles(weatherFileURL=panel_5)  # -> epwFile, statFile; plug-in component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

panel_6 = Panel(item_2)
createhbzones = Honeybee_createHBZones(name="test_room", zoneProgram=item_2, HBSurfaces=flatten(brep), isConditioned=True)  # -> readMe, HBZone; plug-in component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
importstat = Ladybug_ImportStat(statFile=epw_stat.statFile)  # -> readMe, ashraeClimateZone, koppenClimateZone, port, heatingDesignTemp, coolingDesignTemp, port_2, extremeHotWeek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; plug-in component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
setepnatvent = Honeybee_SetEPAirFlow(
    HBZones=flatten(createhbzones.HBZone),
    naturalVentilationType="1",
    minIndoorTempForNatVent="24",
    maxIndoorTempForNatVent="27",
    minOutdoorTempForNatVent="22",
    maxOutdoorTempForNatVent="30")  # -> readMe, simplify(HBZones); plug-in component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
brep_2 = Brep(flatten([brep, hb_epcontextsrf]))
createhbzones_2 = Honeybee_createHBZones(name="test_room", zoneProgram=item_2, HBSurfaces=flatten(brep_2), isConditioned=True)  # -> readMe, HBZone; plug-in component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
wires_2 = BrepWireframe(Brep=createhbzones_2.HBZone, Density=-1)
flip = Flip(Surface=floor)  # -> Surface, Result
gentestpts = Honeybee_GenerateTestPoints(testGeometry=flip.Surface, gridSize=".5", distBaseSrf=".762", moveTestMesh=True)  # -> readMe, simplify(testPoints), simplify(ptsVectors), simplify(facesArea), simplify(mesh); plug-in component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
radparameters = Honeybee_RADParameters(quality=0)  # -> readMe, radParameters; plug-in component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
panel_7 = Panel("""1
1
1
1
1
1
1
0
0
0
0
0
0
0
0
0
1
1
1
1
1
1
1
1""")
annualdaylightsimulation = Honeybee_AnnualDaylightSimulation(
    epwWeatherFile=epw_stat.epwFile,
    testPoints=gentestpts.testPoints,
    ptsVectors=gentestpts.ptsVectors,
    testMesh=gentestpts.mesh,
    radParameters=radparameters.radParameters)  # -> analysisRecipe; plug-in component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
panel_8 = Panel("""1
1
1
1
1
1
1
0
0
0
0
0
0
0
0
0
1
1
1
1
0
0
0
0""")
panel_9 = Panel("""1
1
1
1
1
1
1
1
1
1
1
1
1
1
1
1
1
1
1
1
1
1
1
1""")
item_3 = ListItem(List=gentestpts.testPoints, Index="58", Wrap=True)
toggle = BooleanToggle(True)
sph = Sphere(Base=item_3, Radius=Slider(0.1, range=0..0.1))
gethbzoneepschedules = Honeybee_GetZoneEnergyPlusSchedules(HBZone=setepnatvent.HBZones)  # -> occupancySchedule, occupancyActivitySch, heatingSetPtSchedule, coolingSetPtSchedule, lightingSchedule, equipmentSchedule, infiltrationSchedule; plug-in component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
rundaylightanalysis = Honeybee_RunDaylightSimulation(
    HBObjects=flatten(createhbzones_2.HBZone),
    analysisRecipe=annualdaylightsimulation,
    writeRad=toggle,
    runRad=toggle,
    numOfCPUs=Slider(3, range=0..10),
    overwriteResults=True)  # -> readMe, analysisType, resultsUnit, results, testPts, annual_analysis_files, radGeoFile, studyFolder, done; plug-in component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
lightingcontrol = Honeybee_LightingControlRecipe(
    controlType="4",
    sensorPoints=item_3,
    lightingPower=250,
    lightingSetpoint=300,
    ballastLossFactor=20,
    standbyPower=3,
    delayTime=5)  # -> lightingControlGroup; plug-in component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
annualschedule = Honeybee_AnnualSchedule(
    sun=panel_9,
    mon=panel_7,
    tue=panel_7,
    wed=panel_7,
    thu=panel_7,
    fri=panel_7,
    sat=panel_8,
    scheduleName="Home",
    runIt=Toggle(True))  # -> readMe, port, schedule, port_2, weekSched, schedIDFText; plug-in component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
panel_10 = Panel(rundaylightanalysis.annual_analysis_files)
panel_11 = Panel(gethbzoneepschedules.lightingSchedule)
convertepschvalues = Honeybee_ConvertEnergyPlusScheduleToValues(schName=gethbzoneepschedules.lightingSchedule)  # -> values, holidays; plug-in component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
readannualresultsi = Honeybee_ReadAnnualResultI(
    illFilesAddress=rundaylightanalysis.annual_analysis_files,
    testPoints=simplify(rundaylightanalysis.testPts),
    occupancyFiles=gethbzoneepschedules.lightingSchedule,
    DLAIllumThresholds=300,
    lightingControlGroups=lightingcontrol,
    runIt=Toggle(True))  # -> DLA, UDLI_Less_100, UDLI_100_2000, UDLI_More_2000, CDA, sDA, annualProfiles, htmReport; plug-in component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
dsannualprofiles = Honeybee_DaysimAnnualProfiles(annualProfiles=readannualresultsi.annualProfiles)  # -> simplify(occupancyProfile), simplify(shadingProfiles), simplify(lightingControlProfiles), simplify(dgpProfile); plug-in component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
legendpar = Ladybug_LegendParameters(lowBound="0", highBound="100")  # -> legendPar; plug-in component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
pt_2 = ConstructPoint(XCoordinate="20", YCoordinate="-70", ZCoordinate=0)
_3dchart = Ladybug_3DChart(
    inputData=flatten([dsannualprofiles.lightingControlProfiles, convertepschvalues.values]),
    basePoint=pt_2,
    xScale="0.02",
    yScale=".15",
    zScale="0")  # -> readMe, graphMesh, graphCurves, legend, legendBasePts, title, titleBasePts, dataPts, conditionalHOY; plug-in component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
recolormesh = Ladybug_RecolorMesh(
    analysisResult=readannualresultsi.UDLI_100_2000,
    inputMesh=gentestpts.mesh,
    legendPar=legendpar,
    analysisTitle="Annual Daylight Analysis",
    legendTitle="%")  # -> readMe, newMesh, newLegend, legendBasePt, meshColors, legendColors; plug-in component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
strnum = Ladybug_SeparateData(inputList=flatten(dsannualprofiles.lightingControlProfiles))  # -> numbers, strings; plug-in component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
setepzoneschedules = Honeybee_SetEnergyPlusZoneSchedules(HBZones=setepnatvent.HBZones, lightingSchedules=readannualresultsi.annualProfiles)  # -> schedules, simplify(HBZones); plug-in component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
smaller = SmallerThan(FirstNumber=strnum.numbers, SecondNumber="1")  # -> SmallerThan, OrEqualTo
ma = MassAddition(Input=smaller.SmallerThan)  # -> Result, PartialResults
epoutput = Honeybee_GenerateEPOutput(zoneEnergyUse=Toggle(True), zoneGainsAndLosses="False", zoneComfortMetrics="False", surfaceTempAnalysis="False")  # -> report, flatten(simulationOutputs); plug-in component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
division = Division(A=ma.Result, B="8760")
multiplication = Multiplication(A=division, B="100")
epoutput_2 = Honeybee_GenerateEPOutput(zoneGainsAndLosses="False", zoneComfortMetrics=Toggle(True), surfaceTempAnalysis="False")  # -> report, flatten(simulationOutputs); plug-in component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
round = Round(Number=multiplication)  # -> Nearest, Floor, Ceiling
toggle_2 = BooleanToggle(True)
panel_12 = Panel(round.Nearest)
runenergysimulation = Honeybee_RunEnergySimulation(
    epwFile=epw_stat.epwFile,
    HBZones=flatten(setepzoneschedules.HBZones),
    HBContext=flatten(hb_epcontextsrf),
    simulationOutputs=flatten(epoutput.simulationOutputs),
    writeIdf=toggle_2,
    runEnergyPlus=toggle_2)  # -> report, idfFileAddress, htmlReport, resultFileAddress; plug-in component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
toggle_3 = BooleanToggle(True)
runenergysimulation_2 = Honeybee_RunEnergySimulation(
    epwFile=epw_stat.epwFile,
    HBZones=flatten(setepnatvent.HBZones),
    HBContext=flatten(hb_epcontextsrf),
    simulationOutputs=flatten(epoutput_2.simulationOutputs),
    writeIdf=toggle_3,
    runEnergyPlus=toggle_3)  # -> report, idfFileAddress, htmlReport, resultFileAddress; plug-in component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
readepresult = Honeybee_ReadEPResult(resultFileAddress=runenergysimulation.resultFileAddress)  # -> totalThermalLoad, thermalLoadBalance, cooling, heating, electricLight, electricEquip, fanElectric, port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; plug-in component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
readepresult_2 = Honeybee_ReadEPResult(resultFileAddress=runenergysimulation_2.resultFileAddress)  # -> port, port_2, port_3, port_4, port_5, port_6, port_7, port_8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; plug-in component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
legendpar_2 = Ladybug_LegendParameters(lowBound=Slider(21, range=0..100))  # -> legendPar; plug-in component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
strnum_2 = Ladybug_SeparateData(inputList=flatten(readepresult.cooling))  # -> numbers, strings; plug-in component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
strnum_3 = Ladybug_SeparateData(inputList=flatten(readepresult.heating))  # -> numbers, strings; plug-in component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
strnum_4 = Ladybug_SeparateData(inputList=flatten(readepresult.electricLight))  # -> numbers, strings; plug-in component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
legendpar_3 = Ladybug_LegendParameters(lowBound=Slider(0, range=0..100), highBound="2.9")  # -> legendPar; plug-in component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
graph = QuickGraph(readepresult_2.airTemperature)
ma_2 = MassAddition(Input=strnum_2.numbers)  # -> Result, PartialResults
ma_3 = MassAddition(Input=strnum_3.numbers)  # -> Result, PartialResults
ma_4 = MassAddition(Input=strnum_4.numbers)  # -> Result, PartialResults
barchart = Ladybug_MonthlyBarChart(
    inputData=flatten(readepresult_2.airTemperature),
    basePoint="20, 50, 0",
    xScale=Slider(0.5, range=0..1),
    yScale=Slider(0.7, range=0..1),
    legendPar=legendpar_2)  # -> readMe, dataMesh, dataCurves, dataCrvColors, graphAxes, graphLabels, title, titleBasePt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; plug-in component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
total_cooling = Panel(ma_2.Result)
total_heating = Panel(ma_3.Result)
total_electric_lighting = Panel(ma_4.Result)
round_2 = Round(Number=total_cooling)  # -> Nearest, Floor, Ceiling
concat = Concatenate(FragmentA="Cooling Loads", FragmentB=round_2.Nearest, FragmentD=" kwh")
barchart_2 = Ladybug_MonthlyBarChart(
    inputData=flatten(readepresult.cooling),
    altTitle=concat,
    altYAxisTitle="Cooling Loads",
    basePoint="20, 0, 0",
    xScale=Slider(0.5, range=0..1),
    yScale=Slider(0.7, range=0..1),
    legendPar=legendpar_3)  # -> readMe, dataMesh, dataCurves, dataCrvColors, graphAxes, graphLabels, title, titleBasePt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; plug-in component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
tag = TextTag(Location="30,-10,0", Text=concat)
round_3 = Round(Number=total_heating)  # -> Nearest, Floor, Ceiling
concat_2 = Concatenate(FragmentA="Heating Loads", FragmentB=round_3.Nearest, FragmentD=" kwh")
barchart_3 = Ladybug_MonthlyBarChart(
    inputData=flatten(readepresult.heating),
    altTitle=concat_2,
    altYAxisTitle="Heating Loads",
    basePoint="140, 0, 0",
    xScale=Slider(0.5, range=0..1),
    yScale=Slider(0.7, range=0..1),
    legendPar=legendpar_3)  # -> readMe, dataMesh, dataCurves, dataCrvColors, graphAxes, graphLabels, title, titleBasePt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; plug-in component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
tag_2 = TextTag(Location="150,-10,0", Text=concat_2)
round_4 = Round(Number=total_electric_lighting)  # -> Nearest, Floor, Ceiling
concat_3 = Concatenate(FragmentA="Lighting Loads", FragmentB=round_4.Nearest, FragmentD=" kwh")
barchart_4 = Ladybug_MonthlyBarChart(
    inputData=flatten(readepresult.electricLight),
    altTitle=concat_3,
    altYAxisTitle="Lighting Loads",
    basePoint="260, 0, 0",
    xScale=Slider(0.5, range=0..1),
    yScale=Slider(0.7, range=0..1),
    legendPar=legendpar_3)  # -> readMe, dataMesh, dataCurves, dataCrvColors, graphAxes, graphLabels, title, titleBasePt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; plug-in component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
tag_3 = TextTag(Location="270,-10,0", Text=concat_3)
