# Grasshopper definition nelson_graham.gh (Grasshopper 0.9.76)
# plug-ins: Python Interpreter

brep = Brep([<brep referenced from the Rhino model> x3])
brep_2 = Brep([<brep referenced from the Rhino model> x4])
brep_3 = Brep(<brep referenced from the Rhino model>)
brep_4 = Brep(<brep referenced from the Rhino model>)
honeybee = Honeybee_Honeybee()  # -> Vviiiiiiiiiizzz; plug-in component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
radopaquematerial = Honeybee_RadianceOpaqueMaterial(materialName="floor_20", RReflectance=".4", GReflectance=".4", BReflectance=".4", roughness=0.05, specularity=0)  # -> avrgRef, RADMaterial; plug-in component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
ladybug = Ladybug_Ladybug()  # -> Vviiiiiiiiiizzz; plug-in component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
radopaquematerial_2 = Honeybee_RadianceOpaqueMaterial(materialName="ceiling_70", RReflectance=".7", GReflectance=".7", BReflectance=".7", roughness=0.05, specularity=0)  # -> avrgRef, RADMaterial; plug-in component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
radopaquematerial_3 = Honeybee_RadianceOpaqueMaterial(materialName="wall_50", RReflectance=".5", GReflectance=".5", BReflectance=".5", roughness=0.05, specularity=0)  # -> avrgRef, RADMaterial; plug-in component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
radglassmaterial = Honeybee_RadianceGlassMaterial(materialName="glass_60", RTransmittance="0.5", GTransmittance="0.5", BTransmittance="0.5", refractiveIndex=1.52)  # -> avrgTrans, RADMaterial; plug-in component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
move = Move(Motion=Vector(0, 0, 10))  # -> Geometry, Transform
flip = Flip(Surface=brep_4)  # -> Surface, Result
createhbsrfs = Honeybee_createHBSrfs(geometry=brep_4, RADMaterial=radopaquematerial.RADMaterial)  # -> readMe, simplify(HBSurface); plug-in component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
createhbsrfs_2 = Honeybee_createHBSrfs(geometry=brep_3, RADMaterial=radopaquematerial_2.RADMaterial)  # -> readMe, simplify(HBSurface); plug-in component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
createhbsrfs_3 = Honeybee_createHBSrfs(geometry=brep, RADMaterial=radglassmaterial.RADMaterial)  # -> readMe, simplify(HBSurface); plug-in component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
createhbsrfs_4 = Honeybee_createHBSrfs(geometry=brep_2, RADMaterial=radopaquematerial_3.RADMaterial)  # -> readMe, simplify(HBSurface); plug-in component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
gentestpts = Honeybee_GenerateTestPoints(testGeometry=flip.Surface, gridSize=".5", distBaseSrf=".67", moveTestMesh=True)  # -> readMe, simplify(testPoints), simplify(ptsVectors), simplify(facesArea), simplify(mesh); plug-in component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
brep_5 = Brep([createhbsrfs_2.HBSurface, createhbsrfs.HBSurface, createhbsrfs_4.HBSurface, createhbsrfs_3.HBSurface])
merge = Merge(
    Data1=createhbsrfs_3.HBSurface,
    Data2=createhbsrfs_4.HBSurface,
    Data3=createhbsrfs_2.HBSurface,
    Data4=createhbsrfs.HBSurface)
mass2zone = Honeybee_Masses2Zones(zoneMasses=flatten(brep_5), isConditioned=True, maxRoofAngle=30)  # -> readMe, HBZones; plug-in component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
preview = CustomPreview(
    Geometry=gentestpts.testPoints,
    Shader={ambient=RGB(0, 0, 0), diffuse=RGB(255, 105, 180), emission=RGB(76, 32, 54), shine=0.5, specular=RGB(255, 255, 255), transparency=0})
panel = Panel("https://www.energyplus.net/weather-download/north_and_central_america_wmo_region_4/USA/PA/USA_PA_Philadelphia.Intl.AP.724080_TMY3/all")
epw_stat = Ladybug_OpenEPWAndSTATWeatherFiles(weatherFileURL=panel)  # -> epwFile, statFile; plug-in component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
genclimatebasedsky = Honeybee_GenerateClimateBasedSky(weatherFile=epw_stat.epwFile, month="12", day="21", hour="12")  # -> radiationValues, skyFilePath; plug-in component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
radparameters = Honeybee_RADParameters(quality=0, ab="3")  # -> readMe, radParameters; plug-in component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
gridbasedsimulation = Honeybee_GridBasedSimulation(
    skyFile=genclimatebasedsky.skyFilePath,
    testPoints=gentestpts.testPoints,
    ptsVectors=gentestpts.ptsVectors,
    simulationType=0,
    radParameters=radparameters.radParameters)  # -> analysisRecipe; plug-in component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
toggle = BooleanToggle(True)
panel_2 = Panel(radparameters.readMe)
rundaylightanalysis = Honeybee_RunDaylightSimulation(
    HBObjects=flatten(merge),
    analysisRecipe=gridbasedsimulation,
    writeRad=toggle,
    runRad=toggle,
    workingDir="C:\ladybug",
    radFileName="test",
    overwriteResults=True)  # -> readMe, analysisType, resultsUnit, illuminance_values, testPts, illuminance_files, radGeoFile, studyFolder, done; plug-in component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
legendpar = Ladybug_LegendParameters(lowBound="100", highBound="4000")  # -> legendPar; plug-in component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
panel_3 = Panel(rundaylightanalysis.illuminance_values)
recolormesh = Ladybug_RecolorMesh(
    analysisResult=rundaylightanalysis.illuminance_values,
    inputMesh=gentestpts.mesh,
    legendPar=legendpar,
    analysisTitle="Illuminance",
    legendTitle="lux")  # -> readMe, newMesh, newLegend, legendBasePt, meshColors, legendColors; plug-in component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
