# Grasshopper definition wang_yuchi.gh (Grasshopper 0.9.76)
# plug-ins: Python Interpreter

bldgprograms = Honeybee_bldgPrograms({"Office": 0, "Retail": 1, "MidriseApartment": 2, "PrimarySchool": 3, "SecondarySchool": 4, "SmallHotel": 5, "LargeHotel": 6, "Hospital": 7, "Outpatient": 8, "Warehouse": 9, "SuperMarket": 10, "FullServiceRestaurant": 11, "QuickServiceRestaurant": 12}, selected="MidriseApartment")
ladybug = Ladybug_Ladybug()  # -> Vviiiiiiiiiizzz; plug-in component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
honeybee = Honeybee_Honeybee()  # -> Vviiiiiiiiiizzz; plug-in component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

# ---- group: PREPARE / HBZone Generation
toggle = BooleanToggle(True)

# ---- group: PREPARE / AC Status
toggle_2 = BooleanToggle(False)

# ---- group: RUN DAYLIGHT SIMULATION
toggle_3 = BooleanToggle(True)

# ---- group: RUN ENERGY SIMULATION
toggle_4 = BooleanToggle(True)

# ----
listzoneprograms = Honeybee_ListZonePrograms(bldgProgram=bldgprograms)  # -> MidriseApartmentZonePrograms; plug-in component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
item = ListItem(List=listzoneprograms, Index=0, Wrap=True)

# ---- group: PREPARE
brep = Brep(<brep referenced from the Rhino model>)
brep_2 = Brep(<brep referenced from the Rhino model>)
brep_3 = Brep(<brep referenced from the Rhino model>)
mass2zone = Honeybee_Masses2Zones(
    zoneMasses=flatten(brep_2),
    zoneNames="RESTROOM",
    zonePrograms=item,
    isConditioned=toggle_2,
    maxRoofAngle=30,
    createHBZones=toggle)  # -> readMe, HBZones; plug-in component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
mass2zone_2 = Honeybee_Masses2Zones(
    zoneMasses=flatten(brep_3),
    zoneNames="BEDROOM",
    zonePrograms=item,
    isConditioned=toggle_2,
    maxRoofAngle=30,
    createHBZones=toggle)  # -> readMe, HBZones; plug-in component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
mass2zone_3 = Honeybee_Masses2Zones(
    zoneMasses=flatten(brep),
    zoneNames="LIVING ROOM & KITCHEN",
    zonePrograms=item,
    isConditioned=toggle_2,
    maxRoofAngle=30,
    createHBZones=toggle)  # -> readMe, HBZones; plug-in component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
brep_4 = Brep([<brep referenced from the Rhino model> x2])
brep_5 = Brep(<brep referenced from the Rhino model>)
# GEOMETRY
addhbglz = Honeybee_addHBGlz(HBObj=mass2zone_3.HBZones, childSurfaces=flatten(brep_4))  # -> HBObjWGLZ; plug-in component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
addhbglz_2 = Honeybee_addHBGlz(HBObj=mass2zone_2.HBZones, childSurfaces=flatten(brep_5))  # -> HBObjWGLZ; plug-in component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
brep_6 = Brep(flatten([addhbglz, mass2zone.HBZones, addhbglz_2]))
solveadjc = Honeybee_SolveAdjacencies(HBZones=flatten(brep_6), removeCurrentAdjc=False, findAdjc=toggle)  # -> readMe, HBZonesWADJ; plug-in component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

# ----
callfromepschlibrary = Honeybee_CallFromEPScheduleLibrary(keywords="apartment")  # -> scheduleTypeLimits, scheduleList; plug-in component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
decomposeepconstruction = Honeybee_DecomposeEPConstruction(cnstrName="Exterior Wall")  # -> materials, comments, UValue_SI, UValue_IP, RValue_SI, RValue_IP; plug-in component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
item_2 = ListItem(List=callfromepschlibrary.scheduleList, Index=1, Wrap=True)
setepzoneschedules = Honeybee_SetEnergyPlusZoneSchedules(occupancySchedules=item_2)  # -> schedules, simplify(HBZones); plug-in component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
panel = Panel(decomposeepconstruction.RValue_SI)
# Modifications
srfattributelist = Honeybee_SurfaceAttributeList({"Name": "name", "Radiance Material": "RadMaterial", "EnergyPlus Construction": "EPConstruction", "Surface Type": "type", "Boundary Condition": "BC", "Sun Exposure": "sunExposure", "Wind Exposure": "windExposure", "Has Child Surface": "hasChild", "Is Child Surface": "isChild", "Is Planar": "isPlanar", "Srf Type Set By User": "srfTypeByUser", "Boundary Condition Set By User": "srfBCByUser", "Shade Material Name": "shadeMaterialName", "Shading Control Name": "shadingControlName", "Shcading Schedule Name": "shadingSchName"}, selected="EnergyPlus Construction")
labelsurfaces = Honeybee_LabelZoneSurfaces(HBObjects=flatten(solveadjc.HBZonesWADJ), attribute=srfattributelist)  # -> surfaceTxtLabels, labelBasePts, brepTxtLabels, surfaceWireFrames; plug-in component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
# CONSTRUCTION
callfromepconstrlibrary = Honeybee_CallFromEPConstructionLibrary()  # -> ThermMaterials, EPMaterials, EPWindowMaterials, EPConstructions; plug-in component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

# ----
# ROOF CONSTRUCTION
panel_2 = Panel("1")
searchepconstruction = Honeybee_SearchEPConstruction(EPConstrList=callfromepconstrlibrary.EPConstructions, standard="2", climateZone="4", surfaceType=panel_2)  # -> EPSelectedConstr; plug-in component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
item_3 = ListItem(List=searchepconstruction, Index="0", Wrap=True)

# ----
# WINDOW CONSTRUCTION
panel_3 = Panel("4")
searchepconstruction_2 = Honeybee_SearchEPConstruction(EPConstrList=callfromepconstrlibrary.EPConstructions, standard="2", climateZone="4", surfaceType=panel_3)  # -> EPSelectedConstr; plug-in component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
item_4 = ListItem(List=searchepconstruction_2, Index="1", Wrap=True)

# ----
# WALL CONSTRUCTION
panel_4 = Panel("0")
searchepconstruction_3 = Honeybee_SearchEPConstruction(EPConstrList=callfromepconstrlibrary.EPConstructions, standard="2", climateZone="4", surfaceType=panel_4)  # -> EPSelectedConstr; plug-in component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
item_5 = ListItem(List=searchepconstruction_3, Index="4", Wrap=True)

# ----
# FLOOR CONSTRUCTION
panel_5 = Panel("2")
searchepconstruction_4 = Honeybee_SearchEPConstruction(EPConstrList=callfromepconstrlibrary.EPConstructions, standard="2", climateZone="4", surfaceType=panel_5)  # -> EPSelectedConstr; plug-in component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
item_6 = ListItem(List=searchepconstruction_4, Index="1", Wrap=True)

genhbzonetestpts = Honeybee_GenerateZoneTestPoints(HBZone=solveadjc.HBZonesWADJ, gridSize="0.72", distBaseSrf="0.75", moveTestMesh=True)  # -> readMe, simplify(testPoints), simplify(ptsVectors), simplify(facesArea), simplify(mesh); plug-in component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
brep_7 = Brep([<brep referenced from the Rhino model> x6])
createhbsrfs = Honeybee_createHBSrfs(geometry=brep_7, srfType="6")  # -> readMe, simplify(HBSurface); plug-in component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

# ----
# R Value Check
decomposeepconstruction_2 = Honeybee_DecomposeEPConstruction(cnstrName=item_6)  # -> materials, comments, UValue_SI, UValue_IP, RValue_SI, RValue_IP; plug-in component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
# Ventilation
sort = SortList(Keys=decomposeepconstruction_2.RValue_SI)  # -> Keys, ValuesA
panel_6 = Panel(decomposeepconstruction_2.RValue_SI)

setepzonecnstr = Honeybee_SetEPZoneConstruction(
    HBZones=flatten(solveadjc.HBZonesWADJ),
    wallEPConstruction=item_5,
    windowEPConstruction=item_4,
    roofEPConstruction=item_3,
    floorEPConstruction=item_6)  # -> simplify(modifiedHBZones); plug-in component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

setepnatvent = Honeybee_SetEPAirFlow(
    HBZones=flatten(setepzonecnstr),
    naturalVentilationType="1",
    minIndoorTempForNatVent="24",
    maxIndoorTempForNatVent="27",
    minOutdoorTempForNatVent="22",
    maxOutdoorTempForNatVent="30")  # -> readMe, simplify(HBZones); plug-in component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

legendpar = Ladybug_LegendParameters(lowBound="0", highBound="100")  # -> legendPar; plug-in component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
panel_7 = Panel("""DAYLIGHTING
ANALYSIS""")
path = FilePath("\\juno.design.upenn.edu\home\grad\arch\yuchwang\Desktop\Philadelphia_weather_files\USA_PA_Philadelphia.Intl.AP.724080_TMY3.epw")
annualdaylightsimulation = Honeybee_AnnualDaylightSimulation(
    epwWeatherFile=path,
    testPoints=genhbzonetestpts.testPoints,
    ptsVectors=genhbzonetestpts.ptsVectors,
    testMesh=genhbzonetestpts.mesh)  # -> analysisRecipe; plug-in component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
# Daylighting Simulation
rundaylightanalysis = Honeybee_RunDaylightSimulation(
    HBObjects=flatten(solveadjc.HBZonesWADJ),
    analysisRecipe=annualdaylightsimulation,
    writeRad=toggle_3,
    runRad=toggle_3,
    overwriteResults=True)  # -> readMe, analysisType, resultsUnit, results, testPts, annual_analysis_files, radGeoFile, studyFolder, done; plug-in component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
readannualresultsi = Honeybee_ReadAnnualResultI(
    illFilesAddress=rundaylightanalysis.annual_analysis_files,
    testPoints=simplify(genhbzonetestpts.testPoints),
    ptsVectors=genhbzonetestpts.ptsVectors,
    DLAIllumThresholds=300,
    runIt=Toggle(True))  # -> DLA, UDLI_Less_100, UDLI_100_2000, UDLI_More_2000, CDA, sDA, annualProfiles, htmReport; plug-in component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
panel_8 = Panel(readannualresultsi.annualProfiles)
recolormesh = Ladybug_RecolorMesh(
    analysisResult=readannualresultsi.UDLI_100_2000,
    inputMesh=genhbzonetestpts.mesh,
    legendPar=legendpar,
    analysisTitle=panel_7,
    legendTitle="UDI (%)")  # -> readMe, newMesh, newLegend, legendBasePt, meshColors, legendColors; plug-in component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
setepzoneschedules_2 = Honeybee_SetEnergyPlusZoneSchedules(HBZones=setepnatvent.HBZones, lightingSchedules=flatten(readannualresultsi.annualProfiles))  # -> schedules, simplify(HBZones); plug-in component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
toggle_5 = BooleanToggle(True)
brep_8 = Brep([<brep referenced from the Rhino model> x6])
bang = ExplodeTree(Data=recolormesh.newLegend)  # -> Branch0, Branch1, Branch2
bang_2 = ExplodeTree(Data=recolormesh.newMesh)  # -> Branch0, Branch1, Branch2
hb_epcontextsrf = HoneybeeEPContextSurfaces(shdSurfaces=flatten(brep_8))  # -> HBContext; inputs shdSurfaces: list of Brep, justBoundingBox: Boolean
# ---------- hb_epcontextsrf: Python ----------
"""
prepare shading/context geometries

    Args:
        northVectorOrRotation: A vector that shows North or a number that shows
                               the rotation of the North from the Y axis
        bldgMasses: List of closed Breps as thermal zones.
    Returns:
        report: ...
        thermalZones: Thermal zone's geometries for visualiza
"""

ghenv.Component.Name = 'Honeybee EP context Surfaces'
ghenv.Component.NickName = 'HB_EPContextSrf'
ghenv.Component.Message = 'VER 0.0.62\nJUL_28_2017'
ghenv.Component.IconDisplayMode = ghenv.Component.IconDisplayMode.application
ghenv.Component.Category = "Honeybee"
ghenv.Component.SubCategory = "10 | Energy | Energy"
#compatibleHBVersion = VER 0.0.57\nNOV_04_2016
#compatibleLBVersion = VER 0.0.59\nFEB_01_2015
ghenv.Component.AdditionalHelpFromDocStrings = "2"

import rhinoscriptsyntax as rs
import Rhino as rc
import scriptcontext as sc
import os
import System
import Grasshopper.Kernel as gh
import uuid

tolerance = sc.doc.ModelAbsoluteTolerance
import math


def main(shdSurfaces, EPTransSchedule, meshingSettings, justBoundingBox):
    
    # import the classes
    if sc.sticky.has_key('honeybee_release'):

        try:
            if not sc.sticky['honeybee_release'].isCompatible(ghenv.Component): return -1
            if sc.sticky['honeybee_release'].isInputMissing(ghenv.Component): return -1
        except:
            warning = "You need a newer version of Honeybee to use this compoent." + \
            " Use updateHoneybee component to update userObjects.\n" + \
            "If you have already updated userObjects drag Honeybee_Honeybee component " + \
            "into canvas and try again."
            w = gh.GH_RuntimeMessageLevel.Warning
            ghenv.Component.AddRuntimeMessage(w, warning)
            return -1
        
        # don't customize this part
        hb_EPSrf = sc.sticky["honeybee_EPSurface"]
        hb_EPSHDSurface = sc.sticky["honeybee_EPShdSurface"]
        hb_RADMaterialAUX = sc.sticky["honeybee_RADMaterialAUX"]
        hb_EPObjectsAux = sc.sticky["honeybee_EPObjectsAUX"]()
        HBScheduleList = sc.sticky["honeybee_ScheduleLib"].keys()

        ########################################################################
        #----------------------------------------------------------------------#
        shdBreps = []
        # create bounding box of shading geometries
        if justBoundingBox:
            for brep in shdSurfaces:
                if brep.Faces.Count>1 or not brep.Faces[0].IsPlanar(sc.doc.ModelAbsoluteTolerance):
                    shdBreps.append(brep.GetBoundingBox(True).ToBrep())
                else:
                    shdBreps.append(brep)
        else:
            shdBreps = shdSurfaces
        
        shadingClasses = []
        shadingMeshPreview = []
        
        if meshingSettings == None:
            mp = rc.Geometry.MeshingParameters.Minimal
            mp.SimplePlanes = True
        else:
            mp = meshingSettings
        
        def getRadMaterialName(radMaterial):
            nameStr = radMaterial.split(" ")[2]
            name =  nameStr.split("\n")[0]
            return name
        
        for brepCount, brep in enumerate(shdBreps):
            if brep != None:
                isPlanar = True
                # check planarity
                for face in brep.Faces:
                    if not face.IsPlanar(tolerance):
                        isPlanar = False
                        break
                
                shadingBreps = []
                if not isPlanar:
                    meshArray = rc.Geometry.Mesh.CreateFromBrep(brep, mp)
                    for mesh in meshArray:
                        for meshFace in range(mesh.Faces.Count):
                            vertices = list(mesh.Faces.GetFaceVertices(meshFace))[1:]
                            vertices = vertices + [sc.doc.ModelAbsoluteTolerance]
                            # create the brep from mesh
                            shdBrep = rc.Geometry.Brep.CreateFromCornerPoints(*vertices)
                            shadingBreps.append(shdBrep)
                else:
                    for face in brep.Faces:
                        shadingBreps.append(face.DuplicateFace(False))
                
                for faceCount, shdBrep in enumerate(shadingBreps):
                        thisShading = hb_EPSHDSurface(shdBrep, 1000*brepCount + faceCount, 'shdSrf_' + `brepCount` + '_' + `faceCount` + "_" + str(uuid.uuid4()))
                        
                        # add transmittance schedule if any
                        if EPTransSchedule!=None:
                            schedule= EPTransSchedule.upper()
                            if schedule!=None and not schedule.lower().endswith(".csv") and schedule not in HBScheduleList:
                                msg = "Cannot find " + schedule + " in Honeybee schedule library."
                                print msg
                                ghenv.Component.AddRuntimeMessage(gh.GH_RuntimeMessageLevel.Warning, msg)
                                return -1
                            elif schedule!=None and schedule.lower().endswith(".csv"):
                                # check if csv file is existed
                                if not os.path.isfile(schedule):
                                    msg = "Cannot find the shchedule file: " + schedule
                                    print msg
                                    ghenv.Component.AddRuntimeMessage(gh.GH_RuntimeMessageLevel.Warning, msg)
                                    return -1
                            
                            thisShading.TransmittanceSCH = schedule
                        
                        # add the Rad Material if any
                        if RADMaterial!=None:
                            # if it is just the name of the material make sure it is already defined
                            if len(RADMaterial.split(" ")) == 1:
                                # if the material is not in the library add it to the library
                                if not hb_RADMaterialAUX.isMatrialExistInLibrary(RADMaterial):
                                    warningMsg = "Can't find " + RADMaterial + " in RAD Material Library.\n" + \
                                                "Add the material to the library and try again."
                                    ghenv.Component.AddRuntimeMessage(gh.GH_RuntimeMessageLevel.Warning, warningMsg)
                                    return
                                
                                try:
                                    thisShading.setRADMaterial(RADMaterial)
                                except Exception, e:
                                    print e
                                    warningMsg = "You are using an old version of Honeybee_Honeybee! Update your files and try again."
                                    print warningMsg
                                    ghenv.Component.AddRuntimeMessage(gh.GH_RuntimeMessageLevel.Warning, warningMsg)
                                    return
                                
                                addedToLib = True
                            else:
                                
                                # try to add the material to the library
                                addedToLib, thisShading.RadMaterial = hb_RADMaterialAUX.analyseRadMaterials(RADMaterial, True)
                                
                            if addedToLib==False:
                                warningMsg = "Failed to add " + RADMaterial + " to the Library."
                                ghenv.Component.AddRuntimeMessage(gh.GH_RuntimeMessageLevel.Warning, warningMsg)
                                return
                        
                        # add shading to the list
                        shadingClasses.append(thisShading)
                
        # add to the hive
        hb_hive = sc.sticky["honeybee_Hive"]()
        HBContext  = hb_hive.addToHoneybeeHive(shadingClasses, ghenv.Component)
        return HBContext
        ################################################################################################
    else:
        print "You should first let Honeybee to fly..."
        w = gh.GH_RuntimeMessageLevel.Warning
        ghenv.Component.AddRuntimeMessage(w, "You should first let Honeybee to fly...")
        return -1
        

if _shdSurfaces and _shdSurfaces[0]!=None:
    # add cleaning function
    result= main(_shdSurfaces, EPTransSchedule_, meshingSettings_, justBoundingBox_)
    
    if result != -1: HBContext = result
# ---------- end hb_epcontextsrf ----------
mesh = Mesh(bang.Branch1)
epoutput = Honeybee_GenerateEPOutput(
    zoneEnergyUse=toggle_5,
    zoneGainsAndLosses=toggle_5,
    zoneComfortMetrics=toggle_5,
    surfaceTempAnalysis="False",
    surfaceEnergyAnalysis=toggle_5)  # -> report, flatten(simulationOutputs); plug-in component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
runenergysimulation = Honeybee_RunEnergySimulation(
    epwFile=path,
    HBZones=flatten(setepzoneschedules_2.HBZones),
    simulationOutputs=flatten(epoutput.simulationOutputs),
    writeIdf=toggle_4,
    runEnergyPlus=toggle_4)  # -> report, idfFileAddress, htmlReport, resultFileAddress; plug-in component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
readepresult = Honeybee_ReadEPResult(resultFileAddress=runenergysimulation.resultFileAddress)  # -> port, port_2, port_3, port_4, electricLight, electricEquip, fanElectric, port_5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; plug-in component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
# SIMULATION
importepw = Ladybug_ImportEpw(epwFile=path)  # -> readMe, latitude, location, dryBulbTemperature, dewPointTemperature, relativeHumidity, windSpeed, windDirection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; plug-in component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
readepsrfresult = Honeybee_ReadEPSurfaceResult(resultFileAddress=runenergysimulation.resultFileAddress)  # -> port, port_2, surfaceEnergyFlow, opaqueEnergyFlow, glazEnergyFlow, port_3, port_4, port_5, port_6, port_7; plug-in component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

# ----
# Comfort Chart
adaptivecomfortcalculator = Ladybug_AdaptiveComfortCalculator(
    dryBulbTemperature=readepresult.airTemperature,
    meanRadiantTemperature=readepresult.meanRadTemperature,
    prevailingOutdoorTemp=importepw.dryBulbTemperature,
    runIt=Toggle(True))  # -> readMe, port, comfortableOrNot, conditionOfPerson, degreesFromTarget, port_2, targetTemperature, upperTemperatureBound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; plug-in component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
legendpar_2 = Ladybug_LegendParameters(lowBound="-1", highBound="1", numSegments="3")  # -> legendPar; plug-in component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
pt = Point(<point referenced from the Rhino model>)
_3dchart = Ladybug_3DChart(
    inputData=flatten(adaptivecomfortcalculator.conditionOfPerson),
    basePoint=pt,
    xScale="0.025",
    yScale="0.1",
    zScale="0",
    legendPar=legendpar_2)  # -> readMe, graphMesh, graphCurves, legend, legendBasePts, title, titleBasePts, dataPts, conditionalHOY; plug-in component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

energybalance = Honeybee_ConstructEnergyBalance(
    HBZones=flatten(setepnatvent.HBZones),
    cooling=readepresult.port_3,
    heating=readepresult.port_4,
    electricLight=readepresult.electricLight,
    electricEquip=readepresult.electricEquip,
    fanElectric=readepresult.fanElectric,
    peopleGains=readepresult.peopleGains,
    totalSolarGain=readepresult.totalSolarGain,
    infiltrationEnergy=readepresult.infiltrationEnergy,
    mechVentilationEnergy=readepresult.port_6,
    natVentEnergy=readepresult.natVentEnergy,
    surfaceEnergyFlow=readepsrfresult.surfaceEnergyFlow)  # -> readMe, port, flrNormEnergyBal, flrNormBalWStorage, port_2, modelEnergyBalance, energyBalWithStorage; plug-in component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
gradientlibrary = Ladybug_GradientLibrary(gradIndex="19")  # -> customColors; plug-in component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
# Energy Balance
selectandaveragedata = Ladybug_AverageData(annualHourlyData=energybalance.flrNormBalWStorage, totalOrAverage=Toggle(True))  # -> readMe, selHourlyData, totaledDaily, totaledMonthly, totMonthlyPerHour, totAnalysisPeriod; plug-in component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
legendpar_3 = Ladybug_LegendParameters(customColors=flatten(gradientlibrary))  # -> legendPar; plug-in component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
pt_2 = Point(<point referenced from the Rhino model>)
barchart = Ladybug_MonthlyBarChart(
    inputData=flatten(selectandaveragedata.totaledMonthly),
    stackValues=Toggle(True),
    altTitle="Energy Balance",
    altYAxisTitle="Energy (KWh)",
    basePoint=pt_2,
    xScale="0.75",
    yScale="0.75",
    legendPar=legendpar_3)  # -> readMe, dataMesh, dataCurves, dataCrvColors, graphAxes, graphLabels, title, titleBasePt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; plug-in component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

strnum = Ladybug_SeparateData(inputList=flatten(adaptivecomfortcalculator.conditionOfPerson))  # -> numbers, strings; plug-in component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
equals = Equality(FirstNumber=strnum.numbers, SecondNumber=0)  # -> Equality, Inequality
# Comfort Percentage
dispatch = Dispatch(List=strnum.numbers, DispatchPattern=equals.Equality)  # -> ListA, ListB
lng = ListLength(List=dispatch.ListA)
lng_2 = ListLength(List=strnum.numbers)
division = Division(A=lng, B=lng_2)
panel_9 = Panel(division)

geo = Geometry(Tree({0}: [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], {1}: [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], {2}: [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]))
