# Grasshopper definition zhao_xiaoyu.gh (Grasshopper 0.9.76)
# plug-ins: Python Interpreter

# ---- group: ceiling
brep = Brep(<brep referenced from the Rhino model>)

# ---- group: wall
brep_2 = Brep([<brep referenced from the Rhino model> x3])

# ---- group: floor
brep_3 = Brep(<brep referenced from the Rhino model>)

# ---- group: window
brep_4 = Brep(<brep referenced from the Rhino model>)

# ----
createhbsrfs = Honeybee_createHBSrfs(geometry=brep, srfType="3")  # -> readMe, simplify(HBSurface); plug-in component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
createhbsrfs_2 = Honeybee_createHBSrfs(geometry=brep_2, srfType="0")  # -> readMe, simplify(HBSurface); plug-in component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
createhbsrfs_3 = Honeybee_createHBSrfs(geometry=brep_3, srfType="2")  # -> readMe, simplify(HBSurface); plug-in component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
createhbsrfs_4 = Honeybee_createHBSrfs(geometry=brep_4, srfType="0")  # -> readMe, simplify(HBSurface); plug-in component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
brep_5 = Brep(<brep referenced from the Rhino model>)
addhbglz = Honeybee_addHBGlz(HBObj=createhbsrfs_4.HBSurface, childSurfaces=flatten(brep_5))  # -> HBObjWGLZ; plug-in component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

honeybee = Honeybee_Honeybee()  # -> Vviiiiiiiiiizzz; plug-in component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
ladybug = Ladybug_Ladybug()  # -> Vviiiiiiiiiizzz; plug-in component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
bldgprograms = Honeybee_bldgPrograms({"Office": 0, "Retail": 1, "MidriseApartment": 2, "PrimarySchool": 3, "SecondarySchool": 4, "SmallHotel": 5, "LargeHotel": 6, "Hospital": 7, "Outpatient": 8, "Warehouse": 9, "SuperMarket": 10, "FullServiceRestaurant": 11, "QuickServiceRestaurant": 12}, selected="MidriseApartment")
panel = Panel(honeybee)
listzoneprograms = Honeybee_ListZonePrograms(bldgProgram=bldgprograms)  # -> MidriseApartmentZonePrograms; plug-in component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
brep_6 = Brep([createhbsrfs_2.HBSurface, createhbsrfs.HBSurface, createhbsrfs_3.HBSurface, addhbglz])
item = ListItem(List=listzoneprograms, Index="0", Wrap=True)
box = DomainBox(Base=PlaneXY(0, 0, 0), X="4", Y="4.9", Z="3")
createhbzones = Honeybee_createHBZones(name="my room", zoneProgram=item, HBSurfaces=flatten(brep_6), isConditioned=Toggle(False))  # -> readMe, HBZone; plug-in component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
glzparamlist = Honeybee_GlazingParametersList(northGlzParam=0, westGlzParam=0, southGlzParam="0.5", eastGlzParam=0)  # -> glzParamList; plug-in component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
createhbsrfs_5 = Honeybee_createHBSrfs(geometry=box)  # -> readMe, simplify(HBSurface); plug-in component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
glazingcreator = Honeybee_GlazingBasedOnRatio(glzRatio=glzparamlist, runIt=Toggle(True))  # -> readMe, HBObjWGLZ; plug-in component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
wires = BrepWireframe(Brep=createhbzones.HBZone, Density=-1)
panel_2 = Panel(glazingcreator.HBObjWGLZ)
genhbzonetestpts = Honeybee_GenerateZoneTestPoints(HBZone=createhbzones.HBZone, gridSize="0.5", distBaseSrf="0.8", moveTestMesh=True)  # -> readMe, simplify(testPoints), simplify(ptsVectors), simplify(facesArea), simplify(mesh); plug-in component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
path = FilePath("K:\Dropbox\Philadelphia_weather_files\USA_PA_Philadelphia.Intl.AP.724080_TMY3.epw")
annualdaylightsimulation = Honeybee_AnnualDaylightSimulation(
    epwWeatherFile=path,
    testPoints=genhbzonetestpts.testPoints,
    ptsVectors=genhbzonetestpts.ptsVectors,
    testMesh=genhbzonetestpts.mesh)  # -> analysisRecipe; plug-in component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
brep_7 = Brep([<brep referenced from the Rhino model> x4])
createhbsrfs_6 = Honeybee_createHBSrfs(geometry=brep_7)  # -> readMe, simplify(HBSurface); plug-in component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
toggle = BooleanToggle(True)
wires_2 = BrepWireframe(Brep=createhbsrfs_6.HBSurface, Density=-1)
rundaylightanalysis = Honeybee_RunDaylightSimulation(
    HBObjects=flatten([createhbzones.HBZone, createhbsrfs_6.HBSurface]),
    analysisRecipe=annualdaylightsimulation,
    writeRad=toggle,
    runRad=toggle,
    overwriteResults=True)  # -> readMe, analysisType, resultsUnit, results, testPts, annual_analysis_files, radGeoFile, studyFolder, done; plug-in component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
readannualresultsi = Honeybee_ReadAnnualResultI(
    illFilesAddress=rundaylightanalysis.annual_analysis_files,
    testPoints=simplify(rundaylightanalysis.testPts),
    DLAIllumThresholds=300,
    runIt=Toggle(True))  # -> DLA, UDLI_Less_100, UDLI_100_2000, UDLI_More_2000, CDA, sDA, annualProfiles, htmReport; plug-in component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
setepnatvent = Honeybee_SetEPAirFlow(minIndoorTempForNatVent="24", maxIndoorTempForNatVent="27", minOutdoorTempForNatVent="22", maxOutdoorTempForNatVent="30")  # -> readMe, simplify(HBZones); plug-in component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
setepzoneschedules = Honeybee_SetEnergyPlusZoneSchedules(HBZones=createhbzones.HBZone, lightingSchedules=readannualresultsi.annualProfiles)  # -> schedules, simplify(HBZones); plug-in component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
recolormesh = Ladybug_RecolorMesh(
    analysisResult=readannualresultsi.DLA,
    inputMesh=genhbzonetestpts.mesh,
    analysisTitle="Annual Daylighting Analysis",
    legendTitle="%")  # -> readMe, newMesh, newLegend, legendBasePt, meshColors, legendColors; plug-in component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
path_2 = FilePath("K:\Dropbox\Philadelphia_weather_files\USA_PA_Philadelphia.Intl.AP.724080_TMY3.stat")
panel_3 = Panel(setepzoneschedules.HBZones)
importstat = Ladybug_ImportStat(statFile=path_2)  # -> readMe, ashraeClimateZone, koppenClimateZone, port, heatingDesignTemp, coolingDesignTemp, port_2, extremeHotWeek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; plug-in component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
epoutput = Honeybee_GenerateEPOutput(zoneGainsAndLosses="False", zoneComfortMetrics=Toggle(True), surfaceTempAnalysis="False")  # -> report, flatten(simulationOutputs); plug-in component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
brep_8 = Brep([<brep referenced from the Rhino model> x4])
hb_epcontextsrf = HoneybeeEPContextSurfaces(shdSurfaces=flatten(brep_8))  # -> HBContext; inputs shdSurfaces: list of Brep, justBoundingBox: Boolean
# ---------- hb_epcontextsrf: Python ----------
"""
prepare shading/context geometries

    Args:
        northVectorOrRotation: A vector that shows North or a number that shows
                               the rotation of the North from the Y axis
        bldgMasses: List of closed Breps as thermal zones.
    Returns:
        report: ...
        thermalZones: Thermal zone's geometries for visualiza
"""

ghenv.Component.Name = 'Honeybee EP context Surfaces'
ghenv.Component.NickName = 'HB_EPContextSrf'
ghenv.Component.Message = 'VER 0.0.62\nJUL_28_2017'
ghenv.Component.IconDisplayMode = ghenv.Component.IconDisplayMode.application
ghenv.Component.Category = "Honeybee"
ghenv.Component.SubCategory = "10 | Energy | Energy"
#compatibleHBVersion = VER 0.0.57\nNOV_04_2016
#compatibleLBVersion = VER 0.0.59\nFEB_01_2015
ghenv.Component.AdditionalHelpFromDocStrings = "2"

import rhinoscriptsyntax as rs
import Rhino as rc
import scriptcontext as sc
import os
import System
import Grasshopper.Kernel as gh
import uuid

tolerance = sc.doc.ModelAbsoluteTolerance
import math


def main(shdSurfaces, EPTransSchedule, meshingSettings, justBoundingBox):
    
    # import the classes
    if sc.sticky.has_key('honeybee_release'):

        try:
            if not sc.sticky['honeybee_release'].isCompatible(ghenv.Component): return -1
            if sc.sticky['honeybee_release'].isInputMissing(ghenv.Component): return -1
        except:
            warning = "You need a newer version of Honeybee to use this compoent." + \
            " Use updateHoneybee component to update userObjects.\n" + \
            "If you have already updated userObjects drag Honeybee_Honeybee component " + \
            "into canvas and try again."
            w = gh.GH_RuntimeMessageLevel.Warning
            ghenv.Component.AddRuntimeMessage(w, warning)
            return -1
        
        # don't customize this part
        hb_EPSrf = sc.sticky["honeybee_EPSurface"]
        hb_EPSHDSurface = sc.sticky["honeybee_EPShdSurface"]
        hb_RADMaterialAUX = sc.sticky["honeybee_RADMaterialAUX"]
        hb_EPObjectsAux = sc.sticky["honeybee_EPObjectsAUX"]()
        HBScheduleList = sc.sticky["honeybee_ScheduleLib"].keys()

        ########################################################################
        #----------------------------------------------------------------------#
        shdBreps = []
        # create bounding box of shading geometries
        if justBoundingBox:
            for brep in shdSurfaces:
                if brep.Faces.Count>1 or not brep.Faces[0].IsPlanar(sc.doc.ModelAbsoluteTolerance):
                    shdBreps.append(brep.GetBoundingBox(True).ToBrep())
                else:
                    shdBreps.append(brep)
        else:
            shdBreps = shdSurfaces
        
        shadingClasses = []
        shadingMeshPreview = []
        
        if meshingSettings == None:
            mp = rc.Geometry.MeshingParameters.Minimal
            mp.SimplePlanes = True
        else:
            mp = meshingSettings
        
        def getRadMaterialName(radMaterial):
            nameStr = radMaterial.split(" ")[2]
            name =  nameStr.split("\n")[0]
            return name
        
        for brepCount, brep in enumerate(shdBreps):
            if brep != None:
                isPlanar = True
                # check planarity
                for face in brep.Faces:
                    if not face.IsPlanar(tolerance):
                        isPlanar = False
                        break
                
                shadingBreps = []
                if not isPlanar:
                    meshArray = rc.Geometry.Mesh.CreateFromBrep(brep, mp)
                    for mesh in meshArray:
                        for meshFace in range(mesh.Faces.Count):
                            vertices = list(mesh.Faces.GetFaceVertices(meshFace))[1:]
                            vertices = vertices + [sc.doc.ModelAbsoluteTolerance]
                            # create the brep from mesh
                            shdBrep = rc.Geometry.Brep.CreateFromCornerPoints(*vertices)
                            shadingBreps.append(shdBrep)
                else:
                    for face in brep.Faces:
                        shadingBreps.append(face.DuplicateFace(False))
                
                for faceCount, shdBrep in enumerate(shadingBreps):
                        thisShading = hb_EPSHDSurface(shdBrep, 1000*brepCount + faceCount, 'shdSrf_' + `brepCount` + '_' + `faceCount` + "_" + str(uuid.uuid4()))
                        
                        # add transmittance schedule if any
                        if EPTransSchedule!=None:
                            schedule= EPTransSchedule.upper()
                            if schedule!=None and not schedule.lower().endswith(".csv") and schedule not in HBScheduleList:
                                msg = "Cannot find " + schedule + " in Honeybee schedule library."
                                print msg
                                ghenv.Component.AddRuntimeMessage(gh.GH_RuntimeMessageLevel.Warning, msg)
                                return -1
                            elif schedule!=None and schedule.lower().endswith(".csv"):
                                # check if csv file is existed
                                if not os.path.isfile(schedule):
                                    msg = "Cannot find the shchedule file: " + schedule
                                    print msg
                                    ghenv.Component.AddRuntimeMessage(gh.GH_RuntimeMessageLevel.Warning, msg)
                                    return -1
                            
                            thisShading.TransmittanceSCH = schedule
                        
                        # add the Rad Material if any
                        if RADMaterial!=None:
                            # if it is just the name of the material make sure it is already defined
                            if len(RADMaterial.split(" ")) == 1:
                                # if the material is not in the library add it to the library
                                if not hb_RADMaterialAUX.isMatrialExistInLibrary(RADMaterial):
                                    warningMsg = "Can't find " + RADMaterial + " in RAD Material Library.\n" + \
                                                "Add the material to the library and try again."
                                    ghenv.Component.AddRuntimeMessage(gh.GH_RuntimeMessageLevel.Warning, warningMsg)
                                    return
                                
                                try:
                                    thisShading.setRADMaterial(RADMaterial)
                                except Exception, e:
                                    print e
                                    warningMsg = "You are using an old version of Honeybee_Honeybee! Update your files and try again."
                                    print warningMsg
                                    ghenv.Component.AddRuntimeMessage(gh.GH_RuntimeMessageLevel.Warning, warningMsg)
                                    return
                                
                                addedToLib = True
                            else:
                                
                                # try to add the material to the library
                                addedToLib, thisShading.RadMaterial = hb_RADMaterialAUX.analyseRadMaterials(RADMaterial, True)
                                
                            if addedToLib==False:
                                warningMsg = "Failed to add " + RADMaterial + " to the Library."
                                ghenv.Component.AddRuntimeMessage(gh.GH_RuntimeMessageLevel.Warning, warningMsg)
                                return
                        
                        # add shading to the list
                        shadingClasses.append(thisShading)
                
        # add to the hive
        hb_hive = sc.sticky["honeybee_Hive"]()
        HBContext  = hb_hive.addToHoneybeeHive(shadingClasses, ghenv.Component)
        return HBContext
        ################################################################################################
    else:
        print "You should first let Honeybee to fly..."
        w = gh.GH_RuntimeMessageLevel.Warning
        ghenv.Component.AddRuntimeMessage(w, "You should first let Honeybee to fly...")
        return -1
        

if _shdSurfaces and _shdSurfaces[0]!=None:
    # add cleaning function
    result= main(_shdSurfaces, EPTransSchedule_, meshingSettings_, justBoundingBox_)
    
    if result != -1: HBContext = result
# ---------- end hb_epcontextsrf ----------
toggle_2 = BooleanToggle(True)
importepw = Ladybug_ImportEpw(epwFile=path)  # -> readMe, latitude, location, dryBulbTemperature, dewPointTemperature, relativeHumidity, windSpeed, windDirection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; plug-in component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
runenergysimulation = Honeybee_RunEnergySimulation(
    epwFile=path,
    HBZones=flatten(setepzoneschedules.HBZones),
    HBContext=flatten(hb_epcontextsrf),
    writeIdf=toggle_2,
    runEnergyPlus=toggle_2)  # -> report, idfFileAddress, htmlReport, resultFileAddress; plug-in component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
readepresult = Honeybee_ReadEPResult(resultFileAddress=runenergysimulation.resultFileAddress)  # -> port, port_2, port_3, port_4, electricLight, electricEquip, port_5, port_6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; plug-in component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
adaptivecomfortcalculator = Ladybug_AdaptiveComfortCalculator(prevailingOutdoorTemp=importepw.dryBulbTemperature, runIt=Toggle(True))  # -> readMe, port, comfortableOrNot, conditionOfPerson, degreesFromTarget, port_2, targetTemperature, upperTemperatureBound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; plug-in component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
data = Data(["key:location/dataType/units/frequency/startsAt/endsAt", "Philadelphia International Ap PA USA TMY3 ", "Electric Lighting Energy for MY_ROOM", "kWh", "Monthly", null x2, 5.277294624, 5.261049653, 4.232975107, 2.559743171, 1.770701758, 4.601968003, 2.255730156, 2.993715947, 4.116939605, 4.188881616, 3.671363278, 3.035488728])
data_2 = Data(["key:location/dataType/units/frequency/startsAt/endsAt", "Philadelphia International Ap PA USA TMY3 ", "Electric Lighting Energy for MY_ROOM", "kWh", "Monthly", null x2, 2.719872163, 1.510782234, 1.666269806, 0.4919905278, 0.7403065017, 0.08586627136, 0.3272201152, 0.4757455575, 1.334408271, 0.944528985, 1.415633122, 2.204674535])
base_condition = Panel(data)
glazing_ratio_80 = Panel(data_2)
data_3 = Data(["key:location/dataType/units/frequency/startsAt/endsAt", "Philadelphia International Ap PA USA TMY3 ", "Electric Lighting Energy for MY_ROOM", "kWh", "Monthly", null x2, 9.313009378, 8.670172697, 9.986015288, 8.593589266, 9.874621206, 8.730511158, 9.384951389, 8.031977437, 9.092541924, 6.001356155, 7.927545486, 6.676682776])
data_4 = Data(["key:location/dataType/units/frequency/startsAt/endsAt", "Philadelphia International Ap PA USA TMY3 ", "Electric Lighting Energy for MY_ROOM", "kWh", "Monthly", null x2, 3.829171561, 2.717551453, 2.483159739, 2.281257966, 1.058243777, 1.037357386, 0.3898792862, 1.779984598, 1.329766851, 1.828719509, 2.631685182, 3.200259141])
_3dchart = Ladybug_3DChart(inputData=flatten(adaptivecomfortcalculator.conditionOfPerson))  # -> readMe, graphMesh, graphCurves, legend, legendBasePts, title, titleBasePts, dataPts, conditionalHOY; plug-in component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
adding_4_layer_shading = Panel(data_3)
ration_50 = Panel(data_4)
