# Grasshopper definition chan_lokyunpriscilla.gh (Grasshopper 0.9.70)
# plug-ins: Python Interpreter

callfromepconstrlibrary = Honeybee_CallFromEPConstructionLibrary()  # -> ThermMaterials, EPMaterials, EPWindowMaterials, EPConstructions; plug-in component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
panel = Panel(callfromepconstrlibrary.EPConstructions)
ladybug = Ladybug_Ladybug()  # -> Vviiiiiiiiiizzz; plug-in component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
# Climate analysis
honeybee = Honeybee_Honeybee()  # -> Vviiiiiiiiiizzz; plug-in component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

# ---- group: climate analysis + visualization
path = FilePath("C:\DIVA\WeatherData\USA_Philadelphia.International.Ap_HadCM3-A2-2050.epw")
importepw = Ladybug_ImportEpw(epwFile=path)  # -> readMe, latitude, location, dryBulbTemperature, dewPointTemperature, relativeHumidity, windSpeed, windDirection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; plug-in component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
solaradjusttemperature = Ladybug_OutdoorSolarTemperatureAdjustor(
    location=importepw.location,
    cumSkyMtxOrDirNormRad=importepw.directNormalRadiation,
    diffuseHorizRad=importepw.diffuseHorizontalRadiation,
    baseTemperature=importepw.dryBulbTemperature,
    horizInfraredRad=importepw.horizontalInfraredRadiation,
    runIt=Toggle(True))  # -> readMe, port, effectiveRadiantField, MRTDelta, solarAdjustedMRT, port_2, mannequinMesh, port_3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; plug-in component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
outdoorcomfortcalculator = Ladybug_OutdoorComfortCalculator(
    dryBulbTemperature=importepw.dryBulbTemperature,
    meanRadiantTemperature=solaradjusttemperature.solarAdjustedMRT,
    windSpeed_tenMeters=importepw.windSpeed,
    relativeHumidity=importepw.relativeHumidity,
    runIt=Toggle(True))  # -> readMe, port, universalThermalClimateIndex, comfortableOrNot, thermalStress, conditionOfPerson, port_2, percentOfTimeComfortable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; plug-in component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
legendpar = Ladybug_LegendParameters(numSegments="7")  # -> legendPar; plug-in component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
windrose = Ladybug_WindRose(
    hourlyWindDirection=importepw.windDirection,
    hourlyWindSpeed=importepw.windSpeed,
    annualHourlyData=flatten(outdoorcomfortcalculator.conditionOfPerson),
    centerPoint="0,-700,0",
    legendPar=legendpar,
    bakeIt=Toggle(False),
    runIt=Toggle(False))  # -> readMe, calmRoseMesh, windRoseMesh, windRoseCrvs, windRoseCenPts, legend, legendBasePts, title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; disabled; plug-in component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
_3dchart = Ladybug_3DChart(inputData=flatten(importepw.dryBulbTemperature), xScale="0.25", zScale="0", bakeIt=Toggle(False))  # -> readMe, graphMesh, graphCurves, legend, legendBasePts, title, titleBasePts, dataPts, conditionalHOY; disabled; plug-in component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
_3dchart_2 = Ladybug_3DChart(
    inputData=flatten(outdoorcomfortcalculator.conditionOfPerson),
    basePoint="0,-400,0",
    xScale="0.25",
    zScale="0",
    legendPar=legendpar,
    bakeIt=Toggle(False))  # -> readMe, graphMesh, graphCurves, legend, legendBasePts, title, titleBasePts, dataPts, conditionalHOY; disabled; plug-in component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

# ---- group: custom activity schedule
lb_schedule = GenePool(
    Decimals=1,
    Maximum=1,
    Minimum=0,
    Value=[0, 0, 0, 0, 0, 0.2, 1, 0.8, 0.5, 0.1, 0.1, 0.1, 0.1, 0.1, 0.1, 0.1, 0.1, 0.1, 0.5, 0.8, 1, 1, 1, 0])
lb_schedule_2 = GenePool(
    Decimals=1,
    Maximum=1,
    Minimum=0,
    Value=[0, 0, 0, 0, 0, 0, 0, 0, 1, 0.8, 0.8, 0.5, 0.1, 0.1, 0.5, 0.5, 0.5, 0.8, 0.5, 0.1, 0.1, 0.8, 1, 0])
lb_schedule_3 = GenePool(Decimals=1, Maximum=1, Minimum=0, Value=[0, 0, 0, 0, 0, 0, 0, 0, 0, 0, 0, 0, 0, 0, 0, 0, 0, 0, 0, 0, 0, 0, 0, 0])
annualschedule = Honeybee_AnnualSchedule(
    sun=lb_schedule_2,
    mon=lb_schedule,
    tue=lb_schedule,
    wed=lb_schedule,
    thu=lb_schedule,
    fri=lb_schedule,
    sat=lb_schedule_2,
    scheduleName="school_week_activity",
    runIt=Toggle(True))  # -> readMe, port, schedule, port_2, weekSched, schedIDFText; plug-in component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
constantschedule = Honeybee_ConstantSchedule(value=lb_schedule_3, scheduleName="break_activity")  # -> readMe, schedule, weekSched, schedIDFText; plug-in component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
analysisperiod = Ladybug_AnalysisPeriod(fromMonth=Slider(1, range=1..12), toMonth=Slider(1, range=1..12), toDay=Slider(10, range=1..31))  # -> readMe, analysisPeriod; plug-in component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
analysisperiod_2 = Ladybug_AnalysisPeriod(fromMonth=Slider(12, range=1..12), fromDay=Slider(22, range=1..31), toMonth=Slider(12, range=1..12))  # -> readMe, analysisPeriod; plug-in component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
analysisperiod_3 = Ladybug_AnalysisPeriod(
    fromMonth=Slider(5, range=1..12),
    fromDay=Slider(16, range=1..31),
    toMonth=Slider(8, range=1..12),
    toDay=Slider(29, range=1..31))  # -> readMe, analysisPeriod; plug-in component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
honeybee_seasonalschedule = Honeybee_SeasonalSchedule(
    scheduleName="dorm_year_activity",
    baseWeekSched=annualschedule.weekSched,
    seasonWeekSched1=constantschedule.weekSched,
    analysisPeriod1=analysisperiod_3.analysisPeriod,
    seasonWeekSched2=constantschedule.weekSched,
    analysisPeriod2=analysisperiod_2.analysisPeriod,
    seasonWeekSched3=constantschedule.weekSched,
    analysisPeriod3=analysisperiod.analysisPeriod)  # -> readMe, schedule, schedIDFText; plug-in component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

# ---- group: Custom occupancy schedule
lb_schedule_4 = GenePool(
    Decimals=1,
    Maximum=1,
    Minimum=0,
    Value=[1, 1, 1, 1, 1, 1, 1, 1, 1, 0.8, 0.5, 0.5, 0.1, 0.1, 0.5, 0.5, 0.5, 0.5, 0.5, 0.1, 0.1, 0.8, 1, 1])
lb_schedule_5 = GenePool(
    Decimals=1,
    Maximum=1,
    Minimum=0,
    Value=[1, 1, 1, 1, 1, 1, 1, 0.8, 0.5, 0.1, 0.1, 0.1, 0.1, 0.1, 0.1, 0.1, 0.1, 0.1, 0.5, 0.8, 1, 1, 1, 1])
lb_schedule_6 = GenePool(Decimals=1, Maximum=1, Minimum=0, Value=[0, 0, 0, 0, 0, 0, 0, 0, 0, 0, 0, 0, 0, 0, 0, 0, 0, 0, 0, 0, 0, 0, 0, 0])
annualschedule_2 = Honeybee_AnnualSchedule(
    sun=lb_schedule_4,
    mon=lb_schedule_5,
    tue=lb_schedule_5,
    wed=lb_schedule_5,
    thu=lb_schedule_5,
    fri=lb_schedule_5,
    sat=lb_schedule_4,
    scheduleName="school_week",
    runIt=Toggle(True))  # -> readMe, port, schedule, port_2, weekSched, schedIDFText; plug-in component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
constantschedule_2 = Honeybee_ConstantSchedule(value=lb_schedule_6, scheduleName="break")  # -> readMe, schedule, weekSched, schedIDFText; plug-in component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
analysisperiod_4 = Ladybug_AnalysisPeriod(fromMonth=Slider(1, range=1..12), toMonth=Slider(1, range=1..12), toDay=Slider(10, range=1..31))  # -> readMe, analysisPeriod; plug-in component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
analysisperiod_5 = Ladybug_AnalysisPeriod(fromMonth=Slider(12, range=1..12), fromDay=Slider(22, range=1..31), toMonth=Slider(12, range=1..12))  # -> readMe, analysisPeriod; plug-in component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
analysisperiod_6 = Ladybug_AnalysisPeriod(
    fromMonth=Slider(5, range=1..12),
    fromDay=Slider(16, range=1..31),
    toMonth=Slider(8, range=1..12),
    toDay=Slider(29, range=1..31))  # -> readMe, analysisPeriod; plug-in component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
honeybee_seasonalschedule_2 = Honeybee_SeasonalSchedule(
    scheduleName="dorm_year",
    baseWeekSched=annualschedule_2.weekSched,
    seasonWeekSched1=constantschedule_2.weekSched,
    analysisPeriod1=analysisperiod_6.analysisPeriod,
    seasonWeekSched2=constantschedule_2.weekSched,
    analysisPeriod2=analysisperiod_5.analysisPeriod,
    seasonWeekSched3=constantschedule_2.weekSched,
    analysisPeriod3=analysisperiod_4.analysisPeriod)  # -> readMe, schedule, schedIDFText; plug-in component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

# ---- group: Geometry setup / Floor
brep = Brep(<brep referenced from the Rhino model>)

# ---- group: Geometry setup / Ceiling
brep_2 = Brep(<brep referenced from the Rhino model>)

# ---- group: Geometry setup / exterior wall
# Base case analysis
brep_3 = Brep(<brep referenced from the Rhino model>)

# ---- group: Geometry setup / interior wall
brep_4 = Brep([<brep referenced from the Rhino model> x7])

# ---- group: Geometry setup / glazing
brep_5 = Brep([<brep referenced from the Rhino model> x3])

# ---- group: Geometry setup
bldgprograms = Honeybee_bldgPrograms({"Office": 0, "Retail": 1, "MidriseApartment": 2, "PrimarySchool": 3, "SecondarySchool": 4, "SmallHotel": 5, "LargeHotel": 6, "Hospital": 7, "Outpatient": 8, "Warehouse": 9, "SuperMarket": 10, "FullServiceRestaurant": 11, "QuickServiceRestaurant": 12}, selected="MidriseApartment")
item = ListItem(List=callfromepconstrlibrary.EPConstructions, Index="387", Wrap=True)
item_2 = ListItem(List=callfromepconstrlibrary.EPConstructions, Index="431", Wrap=True)
item_3 = ListItem(List=callfromepconstrlibrary.EPConstructions, Index="433", Wrap=True)
item_4 = ListItem(List=callfromepconstrlibrary.EPConstructions, Index="429", Wrap=True)
createhbsrfs = Honeybee_createHBSrfs(geometry=brep, srfType="2", EPConstruction=item_2)  # -> readMe, simplify(HBSurface); plug-in component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
createhbsrfs_2 = Honeybee_createHBSrfs(geometry=brep_4, EPConstruction=item_3)  # -> readMe, simplify(HBSurface); plug-in component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
createhbsrfs_3 = Honeybee_createHBSrfs(geometry=brep_2, srfType="3", EPConstruction=item_4)  # -> readMe, simplify(HBSurface); plug-in component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
createhbsrfs_4 = Honeybee_createHBSrfs(geometry=brep_3, EPConstruction=item)  # -> readMe, simplify(HBSurface); plug-in component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
radglassmaterial = Honeybee_RadianceGlassMaterial(materialName="glass_80", RTransmittance="0.8", GTransmittance="0.8", BTransmittance="0.8", refractiveIndex=1.52)  # -> avrgTrans, RADMaterial; plug-in component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
item_5 = ListItem(List=callfromepconstrlibrary.EPConstructions, Index="417", Wrap=True)
listzoneprograms = Honeybee_ListZonePrograms(bldgProgram=bldgprograms)  # -> MidriseApartmentZonePrograms; plug-in component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
addhbglz = Honeybee_addHBGlz(
    HBObj=createhbsrfs_4.HBSurface,
    childSurfaces=flatten(brep_5),
    EPConstructions=item_5,
    RADMaterials=radglassmaterial.RADMaterial)  # -> HBObjWGLZ; plug-in component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
makeadiabatic = Honeybee_MakeAdiabatic(HBSrfs=[createhbsrfs_2.HBSurface, createhbsrfs_3.HBSurface, createhbsrfs.HBSurface])  # -> HBSrfs; plug-in component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
item_6 = ListItem(List=listzoneprograms, Index=0, Wrap=True)
createhbzones = Honeybee_createHBZones(name="sansom_room", zoneProgram=item_6, HBSurfaces=flatten([addhbglz, makeadiabatic]), isConditioned=Toggle(False))  # -> readMe, HBZone; plug-in component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

# ----
path_2 = FilePath("C:\DIVA\WeatherData\USA_Philadelphia.International.Ap_HadCM3-A2-2050.epw")

# ---- group: Daylight simulation
genhbzonetestpts = Honeybee_GenerateZoneTestPoints(HBZone=createhbzones.HBZone, gridSize="0.3048", distBaseSrf="0.762")  # -> readMe, simplify(testPoints), simplify(ptsVectors), simplify(facesArea), simplify(mesh); plug-in component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
radparameters = Honeybee_RADParameters(quality=0, ab="3", ad="1024", as="256")  # -> readMe, radParameters; plug-in component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
annualdaylightsimulation = Honeybee_AnnualDaylightSimulation(
    epwWeatherFile=path_2,
    testPoints=genhbzonetestpts.testPoints,
    ptsVectors=genhbzonetestpts.ptsVectors,
    radParameters=radparameters.radParameters)  # -> analysisRecipe; plug-in component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
panel_2 = Panel(radparameters.readMe)
toggle = BooleanToggle(False)
rundaylightanalysis = Honeybee_RunDaylightSimulation(
    HBObjects=flatten(createhbzones.HBZone),
    analysisRecipe=annualdaylightsimulation,
    writeRad=toggle,
    runRad=toggle,
    radFileName="753_final")  # -> readMe, analysisType, resultsUnit, results, testPts, resultFiles, radGeoFile, studyFolder, done; plug-in component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

# ---- group: Point-in-time daylight analysis
genclimatebasedsky = Honeybee_GenerateClimateBasedSky(weatherFile=path_2, month=Slider(6, range=1..12), day=Slider(21, range=1..31), hour=Slider(15, range=1..24))  # -> radiationValues, skyFilePath; plug-in component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
gridbasedsimulation = Honeybee_GridBasedSimulation(
    skyFile=genclimatebasedsky.skyFilePath,
    testPoints=genhbzonetestpts.testPoints,
    ptsVectors=genhbzonetestpts.ptsVectors,
    simulationType=0)  # -> analysisRecipe; plug-in component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
recolormesh = Ladybug_RecolorMesh(
    analysisResult=rundaylightanalysis.results,
    inputMesh=genhbzonetestpts.mesh,
    analysisTitle="Illuminance",
    legendTitle="lux",
    bakeIt=Toggle(False))  # -> readMe, newMesh, newLegend, legendBasePt, meshColors, legendColors; plug-in component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

# ---- group: Interpret daylight simulation results
panel_3 = Panel("""100
101
102
112
113
114""")
item_7 = ListItem(List=genhbzonetestpts.testPoints, Index=panel_3, Wrap=True)
lightingcontrol = Honeybee_LightingControlRecipe(
    controlType=1,
    sensorPoints=item_7,
    lightingPower=250,
    lightingSetpoint=300,
    ballastLossFactor=20,
    standbyPower=3,
    delayTime=5)  # -> lightingControlGroup; plug-in component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
readannualresultsi = Honeybee_ReadAnnualResultI(
    illFilesAddress=rundaylightanalysis.resultFiles,
    testPoints=simplify(rundaylightanalysis.testPts),
    occupancyFiles=honeybee_seasonalschedule_2.schedule,
    DLAIllumThresholds=300,
    lightingControlGroups=lightingcontrol,
    runIt=Toggle(True))  # -> DLA, UDLI_Less_100, UDLI_100_2000, UDLI_More_2000, CDA, sDA, annualProfiles, htmReport; plug-in component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
gradientlibrary = Ladybug_GradientLibrary(gradIndex="0")  # -> customColors; plug-in component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
rev = ReverseList(List=gradientlibrary)
legendpar_2 = Ladybug_LegendParameters(lowBound="0", customColors=flatten(gradientlibrary))  # -> legendPar; plug-in component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
recolormesh_2 = Ladybug_RecolorMesh(
    analysisResult=readannualresultsi.UDLI_More_2000,
    inputMesh=genhbzonetestpts.mesh,
    legendPar=legendpar_2,
    analysisTitle="UDI>2000lux",
    legendTitle="%",
    bakeIt=Toggle(False))  # -> readMe, newMesh, newLegend, legendBasePt, meshColors, legendColors; plug-in component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

# ---- group: Lighting schedule & visualization
readannualresultsi_2 = Honeybee_ReadAnnualResultI(
    illFilesAddress=rundaylightanalysis.resultFiles,
    testPoints=simplify(rundaylightanalysis.testPts),
    occupancyFiles=honeybee_seasonalschedule.schedule,
    DLAIllumThresholds=300,
    lightingControlGroups=lightingcontrol,
    runIt=Toggle(True))  # -> DLA, UDLI_Less_100, UDLI_100_2000, UDLI_More_2000, CDA, sDA, annualProfiles, htmReport; plug-in component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
convertepschvalues = Honeybee_ConvertEnergyPlusScheduleToValues(schName=readannualresultsi_2.annualProfiles)  # -> values, holidays; plug-in component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

# ---- group: Schedule visualization
convertepschvalues_2 = Honeybee_ConvertEnergyPlusScheduleToValues(schName=[honeybee_seasonalschedule_2.schedule, honeybee_seasonalschedule.schedule])  # -> values, holidays; plug-in component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
_3dchart_3 = Ladybug_3DChart(
    inputData=flatten([convertepschvalues_2.values, convertepschvalues.values]),
    xScale="0.25",
    zScale="0",
    bakeIt=Toggle(False))  # -> readMe, graphMesh, graphCurves, legend, legendBasePts, title, titleBasePts, dataPts, conditionalHOY; plug-in component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

# ---- group: Energy simulation
setepzoneloads = Honeybee_SetEnergyPlusZoneLoads(
    HBZones=createhbzones.HBZone,
    equipmentLoadPerArea="2",
    infiltrationRatePerArea="0.0003",
    lightingDensityPerArea="9",
    numOfPeoplePerArea="0.061")  # -> loads, HBZones; plug-in component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
toggle_2 = BooleanToggle(True)
epoutput = Honeybee_GenerateEPOutput(
    zoneEnergyUse=toggle_2,
    zoneGainsAndLosses=toggle_2,
    zoneComfortMetrics="False",
    surfaceTempAnalysis="False",
    surfaceEnergyAnalysis=toggle_2)  # -> report, flatten(simulationOutputs); plug-in component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
setepzoneschedules = Honeybee_SetEnergyPlusZoneSchedules(
    HBZones=setepzoneloads.HBZones,
    occupancySchedules=honeybee_seasonalschedule_2.schedule,
    occupancyActivitySchs=honeybee_seasonalschedule.schedule,
    lightingSchedules=readannualresultsi_2.annualProfiles)  # -> schedules, simplify(HBZones); plug-in component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
toggle_3 = BooleanToggle(False)
runenergysimulation = Honeybee_RunEnergySimulation(
    epwFile=path_2,
    HBZones=flatten(setepzoneschedules.HBZones),
    simulationOutputs=flatten(epoutput.simulationOutputs),
    writeIdf=toggle_3,
    runEnergyPlus=toggle_3,
    idfFileName="753_final")  # -> report, idfFileAddress, htmlReport, resultFileAddress; plug-in component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

# ---- group: Interpret energy simulation results
readepsrfresult = Honeybee_ReadEPSurfaceResult(resultFileAddress=runenergysimulation.resultFileAddress)  # -> surfaceIndoorTemp, surfaceOutdoorTemp, surfaceEnergyFlow, opaqueEnergyFlow, glazEnergyFlow, windowTotalSolarEnergy, windowBeamEnergy, windowDiffEnergy, windowTransmissivity, otherSurfaceData; plug-in component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
readepresult = Honeybee_ReadEPResult(resultFileAddress=runenergysimulation.resultFileAddress)  # -> totalThermalLoad, thermalLoadBalance, cooling, heating, electricLight, electricEquip, fanElectric, pumpElectric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; plug-in component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
importepw_2 = Ladybug_ImportEpw(epwFile=path_2)  # -> readMe, latitude, location, dryBulbTemperature, dewPointTemperature, relativeHumidity, windSpeed, windDirection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; plug-in component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
adaptivecomfortcalculator = Ladybug_AdaptiveComfortCalculator(
    dryBulbTemperature=readepresult.airTemperature,
    meanRadiantTemperature=readepresult.meanRadTemperature,
    prevailingOutdoorTemp=importepw_2.dryBulbTemperature,
    runIt=Toggle(True))  # -> readMe, port, comfortableOrNot, conditionOfPerson, degreesFromTarget, port_2, targetTemperature, upperTemperatureBound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; plug-in component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
energybalance = Honeybee_ConstructEnergyBalance(
    HBZones=flatten(createhbzones.HBZone),
    cooling=readepresult.cooling,
    heating=readepresult.heating,
    electricLight=readepresult.electricLight,
    electricEquip=readepresult.electricEquip,
    fanElectric=readepresult.fanElectric,
    peopleGains=readepresult.peopleGains,
    totalSolarGain=readepresult.totalSolarGain,
    infiltrationEnergy=readepresult.infiltrationEnergy,
    mechVentilationEnergy=readepresult.mechVentilationEnergy,
    natVentEnergy=readepresult.natVentEnergy,
    surfaceEnergyFlow=readepsrfresult.surfaceEnergyFlow)  # -> readMe, port, flrNormEnergyBal, flrNormBalWStorage, port_2, modelEnergyBalance, energyBalWithStorage; plug-in component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
legendpar_3 = Ladybug_LegendParameters(numSegments="3")  # -> legendPar; plug-in component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
baseline = Panel([adaptivecomfortcalculator.percentOfTimeComfortable, adaptivecomfortcalculator.percentHotCold])
_3dchart_4 = Ladybug_3DChart(
    inputData=flatten(adaptivecomfortcalculator.conditionOfPerson),
    xScale="0.25",
    zScale="0",
    legendPar=legendpar_3,
    bakeIt=Toggle(False))  # -> readMe, graphMesh, graphCurves, legend, legendBasePts, title, titleBasePts, dataPts, conditionalHOY; plug-in component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
baseline_2 = Panel("""17.853881
38.47032
43.675799""")
gradientlibrary_2 = Ladybug_GradientLibrary(gradIndex="19")  # -> customColors; plug-in component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
selectandaveragedata = Ladybug_AverageData(annualHourlyData=energybalance.energyBalWithStorage, totalOrAverage=Toggle(True))  # -> readMe, selHourlyData, totaledDaily, totaledMonthly, totMonthlyPerHour, totAnalysisPeriod; plug-in component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
legendpar_4 = Ladybug_LegendParameters(customColors=flatten(gradientlibrary_2))  # -> legendPar; plug-in component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
barchart = Ladybug_MonthlyBarChart(
    inputData=flatten(selectandaveragedata.totaledMonthly),
    stackValues=Toggle(True),
    altTitle="Dorm Room Energy",
    altYAxisTitle="Energy (kWh)",
    legendPar=legendpar_4,
    bakeIt=Toggle(False))  # -> readMe, dataMesh, dataCurves, dataCrvColors, graphAxes, graphLabels, title, titleBasePt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; plug-in component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
preview = CustomPreview(Geometry=barchart.graphAxes, Shader=ColourSwatch(SwatchColor=RGB(0, 0, 0)))

# ----
data = Data(Tree({0}: [1.543673495], {0;0}: ["1IN Stucco", "8IN CONCRETE HW RefBldg", "Mass Wall Insulation R-7.23 IP", "1/2IN Gypsum"]))
data_2 = Data(Tree({0;0}: ["1IN Stucco", "8IN CONCRETE HW RefBldg", "Mass Wall Insulation R-7.23 IP", "1/2IN Gypsum"], {0;0;0}: ["Material", "Smooth", "0.0253", "0.691799999999999", "1858", "836.999999999999", "0.9", "0.92", "0.92"], {0;0;1}: ["Material", "Rough", "0.2032", "1.311", "2240", "836.800000000001", "0.9", "0.7", "0.7"], {0;0;2}: ["Material", "MediumRough", "0.0623638212208", "0.049", "265", "836.800000000001", "0.9", "0.7", "0.7"], {0;0;3}: ["Material", "Smooth", "0.0127", "0.16", "784.9", "830.000000000001", "0.9", "0.4", "0.4"]))
data_3 = Data(["1IN Stucco", "8IN CONCRETE HW RefBldg", "Mass Wall Insulation R-7.23 IP", "1/2IN Gypsum", 0.03657126337, 0.1549961861, 1.272731045, 0.079375])

# ---- group: Custom EPconstruction
uip2usi = Ladybug_uIP2uSI(U_IP="0.17")  # -> U_SI; plug-in component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
# Design analysis
epopaquemat = Honeybee_EnergyPlusOpaqueMaterial(
    name="1IN Stucco",
    roughness="Smooth",
    thickness="0.0253",
    conductivity="0.691799999999999",
    density="1858",
    specificHeat="836.999999999999",
    thermAbsp="0.9",
    solAbsp="0.92",
    visAbsp="0.92")  # -> EPMaterial; plug-in component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
epwindowmat = Honeybee_EnergyPlusWindowMaterial(name="TriplePaneGlazingSystem", U_Value=uip2usi, SHGC="0.24", VT="0.39")  # -> EPMaterial; plug-in component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
epopaquemat_2 = Honeybee_EnergyPlusOpaqueMaterial(
    name="8IN CONCRETE HW RefBldg",
    roughness="Rough",
    thickness="0.2032",
    conductivity="1.311",
    density="2240",
    specificHeat="836.800000000001",
    thermAbsp="0.9",
    solAbsp="0.7",
    visAbsp="0.7")  # -> EPMaterial; plug-in component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
epopaquemat_3 = Honeybee_EnergyPlusOpaqueMaterial(
    name="Mass Wall Insulation",
    roughness="MediumRough",
    thickness="0.08",
    conductivity="0.03",
    density="265",
    specificHeat="836.800000000001",
    thermAbsp="0.9",
    solAbsp="0.7",
    visAbsp="0.7")  # -> EPMaterial; plug-in component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
epopaquemat_4 = Honeybee_EnergyPlusOpaqueMaterial(
    name="1/2IN Gypsum",
    roughness="Smooth",
    thickness="0.0127",
    conductivity="0.16",
    density="784.9",
    specificHeat="830.000000000001",
    thermAbsp="0.9",
    solAbsp="0.4",
    visAbsp="0.4")  # -> EPMaterial; plug-in component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
epconstruction = Honeybee_EnergyPlusConstruction(name="High_R-value_Mass", layer_1=epopaquemat, layer_2=epopaquemat_2, layer_3=epopaquemat_3, layer_4=epopaquemat_4)  # -> EPConstruction; plug-in component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
epconstruction_2 = Honeybee_EnergyPlusConstruction(name="Window_0.97/0.24/0.39", layer_1=epwindowmat)  # -> EPConstruction; plug-in component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

# ----
ashrae_90_1_2010_materials = Panel(data_2)
ashrae_90_1_2010_ext_wall_construction_r = Panel(data)  # "ASHRAE 90.1-2010 ext wall construction, R-value"
ashrae_90_1_2010_material_r_values = Panel(data_3)
callfromepconstrlibrary_2 = Honeybee_CallFromEPConstructionLibrary()  # -> ThermMaterials, EPMaterials, EPWindowMaterials, EPConstructions; plug-in component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
panel_4 = Panel(callfromepconstrlibrary_2.EPConstructions)
data_4 = Data(Tree({0;0}: ["1IN Stucco", "8IN CONCRETE HW RefBldg", "Mass NonRes Wall Insulation-0.99", "1/2IN Gypsum"], {0;0;0}: ["Material", "Smooth", "0.0253", "0.691799999999999", "1858", "836.999999999999", "0.9", "0.92", "0.92"], {0;0;1}: ["Material", "Rough", "0.2032", "1.311", "2240", "836.800000000001", "0.9", "0.7", "0.7"], {0;0;2}: ["Material", "MediumRough", "0.0278705087521745", "0.049", "265", "836.800000000001", "0.9", "0.7", "0.7"], {0;0;3}: ["Material", "Smooth", "0.0127", "0.16", "784.9", "830.000000000001", "0.9", "0.4", "0.4"]))
data_5 = Data(["1IN Stucco", "8IN CONCRETE HW RefBldg", "Mass NonRes Wall Insulation-0.99", "1/2IN Gypsum", 0.03657126337, 0.1549961861, 0.5687858929, 0.079375])
data_6 = Data(Tree({0}: [0.8397283424], {0;0}: ["1IN Stucco", "8IN CONCRETE HW RefBldg", "Mass NonRes Wall Insulation-0.99", "1/2IN Gypsum"]))
baseline_material_r_values = Panel(data_5)
baseline_ext_wall_construction_r_value = Panel(data_6)
baseline_materials = Panel(data_4)
data_7 = Data(Tree({0;0}: ["Fixed Window 3.12/0.40/0.31"], {0;0;0}: ["WindowMaterial:SimpleGlazingSystem", "3.12304483761242", "0.4", "0.31"]))
data_8 = Data(Tree({0}: [3.123044838], {0;0}: ["Fixed Window 3.12/0.40/0.31"]))

# ---- group: custom activity schedule
lb_schedule_7 = GenePool(
    Decimals=1,
    Maximum=1,
    Minimum=0,
    Value=[0, 0, 0, 0, 0, 0.2, 1, 0.8, 0.5, 0.1, 0.1, 0.1, 0.1, 0.1, 0.1, 0.1, 0.1, 0.1, 0.5, 0.8, 1, 1, 1, 0])
lb_schedule_8 = GenePool(
    Decimals=1,
    Maximum=1,
    Minimum=0,
    Value=[0, 0, 0, 0, 0, 0, 0, 0, 1, 0.8, 0.8, 0.5, 0.1, 0.1, 0.5, 0.5, 0.5, 0.8, 0.5, 0.1, 0.1, 0.8, 1, 0])
lb_schedule_9 = GenePool(Decimals=1, Maximum=1, Minimum=0, Value=[0, 0, 0, 0, 0, 0, 0, 0, 0, 0, 0, 0, 0, 0, 0, 0, 0, 0, 0, 0, 0, 0, 0, 0])
annualschedule_3 = Honeybee_AnnualSchedule(
    sun=lb_schedule_8,
    mon=lb_schedule_7,
    tue=lb_schedule_7,
    wed=lb_schedule_7,
    thu=lb_schedule_7,
    fri=lb_schedule_7,
    sat=lb_schedule_8,
    scheduleName="school_week_activity",
    runIt=Toggle(True))  # -> readMe, port, schedule, port_2, weekSched, schedIDFText; plug-in component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
constantschedule_3 = Honeybee_ConstantSchedule(value=lb_schedule_9, scheduleName="break_activity")  # -> readMe, schedule, weekSched, schedIDFText; plug-in component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
analysisperiod_7 = Ladybug_AnalysisPeriod(fromMonth=Slider(1, range=1..12), toMonth=Slider(1, range=1..12), toDay=Slider(10, range=1..31))  # -> readMe, analysisPeriod; plug-in component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
analysisperiod_8 = Ladybug_AnalysisPeriod(fromMonth=Slider(12, range=1..12), fromDay=Slider(22, range=1..31), toMonth=Slider(12, range=1..12))  # -> readMe, analysisPeriod; plug-in component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
analysisperiod_9 = Ladybug_AnalysisPeriod(
    fromMonth=Slider(5, range=1..12),
    fromDay=Slider(16, range=1..31),
    toMonth=Slider(8, range=1..12),
    toDay=Slider(29, range=1..31))  # -> readMe, analysisPeriod; plug-in component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
honeybee_seasonalschedule_3 = Honeybee_SeasonalSchedule(
    scheduleName="dorm_year_activity",
    baseWeekSched=annualschedule_3.weekSched,
    seasonWeekSched1=constantschedule_3.weekSched,
    analysisPeriod1=analysisperiod_9.analysisPeriod,
    seasonWeekSched2=constantschedule_3.weekSched,
    analysisPeriod2=analysisperiod_8.analysisPeriod,
    seasonWeekSched3=constantschedule_3.weekSched,
    analysisPeriod3=analysisperiod_7.analysisPeriod)  # -> readMe, schedule, schedIDFText; plug-in component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

# ---- group: Custom occupancy schedule
lb_schedule_10 = GenePool(
    Decimals=1,
    Maximum=1,
    Minimum=0,
    Value=[1, 1, 1, 1, 1, 1, 1, 1, 1, 0.8, 0.5, 0.5, 0.1, 0.1, 0.5, 0.5, 0.5, 0.5, 0.5, 0.1, 0.1, 0.8, 1, 1])
lb_schedule_11 = GenePool(
    Decimals=1,
    Maximum=1,
    Minimum=0,
    Value=[1, 1, 1, 1, 1, 1, 1, 0.8, 0.5, 0.1, 0.1, 0.1, 0.1, 0.1, 0.1, 0.1, 0.1, 0.1, 0.5, 0.8, 1, 1, 1, 1])
lb_schedule_12 = GenePool(Decimals=1, Maximum=1, Minimum=0, Value=[0, 0, 0, 0, 0, 0, 0, 0, 0, 0, 0, 0, 0, 0, 0, 0, 0, 0, 0, 0, 0, 0, 0, 0])
annualschedule_4 = Honeybee_AnnualSchedule(
    sun=lb_schedule_10,
    mon=lb_schedule_11,
    tue=lb_schedule_11,
    wed=lb_schedule_11,
    thu=lb_schedule_11,
    fri=lb_schedule_11,
    sat=lb_schedule_10,
    scheduleName="school_week",
    runIt=Toggle(True))  # -> readMe, port, schedule, port_2, weekSched, schedIDFText; plug-in component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
constantschedule_4 = Honeybee_ConstantSchedule(value=lb_schedule_12, scheduleName="break")  # -> readMe, schedule, weekSched, schedIDFText; plug-in component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
analysisperiod_10 = Ladybug_AnalysisPeriod(fromMonth=Slider(1, range=1..12), toMonth=Slider(1, range=1..12), toDay=Slider(10, range=1..31))  # -> readMe, analysisPeriod; plug-in component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
analysisperiod_11 = Ladybug_AnalysisPeriod(fromMonth=Slider(12, range=1..12), fromDay=Slider(22, range=1..31), toMonth=Slider(12, range=1..12))  # -> readMe, analysisPeriod; plug-in component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
analysisperiod_12 = Ladybug_AnalysisPeriod(
    fromMonth=Slider(5, range=1..12),
    fromDay=Slider(16, range=1..31),
    toMonth=Slider(8, range=1..12),
    toDay=Slider(29, range=1..31))  # -> readMe, analysisPeriod; plug-in component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
honeybee_seasonalschedule_4 = Honeybee_SeasonalSchedule(
    scheduleName="dorm_year",
    baseWeekSched=annualschedule_4.weekSched,
    seasonWeekSched1=constantschedule_4.weekSched,
    analysisPeriod1=analysisperiod_12.analysisPeriod,
    seasonWeekSched2=constantschedule_4.weekSched,
    analysisPeriod2=analysisperiod_11.analysisPeriod,
    seasonWeekSched3=constantschedule_4.weekSched,
    analysisPeriod3=analysisperiod_10.analysisPeriod)  # -> readMe, schedule, schedIDFText; plug-in component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

# ----
ashrae_90_1_2010_window_materials = Panel(data_7)
ashrae_90_1_2010_window_construction_u_v = Panel(data_8)  # "ASHRAE 90.1-2010 window construction, U-value"

# ---- group: Geometry setup / Shading
brep_6 = Brep([<brep referenced from the Rhino model> x8])

# ---- group: Geometry setup / Ceiling
brep_7 = Brep(<brep referenced from the Rhino model>)

# ---- group: Geometry setup / exterior wall
brep_8 = Brep(<brep referenced from the Rhino model>)

# ---- group: Geometry setup / interior wall
brep_9 = Brep([<brep referenced from the Rhino model> x7])

# ---- group: Geometry setup / Floor
brep_10 = Brep(<brep referenced from the Rhino model>)

# ----
data_9 = Data(Tree({0;0}: ["Fixed Window 5.84/0.54/0.38"], {0;0;0}: ["WindowMaterial:SimpleGlazingSystem", "5.84000000000002", "0.54", "0.38"]))
data_10 = Data(Tree({0}: [5.84], {0;0}: ["Fixed Window 5.84/0.54/0.38"]))
baseline_window_materials = Panel(data_9)
baseline_window_construction_u_value = Panel(data_10)

# ---- group: Geometry setup / glazing
brep_11 = Brep([<brep referenced from the Rhino model> x12])

# ---- group: Geometry setup
radopaquematerial = Honeybee_RadianceOpaqueMaterial(materialName="Floor_50", RReflectance="0.5", GReflectance="0.5", BReflectance="0.5", roughness=0.05, specularity=0)  # -> avrgRef, RADMaterial; plug-in component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
radopaquematerial_2 = Honeybee_RadianceOpaqueMaterial(materialName="Wall_80", RReflectance="0.8", GReflectance="0.8", BReflectance="0.8", roughness=0.05, specularity=0)  # -> avrgRef, RADMaterial; plug-in component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
radopaquematerial_3 = Honeybee_RadianceOpaqueMaterial(materialName="Ceiling_70", RReflectance="0.7", GReflectance="0.7", BReflectance="0.7", roughness=0.05, specularity=0)  # -> avrgRef, RADMaterial; plug-in component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
bldgprograms_2 = Honeybee_bldgPrograms({"Office": 0, "Retail": 1, "MidriseApartment": 2, "PrimarySchool": 3, "SecondarySchool": 4, "SmallHotel": 5, "LargeHotel": 6, "Hospital": 7, "Outpatient": 8, "Warehouse": 9, "SuperMarket": 10, "FullServiceRestaurant": 11, "QuickServiceRestaurant": 12}, selected="MidriseApartment")
item_8 = ListItem(List=callfromepconstrlibrary_2.EPConstructions, Index="429", Wrap=True)
item_9 = ListItem(List=callfromepconstrlibrary_2.EPConstructions, Index="433", Wrap=True)
item_10 = ListItem(List=callfromepconstrlibrary_2.EPConstructions, Index="431", Wrap=True)
createhbsrfs_5 = Honeybee_createHBSrfs(geometry=brep_7, srfType="3", EPConstruction=item_8, RADMaterial=radopaquematerial_3.RADMaterial)  # -> readMe, simplify(HBSurface); plug-in component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
createhbsrfs_6 = Honeybee_createHBSrfs(geometry=brep_9, EPConstruction=item_9, RADMaterial=radopaquematerial_2.RADMaterial)  # -> readMe, simplify(HBSurface); plug-in component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
createhbsrfs_7 = Honeybee_createHBSrfs(geometry=brep_10, srfType="2", EPConstruction=item_10, RADMaterial=radopaquematerial.RADMaterial)  # -> readMe, simplify(HBSurface); plug-in component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
createhbsrfs_8 = Honeybee_createHBSrfs(geometry=brep_8, EPConstruction=epconstruction, RADMaterial=radopaquematerial_2.RADMaterial)  # -> readMe, simplify(HBSurface); plug-in component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
hb_epcontextsrf = HoneybeeEPContextSurfaces(shdSurfaces=flatten(brep_6))  # -> HBContext; inputs shdSurfaces: list of Brep, justBoundingBox: Boolean
# ---------- hb_epcontextsrf: Python ----------
"""
prepare shading/context geometries

    Args:
        northVectorOrRotation: A vector that shows North or a number that shows
                               the rotation of the North from the Y axis
        bldgMasses: List of closed Breps as thermal zones.
    Returns:
        report: ...
        thermalZones: Thermal zone's geometries for visualiza
"""

ghenv.Component.Name = 'Honeybee EP context Surfaces'
ghenv.Component.NickName = 'HB_EPContextSrf'
ghenv.Component.Message = 'VER 0.0.62\nJUL_28_2017'
ghenv.Component.IconDisplayMode = ghenv.Component.IconDisplayMode.application
ghenv.Component.Category = "Honeybee"
ghenv.Component.SubCategory = "10 | Energy | Energy"
#compatibleHBVersion = VER 0.0.57\nNOV_04_2016
#compatibleLBVersion = VER 0.0.59\nFEB_01_2015
ghenv.Component.AdditionalHelpFromDocStrings = "2"

import rhinoscriptsyntax as rs
import Rhino as rc
import scriptcontext as sc
import os
import System
import Grasshopper.Kernel as gh
import uuid

tolerance = sc.doc.ModelAbsoluteTolerance
import math


def main(shdSurfaces, EPTransSchedule, meshingSettings, justBoundingBox):
    
    # import the classes
    if sc.sticky.has_key('honeybee_release'):

        try:
            if not sc.sticky['honeybee_release'].isCompatible(ghenv.Component): return -1
            if sc.sticky['honeybee_release'].isInputMissing(ghenv.Component): return -1
        except:
            warning = "You need a newer version of Honeybee to use this compoent." + \
            " Use updateHoneybee component to update userObjects.\n" + \
            "If you have already updated userObjects drag Honeybee_Honeybee component " + \
            "into canvas and try again."
            w = gh.GH_RuntimeMessageLevel.Warning
            ghenv.Component.AddRuntimeMessage(w, warning)
            return -1
        
        # don't customize this part
        hb_EPSrf = sc.sticky["honeybee_EPSurface"]
        hb_EPSHDSurface = sc.sticky["honeybee_EPShdSurface"]
        hb_RADMaterialAUX = sc.sticky["honeybee_RADMaterialAUX"]
        hb_EPObjectsAux = sc.sticky["honeybee_EPObjectsAUX"]()
        HBScheduleList = sc.sticky["honeybee_ScheduleLib"].keys()

        ########################################################################
        #----------------------------------------------------------------------#
        shdBreps = []
        # create bounding box of shading geometries
        if justBoundingBox:
            for brep in shdSurfaces:
                if brep.Faces.Count>1 or not brep.Faces[0].IsPlanar(sc.doc.ModelAbsoluteTolerance):
                    shdBreps.append(brep.GetBoundingBox(True).ToBrep())
                else:
                    shdBreps.append(brep)
        else:
            shdBreps = shdSurfaces
        
        shadingClasses = []
        shadingMeshPreview = []
        
        if meshingSettings == None:
            mp = rc.Geometry.MeshingParameters.Minimal
            mp.SimplePlanes = True
        else:
            mp = meshingSettings
        
        def getRadMaterialName(radMaterial):
            nameStr = radMaterial.split(" ")[2]
            name =  nameStr.split("\n")[0]
            return name
        
        for brepCount, brep in enumerate(shdBreps):
            if brep != None:
                isPlanar = True
                # check planarity
                for face in brep.Faces:
                    if not face.IsPlanar(tolerance):
                        isPlanar = False
                        break
                
                shadingBreps = []
                if not isPlanar:
                    meshArray = rc.Geometry.Mesh.CreateFromBrep(brep, mp)
                    for mesh in meshArray:
                        for meshFace in range(mesh.Faces.Count):
                            vertices = list(mesh.Faces.GetFaceVertices(meshFace))[1:]
                            vertices = vertices + [sc.doc.ModelAbsoluteTolerance]
                            # create the brep from mesh
                            shdBrep = rc.Geometry.Brep.CreateFromCornerPoints(*vertices)
                            shadingBreps.append(shdBrep)
                else:
                    for face in brep.Faces:
                        shadingBreps.append(face.DuplicateFace(False))
                
                for faceCount, shdBrep in enumerate(shadingBreps):
                        thisShading = hb_EPSHDSurface(shdBrep, 1000*brepCount + faceCount, 'shdSrf_' + `brepCount` + '_' + `faceCount` + "_" + str(uuid.uuid4()))
                        
                        # add transmittance schedule if any
                        if EPTransSchedule!=None:
                            schedule= EPTransSchedule.upper()
                            if schedule!=None and not schedule.lower().endswith(".csv") and schedule not in HBScheduleList:
                                msg = "Cannot find " + schedule + " in Honeybee schedule library."
                                print msg
                                ghenv.Component.AddRuntimeMessage(gh.GH_RuntimeMessageLevel.Warning, msg)
                                return -1
                            elif schedule!=None and schedule.lower().endswith(".csv"):
                                # check if csv file is existed
                                if not os.path.isfile(schedule):
                                    msg = "Cannot find the shchedule file: " + schedule
                                    print msg
                                    ghenv.Component.AddRuntimeMessage(gh.GH_RuntimeMessageLevel.Warning, msg)
                                    return -1
                            
                            thisShading.TransmittanceSCH = schedule
                        
                        # add the Rad Material if any
                        if RADMaterial!=None:
                            # if it is just the name of the material make sure it is already defined
                            if len(RADMaterial.split(" ")) == 1:
                                # if the material is not in the library add it to the library
                                if not hb_RADMaterialAUX.isMatrialExistInLibrary(RADMaterial):
                                    warningMsg = "Can't find " + RADMaterial + " in RAD Material Library.\n" + \
                                                "Add the material to the library and try again."
                                    ghenv.Component.AddRuntimeMessage(gh.GH_RuntimeMessageLevel.Warning, warningMsg)
                                    return
                                
                                try:
                                    thisShading.setRADMaterial(RADMaterial)
                                except Exception, e:
                                    print e
                                    warningMsg = "You are using an old version of Honeybee_Honeybee! Update your files and try again."
                                    print warningMsg
                                    ghenv.Component.AddRuntimeMessage(gh.GH_RuntimeMessageLevel.Warning, warningMsg)
                                    return
                                
                                addedToLib = True
                            else:
                                
                                # try to add the material to the library
                                addedToLib, thisShading.RadMaterial = hb_RADMaterialAUX.analyseRadMaterials(RADMaterial, True)
                                
                            if addedToLib==False:
                                warningMsg = "Failed to add " + RADMaterial + " to the Library."
                                ghenv.Component.AddRuntimeMessage(gh.GH_RuntimeMessageLevel.Warning, warningMsg)
                                return
                        
                        # add shading to the list
                        shadingClasses.append(thisShading)
                
        # add to the hive
        hb_hive = sc.sticky["honeybee_Hive"]()
        HBContext  = hb_hive.addToHoneybeeHive(shadingClasses, ghenv.Component)
        return HBContext
        ################################################################################################
    else:
        print "You should first let Honeybee to fly..."
        w = gh.GH_RuntimeMessageLevel.Warning
        ghenv.Component.AddRuntimeMessage(w, "You should first let Honeybee to fly...")
        return -1
        

if _shdSurfaces and _shdSurfaces[0]!=None:
    # add cleaning function
    result= main(_shdSurfaces, EPTransSchedule_, meshingSettings_, justBoundingBox_)
    
    if result != -1: HBContext = result
# ---------- end hb_epcontextsrf ----------
radglassmaterial_2 = Honeybee_RadianceGlassMaterial(materialName="glass_80", RTransmittance="0.8", GTransmittance="0.8", BTransmittance="0.8", refractiveIndex=1.52)  # -> avrgTrans, RADMaterial; plug-in component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
listzoneprograms_2 = Honeybee_ListZonePrograms(bldgProgram=bldgprograms_2)  # -> MidriseApartmentZonePrograms; plug-in component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
addhbglz_2 = Honeybee_addHBGlz(
    HBObj=createhbsrfs_8.HBSurface,
    childSurfaces=flatten(brep_11),
    EPConstructions=epconstruction_2,
    RADMaterials=radglassmaterial_2.RADMaterial)  # -> HBObjWGLZ; plug-in component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
makeadiabatic_2 = Honeybee_MakeAdiabatic(HBSrfs=[createhbsrfs_6.HBSurface, createhbsrfs_5.HBSurface, createhbsrfs_7.HBSurface])  # -> HBSrfs; plug-in component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
item_11 = ListItem(List=listzoneprograms_2, Index=0, Wrap=True)
createhbzones_2 = Honeybee_createHBZones(name="sansom_room", zoneProgram=item_11, HBSurfaces=flatten([addhbglz_2, makeadiabatic_2]), isConditioned=Toggle(False))  # -> readMe, HBZone; plug-in component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

# ----
path_3 = FilePath("C:\DIVA\WeatherData\USA_Philadelphia.International.Ap_HadCM3-A2-2050.epw")

# ---- group: Daylight simulation
genhbzonetestpts_2 = Honeybee_GenerateZoneTestPoints(HBZone=createhbzones_2.HBZone, gridSize="0.3048", distBaseSrf="0.762")  # -> readMe, simplify(testPoints), simplify(ptsVectors), simplify(facesArea), simplify(mesh); plug-in component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
radparameters_2 = Honeybee_RADParameters(quality=0, ab="3", ad="1024", as="256")  # -> readMe, radParameters; plug-in component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
annualdaylightsimulation_2 = Honeybee_AnnualDaylightSimulation(
    epwWeatherFile=path_3,
    testPoints=genhbzonetestpts_2.testPoints,
    ptsVectors=genhbzonetestpts_2.ptsVectors,
    radParameters=radparameters_2.radParameters)  # -> analysisRecipe; plug-in component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
panel_5 = Panel(radparameters_2.readMe)
toggle_4 = BooleanToggle(False)
rundaylightanalysis_2 = Honeybee_RunDaylightSimulation(
    HBObjects=flatten([createhbzones_2.HBZone, hb_epcontextsrf]),
    analysisRecipe=annualdaylightsimulation_2,
    writeRad=toggle_4,
    runRad=toggle_4,
    radFileName="753_final_design")  # -> readMe, analysisType, resultsUnit, results, testPts, resultFiles, radGeoFile, studyFolder, done; plug-in component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

# ---- group: Point-in-time daylight analysis
genclimatebasedsky_2 = Honeybee_GenerateClimateBasedSky(weatherFile=path_3, month=Slider(6, range=1..12), day=Slider(21, range=1..31), hour=Slider(15, range=1..24))  # -> radiationValues, skyFilePath; plug-in component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
gridbasedsimulation_2 = Honeybee_GridBasedSimulation(
    skyFile=genclimatebasedsky_2.skyFilePath,
    testPoints=genhbzonetestpts_2.testPoints,
    ptsVectors=genhbzonetestpts_2.ptsVectors,
    simulationType=0)  # -> analysisRecipe; plug-in component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
recolormesh_3 = Ladybug_RecolorMesh(
    analysisResult=rundaylightanalysis_2.results,
    inputMesh=genhbzonetestpts_2.mesh,
    analysisTitle="Illuminance",
    legendTitle="lux",
    bakeIt=Toggle(False))  # -> readMe, newMesh, newLegend, legendBasePt, meshColors, legendColors; plug-in component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

# ---- group: Interpret daylight simulation results
panel_6 = Panel("""100
101
102
112
113
114""")
item_12 = ListItem(List=genhbzonetestpts_2.testPoints, Index=panel_6, Wrap=True)
lightingcontrol_2 = Honeybee_LightingControlRecipe(
    controlType=1,
    sensorPoints=item_12,
    lightingPower=250,
    lightingSetpoint=300,
    ballastLossFactor=20,
    standbyPower=3,
    delayTime=5)  # -> lightingControlGroup; plug-in component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
readannualresultsi_3 = Honeybee_ReadAnnualResultI(
    illFilesAddress=rundaylightanalysis_2.resultFiles,
    testPoints=simplify(rundaylightanalysis_2.testPts),
    occupancyFiles=honeybee_seasonalschedule_4.schedule,
    DLAIllumThresholds=300,
    lightingControlGroups=lightingcontrol_2,
    runIt=Toggle(True))  # -> DLA, UDLI_Less_100, UDLI_100_2000, UDLI_More_2000, CDA, sDA, annualProfiles, htmReport; plug-in component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
gradientlibrary_3 = Ladybug_GradientLibrary(gradIndex="0")  # -> customColors; plug-in component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
rev_2 = ReverseList(List=gradientlibrary_3)
legendpar_5 = Ladybug_LegendParameters(lowBound="0", customColors=flatten(gradientlibrary_3))  # -> legendPar; plug-in component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
recolormesh_4 = Ladybug_RecolorMesh(
    analysisResult=readannualresultsi_3.UDLI_100_2000,
    inputMesh=genhbzonetestpts_2.mesh,
    legendPar=legendpar_5,
    analysisTitle="UDI 100<2000lux",
    legendTitle="%",
    bakeIt=Toggle(False))  # -> readMe, newMesh, newLegend, legendBasePt, meshColors, legendColors; plug-in component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

# ---- group: Lighting schedule & visualization
readannualresultsi_4 = Honeybee_ReadAnnualResultI(
    illFilesAddress=rundaylightanalysis_2.resultFiles,
    testPoints=simplify(rundaylightanalysis_2.testPts),
    occupancyFiles=honeybee_seasonalschedule_3.schedule,
    DLAIllumThresholds=300,
    lightingControlGroups=lightingcontrol_2,
    runIt=Toggle(True))  # -> DLA, UDLI_Less_100, UDLI_100_2000, UDLI_More_2000, CDA, sDA, annualProfiles, htmReport; plug-in component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
convertepschvalues_3 = Honeybee_ConvertEnergyPlusScheduleToValues(schName=readannualresultsi_4.annualProfiles)  # -> values, holidays; plug-in component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

# ---- group: Energy simulation
setepzoneloads_2 = Honeybee_SetEnergyPlusZoneLoads(
    HBZones=createhbzones_2.HBZone,
    equipmentLoadPerArea="2",
    infiltrationRatePerArea="0.0003",
    lightingDensityPerArea="9",
    numOfPeoplePerArea="0.061")  # -> loads, HBZones; plug-in component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
epoutput_2 = Honeybee_GenerateEPOutput(zoneGainsAndLosses="False", zoneComfortMetrics=Toggle(True), surfaceTempAnalysis="False")  # -> report, flatten(simulationOutputs); plug-in component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
setepzoneschedules_2 = Honeybee_SetEnergyPlusZoneSchedules(
    HBZones=setepzoneloads_2.HBZones,
    occupancySchedules=honeybee_seasonalschedule_4.schedule,
    occupancyActivitySchs=honeybee_seasonalschedule_3.schedule,
    lightingSchedules=readannualresultsi_4.annualProfiles)  # -> schedules, simplify(HBZones); plug-in component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
setepnatvent = Honeybee_SetEPAirFlow(
    HBZones=flatten(setepzoneschedules_2.HBZones),
    naturalVentilationType="1",
    minIndoorTempForNatVent="24",
    minOutdoorTempForNatVent="18",
    maxOutdoorTempForNatVent="28",
    fractionOfGlzAreaOperable="0.33")  # -> readMe, simplify(HBZones); plug-in component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
toggle_5 = BooleanToggle(False)
runenergysimulation_2 = Honeybee_RunEnergySimulation(
    epwFile=path_3,
    HBZones=flatten(setepnatvent.HBZones),
    HBContext=flatten(hb_epcontextsrf),
    simulationOutputs=flatten(epoutput_2.simulationOutputs),
    writeIdf=toggle_5,
    runEnergyPlus=toggle_5,
    idfFileName="753_final_design")  # -> report, idfFileAddress, htmlReport, resultFileAddress; plug-in component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

# ---- group: Interpret energy simulation results
readepresult_2 = Honeybee_ReadEPResult(resultFileAddress=runenergysimulation_2.resultFileAddress)  # -> totalThermalLoad, thermalLoadBalance, cooling, heating, electricLight, electricEquip, fanElectric, pumpElectric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; plug-in component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
importepw_3 = Ladybug_ImportEpw(epwFile=path_3)  # -> readMe, latitude, location, dryBulbTemperature, dewPointTemperature, relativeHumidity, windSpeed, windDirection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; plug-in component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
adaptivecomfortcalculator_2 = Ladybug_AdaptiveComfortCalculator(
    dryBulbTemperature=readepresult_2.airTemperature,
    meanRadiantTemperature=readepresult_2.meanRadTemperature,
    prevailingOutdoorTemp=importepw_3.dryBulbTemperature,
    runIt=Toggle(True))  # -> readMe, port, comfortableOrNot, conditionOfPerson, degreesFromTarget, port_2, targetTemperature, upperTemperatureBound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; plug-in component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
legendpar_6 = Ladybug_LegendParameters(numSegments="3")  # -> legendPar; plug-in component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
design = Panel([adaptivecomfortcalculator_2.percentOfTimeComfortable, adaptivecomfortcalculator_2.percentHotCold])
_3dchart_5 = Ladybug_3DChart(
    inputData=flatten(adaptivecomfortcalculator_2.conditionOfPerson),
    xScale="0.25",
    zScale="0",
    legendPar=legendpar_6,
    bakeIt=Toggle(False))  # -> readMe, graphMesh, graphCurves, legend, legendBasePts, title, titleBasePts, dataPts, conditionalHOY; plug-in component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
data_11 = Data(["19.257991", "46.769406", "33.972603"])
data_12 = Data(["51.860731", "13.915525", "34.223744"])
data_13 = Data(["52.385845", "12.054795", "35.559361"])
improved_epconstruction = Panel(data_11)
increased_daylight = Panel(data_13)
window_airflow = Panel(data_12)

# ----
panel_7 = Panel("13")
