# Grasshopper definition farah_silmi.gh (Grasshopper 0.9.76)
# plug-ins: Python Interpreter, Ironbug

# ---- group: daylight model / Brep floor
floor = Brep(<brep referenced from the Rhino model>)

# ---- group: daylight model / Brep wall
wall = Brep([<brep referenced from the Rhino model> x2])

# ---- group: daylight model / Brep ceiling
ceiling = Brep(<brep referenced from the Rhino model>)

# ---- group: daylight model
shade = Brep([<brep referenced from the Rhino model> x7])
createhbsrfs = Honeybee_createHBSrfs(geometry=wall, srfType=Slider(0, range=0..6))  # -> readMe, simplify(HBSurface); plug-in component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
createhbsrfs_2 = Honeybee_createHBSrfs(geometry=ceiling, srfType=Slider(3, range=0..6))  # -> readMe, simplify(HBSurface); plug-in component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
createhbsrfs_3 = Honeybee_createHBSrfs(geometry=floor, srfType=Slider(2, range=0..6))  # -> readMe, simplify(HBSurface); plug-in component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
createhbsrfs_4 = Honeybee_createHBSrfs(geometry=shade, srfType=Slider(6, range=0..6))  # -> readMe, simplify(HBSurface); disabled; plug-in component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

# ---- group: daylight model / Brep glass
glass = Brep(<brep referenced from the Rhino model>)

# ----
ladybug = Ladybug_Ladybug()  # -> out; plug-in component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
honeybee = Honeybee_Honeybee()  # -> out; plug-in component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

# ---- group: daylight model
radglassmaterial = Honeybee_RadianceGlassMaterial(materialName="glas_60", RTransmittance=".6", GTransmittance=".6", BTransmittance=".6", refractiveIndex=1.52)  # -> avrgTrans, RADMaterial; plug-in component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
createhbsrfs_5 = Honeybee_createHBSrfs(geometry=glass, RADMaterial=radglassmaterial.RADMaterial)  # -> readMe, simplify(HBSurface); plug-in component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

# ----
open_weather_file = Ladybug_OpenEPWWeatherFile(open=Toggle(True))  # -> epwFile; plug-in component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
point = Point(<point referenced from the Rhino model>)
importepw = Ladybug_ImportEpw(epwFile=open_weather_file)  # -> Output, latitude, location, dryBulbTemperature, dewPointTemperature, relativeHumidity, windSpeed, windDirection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; plug-in component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
solaradjusttemperature = Ladybug_OutdoorSolarTemperatureAdjustor(
    location=importepw.location,
    cumSkyMtxOrDirNormRad=importepw.directNormalRadiation,
    diffuseHorizRad=importepw.diffuseHorizontalRadiation,
    baseTemperature=importepw.dryBulbTemperature,
    horizInfraredRad=importepw.horizontalInfraredRadiation,
    bodyPosture="1",
    bodyLocation=point,
    runIt=Toggle(True))  # -> readMe, port, effectiveRadiantField, MRTDelta, solarAdjustedMRT, port_2, mannequinMesh, port_3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; disabled; plug-in component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
brep = Brep([createhbsrfs_5.HBSurface, createhbsrfs.HBSurface, createhbsrfs_2.HBSurface, createhbsrfs_3.HBSurface, createhbsrfs_4.HBSurface])
preview = CustomPreview(
    Geometry=solaradjusttemperature.mannequinMesh,
    Shader={ambient=RGB(0, 0, 0), diffuse=RGB(255, 105, 180), emission=RGB(76, 32, 54), shine=0.5, specular=RGB(255, 255, 255), transparency=0})

# ---- group: daylight model / create sky
panel = Panel("03")
panel_2 = Panel("09")
panel_3 = Panel("21")
genclimatebasedsky = Honeybee_GenerateClimateBasedSky(weatherFile=open_weather_file, month=panel, day=panel_3, hour=panel_2)  # -> radiationValues, skyFilePath; plug-in component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

# ----
wires = BrepWireframe(Brep=brep, Density=-1)
outdoorcomfortcalculator = Ladybug_OutdoorComfortCalculator(
    dryBulbTemperature=importepw.dryBulbTemperature,
    windSpeed_tenMeters=importepw.windSpeed,
    relativeHumidity=importepw.relativeHumidity,
    runIt=Toggle(True))  # -> out, port, universalThermalClimateIndex, comfortableOrNot, thermalStress, conditionOfPerson, port_2, percentOfTimeComfortable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; plug-in component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
outdoorcomfortcalculator_2 = Ladybug_OutdoorComfortCalculator(
    dryBulbTemperature=importepw.dryBulbTemperature,
    meanRadiantTemperature=solaradjusttemperature.solarAdjustedMRT,
    windSpeed_tenMeters=importepw.windSpeed,
    relativeHumidity=importepw.relativeHumidity,
    runIt=Toggle(True))  # -> out, port, universalThermalClimateIndex, comfortableOrNot, thermalStress, conditionOfPerson, port_2, percentOfTimeComfortable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; plug-in component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

# ---- group: daylight model
radparameters = Honeybee_RADParameters(quality=0, ab="3")  # -> readMe, radParameters; plug-in component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

# ---- group: general climatic condition
legendpar = Ladybug_LegendParameters(lowBound="0", highBound="5")  # -> legendPar; disabled; plug-in component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
point_2 = Point(<point referenced from the Rhino model>)
point_3 = Point(<point referenced from the Rhino model>)
point_4 = Point(<point referenced from the Rhino model>)
_3dchart = Ladybug_3DChart(inputData=flatten(importepw.relativeHumidity), basePoint=point_2, xScale=".25", zScale="0")  # -> out, graphMesh, graphCurves, legend, legendBasePts, title, titleBasePts, dataPts, conditionalHOY; disabled; plug-in component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
_3dchart_2 = Ladybug_3DChart(inputData=flatten(importepw.dryBulbTemperature), basePoint=point_4, xScale=".25", zScale="0")  # -> out, graphMesh, graphCurves, legend, legendBasePts, title, titleBasePts, dataPts, conditionalHOY; disabled; plug-in component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
_3dchart_3 = Ladybug_3DChart(inputData=flatten(importepw.windSpeed), basePoint=point_3, xScale=".25", zScale="0", legendPar=legendpar)  # -> out, graphMesh, graphCurves, legend, legendBasePts, title, titleBasePts, dataPts, conditionalHOY; disabled; plug-in component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

# ----
point_5 = Point(<point referenced from the Rhino model>)
doy_hoy = Ladybug_DOY_HOY(days=panel_3, months=panel, hours=panel_2)  # -> HOY, DOY, date; plug-in component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
comfortmannequin = Ladybug_ComfortMannequin(ambientTemperature=outdoorcomfortcalculator_2.out, bodyLocation=point_5)  # -> mannequinMesh, legend, legendBasePt; disabled; plug-in component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

# ---- group: daylight model
legendpar_2 = Ladybug_LegendParameters(lowBound="270", highBound="2030")  # -> legendPar; plug-in component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

# ----
point_6 = Point(<point referenced from the Rhino model>)
_3dchart_4 = Ladybug_3DChart(
    inputData=flatten([outdoorcomfortcalculator.conditionOfPerson, outdoorcomfortcalculator_2.conditionOfPerson]),
    basePoint=point_6,
    xScale=".25",
    zScale="0")  # -> readMe, graphMesh, graphCurves, legend, legendBasePts, title, titleBasePts, dataPts, conditionalHOY; disabled; plug-in component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
panel_4 = Panel(doy_hoy.date)
panel_5 = Panel("""shade 1
Daylight_Condition""")
custom_preview = CustomPreview(
    Geometry=_3dchart_4.graphCurves,
    Shader={ambient=RGB(0, 0, 0), diffuse=RGB(255, 105, 180), emission=RGB(76, 32, 54), shine=0.5, specular=RGB(255, 255, 255), transparency=0})
custom_preview_2 = CustomPreview(
    Geometry=_3dchart_4.title,
    Shader={ambient=RGB(0, 0, 0), diffuse=RGB(255, 105, 180), emission=RGB(76, 32, 54), shine=0.5, specular=RGB(255, 255, 255), transparency=0})
custom_preview_3 = CustomPreview(
    Geometry=_3dchart_4.legend,
    Shader={ambient=RGB(0, 0, 0), diffuse=RGB(255, 105, 180), emission=RGB(76, 32, 54), shine=0.5, specular=RGB(255, 255, 255), transparency=0})
custom_preview_4 = CustomPreview(
    Geometry=_3dchart_4.graphMesh,
    Shader={ambient=RGB(0, 0, 0), diffuse=RGB(255, 105, 180), emission=RGB(76, 32, 54), shine=0.5, specular=RGB(255, 255, 255), transparency=0})
concatenate = Concatenate(FragmentA=panel_5, FragmentB=panel_4)

# ---- group: energy analysis
callfromepconstrlibrary = Honeybee_CallFromEPConstructionLibrary(keywords="extwindow")  # -> ThermMaterials, EPMaterials, EPWindowMaterials, EPConstructions; plug-in component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
decomposeepconstruction = Honeybee_DecomposeEPConstruction(cnstrName=callfromepconstrlibrary.EPConstructions)  # -> materials, comments, UValue_SI, UValue_IP, RValue_SI, RValue_IP; plug-in component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
panel_6 = Panel(callfromepconstrlibrary.EPConstructions)
panel_7 = Panel(decomposeepconstruction.RValue_SI)
sort = SortList(Keys=decomposeepconstruction.RValue_SI, ValuesA=panel_6)  # -> Keys, ValuesA
panel_8 = Panel(sort.ValuesA)
item = ListItem(List=sort.ValuesA, Index="-1", Wrap=True)
panel_9 = Panel(item)
list_item = ListItem(List=panel_8, Index="61", Wrap=True)
panel_10 = Panel(list_item)
shade_w_context = Brep([<brep referenced from the Rhino model> x15])
exterior_wall = Brep(<brep referenced from the Rhino model>)
floor_2 = Brep(<brep referenced from the Rhino model>)
wall_2 = Brep(<brep referenced from the Rhino model>)
ceiling_2 = Brep(<brep referenced from the Rhino model>)
glass_2 = Brep(<brep referenced from the Rhino model>)
createhbsrfs_6 = Honeybee_createHBSrfs(geometry=exterior_wall, srfType="0")  # -> readMe, simplify(HBSurface); plug-in component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
preview_2 = CustomPreview(Geometry=shade_w_context, Shader=ColourSwatch(SwatchColor=RGBA(199, 185, 98, 160)))
preview_3 = CustomPreview(Geometry=glass_2, Shader=ColourSwatch(SwatchColor=RGBA(80, 222, 255, 160)))  # disabled
createhbsrfs_7 = Honeybee_createHBSrfs(geometry=ceiling_2, srfType=Slider(3, range=0..6))  # -> readMe, simplify(HBSurface); plug-in component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
createhbsrfs_8 = Honeybee_createHBSrfs(geometry=wall_2, srfType=Slider(0, range=0..6))  # -> readMe, simplify(HBSurface); plug-in component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
createhbsrfs_9 = Honeybee_createHBSrfs(geometry=floor_2, srfType=Slider(2, range=0..6))  # -> readMe, simplify(HBSurface); plug-in component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
addhbglz = Honeybee_addHBGlz(HBObj=createhbsrfs_6.HBSurface, childSurfaces=flatten(glass_2), EPConstructions=list_item)  # -> simplify(HBObjWGLZ); plug-in component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
bldgprograms = Honeybee_bldgPrograms({"Office": 0, "Retail": 1, "MidriseApartment": 2, "PrimarySchool": 3, "SecondarySchool": 4, "SmallHotel": 5, "LargeHotel": 6, "Hospital": 7, "Outpatient": 8, "Warehouse": 9, "SuperMarket": 10, "FullServiceRestaurant": 11, "QuickServiceRestaurant": 12}, selected="MidriseApartment")
hb_epcontextsrf = HoneybeeEPContextSurfaces(shdSurfaces=flatten(shade_w_context))  # -> HBContext; inputs shdSurfaces: list of GeometryBase, justBoundingBox: Boolean
# ---------- hb_epcontextsrf: Python ----------
"""
prepare shading/context geometries

    Args:
        northVectorOrRotation: A vector that shows North or a number that shows
                               the rotation of the North from the Y axis
        bldgMasses: List of closed Breps as thermal zones.
    Returns:
        report: ...
        thermalZones: Thermal zone's geometries for visualiza
"""

ghenv.Component.Name = 'Honeybee EP context Surfaces'
ghenv.Component.NickName = 'HB_EPContextSrf'
ghenv.Component.Message = 'VER 0.0.60\nNOV_04_2016'
ghenv.Component.IconDisplayMode = ghenv.Component.IconDisplayMode.application
ghenv.Component.Category = "Honeybee"
ghenv.Component.SubCategory = "10 | Energy | Energy"
#compatibleHBVersion = VER 0.0.57\nNOV_04_2016
#compatibleLBVersion = VER 0.0.59\nFEB_01_2015
ghenv.Component.AdditionalHelpFromDocStrings = "2"

import rhinoscriptsyntax as rs
import Rhino as rc
import scriptcontext as sc
import os
import System
import Grasshopper.Kernel as gh
import uuid

tolerance = sc.doc.ModelAbsoluteTolerance
import math


def main(shdSurfaces, EPTransSchedule, meshingSettings, justBoundingBox):
    
    # import the classes
    if sc.sticky.has_key('honeybee_release'):

        try:
            if not sc.sticky['honeybee_release'].isCompatible(ghenv.Component): return -1
            if sc.sticky['honeybee_release'].isInputMissing(ghenv.Component): return -1
        except:
            warning = "You need a newer version of Honeybee to use this compoent." + \
            " Use updateHoneybee component to update userObjects.\n" + \
            "If you have already updated userObjects drag Honeybee_Honeybee component " + \
            "into canvas and try again."
            w = gh.GH_RuntimeMessageLevel.Warning
            ghenv.Component.AddRuntimeMessage(w, warning)
            return -1
        
        # don't customize this part
        hb_EPSrf = sc.sticky["honeybee_EPSurface"]
        hb_EPSHDSurface = sc.sticky["honeybee_EPShdSurface"]
        hb_RADMaterialAUX = sc.sticky["honeybee_RADMaterialAUX"]
        hb_EPObjectsAux = sc.sticky["honeybee_EPObjectsAUX"]()
        HBScheduleList = sc.sticky["honeybee_ScheduleLib"].keys()

        ########################################################################
        #----------------------------------------------------------------------#
        shdBreps = []
        # create bounding box of shading geometries
        if justBoundingBox:
            for brep in shdSurfaces:
                if brep.Faces.Count>1 or not brep.Faces[0].IsPlanar(sc.doc.ModelAbsoluteTolerance):
                    shdBreps.append(brep.GetBoundingBox(True).ToBrep())
                else:
                    shdBreps.append(brep)
        else:
            shdBreps = shdSurfaces
        
        shadingClasses = []
        shadingMeshPreview = []
        
        if meshingSettings == None:
            mp = rc.Geometry.MeshingParameters.Minimal
            mp.SimplePlanes = True
        else:
            mp = meshingSettings
        
        def getRadMaterialName(radMaterial):
            nameStr = radMaterial.split(" ")[2]
            name =  nameStr.split("\n")[0]
            return name
        
        for brepCount, brep in enumerate(shdBreps):
            if brep != None:
                isPlanar = True
                # check planarity
                for face in brep.Faces:
                    if not face.IsPlanar(tolerance):
                        isPlanar = False
                        break
                
                shadingBreps = []
                if not isPlanar:
                    meshArray = rc.Geometry.Mesh.CreateFromBrep(brep, mp)
                    for mesh in meshArray:
                        for meshFace in range(mesh.Faces.Count):
                            vertices = list(mesh.Faces.GetFaceVertices(meshFace))[1:]
                            vertices = vertices + [sc.doc.ModelAbsoluteTolerance]
                            # create the brep from mesh
                            shdBrep = rc.Geometry.Brep.CreateFromCornerPoints(*vertices)
                            shadingBreps.append(shdBrep)
                else:
                    for face in brep.Faces:
                        shadingBreps.append(face.DuplicateFace(False))
                
                for faceCount, shdBrep in enumerate(shadingBreps):
                        thisShading = hb_EPSHDSurface(shdBrep, 1000*brepCount + faceCount, 'shdSrf_' + `brepCount` + '_' + `faceCount` + "_" + str(uuid.uuid4()))
                        
                        # add transmittance schedule if any
                        if EPTransSchedule!=None:
                            schedule= EPTransSchedule.upper()
                            if schedule!=None and not schedule.lower().endswith(".csv") and schedule not in HBScheduleList:
                                msg = "Cannot find " + schedule + " in Honeybee schedule library."
                                print msg
                                ghenv.Component.AddRuntimeMessage(gh.GH_RuntimeMessageLevel.Warning, msg)
                                return -1
                            elif schedule!=None and schedule.lower().endswith(".csv"):
                                # check if csv file is existed
                                if not os.path.isfile(schedule):
                                    msg = "Cannot find the shchedule file: " + schedule
                                    print msg
                                    ghenv.Component.AddRuntimeMessage(gh.GH_RuntimeMessageLevel.Warning, msg)
                                    return -1
                            
                            thisShading.TransmittanceSCH = schedule
                        
                        # add the Rad Material if any
                        if RADMaterial!=None:
                            # if it is just the name of the material make sure it is already defined
                            if len(RADMaterial.split(" ")) == 1:
                                # if the material is not in the library add it to the library
                                if not hb_RADMaterialAUX.isMatrialExistInLibrary(RADMaterial):
                                    warningMsg = "Can't find " + RADMaterial + " in RAD Material Library.\n" + \
                                                "Add the material to the library and try again."
                                    ghenv.Component.AddRuntimeMessage(gh.GH_RuntimeMessageLevel.Warning, warningMsg)
                                    return
                                
                                try:
                                    thisShading.setRADMaterial(RADMaterial)
                                except Exception, e:
                                    print e
                                    warningMsg = "You are using an old version of Honeybee_Honeybee! Update your files and try again."
                                    print warningMsg
                                    ghenv.Component.AddRuntimeMessage(gh.GH_RuntimeMessageLevel.Warning, warningMsg)
                                    return
                                
                                addedToLib = True
                            else:
                                
                                # try to add the material to the library
                                addedToLib, thisShading.RadMaterial = hb_RADMaterialAUX.analyseRadMaterials(RADMaterial, True)
                                
                            if addedToLib==False:
                                warningMsg = "Failed to add " + RADMaterial + " to the Library."
                                ghenv.Component.AddRuntimeMessage(gh.GH_RuntimeMessageLevel.Warning, warningMsg)
                                return
                        
                        # add shading to the list
                        shadingClasses.append(thisShading)
                
        # add to the hive
        hb_hive = sc.sticky["honeybee_Hive"]()
        HBContext  = hb_hive.addToHoneybeeHive(shadingClasses, ghenv.Component)
        return HBContext
        ################################################################################################
    else:
        print "You should first let Honeybee to fly..."
        w = gh.GH_RuntimeMessageLevel.Warning
        ghenv.Component.AddRuntimeMessage(w, "You should first let Honeybee to fly...")
        return -1
        

if _shdSurfaces and _shdSurfaces[0]!=None:
    # add cleaning function
    result= main(_shdSurfaces, EPTransSchedule_, meshingSettings_, justBoundingBox_)
    
    if result != -1: HBContext = result
# ---------- end hb_epcontextsrf ----------
listzoneprograms = Honeybee_ListZonePrograms(bldgProgram=bldgprograms)  # -> MidriseApartmentZonePrograms; plug-in component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
makeadiabatic = Honeybee_MakeAdiabatic(HBSrfs=flatten([createhbsrfs_7.HBSurface, createhbsrfs_8.HBSurface, createhbsrfs_9.HBSurface]))  # -> HBSrfs; plug-in component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
item_2 = ListItem(List=listzoneprograms, Index=0, Wrap=True)
panel_11 = Panel(item_2)
epoutput = Honeybee_GenerateEPOutput(zoneGainsAndLosses="False", zoneComfortMetrics=Toggle(True), surfaceTempAnalysis="False")  # -> report, flatten(simulationOutputs); plug-in component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
createhbzones = Honeybee_createHBZones(name="room", zoneProgram=panel_11, HBSurfaces=flatten([makeadiabatic, addhbglz]), isConditioned=Toggle(False))  # -> out, HBZone; plug-in component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
setepnatvent = Honeybee_SetEPAirFlow(
    HBZones=flatten(createhbzones.HBZone),
    naturalVentilationType="1",
    minIndoorTempForNatVent="20",
    maxIndoorTempForNatVent="40",
    minOutdoorTempForNatVent="18",
    maxOutdoorTempForNatVent="38")  # -> readMe, simplify(HBZones); plug-in component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
panel_12 = Panel(epoutput.simulationOutputs)
setepzoneloads = Honeybee_SetEnergyPlusZoneLoads(
    HBZones=setepnatvent.HBZones,
    equipmentLoadPerArea="2",
    infiltrationRatePerArea=".0003",
    lightingDensityPerArea="3",
    numOfPeoplePerArea=".056",
    ventilationPerArea=".0002",
    ventilationPerPerson=".001")  # -> loads, HBZones; plug-in component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
bldgprograms_2 = Honeybee_bldgPrograms({"Office": 0, "Retail": 1, "MidriseApartment": 2, "PrimarySchool": 3, "SecondarySchool": 4, "SmallHotel": 5, "LargeHotel": 6, "Hospital": 7, "Outpatient": 8, "Warehouse": 9, "SuperMarket": 10, "FullServiceRestaurant": 11, "QuickServiceRestaurant": 12}, selected="MidriseApartment")
listzoneprograms_2 = Honeybee_ListZonePrograms(bldgProgram=bldgprograms_2)  # -> MidriseApartmentZonePrograms; plug-in component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
item_3 = ListItem(List=listzoneprograms_2, Index=0, Wrap=True)
panel_13 = Panel(item_3)
createhbzones_2 = Honeybee_createHBZones(name="test_room", zoneProgram=item_3, isConditioned=True)  # -> readMe, HBZone; plug-in component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
toggle = BooleanToggle(True)
wires_2 = BrepWireframe(Brep=createhbzones_2.HBZone, Density=-1)
runenergysimulation = Honeybee_RunEnergySimulation(
    epwFile=open_weather_file,
    HBZones=flatten(createhbzones.HBZone),
    HBContext=flatten(hb_epcontextsrf),
    simulationOutputs=flatten(epoutput.simulationOutputs),
    writeIdf=toggle,
    runEnergyPlus=toggle)  # -> report, idfFileAddress, htmlReport, resultFileAddress; plug-in component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
readepresult = Honeybee_ReadEPResult(resultFileAddress=runenergysimulation.resultFileAddress)  # -> port, port_2, port_3, port_4, port_5, port_6, port_7, port_8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; plug-in component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
adaptivecomfortcalculator = Ladybug_AdaptiveComfortCalculator(
    dryBulbTemperature=readepresult.operativeTemperature,
    meanRadiantTemperature=readepresult.meanRadTemperature,
    prevailingOutdoorTemp=importepw.dryBulbTemperature,
    windSpeed=importepw.windSpeed,
    runIt=Toggle(True))  # -> readMe, port, comfortableOrNot, conditionOfPerson, degreesFromTarget, port_2, targetTemperature, upperTemperatureBound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; plug-in component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
panel_14 = Panel(readepresult.operativeTemperature)
panel_15 = Panel([adaptivecomfortcalculator.percentOfTimeComfortable, adaptivecomfortcalculator.percentHotCold])
_3dchart_5 = Ladybug_3DChart(
    inputData=flatten([adaptivecomfortcalculator.degreesFromTarget, adaptivecomfortcalculator.conditionOfPerson]),
    xScale=".25",
    zScale="0")  # -> readMe, graphMesh, graphCurves, legend, legendBasePts, title, titleBasePts, dataPts, conditionalHOY; disabled; plug-in component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

# ---- group: annual daylight analysis
radparameters_2 = Honeybee_RADParameters(quality=0, ab="2")  # -> readMe, radParameters; plug-in component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

# ---- group: annual daylight analysis / test points
gentestpts = Honeybee_GenerateTestPoints(testGeometry=floor, gridSize=".25", distBaseSrf="0.75", moveTestMesh=True)  # -> readMe, simplify(testPoints), simplify(ptsVectors), simplify(facesArea), simplify(mesh); plug-in component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

# ---- group: climate analysis
panel_16 = Panel("""1
2
3
4
5
6
7
8
9
10
11
12""")
panel_17 = Panel("""9
6
12
15""")
sunpath = Ladybug_SunPath(
    location=importepw.location,
    hour=panel_17,
    day=21,
    month=panel_16,
    timeStep=1,
    sunPathScale=".05",
    sunScale="1.5",
    conditionalStatement="a<18 and b<80 and c>.5",
    dailyOrAnnualSunPath=True)  # -> out, sunVectors, sunAltitudes, sunAzimuths, port, sunSpheresMesh, sunPathCrvs, compassCrvs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; disabled; plug-in component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
point_7 = Point(sunpath.sunPathCenPts)
point_8 = Point(sunpath.sunPositions)
line = Line(StartPoint=point_7, EndPoint=point_8)
geometry = Geometry()
custom_preview_5 = CustomPreview(Geometry=[sunpath.compassCrvs, sunpath.sunPathCrvs], Shader=ColourSwatch(SwatchColor=RGB(181, 181, 181)))
custom_preview_6 = CustomPreview(Geometry=line, Shader=ColourSwatch(SwatchColor=RGB(199, 199, 199)))

# ---- group: annual daylight analysis
legendpar_3 = Ladybug_LegendParameters(lowBound=Slider(0, range=0..100), highBound=Slider(100, range=0..100), numSegments=Slider(6, range=0..10))  # -> legendPar; plug-in component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

open_weather_file_2 = Ladybug_OpenEPWWeatherFile(open=Toggle(True))  # -> epwFile; plug-in component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
annualdaylightsimulation = Honeybee_AnnualDaylightSimulation(
    epwWeatherFile=open_weather_file_2,
    testPoints=gentestpts.testPoints,
    ptsVectors=gentestpts.ptsVectors,
    testMesh=gentestpts.mesh,
    radParameters=radparameters_2.radParameters)  # -> analysisRecipe; plug-in component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
toggle_2 = BooleanToggle(True)
rundaylightanalysis = Honeybee_RunDaylightSimulation(
    HBObjects=flatten(brep),
    analysisRecipe=annualdaylightsimulation,
    writeRad=toggle_2,
    runRad=toggle_2,
    workingDir="F:\MEBD\aacademic simulation\day 6\aaa homework",
    meshSettings=gentestpts.mesh,
    overwriteResults=True)  # -> readMe, analysisType, resultsUnit, results, testPts, annual_analysis_files, radGeoFile, studyFolder, done; plug-in component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
readannualresultsi = Honeybee_ReadAnnualResultI(
    illFilesAddress=rundaylightanalysis.annual_analysis_files,
    testPoints=simplify(rundaylightanalysis.testPts),
    DLAIllumThresholds=300,
    runIt=Toggle(True))  # -> DLA, UDLI_Less_100, UDLI_100_2000, UDLI_More_2000, CDA, sDA, annualProfiles, htmReport; plug-in component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
panel_18 = Panel("""Annual Useful Daylight Illuminace
Basecase
Range 100-2000""")
recolormesh = Ladybug_RecolorMesh(
    analysisResult=readannualresultsi.UDLI_100_2000,
    inputMesh=gentestpts.mesh,
    legendPar=legendpar_3,
    analysisTitle=panel_18,
    legendTitle="%")  # -> readMe, newMesh, newLegend, legendBasePt, meshColors, legendColors; disabled; plug-in component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

# ----
decomposeepconstruction_2 = Honeybee_DecomposeEPConstruction(cnstrName=list_item)  # -> materials, comments, UValue_SI, UValue_IP, RValue_SI, RValue_IP; plug-in component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
point_9 = Point(<point referenced from the Rhino model>)

# ---- group: daylight model
wires_3 = BrepWireframe(Brep=[createhbsrfs_5.HBSurface, createhbsrfs.HBSurface], Density=-1)
flip = Flip(Surface=floor)  # -> Surface, Result

# ---- group: daylight model / test points
gentestpts_2 = Honeybee_GenerateTestPoints(testGeometry=flip.Surface, gridSize=".35", distBaseSrf=".75", moveTestMesh=True)  # -> readMe, simplify(testPoints), simplify(ptsVectors), simplify(facesArea), simplify(mesh); plug-in component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
gridbasedsimulation = Honeybee_GridBasedSimulation(
    skyFile=genclimatebasedsky.skyFilePath,
    testPoints=gentestpts_2.testPoints,
    ptsVectors=gentestpts_2.ptsVectors,
    testMesh=gentestpts_2.mesh,
    simulationType=0,
    radParameters=radparameters.radParameters)  # -> analysisRecipe; plug-in component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

# ---- group: daylight model
toggle_3 = BooleanToggle(False)
rundaylightanalysis_2 = Honeybee_RunDaylightSimulation(HBObjects=flatten(brep), analysisRecipe=gridbasedsimulation, writeRad=toggle_3, runRad=toggle_3, overwriteResults=True)  # -> readMe, analysisType, resultsUnit, results, testPts, resultFiles, radGeoFile, studyFolder, done; plug-in component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

recolormesh_2 = Ladybug_RecolorMesh(
    analysisResult=rundaylightanalysis_2.results,
    inputMesh=gentestpts_2.mesh,
    legendPar=legendpar_2,
    analysisTitle=concatenate,
    legendTitle="lux")  # -> readMe, newMesh, newLegend, legendBasePt, meshColors, legendColors; plug-in component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

# ---- group: glare analysis
panel_19 = Panel("15")
panel_20 = Panel("12")
panel_21 = Panel("21")
toggle_4 = BooleanToggle(True)

# ---- group: glare analysis / Recipe
number_slider = Slider(45, range=0..100)
northarrow = Ladybug_North(north=number_slider, scale=".05")  # -> northSign; plug-in component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
genclimatebasedsky_2 = Honeybee_GenerateClimateBasedSky(north=number_slider, weatherFile=open_weather_file, month=panel_20, day=panel_21, hour=panel_19)  # -> radiationValues, skyFilePath; plug-in component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
genavgsky = Honeybee_GenerateAverageSky(north=number_slider, weatherFile=open_weather_file, month=panel_20, hour=panel_19)  # -> radiationValues, skyFilePath; plug-in component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
panel_22 = Panel(genclimatebasedsky_2.radiationValues)
radparameters_3 = Honeybee_RADParameters(quality=0, ab="3")  # -> readMe, radParameters; plug-in component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
set_the_view_to_fisheye_for_glare_analys = Panel("1")  # "set the view to FishEye for Glare Analysis"
doy_hoy_2 = Ladybug_DOY_HOY(days=panel_21, months=panel_20, hours=panel_19)  # -> HOY, DOY, date; plug-in component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
imagebasedsimulation = Honeybee_ImageBasedSimulation(
    skyFile=genavgsky.skyFilePath,
    cameraType=set_the_view_to_fisheye_for_glare_analys,
    simulationType=2,
    radParameters=radparameters_3.radParameters,
    backupImages=0)  # -> analysisRecipe; plug-in component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

# ---- group: glare analysis (continued)
rundaylightanalysis_3 = Honeybee_RunDaylightSimulation(
    HBObjects=flatten(brep),
    analysisRecipe=imagebasedsimulation,
    writeRad=toggle_4,
    runRad=toggle_4,
    numOfCPUs="4",
    workingDir="F:\MEBD\1aacademic_simulation_main\00final\jpegs",
    radFileName=doy_hoy_2.date,
    overwriteResults=True)  # -> readMe, analysisType, resultsUnit, results, testPts, luminance_files, radGeoFile, studyFolder, done; disabled; plug-in component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
glareanalysis = Honeybee_GlareAnalysis(HDRImagePath=rundaylightanalysis_3.luminance_files, runIt=Toggle(True))  # -> readMe, glareCheckImage, DGP, DGI, glareComfortRange, imageWithTaskArea; plug-in component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
falsecolor = Honeybee_FalseColor(
    HDRFilePath=rundaylightanalysis_3.luminance_files,
    legendUnit="lux",
    legendMax="3000",
    contourBands=False,
    maskThreshold=0.1,
    useAlterColors=False,
    render=Toggle(True))  # -> outputFilePath; plug-in component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
hdr_gif = Honeybee_ConvertHDRToGIF(HDRFilePath=glareanalysis.glareCheckImage, adjustExposure=False)  # -> GIFFilePath; plug-in component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
hdr_gif_2 = Honeybee_ConvertHDRToGIF(HDRFilePath=falsecolor, adjustExposure=False)  # -> GIFFilePath; plug-in component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
hdr_tif = Honeybee_ConvertHDRToTIF(HDRFilePath=falsecolor, adjustExposure=False)  # -> TIFFFilePath; plug-in component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
viewer = Ladybug_ImageViewer(ImagePath=hdr_tif, ViewportScale=Slider(1.1, range=0..10), DisableClickable=False, SaveImgWithCoords=False, scale=1.1)  # -> ImagePath, ColorValues, AnimatedGIFImage
viewer_2 = Ladybug_ImageViewer(ImagePath=hdr_gif, ViewportScale="1", DisableClickable=False, SaveImgWithCoords=False, scale=1)  # -> ImagePath, ColorValues, AnimatedGIFImage
panel_23 = Panel(viewer.ImagePath)
