# Grasshopper definition guarin_juan_updated.gh (Grasshopper 0.9.76)
# plug-ins: Python Interpreter

# ---- group: Quad Pane Glass
callfromepconstrlibrary = Honeybee_CallFromEPConstructionLibrary(keywords="air")  # -> ThermMaterials, EPMaterials, EPWindowMaterials, EPConstructions; plug-in component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
epglassmat = Honeybee_EnergyPlusGlassMaterial(
    name="Single_Pane_Glass",
    thickness=".003",
    solarTransmittance=".69",
    solarReflectance=".01",
    visibleTransmittance=".5",
    visibleReflectance=".45",
    frontEmissivity=".40",
    backEmissivity=".40",
    conductivity=".9")  # -> EPMaterial; plug-in component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
callfromepconstrlibrary_2 = Honeybee_CallFromEPConstructionLibrary(keywords="clear")  # -> ThermMaterials, EPMaterials, EPWindowMaterials, EPConstructions; plug-in component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
epconstruction = Honeybee_EnergyPlusConstruction(
    name="Quad_Pane",
    layer_1=epglassmat,
    layer_2=callfromepconstrlibrary.EPWindowMaterials,
    layer_3=epglassmat,
    layer_4=callfromepconstrlibrary.EPWindowMaterials,
    layer_5=epglassmat,
    layer_6=callfromepconstrlibrary.EPWindowMaterials,
    layer_7=epglassmat)  # -> EPConstruction; plug-in component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
toggle = BooleanToggle(True)
addtoeplibrary = Honeybee_AddToEnergyPlusLibrary(EPObject=epconstruction, addToProjectLib=toggle, overwrite=toggle)  # -> readMe; plug-in component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

# ----
epglassmat_2 = Honeybee_EnergyPlusGlassMaterial(
    name="Single_Pane_Glass",
    thickness=".003",
    solarTransmittance=".69",
    solarReflectance=".01",
    visibleTransmittance=".5",
    visibleReflectance=".45",
    frontEmissivity=".40",
    backEmissivity=".40",
    conductivity=".9")  # -> EPMaterial; plug-in component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

# ---- group: Double Pane Glass
callfromepconstrlibrary_3 = Honeybee_CallFromEPConstructionLibrary(keywords="air")  # -> ThermMaterials, EPMaterials, EPWindowMaterials, EPConstructions; plug-in component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
callfromepconstrlibrary_4 = Honeybee_CallFromEPConstructionLibrary(keywords="clear")  # -> ThermMaterials, EPMaterials, EPWindowMaterials, EPConstructions; plug-in component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
# WINDOWS
panel = Panel("Double_Pane")
epconstruction_2 = Honeybee_EnergyPlusConstruction(name=panel, layer_1=epglassmat_2, layer_2=callfromepconstrlibrary_3.EPWindowMaterials, layer_3=epglassmat_2)  # -> EPConstruction; plug-in component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
toggle_2 = BooleanToggle(True)
addtoeplibrary_2 = Honeybee_AddToEnergyPlusLibrary(EPObject=epconstruction_2, addToProjectLib=toggle_2, overwrite=toggle_2)  # -> readMe; plug-in component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
panel_2 = Panel(epconstruction_2)

# ----
epglassmat_3 = Honeybee_EnergyPlusGlassMaterial(
    name="Single_Pane_Glass",
    thickness=".003",
    solarTransmittance=".69",
    solarReflectance=".01",
    visibleTransmittance=".5",
    visibleReflectance=".45",
    frontEmissivity=".40",
    backEmissivity=".40",
    conductivity=".9")  # -> EPMaterial; plug-in component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

# ---- group: Triple Pane Glass
callfromepconstrlibrary_5 = Honeybee_CallFromEPConstructionLibrary(keywords="clear")  # -> ThermMaterials, EPMaterials, EPWindowMaterials, EPConstructions; plug-in component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
callfromepconstrlibrary_6 = Honeybee_CallFromEPConstructionLibrary(keywords="air")  # -> ThermMaterials, EPMaterials, EPWindowMaterials, EPConstructions; plug-in component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
epconstruction_3 = Honeybee_EnergyPlusConstruction(
    name="Triple_Pane",
    layer_1=epglassmat_3,
    layer_2=callfromepconstrlibrary_6.EPWindowMaterials,
    layer_3=epglassmat_3,
    layer_4=callfromepconstrlibrary_6.EPWindowMaterials,
    layer_5=epglassmat_3)  # -> EPConstruction; plug-in component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
toggle_3 = BooleanToggle(True)
addtoeplibrary_3 = Honeybee_AddToEnergyPlusLibrary(EPObject=epconstruction_3, addToProjectLib=toggle_3, overwrite=toggle_3)  # -> readMe; plug-in component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
panel_3 = Panel(epconstruction_3)

# ---- group: Geometry / exterior walls
walls = Brep(<brep referenced from the Rhino model>)

# ---- group: Geometry / ceiling
ceiling = Brep(<brep referenced from the Rhino model>)

# ---- group: Geometry / Walls with Opening
wall_surface_with_opening = Brep([<brep referenced from the Rhino model> x2])

# ---- group: Geometry / interior walls
walls_2 = Brep(<brep referenced from the Rhino model>)

# ---- group: Geometry / floor
floor = Brep(<brep referenced from the Rhino model>)

# ---- group: Geometry
createhbsrfs = Honeybee_createHBSrfs(geometry=walls_2)  # -> readMe, simplify(HBSurface); plug-in component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
createhbsrfs_2 = Honeybee_createHBSrfs(geometry=flatten(floor), srfType="2")  # -> readMe, simplify(HBSurface); plug-in component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
createhbsrfs_3 = Honeybee_createHBSrfs(geometry=walls)  # -> readMe, simplify(HBSurface); plug-in component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
createhbsrfs_4 = Honeybee_createHBSrfs(geometry=wall_surface_with_opening, srfType="0")  # -> readMe, simplify(HBSurface); plug-in component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
createhbsrfs_5 = Honeybee_createHBSrfs(geometry=ceiling, srfType="3")  # -> readMe, simplify(HBSurface); plug-in component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
glass = Brep([<brep referenced from the Rhino model> x2])
preview = CustomPreview(Geometry=glass, Shader=ColourSwatch(SwatchColor=RGBA(80, 222, 255, 160)))
addhbglz = Honeybee_addHBGlz(HBObj=createhbsrfs_4.HBSurface, childSurfaces=flatten(glass))  # -> simplify(HBObjWGLZ); plug-in component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

# ----
honeybee = Honeybee_Honeybee()  # -> Vviiiiiiiiiizzz; plug-in component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
ladybug = Ladybug_Ladybug()  # -> Vviiiiiiiiiizzz; plug-in component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

# ---- group: Adobe Wall
epopaquemat = Honeybee_EnergyPlusOpaqueMaterial(name="adobe", thickness="1.0", conductivity="1.2", density="2200", specificHeat="840", solAbsp=".9", visAbsp=".9")  # -> EPMaterial; plug-in component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
epconstruction_4 = Honeybee_EnergyPlusConstruction(name="AdobeWall", layer_1=epopaquemat)  # -> EPConstruction; plug-in component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
toggle_4 = BooleanToggle(True)
addtoeplibrary_4 = Honeybee_AddToEnergyPlusLibrary(EPObject=epconstruction_4, addToProjectLib=toggle_4, overwrite=toggle_4)  # -> readMe; plug-in component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

# ---- group: CMU Sandwich Wall
callfromepconstrlibrary_7 = Honeybee_CallFromEPConstructionLibrary(keywords="WALL INSULATION 46")  # -> ThermMaterials, EPMaterials, EPWindowMaterials, EPConstructions; plug-in component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
callfromepconstrlibrary_8 = Honeybee_CallFromEPConstructionLibrary(keywords="200 concrete")  # -> ThermMaterials, EPMaterials, EPWindowMaterials, EPConstructions; plug-in component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
epopaquemat_2 = Honeybee_EnergyPlusOpaqueMaterial(
    name="Vacuum_Insulated_Panel",
    thickness="0.05",
    conductivity="0.005",
    density="190",
    specificHeat="837",
    thermAbsp="0.9",
    solAbsp="0.5",
    visAbsp="0.5")  # -> EPMaterial; plug-in component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
panel_4 = Panel(callfromepconstrlibrary_8.EPMaterials)
panel_5 = Panel(callfromepconstrlibrary_7.EPMaterials)
epconstruction_5 = Honeybee_EnergyPlusConstruction(
    name="CMU_Sandwich_Wall",
    layer_1=callfromepconstrlibrary_8.EPMaterials,
    layer_2=epopaquemat_2,
    layer_3=callfromepconstrlibrary_8.EPMaterials)  # -> EPConstruction; plug-in component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
toggle_5 = BooleanToggle(True)
panel_6 = Panel(epconstruction_5)
addtoeplibrary_5 = Honeybee_AddToEnergyPlusLibrary(EPObject=epconstruction_5, addToProjectLib=toggle_5, overwrite=toggle_5)  # -> readMe; plug-in component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

# ---- group: Brick Sandwich Wall
callfromepconstrlibrary_9 = Honeybee_CallFromEPConstructionLibrary(keywords="brick")  # -> ThermMaterials, EPMaterials, EPWindowMaterials, EPConstructions; plug-in component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
callfromepconstrlibrary_10 = Honeybee_CallFromEPConstructionLibrary(keywords="WALL INSULATION 46")  # -> ThermMaterials, EPMaterials, EPWindowMaterials, EPConstructions; plug-in component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
panel_7 = Panel(callfromepconstrlibrary_9.EPMaterials)
panel_8 = Panel(callfromepconstrlibrary_10.EPMaterials)
epconstruction_6 = Honeybee_EnergyPlusConstruction(
    name="BRICK_Sandwich_Wall",
    layer_1=callfromepconstrlibrary_9.EPMaterials,
    layer_2=callfromepconstrlibrary_10.EPMaterials,
    layer_3=callfromepconstrlibrary_9.EPMaterials)  # -> EPConstruction; plug-in component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
toggle_6 = BooleanToggle(True)
panel_9 = Panel(epconstruction_6)
addtoeplibrary_6 = Honeybee_AddToEnergyPlusLibrary(EPObject=epconstruction_6, addToProjectLib=toggle_6, overwrite=toggle_6)  # -> readMe; plug-in component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

# ---- group: Materials Library
panel_10 = Panel("""0
4
1
2""")
callfromepconstrlibrary_11 = Honeybee_CallFromEPConstructionLibrary()  # -> ThermMaterials, EPMaterials, EPWindowMaterials, EPConstructions; plug-in component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
searchepconstruction = Honeybee_SearchEPConstruction(EPConstrList=callfromepconstrlibrary_11.EPConstructions, standard="2", climateZone="3", surfaceType=panel_10)  # -> EPSelectedConstr; plug-in component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
item = ListItem(List=searchepconstruction, Index=0, Wrap=True)
bang = ExplodeTree(Data=item)  # -> Branch0, Branch1, Branch2, Branch3
flatten = FlattenTree(Tree=item, Path="{0}")
item_2 = ListItem(List=flatten, Index=0, Wrap=True)  # -> Item, Item1, Item2, Item3
panel_11 = Panel(bang.Branch0)
panel_12 = Panel(item)
panel_13 = Panel(item_2.Item3)

# ----
bldgprograms = Honeybee_bldgPrograms({"Office": 0, "Retail": 1, "MidriseApartment": 2, "PrimarySchool": 3, "SecondarySchool": 4, "SmallHotel": 5, "LargeHotel": 6, "Hospital": 7, "Outpatient": 8, "Warehouse": 9, "SuperMarket": 10, "FullServiceRestaurant": 11, "QuickServiceRestaurant": 12}, selected="MidriseApartment")
listzoneprograms = Honeybee_ListZonePrograms(bldgProgram=bldgprograms)  # -> MidriseApartmentZonePrograms; plug-in component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

# ---- group: Collect Geometries
brep = Brep(flatten([addhbglz, createhbsrfs_5.HBSurface, createhbsrfs_2.HBSurface, createhbsrfs.HBSurface, createhbsrfs_3.HBSurface]))

# ----
item_3 = ListItem(List=listzoneprograms, Index=0, Wrap=True)

# ---- group: Default Energy Plus Schedule
bldgprograms_2 = Honeybee_bldgPrograms({"Office": 0, "Retail": 1, "MidriseApartment": 2, "PrimarySchool": 3, "SecondarySchool": 4, "SmallHotel": 5, "LargeHotel": 6, "Hospital": 7, "Outpatient": 8, "Warehouse": 9, "SuperMarket": 10, "FullServiceRestaurant": 11, "QuickServiceRestaurant": 12}, selected="MidriseApartment")
listzoneprograms_2 = Honeybee_ListZonePrograms(bldgProgram=bldgprograms_2)  # -> MidriseApartmentZonePrograms; plug-in component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
getepschedules = Honeybee_GetEnergyPlusSchedules(zoneProgram=listzoneprograms_2)  # -> occupancySchedule, occupancyActivitySch, heatingSetPtSchedule, coolingSetPtSchedule, lightingSchedule, equipmentSchedule, infiltrationSchedule; plug-in component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
convertepschvalues = Honeybee_ConvertEnergyPlusScheduleToValues(schName=getepschedules.lightingSchedule)  # -> values, holidays; plug-in component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

# ---- group: Occupancy Schedule Oklahoma City
panel_14 = Panel("""0
0
0
1
1
1
1
1
1
1
0
0
0
0
0
0
0
1
1
1
1
0
0
0""")
panel_15 = Panel("""1
1
1
1
1
1
1
1
1
0
0
0
0
0
0
0
0
0
1
1
1
1
1
1""")
dup = DuplicateData(Data=panel_15, Number="5", Order=True)
dup_2 = DuplicateData(Data=panel_14, Number="2", Order=True)
data = Data([dup, dup_2])
dup_3 = DuplicateData(Data=data, Number="52", Order=True)  # -> flatten(Data)
data_2 = Data([panel_15, dup_3])
csvschedule = Honeybee_CreateCSVSchedule(values=data_2, scheduleName="Occupancy_Room_Oklahoma", writeFile=Toggle(True))  # -> readMe, csvSchedule; plug-in component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

# ----
srfattributelist = Honeybee_SurfaceAttributeList({"Name": "name", "Radiance Material": "RadMaterial", "EnergyPlus Construction": "EPConstruction", "Surface Type": "type", "Boundary Condition": "BC", "Sun Exposure": "sunExposure", "Wind Exposure": "windExposure", "Has Child Surface": "hasChild", "Is Child Surface": "isChild", "Is Planar": "isPlanar", "Srf Type Set By User": "srfTypeByUser", "Boundary Condition Set By User": "srfBCByUser", "Shade Material Name": "shadeMaterialName", "Shading Control Name": "shadingControlName", "Shcading Schedule Name": "shadingSchName"}, selected="EnergyPlus Construction")

# ---- group: HB Zones
createhbzones = Honeybee_createHBZones(name="Oklahoma_City_Room", zoneProgram=item_3, HBSurfaces=flatten(brep), isConditioned=Toggle(False))  # -> readMe, HBZone; plug-in component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

# ----
panel_16 = Panel(item_3)

# ----
# WALLS
decomposeepmaterial = Honeybee_DecomposeEPMaterial(materialName=simplify(callfromepconstrlibrary_7.EPMaterials))  # -> names, values, comments, UValue_SI, UValue_IP, RValue_SI, RValue_IP; plug-in component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
panel_17 = Panel(decomposeepmaterial.comments)
panel_18 = Panel(decomposeepmaterial.values)

labelsurfaces = Honeybee_LabelZoneSurfaces(HBObjects=flatten(createhbzones.HBZone), attribute=srfattributelist)  # -> surfaceTxtLabels, labelBasePts, brepTxtLabels, surfaceWireFrames; plug-in component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

# ---- group: Assign Materials
setepzonecnstr = Honeybee_SetEPZoneConstruction(
    HBZones=flatten(createhbzones.HBZone),
    wallEPConstruction="CMU_Sandwich_Wall",
    windowEPConstruction="Quad_Pane",
    roofEPConstruction=item_2.Item2,
    floorEPConstruction=item_2.Item3)  # -> simplify(modifiedHBZones); plug-in component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

# ----
wires = BrepWireframe(Brep=createhbzones.HBZone, Density=-1)

# ---- group: Adjacent Room
brep_2 = Brep(<brep referenced from the Rhino model>)
hb_epcontextsrf = HoneybeeEPContextSurfaces(shdSurfaces=flatten(brep_2))  # -> HBContext; inputs shdSurfaces: list of Brep, justBoundingBox: Boolean
# ---------- hb_epcontextsrf: Python ----------
"""
prepare shading/context geometries

    Args:
        northVectorOrRotation: A vector that shows North or a number that shows
                               the rotation of the North from the Y axis
        bldgMasses: List of closed Breps as thermal zones.
    Returns:
        report: ...
        thermalZones: Thermal zone's geometries for visualiza
"""

ghenv.Component.Name = 'Honeybee EP context Surfaces'
ghenv.Component.NickName = 'HB_EPContextSrf'
ghenv.Component.Message = 'VER 0.0.62\nJUL_28_2017'
ghenv.Component.IconDisplayMode = ghenv.Component.IconDisplayMode.application
ghenv.Component.Category = "Honeybee"
ghenv.Component.SubCategory = "10 | Energy | Energy"
#compatibleHBVersion = VER 0.0.57\nNOV_04_2016
#compatibleLBVersion = VER 0.0.59\nFEB_01_2015
ghenv.Component.AdditionalHelpFromDocStrings = "2"

import rhinoscriptsyntax as rs
import Rhino as rc
import scriptcontext as sc
import os
import System
import Grasshopper.Kernel as gh
import uuid

tolerance = sc.doc.ModelAbsoluteTolerance
import math


def main(shdSurfaces, EPTransSchedule, meshingSettings, justBoundingBox):
    
    # import the classes
    if sc.sticky.has_key('honeybee_release'):

        try:
            if not sc.sticky['honeybee_release'].isCompatible(ghenv.Component): return -1
            if sc.sticky['honeybee_release'].isInputMissing(ghenv.Component): return -1
        except:
            warning = "You need a newer version of Honeybee to use this compoent." + \
            " Use updateHoneybee component to update userObjects.\n" + \
            "If you have already updated userObjects drag Honeybee_Honeybee component " + \
            "into canvas and try again."
            w = gh.GH_RuntimeMessageLevel.Warning
            ghenv.Component.AddRuntimeMessage(w, warning)
            return -1
        
        # don't customize this part
        hb_EPSrf = sc.sticky["honeybee_EPSurface"]
        hb_EPSHDSurface = sc.sticky["honeybee_EPShdSurface"]
        hb_RADMaterialAUX = sc.sticky["honeybee_RADMaterialAUX"]
        hb_EPObjectsAux = sc.sticky["honeybee_EPObjectsAUX"]()
        HBScheduleList = sc.sticky["honeybee_ScheduleLib"].keys()

        ########################################################################
        #----------------------------------------------------------------------#
        shdBreps = []
        # create bounding box of shading geometries
        if justBoundingBox:
            for brep in shdSurfaces:
                if brep.Faces.Count>1 or not brep.Faces[0].IsPlanar(sc.doc.ModelAbsoluteTolerance):
                    shdBreps.append(brep.GetBoundingBox(True).ToBrep())
                else:
                    shdBreps.append(brep)
        else:
            shdBreps = shdSurfaces
        
        shadingClasses = []
        shadingMeshPreview = []
        
        if meshingSettings == None:
            mp = rc.Geometry.MeshingParameters.Minimal
            mp.SimplePlanes = True
        else:
            mp = meshingSettings
        
        def getRadMaterialName(radMaterial):
            nameStr = radMaterial.split(" ")[2]
            name =  nameStr.split("\n")[0]
            return name
        
        for brepCount, brep in enumerate(shdBreps):
            if brep != None:
                isPlanar = True
                # check planarity
                for face in brep.Faces:
                    if not face.IsPlanar(tolerance):
                        isPlanar = False
                        break
                
                shadingBreps = []
                if not isPlanar:
                    meshArray = rc.Geometry.Mesh.CreateFromBrep(brep, mp)
                    for mesh in meshArray:
                        for meshFace in range(mesh.Faces.Count):
                            vertices = list(mesh.Faces.GetFaceVertices(meshFace))[1:]
                            vertices = vertices + [sc.doc.ModelAbsoluteTolerance]
                            # create the brep from mesh
                            shdBrep = rc.Geometry.Brep.CreateFromCornerPoints(*vertices)
                            shadingBreps.append(shdBrep)
                else:
                    for face in brep.Faces:
                        shadingBreps.append(face.DuplicateFace(False))
                
                for faceCount, shdBrep in enumerate(shadingBreps):
                        thisShading = hb_EPSHDSurface(shdBrep, 1000*brepCount + faceCount, 'shdSrf_' + `brepCount` + '_' + `faceCount` + "_" + str(uuid.uuid4()))
                        
                        # add transmittance schedule if any
                        if EPTransSchedule!=None:
                            schedule= EPTransSchedule.upper()
                            if schedule!=None and not schedule.lower().endswith(".csv") and schedule not in HBScheduleList:
                                msg = "Cannot find " + schedule + " in Honeybee schedule library."
                                print msg
                                ghenv.Component.AddRuntimeMessage(gh.GH_RuntimeMessageLevel.Warning, msg)
                                return -1
                            elif schedule!=None and schedule.lower().endswith(".csv"):
                                # check if csv file is existed
                                if not os.path.isfile(schedule):
                                    msg = "Cannot find the shchedule file: " + schedule
                                    print msg
                                    ghenv.Component.AddRuntimeMessage(gh.GH_RuntimeMessageLevel.Warning, msg)
                                    return -1
                            
                            thisShading.TransmittanceSCH = schedule
                        
                        # add the Rad Material if any
                        if RADMaterial!=None:
                            # if it is just the name of the material make sure it is already defined
                            if len(RADMaterial.split(" ")) == 1:
                                # if the material is not in the library add it to the library
                                if not hb_RADMaterialAUX.isMatrialExistInLibrary(RADMaterial):
                                    warningMsg = "Can't find " + RADMaterial + " in RAD Material Library.\n" + \
                                                "Add the material to the library and try again."
                                    ghenv.Component.AddRuntimeMessage(gh.GH_RuntimeMessageLevel.Warning, warningMsg)
                                    return
                                
                                try:
                                    thisShading.setRADMaterial(RADMaterial)
                                except Exception, e:
                                    print e
                                    warningMsg = "You are using an old version of Honeybee_Honeybee! Update your files and try again."
                                    print warningMsg
                                    ghenv.Component.AddRuntimeMessage(gh.GH_RuntimeMessageLevel.Warning, warningMsg)
                                    return
                                
                                addedToLib = True
                            else:
                                
                                # try to add the material to the library
                                addedToLib, thisShading.RadMaterial = hb_RADMaterialAUX.analyseRadMaterials(RADMaterial, True)
                                
                            if addedToLib==False:
                                warningMsg = "Failed to add " + RADMaterial + " to the Library."
                                ghenv.Component.AddRuntimeMessage(gh.GH_RuntimeMessageLevel.Warning, warningMsg)
                                return
                        
                        # add shading to the list
                        shadingClasses.append(thisShading)
                
        # add to the hive
        hb_hive = sc.sticky["honeybee_Hive"]()
        HBContext  = hb_hive.addToHoneybeeHive(shadingClasses, ghenv.Component)
        return HBContext
        ################################################################################################
    else:
        print "You should first let Honeybee to fly..."
        w = gh.GH_RuntimeMessageLevel.Warning
        ghenv.Component.AddRuntimeMessage(w, "You should first let Honeybee to fly...")
        return -1
        

if _shdSurfaces and _shdSurfaces[0]!=None:
    # add cleaning function
    result= main(_shdSurfaces, EPTransSchedule_, meshingSettings_, justBoundingBox_)
    
    if result != -1: HBContext = result
# ---------- end hb_epcontextsrf ----------

# ----
legendpar = Ladybug_LegendParameters(lowBound="0", highBound="1", numSegments="2", legendScale="1.5", removeLessThan=Toggle(True))  # -> legendPar; plug-in component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

# ---- group: Schedule Charts
convertepschvalues_2 = Honeybee_ConvertEnergyPlusScheduleToValues(schName=csvschedule.csvSchedule)  # -> values, holidays; plug-in component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
_3dchart = Ladybug_3DChart(
    inputData=flatten([convertepschvalues_2.values, convertepschvalues.values]),
    xScale=".25",
    zScale="0",
    legendPar=legendpar)  # -> readMe, graphMesh, graphCurves, legend, legendBasePts, title, titleBasePts, dataPts, conditionalHOY; plug-in component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

# ----
path = FilePath("E:\JDG\Downloads\EPW\USA_OK_Oklahoma.City-Will.Rogers.World.AP.723530_TMY3.epw")
importepw = Ladybug_ImportEpw(epwFile=path)  # -> readMe, latitude, location, dryBulbTemperature, dewPointTemperature, relativeHumidity, windSpeed, windDirection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; plug-in component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

# ---- group: Deployable Shading System BY TEMPERATURE
strnum = Ladybug_SeparateData(inputList=flatten(importepw.dryBulbTemperature))  # -> numbers, strings; plug-in component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
smaller = SmallerThan(FirstNumber=strnum.numbers, SecondNumber="22")  # -> SmallerThan, OrEqualTo
larger = LargerThan(FirstNumber=strnum.numbers, SecondNumber="22")  # -> LargerThan, OrEqualTo
int = Integer(smaller.SmallerThan)

# ---- group: Deployable Shading System BY MONTH
multiplication = Multiplication(A="24", B="30")
multiplication_2 = Multiplication(A=multiplication, B="5")
multiplication_3 = Multiplication(A=multiplication, B="4")
addition = Addition(A=multiplication_3, B=multiplication_2)
subtraction = Subtraction(A="8760", B=addition)
dup_4 = DuplicateData(Data="1", Number=multiplication_3, Order=True)
dup_5 = DuplicateData(Data="1", Number=subtraction, Order=True)
dup_6 = DuplicateData(Data="0", Number=multiplication_2, Order=True)
data_3 = Data([dup_4, dup_6, dup_5])
csvschedule_2 = Honeybee_CreateCSVSchedule(values=int, scheduleName="Deployable_Shading_System", writeFile=Toggle(True))  # -> readMe, csvSchedule; plug-in component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
brep_3 = Brep([<brep referenced from the Rhino model> x9])
hb_epcontextsrf_2 = HoneybeeEPContextSurfaces(shdSurfaces=flatten(brep_3), EPTransSchedule=csvschedule_2.csvSchedule)  # -> HBContext; inputs shdSurfaces: list of Brep, justBoundingBox: Boolean; same code as hb_epcontextsrf

# ---- group: Deployable Shading System BY RADIATION
strnum_2 = Ladybug_SeparateData(inputList=flatten(importepw.globalHorizontalRadiation))  # -> numbers, strings; plug-in component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
smaller_2 = SmallerThan(FirstNumber=strnum_2.numbers, SecondNumber="800")  # -> SmallerThan, OrEqualTo
larger_2 = LargerThan(FirstNumber=strnum_2.numbers, SecondNumber="800")  # -> LargerThan, OrEqualTo
int_2 = Integer(smaller_2.SmallerThan)

# ---- group: Occupancy File
occupancygenerator = Honeybee_DaysimOccupancyGeneratorBasedOnList(occValues=data_2, fileName="FILE", writeTheOcc=Toggle(True))  # -> occupancyFile; plug-in component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

# ----
# DAYLIGHTING
panel_19 = Panel(".25")
genhbzonetestpts = Honeybee_GenerateZoneTestPoints(HBZone=createhbzones.HBZone, gridSize=panel_19, distBaseSrf="0.762", moveTestMesh=True)  # -> readMe, simplify(testPoints), simplify(ptsVectors), simplify(facesArea), simplify(mesh); plug-in component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
annualdaylightsimulation = Honeybee_AnnualDaylightSimulation(epwWeatherFile=path, testPoints=genhbzonetestpts.testPoints, ptsVectors=genhbzonetestpts.ptsVectors)  # -> analysisRecipe; plug-in component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
toggle_7 = BooleanToggle(True)
rundaylightanalysis = Honeybee_RunDaylightSimulation(
    HBObjects=flatten(createhbzones.HBZone),
    analysisRecipe=annualdaylightsimulation,
    writeRad=toggle_7,
    runRad=toggle_7,
    overwriteResults=True)  # -> readMe, analysisType, resultsUnit, results, testPts, annual_analysis_files, radGeoFile, studyFolder, done; plug-in component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
readannualresultsi = Honeybee_ReadAnnualResultI(
    illFilesAddress=rundaylightanalysis.annual_analysis_files,
    testPoints=simplify(rundaylightanalysis.testPts),
    occupancyFiles=occupancygenerator,
    DLAIllumThresholds=300,
    runIt=Toggle(True))  # -> DLA, UDLI_Less_100, UDLI_100_2000, UDLI_More_2000, CDA, sDA, annualProfiles, htmReport; plug-in component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
strnum_3 = Ladybug_SeparateData(inputList=flatten(readannualresultsi.UDLI_100_2000))  # -> numbers, strings; plug-in component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
ma = MassAddition(Input=strnum_3.numbers)  # -> Result, PartialResults
division = Division(A=ma.Result)
total_udi = Panel(division)
legendpar_2 = Ladybug_LegendParameters(lowBound="0", highBound="100")  # -> legendPar; plug-in component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
panel_20 = Panel("""Daylight Analysis
Useful Daylight Illuminance
(100lux-2000lux)""")
recolormesh = Ladybug_RecolorMesh(
    analysisResult=readannualresultsi.UDLI_100_2000,
    inputMesh=genhbzonetestpts.mesh,
    legendPar=legendpar_2,
    analysisTitle=panel_20,
    legendTitle="lux")  # -> readMe, newMesh, newLegend, legendBasePt, meshColors, legendColors; plug-in component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

setepzoneschedules = Honeybee_SetEnergyPlusZoneSchedules(HBZones=setepzonecnstr, occupancySchedules=csvschedule.csvSchedule, lightingSchedules=readannualresultsi.annualProfiles)  # -> schedules, simplify(HBZones); plug-in component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
setepzoneloads = Honeybee_SetEnergyPlusZoneLoads(HBZones=setepzoneschedules.HBZones, infiltrationRatePerArea="0.0001")  # -> loads, HBZones; plug-in component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

# ---- group: Natural Ventilation
setepnatvent = Honeybee_SetEPAirFlow(
    HBZones=flatten(setepzoneloads.HBZones),
    naturalVentilationType="1",
    minIndoorTempForNatVent="23.4",
    maxIndoorTempForNatVent="36",
    minOutdoorTempForNatVent="-1",
    maxOutdoorTempForNatVent="28.3",
    windDrivenCrossVent=Toggle(True))  # -> readMe, simplify(HBZones); plug-in component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

# ----
# Run Analysis
toggle_8 = BooleanToggle(True)
epoutput = Honeybee_GenerateEPOutput(
    zoneEnergyUse=toggle_8,
    zoneGainsAndLosses=toggle_8,
    zoneComfortMetrics=toggle_8,
    surfaceTempAnalysis="False",
    surfaceEnergyAnalysis=toggle_8,
    timestep="monthly")  # -> report, flatten(simulationOutputs); plug-in component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
toggle_9 = BooleanToggle(True)
runenergysimulation = Honeybee_RunEnergySimulation(
    epwFile=path,
    HBZones=flatten(setepnatvent.HBZones),
    HBContext=flatten([hb_epcontextsrf, hb_epcontextsrf_2]),
    simulationOutputs=flatten(epoutput.simulationOutputs),
    writeIdf=toggle_9,
    runEnergyPlus=toggle_9)  # -> report, idfFileAddress, htmlReport, resultFileAddress; plug-in component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

# ---- group: Point in Time Analysis
number_slider = Slider(0, range=0..2)
month = Panel("""3
6
12""")
hour = Panel("""9
12
15""")
number_slider_2 = Slider(0, range=0..2)
item_4 = ListItem(List=hour, Index=number_slider, Wrap=True)
item_5 = ListItem(List=month, Index=number_slider_2, Wrap=True)
path_2 = FilePath("E:\JDG\Downloads\EPW\USA_OK_Oklahoma.City-Will.Rogers.World.AP.723530_TMY3.epw")
genclimatebasedsky = Honeybee_GenerateClimateBasedSky(weatherFile=path_2, month=item_5, day="21", hour=item_4)  # -> radiationValues, skyFilePath; plug-in component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
gridbasedsimulation = Honeybee_GridBasedSimulation(skyFile=genclimatebasedsky.skyFilePath, testPoints=genhbzonetestpts.testPoints, simulationType=0)  # -> analysisRecipe; plug-in component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
fly = Ladybug_fly(inputSliders=[number_slider_2, number_slider], fly=Toggle(False))  # -> Vviiiiiiiiiizzz; plug-in component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
panel_21 = Panel(genclimatebasedsky.skyFilePath)
doy_hoy = Ladybug_DOY_HOY(days="21", months=item_5, hours=item_4)  # -> HOY, DOY, date; plug-in component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
legendpar_3 = Ladybug_LegendParameters(lowBound="0", highBound="2000")  # -> legendPar; plug-in component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
panel_22 = Panel(doy_hoy.date)
concat = Concatenate(FragmentA="Illuminance study", FragmentB="Date: ", FragmentD=panel_22)
panel_23 = Panel(rundaylightanalysis.results)
recolormesh_2 = Ladybug_RecolorMesh(analysisResult=rundaylightanalysis.results, inputMesh=genhbzonetestpts.mesh, legendPar=legendpar_3, analysisTitle=concat)  # -> readMe, newMesh, newLegend, legendBasePt, meshColors, legendColors; plug-in component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
smaller_3 = SmallerThan(FirstNumber=panel_23, SecondNumber="300")  # -> SmallerThan, OrEqualTo
mesh = Mesh(recolormesh_2.newMesh)
larger_3 = LargerThan(FirstNumber=rundaylightanalysis.results, SecondNumber="2000")  # -> LargerThan, OrEqualTo
or = GateOr(A=smaller_3.SmallerThan, B=larger_3.LargerThan)
cullf = CullFaces(Mesh=mesh, Pattern=or)
area = Area(Geometry=cullf)  # -> Area, Centroid
area_2 = Area(Geometry=mesh)  # -> Area, Centroid
division_2 = Division(A=area.Area, B=area_2.Area)
panel_24 = Panel("ill_wwr_")
multiplication_4 = Multiplication(A=division_2, B="100")
concat_2 = Concatenate(FragmentC="_hoy_", FragmentD=doy_hoy.HOY)
round = Round(Number=multiplication_4)  # -> Nearest, Floor, Ceiling
panel_25 = Panel(concat_2)
captureview = Ladybug_CaptureView(fileName=concat_2, folder="c:\ladybug\illuminance_study")  # -> imagePath; plug-in component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
pt = Point(Point(0.941711121, -3.679516468, 1.962177845))
concat_3 = Concatenate(FragmentA=round.Nearest, FragmentB="% of area between 300 lux-2000 lux")
tag = TextTag3D(Location=pt, Text=concat_3, Size=Slider(0.8, range=0..1), Justification=7)

# ---- group: Read Results
readepresult = Honeybee_ReadEPResult(resultFileAddress=runenergysimulation.resultFileAddress)  # -> port, port_2, port_3, port_4, electricLight, electricEquip, fanElectric, port_5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; plug-in component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

# ----
readepsrfresult = Honeybee_ReadEPSurfaceResult(resultFileAddress=runenergysimulation.resultFileAddress)  # -> port, port_2, surfaceEnergyFlow, opaqueEnergyFlow, glazEnergyFlow, port_3, port_4, port_5, port_6, port_7; plug-in component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

# ---- group: seasons / winter
panel_26 = Panel("1")
panel_27 = Panel("2")
panel_28 = Panel("28")
panel_29 = Panel("12")

# ---- group: seasons / spring
panel_30 = Panel("03")
panel_31 = Panel("1")
panel_32 = Panel("5")
panel_33 = Panel("31")

# ---- group: seasons / summer
panel_35 = Panel("8")
panel_36 = Panel("06")

# ---- group: seasons / fall
panel_38 = Panel("09")
panel_39 = Panel("30")
panel_41 = Panel("11")

# ---- group: seasons
analysisperiod = Ladybug_AnalysisPeriod(fromMonth=panel_29, fromDay=panel_26, toMonth=panel_27, toDay=panel_28)  # -> readMe, analysisPeriod; plug-in component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

# ---- group: Comfort Analysis
toggle_10 = BooleanToggle(True)
adaptivecomfortcalculator = Ladybug_AdaptiveComfortCalculator(
    dryBulbTemperature=readepresult.airTemperature,
    meanRadiantTemperature=readepresult.meanRadTemperature,
    prevailingOutdoorTemp=importepw.dryBulbTemperature,
    analysisPeriod=analysisperiod.analysisPeriod,
    runIt=toggle_10)  # -> readMe, port, comfortableOrNot, conditionOfPerson, degreesFromTarget, port_2, targetTemperature, upperTemperatureBound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; plug-in component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
adaptivecomfortcalculator_2 = Ladybug_AdaptiveComfortCalculator(
    dryBulbTemperature=readepresult.airTemperature,
    meanRadiantTemperature=readepresult.meanRadTemperature,
    prevailingOutdoorTemp=importepw.dryBulbTemperature,
    runIt=toggle_10)  # -> readMe, port, comfortableOrNot, conditionOfPerson, degreesFromTarget, port_2, targetTemperature, upperTemperatureBound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; plug-in component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
panel_42 = Panel([adaptivecomfortcalculator.percentOfTimeComfortable, adaptivecomfortcalculator.percentHotCold])
panel_43 = Panel([adaptivecomfortcalculator_2.percentOfTimeComfortable, adaptivecomfortcalculator_2.percentHotCold])
panel_44 = Panel(".25")
panel_45 = Panel("0")

# ----
dsannualprofiles = Honeybee_DaysimAnnualProfiles(annualProfiles=readannualresultsi.annualProfiles)  # -> simplify(occupancyProfile), simplify(shadingProfiles), simplify(lightingControlProfiles), simplify(dgpProfile); plug-in component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

# ---- group: Energy Loads Balance
energybalance = Honeybee_ConstructEnergyBalance(
    HBZones=flatten(setepnatvent.HBZones),
    electricLight=readepresult.electricLight,
    electricEquip=readepresult.electricEquip,
    fanElectric=readepresult.fanElectric,
    peopleGains=readepresult.peopleGains,
    totalSolarGain=readepresult.totalSolarGain,
    infiltrationEnergy=readepresult.infiltrationEnergy,
    natVentEnergy=readepresult.natVentEnergy,
    surfaceEnergyFlow=readepsrfresult.surfaceEnergyFlow)  # -> readMe, port, flrNormEnergyBal, flrNormBalWStorage, port_2, modelEnergyBalance, energyBalWithStorage; plug-in component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
legendpar_4 = Ladybug_LegendParameters(lowBound="-250", highBound="250")  # -> legendPar; plug-in component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
barchart = Ladybug_MonthlyBarChart(inputData=flatten(energybalance.modelEnergyBalance), stackValues=Toggle(True), yScale="2", legendPar=legendpar_4)  # -> readMe, dataMesh, dataCurves, dataCrvColors, graphAxes, graphLabels, title, titleBasePt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; plug-in component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

# ---- group: Loads
strnum_4 = Ladybug_SeparateData(inputList=flatten(readepresult.port_3))  # -> numbers, strings; plug-in component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
strnum_5 = Ladybug_SeparateData(inputList=flatten(readepresult.port_4))  # -> numbers, strings; plug-in component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
strnum_6 = Ladybug_SeparateData(inputList=flatten(readepresult.electricLight))  # -> numbers, strings; plug-in component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
ma_2 = MassAddition(Input=strnum_6.numbers)  # -> Result, PartialResults
ma_3 = MassAddition(Input=strnum_4.numbers)  # -> Result, PartialResults
ma_4 = MassAddition(Input=strnum_5.numbers)  # -> Result, PartialResults
total_cooling = Panel(ma_3.Result)
total_heating = Panel(ma_4.Result)
total_lighting = Panel(ma_2.Result)

# ---- group: Weather Charts
_3dchart_2 = Ladybug_3DChart(
    inputData=flatten([importepw.dryBulbTemperature, importepw.globalHorizontalRadiation, importepw.relativeHumidity]),
    basePoint="0, -320, 0",
    xScale=".25",
    zScale="0")  # -> readMe, graphMesh, graphCurves, legend, legendBasePts, title, titleBasePts, dataPts, conditionalHOY; plug-in component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

# ---- group: Wind Rose
windrose = Ladybug_WindRose(
    north=0,
    hourlyWindDirection=importepw.windDirection,
    hourlyWindSpeed=importepw.windSpeed,
    annualHourlyData=flatten(importepw.dryBulbTemperature),
    runIt=Toggle(True))  # -> readMe, calmRoseMesh, windRoseMesh, windRoseCrvs, windRoseCenPts, legend, legendBasePts, title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; plug-in component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

# ---- group: Lighting Loads
_3dchart_3 = Ladybug_3DChart(inputData=flatten(readepresult.electricLight), xScale=".25", zScale="0")  # -> readMe, graphMesh, graphCurves, legend, legendBasePts, title, titleBasePts, dataPts, conditionalHOY; plug-in component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

# ---- group: Yearly Comfort Chart
_3dchart_4 = Ladybug_3DChart(inputData=flatten(adaptivecomfortcalculator_2.comfortableOrNot), xScale=".25", zScale="0")  # -> readMe, graphMesh, graphCurves, legend, legendBasePts, title, titleBasePts, dataPts, conditionalHOY; plug-in component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

# ----
_3dchart_5 = Ladybug_3DChart(inputData=flatten([dsannualprofiles.lightingControlProfiles, dsannualprofiles.occupancyProfile]), xScale=".25")  # -> readMe, graphMesh, graphCurves, legend, legendBasePts, title, titleBasePts, dataPts, conditionalHOY; plug-in component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
pt_2 = Point(Point(1.098220941, 371.8991845, 0))

# ---- group: Seasonal Comfort Chart
legendpar_5 = Ladybug_LegendParameters(lowBound="-1", highBound="1", numSegments="3")  # -> legendPar; plug-in component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
_3dchart_6 = Ladybug_3DChart(
    inputData=flatten(adaptivecomfortcalculator.conditionOfPerson),
    basePoint=pt_2,
    xScale=panel_44,
    zScale=panel_45,
    legendPar=legendpar_5)  # -> readMe, graphMesh, graphCurves, legend, legendBasePts, title, titleBasePts, dataPts, conditionalHOY; plug-in component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

# ----
importepw_2 = Ladybug_ImportEpw(epwFile=path)  # -> readMe, latitude, location, dryBulbTemperature, dewPointTemperature, relativeHumidity, windSpeed, windDirection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; plug-in component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
clofunction = Ladybug_ClothingFunction(outdoorAirTemperature=importepw_2.dryBulbTemperature, maxClo="1.1", maxCloTemp="10")  # -> readMe, cloValues; plug-in component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

# ----
# OPEN STUDIO ANALYSIS INCORPORATED INTO THE SCRIPT, BUT NOT ENOUGH TIME TO IMPLEMENT IT
# Calculate Clothing Function
# Visualize Underheated / Overheated Hours
toggle_11 = BooleanToggle(True)
epoutput_2 = Honeybee_GenerateEPOutput(
    zoneEnergyUse=toggle_11,
    zoneGainsAndLosses="False",
    zoneComfortMetrics=toggle_11,
    comfortMapVariables=toggle_11,
    surfaceTempAnalysis=toggle_11)  # -> report, flatten(simulationOutputs); plug-in component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
toggle_12 = BooleanToggle(False)
exporttoopenstudio = Honeybee_ExportToOpenStudio(
    epwWeatherFile=path,
    HBZones=flatten(setepnatvent.HBZones),
    simulationOutputs=flatten(epoutput_2.simulationOutputs),
    writeOSM=toggle_12,
    runSimulation=toggle_12,
    fileName="ThermalAutonomyTest")  # -> readMe, osmFileAddress, idfFileAddress, resultFileAddress, eioFileAddress, rddFileAddress, htmlReport, studyFolder, model; plug-in component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

toggle_13 = BooleanToggle(True)
readepsrfresult_2 = Honeybee_ReadEPSurfaceResult(resultFileAddress=exporttoopenstudio.resultFileAddress)  # -> surfaceIndoorTemp, surfaceOutdoorTemp, surfaceEnergyFlow, opaqueEnergyFlow, glazEnergyFlow, windowTotalSolarEnergy, windowBeamEnergy, windowDiffEnergy, windowTransmissivity, otherSurfaceData; plug-in component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
readepresult_2 = Honeybee_ReadEPResult(resultFileAddress=exporttoopenstudio.resultFileAddress)  # -> totalThermalLoad, thermalLoadBalance, cooling, heating, electricLight, electricEquip, fanElectric, pumpElectric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; plug-in component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
indoorviewfactor = Honeybee_IndoorViewFactorCalculator(HBZones=flatten(setepnatvent.HBZones), gridSize="1", parallel=Toggle(True), buildMesh=toggle_13, runIt=toggle_13)  # -> readMe, port, viewFactorMesh, viewFactorInfo, port_2, testPts, viewMeshFaces, zoneWireFrame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; plug-in component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
pmvcomfrecipe = Honeybee_PMVComfortAnalysisRecipe(
    viewFactorMesh=indoorviewfactor.viewFactorMesh,
    viewFactorInfo=indoorviewfactor.viewFactorInfo,
    epwFile=path,
    srfIndoorTemp=readepsrfresult_2.surfaceIndoorTemp,
    zoneAirTemp=readepresult_2.airTemperature,
    zoneRelHumid=readepresult_2.relativeHumidity,
    zoneAirFlowVol=readepresult_2.airFlowVolume,
    zoneAirHeatGain=readepresult_2.airHeatGainRate,
    metabolicRate="1.2",
    clothingLevel=clofunction.cloValues)  # -> comfRecipe; plug-in component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
microclimatemap = Honeybee_MicroclimateMapAnalysis(
    comfAnalysisRecipe=pmvcomfrecipe,
    fileName="test",
    writeResultFile=Toggle(True),
    parallel=Toggle(True),
    runIt=Toggle(True))  # -> readMe, port, radTempMtx, airTempMtx, operativeTempMtx, adaptComfMtx, degFromTargetMtx, port_2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; plug-in component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

thermalautonomy = Honeybee_ThermalAutonomyAnalysis(
    comfResultsMtx=microclimatemap.adaptComfMtx,
    degOrPMVMtx=microclimatemap.degFromTargetMtx,
    viewFactorMesh=flatten(indoorviewfactor.viewFactorMesh),
    totalThermalEnergy=readepresult_2.totalThermalLoad,
    runIt=Toggle(True))  # -> readMe, port, occTCP_Mtx, TA_Mtx, OverHeatedMtx, UnderHeatedMtx, port_2, occTCP_Result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; plug-in component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
visualizemicroclimate = Honeybee_VisualizeMicroclimateMap(comfResultsMtx=thermalautonomy.OverHeatedMtx, viewFactorMesh=flatten(indoorviewfactor.viewFactorMesh))  # -> readMe, port, resultMesh, legend, legendBasePt, port_2, resultValues, resultColors; plug-in component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
move = Move(Geometry=indoorviewfactor.zoneWireFrame, Motion="20,0,0")  # -> Geometry, Transform
move_2 = Move(Geometry=[visualizemicroclimate.resultMesh, visualizemicroclimate.legend], Motion="20,0,0")  # -> Geometry, Transform
preview_2 = CustomPreview(Geometry=[indoorviewfactor.zoneWireFrame, move.Geometry], Shader=ColourSwatch(SwatchColor=RGB(0, 0, 0)))

visualizemicroclimate_2 = Honeybee_VisualizeMicroclimateMap(comfResultsMtx=thermalautonomy.UnderHeatedMtx, viewFactorMesh=flatten(indoorviewfactor.viewFactorMesh))  # -> readMe, port, resultMesh, legend, legendBasePt, port_2, resultValues, resultColors; plug-in component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
ma_5 = MassAddition(Input=visualizemicroclimate.resultValues)  # -> Result, PartialResults
ma_6 = MassAddition(Input=visualizemicroclimate_2.resultValues)  # -> Result, PartialResults
division_3 = Division(A=ma_5.Result, B="60")
division_4 = Division(A=ma_6.Result, B="60")
panel_46 = Panel(division_3)
panel_47 = Panel(division_4)
