# Grasshopper definition gupta_naman.gh (Grasshopper 0.9.76)
# plug-ins: Python Interpreter

# Geometry
# geometry is not considered in airflow
# - volume is
# - surface is
# 
# these are simplified calculations done, not CFT calculations
# - can be more accurate than CFT
panel = Panel("""first 
54.46347
10.856164
34.680365""")

floor = Brep(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)
_3windowwall = Brep(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)
wall = Brep([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])
ceiling = Brep(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)
createhbsrfs = Honeybee_createHBSrfs(geometry=floor, srfType="2")  # -> readMe, simplify(HBSurface); plug-in component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
createhbsrfs_2 = Honeybee_createHBSrfs(geometry=ceiling, srfType="3")  # -> readMe, simplify(HBSurface); plug-in component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
createhbsrfs_3 = Honeybee_createHBSrfs(geometry=_3windowwall, srfType="0")  # -> readMe, simplify(HBSurface); plug-in component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
createhbsrfs_4 = Honeybee_createHBSrfs(geometry=wall, srfType="0")  # -> readMe, simplify(HBSurface); plug-in component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
brep = Brep([<brep referenced from the Rhino model> x3])
addhbglz = Honeybee_addHBGlz(HBObj=createhbsrfs_3.HBSurface, childSurfaces=flatten(brep))  # -> HBObjWGLZ; plug-in component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

honeybee = Honeybee_Honeybee()  # -> Vviiiiiiiiiizzz; plug-in component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
ladybug = Ladybug_Ladybug()  # -> Vviiiiiiiiiizzz; plug-in component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
makeadiabatic = Honeybee_MakeAdiabatic(HBSrfs=[createhbsrfs_2.HBSurface, createhbsrfs.HBSurface, createhbsrfs_4.HBSurface])  # -> HBSrfs; plug-in component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

bldgprograms = Honeybee_bldgPrograms({"Office": 0, "Retail": 1, "MidriseApartment": 2, "PrimarySchool": 3, "SecondarySchool": 4, "SmallHotel": 5, "LargeHotel": 6, "Hospital": 7, "Outpatient": 8, "Warehouse": 9, "SuperMarket": 10, "FullServiceRestaurant": 11, "QuickServiceRestaurant": 12}, selected="MidriseApartment")
listzoneprograms = Honeybee_ListZonePrograms(bldgProgram=bldgprograms)  # -> MidriseApartmentZonePrograms; plug-in component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
item = ListItem(List=listzoneprograms, Index=0, Wrap=True)
createhbzones = Honeybee_createHBZones(name="naman_room", zoneProgram=item, HBSurfaces=flatten([makeadiabatic, addhbglz]), isConditioned=Toggle(False))  # -> readMe, HBZone; plug-in component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
wires = BrepWireframe(Brep=createhbzones.HBZone, Density=-1)

flip = Flip(Surface=createhbsrfs.HBSurface)  # -> Surface, Result
gentestpts = Honeybee_GenerateTestPoints(testGeometry=flip.Surface, gridSize=".5", distBaseSrf=".786", moveTestMesh=True)  # -> readMe, simplify(testPoints), simplify(ptsVectors), simplify(facesArea), simplify(mesh); plug-in component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
radparameters = Honeybee_RADParameters(quality=0)  # -> readMe, radParameters; plug-in component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
path = FilePath("C:\Users\naman\Desktop\Distribution\Philadelphia_weather_files\USA_PA_Philadelphia.Intl.AP.724080_TMY3.epw")
annualdaylightsimulation = Honeybee_AnnualDaylightSimulation(
    epwWeatherFile=path,
    testPoints=gentestpts.testPoints,
    ptsVectors=gentestpts.ptsVectors,
    radParameters=radparameters.radParameters)  # -> analysisRecipe; plug-in component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
item_2 = ListItem(List=gentestpts.testPoints, Index="35", Wrap=True)
toggle = BooleanToggle(True)
sph = Sphere(Base=item_2, Radius=Slider(0.1, range=0..0.1))
rundaylightanalysis = Honeybee_RunDaylightSimulation(
    HBObjects=flatten(createhbzones.HBZone),
    analysisRecipe=annualdaylightsimulation,
    writeRad=toggle,
    runRad=toggle,
    numOfCPUs=Slider(3, range=0..10),
    overwriteResults=True)  # -> readMe, analysisType, resultsUnit, results, testPts, annual_analysis_files, radGeoFile, studyFolder, done; plug-in component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
lightingcontrol = Honeybee_LightingControlRecipe(
    controlType="4",
    sensorPoints=item_2,
    lightingPower=250,
    lightingSetpoint=300,
    ballastLossFactor=20,
    standbyPower=3,
    delayTime=5)  # -> lightingControlGroup; plug-in component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
gethbzoneepschedules = Honeybee_GetZoneEnergyPlusSchedules(HBZone=createhbzones.HBZone)  # -> occupancySchedule, occupancyActivitySch, heatingSetPtSchedule, coolingSetPtSchedule, lightingSchedule, equipmentSchedule, infiltrationSchedule; plug-in component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
readannualresultsi = Honeybee_ReadAnnualResultI(
    illFilesAddress=rundaylightanalysis.annual_analysis_files,
    testPoints=simplify(rundaylightanalysis.testPts),
    occupancyFiles=gethbzoneepschedules.lightingSchedule,
    DLAIllumThresholds=300,
    lightingControlGroups=lightingcontrol,
    runIt=Toggle(True))  # -> DLA, UDLI_Less_100, UDLI_100_2000, UDLI_More_2000, CDA, sDA, annualProfiles, htmReport; plug-in component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
path_2 = FilePath("C:\Users\naman\Desktop\Distribution\Philadelphia_weather_files\USA_PA_Philadelphia.Intl.AP.724080_TMY3.epw")
dsannualprofiles = Honeybee_DaysimAnnualProfiles(annualProfiles=readannualresultsi.annualProfiles)  # -> simplify(occupancyProfile), simplify(shadingProfiles), simplify(lightingControlProfiles), simplify(dgpProfile); plug-in component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
convertepschvalues = Honeybee_ConvertEnergyPlusScheduleToValues(schName=gethbzoneepschedules.lightingSchedule, epwFileForHol=path_2)  # -> values, holidays; plug-in component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
_3dchart = Ladybug_3DChart(inputData=flatten([convertepschvalues.values, dsannualprofiles.lightingControlProfiles]), xScale=".12", zScale="0")  # -> readMe, graphMesh, graphCurves, legend, legendBasePts, title, titleBasePts, dataPts, conditionalHOY; plug-in component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

callfromepconstrlibrary = Honeybee_CallFromEPConstructionLibrary()  # -> ThermMaterials, EPMaterials, EPWindowMaterials, EPConstructions; plug-in component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
panel_2 = Panel("""0
1
2""")
searchepconstruction = Honeybee_SearchEPConstruction(EPConstrList=callfromepconstrlibrary.EPConstructions, standard="2", climateZone="4", surfaceType=panel_2)  # -> EPSelectedConstr; plug-in component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
item_3 = ListItem(List=searchepconstruction, Index=Slider(4, range=0..10), Wrap=True)  # -> flatten(Item), Item1, Item2, Item3
item_4 = ListItem(List=item_3.Item, Index=0, Wrap=True)  # -> Item, Item1, Item2

callfromepconstrlibrary_2 = Honeybee_CallFromEPConstructionLibrary()  # -> ThermMaterials, EPMaterials, EPWindowMaterials, EPConstructions; plug-in component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
searchepconstruction_2 = Honeybee_SearchEPConstruction(EPConstrList=callfromepconstrlibrary_2.EPConstructions, standard="2", climateZone="4", surfaceType="4")  # -> EPSelectedConstr; plug-in component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
item_5 = ListItem(List=searchepconstruction_2, Index="1", Wrap=True)  # -> flatten(Item), Item1, Item2, Item3
item_6 = ListItem(List=item_5.Item, Index=0, Wrap=True)  # -> Item, Item1, Item2, Item3

panel_3 = Panel(searchepconstruction_2)
decomposeepconstruction = Honeybee_DecomposeEPConstruction(cnstrName=panel_3)  # -> materials, comments, UValue_SI, UValue_IP, RValue_SI, RValue_IP; plug-in component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
panel_4 = Panel(decomposeepconstruction.UValue_SI)
panel_5 = Panel(decomposeepconstruction.materials)
panel_6 = Panel(item_6.Item)
setepzonecnstr = Honeybee_SetEPZoneConstruction(
    HBZones=flatten(createhbzones.HBZone),
    wallEPConstruction=item_4.Item,
    windowEPConstruction="NEW_WINDOW",
    roofEPConstruction=item_4.Item1,
    floorEPConstruction=item_4.Item2)  # -> simplify(modifiedHBZones); plug-in component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
zoneattributelist = Honeybee_ZoneAttributeList({"Name": "name", "Zone Program": "zoneProgram", "Zone Floor Area": "zoneFloorArea", "Zone Volume": "zoneVolume", "Building Program": "bldgProgram", "Is Conditioned": "isConditioned", "Occupancy Schedule": "occupancySchedule", "Occupancy Activity Schedule": "occupancyActivitySch", "Heating SetPoint Schedule": "heatingSetPtSchedule", "Cooling SetPoint Schedule": "coolingSetPtSchedule"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}, selected="Natural Ventilation": "natVent")

epglassmat = Honeybee_EnergyPlusGlassMaterial(
    name="single_wind",
    thickness="3",
    solarTransmittance=".6",
    solarReflectance=".4",
    visibleTransmittance=".5",
    visibleReflectance=".5",
    conductivity=".6")  # -> EPMaterial; plug-in component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

epwindowmat = Honeybee_EnergyPlusWindowMaterial(name="single", U_Value="2", SHGC=".3", VT=".6")  # -> EPMaterial; plug-in component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
epconstruction = Honeybee_EnergyPlusConstruction(name="SINGLE_PANE", layer_1=epwindowmat)  # -> EPConstruction; plug-in component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
toggle_2 = BooleanToggle(True)
addtoeplibrary = Honeybee_AddToEnergyPlusLibrary(EPObject=epconstruction, addToProjectLib=toggle_2, overwrite=toggle_2)  # -> readMe; plug-in component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
panel_7 = Panel(addtoeplibrary)

epwindowmat_2 = Honeybee_EnergyPlusWindowMaterial(name="single", U_Value="1.5", SHGC=".2", VT=".5")  # -> EPMaterial; plug-in component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
epconstruction_2 = Honeybee_EnergyPlusConstruction(name="double_paNE", layer_1=epwindowmat_2)  # -> EPConstruction; plug-in component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
toggle_3 = BooleanToggle(True)
addtoeplibrary_2 = Honeybee_AddToEnergyPlusLibrary(EPObject=epconstruction_2, addToProjectLib=toggle_3, overwrite=toggle_3)  # -> readMe; plug-in component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
panel_8 = Panel(addtoeplibrary_2)

epwindowmat_3 = Honeybee_EnergyPlusWindowMaterial(name="single", U_Value="1", SHGC=".1", VT=".6")  # -> EPMaterial; plug-in component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
epconstruction_3 = Honeybee_EnergyPlusConstruction(name="pANE", layer_1=epwindowmat_3)  # -> EPConstruction; plug-in component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
toggle_4 = BooleanToggle(True)
addtoeplibrary_3 = Honeybee_AddToEnergyPlusLibrary(EPObject=epconstruction_3, addToProjectLib=toggle_4, overwrite=toggle_4)  # -> readMe; plug-in component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
panel_9 = Panel(addtoeplibrary_3)

epwindowmat_4 = Honeybee_EnergyPlusWindowMaterial(name="single", U_Value="2.5", SHGC=".2", VT=".7")  # -> EPMaterial; plug-in component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
epconstruction_4 = Honeybee_EnergyPlusConstruction(name="PANE_SECOND", layer_1=epwindowmat_4)  # -> EPConstruction; plug-in component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
toggle_5 = BooleanToggle(True)
addtoeplibrary_4 = Honeybee_AddToEnergyPlusLibrary(EPObject=epconstruction_4, addToProjectLib=toggle_5, overwrite=toggle_5)  # -> readMe; plug-in component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
panel_10 = Panel(addtoeplibrary_4)

setepnatvent = Honeybee_SetEPAirFlow(
    HBZones=flatten(setepzonecnstr),
    naturalVentilationType="1",
    minIndoorTempForNatVent="24",
    maxIndoorTempForNatVent="38",
    maxOutdoorTempForNatVent="28")  # -> readMe, simplify(HBZones); plug-in component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
setepzoneloads = Honeybee_SetEnergyPlusZoneLoads(HBZones=setepnatvent.HBZones, equipmentLoadPerArea="2", infiltrationRatePerArea=".0003")  # -> loads, HBZones; plug-in component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

labelzones = Honeybee_LabelZones(HBZones=flatten(setepnatvent.HBZones), attribute=zoneattributelist)  # -> zoneTxtLabels, labelBasePts, brepTxtLabels, zoneWireFrames; plug-in component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

epconstruction_5 = Honeybee_EnergyPlusConstruction(name="new_window", layer_1=epglassmat)  # -> EPConstruction; plug-in component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
toggle_6 = BooleanToggle(True)
addtoeplibrary_5 = Honeybee_AddToEnergyPlusLibrary(EPObject=epconstruction_5, addToProjectLib=toggle_6, overwrite=toggle_6)  # -> readMe; plug-in component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
panel_11 = Panel(addtoeplibrary_5)

panel_12 = Panel("""1
1
1
1
1
1
0
0
0
0
0
0
0
0
0
0
0
0
1
1
1
0
0
1""")
panel_13 = Panel("""0
1
1
1
1
1
1
0
0
0
0
0
0
0
0
0
1
1
1
1
1
0
0
0""")
dup = DuplicateData(Data=panel_12, Number="5", Order=True)
dup_2 = DuplicateData(Data=panel_13, Number="2", Order=True)
data = Data([dup, dup_2])
dup_3 = DuplicateData(Data=data, Number="52", Order=True)  # -> flatten(Data)
data_2 = Data([dup_3, panel_12])
csvschedule = Honeybee_CreateCSVSchedule(values=data_2, writeFile=Toggle(True))  # -> readMe, csvSchedule; plug-in component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

path_3 = FilePath("C:\Users\naman\Desktop\Distribution\Philadelphia_weather_files\USA_PA_Philadelphia.Intl.AP.724080_TMY3.epw")
importepw = Ladybug_ImportEpw(epwFile=path_3)  # -> readMe, latitude, location, dryBulbTemperature, dewPointTemperature, relativeHumidity, windSpeed, windDirection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; plug-in component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

ach2m3_s_m2_calculator = HoneybeeInfORventPerAreaCalculator(HBZones=flatten(setepzoneloads.HBZones), airChangeHour="1")  # -> out, infORventPerArea, allFloors; plug-in component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
setepzoneloads_2 = Honeybee_SetEnergyPlusZoneLoads(HBZones=setepzoneloads.HBZones, numOfPeoplePerArea="0.12", ventilationPerArea=ach2m3_s_m2_calculator.infORventPerArea)  # -> loads, HBZones; plug-in component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

separatedata = Ladybug_SeparateData(inputList=flatten(importepw.dryBulbTemperature))  # -> numbers, strings; plug-in component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
larger = LargerThan(FirstNumber=separatedata.numbers, SecondNumber="18")  # -> LargerThan, OrEqualTo
int = Integer(larger.LargerThan)
csvschedule_2 = Honeybee_CreateCSVSchedule(values=int, scheduleName="infiltration_Schedule", writeFile=Toggle(True))  # -> readMe, csvSchedule; plug-in component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

setepzoneschedules = Honeybee_SetEnergyPlusZoneSchedules(
    HBZones=setepzoneloads.HBZones,
    occupancySchedules=csvschedule.csvSchedule,
    lightingSchedules=readannualresultsi.annualProfiles,
    infiltrationSchedules=csvschedule_2.csvSchedule)  # -> schedules, simplify(HBZones); plug-in component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

epoutput = Honeybee_GenerateEPOutput(zoneGainsAndLosses="False", zoneComfortMetrics=Toggle(True), surfaceTempAnalysis="False")  # -> report, flatten(simulationOutputs); plug-in component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

brep_2 = Brep([<brep referenced from the Rhino model> x11])
hb_epcontextsrf = HoneybeeEPContextSurfaces(shdSurfaces=flatten(brep_2))  # -> HBContext; inputs shdSurfaces: list of GeometryBase, justBoundingBox: Boolean
# ---------- hb_epcontextsrf: Python ----------
"""
prepare shading/context geometries

    Args:
        northVectorOrRotation: A vector that shows North or a number that shows
                               the rotation of the North from the Y axis
        bldgMasses: List of closed Breps as thermal zones.
    Returns:
        report: ...
        thermalZones: Thermal zone's geometries for visualiza
"""

ghenv.Component.Name = 'Honeybee EP context Surfaces'
ghenv.Component.NickName = 'HB_EPContextSrf'
ghenv.Component.Message = 'VER 0.0.60\nNOV_04_2016'
ghenv.Component.IconDisplayMode = ghenv.Component.IconDisplayMode.application
ghenv.Component.Category = "Honeybee"
ghenv.Component.SubCategory = "10 | Energy | Energy"
#compatibleHBVersion = VER 0.0.57\nNOV_04_2016
#compatibleLBVersion = VER 0.0.59\nFEB_01_2015
ghenv.Component.AdditionalHelpFromDocStrings = "2"

import rhinoscriptsyntax as rs
import Rhino as rc
import scriptcontext as sc
import os
import System
import Grasshopper.Kernel as gh
import uuid

tolerance = sc.doc.ModelAbsoluteTolerance
import math


def main(shdSurfaces, EPTransSchedule, meshingSettings, justBoundingBox):
    
    # import the classes
    if sc.sticky.has_key('honeybee_release'):

        try:
            if not sc.sticky['honeybee_release'].isCompatible(ghenv.Component): return -1
            if sc.sticky['honeybee_release'].isInputMissing(ghenv.Component): return -1
        except:
            warning = "You need a newer version of Honeybee to use this compoent." + \
            " Use updateHoneybee component to update userObjects.\n" + \
            "If you have already updated userObjects drag Honeybee_Honeybee component " + \
            "into canvas and try again."
            w = gh.GH_RuntimeMessageLevel.Warning
            ghenv.Component.AddRuntimeMessage(w, warning)
            return -1
        
        # don't customize this part
        hb_EPSrf = sc.sticky["honeybee_EPSurface"]
        hb_EPSHDSurface = sc.sticky["honeybee_EPShdSurface"]
        hb_RADMaterialAUX = sc.sticky["honeybee_RADMaterialAUX"]
        hb_EPObjectsAux = sc.sticky["honeybee_EPObjectsAUX"]()
        HBScheduleList = sc.sticky["honeybee_ScheduleLib"].keys()

        ########################################################################
        #----------------------------------------------------------------------#
        shdBreps = []
        # create bounding box of shading geometries
        if justBoundingBox:
            for brep in shdSurfaces:
                if brep.Faces.Count>1 or not brep.Faces[0].IsPlanar(sc.doc.ModelAbsoluteTolerance):
                    shdBreps.append(brep.GetBoundingBox(True).ToBrep())
                else:
                    shdBreps.append(brep)
        else:
            shdBreps = shdSurfaces
        
        shadingClasses = []
        shadingMeshPreview = []
        
        if meshingSettings == None:
            mp = rc.Geometry.MeshingParameters.Minimal
            mp.SimplePlanes = True
        else:
            mp = meshingSettings
        
        def getRadMaterialName(radMaterial):
            nameStr = radMaterial.split(" ")[2]
            name =  nameStr.split("\n")[0]
            return name
        
        for brepCount, brep in enumerate(shdBreps):
            if brep != None:
                isPlanar = True
                # check planarity
                for face in brep.Faces:
                    if not face.IsPlanar(tolerance):
                        isPlanar = False
                        break
                
                shadingBreps = []
                if not isPlanar:
                    meshArray = rc.Geometry.Mesh.CreateFromBrep(brep, mp)
                    for mesh in meshArray:
                        for meshFace in range(mesh.Faces.Count):
                            vertices = list(mesh.Faces.GetFaceVertices(meshFace))[1:]
                            vertices = vertices + [sc.doc.ModelAbsoluteTolerance]
                            # create the brep from mesh
                            shdBrep = rc.Geometry.Brep.CreateFromCornerPoints(*vertices)
                            shadingBreps.append(shdBrep)
                else:
                    for face in brep.Faces:
                        shadingBreps.append(face.DuplicateFace(False))
                
                for faceCount, shdBrep in enumerate(shadingBreps):
                        thisShading = hb_EPSHDSurface(shdBrep, 1000*brepCount + faceCount, 'shdSrf_' + `brepCount` + '_' + `faceCount` + "_" + str(uuid.uuid4()))
                        
                        # add transmittance schedule if any
                        if EPTransSchedule!=None:
                            schedule= EPTransSchedule.upper()
                            if schedule!=None and not schedule.lower().endswith(".csv") and schedule not in HBScheduleList:
                                msg = "Cannot find " + schedule + " in Honeybee schedule library."
                                print msg
                                ghenv.Component.AddRuntimeMessage(gh.GH_RuntimeMessageLevel.Warning, msg)
                                return -1
                            elif schedule!=None and schedule.lower().endswith(".csv"):
                                # check if csv file is existed
                                if not os.path.isfile(schedule):
                                    msg = "Cannot find the shchedule file: " + schedule
                                    print msg
                                    ghenv.Component.AddRuntimeMessage(gh.GH_RuntimeMessageLevel.Warning, msg)
                                    return -1
                            
                            thisShading.TransmittanceSCH = schedule
                        
                        # add the Rad Material if any
                        if RADMaterial!=None:
                            # if it is just the name of the material make sure it is already defined
                            if len(RADMaterial.split(" ")) == 1:
                                # if the material is not in the library add it to the library
                                if not hb_RADMaterialAUX.isMatrialExistInLibrary(RADMaterial):
                                    warningMsg = "Can't find " + RADMaterial + " in RAD Material Library.\n" + \
                                                "Add the material to the library and try again."
                                    ghenv.Component.AddRuntimeMessage(gh.GH_RuntimeMessageLevel.Warning, warningMsg)
                                    return
                                
                                try:
                                    thisShading.setRADMaterial(RADMaterial)
                                except Exception, e:
                                    print e
                                    warningMsg = "You are using an old version of Honeybee_Honeybee! Update your files and try again."
                                    print warningMsg
                                    ghenv.Component.AddRuntimeMessage(gh.GH_RuntimeMessageLevel.Warning, warningMsg)
                                    return
                                
                                addedToLib = True
                            else:
                                
                                # try to add the material to the library
                                addedToLib, thisShading.RadMaterial = hb_RADMaterialAUX.analyseRadMaterials(RADMaterial, True)
                                
                            if addedToLib==False:
                                warningMsg = "Failed to add " + RADMaterial + " to the Library."
                                ghenv.Component.AddRuntimeMessage(gh.GH_RuntimeMessageLevel.Warning, warningMsg)
                                return
                        
                        # add shading to the list
                        shadingClasses.append(thisShading)
                
        # add to the hive
        hb_hive = sc.sticky["honeybee_Hive"]()
        HBContext  = hb_hive.addToHoneybeeHive(shadingClasses, ghenv.Component)
        return HBContext
        ################################################################################################
    else:
        print "You should first let Honeybee to fly..."
        w = gh.GH_RuntimeMessageLevel.Warning
        ghenv.Component.AddRuntimeMessage(w, "You should first let Honeybee to fly...")
        return -1
        

if _shdSurfaces and _shdSurfaces[0]!=None:
    # add cleaning function
    result= main(_shdSurfaces, EPTransSchedule_, meshingSettings_, justBoundingBox_)
    
    if result != -1: HBContext = result
# ---------- end hb_epcontextsrf ----------

toggle_7 = BooleanToggle(True)
path_4 = FilePath("C:\Users\naman\Desktop\Distribution\Philadelphia_weather_files\USA_PA_Philadelphia.Intl.AP.724080_TMY3.epw")
runenergysimulation = Honeybee_RunEnergySimulation(
    epwFile=path_4,
    HBZones=flatten(setepzoneschedules.HBZones),
    HBContext=flatten(hb_epcontextsrf),
    simulationOutputs=flatten(epoutput.simulationOutputs),
    writeIdf=toggle_7,
    runEnergyPlus=toggle_7)  # -> report, idfFileAddress, htmlReport, resultFileAddress; plug-in component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
readepresult = Honeybee_ReadEPResult(resultFileAddress=runenergysimulation.resultFileAddress)  # -> port, port_2, port_3, port_4, port_5, port_6, port_7, port_8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; plug-in component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
importepw_2 = Ladybug_ImportEpw(epwFile=path_4)  # -> readMe, latitude, location, dryBulbTemperature, dewPointTemperature, relativeHumidity, windSpeed, windDirection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; plug-in component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
adaptivecomfortcalculator = Ladybug_AdaptiveComfortCalculator(
    dryBulbTemperature=readepresult.airTemperature,
    meanRadiantTemperature=readepresult.meanRadTemperature,
    prevailingOutdoorTemp=importepw_2.dryBulbTemperature,
    runIt=Toggle(True))  # -> readMe, port, comfortableOrNot, conditionOfPerson, degreesFromTarget, port_2, targetTemperature, upperTemperatureBound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; plug-in component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
panel_14 = Panel([adaptivecomfortcalculator.percentOfTimeComfortable, adaptivecomfortcalculator.percentHotCold])
gradientlibrary = Ladybug_GradientLibrary(gradIndex="0")  # -> customColors; plug-in component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
pt = Point(<point referenced from the Rhino model>)
adaptivechart = Ladybug_AdaptiveComfortChart(
    dryBulbTemperature=readepresult.airTemperature,
    meanRadiantTemperature=readepresult.meanRadTemperature,
    prevailingOutdoorTemp=importepw_2.dryBulbTemperature,
    windSpeed=importepw_2.windSpeed,
    basePoint=pt,
    runIt=Toggle(True))  # -> readMe, comfPercentOfTime, percentHotCold, comfortableOrNot, conditionOfPerson, degreesFromTarget, prevailingTemp, targetTemperature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; plug-in component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
legendpar = Ladybug_LegendParameters(numSegments="3", customColors=flatten(gradientlibrary))  # -> legendPar; plug-in component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
pt_2 = Point(<point referenced from the Rhino model>)
_3dchart_2 = Ladybug_3DChart(
    inputData=flatten(adaptivecomfortcalculator.conditionOfPerson),
    basePoint=pt_2,
    xScale=".25",
    zScale="0",
    legendPar=legendpar,
    bakeIt=Toggle(True))  # -> readMe, graphMesh, graphCurves, legend, legendBasePts, title, titleBasePts, dataPts, conditionalHOY; plug-in component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

pt_3 = Point(simplify(<point referenced from the Rhino model>))

# ----
# Visualization
toggle_8 = BooleanToggle(True)
epoutput_2 = Honeybee_GenerateEPOutput(
    zoneEnergyUse=toggle_8,
    zoneGainsAndLosses=toggle_8,
    zoneComfortMetrics="False",
    surfaceTempAnalysis="False",
    surfaceEnergyAnalysis=toggle_8)  # -> report, flatten(simulationOutputs); plug-in component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
toggle_9 = BooleanToggle(True)
path_5 = FilePath("C:\Users\naman\Desktop\Distribution\Philadelphia_weather_files\USA_PA_Philadelphia.Intl.AP.724080_TMY3.epw")

exporttoopenstudio = Honeybee_ExportToOpenStudio(
    epwWeatherFile=path_5,
    HBZones=flatten(setepzoneloads_2.HBZones),
    simulationOutputs=flatten(epoutput_2.simulationOutputs),
    writeOSM=toggle_9,
    runSimulation=toggle_9)  # -> readMe, osmFileAddress, idfFileAddress, resultFileAddress, eioFileAddress, rddFileAddress, htmlReport, studyFolder, model; plug-in component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
readepsrfresult = Honeybee_ReadEPSurfaceResult(resultFileAddress=exporttoopenstudio.resultFileAddress)  # -> port, port_2, surfaceEnergyFlow, opaqueEnergyFlow, glazEnergyFlow, port_3, port_4, port_5, port_6, port_7; plug-in component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
readepresult_2 = Honeybee_ReadEPResult(resultFileAddress=exporttoopenstudio.resultFileAddress)  # -> port, port_2, port_3, port_4, electricLight, electricEquip, fanElectric, port_5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; plug-in component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

energybalance = Honeybee_ConstructEnergyBalance(
    HBZones=flatten(setepzoneloads_2.HBZones),
    cooling=readepresult_2.port_3,
    heating=readepresult_2.port_4,
    electricLight=readepresult_2.electricLight,
    electricEquip=readepresult_2.electricEquip,
    fanElectric=readepresult_2.fanElectric,
    peopleGains=readepresult_2.peopleGains,
    totalSolarGain=readepresult_2.totalSolarGain,
    infiltrationEnergy=readepresult_2.infiltrationEnergy,
    mechVentilationEnergy=readepresult_2.port_6,
    natVentEnergy=readepresult_2.natVentEnergy,
    surfaceEnergyFlow=readepsrfresult.surfaceEnergyFlow)  # -> readMe, port, flrNormEnergyBal, flrNormBalWStorage, port_2, modelEnergyBalance, energyBalWithStorage; plug-in component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
gradientlibrary_2 = Ladybug_GradientLibrary(gradIndex="19")  # -> customColors; plug-in component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
legendpar_2 = Ladybug_LegendParameters(customColors=flatten(gradientlibrary_2))  # -> legendPar; plug-in component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

selectandaveragedata = Ladybug_AverageData(annualHourlyData=energybalance.flrNormBalWStorage, totalOrAverage=Toggle(True))  # -> readMe, selHourlyData, totaledDaily, totaledMonthly, totMonthlyPerHour, totAnalysisPeriod; plug-in component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
barchart = Ladybug_MonthlyBarChart(
    inputData=flatten(selectandaveragedata.totaledMonthly),
    stackValues=Toggle(True),
    altTitle="Room Energy Balance",
    altYAxisTitle="Energy (kWh)",
    basePoint=pt_3,
    legendPar=legendpar_2)  # -> readMe, dataMesh, dataCurves, dataCrvColors, graphAxes, graphLabels, title, titleBasePt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; plug-in component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

preview = CustomPreview(Geometry=barchart.graphAxes, Shader=ColourSwatch(SwatchColor=RGB(0, 0, 0)))
