# Grasshopper definition huang_weston.gh (Grasshopper 0.9.76)
# plug-ins: Python Interpreter, DIVA Daylight, Ironbug

brep = Brep([<brep referenced from the Rhino model> x5])

# ---- group: Ceiling
brep_2 = Brep(<brep referenced from the Rhino model>)

# ----
brep_3 = Brep([<brep referenced from the Rhino model> x5])

# ---- group: Wall
brep_4 = Brep([<brep referenced from the Rhino model> x2])

# ---- group: Floor
brep_5 = Brep(<brep referenced from the Rhino model>)

# ---- group: Shade
brep_6 = Brep([<brep referenced from the Rhino model> x15])

# ----
number_slider = Slider(0, range=0..100)

# ---- group: EPW
path = FilePath("E:\UPenn MEBD\USA_PA_Philadelphia.Intl.AP.724080_TMY3.epw")

# ---- group: Ceiling
brep_7 = Brep(<brep referenced from the Rhino model>)

# ---- group: Wall
brep_8 = Brep([<brep referenced from the Rhino model> x8])

# ---- group: Floor
brep_9 = Brep(<brep referenced from the Rhino model>)

# ---- group: Shade
brep_10 = Brep([<brep referenced from the Rhino model> x15])

# ---- group: Glass
brep_11 = Brep([<brep referenced from the Rhino model> x6])

# ----
ladybug = Ladybug_Ladybug()  # -> Vviiiiiiiiiizzz; plug-in component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
honeybee = Honeybee_Honeybee()  # -> Vviiiiiiiiiizzz; plug-in component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

# ---- group: EPW
path_2 = FilePath("E:\USA_PA_Philadelphia.Intl.AP.724080_TMY3.epw")

# ----
number_slider_2 = Slider(0, range=0..100)

# ---- group: Time
panel = Panel("12")
panel_2 = Panel("15")
panel_3 = Panel("21")

# ----
createhbsrfs = Honeybee_createHBSrfs(geometry=brep_2, srfType="3")  # -> readMe, simplify(HBSurface); plug-in component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
createhbsrfs_2 = Honeybee_createHBSrfs(geometry=brep_4, srfType="0")  # -> readMe, simplify(HBSurface); plug-in component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
createhbsrfs_3 = Honeybee_createHBSrfs(geometry=brep, srfType="0")  # -> readMe, simplify(HBSurface); plug-in component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
createhbsrfs_4 = Honeybee_createHBSrfs(geometry=brep_5, srfType="2")  # -> readMe, simplify(HBSurface); plug-in component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
bldgprograms = Honeybee_bldgPrograms({"Office": 0, "Retail": 1, "MidriseApartment": 2, "PrimarySchool": 3, "SecondarySchool": 4, "SmallHotel": 5, "LargeHotel": 6, "Hospital": 7, "Outpatient": 8, "Warehouse": 9, "SuperMarket": 10, "FullServiceRestaurant": 11, "QuickServiceRestaurant": 12}, selected="MidriseApartment")
hb_epcontextsrf = HoneybeeEPContextSurfaces(shdSurfaces=flatten(brep_6))  # -> HBContext; inputs shdSurfaces: list of GeometryBase, justBoundingBox: Boolean; disabled
# ---------- hb_epcontextsrf: Python ----------
"""
prepare shading/context geometries

    Args:
        northVectorOrRotation: A vector that shows North or a number that shows
                               the rotation of the North from the Y axis
        bldgMasses: List of closed Breps as thermal zones.
    Returns:
        report: ...
        thermalZones: Thermal zone's geometries for visualiza
"""

ghenv.Component.Name = 'Honeybee EP context Surfaces'
ghenv.Component.NickName = 'HB_EPContextSrf'
ghenv.Component.Message = 'VER 0.0.60\nNOV_04_2016'
ghenv.Component.IconDisplayMode = ghenv.Component.IconDisplayMode.application
ghenv.Component.Category = "Honeybee"
ghenv.Component.SubCategory = "10 | Energy | Energy"
#compatibleHBVersion = VER 0.0.57\nNOV_04_2016
#compatibleLBVersion = VER 0.0.59\nFEB_01_2015
ghenv.Component.AdditionalHelpFromDocStrings = "2"

import rhinoscriptsyntax as rs
import Rhino as rc
import scriptcontext as sc
import os
import System
import Grasshopper.Kernel as gh
import uuid

tolerance = sc.doc.ModelAbsoluteTolerance
import math


def main(shdSurfaces, EPTransSchedule, meshingSettings, justBoundingBox):
    
    # import the classes
    if sc.sticky.has_key('honeybee_release'):

        try:
            if not sc.sticky['honeybee_release'].isCompatible(ghenv.Component): return -1
            if sc.sticky['honeybee_release'].isInputMissing(ghenv.Component): return -1
        except:
            warning = "You need a newer version of Honeybee to use this compoent." + \
            " Use updateHoneybee component to update userObjects.\n" + \
            "If you have already updated userObjects drag Honeybee_Honeybee component " + \
            "into canvas and try again."
            w = gh.GH_RuntimeMessageLevel.Warning
            ghenv.Component.AddRuntimeMessage(w, warning)
            return -1
        
        # don't customize this part
        hb_EPSrf = sc.sticky["honeybee_EPSurface"]
        hb_EPSHDSurface = sc.sticky["honeybee_EPShdSurface"]
        hb_RADMaterialAUX = sc.sticky["honeybee_RADMaterialAUX"]
        hb_EPObjectsAux = sc.sticky["honeybee_EPObjectsAUX"]()
        HBScheduleList = sc.sticky["honeybee_ScheduleLib"].keys()

        ########################################################################
        #----------------------------------------------------------------------#
        shdBreps = []
        # create bounding box of shading geometries
        if justBoundingBox:
            for brep in shdSurfaces:
                if brep.Faces.Count>1 or not brep.Faces[0].IsPlanar(sc.doc.ModelAbsoluteTolerance):
                    shdBreps.append(brep.GetBoundingBox(True).ToBrep())
                else:
                    shdBreps.append(brep)
        else:
            shdBreps = shdSurfaces
        
        shadingClasses = []
        shadingMeshPreview = []
        
        if meshingSettings == None:
            mp = rc.Geometry.MeshingParameters.Minimal
            mp.SimplePlanes = True
        else:
            mp = meshingSettings
        
        def getRadMaterialName(radMaterial):
            nameStr = radMaterial.split(" ")[2]
            name =  nameStr.split("\n")[0]
            return name
        
        for brepCount, brep in enumerate(shdBreps):
            if brep != None:
                isPlanar = True
                # check planarity
                for face in brep.Faces:
                    if not face.IsPlanar(tolerance):
                        isPlanar = False
                        break
                
                shadingBreps = []
                if not isPlanar:
                    meshArray = rc.Geometry.Mesh.CreateFromBrep(brep, mp)
                    for mesh in meshArray:
                        for meshFace in range(mesh.Faces.Count):
                            vertices = list(mesh.Faces.GetFaceVertices(meshFace))[1:]
                            vertices = vertices + [sc.doc.ModelAbsoluteTolerance]
                            # create the brep from mesh
                            shdBrep = rc.Geometry.Brep.CreateFromCornerPoints(*vertices)
                            shadingBreps.append(shdBrep)
                else:
                    for face in brep.Faces:
                        shadingBreps.append(face.DuplicateFace(False))
                
                for faceCount, shdBrep in enumerate(shadingBreps):
                        thisShading = hb_EPSHDSurface(shdBrep, 1000*brepCount + faceCount, 'shdSrf_' + `brepCount` + '_' + `faceCount` + "_" + str(uuid.uuid4()))
                        
                        # add transmittance schedule if any
                        if EPTransSchedule!=None:
                            schedule= EPTransSchedule.upper()
                            if schedule!=None and not schedule.lower().endswith(".csv") and schedule not in HBScheduleList:
                                msg = "Cannot find " + schedule + " in Honeybee schedule library."
                                print msg
                                ghenv.Component.AddRuntimeMessage(gh.GH_RuntimeMessageLevel.Warning, msg)
                                return -1
                            elif schedule!=None and schedule.lower().endswith(".csv"):
                                # check if csv file is existed
                                if not os.path.isfile(schedule):
                                    msg = "Cannot find the shchedule file: " + schedule
                                    print msg
                                    ghenv.Component.AddRuntimeMessage(gh.GH_RuntimeMessageLevel.Warning, msg)
                                    return -1
                            
                            thisShading.TransmittanceSCH = schedule
                        
                        # add the Rad Material if any
                        if RADMaterial!=None:
                            # if it is just the name of the material make sure it is already defined
                            if len(RADMaterial.split(" ")) == 1:
                                # if the material is not in the library add it to the library
                                if not hb_RADMaterialAUX.isMatrialExistInLibrary(RADMaterial):
                                    warningMsg = "Can't find " + RADMaterial + " in RAD Material Library.\n" + \
                                                "Add the material to the library and try again."
                                    ghenv.Component.AddRuntimeMessage(gh.GH_RuntimeMessageLevel.Warning, warningMsg)
                                    return
                                
                                try:
                                    thisShading.setRADMaterial(RADMaterial)
                                except Exception, e:
                                    print e
                                    warningMsg = "You are using an old version of Honeybee_Honeybee! Update your files and try again."
                                    print warningMsg
                                    ghenv.Component.AddRuntimeMessage(gh.GH_RuntimeMessageLevel.Warning, warningMsg)
                                    return
                                
                                addedToLib = True
                            else:
                                
                                # try to add the material to the library
                                addedToLib, thisShading.RadMaterial = hb_RADMaterialAUX.analyseRadMaterials(RADMaterial, True)
                                
                            if addedToLib==False:
                                warningMsg = "Failed to add " + RADMaterial + " to the Library."
                                ghenv.Component.AddRuntimeMessage(gh.GH_RuntimeMessageLevel.Warning, warningMsg)
                                return
                        
                        # add shading to the list
                        shadingClasses.append(thisShading)
                
        # add to the hive
        hb_hive = sc.sticky["honeybee_Hive"]()
        HBContext  = hb_hive.addToHoneybeeHive(shadingClasses, ghenv.Component)
        return HBContext
        ################################################################################################
    else:
        print "You should first let Honeybee to fly..."
        w = gh.GH_RuntimeMessageLevel.Warning
        ghenv.Component.AddRuntimeMessage(w, "You should first let Honeybee to fly...")
        return -1
        

if _shdSurfaces and _shdSurfaces[0]!=None:
    # add cleaning function
    result= main(_shdSurfaces, EPTransSchedule_, meshingSettings_, justBoundingBox_)
    
    if result != -1: HBContext = result
# ---------- end hb_epcontextsrf ----------
importepw = Ladybug_ImportEpw(epwFile=path)  # -> readMe, latitude, location, dryBulbTemperature, dewPointTemperature, relativeHumidity, windSpeed, windDirection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; plug-in component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
northarrow = Ladybug_North(north=number_slider, scale=".05")  # -> northSign; plug-in component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
northarrow_2 = Ladybug_North(north=number_slider_2, scale=".05")  # -> northSign; plug-in component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
addhbglz = Honeybee_addHBGlz(HBObj=createhbsrfs_3.HBSurface, childSurfaces=flatten(brep_3))  # -> simplify(HBObjWGLZ); plug-in component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
radglassmaterial = Honeybee_RadianceGlassMaterial(materialName="glass_60", RTransmittance="0.6", GTransmittance="0.6", BTransmittance="0.6", refractiveIndex=1.52)  # -> avrgTrans, RADMaterial; plug-in component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
radopaquematerial = Honeybee_RadianceOpaqueMaterial(materialName="ceiling_80", RReflectance="0.8", GReflectance="0.8", BReflectance="0.8", roughness=0.05, specularity=0)  # -> avrgRef, RADMaterial; plug-in component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
radopaquematerial_2 = Honeybee_RadianceOpaqueMaterial(materialName="wall_50", RReflectance="0.5", GReflectance="0.5", BReflectance="0.5", roughness=0.05, specularity=0)  # -> avrgRef, RADMaterial; plug-in component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
radopaquematerial_3 = Honeybee_RadianceOpaqueMaterial(materialName="floor_20", RReflectance="0.2", GReflectance="0.2", BReflectance="0.2", roughness=0.05, specularity=0)  # -> avrgRef, RADMaterial; plug-in component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
radopaquematerial_4 = Honeybee_RadianceOpaqueMaterial(materialName="Shade_50", RReflectance="0.5", GReflectance="0.5", BReflectance="0.5", roughness=0.05, specularity=0)  # -> avrgRef, RADMaterial; plug-in component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
listzoneprograms = Honeybee_ListZonePrograms(bldgProgram=bldgprograms)  # -> MidriseApartmentZonePrograms; plug-in component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
makeadiabatic = Honeybee_MakeAdiabatic(HBSrfs=flatten([createhbsrfs.HBSurface, createhbsrfs_2.HBSurface, createhbsrfs_4.HBSurface]))  # -> HBSrfs; plug-in component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
genavgsky = Honeybee_GenerateAverageSky(north=number_slider, weatherFile=path, month=panel, hour=panel_2)  # -> radiationValues, skyFilePath; plug-in component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
genclimatebasedsky = Honeybee_GenerateClimateBasedSky(north=number_slider, weatherFile=path, month=panel, day=panel_3, hour=panel_2)  # -> radiationValues, skyFilePath; plug-in component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
doy_hoy = Ladybug_DOY_HOY(days=panel_3, months=panel, hours=panel_2)  # -> HOY, DOY, date; plug-in component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

# ---- group: Visualize Result
legendpar = Ladybug_LegendParameters(
    lowBound="0",
    highBound="30",
    numSegments="7",
    customColors=reverse(flatten([ColourSwatch(SwatchColor=RGB(255, 255, 255)), ColourSwatch(SwatchColor=RGB(0, 170, 255)), ColourSwatch(SwatchColor=RGB(0, 0, 0))])),
    legendLocation="100,10,0")  # -> legendPar; plug-in component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

# ----
gencumulativeskymtx = Ladybug_GenCumulativeSkyMtx(epwFile=path, skyDensity=0, useOldRes=True, runIt=Toggle(False))  # -> readMe, cumulativeSkyMtx; disabled; plug-in component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
selectskymtx = Ladybug_selectSkyMtx(cumulativeSkyMtx=gencumulativeskymtx.cumulativeSkyMtx, removeDiffuse=False, removeDirect=False)  # -> readMe, selectedSkyMtx; plug-in component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
toggle = BooleanToggle(False)
radiationanalysis = Ladybug_RadiationAnalysis(
    geometry=flatten(brep_11),
    gridSize="4",
    disFromBase=".01",
    selectedSkyMtx=flatten(selectskymtx.selectedSkyMtx),
    parallel=toggle,
    runIt=toggle)  # -> readMe, contextMesh, analysisMesh, testPts, testVec, port, radiationResult, radiationMesh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; plug-in component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

createhbsrfs_5 = Honeybee_createHBSrfs(geometry=brep_11, RADMaterial=radglassmaterial.RADMaterial)  # -> readMe, simplify(HBSurface); plug-in component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
createhbsrfs_6 = Honeybee_createHBSrfs(geometry=brep_7, RADMaterial=radopaquematerial.RADMaterial)  # -> readMe, simplify(HBSurface); plug-in component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
createhbsrfs_7 = Honeybee_createHBSrfs(geometry=brep_8, RADMaterial=radopaquematerial_2.RADMaterial)  # -> readMe, simplify(HBSurface); plug-in component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
createhbsrfs_8 = Honeybee_createHBSrfs(geometry=brep_9, RADMaterial=radopaquematerial_3.RADMaterial)  # -> readMe, simplify(HBSurface); plug-in component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
createhbsrfs_9 = Honeybee_createHBSrfs(geometry=brep_10, RADMaterial=radopaquematerial_4.RADMaterial)  # -> readMe, simplify(HBSurface); disabled; plug-in component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
panel_4 = Panel("a>28")
brep_12 = Brep(flatten([makeadiabatic, addhbglz]))
importepw_2 = Ladybug_ImportEpw(epwFile=path_2)  # -> readMe, latitude, location, dryBulbTemperature, dewPointTemperature, relativeHumidity, windSpeed, windDirection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; plug-in component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
item = ListItem(List=listzoneprograms, Index=0, Wrap=True)
wires = BrepWireframe(Brep=brep_12, Density=-1)

# ---- group: Sun Path
analysisperiod = Ladybug_AnalysisPeriod(fromMonth="1", toMonth="12")  # -> readMe, analysisPeriod; plug-in component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
panel_5 = Panel("a>28 and b>80")
series = Series(Start="1", Step=1, Count="24")
sunpath = Ladybug_SunPath(
    north=number_slider,
    location=importepw.location,
    hour=12,
    day=21,
    month=12,
    timeStep=1,
    analysisPeriod=analysisperiod.analysisPeriod,
    sunPathScale=Slider(0.3, range=0..3),
    sunScale=Slider(0.3, range=0..3),
    projection="1",
    annualHourlyData=flatten(importepw.dryBulbTemperature),
    legendPar=legendpar,
    dailyOrAnnualSunPath=True)  # -> readMe, sunVectors, sunAltitudes, sunAzimuths, port, sunSpheresMesh, sunPathCrvs, compassCrvs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; plug-in component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
Z = UnitZ(Factor=Slider(30, range=0..100))
mesh = Mesh(sunpath.sunSpheresMesh)
geo = Geometry([sunpath.legend, sunpath.sunPathCrvs, sunpath.title])
move = Move(Geometry=sunpath.sunPositions, Motion=Z)  # -> Geometry, Transform
ln = Line(StartPoint=sunpath.sunPathCenPts, EndPoint=sunpath.sunPositions)
preview = CustomPreview(Geometry=geo, Shader=ColourSwatch(SwatchColor=RGB(194, 188, 188)))
tag = TextTag(Location=move.Geometry, Text=sunpath.sunPositionsInfo)  # disabled
preview_2 = CustomPreview(Geometry=[ln, mesh], Shader=ColourSwatch(SwatchColor=RGB(255, 255, 0)))  # disabled

# ----
createhbzones = Honeybee_createHBZones(name="Weston_room", zoneProgram=item, HBSurfaces=flatten(brep_12), isConditioned=Toggle(False))  # -> readMe, HBZone; plug-in component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
panel_6 = Panel("3737_Chestnut")
brep_13 = Brep(flatten([createhbsrfs_5.HBSurface, createhbsrfs_9.HBSurface, createhbsrfs_6.HBSurface, createhbsrfs_7.HBSurface, createhbsrfs_8.HBSurface]))

# ---- group: Glare
radparameters = Honeybee_RADParameters(quality=0, ab="3")  # -> readMe, radParameters; plug-in component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
imagebasedsimulation = Honeybee_ImageBasedSimulation(
    skyFile=genavgsky.skyFilePath,
    cameraType="1",
    simulationType=2,
    radParameters=radparameters.radParameters,
    backupImages=0)  # -> analysisRecipe; plug-in component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
toggle_2 = BooleanToggle(False)
rundaylightanalysis = Honeybee_RunDaylightSimulation(
    HBObjects=flatten(brep_13),
    analysisRecipe=imagebasedsimulation,
    writeRad=toggle_2,
    runRad=toggle_2,
    numOfCPUs="4",
    radFileName=doy_hoy.date,
    overwriteResults=True)  # -> readMe, analysisType, resultsUnit, results, testPts, resultFiles, radGeoFile, studyFolder, done; plug-in component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
glareanalysis = Honeybee_GlareAnalysis(HDRImagePath=rundaylightanalysis.resultFiles, runIt=Toggle(True))  # -> readMe, glareCheckImage, DGP, DGI, glareComfortRange, imageWithTaskArea; plug-in component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
falsecolor = Honeybee_FalseColor(
    HDRFilePath=rundaylightanalysis.resultFiles,
    contourBands=False,
    maskThreshold=0.1,
    useAlterColors=False,
    render=Toggle(False))  # -> outputFilePath; plug-in component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
hdr_gif = Honeybee_ConvertHDRToGIF(HDRFilePath=falsecolor, adjustExposure=False)  # -> GIFFilePath; plug-in component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
hdr_gif_2 = Honeybee_ConvertHDRToGIF(HDRFilePath=glareanalysis.glareCheckImage, adjustExposure=Toggle(True))  # -> GIFFilePath; plug-in component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
panel_7 = Panel(glareanalysis.DGP)
number_slider_3 = Slider(0.8, range=0..1)
viewer = Ladybug_ImageViewer(ImagePath_=hdr_gif_2, _scale_=number_slider_3, DisableClickable=False, SaveImgWithCoords=False, scale=0.8)  # -> ImagePath, Colors, GIF
viewer_2 = Ladybug_ImageViewer(ImagePath_=number_slider_3, _scale_=hdr_gif, DisableClickable=False, SaveImgWithCoords=False, scale=1)  # -> ImagePath, Colors, GIF

# ----
epwindowairgap = Honeybee_EnergyPlusWindowAirGap(thickness="0.9")  # -> EPMaterial; plug-in component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
epglassmat = Honeybee_EnergyPlusGlassMaterial(
    name="Low_E",
    thickness="0.01",
    solarTransmittance="0.55",
    solarReflectance="0.05",
    visibleTransmittance="0.49",
    visibleReflectance="0.05",
    frontEmissivity="0.2",
    backEmissivity="0.2")  # -> EPMaterial; plug-in component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
epwindowairgap_2 = Honeybee_EnergyPlusWindowAirGap()  # -> EPMaterial; plug-in component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
epconstruction = Honeybee_EnergyPlusConstruction(
    name="Window_modify",
    layer_1=epglassmat,
    layer_2=epwindowairgap_2,
    layer_3=epglassmat,
    layer_4=epwindowairgap,
    layer_5=epglassmat,
    layer_6=epwindowairgap_2,
    layer_7=epglassmat)  # -> EPConstruction; plug-in component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

flip = Flip()  # -> Surface, Result
item_2 = ListItem(List=brep_9, Index=0, Wrap=True)

epglassmat_2 = Honeybee_EnergyPlusGlassMaterial(
    name="Low_E",
    thickness="0.01",
    solarTransmittance="0.55",
    solarReflectance="0.05",
    visibleTransmittance="0.49",
    visibleReflectance="0.05",
    frontEmissivity="0.2",
    backEmissivity="0.2")  # -> EPMaterial; plug-in component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
epwindowairgap_3 = Honeybee_EnergyPlusWindowAirGap()  # -> EPMaterial; plug-in component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
epconstruction_2 = Honeybee_EnergyPlusConstruction(name="Window_original", layer_1=epglassmat_2, layer_2=epwindowairgap_3, layer_3=epglassmat_2)  # -> EPConstruction; plug-in component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

wires_2 = BrepWireframe(Brep=brep_13, Density=-1)
gentestpts = Honeybee_GenerateTestPoints(testGeometry=item_2, gridSize="0.5", distBaseSrf="0.3", moveTestMesh=True)  # -> readMe, simplify(testPoints), simplify(ptsVectors), simplify(facesArea), simplify(mesh); plug-in component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
radparameters_2 = Honeybee_RADParameters(quality=0, ab="3")  # -> readMe, radParameters; plug-in component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
epopaquemat = Honeybee_EnergyPlusOpaqueMaterial(name="Concrete", thickness="0.2", conductivity="0.1", density="2400", specificHeat="960")  # -> EPMaterial; plug-in component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
epconstruction_3 = Honeybee_EnergyPlusConstruction(name="Wall", layer_1=epopaquemat)  # -> EPConstruction; plug-in component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

# ---- group: Day Simulation
gridbasedsimulation = Honeybee_GridBasedSimulation(
    skyFile=genclimatebasedsky.skyFilePath,
    testPoints=gentestpts.testPoints,
    ptsVectors=gentestpts.ptsVectors,
    testMesh=gentestpts.mesh,
    simulationType=0,
    radParameters=radparameters_2.radParameters)  # -> analysisRecipe; disabled; plug-in component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
toggle_3 = BooleanToggle(False)
rundaylightanalysis_2 = Honeybee_RunDaylightSimulation(
    HBObjects=flatten(brep_13),
    analysisRecipe=gridbasedsimulation,
    writeRad=toggle_3,
    runRad=toggle_3,
    overwriteResults=True)  # -> readMe, analysisType, resultsUnit, results, testPts, resultFiles, radGeoFile, studyFolder, done; plug-in component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
tag_2 = TextTag3D(Location=rundaylightanalysis_2.testPts, Text=rundaylightanalysis_2.results, Size=1, Justification=7)

# ---- group: Image
imagebasedsimulation_2 = Honeybee_ImageBasedSimulation(skyFile=genclimatebasedsky.skyFilePath, simulationType=2, backupImages=0)  # -> analysisRecipe; disabled; plug-in component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
toggle_4 = BooleanToggle(False)
rundaylightanalysis_3 = Honeybee_RunDaylightSimulation(
    HBObjects=flatten(brep_13),
    analysisRecipe=imagebasedsimulation_2,
    writeRad=toggle_4,
    runRad=toggle_4,
    overwriteResults=True)  # -> readMe, analysisType, resultsUnit, results, testPts, resultFiles, radGeoFile, studyFolder, done; disabled; plug-in component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
hdr_tif = Honeybee_ConvertHDRToTIF(HDRFilePath=rundaylightanalysis_3.resultFiles, adjustExposure=Toggle(True))  # -> TIFFFilePath; plug-in component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
image_viewer = ImageViewer(
    ImagePath=hdr_tif,
    Scale=Slider(0.4, range=0..1),
    enable_regions=False,
    save_tags=False,
    show_max=False,
    show_min=False,
    tag_size=-1)

# ---- group: Annual Simulation
annualdaylightsimulation = Honeybee_AnnualDaylightSimulation(epwWeatherFile=path, testPoints=gentestpts.testPoints, ptsVectors=gentestpts.ptsVectors)  # -> analysisRecipe; disabled; plug-in component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
toggle_5 = BooleanToggle(False)
occupancygenerator = Honeybee_DaysimOccupancyGenerator(weekendDays=[1, 2], writeTheOcc=Toggle(True))  # -> occupancyFile; plug-in component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
rundaylightanalysis_4 = Honeybee_RunDaylightSimulation(
    HBObjects=flatten(brep_13),
    analysisRecipe=annualdaylightsimulation,
    writeRad=toggle_5,
    runRad=toggle_5,
    overwriteResults=True)  # -> readMe, analysisType, resultsUnit, results, testPts, resultFiles, radGeoFile, studyFolder, done; plug-in component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
readannualresultsi = Honeybee_ReadAnnualResultI(
    illFilesAddress=rundaylightanalysis_4.resultFiles,
    testPoints=simplify(rundaylightanalysis_4.testPts),
    DLAIllumThresholds=300,
    runIt=Toggle(True))  # -> DLA, UDLI_Less_100, UDLI_100_2000, UDLI_More_2000, CDA, sDA, annualProfiles, htmReport; plug-in component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

# ---- group: Shading Designer
brep_glass = Brep([<brep referenced from the Rhino model> x6])  # disabled
brep_shade = Brep(<brep referenced from the Rhino model>)  # disabled
number_slider_4 = Slider(4, range=0..10)
wires_3 = BrepWireframe(Brep=brep_shade, Density=-1)
smesh = SimpleMesh(Brep=brep_shade)
mjoin = MeshJoin(Meshes=smesh)
debrep = DeconstructBrep(Brep=brep_glass)  # -> Faces, Edges, Vertices
ext = ExtendCurve(Curve=wires_3, Type=0, Start=number_slider_4, End=number_slider_4)
preview_3 = CustomPreview(Geometry=brep_glass, Shader=ColourSwatch(SwatchColor=RGB(0, 170, 255)))
rev = Reverse(Vector=sunpath.sunVectors)
preview_4 = CustomPreview(Geometry=ext, Shader=ColourSwatch(SwatchColor=RGB(0, 0, 0)))
preview_5 = CustomPreview(Geometry=brep_shade, Shader=ColourSwatch(SwatchColor=RGB(255, 255, 255)))
meshray = MeshRay(Mesh=mjoin, Point=debrep.Vertices, Direction=rev)  # -> Point, Hit
ma = MassAddition(Input=meshray.Hit)  # -> Result, PartialResults
smaller = SmallerThan(FirstNumber=ma.Result, SecondNumber="4")  # -> SmallerThan, OrEqualTo
dispatch = Dispatch(List=sunpath.sunVectors, DispatchPattern=smaller.SmallerThan)  # -> ListA, ListB
dispatch_2 = Dispatch(List=sunpath.selHourlyData, DispatchPattern=smaller.SmallerThan)  # -> ListA, ListB
bnd = Bounds(Numbers=dispatch_2.ListA)
remap = RemapNumbers(Value=dispatch_2.ListA, Source=bnd, Target=Domain(0, 1))  # -> Mapped, Clipped
gradient = Gradient(
    LowerLimit=0,
    UpperLimit=1,
    Parameter=remap.Mapped,
    stops=[0: RGB(234, 38, 0), 0.25: RGB(234, 126, 0), 0.5: RGB(254, 244, 84), 0.75: RGB(173, 203, 249), 1: RGB(75, 107, 169)])
shddesigner = Ladybug_ShadingDesigner(glzSrf=flatten(brep_glass), depthOrVector=flatten(dispatch.ListA), numOfShds="1", runIt=Toggle(True), mergeVectors=False)  # -> readMe, shadingSrfs; disabled; plug-in component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
material = CreateMaterial(Diffuse=gradient, Specular=RGB(255, 255, 255), Emission=RGB(0, 0, 0), Transparency=Slider(0.8, range=0..1), Shine=0)
preview_6 = CustomPreview(Geometry=shddesigner.shadingSrfs, Shader=material)

# ----
setepzonecnstr = Honeybee_SetEPZoneConstruction(HBZones=flatten(createhbzones.HBZone), windowEPConstruction=epconstruction_2)  # -> simplify(modifiedHBZones); plug-in component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
setepzoneintcnstr = Honeybee_SetEPZoneInteriorConstruction(HBZones=setepzonecnstr)  # -> simplify(modifiedHBZones); plug-in component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
setepnatvent = Honeybee_SetEPAirFlow(
    HBZones=flatten(setepzonecnstr),
    naturalVentilationType="1",
    minIndoorTempForNatVent="34",
    fractionOfGlzAreaOperable="0.9")  # -> readMe, simplify(HBZones); plug-in component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
epoutput = Honeybee_GenerateEPOutput(zoneGainsAndLosses="False", zoneComfortMetrics=Toggle(True), surfaceTempAnalysis="False")  # -> report, flatten(simulationOutputs); plug-in component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
setepsrfcnstr = Honeybee_SetEPSurfaceConstruction()  # -> readMe, HBSurface; plug-in component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

# ---- group: Visualize Result
legendpar_2 = Ladybug_LegendParameters(
    lowBound="0",
    highBound="90",
    numSegments="10",
    customColors=reverse(flatten([ColourSwatch(SwatchColor=RGB(255, 255, 255)), ColourSwatch(SwatchColor=RGB(0, 170, 255)), ColourSwatch(SwatchColor=RGB(0, 0, 0))])),
    legendLocation="3,10,0")  # -> legendPar; plug-in component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
recolormesh = Ladybug_RecolorMesh(
    analysisResult=readannualresultsi.UDLI_100_2000,
    inputMesh=gentestpts.mesh,
    legendPar=legendpar_2,
    analysisTitle="Daylight Autonomy",
    legendTitle="%")  # -> readMe, newMesh, newLegend, legendBasePt, meshColors, legendColors; plug-in component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

legendpar_3 = Ladybug_LegendParameters(
    lowBound="0",
    highBound="2100",
    numSegments="8",
    customColors=reverse(flatten([ColourSwatch(SwatchColor=RGB(255, 255, 255)), ColourSwatch(SwatchColor=RGB(0, 170, 255)), ColourSwatch(SwatchColor=RGB(0, 0, 0))])),
    legendLocation="3,10,0")  # -> legendPar; plug-in component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
recolormesh_2 = Ladybug_RecolorMesh(
    analysisResult=rundaylightanalysis_2.results,
    inputMesh=gentestpts.mesh,
    legendPar=legendpar_3,
    analysisTitle="Illuminance",
    legendTitle="Lux")  # -> readMe, newMesh, newLegend, legendBasePt, meshColors, legendColors; plug-in component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

# ----
toggle_6 = BooleanToggle(True)
runenergysimulation = Honeybee_RunEnergySimulation(
    north=number_slider_2,
    epwFile=path_2,
    HBZones=flatten(setepnatvent.HBZones),
    HBContext=flatten(hb_epcontextsrf),
    simulationOutputs=flatten(epoutput.simulationOutputs),
    writeIdf=toggle_6,
    runEnergyPlus=toggle_6)  # -> report, idfFileAddress, htmlReport, resultFileAddress; plug-in component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
readepresult = Honeybee_ReadEPResult(resultFileAddress=runenergysimulation.resultFileAddress)  # -> port, port_2, port_3, port_4, port_5, port_6, port_7, port_8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; plug-in component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

# ---- group: Target Temp
legendpar_4 = Ladybug_LegendParameters(
    lowBound="-6",
    highBound="8",
    numSegments="8",
    customColors=flatten([ColourSwatch(SwatchColor=RGB(255, 255, 255)), ColourSwatch(SwatchColor=RGB(0, 170, 255)), ColourSwatch(SwatchColor=RGB(0, 0, 0))]),
    legendLocation="-120,-80,0")  # -> legendPar; plug-in component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

# ---- group: Comfort
legendpar_5 = Ladybug_LegendParameters(
    lowBound="-1",
    highBound="1",
    numSegments="3",
    customColors=flatten([ColourSwatch(SwatchColor=RGB(255, 255, 255)), ColourSwatch(SwatchColor=RGB(0, 170, 255)), ColourSwatch(SwatchColor=RGB(0, 0, 0))]),
    legendLocation="500,-80,0")  # -> legendPar; plug-in component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

# ----
barchart = Ladybug_MonthlyBarChart(
    inputData=flatten([readepresult.port_3, readepresult.port_4]),
    stackValues=Toggle(True),
    altYAxisTitle="Cooling and Heating Loads",
    basePoint="0, 0, 0",
    xScale=Slider(0.5, range=0..1),
    yScale=Slider(0.7, range=0..1))  # -> readMe, dataMesh, dataCurves, dataCrvColors, graphAxes, graphLabels, title, titleBasePt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; plug-in component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
adaptivecomfortcalculator = Ladybug_AdaptiveComfortCalculator(
    dryBulbTemperature=readepresult.airTemperature,
    meanRadiantTemperature=readepresult.meanRadTemperature,
    prevailingOutdoorTemp=importepw_2.dryBulbTemperature,
    runIt=Toggle(True))  # -> readMe, port, comfortableOrNot, conditionOfPerson, degreesFromTarget, port_2, targetTemperature, upperTemperatureBound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; plug-in component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
strnum = Ladybug_SeparateData(inputList=flatten(readepresult.port_3))  # -> numbers, strings; plug-in component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
strnum_2 = Ladybug_SeparateData(inputList=flatten(readepresult.port_4))  # -> numbers, strings; plug-in component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
ma_2 = MassAddition(Input=strnum_2.numbers)  # -> Result, PartialResults
ma_3 = MassAddition(Input=strnum.numbers)  # -> Result, PartialResults
total_heating = Panel(ma_2.Result)
total_cooling = Panel(ma_3.Result)
panel_8 = Panel([adaptivecomfortcalculator.percentOfTimeComfortable, adaptivecomfortcalculator.percentHotCold])
_3dchart = Ladybug_3DChart(
    inputData=flatten(adaptivecomfortcalculator.conditionOfPerson),
    xScale="0.2",
    zScale="0",
    legendPar=legendpar_5,
    bakeIt="2")  # -> readMe, graphMesh, graphCurves, legend, legendBasePts, title, titleBasePts, dataPts, conditionalHOY; plug-in component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

importepw_3 = Ladybug_ImportEpw(epwFile=path)  # -> readMe, latitude, location, dryBulbTemperature, dewPointTemperature, relativeHumidity, windSpeed, windDirection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; plug-in component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
solaradjusttemperature = Ladybug_OutdoorSolarTemperatureAdjustor(
    location=importepw_3.location,
    cumSkyMtxOrDirNormRad=importepw_3.directNormalRadiation,
    diffuseHorizRad=importepw_3.diffuseHorizontalRadiation,
    baseTemperature=importepw_3.dryBulbTemperature,
    horizInfraredRad=importepw_3.horizontalInfraredRadiation,
    runIt=Toggle(True))  # -> readMe, port, effectiveRadiantField, MRTDelta, solarAdjustedMRT, port_2, mannequinMesh, port_3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; plug-in component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
outdoorcomfortcalculator = Ladybug_OutdoorComfortCalculator(
    dryBulbTemperature=importepw_3.dryBulbTemperature,
    meanRadiantTemperature=solaradjusttemperature.solarAdjustedMRT,
    windSpeed_tenMeters=importepw_3.windSpeed,
    relativeHumidity=importepw_3.relativeHumidity,
    runIt=Toggle(True))  # -> readMe, port, universalThermalClimateIndex, comfortableOrNot, thermalStress, conditionOfPerson, port_2, percentOfTimeComfortable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; plug-in component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
panel_9 = Panel([outdoorcomfortcalculator.percentOfTimeComfortable, outdoorcomfortcalculator.percentComfForShortPeriod, outdoorcomfortcalculator.percentHeatStress, outdoorcomfortcalculator.percentColdStress])

# ---- group: Visualize Result
panel_10 = Panel("10")
panel_11 = Panel("5")
panel_12 = Panel("32")
swatch = ColourSwatch(SwatchColor=RGB(255, 255, 255))
legendpar_6 = Ladybug_LegendParameters(
    lowBound="-1",
    highBound="1",
    numSegments="3",
    customColors=flatten([ColourSwatch(SwatchColor=RGB(255, 255, 255)), ColourSwatch(SwatchColor=RGB(0, 170, 255)), ColourSwatch(SwatchColor=RGB(0, 0, 0))]),
    legendLocation="400,-80,0")  # -> legendPar; plug-in component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

# ----
_3dchart_2 = Ladybug_3DChart(inputData=flatten(outdoorcomfortcalculator.thermalStress), xScale="0.2", zScale="0", legendPar=legendpar_6)  # -> readMe, graphMesh, graphCurves, legend, legendBasePts, title, titleBasePts, dataPts, conditionalHOY; plug-in component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
