# Grasshopper definition hwang_youngjin_gh.gh (Grasshopper 0.9.76)
# plug-ins: Python Interpreter

ladybug = Ladybug_Ladybug()  # -> Vviiiiiiiiiizzz; plug-in component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
honeybee = Honeybee_Honeybee()  # -> Vviiiiiiiiiizzz; plug-in component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
callfromepconstrlibrary = Honeybee_CallFromEPConstructionLibrary()  # -> ThermMaterials, EPMaterials, EPWindowMaterials, EPConstructions; plug-in component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
panel = Panel(honeybee)
panel_2 = Panel(callfromepconstrlibrary.EPConstructions)

# ----
# Window material
panel_3 = Panel("low_e_double_glazing")
epwindowmat = Honeybee_EnergyPlusWindowMaterial(name=panel_3, U_Value="0.5", SHGC="0.37", VT="0.56")  # -> EPMaterial; plug-in component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
epconstruction = Honeybee_EnergyPlusConstruction(name="low_e_double_glazing", layer_1=epwindowmat)  # -> EPConstruction; plug-in component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

# ----
# wall material
callfromepconstrlibrary_2 = Honeybee_CallFromEPConstructionLibrary()  # -> ThermMaterials, EPMaterials, EPWindowMaterials, EPConstructions; plug-in component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
searchepconstruction = Honeybee_SearchEPConstruction(EPConstrList=callfromepconstrlibrary_2.EPConstructions, standard="2", surfaceType="0")  # -> EPSelectedConstr; plug-in component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
panel_4 = Panel(searchepconstruction)
decomposeepconstruction = Honeybee_DecomposeEPConstruction(cnstrName=searchepconstruction)  # -> materials, comments, UValue_SI, UValue_IP, RValue_SI, RValue_IP; plug-in component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
panel_5 = Panel(decomposeepconstruction.RValue_SI)
sort = SortList(Keys=panel_5, ValuesA=panel_4)  # -> Keys, ValuesA
rev = ReverseList(List=sort.ValuesA)
panel_6 = Panel(sort.Keys)
item = ListItem(List=rev, Index=0, Wrap=True)

captureview = Ladybug_CaptureView(
    fileName="INDOOR_RH",
    folder="C:\Users\himyn\Desktop\source",
    viewNames="TOP",
    imageWidth="3200",
    imageHeight="1600",
    transparBack=Toggle(True),
    capture=Toggle(False))  # -> imagePath; plug-in component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
panel_7 = Panel(captureview)

# ----
# creating surface
# CEILING
# INTFLOOR
# INTWALL
# EXTWALL
wall_non_exposed = Brep([<brep referenced from the Rhino model> x2])
exterior_wall = Brep([<brep referenced from the Rhino model> x2])
ceiling = Brep(<brep referenced from the Rhino model>)
floor = Brep(<brep referenced from the Rhino model>)
createhbsrfs = Honeybee_createHBSrfs(geometry=ceiling, srfType="3")  # -> readMe, simplify(HBSurface); plug-in component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
createhbsrfs_2 = Honeybee_createHBSrfs(geometry=floor, srfType="2")  # -> readMe, simplify(HBSurface); plug-in component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
createhbsrfs_3 = Honeybee_createHBSrfs(geometry=wall_non_exposed, srfType="0")  # -> readMe, simplify(HBSurface); plug-in component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
createhbsrfs_4 = Honeybee_createHBSrfs(geometry=exterior_wall, srfType="0", EPConstruction=item)  # -> readMe, simplify(HBSurface); plug-in component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
window = Brep(flatten([<brep referenced from the Rhino model> x5]))
makeadiabatic = Honeybee_MakeAdiabatic(HBSrfs=flatten([createhbsrfs.HBSurface, createhbsrfs_2.HBSurface, createhbsrfs_3.HBSurface]))  # -> HBSrfs; plug-in component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
addhbglz = Honeybee_addHBGlz(HBObj=createhbsrfs_4.HBSurface, childSurfaces=flatten(window), EPConstructions=epconstruction)  # -> HBObjWGLZ; plug-in component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

gradientlibrary = Ladybug_GradientLibrary(gradIndex="6")  # -> customColors; plug-in component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
legendpar = Ladybug_LegendParameters(
    lowBound="0",
    highBound="100",
    numSegments="11",
    customColors=flatten(gradientlibrary),
    font="century gothic",
    fontSize="9")  # -> legendPar; plug-in component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

# ----
# shading context
shading = Brep([<brep referenced from the Rhino model> x12])
hb_epcontextsrf = HoneybeeEPContextSurfaces(shdSurfaces=flatten(shading))  # -> HBContext; inputs shdSurfaces: list of Brep, justBoundingBox: Boolean
# ---------- hb_epcontextsrf: Python ----------
"""
prepare shading/context geometries

    Args:
        northVectorOrRotation: A vector that shows North or a number that shows
                               the rotation of the North from the Y axis
        bldgMasses: List of closed Breps as thermal zones.
    Returns:
        report: ...
        thermalZones: Thermal zone's geometries for visualiza
"""

ghenv.Component.Name = 'Honeybee EP context Surfaces'
ghenv.Component.NickName = 'HB_EPContextSrf'
ghenv.Component.Message = 'VER 0.0.62\nJUL_28_2017'
ghenv.Component.IconDisplayMode = ghenv.Component.IconDisplayMode.application
ghenv.Component.Category = "Honeybee"
ghenv.Component.SubCategory = "10 | Energy | Energy"
#compatibleHBVersion = VER 0.0.57\nNOV_04_2016
#compatibleLBVersion = VER 0.0.59\nFEB_01_2015
ghenv.Component.AdditionalHelpFromDocStrings = "2"

import rhinoscriptsyntax as rs
import Rhino as rc
import scriptcontext as sc
import os
import System
import Grasshopper.Kernel as gh
import uuid

tolerance = sc.doc.ModelAbsoluteTolerance
import math


def main(shdSurfaces, EPTransSchedule, meshingSettings, justBoundingBox):
    
    # import the classes
    if sc.sticky.has_key('honeybee_release'):

        try:
            if not sc.sticky['honeybee_release'].isCompatible(ghenv.Component): return -1
            if sc.sticky['honeybee_release'].isInputMissing(ghenv.Component): return -1
        except:
            warning = "You need a newer version of Honeybee to use this compoent." + \
            " Use updateHoneybee component to update userObjects.\n" + \
            "If you have already updated userObjects drag Honeybee_Honeybee component " + \
            "into canvas and try again."
            w = gh.GH_RuntimeMessageLevel.Warning
            ghenv.Component.AddRuntimeMessage(w, warning)
            return -1
        
        # don't customize this part
        hb_EPSrf = sc.sticky["honeybee_EPSurface"]
        hb_EPSHDSurface = sc.sticky["honeybee_EPShdSurface"]
        hb_RADMaterialAUX = sc.sticky["honeybee_RADMaterialAUX"]
        hb_EPObjectsAux = sc.sticky["honeybee_EPObjectsAUX"]()
        HBScheduleList = sc.sticky["honeybee_ScheduleLib"].keys()

        ########################################################################
        #----------------------------------------------------------------------#
        shdBreps = []
        # create bounding box of shading geometries
        if justBoundingBox:
            for brep in shdSurfaces:
                if brep.Faces.Count>1 or not brep.Faces[0].IsPlanar(sc.doc.ModelAbsoluteTolerance):
                    shdBreps.append(brep.GetBoundingBox(True).ToBrep())
                else:
                    shdBreps.append(brep)
        else:
            shdBreps = shdSurfaces
        
        shadingClasses = []
        shadingMeshPreview = []
        
        if meshingSettings == None:
            mp = rc.Geometry.MeshingParameters.Minimal
            mp.SimplePlanes = True
        else:
            mp = meshingSettings
        
        def getRadMaterialName(radMaterial):
            nameStr = radMaterial.split(" ")[2]
            name =  nameStr.split("\n")[0]
            return name
        
        for brepCount, brep in enumerate(shdBreps):
            if brep != None:
                isPlanar = True
                # check planarity
                for face in brep.Faces:
                    if not face.IsPlanar(tolerance):
                        isPlanar = False
                        break
                
                shadingBreps = []
                if not isPlanar:
                    meshArray = rc.Geometry.Mesh.CreateFromBrep(brep, mp)
                    for mesh in meshArray:
                        for meshFace in range(mesh.Faces.Count):
                            vertices = list(mesh.Faces.GetFaceVertices(meshFace))[1:]
                            vertices = vertices + [sc.doc.ModelAbsoluteTolerance]
                            # create the brep from mesh
                            shdBrep = rc.Geometry.Brep.CreateFromCornerPoints(*vertices)
                            shadingBreps.append(shdBrep)
                else:
                    for face in brep.Faces:
                        shadingBreps.append(face.DuplicateFace(False))
                
                for faceCount, shdBrep in enumerate(shadingBreps):
                        thisShading = hb_EPSHDSurface(shdBrep, 1000*brepCount + faceCount, 'shdSrf_' + `brepCount` + '_' + `faceCount` + "_" + str(uuid.uuid4()))
                        
                        # add transmittance schedule if any
                        if EPTransSchedule!=None:
                            schedule= EPTransSchedule.upper()
                            if schedule!=None and not schedule.lower().endswith(".csv") and schedule not in HBScheduleList:
                                msg = "Cannot find " + schedule + " in Honeybee schedule library."
                                print msg
                                ghenv.Component.AddRuntimeMessage(gh.GH_RuntimeMessageLevel.Warning, msg)
                                return -1
                            elif schedule!=None and schedule.lower().endswith(".csv"):
                                # check if csv file is existed
                                if not os.path.isfile(schedule):
                                    msg = "Cannot find the shchedule file: " + schedule
                                    print msg
                                    ghenv.Component.AddRuntimeMessage(gh.GH_RuntimeMessageLevel.Warning, msg)
                                    return -1
                            
                            thisShading.TransmittanceSCH = schedule
                        
                        # add the Rad Material if any
                        if RADMaterial!=None:
                            # if it is just the name of the material make sure it is already defined
                            if len(RADMaterial.split(" ")) == 1:
                                # if the material is not in the library add it to the library
                                if not hb_RADMaterialAUX.isMatrialExistInLibrary(RADMaterial):
                                    warningMsg = "Can't find " + RADMaterial + " in RAD Material Library.\n" + \
                                                "Add the material to the library and try again."
                                    ghenv.Component.AddRuntimeMessage(gh.GH_RuntimeMessageLevel.Warning, warningMsg)
                                    return
                                
                                try:
                                    thisShading.setRADMaterial(RADMaterial)
                                except Exception, e:
                                    print e
                                    warningMsg = "You are using an old version of Honeybee_Honeybee! Update your files and try again."
                                    print warningMsg
                                    ghenv.Component.AddRuntimeMessage(gh.GH_RuntimeMessageLevel.Warning, warningMsg)
                                    return
                                
                                addedToLib = True
                            else:
                                
                                # try to add the material to the library
                                addedToLib, thisShading.RadMaterial = hb_RADMaterialAUX.analyseRadMaterials(RADMaterial, True)
                                
                            if addedToLib==False:
                                warningMsg = "Failed to add " + RADMaterial + " to the Library."
                                ghenv.Component.AddRuntimeMessage(gh.GH_RuntimeMessageLevel.Warning, warningMsg)
                                return
                        
                        # add shading to the list
                        shadingClasses.append(thisShading)
                
        # add to the hive
        hb_hive = sc.sticky["honeybee_Hive"]()
        HBContext  = hb_hive.addToHoneybeeHive(shadingClasses, ghenv.Component)
        return HBContext
        ################################################################################################
    else:
        print "You should first let Honeybee to fly..."
        w = gh.GH_RuntimeMessageLevel.Warning
        ghenv.Component.AddRuntimeMessage(w, "You should first let Honeybee to fly...")
        return -1
        

if _shdSurfaces and _shdSurfaces[0]!=None:
    # add cleaning function
    result= main(_shdSurfaces, EPTransSchedule_, meshingSettings_, justBoundingBox_)
    
    if result != -1: HBContext = result
# ---------- end hb_epcontextsrf ----------

# ----
# creating hbZone
bldgprograms = Honeybee_bldgPrograms({"Office": 0, "Retail": 1, "MidriseApartment": 2, "PrimarySchool": 3, "SecondarySchool": 4, "SmallHotel": 5, "LargeHotel": 6, "Hospital": 7, "Outpatient": 8, "Warehouse": 9, "SuperMarket": 10, "FullServiceRestaurant": 11, "QuickServiceRestaurant": 12}, selected="MidriseApartment")
listzoneprograms = Honeybee_ListZonePrograms(bldgProgram=bldgprograms)  # -> flatten(MidriseApartmentZonePrograms); plug-in component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
brep = Brep(flatten([makeadiabatic, addhbglz]))
item_2 = ListItem(List=listzoneprograms, Index="0", Wrap=True)  # -> flatten(Item)
createhbzones = Honeybee_createHBZones(name="my_room", zoneProgram=item_2, HBSurfaces=flatten(brep), isConditioned=Toggle(False))  # -> readMe, HBZone; plug-in component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
wires = BrepWireframe(Brep=[createhbzones.HBZone, shading], Density=-1)

decomposebytype = Honeybee_DecomposeBasedOnType(HBZone=createhbzones.HBZone)  # -> walls, interiorWalls, airWalls, windows, interiorWindows, skylights, roofs, ceilings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; plug-in component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
preview = CustomPreview(
    Geometry=decomposebytype.windows,
    Shader={ambient=RGB(0, 0, 0), diffuse=RGB(255, 105, 180), emission=RGB(76, 32, 54), shine=0.5, specular=RGB(255, 255, 255), transparency=0})
panel_8 = Panel(listzoneprograms)
pt = Point(<point referenced from the Rhino model>)

# ----
# Natural Vent & Infiltration
panel_9 = Panel("23")
setepnatvent = Honeybee_SetEPAirFlow(
    HBZones=flatten(createhbzones.HBZone),
    naturalVentilationType="1",
    minIndoorTempForNatVent=panel_9,
    maxIndoorTempForNatVent="34",
    minOutdoorTempForNatVent="10",
    maxOutdoorTempForNatVent="27")  # -> readMe, simplify(HBZones); plug-in component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
setepzoneloads = Honeybee_SetEnergyPlusZoneLoads(HBZones=setepnatvent.HBZones, infiltrationRatePerArea="0.0001")  # -> loads, HBZones; plug-in component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

# ----
# UDI
number_slider = Slider(0.3, range=0..10)
gentestpts = Honeybee_GenerateTestPoints(testGeometry=createhbsrfs_2.HBSurface, gridSize=number_slider, distBaseSrf=Slider(0.75, range=0..3), moveTestMesh=True)  # -> readMe, simplify(testPoints), simplify(ptsVectors), simplify(facesArea), simplify(mesh); plug-in component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
path = FilePath("C:\Users\himyn\Desktop\USA_PA_Philadelphia.Intl.AP.724080_TMY3.epw")
annualdaylightsimulation = Honeybee_AnnualDaylightSimulation(epwWeatherFile=path, testPoints=gentestpts.testPoints, ptsVectors=gentestpts.ptsVectors)  # -> analysisRecipe; plug-in component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
toggle = BooleanToggle(True)
occupancygenerator = Honeybee_DaysimOccupancyGenerator(weekendDays="0", writeTheOcc=Toggle(True))  # -> occupancyFile; plug-in component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
rundaylightanalysis = Honeybee_RunDaylightSimulation(
    HBObjects=flatten(setepzoneloads.HBZones),
    analysisRecipe=annualdaylightsimulation,
    writeRad=toggle,
    runRad=toggle,
    overwriteResults=True)  # -> readMe, analysisType, resultsUnit, results, testPts, annual_analysis_files, radGeoFile, studyFolder, done; plug-in component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
readannualresultsi = Honeybee_ReadAnnualResultI(
    illFilesAddress=rundaylightanalysis.annual_analysis_files,
    testPoints=simplify(gentestpts.testPoints),
    ptsVectors=gentestpts.ptsVectors,
    occupancyFiles=occupancygenerator,
    DLAIllumThresholds=300,
    runIt=Toggle(True))  # -> DLA, UDLI_Less_100, UDLI_100_2000, UDLI_More_2000, CDA, sDA, annualProfiles, htmReport; plug-in component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

epoutput = Honeybee_GenerateEPOutput(zoneGainsAndLosses="False", zoneComfortMetrics=Toggle(True), surfaceTempAnalysis="False")  # -> report, flatten(simulationOutputs); plug-in component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
toggle_2 = BooleanToggle(True)

# ----
# Schedule
setepzoneschedules = Honeybee_SetEnergyPlusZoneSchedules(HBZones=setepzoneloads.HBZones)  # -> schedules, simplify(HBZones); plug-in component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

# ----
# Schedule visualization
dsannualprofiles = Honeybee_DaysimAnnualProfiles(annualProfiles=readannualresultsi.annualProfiles)  # -> simplify(occupancyProfile), simplify(shadingProfiles), simplify(lightingControlProfiles), simplify(dgpProfile); plug-in component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
gethbzoneepschedules = Honeybee_GetZoneEnergyPlusSchedules(HBZone=setepzoneschedules.HBZones)  # -> occupancySchedule, occupancyActivitySch, heatingSetPtSchedule, coolingSetPtSchedule, lightingSchedule, equipmentSchedule, infiltrationSchedule; plug-in component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
legendpar_2 = Ladybug_LegendParameters(lowBound="0", highBound="1", numSegments="2", fontSize="10")  # -> legendPar; plug-in component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
legendpar_3 = Ladybug_LegendParameters(lowBound="0", highBound="1", numSegments="11", font="CENTURY GOTHIC", fontSize="10")  # -> legendPar; plug-in component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
convertepschvalues = Honeybee_ConvertEnergyPlusScheduleToValues(schName=[gethbzoneepschedules.occupancySchedule, gethbzoneepschedules.lightingSchedule])  # -> values, holidays; plug-in component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
pt_2 = Point(<point referenced from the Rhino model>)
_3dchart = Ladybug_3DChart(
    inputData=flatten([dsannualprofiles.occupancyProfile, dsannualprofiles.lightingControlProfiles]),
    basePoint=pt_2,
    xScale="0.2",
    legendPar=legendpar_2,
    bakeIt=Toggle(True))  # -> readMe, graphMesh, graphCurves, legend, legendBasePts, title, titleBasePts, dataPts, conditionalHOY; plug-in component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
_3dchart_2 = Ladybug_3DChart(inputData=flatten(convertepschvalues.values), xScale="0.2", legendPar=legendpar_3, bakeIt=Toggle(True))  # -> readMe, graphMesh, graphCurves, legend, legendBasePts, title, titleBasePts, dataPts, conditionalHOY; plug-in component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

path_2 = FilePath("C:\Users\himyn\Desktop\USA_PA_Philadelphia.Intl.AP.724080_TMY3.epw")
runenergysimulation = Honeybee_RunEnergySimulation(
    epwFile=path_2,
    HBZones=flatten(createhbzones.HBZone),
    HBContext=flatten(hb_epcontextsrf),
    simulationOutputs=flatten(epoutput.simulationOutputs),
    writeIdf=toggle_2,
    runEnergyPlus=toggle_2)  # -> report, idfFileAddress, htmlReport, resultFileAddress, eioFileAddress; plug-in component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
readepresult = Honeybee_ReadEPResult(resultFileAddress=runenergysimulation.resultFileAddress)  # -> port, port_2, port_3, port_4, port_5, port_6, port_7, port_8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; plug-in component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
_3dchart_3 = Ladybug_3DChart(inputData=flatten(readepresult.relativeHumidity), basePoint=pt, xScale="0.2", zScale="0", legendPar=legendpar)  # -> readMe, graphMesh, graphCurves, legend, legendBasePts, title, titleBasePts, dataPts, conditionalHOY; plug-in component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
panel_10 = Panel(convertepschvalues.values)
importepw = Ladybug_ImportEpw(epwFile=path_2)  # -> readMe, latitude, location, dryBulbTemperature, dewPointTemperature, relativeHumidity, windSpeed, windDirection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; plug-in component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
panel_11 = Panel(importepw.dryBulbTemperature)

# ----
# Apaptive Comfort Chart
panel_12 = Panel("century gothic")
legendpar_4 = Ladybug_LegendParameters(lowBound="-10", highBound="35", numSegments="10", font=panel_12, fontSize="9")  # -> legendPar; plug-in component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
adaptivechart = Ladybug_AdaptiveComfortChart(
    dryBulbTemperature=readepresult.airTemperature,
    meanRadiantTemperature=readepresult.meanRadTemperature,
    prevailingOutdoorTemp=importepw.dryBulbTemperature,
    runIt=Toggle(False))  # -> readMe, comfPercentOfTime, percentHotCold, comfortableOrNot, conditionOfPerson, degreesFromTarget, prevailingTemp, targetTemperature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; plug-in component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
_3dchart_4 = Ladybug_3DChart(
    inputData=flatten([readepresult.airTemperature, readepresult.relativeHumidity]),
    xScale="0.2",
    zScale="0",
    legendPar=legendpar_4,
    condStatement="9<a<26 and b<80")  # -> readMe, graphMesh, graphCurves, legend, legendBasePts, title, titleBasePts, dataPts, conditionalHOY; plug-in component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
panel_13 = Panel(_3dchart_4.conditionalHOY)
panel_14 = Panel(readepresult.relativeHumidity)
strnum = Ladybug_SeparateData(inputList=flatten(panel_14))  # -> numbers, strings; plug-in component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
panel_15 = Panel(strnum.numbers)
sort_2 = SortList(Keys=panel_15)  # -> Keys, ValuesA
panel_16 = Panel(sort_2.Keys)
ma = MassAddition(Input=panel_16)  # -> Result, PartialResults
integer_division = IntegerDivision(A=ma.Result, B="8760")

# ----
# Energy Balance Graph
toggle_3 = BooleanToggle(True)
epoutput_2 = Honeybee_GenerateEPOutput(
    zoneEnergyUse=toggle_3,
    zoneGainsAndLosses=toggle_3,
    zoneComfortMetrics="False",
    surfaceTempAnalysis="False",
    surfaceEnergyAnalysis=toggle_3)  # -> report, flatten(simulationOutputs); plug-in component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
toggle_4 = BooleanToggle(True)
runenergysimulation_2 = Honeybee_RunEnergySimulation(
    epwFile=path_2,
    HBZones=flatten(setepzoneschedules.HBZones),
    HBContext=flatten(hb_epcontextsrf),
    simulationOutputs=flatten(epoutput_2.simulationOutputs),
    writeIdf=toggle_4,
    runEnergyPlus=toggle_4)  # -> report, idfFileAddress, htmlReport, resultFileAddress, eioFileAddress; plug-in component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
readepresult_2 = Honeybee_ReadEPResult(resultFileAddress=runenergysimulation_2.resultFileAddress)  # -> port, port_2, port_3, port_4, electricLight, electricEquip, fanElectric, port_5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; plug-in component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
readepsrfresult = Honeybee_ReadEPSurfaceResult(resultFileAddress=runenergysimulation_2.resultFileAddress)  # -> port, port_2, surfaceEnergyFlow, opaqueEnergyFlow, glazEnergyFlow, port_3, port_4, port_5, port_6, port_7; plug-in component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
energybalance = Honeybee_ConstructEnergyBalance(
    HBZones=flatten(createhbzones.HBZone),
    electricLight=readepresult_2.electricLight,
    electricEquip=readepresult_2.electricEquip,
    peopleGains=readepresult_2.peopleGains,
    totalSolarGain=readepresult_2.totalSolarGain,
    infiltrationEnergy=readepresult_2.infiltrationEnergy,
    natVentEnergy=readepresult_2.natVentEnergy,
    surfaceEnergyFlow=readepsrfresult.surfaceEnergyFlow)  # -> readMe, port, flrNormEnergyBal, flrNormBalWStorage, port_2, modelEnergyBalance, energyBalWithStorage; plug-in component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
gradientlibrary_2 = Ladybug_GradientLibrary(gradIndex="19")  # -> customColors; plug-in component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
legendpar_5 = Ladybug_LegendParameters(lowBound="-20", highBound="20", numSegments="11", customColors=flatten(gradientlibrary_2), font="century gothic")  # -> legendPar; plug-in component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
selectandaveragedata = Ladybug_AverageData(annualHourlyData=energybalance.flrNormBalWStorage, totalOrAverage=Toggle(True))  # -> readMe, selHourlyData, totaledDaily, totaledMonthly, totMonthlyPerHour, totAnalysisPeriod; plug-in component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
barchart = Ladybug_MonthlyBarChart(
    inputData=flatten(selectandaveragedata.totaledMonthly),
    stackValues=Toggle(True),
    altTitle="My Room Energy Balance",
    altYAxisTitle="Energy (kWh)",
    legendPar=legendpar_5)  # -> readMe, dataMesh, dataCurves, dataCrvColors, graphAxes, graphLabels, title, titleBasePt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; plug-in component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

# ----
# Comfort Analysis
toggle_5 = BooleanToggle(True)
adaptivecomfortcalculator = Ladybug_AdaptiveComfortCalculator(
    dryBulbTemperature=readepresult.airTemperature,
    meanRadiantTemperature=readepresult.meanRadTemperature,
    prevailingOutdoorTemp=importepw.dryBulbTemperature,
    runIt=toggle_5)  # -> readMe, port, comfortableOrNot, conditionOfPerson, degreesFromTarget, port_2, targetTemperature, upperTemperatureBound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; plug-in component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
panel_17 = Panel(adaptivecomfortcalculator.percentHotCold)
legendpar_6 = Ladybug_LegendParameters(lowBound="-1", highBound="1", numSegments="3", font="century gothic", fontSize="9", decimalPlaces="0")  # -> legendPar; plug-in component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
_3dchart_5 = Ladybug_3DChart(inputData=flatten(adaptivecomfortcalculator.conditionOfPerson), xScale="0.2", zScale="0", legendPar=legendpar_6)  # -> readMe, graphMesh, graphCurves, legend, legendBasePts, title, titleBasePts, dataPts, conditionalHOY; plug-in component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
