# Grasshopper definition jeon_bosung.gh (Grasshopper 0.9.76)
# plug-ins: Python Interpreter

ladybug = Ladybug_Ladybug()  # -> Vviiiiiiiiiizzz; plug-in component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
# Geometry_Prepartation
honeybee = Honeybee_Honeybee()  # -> Vviiiiiiiiiizzz; plug-in component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

# ---- group: East & South
brep = Brep([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])

# ----
honeybee_bldgprograms = Honeybee_bldgPrograms({"Office": 0, "Retail": 1, "MidriseApartment": 2, "PrimarySchool": 3, "SecondarySchool": 4, "SmallHotel": 5, "LargeHotel": 6, "Hospital": 7, "Outpatient": 8, "Warehouse": 9, "SuperMarket": 10, "FullServiceRestaurant": 11, "QuickServiceRestaurant": 12}, selected="MidriseApartment")
listzoneprograms = Honeybee_ListZonePrograms(bldgProgram=honeybee_bldgprograms)  # -> MidriseApartmentZonePrograms; plug-in component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
list_item = ListItem(List=listzoneprograms, Index=0, Wrap=True)
panel = Panel("""Window_South
Window_East""")
panel_2 = Panel("Window_South")
panel_3 = Panel("Window_East")
brep_2 = Brep(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)
south = Brep(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)
east = Brep(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)
mass2zone = Honeybee_Masses2Zones(
    zoneMasses=flatten(brep_2),
    zoneNames="Bosung_Dream_Room",
    zonePrograms=list_item,
    isConditioned=Toggle(False),
    maxRoofAngle=30,
    createHBZones=Toggle(True))  # -> readMe, HBZones; plug-in component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
custom_preview = CustomPreview(Geometry=brep, Shader=ColourSwatch(SwatchColor=RGB(168, 246, 255)))
addhbglz = Honeybee_addHBGlz(HBObj=mass2zone.HBZones, childSurfaces=flatten(brep), childSurfacesName=flatten(panel))  # -> HBObjWGLZ; plug-in component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
toggle = BooleanToggle(True)
makeadiabaticbytype = Honeybee_MakeAdiabaticByType(HBZones=addhbglz, roofs=toggle, ceilings=toggle, floors=toggle, exposedFloors=toggle, groundFloors=toggle)  # -> HBZones; plug-in component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

# ----
# Shading_Last
brep_3 = Brep([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])
# Shading_Control
custom_preview_2 = CustomPreview(Geometry=brep_3, Shader=ColourSwatch(SwatchColor=RGB(214, 137, 60)))
hb_epcontextsrf = HoneybeeEPContextSurfaces(shdSurfaces=flatten(brep_3))  # -> HBContext; inputs shdSurfaces: list of Brep, justBoundingBox: Boolean
# ---------- hb_epcontextsrf: Python ----------
"""
prepare shading/context geometries

    Args:
        northVectorOrRotation: A vector that shows North or a number that shows
                               the rotation of the North from the Y axis
        bldgMasses: List of closed Breps as thermal zones.
    Returns:
        report: ...
        thermalZones: Thermal zone's geometries for visualiza
"""

ghenv.Component.Name = 'Honeybee EP context Surfaces'
ghenv.Component.NickName = 'HB_EPContextSrf'
ghenv.Component.Message = 'VER 0.0.62\nJUL_28_2017'
ghenv.Component.IconDisplayMode = ghenv.Component.IconDisplayMode.application
ghenv.Component.Category = "Honeybee"
ghenv.Component.SubCategory = "10 | Energy | Energy"
#compatibleHBVersion = VER 0.0.57\nNOV_04_2016
#compatibleLBVersion = VER 0.0.59\nFEB_01_2015
ghenv.Component.AdditionalHelpFromDocStrings = "2"

import rhinoscriptsyntax as rs
import Rhino as rc
import scriptcontext as sc
import os
import System
import Grasshopper.Kernel as gh
import uuid

tolerance = sc.doc.ModelAbsoluteTolerance
import math


def main(shdSurfaces, EPTransSchedule, meshingSettings, justBoundingBox):
    
    # import the classes
    if sc.sticky.has_key('honeybee_release'):

        try:
            if not sc.sticky['honeybee_release'].isCompatible(ghenv.Component): return -1
            if sc.sticky['honeybee_release'].isInputMissing(ghenv.Component): return -1
        except:
            warning = "You need a newer version of Honeybee to use this compoent." + \
            " Use updateHoneybee component to update userObjects.\n" + \
            "If you have already updated userObjects drag Honeybee_Honeybee component " + \
            "into canvas and try again."
            w = gh.GH_RuntimeMessageLevel.Warning
            ghenv.Component.AddRuntimeMessage(w, warning)
            return -1
        
        # don't customize this part
        hb_EPSrf = sc.sticky["honeybee_EPSurface"]
        hb_EPSHDSurface = sc.sticky["honeybee_EPShdSurface"]
        hb_RADMaterialAUX = sc.sticky["honeybee_RADMaterialAUX"]
        hb_EPObjectsAux = sc.sticky["honeybee_EPObjectsAUX"]()
        HBScheduleList = sc.sticky["honeybee_ScheduleLib"].keys()

        ########################################################################
        #----------------------------------------------------------------------#
        shdBreps = []
        # create bounding box of shading geometries
        if justBoundingBox:
            for brep in shdSurfaces:
                if brep.Faces.Count>1 or not brep.Faces[0].IsPlanar(sc.doc.ModelAbsoluteTolerance):
                    shdBreps.append(brep.GetBoundingBox(True).ToBrep())
                else:
                    shdBreps.append(brep)
        else:
            shdBreps = shdSurfaces
        
        shadingClasses = []
        shadingMeshPreview = []
        
        if meshingSettings == None:
            mp = rc.Geometry.MeshingParameters.Minimal
            mp.SimplePlanes = True
        else:
            mp = meshingSettings
        
        def getRadMaterialName(radMaterial):
            nameStr = radMaterial.split(" ")[2]
            name =  nameStr.split("\n")[0]
            return name
        
        for brepCount, brep in enumerate(shdBreps):
            if brep != None:
                isPlanar = True
                # check planarity
                for face in brep.Faces:
                    if not face.IsPlanar(tolerance):
                        isPlanar = False
                        break
                
                shadingBreps = []
                if not isPlanar:
                    meshArray = rc.Geometry.Mesh.CreateFromBrep(brep, mp)
                    for mesh in meshArray:
                        for meshFace in range(mesh.Faces.Count):
                            vertices = list(mesh.Faces.GetFaceVertices(meshFace))[1:]
                            vertices = vertices + [sc.doc.ModelAbsoluteTolerance]
                            # create the brep from mesh
                            shdBrep = rc.Geometry.Brep.CreateFromCornerPoints(*vertices)
                            shadingBreps.append(shdBrep)
                else:
                    for face in brep.Faces:
                        shadingBreps.append(face.DuplicateFace(False))
                
                for faceCount, shdBrep in enumerate(shadingBreps):
                        thisShading = hb_EPSHDSurface(shdBrep, 1000*brepCount + faceCount, 'shdSrf_' + `brepCount` + '_' + `faceCount` + "_" + str(uuid.uuid4()))
                        
                        # add transmittance schedule if any
                        if EPTransSchedule!=None:
                            schedule= EPTransSchedule.upper()
                            if schedule!=None and not schedule.lower().endswith(".csv") and schedule not in HBScheduleList:
                                msg = "Cannot find " + schedule + " in Honeybee schedule library."
                                print msg
                                ghenv.Component.AddRuntimeMessage(gh.GH_RuntimeMessageLevel.Warning, msg)
                                return -1
                            elif schedule!=None and schedule.lower().endswith(".csv"):
                                # check if csv file is existed
                                if not os.path.isfile(schedule):
                                    msg = "Cannot find the shchedule file: " + schedule
                                    print msg
                                    ghenv.Component.AddRuntimeMessage(gh.GH_RuntimeMessageLevel.Warning, msg)
                                    return -1
                            
                            thisShading.TransmittanceSCH = schedule
                        
                        # add the Rad Material if any
                        if RADMaterial!=None:
                            # if it is just the name of the material make sure it is already defined
                            if len(RADMaterial.split(" ")) == 1:
                                # if the material is not in the library add it to the library
                                if not hb_RADMaterialAUX.isMatrialExistInLibrary(RADMaterial):
                                    warningMsg = "Can't find " + RADMaterial + " in RAD Material Library.\n" + \
                                                "Add the material to the library and try again."
                                    ghenv.Component.AddRuntimeMessage(gh.GH_RuntimeMessageLevel.Warning, warningMsg)
                                    return
                                
                                try:
                                    thisShading.setRADMaterial(RADMaterial)
                                except Exception, e:
                                    print e
                                    warningMsg = "You are using an old version of Honeybee_Honeybee! Update your files and try again."
                                    print warningMsg
                                    ghenv.Component.AddRuntimeMessage(gh.GH_RuntimeMessageLevel.Warning, warningMsg)
                                    return
                                
                                addedToLib = True
                            else:
                                
                                # try to add the material to the library
                                addedToLib, thisShading.RadMaterial = hb_RADMaterialAUX.analyseRadMaterials(RADMaterial, True)
                                
                            if addedToLib==False:
                                warningMsg = "Failed to add " + RADMaterial + " to the Library."
                                ghenv.Component.AddRuntimeMessage(gh.GH_RuntimeMessageLevel.Warning, warningMsg)
                                return
                        
                        # add shading to the list
                        shadingClasses.append(thisShading)
                
        # add to the hive
        hb_hive = sc.sticky["honeybee_Hive"]()
        HBContext  = hb_hive.addToHoneybeeHive(shadingClasses, ghenv.Component)
        return HBContext
        ################################################################################################
    else:
        print "You should first let Honeybee to fly..."
        w = gh.GH_RuntimeMessageLevel.Warning
        ghenv.Component.AddRuntimeMessage(w, "You should first let Honeybee to fly...")
        return -1
        

if _shdSurfaces and _shdSurfaces[0]!=None:
    # add cleaning function
    result= main(_shdSurfaces, EPTransSchedule_, meshingSettings_, justBoundingBox_)
    
    if result != -1: HBContext = result
# ---------- end hb_epcontextsrf ----------

# ----
# Base_Geometry
# Space_to_Simulate
brep_4 = Brep([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])
brep_wireframe = BrepWireframe(Brep=brep_4, Density=-1)

callfromepconstrlibrary = Honeybee_CallFromEPConstructionLibrary()  # -> ThermMaterials, EPMaterials, EPWindowMaterials, EPConstructions; plug-in component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
panel_4 = Panel("""0
4
1
2""")
searchepconstruction = Honeybee_SearchEPConstruction(EPConstrList=callfromepconstrlibrary.EPConstructions, standard="2", climateZone="4", surfaceType=panel_4)  # -> EPSelectedConstr; plug-in component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
panel_5 = Panel(searchepconstruction)
decomposeepconstruction = Honeybee_DecomposeEPConstruction(cnstrName=searchepconstruction)  # -> materials, comments, UValue_SI, UValue_IP, RValue_SI, RValue_IP; plug-in component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
panel_6 = Panel(decomposeepconstruction.RValue_SI)
sort_list = SortList(Keys=decomposeepconstruction.RValue_SI, ValuesValuesA=searchepconstruction)  # -> Keys, ValuesValuesA
panel_7 = Panel(sort_list.ValuesValuesA)
panel_8 = Panel(sort_list.Keys)
list_item_2 = ListItem(List=sort_list.ValuesValuesA, Index=expr("x-1", 0), Wrap=True)
panel_9 = Panel(list_item_2)
list_item_3 = ListItem(List=flatten(list_item_2), Index=0, Wrap=True)  # -> Item, Item1, Item2, Item3
setepzonecnstr = Honeybee_SetEPZoneConstruction(
    HBZones=flatten(makeadiabaticbytype),
    wallEPConstruction=list_item_3.Item,
    windowEPConstruction=list_item_3.Item1,
    roofEPConstruction=list_item_3.Item2,
    floorEPConstruction=list_item_3.Item3)  # -> simplify(modifiedHBZones); plug-in component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

panel_10 = Panel("10")
panel_11 = Panel("20")
panel_12 = Panel("15")

panel_13 = Panel("0.8")
uip2usi = Ladybug_uIP2uSI(U_IP="0.1")  # -> U_SI; plug-in component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
rip2rsi = Ladybug_rIP2rSI(R_IP="20")  # -> R_SI; plug-in component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
# Assign_Constructions
panel_14 = Panel("Basic_Wall")
rip2rsi_2 = Ladybug_rIP2rSI(R_IP="50")  # -> R_SI; plug-in component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
rip2rsi_3 = Ladybug_rIP2rSI(R_IP="40")  # -> R_SI; plug-in component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
epnomassmat = Honeybee_EnergyPlusNoMassOpaqueMaterial(name=panel_14, R_Value=rip2rsi)  # -> EPMaterial; plug-in component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
epnomassmat_2 = Honeybee_EnergyPlusNoMassOpaqueMaterial(name="Basic_Floor", R_Value=rip2rsi_2)  # -> EPMaterial; plug-in component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
epnomassmat_3 = Honeybee_EnergyPlusNoMassOpaqueMaterial(name="Basic_Roof", R_Value=rip2rsi_3)  # -> EPMaterial; plug-in component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
epwindowmat = Honeybee_EnergyPlusWindowMaterial(name="Triple_Pane", U_Value=uip2usi, SHGC="0.35", VT="0.55")  # -> EPMaterial; plug-in component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
# Assign_Constructions_Maunal_R-Value
epconstruction = Honeybee_EnergyPlusConstruction(name=panel_14, layer_1=epnomassmat)  # -> EPConstruction; plug-in component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
epconstruction_2 = Honeybee_EnergyPlusConstruction(name="Triple_Pane", layer_1=epwindowmat)  # -> EPConstruction; plug-in component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
# Assign_Constructions_EP_Library
epconstruction_3 = Honeybee_EnergyPlusConstruction(name="Basic_Floor", layer_1=epnomassmat_2)  # -> EPConstruction; plug-in component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
epconstruction_4 = Honeybee_EnergyPlusConstruction(name="Basic_Roof", layer_1=epnomassmat_3)  # -> EPConstruction; plug-in component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
setepzonecnstr_2 = Honeybee_SetEPZoneConstruction(
    HBZones=flatten(makeadiabaticbytype),
    wallEPConstruction=epconstruction,
    windowEPConstruction=epconstruction_2,
    roofEPConstruction=epconstruction_4,
    expFloorEPConstruction=epconstruction_3)  # -> simplify(modifiedHBZones); plug-in component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

ach2m3_s_m2_calculator = Honeybee_infORventPerAreaCalculator(HBZones=flatten(setepzonecnstr), airFlowRate="1")  # -> out, infORventPerArea, allFloors; plug-in component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
division = Division(A="1", B="24.2")
# Infiltration_Rate
setepzoneloads = Honeybee_SetEnergyPlusZoneLoads(HBZones=setepzonecnstr, numOfPeoplePerArea=division, ventilationPerArea=ach2m3_s_m2_calculator.infORventPerArea)  # -> loads, HBZones; plug-in component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

# ----
# Sky_&_Date
number_slider = Slider(2, range=0..2)
panel_15 = Panel("""3
6
12""")
panel_16 = Panel("""9
12
15""")
list_item_4 = ListItem(List=panel_15, Index=number_slider, Wrap=True)
list_item_5 = ListItem(List=panel_16, Index=Slider(2, range=0..2), Wrap=True)
file_path = FilePath("E:\Jeon\02_UPenn\2017_Fall____02_Building_Performance_Simulation\170918\Philadelphia_weather_files\USA_PA_Philadelphia.Intl.AP.724080_TMY3.epw")
doy_hoy = Ladybug_DOY_HOY(days="21", months=list_item_4, hours=list_item_5)  # -> HOY, DOY, date; plug-in component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
genclimatebasedsky = Honeybee_GenerateClimateBasedSky(weatherFile=file_path, month=list_item_4, day="21", hour=list_item_5)  # -> out, skyFilePath; plug-in component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
panel_17 = Panel(doy_hoy.date)

# ----
# Air_Flow
# Natural_Ventilation
setepnatvent = Honeybee_SetEPAirFlow(
    HBZones=flatten(setepzoneloads.HBZones),
    naturalVentilationType="1",
    minIndoorTempForNatVent="20",
    maxOutdoorTempForNatVent="28")  # -> readMe, simplify(HBZones); plug-in component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

decomposebytype = Honeybee_DecomposeBasedOnType(HBZone=setepnatvent.HBZones)  # -> walls, interiorWalls, airWalls, windows, interiorWindows, skylights, roofs, ceilings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; plug-in component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
list_item_6 = ListItem(List=decomposebytype.windows, Index=0, Wrap=True)  # -> Item, Item1
# Material_&_Shading_Information
panel_18 = Panel("0")
shddesigner = Ladybug_ShadingDesigner(
    glzSrf=flatten(list_item_6.Item1),
    depthOrVector=flatten("0.2"),
    numOfShds="7",
    runIt=Toggle(True),
    port_4=False,
    horOrVertical=Toggle(True),
    shdAngle=panel_18)  # -> out, shadingSrfs; plug-in component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
shddesigner_2 = Ladybug_ShadingDesigner(
    glzSrf=flatten(list_item_6.Item),
    depthOrVector=flatten("0.2"),
    numOfShds="15",
    runIt=Toggle(True),
    port_4=False,
    horOrVertical=Toggle(False),
    shdAngle="0")  # -> out, shadingSrfs; plug-in component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
hb_epcontextsrf_2 = HoneybeeEPContextSurfaces(shdSurfaces=flatten([shddesigner_2.shadingSrfs, shddesigner.shadingSrfs]))  # -> HBContext; inputs shdSurfaces: list of Brep, justBoundingBox: Boolean; same code as hb_epcontextsrf
brep_wireframe_2 = BrepWireframe(Brep=[shddesigner_2.shadingSrfs, shddesigner.shadingSrfs], Density="4")

list_item_7 = ListItem(List=panel_8, Index=expr("x-1", 0), Wrap=True)
list_item_8 = ListItem(List=flatten(list_item_7), Index=0, Wrap=True)  # -> Item, Item1, Item2, Item3
concatenate = Concatenate(
    Fragment_A="Shading Information",
    Fragment_B="Depth: ",
    A="0.2",
    B="m",
    C="Number of Shadings: ",
    D="15",
    E="Shadings Angle: ",
    F="0",
    G="Material R-Value ",
    H="Wall: ",
    I=rip2rsi,
    J="Window: ",
    K=uip2usi,
    L="Roof: ",
    M=rip2rsi_3,
    N="Floor: ",
    O=rip2rsi_2)
point = Point(Point(0, -1.912594163, 0.3086550302))
text_tag_3d = TextTag3D(Location=point, Text=concatenate, Size="0.3", Colour=ColourSwatch(SwatchColor=RGB(0, 0, 0)), Justification=7)

toggle_2 = BooleanToggle(True)
# Simulation_Execution
# Simulation_Parameters
panel_19 = Panel("1")
epoutput = Honeybee_GenerateEPOutput(
    zoneEnergyUse=toggle_2,
    zoneGainsAndLosses=toggle_2,
    zoneComfortMetrics=toggle_2,
    comfortMapVariables=toggle_2,
    surfaceTempAnalysis=toggle_2,
    surfaceEnergyAnalysis=toggle_2,
    glazingSolarAnalysis=toggle_2)  # -> report, flatten(simulationOutputs); plug-in component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
panel_20 = Panel(epoutput.simulationOutputs)
energysimpar = Honeybee_EnergySimulationPar(timestep=6, solarDistribution=panel_19)  # -> energySimPar; plug-in component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

data = Data(12.87671233)
data_2 = Data(12.88812785)
data_3 = Data(12.73972603)
data_4 = Data(12.89954338)
data_5 = Data(12.92237443)
east_south = Panel(data)
construction = Panel(data_2)
construction2 = Panel(data_3)
louver1 = Panel(data_4)
louver2 = Panel(data_5)

decompose_honeybee_zone = Honeybee_DecomposeHBZone(HBZone=makeadiabaticbytype)  # -> HBSurfaces; plug-in component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
list_item_9 = ListItem(List=decompose_honeybee_zone, Index=Slider(4, range=0..6), Wrap=True)
radparameters = Honeybee_RADParameters(quality=0, ab="2")  # -> out, radParameters; plug-in component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

flip = Flip(Surface=list_item_9)  # -> Surface, Result

# ----
# Grid_Based_Recipe
gentestpts = Honeybee_GenerateTestPoints(testGeometry=flip.Surface, gridSize="0.5", distBaseSrf="0.762", moveTestMesh=True)  # -> out, simplify(testPoints), simplify(ptsVectors), simplify(facesArea), simplify(mesh); plug-in component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
gridbasedsimulation = Honeybee_GridBasedSimulation(
    skyFile=genclimatebasedsky.skyFilePath,
    testPoints=gentestpts.testPoints,
    ptsVectors=gentestpts.ptsVectors,
    simulationType=0,
    radParameters=radparameters.radParameters)  # -> analysisRecipe; plug-in component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

boolean_toggle = BooleanToggle(False)
# Run_Simulation
rundaylightanalysis = Honeybee_RunDaylightSimulation(
    HBObjects=flatten([makeadiabaticbytype, hb_epcontextsrf_2]),
    analysisRecipe=gridbasedsimulation,
    writeRad=boolean_toggle,
    runRad=boolean_toggle,
    overwriteResults=True)  # -> out, analysisType, resultsUnit, results, testPts, resultFiles, radGeoFile, studyFolder, done; plug-in component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

legendpar = Ladybug_LegendParameters(lowBound="100")  # -> legendPar; plug-in component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
concatenate_2 = Concatenate(FragmentA="Illuminance Simulation", FragmentB=panel_17)
# Grid_Daylighting
recolormesh = Ladybug_RecolorMesh(
    analysisResult=rundaylightanalysis.results,
    inputMesh=gentestpts.mesh,
    legendPar=legendpar,
    analysisTitle=concatenate_2,
    legendTitle="lux")  # -> out, newMesh, newLegend, legendBasePt, meshColors, legendColors; plug-in component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

# ----
# Daylighting_Simulation
panel_21 = Panel("0.5")
# Daylighting_Recipe
genhbzonetestpts = Honeybee_GenerateZoneTestPoints(HBZone=makeadiabaticbytype, gridSize=panel_21, distBaseSrf="0.762", moveTestMesh=True)  # -> out, simplify(testPoints), simplify(ptsVectors), simplify(facesArea), simplify(mesh); plug-in component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
radparameters_2 = Honeybee_RADParameters(quality=0, ab="2")  # -> out, radParameters; plug-in component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

boolean_toggle_2 = BooleanToggle(False)

gethbzoneepschedules = Honeybee_GetZoneEnergyPlusSchedules(HBZone=setepnatvent.HBZones)  # -> occupancySchedule, occupancyActivitySch, heatingSetPtSchedule, coolingSetPtSchedule, lightingSchedule, equipmentSchedule, infiltrationSchedule; plug-in component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

toggle_3 = BooleanToggle(False)
path = FilePath("E:\Jeon\02_UPenn\2017_Fall____02_Building_Performance_Simulation\170918\Philadelphia_weather_files\USA_PA_Philadelphia.Intl.AP.724080_TMY3.epw")

annualdaylightsimulation = Honeybee_AnnualDaylightSimulation(
    epwWeatherFile=path,
    testPoints=genhbzonetestpts.testPoints,
    ptsVectors=genhbzonetestpts.ptsVectors,
    radParameters=radparameters_2.radParameters)  # -> analysisRecipe; plug-in component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

# ----
# Run_Simulation
rundaylightanalysis_2 = Honeybee_RunDaylightSimulation(
    HBObjects=flatten([makeadiabaticbytype, hb_epcontextsrf_2]),
    analysisRecipe=annualdaylightsimulation,
    writeRad=boolean_toggle_2,
    runRad=boolean_toggle_2,
    overwriteResults=True)  # -> out, analysisType, resultsUnit, results, testPts, resultFiles, radGeoFile, studyFolder, done; plug-in component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

# ----
# Lighting_Schedule
readannualresultsi = Honeybee_ReadAnnualResultI(
    illFilesAddress=rundaylightanalysis_2.resultFiles,
    testPoints=simplify(rundaylightanalysis_2.testPts),
    occupancyFiles=gethbzoneepschedules.lightingSchedule,
    DLAIllumThresholds=300,
    runIt=Toggle(True))  # -> DLA, UDLI_Less_100, UDLI_100_2000, UDLI_More_2000, CDA, sDA, annualProfiles, htmReport; plug-in component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

strnum = Ladybug_SeparateData(inputList=flatten(readannualresultsi.UDLI_100_2000))  # -> numbers, strings; plug-in component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
mass_addition = MassAddition(Input=strnum.numbers)  # -> Result, PartialResults
division_2 = Division(A=mass_addition.Result, B="96")
round = Round(Number=division_2)  # -> Nearest, Floor, Ceiling
# Total_Value
panel_22 = Panel(round.Nearest)

# ----
# Generating_Lighting_Schedule
# Updating_Lighting_Schedule
setepzoneschedules = Honeybee_SetEnergyPlusZoneSchedules(HBZones=setepnatvent.HBZones, lightingSchedules=readannualresultsi.annualProfiles)  # -> schedules, simplify(HBZones); plug-in component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

# ----
# Run_Simulation
runenergysimulation = Honeybee_RunEnergySimulation(
    epwFile=path,
    energySimPar=energysimpar,
    HBZones=flatten(setepzoneschedules.HBZones),
    HBContext=flatten(hb_epcontextsrf_2),
    simulationOutputs=flatten(epoutput.simulationOutputs),
    writeIdf=toggle_3,
    runEnergyPlus=toggle_3)  # -> report, idfFileAddress, htmlReport, resultFileAddress; plug-in component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

# ----
# Results
# EP_Results
# EP_Surface_Results
readepresult = Honeybee_ReadEPResult(resultFileAddress=runenergysimulation.resultFileAddress)  # -> totalThermalLoad, thermalLoadBalance, cooling, heating, electricLight, electricEquip, fanElectric, pumpElectric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; plug-in component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
readepsrfresult = Honeybee_ReadEPSurfaceResult(resultFileAddress=runenergysimulation.resultFileAddress)  # -> surfaceIndoorTemp, surfaceOutdoorTemp, surfaceEnergyFlow, opaqueEnergyFlow, glazEnergyFlow, windowTotalSolarEnergy, windowBeamEnergy, windowDiffEnergy, windowTransmissivity, otherSurfaceData; plug-in component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

importepw = Ladybug_ImportEpw(epwFile=path)  # -> readMe, latitude, location, dryBulbTemperature, dewPointTemperature, relativeHumidity, windSpeed, windDirection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; plug-in component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
adaptivecomfortcalculator = Ladybug_AdaptiveComfortCalculator(
    dryBulbTemperature=readepresult.airTemperature,
    meanRadiantTemperature=readepresult.meanRadTemperature,
    prevailingOutdoorTemp=importepw.dryBulbTemperature,
    runIt=Toggle(True))  # -> readMe, port, comfortableOrNot, conditionOfPerson, degreesFromTarget, port_2, targetTemperature, upperTemperatureBound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; plug-in component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
panel_23 = Panel([adaptivecomfortcalculator.percentOfTimeComfortable, adaptivecomfortcalculator.percentHotCold])
legendpar_2 = Ladybug_LegendParameters(lowBound="-1", highBound="1", numSegments="3")  # -> legendPar; plug-in component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
# Adaptive_Comfort
_3dchart = Ladybug_3DChart(inputData=flatten(adaptivecomfortcalculator.conditionOfPerson), xScale="0.3", zScale="0", legendPar=legendpar_2)  # -> out, graphMesh, graphCurves, legend, legendBasePts, title, titleBasePts, dataPts, conditionalHOY; plug-in component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

gradientlibrary = Ladybug_GradientLibrary(gradIndex="8")  # -> customColors; plug-in component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
legendpar_3 = Ladybug_LegendParameters(customColors=flatten(gradientlibrary))  # -> legendPar; plug-in component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
# Psychometric_Chart
psychchart = Ladybug_PsychrometricChart(
    dryBulbTemperature=importepw.dryBulbTemperature,
    relativeHumidity=importepw.relativeHumidity,
    legendPar=legendpar_3,
    runIt=Toggle(False))  # -> out, port, totalComfortPercent, totalComfortOrNot, strategyNames, strategyPercentOfTime, strategyOrNot, port_2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; plug-in component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
panel_24 = Panel(psychchart.totalComfortPercent)

gradientlibrary_2 = Ladybug_GradientLibrary(gradIndex="8")  # -> customColors; plug-in component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
# Visualization
panel_25 = Panel("18 < a < 26 and b < 80 and c > 2")
data_6 = Data(6078)
data_7 = Data(2157)
data_8 = Data(7993)
data_9 = Data(Tree({0}: [1228], {1}: [1228], {2}: [1228]))
legendpar_4 = Ladybug_LegendParameters(customColors=flatten(gradientlibrary_2))  # -> legendPar; plug-in component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
humidity = Panel(data_6)
temperature = Panel(data_7)
wind_speed = Panel(data_8)
together = Panel(data_9)
# Climate_Analysis
_3dchart_2 = Ladybug_3DChart(
    inputData=flatten([importepw.dryBulbTemperature, importepw.relativeHumidity, importepw.windSpeed]),
    xScale="0.3",
    zScale="0",
    legendPar=legendpar_4,
    condStatement=panel_25)  # -> out, graphMesh, graphCurves, legend, legendBasePts, title, titleBasePts, dataPts, conditionalHOY; plug-in component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
division_3 = Division(A=humidity, B="8760")
division_4 = Division(A=temperature, B="8760")
division_5 = Division(A=wind_speed, B="8760")
division_6 = Division(A=together, B="8760")
panel_26 = Panel(division_3)
panel_27 = Panel(division_4)
panel_28 = Panel(division_5)
panel_29 = Panel(division_6)
list_length = ListLength(List=_3dchart_2.conditionalHOY)

gradientlibrary_3 = Ladybug_GradientLibrary(gradIndex="8")  # -> customColors; plug-in component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
strnum_2 = Ladybug_SeparateData(inputList=flatten(importepw.windSpeed))  # -> numbers, strings; plug-in component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
legendpar_5 = Ladybug_LegendParameters(customColors=flatten(gradientlibrary_3))  # -> legendPar; plug-in component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
mass_addition_2 = MassAddition(Input=strnum_2.numbers)  # -> Result, PartialResults
# Wind_Analysis
windrose = Ladybug_WindRose(
    north=0,
    hourlyWindDirection=importepw.windDirection,
    hourlyWindSpeed=importepw.windSpeed,
    annualHourlyData=flatten([importepw.dryBulbTemperature, importepw.relativeHumidity]),
    conditionalStatement="18 < b < 26 and c < 80",
    legendPar=legendpar_5,
    runIt=Toggle(False))  # -> out, calmRoseMesh, windRoseMesh, windRoseCrvs, windRoseCenPts, legend, legendBasePts, title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; plug-in component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
division_7 = Division(A=mass_addition_2.Result, B="8760")
avg_wind_speed = Panel(division_7)

# ----
# Comparing_Lighting_Schedules
dsannualprofiles = Honeybee_DaysimAnnualProfiles(annualProfiles=readannualresultsi.annualProfiles)  # -> simplify(occupancyProfile), simplify(shadingProfiles), simplify(lightingControlProfiles), simplify(dgpProfile); plug-in component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
convertepschvalues = Honeybee_ConvertEnergyPlusScheduleToValues(schName=gethbzoneepschedules.lightingSchedule)  # -> values, holidays; plug-in component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
_3dchart_3 = Ladybug_3DChart(inputData=flatten([dsannualprofiles.lightingControlProfiles, convertepschvalues.holidays]), xScale="0.1", zScale="0")  # -> out, graphMesh, graphCurves, legend, legendBasePts, title, titleBasePts, dataPts, conditionalHOY; plug-in component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

# ----
# Cooling_Heating_Lighting_Loads
# Inner_Surface_Temperature
panel_30 = Panel("Cooling, Heating, And Lighting Loads")
barchart = Ladybug_MonthlyBarChart(inputData=flatten([readepresult.cooling, readepresult.heating, readepresult.electricLight]), altTitle=panel_30)  # -> out, dataMesh, dataCurves, dataCrvColors, graphAxes, graphLabels, title, titleBasePt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; plug-in component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

# ----
# Window_Transsmitted_Energy
toggle_4 = BooleanToggle(True)
colorsurfaces = Honeybee_ColorSurfacesByEPResult(srfData=readepsrfresult.surfaceIndoorTemp, HBZones=flatten(setepzoneschedules.HBZones), runIt=toggle_4)  # -> readMe, srfColoredMesh, zoneWireFrame, legend, legendBasePt, analysisTitle, srfBreps, srfColors, srfValues, normalizedSrfData; plug-in component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

_3dchart_4 = Ladybug_3DChart(
    inputData=flatten([readepsrfresult.windowDiffEnergy, readepsrfresult.windowBeamEnergy, readepsrfresult.windowTotalSolarEnergy]),
    xScale="0.3",
    zScale="0")  # -> readMe, graphMesh, graphCurves, legend, legendBasePts, title, titleBasePts, dataPts, conditionalHOY; plug-in component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

energybalance = Honeybee_ConstructEnergyBalance(
    HBZones=flatten(setepzoneschedules.HBZones),
    cooling=readepresult.cooling,
    heating=readepresult.heating,
    electricLight=readepresult.electricLight,
    electricEquip=readepresult.electricEquip,
    fanElectric=readepresult.fanElectric,
    peopleGains=readepresult.peopleGains,
    totalSolarGain=readepresult.totalSolarGain,
    infiltrationEnergy=readepresult.infiltrationEnergy,
    mechVentilationEnergy=readepresult.mechVentilationEnergy,
    natVentEnergy=readepresult.natVentEnergy,
    surfaceEnergyFlow=readepsrfresult.surfaceEnergyFlow)  # -> out, port, flrNormEnergyBal, flrNormBalWStorage, port_2, modelEnergyBalance, energyBalWithStorage; plug-in component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
gradientlibrary_4 = Ladybug_GradientLibrary(gradIndex="19")  # -> customColors; plug-in component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
# Energy_Balance
selectandaveragedata = Ladybug_AverageData(annualHourlyData=energybalance.flrNormBalWStorage, totalOrAverage=Toggle(True))  # -> readMe, selHourlyData, totaledDaily, totaledMonthly, totMonthlyPerHour, totAnalysisPeriod; plug-in component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
legendpar_6 = Ladybug_LegendParameters(customColors=flatten(gradientlibrary_4))  # -> legendPar; plug-in component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
barchart_2 = Ladybug_MonthlyBarChart(
    inputData=flatten(selectandaveragedata.totaledMonthly),
    stackValues=Toggle(True),
    altTitle="My Room Energy Balanace",
    altYAxisTitle="Energy (kWh)",
    legendPar=legendpar_6)  # -> out, dataMesh, dataCurves, dataCrvColors, graphAxes, graphLabels, title, titleBasePt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; plug-in component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

panel_31 = Panel("""Daylight Autonomy
UDI 100 ~ 2000 lux

Average of the Whole Space: """)
# Annual_Daylighting
concatenate_3 = Concatenate(Fragment_A=panel_31, Fragment_B=panel_22, A=" %")
recolormesh_2 = Ladybug_RecolorMesh(
    analysisResult=readannualresultsi.UDLI_100_2000,
    inputMesh=genhbzonetestpts.mesh,
    analysisTitle=concatenate_3,
    legendTitle=" %")  # -> out, newMesh, newLegend, legendBasePt, meshColors, legendColors; plug-in component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

# ----
# Surface_Energy_Loss/Gain
panel_32 = Panel("18<a<26")
# Temperature
_3dchart_5 = Ladybug_3DChart(inputData=flatten(readepresult.airTemperature), xScale="0.3", zScale="0", condStatement=panel_32)  # -> readMe, graphMesh, graphCurves, legend, legendBasePts, title, titleBasePts, dataPts, conditionalHOY; plug-in component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
panel_33 = Panel(_3dchart_5.conditionalHOY)

psychchart_2 = Ladybug_PsychrometricChart(dryBulbTemperature=readepresult.airTemperature, relativeHumidity=readepresult.relativeHumidity, runIt=Toggle(True))  # -> out, port, totalComfortPercent, totalComfortOrNot, strategyNames, strategyPercentOfTime, strategyOrNot, port_2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; plug-in component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

# ----
# Psychometric_Chart
toggle_5 = BooleanToggle(True)
colorsurfaces_2 = Honeybee_ColorSurfacesByEPResult(srfData=readepsrfresult.glazEnergyFlow, HBZones=flatten(setepzoneschedules.HBZones), runIt=toggle_5)  # -> readMe, srfColoredMesh, zoneWireFrame, legend, legendBasePt, analysisTitle, srfBreps, srfColors, srfValues, normalizedSrfData; plug-in component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

strnum_3 = Ladybug_SeparateData(inputList=flatten(adaptivecomfortcalculator.comfortableOrNot))  # -> numbers, strings; plug-in component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
mass_addition_3 = MassAddition(Input=strnum_3.numbers)  # -> Result, PartialResults
division_8 = Division(A=mass_addition_3.Result, B="8760")
panel_34 = Panel(division_8)
list_item_10 = ListItem(List=adaptivecomfortcalculator.percentHotCold, Index=0, Wrap=True)  # -> Item, Item1
multiplication = Multiplication(A=panel_34, B="100")
round_2 = Round(Number=list_item_10.Item)  # -> Nearest, Floor, Ceiling
round_3 = Round(Number=list_item_10.Item1)  # -> Nearest, Floor, Ceiling
round_4 = Round(Number=multiplication)  # -> Nearest, Floor, Ceiling
concatenate_4 = Concatenate(
    Fragment_A="Annual Total Comfortable Time: ",
    Fragment_B=round_4.Nearest,
    A=" %",
    B="Percent of Hot: ",
    C=round_2.Nearest,
    D=" %",
    E="Percent of Cold: ",
    F=round_3.Nearest,
    G=" %")
# Total_Value
point_2 = Point(Point(-42.10327939, -103.9391014, 0))
text_tag_3d_2 = TextTag3D(Location=point_2, Text=concatenate_4, Size="20", Colour=ColourSwatch(SwatchColor=RGB(0, 0, 0)), Justification=7)

list_length_2 = ListLength(List=panel_33)
panel_35 = Panel(list_length_2)
division_9 = Division(A=panel_35, B="8760")
panel_36 = Panel(division_9)
multiplication_2 = Multiplication(A=panel_36, B="100")
# Total_Value
round_5 = Round(Number=multiplication_2)  # -> Nearest, Floor, Ceiling
point_3 = Point(Point(-42.10327939, -103.9391014, 0))
panel_37 = Panel(round_5.Nearest)
concatenate_5 = Concatenate(Fragment_A="Percentage of Temperature between 18 and 26: ", Fragment_B=panel_37, A="%")
text_tag_3d_3 = TextTag3D(Location=point_3, Text=concatenate_5, Size="20", Colour=ColourSwatch(SwatchColor=RGB(0, 0, 0)), Justification=7)
