# Grasshopper definition jiang_hewen.gh (Grasshopper 0.9.76)
# plug-ins: Python Interpreter, Colibri

img_setting = ImageSetting(ImageSaveAsName="defaultName", RhinoViewNames="shadingandcomfort", Width="1900", Height="1000")
sideshading = Slider(1, range=0..1)
shadingcounts_2 = Slider(9, range=0..10)
shadingdepth = Slider(0, range=0..0.3)
iterator = ColibriIterator(
    SideShading=sideshading,
    ShadingCounts_2=shadingcounts_2,
    ShadingDepth=shadingdepth,
    ignoreAllWarningMsg=False,
    RemoteFly=False)  # -> SideShading, ShadingCounts_2, ShadingDepth, Value_N, Genome
panel = Panel("C:\Users\wen\Desktop\gh working\shading and comfort-adiabatic")
img_setting_2 = ImageSetting(ImageSaveAsName="defaultName", RhinoViewNames="shadingandcomfort", Width="1900", Height="1000")
fragment_b = Slider(0.9, range=0..1)
honeybee = Honeybee_Honeybee()  # -> Vviiiiiiiiiizzz; plug-in component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
# make geometry
ladybug = Ladybug_Ladybug()  # -> Vviiiiiiiiiizzz; plug-in component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
# ENERGY SIM
floor = Slider(0.3, range=0.2..0.3)
wall = Slider(0.7, range=0.3..0.7)
ceiling = Slider(0.9, range=0.6..1)
concat = Concatenate(FragmentA="glass_", FragmentB=fragment_b)
concat_2 = Concatenate(FragmentA="floor_", FragmentB=floor)
panel_2 = Panel(concat)
concat_3 = Concatenate(FragmentA="wall_", FragmentB=wall)

panel_3 = Panel("""1
1
1
1
1
1
1
1
1
1
1
1
1
0
0
0
0
0
0
1
1
1
1
1""")
dup = DuplicateData(Data=panel_3, Number="365", Order=True)
csvschedule = Honeybee_CreateCSVSchedule(values=dup, scheduleName="dorm_occ.csv", writeFile=Toggle(True))  # -> readMe, csvSchedule; plug-in component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
panel_4 = Panel(csvschedule.csvSchedule)

panel_5 = Panel(concat_2)
concat_4 = Concatenate(FragmentA="ceiling_", FragmentB=ceiling)
panel_6 = Panel(concat_3)
panel_7 = Panel(concat_4)
radglassmaterial = Honeybee_RadianceGlassMaterial(
    materialName=panel_2,
    RTransmittance=fragment_b,
    GTransmittance=fragment_b,
    BTransmittance=fragment_b,
    refractiveIndex=1.52)  # -> avrgTrans, RADMaterial; plug-in component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
radopaquematerial = Honeybee_RadianceOpaqueMaterial(materialName=panel_5, RReflectance=floor, GReflectance=floor, BReflectance=floor, roughness=0.05, specularity=0)  # -> avrgRef, RADMaterial; plug-in component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
radopaquematerial_2 = Honeybee_RadianceOpaqueMaterial(materialName=panel_6, RReflectance=wall, GReflectance=wall, BReflectance=wall, roughness=0.05, specularity=0)  # -> avrgRef, RADMaterial; plug-in component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
radopaquematerial_3 = Honeybee_RadianceOpaqueMaterial(materialName=panel_7, RReflectance=ceiling, GReflectance=ceiling, BReflectance=ceiling, roughness=0.05, specularity=0)  # -> avrgRef, RADMaterial; plug-in component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

# ---- group: windows
brep = Brep([<brep referenced from the Rhino model> x3])

# ----
# make windows geometry
item = ListItem(List=brep, Index=0, Wrap=True)  # -> Item, Item1, Item2
srf = Surface(item.Item2)

debox = DeconstructBox(Box=srf)  # -> Plane, X, Y, Z
windowswidth = Slider(2, range=1..2)
# change windows width
dedomain = DeconstructDomain(Domain=[debox.X, debox.Y, debox.Z])  # -> Start, End
item_2 = ListItem(List=dedomain.Start, Index=0, Wrap=True)  # -> Item, Item1, Item2
pt = ConstructPoint(XCoordinate=item_2.Item, YCoordinate=item_2.Item1, ZCoordinate=item_2.Item2)
subtraction = Subtraction(A=windowswidth, B=1)
division = Division(A=subtraction, B=2)
scale_nu = ScaleNU(Geometry=srf, Plane=pt, ScaleX=windowswidth, ScaleY=1, ScaleZ=1)  # -> Geometry, Transform
X = UnitX(Factor=expr("x*-1", division))
move = Move(Geometry=scale_nu.Geometry, Motion=X)  # -> Geometry, Transform

srf_2 = Surface(move.Geometry)
debrep = DeconstructBrep(Brep=srf_2)  # -> Faces, Edges, Vertices
end = EndPoints(Curve=debrep.Edges)  # -> Start, End
vec2pt = Vector2Pt(PointA=end.Start, PointB=end.End, Unitize=False)  # -> Vector, Length
devec = DeconstructVector(Vector=vec2pt.Vector)  # -> XComponent, YComponent, ZComponent
equals = Equality(FirstNumber=devec.ZComponent, SecondNumber=0)  # -> Equality, Inequality
east_shading_angle = Panel("1")
south_shading_angle_degree = Panel("23")
cull = CullPattern(List=debrep.Edges, CullPattern=equals.Inequality)
divide = DivideCurve(Curve=cull, Count=shadingcounts_2, Kinks=False)  # -> Points, Tangents, Parameters
multiplication = Multiplication(A=shadingdepth, B="1")
# south shading panel
filter = StreamFilter(Gate=sideshading, Stream1=cull)
bang = ExplodeTree(Data=divide.Points)  # -> Branch0, Branch1
rad = Radians(Degrees=south_shading_angle_degree)
multiplication_2 = Multiplication(A=multiplication, B=-1)
ln = Line(StartPoint=reverse(bang.Branch0), EndPoint=bang.Branch1)
Y = UnitY(Factor=multiplication_2)
X_2 = UnitX(Factor=1)
vrot = Rotate(Vector=Y, Axis=X_2, Angle=rad)
extr = Extrude(Base=[ln, filter], Direction=vrot)
join = BrepJoin(Breps=flatten(extr))  # -> Breps, Closed

srf_3 = Surface(move.Geometry)
debrep_2 = DeconstructBrep(Brep=srf_3)  # -> Faces, Edges, Vertices
end_2 = EndPoints(Curve=debrep_2.Edges)  # -> Start, End
vec2pt_2 = Vector2Pt(PointA=end_2.Start, PointB=end_2.End, Unitize=False)  # -> Vector, Length
devec_2 = DeconstructVector(Vector=vec2pt_2.Vector)  # -> XComponent, YComponent, ZComponent
equals_2 = Equality(FirstNumber=devec_2.ZComponent, SecondNumber=0)  # -> Equality, Inequality
cull_2 = CullPattern(List=debrep_2.Edges, CullPattern=equals_2.Inequality)
divide_2 = DivideCurve(Curve=cull_2, Count=shadingcounts_2, Kinks=False)  # -> Points, Tangents, Parameters
multiplication_3 = Multiplication(A=shadingdepth, B="1")
# east shading
filter_2 = StreamFilter(Gate=sideshading, Stream1=cull_2)
bang_2 = ExplodeTree(Data=divide_2.Points)  # -> Branch0, Branch1
rad_2 = Radians(Degrees=east_shading_angle)
multiplication_4 = Multiplication(A=multiplication_3, B=-1)
ln_2 = Line(StartPoint=reverse(bang_2.Branch0), EndPoint=bang_2.Branch1)
Y_2 = UnitY(Factor=multiplication_4)
X_3 = UnitX(Factor=1)
vrot_2 = Rotate(Vector=Y_2, Axis=X_3, Angle=rad_2)
extr_2 = Extrude(Base=[ln_2, filter_2], Direction=vrot_2)
join_2 = BrepJoin(Breps=flatten(extr_2))  # -> Breps, Closed
pt_2 = Point(<point referenced from the Rhino model>)
pt_3 = Point([<point referenced from the Rhino model> x2])
vec2pt_3 = Vector2Pt(PointA=pt_2, PointB=pt_3, Unitize=False)  # -> Vector, Length
move_2 = Move(Geometry=graft(join_2.Breps), Motion=vec2pt_3.Vector)  # -> Geometry, Transform
rotate = Rotate(Geometry=move_2.Geometry, Center=pt_3, From=Vector(1, 0, 0), To=Vector(0, 1, 0))  # -> Geometry, Transform

iterator_2 = ColibriIterator(windowsWidth=windowswidth, ignoreAllWarningMsg=False, RemoteFly=False)  # -> WindowsWidth, Value_N, IterationGenome
merge = Merge(Data1=join.Breps, Data2=rotate.Geometry)  # -> flatten(Result)

# ---- group: shading
brep_2 = Brep(merge)

# ---- group: wall- win
brep_3 = Brep([<brep referenced from the Rhino model> x2])

# ---- group: wall
brep_4 = Brep([<brep referenced from the Rhino model> x4])

# ---- group: floor
brep_5 = Brep(<brep referenced from the Rhino model>)

# ---- group: ceiling
brep_6 = Brep(<brep referenced from the Rhino model>)

# ----
createhbsrfs = Honeybee_createHBSrfs(geometry=brep_6, srfName="ceiling", srfType="3", RADMaterial=radopaquematerial_3.RADMaterial)  # -> readMe, simplify(HBSurface); plug-in component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
createhbsrfs_2 = Honeybee_createHBSrfs(geometry=brep_4, srfName="wall", srfType="0", RADMaterial=radopaquematerial_2.RADMaterial)  # -> readMe, simplify(HBSurface); plug-in component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
createhbsrfs_3 = Honeybee_createHBSrfs(geometry=brep_3, srfName="wall", srfType="0", RADMaterial=radopaquematerial_2.RADMaterial)  # -> readMe, simplify(HBSurface); plug-in component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
createhbsrfs_4 = Honeybee_createHBSrfs(geometry=brep, srfName="glass", srfType="5", RADMaterial=radglassmaterial.RADMaterial)  # -> readMe, simplify(HBSurface); plug-in component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
createhbsrfs_5 = Honeybee_createHBSrfs(geometry=brep_5, srfName="floor", srfType="2", RADMaterial=radopaquematerial.RADMaterial)  # -> readMe, simplify(HBSurface); plug-in component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
hb_epcontextsrf = HoneybeeEPContextSurfaces(shdSurfaces=flatten(brep_2))  # -> HBContext; inputs shdSurfaces: list of Brep, justBoundingBox: Boolean
# ---------- hb_epcontextsrf: Python ----------
"""
prepare shading/context geometries

    Args:
        northVectorOrRotation: A vector that shows North or a number that shows
                               the rotation of the North from the Y axis
        bldgMasses: List of closed Breps as thermal zones.
    Returns:
        report: ...
        thermalZones: Thermal zone's geometries for visualiza
"""

ghenv.Component.Name = 'Honeybee EP context Surfaces'
ghenv.Component.NickName = 'HB_EPContextSrf'
ghenv.Component.Message = 'VER 0.0.62\nJUL_28_2017'
ghenv.Component.IconDisplayMode = ghenv.Component.IconDisplayMode.application
ghenv.Component.Category = "Honeybee"
ghenv.Component.SubCategory = "10 | Energy | Energy"
#compatibleHBVersion = VER 0.0.57\nNOV_04_2016
#compatibleLBVersion = VER 0.0.59\nFEB_01_2015
ghenv.Component.AdditionalHelpFromDocStrings = "2"

import rhinoscriptsyntax as rs
import Rhino as rc
import scriptcontext as sc
import os
import System
import Grasshopper.Kernel as gh
import uuid

tolerance = sc.doc.ModelAbsoluteTolerance
import math


def main(shdSurfaces, EPTransSchedule, meshingSettings, justBoundingBox):
    
    # import the classes
    if sc.sticky.has_key('honeybee_release'):

        try:
            if not sc.sticky['honeybee_release'].isCompatible(ghenv.Component): return -1
            if sc.sticky['honeybee_release'].isInputMissing(ghenv.Component): return -1
        except:
            warning = "You need a newer version of Honeybee to use this compoent." + \
            " Use updateHoneybee component to update userObjects.\n" + \
            "If you have already updated userObjects drag Honeybee_Honeybee component " + \
            "into canvas and try again."
            w = gh.GH_RuntimeMessageLevel.Warning
            ghenv.Component.AddRuntimeMessage(w, warning)
            return -1
        
        # don't customize this part
        hb_EPSrf = sc.sticky["honeybee_EPSurface"]
        hb_EPSHDSurface = sc.sticky["honeybee_EPShdSurface"]
        hb_RADMaterialAUX = sc.sticky["honeybee_RADMaterialAUX"]
        hb_EPObjectsAux = sc.sticky["honeybee_EPObjectsAUX"]()
        HBScheduleList = sc.sticky["honeybee_ScheduleLib"].keys()

        ########################################################################
        #----------------------------------------------------------------------#
        shdBreps = []
        # create bounding box of shading geometries
        if justBoundingBox:
            for brep in shdSurfaces:
                if brep.Faces.Count>1 or not brep.Faces[0].IsPlanar(sc.doc.ModelAbsoluteTolerance):
                    shdBreps.append(brep.GetBoundingBox(True).ToBrep())
                else:
                    shdBreps.append(brep)
        else:
            shdBreps = shdSurfaces
        
        shadingClasses = []
        shadingMeshPreview = []
        
        if meshingSettings == None:
            mp = rc.Geometry.MeshingParameters.Minimal
            mp.SimplePlanes = True
        else:
            mp = meshingSettings
        
        def getRadMaterialName(radMaterial):
            nameStr = radMaterial.split(" ")[2]
            name =  nameStr.split("\n")[0]
            return name
        
        for brepCount, brep in enumerate(shdBreps):
            if brep != None:
                isPlanar = True
                # check planarity
                for face in brep.Faces:
                    if not face.IsPlanar(tolerance):
                        isPlanar = False
                        break
                
                shadingBreps = []
                if not isPlanar:
                    meshArray = rc.Geometry.Mesh.CreateFromBrep(brep, mp)
                    for mesh in meshArray:
                        for meshFace in range(mesh.Faces.Count):
                            vertices = list(mesh.Faces.GetFaceVertices(meshFace))[1:]
                            vertices = vertices + [sc.doc.ModelAbsoluteTolerance]
                            # create the brep from mesh
                            shdBrep = rc.Geometry.Brep.CreateFromCornerPoints(*vertices)
                            shadingBreps.append(shdBrep)
                else:
                    for face in brep.Faces:
                        shadingBreps.append(face.DuplicateFace(False))
                
                for faceCount, shdBrep in enumerate(shadingBreps):
                        thisShading = hb_EPSHDSurface(shdBrep, 1000*brepCount + faceCount, 'shdSrf_' + `brepCount` + '_' + `faceCount` + "_" + str(uuid.uuid4()))
                        
                        # add transmittance schedule if any
                        if EPTransSchedule!=None:
                            schedule= EPTransSchedule.upper()
                            if schedule!=None and not schedule.lower().endswith(".csv") and schedule not in HBScheduleList:
                                msg = "Cannot find " + schedule + " in Honeybee schedule library."
                                print msg
                                ghenv.Component.AddRuntimeMessage(gh.GH_RuntimeMessageLevel.Warning, msg)
                                return -1
                            elif schedule!=None and schedule.lower().endswith(".csv"):
                                # check if csv file is existed
                                if not os.path.isfile(schedule):
                                    msg = "Cannot find the shchedule file: " + schedule
                                    print msg
                                    ghenv.Component.AddRuntimeMessage(gh.GH_RuntimeMessageLevel.Warning, msg)
                                    return -1
                            
                            thisShading.TransmittanceSCH = schedule
                        
                        # add the Rad Material if any
                        if RADMaterial!=None:
                            # if it is just the name of the material make sure it is already defined
                            if len(RADMaterial.split(" ")) == 1:
                                # if the material is not in the library add it to the library
                                if not hb_RADMaterialAUX.isMatrialExistInLibrary(RADMaterial):
                                    warningMsg = "Can't find " + RADMaterial + " in RAD Material Library.\n" + \
                                                "Add the material to the library and try again."
                                    ghenv.Component.AddRuntimeMessage(gh.GH_RuntimeMessageLevel.Warning, warningMsg)
                                    return
                                
                                try:
                                    thisShading.setRADMaterial(RADMaterial)
                                except Exception, e:
                                    print e
                                    warningMsg = "You are using an old version of Honeybee_Honeybee! Update your files and try again."
                                    print warningMsg
                                    ghenv.Component.AddRuntimeMessage(gh.GH_RuntimeMessageLevel.Warning, warningMsg)
                                    return
                                
                                addedToLib = True
                            else:
                                
                                # try to add the material to the library
                                addedToLib, thisShading.RadMaterial = hb_RADMaterialAUX.analyseRadMaterials(RADMaterial, True)
                                
                            if addedToLib==False:
                                warningMsg = "Failed to add " + RADMaterial + " to the Library."
                                ghenv.Component.AddRuntimeMessage(gh.GH_RuntimeMessageLevel.Warning, warningMsg)
                                return
                        
                        # add shading to the list
                        shadingClasses.append(thisShading)
                
        # add to the hive
        hb_hive = sc.sticky["honeybee_Hive"]()
        HBContext  = hb_hive.addToHoneybeeHive(shadingClasses, ghenv.Component)
        return HBContext
        ################################################################################################
    else:
        print "You should first let Honeybee to fly..."
        w = gh.GH_RuntimeMessageLevel.Warning
        ghenv.Component.AddRuntimeMessage(w, "You should first let Honeybee to fly...")
        return -1
        

if _shdSurfaces and _shdSurfaces[0]!=None:
    # add cleaning function
    result= main(_shdSurfaces, EPTransSchedule_, meshingSettings_, justBoundingBox_)
    
    if result != -1: HBContext = result
# ---------- end hb_epcontextsrf ----------
addhbglz = Honeybee_addHBGlz(HBObj=createhbsrfs_3.HBSurface, childSurfaces=flatten(brep))  # -> HBObjWGLZ; plug-in component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
merge_2 = Merge(Data1=createhbsrfs.HBSurface, Data2=createhbsrfs_2.HBSurface, Data3=createhbsrfs_5.HBSurface)
makeadiabatic = Honeybee_MakeAdiabatic(HBSrfs=merge_2)  # -> HBSrfs; plug-in component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
bldgprograms = Honeybee_bldgPrograms({"Office": 0, "Retail": 1, "MidriseApartment": 2, "PrimarySchool": 3, "SecondarySchool": 4, "SmallHotel": 5, "LargeHotel": 6, "Hospital": 7, "Outpatient": 8, "Warehouse": 9, "SuperMarket": 10, "FullServiceRestaurant": 11, "QuickServiceRestaurant": 12}, selected="MidriseApartment")
createhbzones = Honeybee_createHBZones(name="myroom", zoneProgram=bldgprograms, HBSurfaces=flatten([addhbglz, makeadiabatic]), isConditioned=Toggle(True))  # -> readMe, HBZone; plug-in component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
brep_7 = Brep(createhbzones.HBZone)
# schedule
# MY SCHEDULE
setepzoneschedules = Honeybee_SetEnergyPlusZoneSchedules(HBZones=brep_7, occupancySchedules=panel_4)  # -> schedules, simplify(HBZones); plug-in component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

callfromepconstrlibrary = Honeybee_CallFromEPConstructionLibrary()  # -> ThermMaterials, EPMaterials, EPWindowMaterials, EPConstructions; plug-in component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
panel_8 = Panel("""0
4
1
2""")
searchepconstruction = Honeybee_SearchEPConstruction(EPConstrList=callfromepconstrlibrary.EPConstructions, standard="2", climateZone="4", surfaceType=panel_8)  # -> EPSelectedConstr; plug-in component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
# CONSTRUCTION
panel_9 = Panel(searchepconstruction)
decomposeepconstruction = Honeybee_DecomposeEPConstruction(cnstrName=searchepconstruction)  # -> materials, comments, UValue_SI, UValue_IP, RValue_SI, RValue_IP; plug-in component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
decomposeepconstruction_2 = Honeybee_DecomposeEPConstruction(cnstrName=searchepconstruction)  # -> materials, comments, UValue_SI, UValue_IP, RValue_SI, RValue_IP; plug-in component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
sort = SortList(Keys=decomposeepconstruction.RValue_SI, ValuesA=searchepconstruction)  # -> Keys, reverse(ValuesA)
sort_2 = SortList(Keys=decomposeepconstruction.RValue_SI, ValuesA=searchepconstruction)  # -> Keys, ValuesA
sort_3 = SortList(Keys=decomposeepconstruction_2.RValue_SI, ValuesA=searchepconstruction)  # -> Keys, ValuesA
panel_10 = Panel("""0
-1
0
0""")
item_3 = ListItem(List=sort_2.ValuesA, Index=0, Wrap=True)  # -> flatten(Item)
item_4 = ListItem(List=sort.ValuesA, Index=0, Wrap=True)  # -> flatten(Item)
item_5 = ListItem(List=sort_3.ValuesA, Index=graft(panel_10), Wrap=True)  # -> flatten(Item)
item_6 = ListItem(List=item_4, Index=0, Wrap=True)  # -> Item, Item1, Item2, Item3
item_7 = ListItem(List=item_3, Index=0, Wrap=True)  # -> Item, Item1, Item2, Item3
item_8 = ListItem(List=item_5, Index=0, Wrap=True)  # -> Item, Item1, Item2, Item3
setepzonecnstr = Honeybee_SetEPZoneConstruction(
    HBZones=flatten(setepzoneschedules.HBZones),
    wallEPConstruction=item_6.Item,
    windowEPConstruction=item_6.Item1,
    roofEPConstruction=item_6.Item2,
    floorEPConstruction=item_6.Item3)  # -> simplify(modifiedHBZones); plug-in component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
setepzonecnstr_2 = Honeybee_SetEPZoneConstruction(
    HBZones=flatten(setepzoneschedules.HBZones),
    wallEPConstruction=item_7.Item,
    windowEPConstruction=item_7.Item1,
    roofEPConstruction=item_7.Item2,
    floorEPConstruction=item_7.Item3)  # -> simplify(modifiedHBZones); plug-in component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
setepzonecnstr_3 = Honeybee_SetEPZoneConstruction(
    HBZones=flatten(setepzoneschedules.HBZones),
    wallEPConstruction=item_8.Item,
    windowEPConstruction=item_8.Item1,
    roofEPConstruction=item_8.Item2,
    floorEPConstruction=item_8.Item3)  # -> simplify(modifiedHBZones); plug-in component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

# ----
# ANNUAL DAYLIGHT SIM
# run day sim
toggle = BooleanToggle(False)
conduction = Slider(2, range=0..2)

list = ValueList({"default": 0, "low R value": 1, "high R value": 2}, selected="high R value")
# conduction
# CONSTRUCTION
filter_3 = StreamFilter(
    Gate=conduction,
    Stream0=setepzoneschedules.HBZones,
    Stream1=setepzonecnstr_2,
    Stream2=setepzonecnstr,
    Stream3=setepzonecnstr_3)

filter_4 = StreamFilter(Gate=toggle, Stream1=createhbzones.HBZone)
wires = BrepWireframe(Brep=filter_4, Density=-1)
# make receipe
genhbzonetestpts = Honeybee_GenerateZoneTestPoints(HBZone=filter_4, gridSize="0.5", distBaseSrf="0.76", moveTestMesh=True)  # -> readMe, simplify(testPoints), simplify(ptsVectors), simplify(facesArea), simplify(mesh); plug-in component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
path = FilePath("C:\Users\wen\Desktop\Philadelphia_weather_files\USA_PA_Philadelphia.Intl.AP.724080_TMY3.epw")

bldgprograms_2 = Honeybee_bldgPrograms({"Office": 0, "Retail": 1, "MidriseApartment": 2, "PrimarySchool": 3, "SecondarySchool": 4, "SmallHotel": 5, "LargeHotel": 6, "Hospital": 7, "Outpatient": 8, "Warehouse": 9, "SuperMarket": 10, "FullServiceRestaurant": 11, "QuickServiceRestaurant": 12}, selected="MidriseApartment")
# infiltration
listzoneprograms = Honeybee_ListZonePrograms(bldgProgram=bldgprograms_2)  # -> MidriseApartmentZonePrograms; plug-in component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
geteploads = Honeybee_GetEnergyPlusLoads(zoneProgram=listzoneprograms)  # -> equipmentLoadPerArea, infiltrationRatePerArea, lightingDensityPerArea, numOfPeoplePerArea, ventilationPerArea, ventilationPerPerson; plug-in component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
setepzoneloads = Honeybee_SetEnergyPlusZoneLoads(HBZones=filter_3, infiltrationRatePerArea=geteploads.infiltrationRatePerArea)  # -> loads, HBZones; plug-in component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

annualdaylightsimulation = Honeybee_AnnualDaylightSimulation(
    epwWeatherFile=path,
    testPoints=genhbzonetestpts.testPoints,
    ptsVectors=genhbzonetestpts.ptsVectors,
    testMesh=genhbzonetestpts.mesh)  # -> analysisRecipe; plug-in component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
toggle_2 = BooleanToggle(True)
# run sim
rundaylightanalysis = Honeybee_RunDaylightSimulation(
    HBObjects=flatten([filter_4, hb_epcontextsrf]),
    analysisRecipe=annualdaylightsimulation,
    writeRad=toggle_2,
    runRad=toggle_2,
    overwriteResults=True)  # -> readMe, analysisType, resultsUnit, results, testPts, resultFiles, radGeoFile, studyFolder, done; plug-in component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

# ----
# read result
occupancygenerator = Honeybee_DaysimOccupancyGenerator(weekendDays=[1, 2], writeTheOcc=Toggle(True))  # -> occupancyFile; plug-in component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

readannualresultsi = Honeybee_ReadAnnualResultI(
    illFilesAddress=rundaylightanalysis.resultFiles,
    testPoints=simplify(genhbzonetestpts.testPoints),
    ptsVectors=genhbzonetestpts.ptsVectors,
    occupancyFiles=occupancygenerator,
    DLAIllumThresholds=300,
    runIt=Toggle(True))  # -> DLA, UDLI_Less_100, UDLI_100_2000, UDLI_More_2000, CDA, sDA, annualProfiles, htmReport; plug-in component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
minindoor = Slider(18, range=15..18)
maxindoor = Slider(27, range=25..27)
minoutdoor = Slider(21, range=20..23)
maxoutdoor = Slider(24, range=22..25)

panel_11 = Panel("22")
panel_12 = Panel("26")
panel_13 = Panel("18")
panel_14 = Panel("25")
# ventilation
setepnatvent = Honeybee_SetEPAirFlow(
    HBZones=flatten(setepzoneloads.HBZones),
    naturalVentilationType="1",
    minIndoorTempForNatVent=minindoor,
    maxIndoorTempForNatVent=maxindoor,
    minOutdoorTempForNatVent=minoutdoor,
    maxOutdoorTempForNatVent=maxoutdoor,
    fractionOfGlzAreaOperable="0.5",
    fractionOfGlzHeightOperable="1")  # -> readMe, simplify(HBZones); plug-in component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

legendpar = Ladybug_LegendParameters(lowBound="0", highBound="100", numSegments="11")  # -> legendPar; plug-in component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
pt_4 = Point(<point referenced from the Rhino model>)
avr = Average(Input=readannualresultsi.UDLI_100_2000)
averageudli = Data(avr)
concat_5 = Concatenate(FragmentA="Average:", FragmentB=avr, FragmentC="%")
pt_5 = Point(<point referenced from the Rhino model>)
recolormesh = Ladybug_RecolorMesh(
    analysisResult=readannualresultsi.UDLI_100_2000,
    inputMesh=genhbzonetestpts.mesh,
    legendPar=legendpar,
    analysisTitle="UDLI 100-2000",
    legendTitle="%")  # -> readMe, newMesh, newLegend, legendBasePt, meshColors, legendColors; plug-in component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
concat_6 = Concatenate(FragmentA=panel_7, FragmentC=panel_6, FragmentE=panel_5, FragmentG=panel_2)
toggle_3 = BooleanToggle(True)

geo = Geometry([recolormesh.newMesh, recolormesh.newLegend])
# preview
tag = TextTag3D(
    Location=pt_4,
    Text=concat_5,
    Size=Slider(0.3, range=0..1),
    Colour=ColourSwatch(SwatchColor=RGB(0, 0, 0)),
    Justification=7)
tag_2 = TextTag3D(
    Location=pt_5,
    Text=concat_6,
    Size=Slider(0.3, range=0..1),
    Colour=ColourSwatch(SwatchColor=RGB(0, 0, 0)),
    Justification=7)

brep_8 = Brep([setepzoneloads.HBZones, hb_epcontextsrf])
jagged = SettingsSpeed()
mesh = MeshBrep(Brep=brep_2, Settings=jagged)
# 3d geo output
swatch = ColourSwatch(SwatchColor=RGB(117, 117, 117))
wires_2 = BrepWireframe(Brep=brep_8, Density=-1)
mjoin = MeshJoin(Meshes=flatten(mesh))
join_3 = JoinCurves(Curves=flatten(wires_2), Preserve=False)
mcol = MeshColours(Mesh=mjoin, Colours=swatch)
geo_2 = Geometry(flatten([mcol, join_3, geo]))

epoutput = Honeybee_GenerateEPOutput(
    zoneEnergyUse=toggle_3,
    zoneGainsAndLosses=toggle_3,
    zoneComfortMetrics=toggle_3,
    surfaceTempAnalysis="False",
    surfaceEnergyAnalysis=toggle_3)  # -> report, flatten(simulationOutputs); plug-in component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
toggle_4 = BooleanToggle(True)
# run energy sim
runenergysimulation = Honeybee_RunEnergySimulation(
    epwFile=path,
    HBZones=flatten(brep_7),
    HBContext=flatten(hb_epcontextsrf),
    simulationOutputs=flatten(epoutput.simulationOutputs),
    writeIdf=toggle_4,
    runEnergyPlus=toggle_4)  # -> report, idfFileAddress, htmlReport, resultFileAddress; plug-in component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
importepw = Ladybug_ImportEpw(epwFile=path)  # -> readMe, latitude, location, dryBulbTemperature, dewPointTemperature, relativeHumidity, windSpeed, windDirection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; plug-in component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
readepresult = Honeybee_ReadEPResult(resultFileAddress=runenergysimulation.resultFileAddress)  # -> totalThermalLoad, thermalLoadBalance, cooling, heating, electricLight, electricEquip, port, port_2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; plug-in component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
iterator_3 = ColibriIterator(ceiling=ceiling, wall=wall, Fragment_B=fragment_b, floor=floor, ignoreAllWarningMsg=False, RemoteFly=False)  # -> ceiling, wall, Fragment_B, floor, Value_N, Genome

readepsrfresult = Honeybee_ReadEPSurfaceResult(resultFileAddress=runenergysimulation.resultFileAddress)  # -> port, port_2, surfaceEnergyFlow, opaqueEnergyFlow, glazEnergyFlow, port_3, port_4, port_5, port_6, port_7; plug-in component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
strnum = Ladybug_SeparateData(inputList=flatten(readepresult.electricLight))  # -> numbers, strings; plug-in component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
strnum_2 = Ladybug_SeparateData(inputList=flatten(readepresult.cooling))  # -> numbers, strings; plug-in component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
strnum_3 = Ladybug_SeparateData(inputList=flatten(readepresult.heating))  # -> numbers, strings; plug-in component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
strnum_4 = Ladybug_SeparateData(inputList=flatten(readepresult.totalThermalLoad))  # -> numbers, strings; plug-in component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
energybalance = Honeybee_ConstructEnergyBalance(
    HBZones=flatten(setepnatvent.HBZones),
    cooling=readepresult.cooling,
    heating=readepresult.heating,
    electricLight=readepresult.electricLight,
    electricEquip=readepresult.electricEquip,
    fanElectric=readepresult.port,
    peopleGains=readepresult.peopleGains,
    totalSolarGain=readepresult.totalSolarGain,
    infiltrationEnergy=readepresult.infiltrationEnergy,
    mechVentilationEnergy=readepresult.mechVentilationEnergy,
    natVentEnergy=readepresult.port_3,
    surfaceEnergyFlow=readepsrfresult.surfaceEnergyFlow)  # -> readMe, port, flrNormEnergyBal, flrNormBalWStorage, port_2, modelEnergyBalance, energyBalWithStorage; plug-in component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
ma = MassAddition(Input=strnum.numbers)  # -> Result, PartialResults
ma_2 = MassAddition(Input=strnum_3.numbers)  # -> Result, PartialResults
ma_3 = MassAddition(Input=strnum_2.numbers)  # -> Result, PartialResults
ma_4 = MassAddition(Input=strnum_4.numbers)  # -> Result, PartialResults
panel_15 = Panel(ma_3.Result)
panel_16 = Panel(ma.Result)
panel_17 = Panel(ma_2.Result)
panel_18 = Panel(ma_4.Result)
# energy balance
selectandaveragedata = Ladybug_AverageData(annualHourlyData=energybalance.flrNormBalWStorage, totalOrAverage=Toggle(True))  # -> readMe, selHourlyData, totaledDaily, totaledMonthly, totMonthlyPerHour, totAnalysisPeriod; plug-in component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
thermalload = Integer(panel_18)
lighting = Integer(panel_16)
cooling = Integer(panel_15)
heating = Integer(panel_17)
gradientlibrary = Ladybug_GradientLibrary(gradIndex="19")  # -> customColors; plug-in component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
legendpar_2 = Ladybug_LegendParameters(highBound=Slider(100, range=0..1000), customColors=flatten(gradientlibrary))  # -> legendPar; plug-in component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
concat_7 = Concatenate(
    FragmentA="Energy used in total(kWh):",
    FragmentC="Cooling Energy: ",
    FragmentD=cooling,
    FragmentF="Heating Energy: ",
    FragmentG=heating,
    FragmentI="Lighting Energy: ",
    FragmentJ=lighting,
    FragmentL="ThermalLoad:  ",
    FragmentM=thermalload)
pt_6 = Point(<point referenced from the Rhino model>)
barchart = Ladybug_MonthlyBarChart(inputData=flatten(selectandaveragedata.totaledMonthly), stackValues=Toggle(True), legendPar=legendpar_2)  # -> readMe, dataMesh, dataCurves, dataCrvColors, graphAxes, graphLabels, title, titleBasePt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; plug-in component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
tag_3 = TextTag3D(
    Location=pt_6,
    Text=concat_7,
    Size=Slider(17, range=0..100),
    Colour=ColourSwatch(SwatchColor=RGB(0, 0, 0)),
    Justification=7)
geo_3 = Geometry([barchart.dataMesh, barchart.dataCurves, barchart.dataCrvColors, barchart.graphAxes, barchart.graphLabels, barchart.title, barchart.legend, barchart.comfortBand, barchart.comfortLegend])
pt_7 = Point(<point referenced from the Rhino model>)
move_3 = Move(Geometry=geo_3, Motion=pt_7)  # -> Geometry, Transform
scale = Scale(Geometry=move_3.Geometry, Center=pt_7, Factor=Slider(7, range=0..10))  # -> Geometry, Transform

# ----
# record
img_setting_3 = ImageSetting(ImageSaveAsName="defaultName", RhinoViewNames="myview", Width="1600", Height="1000")
parameters = ColibriParameters(average=flatten(avr))
aggregator = ColibriAggregator(
    Folder="C:\Users\wen\Desktop\gh1",
    IterationGenomeID=iterator_3.Genome,
    IterationPhenomeResults=parameters,
    ImgSetting=img_setting_3,
    _3DObjects=flatten(geo),
    Write=Toggle(False),
    recordingMode=3)
panel_19 = Panel("")  # disabled
panel_20 = Panel("hot : ")  # disabled
panel_21 = Panel("%   cold : ")  # disabled

toggle_5 = BooleanToggle(True)  # disabled
adaptivecomfortcalculator = Ladybug_AdaptiveComfortCalculator(
    dryBulbTemperature=readepresult.airTemperature,
    meanRadiantTemperature=readepresult.meanRadTemperature,
    prevailingOutdoorTemp=importepw.dryBulbTemperature,
    runIt=toggle_5)  # -> readMe, port, comfortableOrNot, conditionOfPerson, degreesFromTarget, port_2, targetTemperature, upperTemperatureBound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; disabled; plug-in component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
panel_22 = Panel("8")  # disabled
gradientlibrary_2 = Ladybug_GradientLibrary(gradIndex=panel_22)  # -> customColors; disabled; plug-in component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
panel_23 = Panel("-1")  # disabled
panel_24 = Panel("1")  # disabled
panel_25 = Panel("3")  # disabled
item_9 = ListItem(List=adaptivecomfortcalculator.percentHotCold, Index=0, Wrap=True)  # -> Item, Item1; disabled
panel_26 = Panel(adaptivecomfortcalculator.percentOfTimeComfortable)  # disabled
panel_27 = Panel("comfort percentage :")  # disabled
legendpar_3 = Ladybug_LegendParameters(lowBound=panel_23, highBound=panel_24, numSegments=panel_25, customColors=flatten(gradientlibrary_2))  # -> legendPar; disabled; plug-in component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
cold = Number(item_9.Item1)  # disabled
hot = Number(item_9.Item)  # disabled
panel_28 = Panel("%")  # disabled
panel_29 = Panel(".25")  # disabled
panel_30 = Panel("0")  # disabled
number_slider = Slider(31, range=0..100)  # disabled
comfort = Number(panel_26)  # disabled
swatch_2 = ColourSwatch(SwatchColor=RGB(0, 0, 0))  # disabled
concat_8 = Concatenate(
    FragmentA=panel_27,
    FragmentB=panel_26,
    FragmentC=panel_28,
    FragmentD=panel_19,
    FragmentE=panel_20,
    FragmentF=hot,
    FragmentG=panel_21,
    FragmentH=cold,
    FragmentI=panel_28)  # disabled
pt_8 = Point(<point referenced from the Rhino model>)  # disabled
_3dchart = Ladybug_3DChart(inputData=flatten(adaptivecomfortcalculator.conditionOfPerson), xScale=panel_29, zScale=panel_30, legendPar=legendpar_3)  # -> readMe, graphMesh, graphCurves, legend, legendBasePts, title, titleBasePts, dataPts, conditionalHOY; disabled; plug-in component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
tag_4 = TextTag3D(Location=pt_8, Text=concat_8, Size=number_slider, Colour=swatch_2, Justification=7)  # disabled

panel_31 = Panel("13")  # disabled
gradientlibrary_3 = Ladybug_GradientLibrary(gradIndex=panel_31)  # -> customColors; disabled; plug-in component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
panel_32 = Panel("-20")  # disabled
panel_33 = Panel("20")  # disabled
panel_34 = Panel("10")  # disabled
# degree from target
legendpar_4 = Ladybug_LegendParameters(lowBound=panel_32, highBound=panel_33, numSegments=panel_34, customColors=flatten(gradientlibrary_3))  # -> legendPar; disabled; plug-in component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
# comfort percentage
strnum_5 = Ladybug_SeparateData(inputList=flatten(adaptivecomfortcalculator.degreesFromTarget))  # -> numbers, strings; disabled; plug-in component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
pt_9 = Point(<point referenced from the Rhino model>)  # disabled
abs = Absolute(Value=strnum_5.numbers)  # disabled
avr_2 = Average(Input=abs)  # disabled
_3dchart_2 = Ladybug_3DChart(
    inputData=flatten(adaptivecomfortcalculator.degreesFromTarget),
    basePoint=pt_9,
    xScale=panel_29,
    zScale=panel_30,
    legendPar=legendpar_4)  # -> readMe, graphMesh, graphCurves, legend, legendBasePts, title, titleBasePts, dataPts, conditionalHOY; disabled; plug-in component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
averagefromtarget_abs = Data(avr_2)  # disabled
panel_35 = Panel("averageFromTarget(abs) :")  # disabled
panel_36 = Panel(" Celcius")  # disabled
number_slider_2 = Slider(31, range=0..100)  # disabled
swatch_3 = ColourSwatch(SwatchColor=RGB(0, 0, 0))  # disabled
concat_9 = Concatenate(FragmentA=panel_35, FragmentB=averagefromtarget_abs, FragmentC=panel_36)  # disabled
pt_10 = Point(<point referenced from the Rhino model>)  # disabled
tag_5 = TextTag3D(Location=pt_10, Text=concat_9, Size=number_slider_2, Colour=swatch_3, Justification=7)  # disabled

parameters_2 = ColibriParameters(
    comfort=flatten(comfort),
    hot=flatten(hot),
    cold=flatten(cold),
    averageFromTarget_abs=flatten(averagefromtarget_abs),
    averageUDLI=flatten(averageudli))
aggregator_2 = ColibriAggregator(
    Folder="C:\Users\wen\Desktop\gh working\windowSize",
    IterationGenomeID=iterator_2.IterationGenome,
    IterationPhenomeResults=parameters_2,
    ImgSetting=img_setting,
    _3DObjects=flatten(geo_2),
    Write=Toggle(False),
    recordingMode=3)
parameters_3 = ColibriParameters(comfort=flatten(comfort), averageFromTarget_abs=flatten(averagefromtarget_abs), hot=flatten(hot), cold=flatten(cold))
aggregator_3 = ColibriAggregator(
    Folder=panel,
    IterationGenomeID=iterator.Genome,
    IterationPhenomeResults=parameters_3,
    ImgSetting=img_setting_2,
    _3DObjects=flatten(geo_2),
    Write=Toggle(False),
    recordingMode=3)
parameters_4 = ColibriParameters(cooling=flatten(cooling), heating=flatten(heating), lighting=flatten(lighting), ThermalLoad=flatten(thermalload))
iterator_4 = ColibriIterator(
    minIndoor=minindoor,
    maxIndoor=maxindoor,
    minOutdoor=minoutdoor,
    maxOutdoor=maxoutdoor,
    conduction=conduction,
    ignoreAllWarningMsg=False,
    RemoteFly=False)  # -> minIndoor, maxIndoor, minOutdoor, maxOutdoor, conduction, Value_N, Genome
img_setting_4 = ImageSetting(ImageSaveAsName="defaultName", RhinoViewNames="energy1", Width="1400", Height="800")
aggregator_4 = ColibriAggregator(
    Folder="C:\Users\wen\Desktop\gh working\energy and material-2",
    IterationGenomeID=iterator_4.Genome,
    IterationPhenomeResults=parameters_4,
    ImgSetting=img_setting_4,
    Write=Toggle(False),
    recordingMode=3)
