# Grasshopper definition kamath_ayodh.gh (Grasshopper 0.9.76)
# plug-ins: Python Interpreter, Colibri

ladybug = Ladybug_Ladybug()  # -> Vviiiiiiiiiizzz; plug-in component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
honeybee = Honeybee_Honeybee()  # -> Vviiiiiiiiiizzz; plug-in component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

# ---- group: Adjust External Wall
brep = Brep(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)

# ---- group: Adjust Window Wall
brep_2 = Brep(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)

# ---- group: Existing Openings
panel = Panel("4")

# ---- group: Existing External Wall
brep_3 = Brep(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)

# ---- group: Existing Window Wall
brep_4 = Brep([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])

# ----
glzratio = Slider(0.95, range=0.1..0.95)

# ---- group: Neighbouring Building
brep_5 = Brep([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])

# ---- group: Facade Srf
bbox = BoundingBox(Content=[brep_3, brep_4], Plane=PlaneXY(0, 0, 0), UnionBox=True)  # -> Box, Box_2
box_corners = BoxCorners(Box=bbox.Box)  # -> CornerA, CornerB, CornerC, CornerD, CornerE, CornerF, CornerG, CornerH
srf4pt = _4PointSurface(CornerA=box_corners.CornerA, CornerB=box_corners.CornerE, CornerC=box_corners.CornerH, CornerD=box_corners.CornerD)

# ---- group: Infiltration
area = Area(Geometry=srf4pt)  # -> Area, Centroid
multiplication = Multiplication(A=".0001", B=area.Area)

# ---- group: Custom Schedules
panel_2 = Panel("""70
70
70
70
70
70
70
80
80
80
80
80
80
80
80
80
100
80
80
80
80
80
80
70""")
panel_3 = Panel("""1
1
1
1
1
1
1
1
1
1
1
1
1
1
1
1
1
1
1
1
1
1
1
1""")
constantschedule = Honeybee_ConstantSchedule(value=panel_3, scheduleName="StayAtHomeOcc")  # -> readMe, schedule, weekSched, schedIDFText; plug-in component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
constantschedule_2 = Honeybee_ConstantSchedule(value=panel_2, scheduleName="StayAtHomeAct", schedTypeLimits="ActivityLevel")  # -> readMe, schedule, weekSched, schedIDFText; plug-in component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

# ---- group: DaylightingSimulation
# Make sure there are no spaces in the file path
path = FilePath("C:\Users\Ayodh\Documents\Us\Ayodh\UPenn\1709\753\USA_PA_Philadelphia.Intl.AP.724080_TMY3\USA_PA_Philadelphia.Intl.AP.724080_TMY3.epw")

# ---- group: Test Point / Adequate for Computer Screen
panel_4 = Panel("150")

# ---- group: Furniture
brep_6 = Brep([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])

# ----
Y = UnitY(Factor="50")
move = Move(Geometry=brep_6, Motion=Y)  # -> Geometry, Transform
preview = CustomPreview(Geometry=move.Geometry, Shader=ColourSwatch(SwatchColor=RGBA(0, 0, 0, 67)))

# ---- group: Run
toggle = BooleanToggle(False)

# ----
multiplication_2 = Multiplication(A="8", B="365")
vec = VectorXYZ(XComponent="-2.25", YComponent="-.5", ZComponent=0)  # -> Vector, Length
panel_5 = Panel("""5
3
3""")
panel_6 = Panel("""PlanExtent
WirePerspective""")
selection = IterationSelection(Divisions=panel_5)
multiplication_3 = Multiplication(A="2500", B=0.7)
img_setting = ImageSetting(ImageSaveAsName="defaultName", RhinoViewNames=panel_6, Width="2500", Height=multiplication_3)

# ---- group: HB Setup
panel_7 = Panel("reflectingCurtains")
brep_7 = Brep([<brep referenced from the Rhino model> x2])
brep_8 = Brep([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])
panel_8 = Panel("0")
brep_9 = Brep([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])
brep_10 = Brep([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])
createhbsrfs = Honeybee_createHBSrfs(geometry=brep_8, srfName="internalWalls", srfType="0")  # -> readMe, simplify(HBSurface); plug-in component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
createhbsrfs_2 = Honeybee_createHBSrfs(geometry=brep_9, srfName="floor", srfType="2")  # -> readMe, simplify(HBSurface); plug-in component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
createhbsrfs_3 = Honeybee_createHBSrfs(geometry=brep_10, srfName="ceiling", srfType="3")  # -> readMe, simplify(HBSurface); plug-in component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
createhbsrfs_4 = Honeybee_createHBSrfs(geometry=brep_3, srfName="externalWall", srfType="0")  # -> readMe, simplify(HBSurface); plug-in component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
createhbsrfs_5 = Honeybee_createHBSrfs(geometry=brep_4, srfName="windowWall", srfType="0")  # -> readMe, simplify(HBSurface); plug-in component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
glazingcreator = Honeybee_GlazingBasedOnRatio(HBObjects=createhbsrfs_5.HBSurface, glzRatio=glzratio, runIt=Toggle(True))  # -> readMe, HBObjWGLZ; plug-in component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

# ----
createhbsrfs_6 = Honeybee_createHBSrfs(geometry=brep_7, srfName=panel_7, srfType=panel_8)  # -> readMe, simplify(HBSurface); plug-in component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

# ---- group: HB Setup / Assumes neighbours + corridor @ same temperature
makeadiabatic = Honeybee_MakeAdiabatic(HBSrfs=[createhbsrfs.HBSurface, createhbsrfs_2.HBSurface, createhbsrfs_3.HBSurface, createhbsrfs_6.HBSurface])  # -> HBSrfs; plug-in component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

# ----
debrep = DeconstructBrep(Brep=flatten(glazingcreator.HBObjWGLZ))  # -> Faces, Edges, Vertices
item = ListItem(List=debrep.Faces, Index=0, Wrap=True)
item_2 = ListItem(List=debrep.Faces, Index=1, Wrap=True)

# ---- group: Shading
bbox_2 = BoundingBox(Content=flatten([item, item_2]), Plane=PlaneXY(0, 0, 0), UnionBox=True)  # -> Box, Box_2
box_corners_2 = BoxCorners(Box=bbox_2.Box)  # -> CornerA, CornerB, CornerC, CornerD, CornerE, CornerF, CornerG, CornerH
srf4pt_2 = _4PointSurface(
    CornerA=box_corners_2.CornerA,
    CornerB=box_corners_2.CornerD,
    CornerC=box_corners_2.CornerH,
    CornerD=box_corners_2.CornerE)
X = UnitX(Factor=".01")
move_2 = Move(Geometry=srf4pt_2, Motion=X)  # -> Geometry, Transform
edges = BrepEdges(Brep=move_2.Geometry)  # -> Naked, Interior, NonManifold
item_3 = ListItem(List=edges.Naked, Index=0, Wrap=True)
item_4 = ListItem(List=edges.Naked, Index=1, Wrap=True)
divide = DivideCurve(Curve=item_3, Count="5", Kinks=False)  # -> Points, Tangents, Parameters
divide_2 = DivideCurve(Curve=item_4, Count="5", Kinks=False)  # -> Points, Tangents, Parameters
shade_depth = Slider(0.45, range=0.15..0.45)
shadeangle = Slider(40, range=0..40)
vec2pt = Vector2Pt(PointA=box_corners_2.CornerC, PointB=divide.Points, Unitize=False)  # -> Vector, Length
vec2pt_2 = Vector2Pt(PointA=box_corners_2.CornerC, PointB=divide_2.Points, Unitize=False)  # -> Vector, Length
move_3 = Move(Geometry=item_4, Motion=vec2pt.Vector)  # -> Geometry, Transform
move_4 = Move(Geometry=item_3, Motion=vec2pt_2.Vector)  # -> Geometry, Transform
X_2 = UnitX(Factor=shade_depth)
extr = Extrude(Base=[move_3.Geometry, move_4.Geometry], Direction=X_2)
bbox_3 = BoundingBox(Content=extr, Plane=PlaneXY(0, 0, 0), UnionBox=True)  # -> Box, Box_2
box_corners_3 = BoxCorners(Box=bbox_3.Box)  # -> CornerA, CornerB, CornerC, CornerD, CornerE, CornerF, CornerG, CornerH
pl_3pt = Plane3Pt(PointA=box_corners_3.CornerB, PointB=box_corners_3.CornerC, PointC=box_corners_3.CornerE)
srf4pt_3 = _4PointSurface(
    CornerA=box_corners_3.CornerB,
    CornerB=box_corners_3.CornerC,
    CornerC=box_corners_3.CornerH,
    CornerD=box_corners_3.CornerE)
split = SplitBrep(Brep=extr, Cutter=srf4pt_3)
item_5 = ListItem(List=split, Index=1, Wrap=True)
rev = ReverseList(List=flatten(item_5))
shift = ShiftList(List=rev, Shift=1, Wrap=False)
rad = Radians(Degrees=shadeangle)
area_2 = Area(Geometry=shift)  # -> Area, Centroid
ma = MassAddition(Input=area_2.Area)  # -> Result, PartialResults
rotax = RotateAxis(Geometry=shift, Angle=rad, Axis=item_3)  # -> Geometry, Transform
createhbsrfs_7 = Honeybee_createHBSrfs(geometry=rotax.Geometry, srfName="shading", srfType="6")  # -> readMe, simplify(HBSurface); plug-in component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

# ---- group: HB Setup (continued)
brep_11 = Brep(flatten([makeadiabatic, glazingcreator.HBObjWGLZ, createhbsrfs_4.HBSurface]))
hb_epcontextsrf = HoneybeeEPContextSurfaces(shdSurfaces=flatten([brep_5, createhbsrfs_7.HBSurface]), justBoundingBox=Toggle(False))  # -> HBContext; inputs shdSurfaces: list of Brep, justBoundingBox: Boolean
# ---------- hb_epcontextsrf: Python ----------
"""
prepare shading/context geometries

    Args:
        northVectorOrRotation: A vector that shows North or a number that shows
                               the rotation of the North from the Y axis
        bldgMasses: List of closed Breps as thermal zones.
    Returns:
        report: ...
        thermalZones: Thermal zone's geometries for visualiza
"""

ghenv.Component.Name = 'Honeybee EP context Surfaces'
ghenv.Component.NickName = 'HB_EPContextSrf'
ghenv.Component.Message = 'VER 0.0.62\nJUL_28_2017'
ghenv.Component.IconDisplayMode = ghenv.Component.IconDisplayMode.application
ghenv.Component.Category = "Honeybee"
ghenv.Component.SubCategory = "10 | Energy | Energy"
#compatibleHBVersion = VER 0.0.57\nNOV_04_2016
#compatibleLBVersion = VER 0.0.59\nFEB_01_2015
ghenv.Component.AdditionalHelpFromDocStrings = "2"

import rhinoscriptsyntax as rs
import Rhino as rc
import scriptcontext as sc
import os
import System
import Grasshopper.Kernel as gh
import uuid

tolerance = sc.doc.ModelAbsoluteTolerance
import math


def main(shdSurfaces, EPTransSchedule, meshingSettings, justBoundingBox):
    
    # import the classes
    if sc.sticky.has_key('honeybee_release'):

        try:
            if not sc.sticky['honeybee_release'].isCompatible(ghenv.Component): return -1
            if sc.sticky['honeybee_release'].isInputMissing(ghenv.Component): return -1
        except:
            warning = "You need a newer version of Honeybee to use this compoent." + \
            " Use updateHoneybee component to update userObjects.\n" + \
            "If you have already updated userObjects drag Honeybee_Honeybee component " + \
            "into canvas and try again."
            w = gh.GH_RuntimeMessageLevel.Warning
            ghenv.Component.AddRuntimeMessage(w, warning)
            return -1
        
        # don't customize this part
        hb_EPSrf = sc.sticky["honeybee_EPSurface"]
        hb_EPSHDSurface = sc.sticky["honeybee_EPShdSurface"]
        hb_RADMaterialAUX = sc.sticky["honeybee_RADMaterialAUX"]
        hb_EPObjectsAux = sc.sticky["honeybee_EPObjectsAUX"]()
        HBScheduleList = sc.sticky["honeybee_ScheduleLib"].keys()

        ########################################################################
        #----------------------------------------------------------------------#
        shdBreps = []
        # create bounding box of shading geometries
        if justBoundingBox:
            for brep in shdSurfaces:
                if brep.Faces.Count>1 or not brep.Faces[0].IsPlanar(sc.doc.ModelAbsoluteTolerance):
                    shdBreps.append(brep.GetBoundingBox(True).ToBrep())
                else:
                    shdBreps.append(brep)
        else:
            shdBreps = shdSurfaces
        
        shadingClasses = []
        shadingMeshPreview = []
        
        if meshingSettings == None:
            mp = rc.Geometry.MeshingParameters.Minimal
            mp.SimplePlanes = True
        else:
            mp = meshingSettings
        
        def getRadMaterialName(radMaterial):
            nameStr = radMaterial.split(" ")[2]
            name =  nameStr.split("\n")[0]
            return name
        
        for brepCount, brep in enumerate(shdBreps):
            if brep != None:
                isPlanar = True
                # check planarity
                for face in brep.Faces:
                    if not face.IsPlanar(tolerance):
                        isPlanar = False
                        break
                
                shadingBreps = []
                if not isPlanar:
                    meshArray = rc.Geometry.Mesh.CreateFromBrep(brep, mp)
                    for mesh in meshArray:
                        for meshFace in range(mesh.Faces.Count):
                            vertices = list(mesh.Faces.GetFaceVertices(meshFace))[1:]
                            vertices = vertices + [sc.doc.ModelAbsoluteTolerance]
                            # create the brep from mesh
                            shdBrep = rc.Geometry.Brep.CreateFromCornerPoints(*vertices)
                            shadingBreps.append(shdBrep)
                else:
                    for face in brep.Faces:
                        shadingBreps.append(face.DuplicateFace(False))
                
                for faceCount, shdBrep in enumerate(shadingBreps):
                        thisShading = hb_EPSHDSurface(shdBrep, 1000*brepCount + faceCount, 'shdSrf_' + `brepCount` + '_' + `faceCount` + "_" + str(uuid.uuid4()))
                        
                        # add transmittance schedule if any
                        if EPTransSchedule!=None:
                            schedule= EPTransSchedule.upper()
                            if schedule!=None and not schedule.lower().endswith(".csv") and schedule not in HBScheduleList:
                                msg = "Cannot find " + schedule + " in Honeybee schedule library."
                                print msg
                                ghenv.Component.AddRuntimeMessage(gh.GH_RuntimeMessageLevel.Warning, msg)
                                return -1
                            elif schedule!=None and schedule.lower().endswith(".csv"):
                                # check if csv file is existed
                                if not os.path.isfile(schedule):
                                    msg = "Cannot find the shchedule file: " + schedule
                                    print msg
                                    ghenv.Component.AddRuntimeMessage(gh.GH_RuntimeMessageLevel.Warning, msg)
                                    return -1
                            
                            thisShading.TransmittanceSCH = schedule
                        
                        # add the Rad Material if any
                        if RADMaterial!=None:
                            # if it is just the name of the material make sure it is already defined
                            if len(RADMaterial.split(" ")) == 1:
                                # if the material is not in the library add it to the library
                                if not hb_RADMaterialAUX.isMatrialExistInLibrary(RADMaterial):
                                    warningMsg = "Can't find " + RADMaterial + " in RAD Material Library.\n" + \
                                                "Add the material to the library and try again."
                                    ghenv.Component.AddRuntimeMessage(gh.GH_RuntimeMessageLevel.Warning, warningMsg)
                                    return
                                
                                try:
                                    thisShading.setRADMaterial(RADMaterial)
                                except Exception, e:
                                    print e
                                    warningMsg = "You are using an old version of Honeybee_Honeybee! Update your files and try again."
                                    print warningMsg
                                    ghenv.Component.AddRuntimeMessage(gh.GH_RuntimeMessageLevel.Warning, warningMsg)
                                    return
                                
                                addedToLib = True
                            else:
                                
                                # try to add the material to the library
                                addedToLib, thisShading.RadMaterial = hb_RADMaterialAUX.analyseRadMaterials(RADMaterial, True)
                                
                            if addedToLib==False:
                                warningMsg = "Failed to add " + RADMaterial + " to the Library."
                                ghenv.Component.AddRuntimeMessage(gh.GH_RuntimeMessageLevel.Warning, warningMsg)
                                return
                        
                        # add shading to the list
                        shadingClasses.append(thisShading)
                
        # add to the hive
        hb_hive = sc.sticky["honeybee_Hive"]()
        HBContext  = hb_hive.addToHoneybeeHive(shadingClasses, ghenv.Component)
        return HBContext
        ################################################################################################
    else:
        print "You should first let Honeybee to fly..."
        w = gh.GH_RuntimeMessageLevel.Warning
        ghenv.Component.AddRuntimeMessage(w, "You should first let Honeybee to fly...")
        return -1
        

if _shdSurfaces and _shdSurfaces[0]!=None:
    # add cleaning function
    result= main(_shdSurfaces, EPTransSchedule_, meshingSettings_, justBoundingBox_)
    
    if result != -1: HBContext = result
# ---------- end hb_epcontextsrf ----------
createhbzones = Honeybee_createHBZones(name="room", HBSurfaces=flatten(brep_11), isConditioned=Toggle(False))  # -> readMe, HBZone; plug-in component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

# ---- group: Floor Srf
bbox_4 = BoundingBox(Content=brep_9, Plane=PlaneXY(0, 0, 0), UnionBox=True)  # -> Box, Box_2
box_corners_4 = BoxCorners(Box=bbox_4.Box)  # -> CornerA, CornerB, CornerC, CornerD, CornerE, CornerF, CornerG, CornerH
srf4pt_4 = _4PointSurface(
    CornerA=box_corners_4.CornerA,
    CornerB=box_corners_4.CornerB,
    CornerC=box_corners_4.CornerC,
    CornerD=box_corners_4.CornerD)

# ---- group: Preview
wires = BrepWireframe(Brep=[createhbzones.HBZone, rotax.Geometry], Density=-1)

# ----
move_5 = Move(Geometry=[item, item_2], Motion=Y)  # -> Geometry, Transform
move_6 = Move(Geometry=wires, Motion=Y)  # -> Geometry, Transform
preview_2 = CustomPreview(Geometry=move_6.Geometry, Shader=ColourSwatch(SwatchColor=RGB(0, 0, 0)))
preview_3 = CustomPreview(Geometry=move_5.Geometry, Shader=ColourSwatch(SwatchColor=RGBA(0, 200, 255, 100)))
iterator = ColibriIterator(
    glzRatio=glzratio,
    ShadeAngle=shadeangle,
    Shade_Depth=shade_depth,
    Selection=selection,
    ignoreAllWarningMsg=False,
    RemoteFly=False)  # -> glzRatio, ShadeAngle, Shade_Depth, Genome

# ---- group: Loading and Ventilation
area_3 = Area(Geometry=srf4pt_4)  # -> Area, Centroid
setepnatvent = Honeybee_SetEPAirFlow(
    HBZones=flatten(createhbzones.HBZone),
    naturalVentilationType="1",
    minIndoorTempForNatVent="20",
    maxOutdoorTempForNatVent="30",
    fractionOfGlzHeightOperable="1")  # -> readMe, simplify(HBZones); plug-in component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
callfromepconstrlibrary = Honeybee_CallFromEPConstructionLibrary(keywords="wood")  # -> ThermMaterials, EPMaterials, EPWindowMaterials, EPConstructions; plug-in component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
item_6 = ListItem(List=callfromepconstrlibrary.EPMaterials, Index="0", Wrap=True)
epconstruction = Honeybee_EnergyPlusConstruction(name="wood", layer_1=item_6)  # -> EPConstruction; plug-in component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
panel_9 = Panel(item_6)

# ---- group: Loading and Ventilation / 4 x 6W LED bulbs
multiplication_4 = Multiplication(A="4", B="6")
division = Division(A=multiplication_4, B=area_3.Area)

# ---- group: Loading and Ventilation / Laptop + Refrigerator
division_2 = Division(A="200", B=area_3.Area)

# ---- group: Loading and Ventilation / One occupant
division_3 = Division(A="1", B=area_3.Area)

# ---- group: Loading and Ventilation (continued)
setepzoneloads = Honeybee_SetEnergyPlusZoneLoads(
    HBZones=setepnatvent.HBZones,
    equipmentLoadPerArea=division_2,
    infiltrationRatePerArea=multiplication,
    lightingDensityPerArea=division,
    numOfPeoplePerArea=division_3,
    ventilationPerArea="0",
    ventilationPerPerson="0",
    recirculatedAirPerArea="0")  # -> loads, HBZones; plug-in component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
addinternalmass = Honeybee_AddInternalMassToZone(HBZones=setepzoneloads.HBZones, internalMassName="shade", srfsOrSrfArea=ma.Result, EPConstruction=epconstruction)  # -> readMe, HBZones; plug-in component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
changehbobjname = Honeybee_ChangeHBObjName(HBObjects=addinternalmass.HBZones, names="Openable Windows+Internal Loads")  # -> HBObjects; plug-in component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

# ---- group: DaylightingSimulation
gentestpts = Honeybee_GenerateTestPoints(testGeometry=srf4pt_4, gridSize="0.5", distBaseSrf="0.762", moveTestMesh=True)  # -> readMe, simplify(testPoints), simplify(ptsVectors), simplify(facesArea), simplify(mesh); plug-in component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
radparameters = Honeybee_RADParameters(quality=0, ab="3")  # -> readMe, radParameters; plug-in component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
annualdaylightsimulation = Honeybee_AnnualDaylightSimulation(
    epwWeatherFile=path,
    testPoints=gentestpts.testPoints,
    ptsVectors=gentestpts.ptsVectors,
    testMesh=gentestpts.mesh,
    radParameters=radparameters.radParameters)  # -> analysisRecipe; plug-in component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
rundaylightanalysis = Honeybee_RunDaylightSimulation(
    HBObjects=flatten([changehbobjname, createhbsrfs_7.HBSurface]),
    analysisRecipe=annualdaylightsimulation,
    writeRad=toggle,
    runRad=toggle,
    overwriteResults=True)  # -> readMe, analysisType, resultsUnit, results, testPts, resultFiles, radGeoFile, studyFolder, done; plug-in component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

# ---- group: Test Point
item_7 = ListItem(List=gentestpts.testPoints, Index=Slider(47, range=0..70), Wrap=True)
lightingcontrol = Honeybee_LightingControlRecipe(
    controlType="4",
    sensorPoints=item_7,
    lightingPower=multiplication_4,
    lightingSetpoint=panel_4,
    ballastLossFactor=20,
    standbyPower=3,
    delayTime=5)  # -> lightingControlGroup; plug-in component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

# ---- group: DaylightingSimulation (continued)
readannualresultsi = Honeybee_ReadAnnualResultI(
    illFilesAddress=rundaylightanalysis.resultFiles,
    testPoints=simplify(gentestpts.testPoints),
    occupancyFiles=constantschedule.schedule,
    DLAIllumThresholds=panel_4,
    lightingControlGroups=lightingcontrol,
    runIt=toggle)  # -> DLA, UDLI_Less_100, UDLI_100_2000, UDLI_More_2000, CDA, sDA, annualProfiles, htmReport; plug-in component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
strnum = Ladybug_SeparateData(inputList=flatten(readannualresultsi.UDLI_100_2000))  # -> numbers, strings; plug-in component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
setepzoneschedules = Honeybee_SetEnergyPlusZoneSchedules(
    HBZones=changehbobjname,
    occupancySchedules=constantschedule.schedule,
    occupancyActivitySchs=constantschedule_2.schedule,
    lightingSchedules=readannualresultsi.annualProfiles)  # -> schedules, simplify(HBZones); plug-in component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
ma_2 = MassAddition(Input=strnum.numbers)  # -> Result, PartialResults
lng = ListLength(List=strnum.numbers)
series = Series(Start=0, Step=1, Count=lng)
sort = SortList(Keys=strnum.numbers, ValuesA=series)  # -> Keys, ValuesA
rev_2 = ReverseList(List=sort.Keys)
rev_3 = ReverseList(List=sort.ValuesA)
item_8 = ListItem(List=rev_2, Index=0, Wrap=True)
item_9 = ListItem(List=rev_3, Index=0, Wrap=True)

# ----
strnum_2 = Ladybug_SeparateData(inputList=flatten(readannualresultsi.UDLI_More_2000))  # -> numbers, strings; plug-in component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
ma_3 = MassAddition(Input=strnum_2.numbers)  # -> Result, PartialResults
lng_2 = ListLength(List=strnum_2.numbers)
division_4 = Division(A=ma_2.Result, B=lng)
division_5 = Division(A=ma_3.Result, B=lng_2)

# ---- group: EnergySimulation
toggle_2 = BooleanToggle(True)
epoutput = Honeybee_GenerateEPOutput(
    zoneEnergyUse=toggle_2,
    zoneGainsAndLosses=toggle_2,
    zoneComfortMetrics=toggle_2,
    comfortMapVariables=toggle_2,
    surfaceTempAnalysis=toggle_2,
    surfaceEnergyAnalysis=toggle_2)  # -> report, flatten(simulationOutputs); plug-in component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
runenergysimulation = Honeybee_RunEnergySimulation(
    epwFile=path,
    HBZones=flatten(setepzoneschedules.HBZones),
    HBContext=flatten(hb_epcontextsrf),
    simulationOutputs=flatten(epoutput.simulationOutputs),
    writeIdf=toggle,
    runEnergyPlus=toggle)  # -> report, idfFileAddress, htmlReport, resultFileAddress; plug-in component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
importepw = Ladybug_ImportEpw(epwFile=path)  # -> readMe, latitude, location, dryBulbTemperature, dewPointTemperature, relativeHumidity, windSpeed, windDirection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; plug-in component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
readepsrfresult = Honeybee_ReadEPSurfaceResult(resultFileAddress=runenergysimulation.resultFileAddress)  # -> surfaceIndoorTemp, surfaceOutdoorTemp, surfaceEnergyFlow, opaqueEnergyFlow, glazEnergyFlow, windowTotalSolarEnergy, windowBeamEnergy, windowDiffEnergy, windowTransmissivity, otherSurfaceData; plug-in component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
readepresult = Honeybee_ReadEPResult(resultFileAddress=runenergysimulation.resultFileAddress)  # -> totalThermalLoad, thermalLoadBalance, cooling, heating, electricLight, electricEquip, fanElectric, pumpElectric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; plug-in component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
adaptivecomfortcalculator = Ladybug_AdaptiveComfortCalculator(
    dryBulbTemperature=readepresult.airTemperature,
    meanRadiantTemperature=readepresult.meanRadTemperature,
    prevailingOutdoorTemp=importepw.dryBulbTemperature,
    runIt=Toggle(True))  # -> readMe, port, comfortableOrNot, conditionOfPerson, degreesFromTarget, port_2, targetTemperature, upperTemperatureBound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; plug-in component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
energybalance = Honeybee_ConstructEnergyBalance(
    HBZones=flatten(changehbobjname),
    electricLight=readepresult.electricLight,
    electricEquip=readepresult.electricEquip,
    peopleGains=readepresult.peopleGains,
    totalSolarGain=readepresult.totalSolarGain,
    infiltrationEnergy=readepresult.infiltrationEnergy,
    natVentEnergy=readepresult.natVentEnergy,
    surfaceEnergyFlow=readepsrfresult.surfaceEnergyFlow)  # -> readMe, port, flrNormEnergyBal, flrNormBalWStorage, port_2, modelEnergyBalance, energyBalWithStorage; plug-in component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

# ----
item_10 = ListItem(List=adaptivecomfortcalculator.percentHotCold, Index=0, Wrap=True)
item_11 = ListItem(List=adaptivecomfortcalculator.percentHotCold, Index=1, Wrap=True)
int = Integer(division_5)
int_2 = Integer(adaptivecomfortcalculator.percentOfTimeComfortable)
int_3 = Integer(item_10)
int_4 = Integer(item_11)

# ---- group: Visualize Lighting Schedule
legendpar = Ladybug_LegendParameters(customColors=flatten([ColourSwatch(SwatchColor=RGB(255, 175, 0)), ColourSwatch(SwatchColor=RGB(0, 0, 255))]))  # -> legendPar; plug-in component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
dsannualprofiles = Honeybee_DaysimAnnualProfiles(annualProfiles=readannualresultsi.annualProfiles)  # -> simplify(occupancyProfile), simplify(shadingProfiles), simplify(lightingControlProfiles), simplify(dgpProfile); plug-in component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
strnum_3 = Ladybug_SeparateData(inputList=flatten(dsannualprofiles.lightingControlProfiles))  # -> numbers, strings; plug-in component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
ma_4 = MassAddition(Input=strnum_3.numbers)  # -> Result, PartialResults
panel_10 = Panel("0.125")

# ----
subtraction = Subtraction(A=ma_4.Result, B=multiplication_2)
division_6 = Division(A=subtraction, B="365")
int_5 = Integer(subtraction)
int_6 = Integer(division_6)

# ---- group: Visualize Lighting Schedule (continued)
concat = Concatenate(
    FragmentA="Annual Light 'ON' Hours=",
    FragmentB=int_5,
    FragmentC=". Daily Average Light 'ON' Hours=",
    FragmentD=int_6,
    FragmentE=". (Measured @ Max UDLI Point & assuming 8 hrs of dark.)")

# ---- group: Indoor Microclimate
toggle_3 = BooleanToggle(True)
indoorviewfactor = Honeybee_IndoorViewFactorCalculator(HBZones=flatten(setepzoneschedules.HBZones), gridSize="1", buildMesh=toggle_3, runIt=toggle_3)  # -> readMe, port, viewFactorMesh, viewFactorInfo, port_2, testPts, viewMeshFaces, zoneWireFrame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; plug-in component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
adaptcomfrecipe = Honeybee_AdaptiveComfortAnalysisRecipe(
    viewFactorMesh=indoorviewfactor.viewFactorMesh,
    viewFactorInfo=indoorviewfactor.viewFactorInfo,
    epwFile=path,
    srfIndoorTemp=readepsrfresult.surfaceIndoorTemp,
    zoneAirTemp=readepresult.airTemperature,
    zoneAirFlowVol=readepresult.airFlowVolume,
    zoneAirHeatGain=readepresult.airHeatGainRate)  # -> comfRecipe; plug-in component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
analysisperiod = Ladybug_AnalysisPeriod()  # -> readMe, analysisPeriod; plug-in component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
microclimatemap = Honeybee_MicroclimateMapAnalysis(
    comfAnalysisRecipe=adaptcomfrecipe,
    analysisPeriodOrHOY=analysisperiod.analysisPeriod,
    writeResultFile=toggle_3,
    runIt=toggle_3)  # -> readMe, port, radTempMtx, airTempMtx, operativeTempMtx, adaptComfMtx, degFromTargetMtx, port_2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; plug-in component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
thermalautonomy = Honeybee_ThermalAutonomyAnalysis(
    comfResultsMtx=microclimatemap.adaptComfMtx,
    degOrPMVMtx=microclimatemap.degFromTargetMtx,
    viewFactorMesh=flatten(indoorviewfactor.viewFactorMesh),
    HBZones=flatten(setepzoneschedules.HBZones),
    runIt=toggle_3)  # -> readMe, port, occTCP_Mtx, TA_Mtx, OverHeatedMtx, UnderHeatedMtx, port_2, occTCP_Result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; plug-in component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
legendpar_2 = Ladybug_LegendParameters(
    lowBound="0",
    highBound="100",
    customColors=reverse(flatten([ColourSwatch(SwatchColor=RGB(255, 255, 255)), ColourSwatch(SwatchColor=RGB(0, 0, 0))])))  # -> legendPar; plug-in component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
visualizemicroclimate = Honeybee_VisualizeMicroclimateMap(comfResultsMtx=thermalautonomy.TA_Mtx, viewFactorMesh=flatten(indoorviewfactor.viewFactorMesh), legendPar=legendpar_2)  # -> readMe, port, resultMesh, legend, legendBasePt, port_2, resultValues, resultColors; plug-in component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
visualizemicroclimate_2 = Honeybee_VisualizeMicroclimateMap(
    comfResultsMtx=thermalautonomy.UnderHeatedMtx,
    viewFactorMesh=flatten(indoorviewfactor.viewFactorMesh),
    legendPar=legendpar_2)  # -> readMe, port, resultMesh, legend, legendBasePt, port_2, resultValues, resultColors; plug-in component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
ma_5 = MassAddition(Input=visualizemicroclimate.resultValues)  # -> Result, PartialResults
lng_3 = ListLength(List=visualizemicroclimate.resultValues)
series_2 = Series(Start=0, Step=1, Count=lng_3)
sort_2 = SortList(Keys=visualizemicroclimate.resultValues, ValuesA=series_2)  # -> Keys, ValuesA
faceb = FaceBoundaries(Mesh=visualizemicroclimate.resultMesh)

# ----
division_7 = Division(A=ma_5.Result, B=lng_3)
rev_4 = ReverseList(List=sort_2.Keys)
rev_5 = ReverseList(List=sort_2.ValuesA)

# ---- group: Display
interior_temperature = Panel(readepresult.airTemperature)
int_7 = Integer(division_4)
int_8 = Integer(item_8)
xscale = Panel("0.0025")
yscale = Panel("0.0125")
legendpar_3 = Ladybug_LegendParameters(
    lowBound="0",
    highBound="100",
    customColors=reverse(flatten([ColourSwatch(SwatchColor=RGB(255, 175, 0)), ColourSwatch(SwatchColor=RGB(0, 0, 255))])),
    fontSize=panel_10)  # -> legendPar; plug-in component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
concat_2 = Concatenate(
    FragmentA="UDLI 100-2000. Avg UDLI=",
    FragmentB=int_7,
    FragmentC=". Max=",
    FragmentH="%",
    FragmentD=int_8,
    FragmentE="%",
    FragmentF=". Avg.UDLI>2000=",
    FragmentG=int,
    FragmentI="%")
legendpar_4 = Ladybug_LegendParameters(lowBound="-15", highBound="15")  # -> legendPar; plug-in component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
selectandaveragedata = Ladybug_AverageData(annualHourlyData=energybalance.energyBalWithStorage, totalOrAverage=Toggle(True))  # -> readMe, selHourlyData, totaledDaily, totaledMonthly, totMonthlyPerHour, totMonthlyMinPerHour, totMonthlyMaxPerHour; plug-in component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
recolormesh = Ladybug_RecolorMesh(
    analysisResult=readannualresultsi.UDLI_100_2000,
    inputMesh=gentestpts.mesh,
    legendPar=legendpar_3,
    analysisTitle=concat_2,
    legendTitle="%")  # -> readMe, newMesh, newLegend, legendBasePt, meshColors, legendColors; plug-in component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
exterior_teperature = Panel(importepw.dryBulbTemperature)
panel_11 = Panel("0")
concat_3 = Concatenate(
    FragmentA="% of year comfortable=",
    FragmentB=int_2,
    FragmentC=". % of year hot=",
    FragmentD=int_3,
    FragmentE=". % of year cold=",
    FragmentF=int_4)
gradientlibrary = Ladybug_GradientLibrary(gradIndex="19")  # -> customColors; plug-in component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
toggle_4 = BooleanToggle(True)
barchart = Ladybug_MonthlyBarChart(inputData=flatten(selectandaveragedata.totaledMonthly), stackValues=toggle_4)  # -> readMe, dataMesh, dataCurves, dataCrvColors, graphAxes, graphLabels, title, titleBasePt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; plug-in component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
bbox_5 = BoundingBox(Content=barchart.graphAxes, Plane=PlaneXY(0, 0, 0), UnionBox=True)  # -> Box, Box_2
box_corners_5 = BoxCorners(Box=bbox_5.Box)  # -> CornerA, CornerB, CornerC, CornerD, CornerE, CornerF, CornerG, CornerH
dist = Distance(PointA=box_corners_5.CornerA, PointB=box_corners_5.CornerB)
dist_2 = Distance(PointA=box_corners_5.CornerB, PointB=box_corners_5.CornerC)

# ---- group: Test Point (continued)
faceb_2 = FaceBoundaries(Mesh=recolormesh.newMesh)
item_12 = ListItem(List=faceb_2, Index=item_9, Wrap=True)
pcen = PolygonCenter(Polyline=item_12)  # -> CenterV, CenterE, CenterA
tag = TextTag3D(Location=pcen.CenterV, Text="Max UDLI", Size="0.125", Colour=ColourSwatch(SwatchColor=RGB(0, 0, 0)), Justification=9)

# ---- group: Visualize Lighting Schedule (continued)
bbox_6 = BoundingBox(Content=recolormesh.newLegend, Plane=PlaneXY(0, 0, 0), UnionBox=True)  # -> flatten(Box), Box_2
box_corners_6 = BoxCorners(Box=bbox_6.Box)  # -> CornerA, CornerB, CornerC, CornerD, CornerE, CornerF, CornerG, CornerH
pdecon = Deconstruct(Point=box_corners_6.CornerB)  # -> XComponent, YComponent, ZComponent
addition = Addition(A=pdecon.XComponent, B="1.5")

# ----
addition_2 = Addition(A=pdecon.YComponent, B=".365")

# ---- group: Visualize Lighting Schedule (continued)
pt = ConstructPoint(XCoordinate=addition, YCoordinate=addition_2, ZCoordinate=pdecon.ZComponent)
_3dchart = Ladybug_3DChart(
    inputData=flatten(dsannualprofiles.lightingControlProfiles),
    basePoint=pt,
    xScale=xscale,
    yScale=yscale,
    zScale=panel_11,
    legendPar=legendpar)  # -> readMe, graphMesh, graphCurves, legend, legendBasePts, title, titleBasePts, dataPts, conditionalHOY; plug-in component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
pdecon_2 = Deconstruct(Point=_3dchart.titleBasePts)  # -> XComponent, YComponent, ZComponent
subtraction_2 = Subtraction(A=pdecon_2.YComponent, B=".75")
pt_2 = ConstructPoint(XCoordinate=pdecon_2.XComponent, YCoordinate=subtraction_2, ZCoordinate=pdecon_2.ZComponent)
tag_2 = TextTag3D(Location=pt_2, Text=concat, Size=panel_10, Colour=ColourSwatch(SwatchColor=RGB(0, 0, 0)), Justification=7)

# ---- group: Display (continued)
bbox_7 = BoundingBox(Content=_3dchart.graphMesh, Plane=PlaneXY(0, 0, 0))  # -> Box, Box_2
box_corners_7 = BoxCorners(Box=bbox_7.Box)  # -> CornerA, CornerB, CornerC, CornerD, CornerE, CornerF, CornerG, CornerH
dist_3 = Distance(PointA=box_corners_7.CornerA, PointB=box_corners_7.CornerB)
dist_4 = Distance(PointA=box_corners_7.CornerB, PointB=box_corners_7.CornerC)
pdecon_3 = Deconstruct(Point=box_corners_7.CornerD)  # -> XComponent, YComponent, ZComponent
division_8 = Division(A=dist_3, B=dist)
division_9 = Division(A=dist_4, B=dist_2)
multiplication_5 = Multiplication(A=division_8, B="15")
addition_3 = Addition(A=pdecon_3.YComponent, B=multiplication_5)
legendpar_5 = Ladybug_LegendParameters(highBound="450", customColors=reverse(flatten(gradientlibrary)), fontSize=division_9)  # -> legendPar; plug-in component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
pt_3 = ConstructPoint(XCoordinate=pdecon_3.XComponent, YCoordinate=addition_3, ZCoordinate=pdecon_3.ZComponent)
barchart_2 = Ladybug_MonthlyBarChart(
    inputData=flatten(selectandaveragedata.totaledMonthly),
    stackValues=toggle_4,
    altTitle="Energy Balance",
    altYAxisTitle="Energy (kWh)",
    basePoint=pt_3,
    xScale=division_8,
    yScale=division_9,
    legendPar=legendpar_5)  # -> readMe, dataMesh, dataCurves, dataCrvColors, graphAxes, graphLabels, title, titleBasePt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; plug-in component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
bbox_8 = BoundingBox(Content=barchart_2.graphAxes, Plane=PlaneXY(0, 0, 0), UnionBox=True)  # -> Box, Box_2
box_corners_8 = BoxCorners(Box=bbox_8.Box)  # -> CornerA, CornerB, CornerC, CornerD, CornerE, CornerF, CornerG, CornerH
pdecon_4 = Deconstruct(Point=box_corners_8.CornerD)  # -> XComponent, YComponent, ZComponent
addition_4 = Addition(A=pdecon_4.YComponent, B="1.75")
pt_4 = ConstructPoint(XCoordinate=pdecon_4.XComponent, YCoordinate=addition_4, ZCoordinate=pdecon_4.ZComponent)
_3dchart_2 = Ladybug_3DChart(
    inputData=flatten(adaptivecomfortcalculator.degreesFromTarget),
    basePoint=pt_4,
    xScale=xscale,
    yScale=yscale,
    zScale=panel_11,
    legendPar=legendpar_4)  # -> readMe, graphMesh, graphCurves, legend, legendBasePts, title, titleBasePts, dataPts, conditionalHOY; plug-in component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
pdecon_5 = Deconstruct(Point=_3dchart_2.titleBasePts)  # -> XComponent, YComponent, ZComponent
subtraction_3 = Subtraction(A=pdecon_5.YComponent, B=".75")
pt_5 = ConstructPoint(XCoordinate=pdecon_5.XComponent, YCoordinate=subtraction_3, ZCoordinate=pdecon_5.ZComponent)
tag_3 = TextTag3D(Location=pt_5, Text=concat_3, Size="0.125", Colour=ColourSwatch(SwatchColor=RGB(0, 0, 0)), Justification=7)
preview_4 = CustomPreview(
    Geometry=[_3dchart.graphCurves, barchart_2.graphAxes, _3dchart_2.graphCurves, wires, barchart_2.title],
    Shader=ColourSwatch(SwatchColor=RGB(0, 0, 0)))

# ---- group: Indoor Microclimate (continued)
dist_5 = Distance(PointA=box_corners_6.CornerB, PointB=box_corners_6.CornerC)
pdecon_6 = Deconstruct(Point=box_corners_6.CornerA)  # -> XComponent, YComponent, ZComponent
multiplication_6 = Multiplication(A=dist_5, B="1.25")
addition_5 = Addition(A=pdecon_6.YComponent, B=multiplication_6)
pt_6 = ConstructPoint(XCoordinate=pdecon_6.XComponent, YCoordinate=addition_5, ZCoordinate=pdecon_6.ZComponent)
vec2pt_3 = Vector2Pt(PointA=box_corners_6.CornerA, PointB=pt_6, Unitize=False)  # -> Vector, Length
vlen = VectorLength(Vector=vec2pt_3.Vector)
multiplication_7 = Multiplication(A=vlen, B=2)
amp = Amplitude(Vector=vec2pt_3.Vector, Amplitude=multiplication_7)
int_9 = Integer(division_7)
move_7 = Move(Geometry=[visualizemicroclimate.resultMesh, visualizemicroclimate.legend, wires], Motion=vec2pt_3.Vector)  # -> Geometry, Transform
move_8 = Move(Geometry=[visualizemicroclimate_2.resultMesh, visualizemicroclimate_2.legend], Motion=amp)  # -> Geometry, Transform
item_13 = ListItem(List=rev_4, Index=0, Wrap=True)
item_14 = ListItem(List=rev_5, Index=0, Wrap=True)
preview_5 = CustomPreview(Geometry=move_7.Geometry, Shader=ColourSwatch(SwatchColor=RGB(0, 0, 0)))
item_15 = ListItem(List=faceb, Index=item_14, Wrap=True)
pcen_2 = PolygonCenter(Polyline=item_15)  # -> CenterV, CenterE, CenterA
addition_6 = Addition(A=pcen_2.CenterV, B=vec2pt_3.Vector)
tag_4 = TextTag3D(Location=addition_6, Text="Max ATA", Size=panel_10, Colour=ColourSwatch(SwatchColor=RGB(0, 0, 0)), Justification=9)

# ----
int_10 = Integer(item_13)
concat_4 = Concatenate(FragmentA="Average Adaptive Thermal Autonomy=", FragmentB=int_9, FragmentC=". Max ATA=", FragmentD=int_10, FragmentE="%")
addition_7 = Addition(A=vec.Vector, B=visualizemicroclimate.legendBasePt, C=vec2pt_3.Vector)
tag_5 = TextTag3D(Location=addition_7, Text=concat_4, Size=panel_10, Colour=ColourSwatch(SwatchColor=RGB(0, 0, 0)), Justification=5)
parameters = ColibriParameters(
    AvgUDLI=flatten(int_7),
    MaxUDLI=flatten(int_8),
    AvgATA=flatten(int_9),
    MaxATA=flatten(int_10),
    AvgLight_ON_Hrs_Day=flatten(int_6),
    Light_ON_Hrs_Yr=flatten(int_5))
aggregator = ColibriAggregator(
    Folder="C:\Users\Ayodh\Desktop\New folder",
    IterationGenomeID=iterator.Genome,
    IterationPhenomeResults=parameters,
    ImgSetting=img_setting,
    _3DObjects=flatten(wires),
    Write=Toggle(False),
    recordingMode=3)
