# Grasshopper definition katta-adiseshaiah_aishwarya.gh (Grasshopper 0.9.76)
# plug-ins: Python Interpreter

# ---- group: Component for checking the values using the name of the material
panel = Panel("Exterior Roof")  # disabled
decomposeepconstruction = Honeybee_DecomposeEPConstruction(cnstrName=panel)  # -> materials, comments, UValue_SI, UValue_IP, RValue_SI, RValue_IP; disabled; plug-in component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
panel_2 = Panel(decomposeepconstruction.RValue_SI)  # disabled

# ---- group: Construct material from scratch
epopaquemat = Honeybee_EnergyPlusOpaqueMaterial()  # -> EPMaterial; plug-in component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
epconstruction = Honeybee_EnergyPlusConstruction(layer_1=epopaquemat)  # -> EPConstruction; plug-in component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

# ---- group: Use these components to label the parts - can also find the default values
# Type BALANCE in Hydra for examples
srfattributelist = Honeybee_SurfaceAttributeList({"Name": "name", "Radiance Material": "RadMaterial", "EnergyPlus Construction": "EPConstruction", "Surface Type": "type", "Boundary Condition": "BC", "Sun Exposure": "sunExposure", "Wind Exposure": "windExposure", "Has Child Surface": "hasChild", "Is Child Surface": "isChild", "Is Planar": "isPlanar", "Srf Type Set By User": "srfTypeByUser", "Boundary Condition Set By User": "srfBCByUser", "Shade Material Name": "shadeMaterialName", "Shading Control Name": "shadingControlName", "Shcading Schedule Name": "shadingSchName"}, selected="EnergyPlus Construction")  # disabled
toggle = BooleanToggle(True)  # disabled
labelsurfaces = Honeybee_LabelZoneSurfaces(attribute=srfattributelist, windows=toggle)  # -> surfaceTxtLabels, labelBasePts, brepTxtLabels, surfaceWireFrames; disabled; plug-in component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

# ----
setepzoneloads = Honeybee_SetEnergyPlusZoneLoads()  # -> loads, HBZones; disabled; plug-in component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
setloadsandschedules = Honeybee_SetLoadsAndSchedules()  # -> currentSchedules, currentLoads, HBZones; disabled; plug-in component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

callfromepconstrlibrary = Honeybee_CallFromEPConstructionLibrary()  # -> ThermMaterials, EPMaterials, EPWindowMaterials, EPConstructions; plug-in component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
callfromepconstrlibrary_2 = Honeybee_CallFromEPConstructionLibrary()  # -> ThermMaterials, EPMaterials, EPWindowMaterials, EPConstructions; plug-in component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
panel_3 = Panel("""0
1
2
3
4""")
searchepconstruction = Honeybee_SearchEPConstruction(EPConstrList=callfromepconstrlibrary.EPConstructions, standard="2", climateZone="4", surfaceType=panel_3)  # -> EPSelectedConstr; plug-in component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
searchepconstruction_2 = Honeybee_SearchEPConstruction(EPConstrList=callfromepconstrlibrary_2.EPConstructions, standard="2", climateZone="4", surfaceType="1")  # -> EPSelectedConstr; plug-in component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
panel_4 = Panel("""interior Ceiling
Interior Floor
Interior Wall
Exterior Wall
CBECS BBefore-1980 Extwindow Climatezone 1-4""")
panel_5 = Panel(searchepconstruction_2)
decomposeepconstruction_2 = Honeybee_DecomposeEPConstruction(cnstrName=panel_4)  # -> materials, comments, UValue_SI, UValue_IP, RValue_SI, RValue_IP; plug-in component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
decomposeepconstruction_3 = Honeybee_DecomposeEPConstruction(cnstrName=searchepconstruction_2)  # -> materials, comments, UValue_SI, UValue_IP, RValue_SI, RValue_IP; plug-in component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
decomposeepconstruction_4 = Honeybee_DecomposeEPConstruction(cnstrName=searchepconstruction)  # -> materials, comments, UValue_SI, UValue_IP, RValue_SI, RValue_IP; plug-in component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
item = ListItem(List=searchepconstruction, Index=0, Wrap=True)
panel_6 = Panel(decomposeepconstruction_2.RValue_SI)
panel_7 = Panel(searchepconstruction)
panel_8 = Panel(decomposeepconstruction_4.RValue_IP)
panel_9 = Panel(decomposeepconstruction_4.RValue_SI)
panel_10 = Panel(decomposeepconstruction_3.RValue_SI)
sort = SortList(Keys=panel_9, ValuesA=panel_7)  # -> Keys, ValuesA

# ---- group: last item of the list
rev = ReverseList(List=sort.ValuesA)
item_2 = ListItem(List=rev, Index="-1", Wrap=True)
panel_11 = Panel(item_2)

# ----
item_3 = ListItem(List=sort.ValuesA, Index="-1", Wrap=True)
panel_12 = Panel(item_3)

panel_13 = Panel(sort.ValuesA)

callfromepconstrlibrary_3 = Honeybee_CallFromEPConstructionLibrary()  # -> ThermMaterials, EPMaterials, EPWindowMaterials, EPConstructions; plug-in component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
panel_14 = Panel("""0
1
2
4""")
searchepconstruction_3 = Honeybee_SearchEPConstruction(EPConstrList=callfromepconstrlibrary_3.EPConstructions, standard="3", climateZone="4", surfaceType=panel_14)  # -> EPSelectedConstr; plug-in component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
panel_15 = Panel(searchepconstruction_3)
flatten = FlattenTree(Tree=searchepconstruction_3, Path="{0}")
panel_16 = Panel(flatten)
item_4 = ListItem(List=flatten, Index=0, Wrap=True)  # -> Item, Item1, Item2, Item3, Item4, Item5, Item6, Item7, Item8, Item9
setepzonecnstr = Honeybee_SetEPZoneConstruction()  # -> simplify(modifiedHBZones); plug-in component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

callfromepconstrlibrary_4 = Honeybee_CallFromEPConstructionLibrary()  # -> ThermMaterials, EPMaterials, EPWindowMaterials, EPConstructions; plug-in component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
epnomassmat = Honeybee_EnergyPlusNoMassOpaqueMaterial(name="Wall", R_Value="5")  # -> EPMaterial; plug-in component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
item_5 = ListItem(List=callfromepconstrlibrary_4.EPConstructions, Index="433", Wrap=True)
item_6 = ListItem(List=callfromepconstrlibrary_4.EPConstructions, Index="431", Wrap=True)
item_7 = ListItem(List=callfromepconstrlibrary_4.EPConstructions, Index="417", Wrap=True)
item_8 = ListItem(List=callfromepconstrlibrary_4.EPConstructions, Index="429", Wrap=True)
item_9 = ListItem(List=callfromepconstrlibrary_4.EPConstructions, Index="423", Wrap=True)
decomposeepconstruction_5 = Honeybee_DecomposeEPConstruction(cnstrName=searchepconstruction_3)  # -> materials, comments, UValue_SI, UValue_IP, RValue_SI, RValue_IP; plug-in component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
epconstruction_2 = Honeybee_EnergyPlusConstruction(name="Wall", layer_1=epnomassmat)  # -> EPConstruction; plug-in component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
setepzonecnstr_2 = Honeybee_SetEPZoneConstruction(wallEPConstruction=item_5, windowEPConstruction=item_7, roofEPConstruction=item_8, floorEPConstruction=item_6)  # -> simplify(modifiedHBZones); plug-in component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
decomposeepconstruction_6 = Honeybee_DecomposeEPConstruction(cnstrName=item_9)  # -> materials, comments, UValue_SI, UValue_IP, RValue_SI, RValue_IP; plug-in component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
panel_17 = Panel(item_9)
panel_18 = Panel(decomposeepconstruction_5.RValue_SI)
panel_19 = Panel(decomposeepconstruction_6.RValue_SI)

callfromepconstrlibrary_5 = Honeybee_CallFromEPConstructionLibrary()  # -> ThermMaterials, EPMaterials, EPWindowMaterials, EPConstructions; plug-in component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
panel_20 = Panel("""0
1
2
4""")
searchepconstruction_4 = Honeybee_SearchEPConstruction(EPConstrList=callfromepconstrlibrary_5.EPConstructions, standard="3", climateZone="7", surfaceType=panel_20)  # -> EPSelectedConstr; plug-in component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
panel_21 = Panel(searchepconstruction_4)
flatten_2 = FlattenTree(Tree=searchepconstruction_4, Path="{0}")
panel_22 = Panel(flatten_2)
item_10 = ListItem(List=flatten_2, Index=0, Wrap=True)  # -> Item, Item1, Item2, Item3, Item4, Item5, Item6, Item7, Item8, Item9
setepzonecnstr_3 = Honeybee_SetEPZoneConstruction(
    wallEPConstruction=item_10.Item2,
    windowEPConstruction=item_10.Item8,
    roofEPConstruction=item_10.Item6,
    floorEPConstruction=item_10.Item7)  # -> simplify(modifiedHBZones); plug-in component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

rip2rsi = Ladybug_rIP2rSI(R_IP=Slider(58, range=0..100))  # -> R_SI; plug-in component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
panel_23 = Panel("0.5")
panel_24 = Panel("0.51")
panel_25 = Panel(rip2rsi)
panel_26 = Panel("Window")  # disabled
panel_27 = Panel("0.018")  # disabled
epglassmat = Honeybee_EnergyPlusGlassMaterial(name="SHGC", thickness="0.004")  # -> EPMaterial; plug-in component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
searchepconstruction_5 = Honeybee_SearchEPConstruction()  # -> EPSelectedConstr; disabled; plug-in component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
epwindowairgap = Honeybee_EnergyPlusWindowAirGap(name=panel_26, thickness=panel_27)  # -> EPMaterial; disabled; plug-in component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
epnomassmat_2 = Honeybee_EnergyPlusNoMassOpaqueMaterial(name="Wall", R_Value="100")  # -> EPMaterial; plug-in component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
epwindowairgap_2 = Honeybee_EnergyPlusWindowAirGap(name="Low-e", thickness="0.4")  # -> EPMaterial; plug-in component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
decomposeepconstruction_7 = Honeybee_DecomposeEPConstruction(cnstrName=searchepconstruction_4)  # -> materials, comments, UValue_SI, UValue_IP, RValue_SI, RValue_IP; plug-in component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
panel_28 = Panel(epnomassmat_2)
panel_29 = Panel(".9")  # disabled
panel_30 = Panel("1000")  # disabled
panel_31 = Panel("38")  # disabled
panel_32 = Panel("3")  # disabled
panel_33 = Panel(".1")  # disabled
panel_34 = Panel("wall'")  # disabled
epconstruction_3 = Honeybee_EnergyPlusConstruction(name="Wall", layer_1=epnomassmat_2)  # -> EPConstruction; plug-in component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
epshademat = Honeybee_EnergyPlusShadeMaterial()  # -> shadeMaterial; disabled; plug-in component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
epopaquemat_2 = Honeybee_EnergyPlusOpaqueMaterial(
    name=panel_34,
    thickness=panel_32,
    conductivity=panel_33,
    density=panel_31,
    specificHeat=panel_30,
    thermAbsp=panel_29,
    solAbsp=panel_29)  # -> EPMaterial; disabled; plug-in component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
panel_35 = Panel("Wall")  # disabled
panel_36 = Panel("Wall")  # disabled
panel_37 = Panel("12")  # disabled
panel_38 = Panel(decomposeepconstruction_7.RValue_SI)
epnomassmat_3 = Honeybee_EnergyPlusNoMassOpaqueMaterial(name=panel_36, R_Value=panel_37)  # -> EPMaterial; disabled; plug-in component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
epconstruction_4 = Honeybee_EnergyPlusConstruction(name=panel_35, layer_1=epopaquemat_2, layer_2=epnomassmat_3)  # -> EPConstruction; disabled; plug-in component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
setepzonecnstr_4 = Honeybee_SetEPZoneConstruction(floorEPConstruction=item_10.Item7)  # -> simplify(modifiedHBZones); plug-in component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
srfattributelist_2 = Honeybee_SurfaceAttributeList({"Name": "name", "Radiance Material": "RadMaterial", "EnergyPlus Construction": "EPConstruction", "Surface Type": "type", "Boundary Condition": "BC", "Sun Exposure": "sunExposure", "Wind Exposure": "windExposure", "Has Child Surface": "hasChild", "Is Child Surface": "isChild", "Is Planar": "isPlanar", "Srf Type Set By User": "srfTypeByUser", "Boundary Condition Set By User": "srfBCByUser", "Shade Material Name": "shadeMaterialName", "Shading Control Name": "shadingControlName", "Shcading Schedule Name": "shadingSchName"}, selected="Boundary Condition")
labelsurfaces_2 = Honeybee_LabelZoneSurfaces(HBObjects=flatten(setepzonecnstr_4), attribute=srfattributelist_2)  # -> surfaceTxtLabels, labelBasePts, brepTxtLabels, surfaceWireFrames; plug-in component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
uip2usi = Ladybug_uIP2uSI(U_IP="34.3")  # -> U_SI; plug-in component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
panel_39 = Panel(uip2usi)
callfromepconstrlibrary_6 = Honeybee_CallFromEPConstructionLibrary()  # -> ThermMaterials, EPMaterials, EPWindowMaterials, EPConstructions; disabled; plug-in component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
panel_40 = Panel(callfromepconstrlibrary_6.EPConstructions)  # disabled
callfromepconstrlibrary_7 = Honeybee_CallFromEPConstructionLibrary()  # -> ThermMaterials, EPMaterials, EPWindowMaterials, EPConstructions; disabled; plug-in component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
panel_41 = Panel(callfromepconstrlibrary_7.EPConstructions)  # disabled
callfromepconstrlibrary_8 = Honeybee_CallFromEPConstructionLibrary()  # -> ThermMaterials, EPMaterials, EPWindowMaterials, EPConstructions; disabled; plug-in component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
panel_42 = Panel(callfromepconstrlibrary_8.EPConstructions)  # disabled
epwindowmat = Honeybee_EnergyPlusWindowMaterial(name="SHGC", U_Value=".5", SHGC="0.4", VT="0.51")  # -> EPMaterial; plug-in component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
panel_43 = Panel("431")  # disabled
item_11 = ListItem(List=callfromepconstrlibrary_6.EPConstructions, Index=panel_43, Wrap=True)  # disabled
list = ValueList({"Exterior Window [R1.0, SHGC 0.7]": "ASHRAE 90.1-2004 EXTWINDOW CLIMATEZONE ALT-WARE 1-8", "Exterior Window [R1.7, SHGC 0.39]": "ASHRAE 90.1-2004 EXTWINDOW CLIMATEZONE 4-6", "Exterior Window [R1.9, SHGC 0.39]": "ASHRAE 90.1-2004 EXTWINDOW CLIMATEZONE ALT-RES 4-6", "Exterior Window [R0.7, SHGC 0.65]": "Dbl LoE (e3=.1) Clr 3mm/13mm Arg"}, selected="Exterior Window [R1.9, SHGC 0.39]")
panel_44 = Panel("433")  # disabled
panel_45 = Panel("429")  # disabled
panel_46 = Panel("431")  # disabled
panel_47 = Panel("423")  # disabled
list_2 = ValueList({"Exterior Roof [R9.2]": "ASHRAE 90.1-2004 EXTROOF METAL CLIMATEZONE 3-4", "Exterior Roof [R14.8]": "ASHRAE 90.1-2004 EXTROOF IEAD CLIMATEZONE 1-4", "Exterior Roof [R34.4]": "ASHRAE 189.1-2009 EXTROOF IEAD CLIMATEZONE 7-8"}, selected="Exterior Roof [R34.4]")
panel_48 = Panel("417")  # disabled
panel_49 = Panel("433")  # disabled
panel_50 = Panel("431")  # disabled
panel_51 = Panel("429")  # disabled
panel_52 = Panel("423")  # disabled
epconstruction_5 = Honeybee_EnergyPlusConstruction(name="Window", layer_1=epwindowmat)  # -> EPConstruction; plug-in component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
list_3 = ValueList({"Exterior Wall [R5.5]": "ASHRAE 90.1-2004 EXTWALL METAL CLIMATEZONE 4", "Exterior Wall [R5.8]": "ASHRAE 90.1-2004 EXTWALL MASS CLIMATEZONE 3-4", "Exterior Wall [R7.2]": "ASHRAE 90.1-2004 EXTWALL STEELFRAME CLIMATEZONE 1-4", "Exterior Wall [R8.7]": "ASHRAE 90.1-2004 EXTWALL MASS CLIMATEZONE ALT-RES 4", "Exterior Wall [R10.4]": "ASHRAE 90.1-2004 EXTWALL WOODFRAME CLIMATEZONE 1-7", "Exterior Wall [R14.8]": "ASHRAE 90.1-2004 EXTWALL STEELFRAME CLIMATEZONE ALT-RES 4-6", "Exterior Wall [R34.4]": "ASHRAE 189.1-2009 EXTROOF IEAD CLIMATEZONE 7-8"}, selected="Exterior Wall [R34.4]")
panel_53 = Panel("417")  # disabled
item_12 = ListItem(List=callfromepconstrlibrary_7.EPConstructions, Index=panel_44, Wrap=True)  # disabled
item_13 = ListItem(List=callfromepconstrlibrary_7.EPConstructions, Index=panel_45, Wrap=True)  # disabled
item_14 = ListItem(List=callfromepconstrlibrary_7.EPConstructions, Index=panel_46, Wrap=True)  # disabled
item_15 = ListItem(List=callfromepconstrlibrary_7.EPConstructions, Index=panel_47, Wrap=True)  # disabled
item_16 = ListItem(List=callfromepconstrlibrary_7.EPConstructions, Index=panel_48, Wrap=True)  # disabled
item_17 = ListItem(List=callfromepconstrlibrary_8.EPConstructions, Index=panel_49, Wrap=True)  # disabled
item_18 = ListItem(List=callfromepconstrlibrary_8.EPConstructions, Index=panel_51, Wrap=True)  # disabled
item_19 = ListItem(List=callfromepconstrlibrary_8.EPConstructions, Index=panel_50, Wrap=True)  # disabled
item_20 = ListItem(List=callfromepconstrlibrary_8.EPConstructions, Index=panel_52, Wrap=True)  # disabled
item_21 = ListItem(List=callfromepconstrlibrary_8.EPConstructions, Index=panel_53, Wrap=True)  # disabled

# ---- group: glass
# Design
brep = Brep(<brep referenced from the Rhino model>)  # disabled

# ---- group: ceiling
# Baseline
brep_2 = Brep(<brep referenced from the Rhino model>)  # disabled

# ---- group: floor
brep_3 = Brep(<brep referenced from the Rhino model>)  # disabled

# ---- group: wall
brep_4 = Brep([<brep referenced from the Rhino model> x3])  # disabled

# ---- group: wall that has glazing
brep_5 = Brep(<brep referenced from the Rhino model>)  # disabled

# ---- group: glass
brep_6 = Brep([<brep referenced from the Rhino model> x3])

# ---- group: ceiling
# Proposed Design
brep_7 = Brep(<brep referenced from the Rhino model>)

# ---- group: floor
brep_8 = Brep(<brep referenced from the Rhino model>)

# ---- group: wall that has glazing
brep_9 = Brep(<brep referenced from the Rhino model>)

# ---- group: wall
brep_10 = Brep([<brep referenced from the Rhino model> x3])

# ---- group: S
brep_11 = Brep(<brep referenced from the Rhino model>)  # disabled

# ---- group: glass
brep_12 = Brep(<brep referenced from the Rhino model>)  # disabled

# ---- group: ceiling
brep_13 = Brep(<brep referenced from the Rhino model>)  # disabled

# ---- group: floor
brep_14 = Brep(<brep referenced from the Rhino model>)  # disabled

# ---- group: wall that has glazing
brep_15 = Brep(<brep referenced from the Rhino model>)  # disabled

# ---- group: wall
brep_16 = Brep([<brep referenced from the Rhino model> x3])  # disabled

# ----
panel_54 = Panel("0")  # disabled
panel_55 = Panel("3")  # disabled
panel_56 = Panel("0")  # disabled
panel_57 = Panel("2")  # disabled
createhbsrfs = Honeybee_createHBSrfs(geometry=brep_5, srfType=panel_54, EPConstruction=item_15)  # -> readMe, simplify(HBSurface); disabled; plug-in component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
createhbsrfs_2 = Honeybee_createHBSrfs(geometry=brep_3, srfType=panel_57, EPConstruction=item_14)  # -> readMe, simplify(HBSurface); disabled; plug-in component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
createhbsrfs_3 = Honeybee_createHBSrfs(geometry=brep_2, srfType=panel_55, EPConstruction=item_13)  # -> readMe, simplify(HBSurface); disabled; plug-in component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
createhbsrfs_4 = Honeybee_createHBSrfs(geometry=brep_4, srfType=panel_56, EPConstruction=item_12)  # -> readMe, simplify(HBSurface); disabled; plug-in component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
flip = Flip(Surface=brep_3)  # -> Surface, Result; disabled

createhbsrfs_5 = Honeybee_createHBSrfs(geometry=brep_9, srfType="0", EPConstruction=list_3)  # -> readMe, simplify(HBSurface); plug-in component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
createhbsrfs_6 = Honeybee_createHBSrfs(geometry=brep_8, srfType="2", EPConstruction=list_3)  # -> readMe, simplify(HBSurface); plug-in component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
createhbsrfs_7 = Honeybee_createHBSrfs(geometry=brep_7, srfType="3", EPConstruction=list_2)  # -> readMe, simplify(HBSurface); plug-in component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
createhbsrfs_8 = Honeybee_createHBSrfs(geometry=brep_10, srfType="0", EPConstruction=list_3)  # -> readMe, simplify(HBSurface); plug-in component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
flip_2 = Flip(Surface=brep_8)  # -> Surface, Result

panel_58 = Panel("0")  # disabled

panel_59 = Panel("0")  # disabled
panel_60 = Panel("3")  # disabled
panel_61 = Panel("0")  # disabled
panel_62 = Panel("2")  # disabled
createhbsrfs_9 = Honeybee_createHBSrfs(geometry=brep_15, srfType=panel_59, EPConstruction=item_20)  # -> readMe, simplify(HBSurface); disabled; plug-in component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
createhbsrfs_10 = Honeybee_createHBSrfs(geometry=brep_14, srfType=panel_62, EPConstruction=item_19)  # -> readMe, simplify(HBSurface); disabled; plug-in component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
createhbsrfs_11 = Honeybee_createHBSrfs(geometry=brep_13, srfType=panel_60, EPConstruction=item_18)  # -> readMe, simplify(HBSurface); disabled; plug-in component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
createhbsrfs_12 = Honeybee_createHBSrfs(geometry=brep_16, srfType=panel_61, EPConstruction=item_17)  # -> readMe, simplify(HBSurface); disabled; plug-in component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
flip_3 = Flip(Surface=brep_14)  # -> Surface, Result; disabled

createhbsrfs_13 = Honeybee_createHBSrfs(geometry=brep_11, srfType=panel_58)  # -> readMe, simplify(HBSurface); disabled; plug-in component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
addhbglz = Honeybee_addHBGlz(HBObj=createhbsrfs.HBSurface, childSurfaces=flatten(brep), EPConstructions=item_16)  # -> simplify(HBObjWGLZ); disabled; plug-in component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
addhbglz_2 = Honeybee_addHBGlz(HBObj=createhbsrfs_5.HBSurface, childSurfaces=flatten(brep_6), EPConstructions=epconstruction_5)  # -> simplify(HBObjWGLZ); plug-in component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
wires = BrepWireframe(
    Brep=[createhbsrfs_8.HBSurface, createhbsrfs_7.HBSurface, createhbsrfs_6.HBSurface, createhbsrfs_5.HBSurface],
    Density=-1)
addhbglz_3 = Honeybee_addHBGlz(HBObj=createhbsrfs_9.HBSurface, childSurfaces=flatten(brep_12), EPConstructions=item_21)  # -> simplify(HBObjWGLZ); disabled; plug-in component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
makeadiabatic = Honeybee_MakeAdiabatic(HBSrfs=[createhbsrfs_7.HBSurface, createhbsrfs_6.HBSurface, createhbsrfs_8.HBSurface])  # -> HBSrfs; plug-in component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
wires_2 = BrepWireframe(Brep=[createhbsrfs_4.HBSurface, createhbsrfs_3.HBSurface, createhbsrfs_2.HBSurface, createhbsrfs.HBSurface], Density=-1)  # disabled
makeadiabatic_2 = Honeybee_MakeAdiabatic(HBSrfs=flatten([createhbsrfs_3.HBSurface, createhbsrfs_2.HBSurface, createhbsrfs_4.HBSurface]))  # -> HBSrfs; disabled; plug-in component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
wires_3 = BrepWireframe(
    Brep=[createhbsrfs_12.HBSurface, createhbsrfs_11.HBSurface, createhbsrfs_10.HBSurface, createhbsrfs_9.HBSurface],
    Density=-1)  # disabled
makeadiabatic_3 = Honeybee_MakeAdiabatic(HBSrfs=flatten([createhbsrfs_11.HBSurface, createhbsrfs_10.HBSurface, createhbsrfs_12.HBSurface]))  # -> HBSrfs; disabled; plug-in component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
ladybug = Ladybug_Ladybug()  # -> Vviiiiiiiiiizzz; disabled; plug-in component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
honeybee = Honeybee_Honeybee()  # -> Vviiiiiiiiiizzz; disabled; plug-in component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

bldgprograms = Honeybee_bldgPrograms({"Office": 0, "Retail": 1, "MidriseApartment": 2, "PrimarySchool": 3, "SecondarySchool": 4, "SmallHotel": 5, "LargeHotel": 6, "Hospital": 7, "Outpatient": 8, "Warehouse": 9, "SuperMarket": 10, "FullServiceRestaurant": 11, "QuickServiceRestaurant": 12}, selected="MidriseApartment")
listzoneprograms = Honeybee_ListZonePrograms(bldgProgram=bldgprograms)  # -> MidriseApartmentZonePrograms; plug-in component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
item_22 = ListItem(List=listzoneprograms, Index="0", Wrap=True)
createhbzones = Honeybee_createHBZones(name="Bedroom", zoneProgram=item_22, HBSurfaces=flatten([makeadiabatic, addhbglz_2]), isConditioned=Toggle(False))  # -> readMe, HBZone; plug-in component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

honeybee_2 = Honeybee_Honeybee()  # -> Vviiiiiiiiiizzz; plug-in component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

bldgprograms_2 = Honeybee_bldgPrograms({"Office": 0, "Retail": 1, "MidriseApartment": 2, "PrimarySchool": 3, "SecondarySchool": 4, "SmallHotel": 5, "LargeHotel": 6, "Hospital": 7, "Outpatient": 8, "Warehouse": 9, "SuperMarket": 10, "FullServiceRestaurant": 11, "QuickServiceRestaurant": 12}, selected="MidriseApartment")  # disabled
listzoneprograms_2 = Honeybee_ListZonePrograms(bldgProgram=bldgprograms_2)  # -> MidriseApartmentZonePrograms; disabled; plug-in component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
panel_63 = Panel("0")  # disabled
toggle_2 = BooleanToggle(False)  # disabled
panel_64 = Panel("Bedroom")  # disabled
item_23 = ListItem(List=listzoneprograms_2, Index=panel_63, Wrap=True)  # disabled
createhbzones_2 = Honeybee_createHBZones(name=panel_64, zoneProgram=item_23, HBSurfaces=flatten([makeadiabatic_2, addhbglz]), isConditioned=toggle_2)  # -> readMe, HBZone; disabled; plug-in component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

bldgprograms_3 = Honeybee_bldgPrograms({"Office": 0, "Retail": 1, "MidriseApartment": 2, "PrimarySchool": 3, "SecondarySchool": 4, "SmallHotel": 5, "LargeHotel": 6, "Hospital": 7, "Outpatient": 8, "Warehouse": 9, "SuperMarket": 10, "FullServiceRestaurant": 11, "QuickServiceRestaurant": 12}, selected="MidriseApartment")  # disabled
listzoneprograms_3 = Honeybee_ListZonePrograms(bldgProgram=bldgprograms_3)  # -> MidriseApartmentZonePrograms; disabled; plug-in component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
panel_65 = Panel("0")  # disabled
toggle_3 = BooleanToggle(False)  # disabled
panel_66 = Panel("Bedroom")  # disabled
item_24 = ListItem(List=listzoneprograms_3, Index=panel_65, Wrap=True)  # disabled
createhbzones_3 = Honeybee_createHBZones(name=panel_66, zoneProgram=item_24, HBSurfaces=flatten([makeadiabatic_3, addhbglz_3]), isConditioned=toggle_3)  # -> readMe, HBZone; disabled; plug-in component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

ladybug_2 = Ladybug_Ladybug()  # -> Vviiiiiiiiiizzz; plug-in component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

# ----
# geometry is not considered in airflow
# - volume is
# - surface is
# 
# these are simplified calculations done, not CFT calculations
# - can be more accurate than CFT
toggle_4 = BooleanToggle(True)  # disabled
# Natural Ventilation
panel_67 = Panel("1")  # disabled
panel_68 = Panel("22")  # disabled
panel_69 = Panel("35")  # disabled
panel_70 = Panel("12")  # disabled
panel_71 = Panel("30")  # disabled
setepnatvent = Honeybee_SetEPAirFlow(
    HBZones=flatten(createhbzones.HBZone),
    naturalVentilationType=panel_67,
    minIndoorTempForNatVent=panel_68,
    maxOutdoorTempForNatVent=panel_71,
    windDrivenCrossVent=toggle_4)  # -> readMe, simplify(HBZones); disabled; plug-in component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

panel_72 = Panel("0.0001")  # disabled
panel_73 = Panel(".03")  # disabled
# Zone Loads
panel_74 = Panel("5")  # disabled
panel_75 = Panel("9")  # disabled
setepzoneloads_2 = Honeybee_SetEnergyPlusZoneLoads(
    HBZones=setepnatvent.HBZones,
    equipmentLoadPerArea=panel_74,
    infiltrationRatePerArea=panel_72,
    lightingDensityPerArea=panel_75,
    numOfPeoplePerArea=panel_73)  # -> loads, HBZones; disabled; plug-in component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

honeybee_3 = Honeybee_Honeybee()  # -> Vviiiiiiiiiizzz; disabled; plug-in component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
honeybee_4 = Honeybee_Honeybee()  # -> Vviiiiiiiiiizzz; disabled; plug-in component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
brep_17 = Brep([<brep referenced from the Rhino model> x12])  # disabled
panel_76 = Panel("https://www.energyplus.net/weather-download/north_and_central_america_wmo_region_4/USA/NY/USA_NY_New.York-J.F.Kennedy.Intl.AP.744860_TMY3/all")  # disabled

toggle_5 = BooleanToggle(True)  # disabled
# Run Energy Model
epoutput = Honeybee_GenerateEPOutput(
    zoneEnergyUse=toggle_5,
    zoneGainsAndLosses="False",
    zoneComfortMetrics=toggle_5,
    comfortMapVariables=toggle_5,
    surfaceTempAnalysis=toggle_5)  # -> report, flatten(simulationOutputs); disabled; plug-in component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
analysisperiod = Ladybug_AnalysisPeriod()  # -> readMe, analysisPeriod; disabled; plug-in component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
toggle_6 = BooleanToggle(True)  # disabled

hb_epcontextsrf = HoneybeeEPContextSurfaces(shdSurfaces=flatten(brep_17))  # -> HBContext; inputs shdSurfaces: list of Brep, justBoundingBox: Boolean; disabled
# ---------- hb_epcontextsrf: Python ----------
"""
prepare shading/context geometries

    Args:
        northVectorOrRotation: A vector that shows North or a number that shows
                               the rotation of the North from the Y axis
        bldgMasses: List of closed Breps as thermal zones.
    Returns:
        report: ...
        thermalZones: Thermal zone's geometries for visualiza
"""

ghenv.Component.Name = 'Honeybee EP context Surfaces'
ghenv.Component.NickName = 'HB_EPContextSrf'
ghenv.Component.Message = 'VER 0.0.62\nJUL_28_2017'
ghenv.Component.IconDisplayMode = ghenv.Component.IconDisplayMode.application
ghenv.Component.Category = "Honeybee"
ghenv.Component.SubCategory = "10 | Energy | Energy"
#compatibleHBVersion = VER 0.0.57\nNOV_04_2016
#compatibleLBVersion = VER 0.0.59\nFEB_01_2015
ghenv.Component.AdditionalHelpFromDocStrings = "2"

import rhinoscriptsyntax as rs
import Rhino as rc
import scriptcontext as sc
import os
import System
import Grasshopper.Kernel as gh
import uuid

tolerance = sc.doc.ModelAbsoluteTolerance
import math


def main(shdSurfaces, EPTransSchedule, meshingSettings, justBoundingBox):
    
    # import the classes
    if sc.sticky.has_key('honeybee_release'):

        try:
            if not sc.sticky['honeybee_release'].isCompatible(ghenv.Component): return -1
            if sc.sticky['honeybee_release'].isInputMissing(ghenv.Component): return -1
        except:
            warning = "You need a newer version of Honeybee to use this compoent." + \
            " Use updateHoneybee component to update userObjects.\n" + \
            "If you have already updated userObjects drag Honeybee_Honeybee component " + \
            "into canvas and try again."
            w = gh.GH_RuntimeMessageLevel.Warning
            ghenv.Component.AddRuntimeMessage(w, warning)
            return -1
        
        # don't customize this part
        hb_EPSrf = sc.sticky["honeybee_EPSurface"]
        hb_EPSHDSurface = sc.sticky["honeybee_EPShdSurface"]
        hb_RADMaterialAUX = sc.sticky["honeybee_RADMaterialAUX"]
        hb_EPObjectsAux = sc.sticky["honeybee_EPObjectsAUX"]()
        HBScheduleList = sc.sticky["honeybee_ScheduleLib"].keys()

        ########################################################################
        #----------------------------------------------------------------------#
        shdBreps = []
        # create bounding box of shading geometries
        if justBoundingBox:
            for brep in shdSurfaces:
                if brep.Faces.Count>1 or not brep.Faces[0].IsPlanar(sc.doc.ModelAbsoluteTolerance):
                    shdBreps.append(brep.GetBoundingBox(True).ToBrep())
                else:
                    shdBreps.append(brep)
        else:
            shdBreps = shdSurfaces
        
        shadingClasses = []
        shadingMeshPreview = []
        
        if meshingSettings == None:
            mp = rc.Geometry.MeshingParameters.Minimal
            mp.SimplePlanes = True
        else:
            mp = meshingSettings
        
        def getRadMaterialName(radMaterial):
            nameStr = radMaterial.split(" ")[2]
            name =  nameStr.split("\n")[0]
            return name
        
        for brepCount, brep in enumerate(shdBreps):
            if brep != None:
                isPlanar = True
                # check planarity
                for face in brep.Faces:
                    if not face.IsPlanar(tolerance):
                        isPlanar = False
                        break
                
                shadingBreps = []
                if not isPlanar:
                    meshArray = rc.Geometry.Mesh.CreateFromBrep(brep, mp)
                    for mesh in meshArray:
                        for meshFace in range(mesh.Faces.Count):
                            vertices = list(mesh.Faces.GetFaceVertices(meshFace))[1:]
                            vertices = vertices + [sc.doc.ModelAbsoluteTolerance]
                            # create the brep from mesh
                            shdBrep = rc.Geometry.Brep.CreateFromCornerPoints(*vertices)
                            shadingBreps.append(shdBrep)
                else:
                    for face in brep.Faces:
                        shadingBreps.append(face.DuplicateFace(False))
                
                for faceCount, shdBrep in enumerate(shadingBreps):
                        thisShading = hb_EPSHDSurface(shdBrep, 1000*brepCount + faceCount, 'shdSrf_' + `brepCount` + '_' + `faceCount` + "_" + str(uuid.uuid4()))
                        
                        # add transmittance schedule if any
                        if EPTransSchedule!=None:
                            schedule= EPTransSchedule.upper()
                            if schedule!=None and not schedule.lower().endswith(".csv") and schedule not in HBScheduleList:
                                msg = "Cannot find " + schedule + " in Honeybee schedule library."
                                print msg
                                ghenv.Component.AddRuntimeMessage(gh.GH_RuntimeMessageLevel.Warning, msg)
                                return -1
                            elif schedule!=None and schedule.lower().endswith(".csv"):
                                # check if csv file is existed
                                if not os.path.isfile(schedule):
                                    msg = "Cannot find the shchedule file: " + schedule
                                    print msg
                                    ghenv.Component.AddRuntimeMessage(gh.GH_RuntimeMessageLevel.Warning, msg)
                                    return -1
                            
                            thisShading.TransmittanceSCH = schedule
                        
                        # add the Rad Material if any
                        if RADMaterial!=None:
                            # if it is just the name of the material make sure it is already defined
                            if len(RADMaterial.split(" ")) == 1:
                                # if the material is not in the library add it to the library
                                if not hb_RADMaterialAUX.isMatrialExistInLibrary(RADMaterial):
                                    warningMsg = "Can't find " + RADMaterial + " in RAD Material Library.\n" + \
                                                "Add the material to the library and try again."
                                    ghenv.Component.AddRuntimeMessage(gh.GH_RuntimeMessageLevel.Warning, warningMsg)
                                    return
                                
                                try:
                                    thisShading.setRADMaterial(RADMaterial)
                                except Exception, e:
                                    print e
                                    warningMsg = "You are using an old version of Honeybee_Honeybee! Update your files and try again."
                                    print warningMsg
                                    ghenv.Component.AddRuntimeMessage(gh.GH_RuntimeMessageLevel.Warning, warningMsg)
                                    return
                                
                                addedToLib = True
                            else:
                                
                                # try to add the material to the library
                                addedToLib, thisShading.RadMaterial = hb_RADMaterialAUX.analyseRadMaterials(RADMaterial, True)
                                
                            if addedToLib==False:
                                warningMsg = "Failed to add " + RADMaterial + " to the Library."
                                ghenv.Component.AddRuntimeMessage(gh.GH_RuntimeMessageLevel.Warning, warningMsg)
                                return
                        
                        # add shading to the list
                        shadingClasses.append(thisShading)
                
        # add to the hive
        hb_hive = sc.sticky["honeybee_Hive"]()
        HBContext  = hb_hive.addToHoneybeeHive(shadingClasses, ghenv.Component)
        return HBContext
        ################################################################################################
    else:
        print "You should first let Honeybee to fly..."
        w = gh.GH_RuntimeMessageLevel.Warning
        ghenv.Component.AddRuntimeMessage(w, "You should first let Honeybee to fly...")
        return -1
        

if _shdSurfaces and _shdSurfaces[0]!=None:
    # add cleaning function
    result= main(_shdSurfaces, EPTransSchedule_, meshingSettings_, justBoundingBox_)
    
    if result != -1: HBContext = result
# ---------- end hb_epcontextsrf ----------

# ----
# REQUEST THE RIGHT OUTPUTS
toggle_7 = BooleanToggle(True)  # disabled
epoutput_2 = Honeybee_GenerateEPOutput(
    zoneEnergyUse=toggle_7,
    zoneGainsAndLosses=toggle_7,
    zoneComfortMetrics="False",
    surfaceTempAnalysis="False",
    surfaceEnergyAnalysis=toggle_7)  # -> report, flatten(simulationOutputs); disabled; plug-in component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

panel_77 = Panel("https://www.energyplus.net/weather-download/north_and_central_america_wmo_region_4/USA/PA/USA_PA_Philadelphia.Intl.AP.724080_TMY3/all")  # disabled
epw_stat = Ladybug_OpenEPWAndSTATWeatherFiles(weatherFileURL=panel_76)  # -> epwFile, statFile; disabled; plug-in component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
epw_stat_2 = Ladybug_OpenEPWAndSTATWeatherFiles(weatherFileURL=panel_77)  # -> epwFile, statFile; disabled; plug-in component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
toggle_8 = BooleanToggle(True)  # disabled

# ----
# COMFORT AUTONOMY
# Calculate Clothing Function
importepw = Ladybug_ImportEpw(epwFile=epw_stat.epwFile)  # -> readMe, latitude, location, dryBulbTemperature, dewPointTemperature, relativeHumidity, windSpeed, windDirection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; disabled; plug-in component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
panel_78 = Panel("10")  # disabled
panel_79 = Panel("1.1")  # disabled
clofunction = Ladybug_ClothingFunction(outdoorAirTemperature=importepw.dryBulbTemperature, maxClo=panel_79, maxCloTemp=panel_78)  # -> readMe, cloValues; disabled; plug-in component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

pt = Point(<point referenced from the Rhino model>)  # disabled
pt_2 = Point(<point referenced from the Rhino model>)  # disabled
panel_80 = Panel(".025")  # disabled
panel_81 = Panel(".1")  # disabled
panel_82 = Panel(".025")  # disabled
panel_83 = Panel(".1")  # disabled
toggle_9 = BooleanToggle(True)  # disabled
# PSYCHROMETRIC CHART
activitieslist = Ladybug_ActivitiesMetList({"Sleeping": 0.7, "Reclining": 0.8, "Sitting": 1.0, "Typing": 1.1, "Standing": 1.2, "Driving": 1.5, "Cooking": 1.8, "House Cleaning": 2.7, "Strolling": 1.7, "Walking 2mph": 2.0, "Walking 3mph": 2.6, "Walking 4mph": 3.8, "Running 9mph": 9.5, "Lifting 10lbs": 2.1, "Lifting 100lbs": 4.0, "Shoveling": 4.4, "Dancing": 3.4, "Basketball": 6.3}, selected="Reclining")  # disabled
pt_3 = Point(<point referenced from the Rhino model>)  # disabled
panel_84 = Panel("0.5")  # disabled

# ----
# Annual Daylight
# lighting Schedule
# lighting schedule
panel_85 = Panel("https://www.energyplus.net/weather-download/north_and_central_america_wmo_region_4/USA/PA/USA_PA_Philadelphia.Intl.AP.724080_TMY3/all")  # disabled
panel_86 = Panel(".5")  # disabled
panel_87 = Panel(".762")  # disabled
epw_stat_3 = Ladybug_OpenEPWAndSTATWeatherFiles(weatherFileURL=panel_85)  # -> epwFile, statFile; disabled; plug-in component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
gentestpts = Honeybee_GenerateTestPoints(testGeometry=brep_8, gridSize=panel_86, distBaseSrf=panel_87, moveTestMesh=True)  # -> readMe, simplify(testPoints), simplify(ptsVectors), simplify(facesArea), simplify(mesh); disabled; plug-in component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
radparameters = Honeybee_RADParameters(quality=0)  # -> readMe, radParameters; disabled; plug-in component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
panel_88 = Panel("58")  # disabled
number_slider = Slider(0.1, range=0..0.1)  # disabled
# Occupancy & Lighting
annualdaylightsimulation = Honeybee_AnnualDaylightSimulation(
    epwWeatherFile=epw_stat_3.epwFile,
    testPoints=gentestpts.testPoints,
    ptsVectors=gentestpts.ptsVectors,
    testMesh=gentestpts.mesh,
    radParameters=radparameters.radParameters)  # -> analysisRecipe; disabled; plug-in component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
item_25 = ListItem(List=gentestpts.testPoints, Index=panel_88, Wrap=True)  # disabled
sph = Sphere(Base=item_25, Radius=number_slider)  # disabled
number_slider_2 = Slider(3, range=0..10)  # disabled
toggle_10 = BooleanToggle(True)  # disabled
panel_89 = Panel("4")  # disabled
lightingcontrol = Honeybee_LightingControlRecipe(
    controlType=panel_89,
    sensorPoints=item_25,
    lightingPower=250,
    lightingSetpoint=300,
    ballastLossFactor=20,
    standbyPower=3,
    delayTime=5)  # -> lightingControlGroup; disabled; plug-in component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
rundaylightanalysis = Honeybee_RunDaylightSimulation(
    HBObjects=flatten(setepzoneloads_2.HBZones),
    analysisRecipe=annualdaylightsimulation,
    writeRad=toggle_10,
    runRad=toggle_10,
    numOfCPUs=number_slider_2,
    overwriteResults=True)  # -> readMe, analysisType, resultsUnit, results, testPts, annual_analysis_files, radGeoFile, studyFolder, done; disabled; plug-in component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
gethbzoneepschedules = Honeybee_GetZoneEnergyPlusSchedules(HBZone=setepzoneloads_2.HBZones)  # -> occupancySchedule, occupancyActivitySch, heatingSetPtSchedule, coolingSetPtSchedule, lightingSchedule, equipmentSchedule, infiltrationSchedule; disabled; plug-in component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
panel_90 = Panel(gethbzoneepschedules.lightingSchedule)  # disabled
toggle_11 = BooleanToggle(True)  # disabled
readannualresultsi = Honeybee_ReadAnnualResultI(
    illFilesAddress=rundaylightanalysis.annual_analysis_files,
    testPoints=simplify(rundaylightanalysis.testPts),
    occupancyFiles=gethbzoneepschedules.lightingSchedule,
    DLAIllumThresholds=300,
    lightingControlGroups=lightingcontrol,
    runIt=toggle_11)  # -> DLA, UDLI_Less_100, UDLI_100_2000, UDLI_More_2000, CDA, sDA, annualProfiles, htmReport; disabled; plug-in component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
number_slider_3 = Slider(1, range=0..1)  # disabled
number_slider_4 = Slider(0, range=0..100)  # disabled
convertepschvalues = Honeybee_ConvertEnergyPlusScheduleToValues(schName=gethbzoneepschedules.lightingSchedule)  # -> values, holidays; disabled; plug-in component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
panel_91 = Panel("2")  # disabled
legendpar = Ladybug_LegendParameters(lowBound=number_slider_4, highBound=number_slider_3, numSegments=panel_91)  # -> legendPar; disabled; plug-in component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
pt_4 = Point(<point referenced from the Rhino model>)  # disabled
setepzoneschedules = Honeybee_SetEnergyPlusZoneSchedules(HBZones=setepzoneloads_2.HBZones, lightingSchedules=readannualresultsi.annualProfiles)  # -> schedules, simplify(HBZones); disabled; plug-in component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

# ---- group: just for visualization
# Compare Schedules!
dsannualprofiles = Honeybee_DaysimAnnualProfiles(annualProfiles=readannualresultsi.annualProfiles)  # -> simplify(occupancyProfile), simplify(shadingProfiles), simplify(lightingControlProfiles), simplify(dgpProfile); disabled; plug-in component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
panel_92 = Panel("0.02")  # disabled
panel_93 = Panel("0")  # disabled
panel_94 = Panel(".15")  # disabled
panel_95 = Panel("120")  # disabled
pt_5 = ConstructPoint(XCoordinate=panel_95, YCoordinate=0, ZCoordinate=0)  # disabled

# ----
_3dchart = Ladybug_3DChart(
    inputData=flatten([dsannualprofiles.lightingControlProfiles, convertepschvalues.values]),
    basePoint=pt_4,
    xScale=panel_92,
    yScale=panel_94,
    zScale=panel_93,
    legendPar=legendpar)  # -> readMe, graphMesh, graphCurves, legend, legendBasePts, title, titleBasePts, dataPts, conditionalHOY; disabled; plug-in component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

toggle_12 = BooleanToggle(True)  # disabled
panel_96 = Panel("https://www.energyplus.net/weather-download/north_and_central_america_wmo_region_4/USA/PA/USA_PA_Philadelphia.Intl.AP.724080_TMY3/all")  # disabled
epoutput_3 = Honeybee_GenerateEPOutput(zoneGainsAndLosses="False", zoneComfortMetrics=toggle_12, surfaceTempAnalysis="False")  # -> report, flatten(simulationOutputs); disabled; plug-in component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
epw_stat_4 = Ladybug_OpenEPWAndSTATWeatherFiles(weatherFileURL=panel_96)  # -> epwFile, statFile; disabled; plug-in component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
toggle_13 = BooleanToggle(True)  # disabled
runenergysimulation = Honeybee_RunEnergySimulation(
    epwFile=epw_stat_4.epwFile,
    HBZones=flatten(setepzoneschedules.HBZones),
    HBContext=flatten(hb_epcontextsrf),
    simulationOutputs=flatten(epoutput_3.simulationOutputs),
    writeIdf=toggle_13,
    runEnergyPlus=toggle_13)  # -> report, idfFileAddress, htmlReport, resultFileAddress; disabled; plug-in component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

runenergysimulation_2 = Honeybee_RunEnergySimulation(
    epwFile=epw_stat.epwFile,
    analysisPeriod=analysisperiod.analysisPeriod,
    HBZones=flatten(setepzoneschedules.HBZones),
    simulationOutputs=flatten(epoutput.simulationOutputs),
    writeIdf=toggle_6,
    runEnergyPlus=toggle_6)  # -> report, idfFileAddress, htmlReport, resultFileAddress, eioFileAddress; disabled; plug-in component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
# RUN THE SIMULATION
runenergysimulation_3 = Honeybee_RunEnergySimulation(
    epwFile=epw_stat_2.epwFile,
    HBZones=flatten(setepzoneschedules.HBZones),
    simulationOutputs=flatten(epoutput_2.simulationOutputs),
    writeIdf=toggle_8,
    runEnergyPlus=toggle_8)  # -> report, idfFileAddress, htmlReport, resultFileAddress; disabled; plug-in component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

exporttoopenstudio = Honeybee_ExportToOpenStudio()  # -> readMe, osmFileAddress, idfFileAddress, resultFileAddress, eioFileAddress, rddFileAddress, htmlReport, studyFolder, model; disabled; plug-in component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
# ENERGY BALANCE
readepresult = Honeybee_ReadEPResult(resultFileAddress=runenergysimulation_3.resultFileAddress)  # -> port, port_2, port_3, port_4, electricLight, electricEquip, fanElectric, port_5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; disabled; plug-in component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
readepsrfresult = Honeybee_ReadEPSurfaceResult(resultFileAddress=runenergysimulation_3.resultFileAddress)  # -> port, port_2, surfaceEnergyFlow, opaqueEnergyFlow, glazEnergyFlow, port_3, port_4, port_5, port_6, port_7; disabled; plug-in component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

# ----
# COMFORT ANALYSIS
# Visualization
importepw_2 = Ladybug_ImportEpw(epwFile=epw_stat_4.epwFile)  # -> readMe, latitude, location, dryBulbTemperature, dewPointTemperature, relativeHumidity, windSpeed, windDirection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; disabled; plug-in component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
readepresult_2 = Honeybee_ReadEPResult(resultFileAddress=runenergysimulation.resultFileAddress)  # -> port, port_2, port_3, port_4, port_5, port_6, port_7, port_8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; disabled; plug-in component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
toggle_14 = BooleanToggle(True)  # disabled
adaptivecomfortcalculator = Ladybug_AdaptiveComfortCalculator(
    dryBulbTemperature=readepresult_2.airTemperature,
    meanRadiantTemperature=readepresult_2.meanRadTemperature,
    prevailingOutdoorTemp=importepw_2.dryBulbTemperature,
    runIt=toggle_14)  # -> readMe, port, comfortableOrNot, conditionOfPerson, degreesFromTarget, port_2, targetTemperature, upperTemperatureBound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; disabled; plug-in component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
panel_97 = Panel([adaptivecomfortcalculator.percentOfTimeComfortable, adaptivecomfortcalculator.percentHotCold])  # disabled

# ----
# Calculate High Resolution Thermal Map
toggle_15 = BooleanToggle(True)  # disabled
toggle_16 = BooleanToggle(False)  # disabled
panel_98 = Panel("1")  # disabled
readepresult_3 = Honeybee_ReadEPResult(resultFileAddress=runenergysimulation_2.resultFileAddress)  # -> port, port_2, port_3, port_4, electricLight, electricEquip, fanElectric, port_5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; disabled; plug-in component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
readepsrfresult_2 = Honeybee_ReadEPSurfaceResult(resultFileAddress=runenergysimulation_2.resultFileAddress)  # -> surfaceIndoorTemp, surfaceOutdoorTemp, port, port_2, port_3, port_4, port_5, port_6, windowTransmissivity, port_7; disabled; plug-in component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
indoorviewfactor = Honeybee_IndoorViewFactorCalculator(HBZones=flatten(setepzoneschedules.HBZones), gridSize=panel_98, parallel=toggle_16, buildMesh=toggle_15, runIt=toggle_15)  # -> readMe, port, viewFactorMesh, viewFactorInfo, port_2, testPts, viewMeshFaces, zoneWireFrame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; disabled; plug-in component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
panel_99 = Panel("1.2")  # disabled
pmvcomfrecipe = Honeybee_PMVComfortAnalysisRecipe(
    viewFactorMesh=indoorviewfactor.viewFactorMesh,
    viewFactorInfo=indoorviewfactor.viewFactorInfo,
    epwFile=epw_stat.epwFile,
    srfIndoorTemp=readepsrfresult_2.surfaceIndoorTemp,
    zoneAirTemp=readepresult_3.airTemperature,
    zoneRelHumid=readepresult_3.relativeHumidity,
    zoneAirFlowVol=readepresult_3.airFlowVolume,
    zoneAirHeatGain=readepresult_3.airHeatGainRate,
    metabolicRate=panel_99,
    clothingLevel=clofunction.cloValues)  # -> comfRecipe; disabled; plug-in component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
toggle_17 = BooleanToggle(True)  # disabled
toggle_18 = BooleanToggle(True)  # disabled
toggle_19 = BooleanToggle(True)  # disabled
panel_100 = Panel("test")  # disabled
microclimatemap = Honeybee_MicroclimateMapAnalysis(
    comfAnalysisRecipe=pmvcomfrecipe,
    fileName=panel_100,
    analysisPeriodOrHOY=analysisperiod.analysisPeriod,
    writeResultFile=toggle_18,
    parallel=toggle_19,
    runIt=toggle_17)  # -> readMe, port, radTempMtx, airTempMtx, operativeTempMtx, adaptComfMtx, degFromTargetMtx, port_2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; disabled; plug-in component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

panel_101 = Panel("3")  # disabled
legendpar_2 = Ladybug_LegendParameters(numSegments=panel_101)  # -> legendPar; disabled; plug-in component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
panel_102 = Panel("0")  # disabled
panel_103 = Panel("0")  # disabled
_3dchart_2 = Ladybug_3DChart(
    inputData=flatten(adaptivecomfortcalculator.conditionOfPerson),
    xScale=panel_82,
    yScale=panel_83,
    zScale=panel_103,
    legendPar=legendpar_2)  # -> readMe, graphMesh, graphCurves, legend, legendBasePts, title, titleBasePts, dataPts, conditionalHOY; disabled; plug-in component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
_3dchart_3 = Ladybug_3DChart(inputData=flatten(readepresult_2.airTemperature), basePoint=pt_2, xScale=panel_80, yScale=panel_81, zScale=panel_102)  # -> readMe, graphMesh, graphCurves, legend, legendBasePts, title, titleBasePts, dataPts, conditionalHOY; disabled; plug-in component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

toggle_20 = BooleanToggle(True)  # disabled
# Visualize Underheated / Overheated Hours
thermalautonomy = Honeybee_ThermalAutonomyAnalysis(
    comfResultsMtx=microclimatemap.adaptComfMtx,
    degOrPMVMtx=microclimatemap.degFromTargetMtx,
    viewFactorMesh=flatten(indoorviewfactor.viewFactorMesh),
    HBZones=flatten(setepzoneschedules.HBZones),
    totalThermalEnergy=readepresult_3.port,
    runIt=toggle_20)  # -> readMe, port, occTCP_Mtx, TA_Mtx, OverHeatedMtx, UnderHeatedMtx, port_2, occTCP_Result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; disabled; plug-in component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
visualizemicroclimate = Honeybee_VisualizeMicroclimateMap(comfResultsMtx=thermalautonomy.OverHeatedMtx, viewFactorMesh=flatten(indoorviewfactor.viewFactorMesh))  # -> readMe, port, resultMesh, legend, legendBasePt, port_2, resultValues, resultColors; disabled; plug-in component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
panel_104 = Panel("20,0,0")  # disabled
swatch = ColourSwatch(SwatchColor=RGB(0, 0, 0))  # disabled
move = Move(Geometry=indoorviewfactor.zoneWireFrame, Motion=panel_104)  # -> Geometry, Transform; disabled
move_2 = Move(Geometry=[visualizemicroclimate.resultMesh, visualizemicroclimate.legend], Motion=panel_104)  # -> Geometry, Transform; disabled
preview = CustomPreview(Geometry=[indoorviewfactor.zoneWireFrame, move.Geometry], Shader=swatch)  # disabled

visualizemicroclimate_2 = Honeybee_VisualizeMicroclimateMap(comfResultsMtx=thermalautonomy.UnderHeatedMtx, viewFactorMesh=flatten(indoorviewfactor.viewFactorMesh))  # -> readMe, port, resultMesh, legend, legendBasePt, port_2, resultValues, resultColors; disabled; plug-in component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
psychchart = Ladybug_PsychrometricChart(
    dryBulbTemperature=readepresult_2.airTemperature,
    relativeHumidity=readepresult_2.relativeHumidity,
    barometricPressure=importepw_2.barometricPressure,
    metabolicRate=activitieslist,
    clothingLevel=panel_84,
    basePoint=pt_3,
    runIt=toggle_9)  # -> readMe, port, totalComfortPercent, totalComfortOrNot, strategyNames, strategyPercentOfTime, strategyOrNot, port_2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; disabled; plug-in component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
panel_105 = Panel(psychchart.totalComfortOrNot)  # disabled

# ----
# MAKE AN ENERGY BALANCE AND PLOT IT ON A CHART
energybalance = Honeybee_ConstructEnergyBalance(
    HBZones=flatten(setepzoneschedules.HBZones),
    cooling=readepresult.port_3,
    heating=readepresult.port_4,
    electricLight=readepresult.electricLight,
    electricEquip=readepresult.electricEquip,
    fanElectric=readepresult.fanElectric,
    peopleGains=readepresult.peopleGains,
    totalSolarGain=readepresult.totalSolarGain,
    infiltrationEnergy=readepresult.infiltrationEnergy,
    mechVentilationEnergy=readepresult.port_6,
    natVentEnergy=readepresult.natVentEnergy,
    surfaceEnergyFlow=readepsrfresult.surfaceEnergyFlow)  # -> readMe, port, flrNormEnergyBal, flrNormBalWStorage, port_2, modelEnergyBalance, energyBalWithStorage; disabled; plug-in component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
panel_106 = Panel("0")  # disabled
gradientlibrary = Ladybug_GradientLibrary(gradIndex=panel_106)  # -> customColors; disabled; plug-in component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
toggle_21 = BooleanToggle(True)  # disabled
legendpar_3 = Ladybug_LegendParameters(customColors=flatten(gradientlibrary))  # -> legendPar; disabled; plug-in component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
panel_107 = Panel("Patient Room Energy Balance")  # disabled
panel_108 = Panel("Energy (kWh)")  # disabled
toggle_22 = BooleanToggle(True)  # disabled
swatch_2 = ColourSwatch(SwatchColor=RGB(0, 0, 0))  # disabled

selectandaveragedata = Ladybug_AverageData(annualHourlyData=energybalance.flrNormBalWStorage, totalOrAverage=toggle_21)  # -> readMe, selHourlyData, totaledDaily, totaledMonthly, totMonthlyPerHour, totAnalysisPeriod; disabled; plug-in component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
barchart = Ladybug_MonthlyBarChart(
    inputData=flatten(selectandaveragedata.totaledMonthly),
    stackValues=toggle_22,
    altTitle=panel_107,
    altYAxisTitle=panel_108,
    basePoint=pt,
    legendPar=legendpar_3)  # -> readMe, dataMesh, dataCurves, dataCrvColors, graphAxes, graphLabels, title, titleBasePt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; disabled; plug-in component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

preview_2 = CustomPreview(Geometry=barchart.graphAxes, Shader=swatch_2)  # disabled
