# Grasshopper definition kennedy_kirin_final_project.gh (Grasshopper 0.9.76)
# plug-ins: Python Interpreter, Ironbug

construction_name = Panel("Shading_Device")
r_value_h_ft2_f_btu = Panel("26")
r_value_h_ft2_f_btu_2 = Panel("25")
r_value_h_ft2_f_btu_3 = Panel("25")
construction_name_2 = Panel("Baseline Wall")
construction_name_3 = Panel("Baseline Roof")
uip2usi = Ladybug_uIP2uSI(U_IP=".22")  # -> U_SI; plug-in component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
construction_name_4 = Panel("Baseline Floor")
rip2rsi = Ladybug_rIP2rSI(R_IP=r_value_h_ft2_f_btu_2)  # -> R_SI; plug-in component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
rip2rsi_2 = Ladybug_rIP2rSI(R_IP=r_value_h_ft2_f_btu)  # -> R_SI; plug-in component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
rip2rsi_3 = Ladybug_rIP2rSI(R_IP=r_value_h_ft2_f_btu_3)  # -> R_SI; plug-in component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
panel = Panel(uip2usi)
radmetalmaterial = Honeybee_RadianceMetalMaterial(materialName=construction_name, RReflectance="1", GReflectance="1", BReflectance="1", roughness="0", specularity="1")  # -> RADMaterial; plug-in component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
epnomassmat = Honeybee_EnergyPlusNoMassOpaqueMaterial(name=construction_name_3, R_Value=rip2rsi)  # -> EPMaterial; plug-in component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
epnomassmat_2 = Honeybee_EnergyPlusNoMassOpaqueMaterial(name=construction_name_2, R_Value=rip2rsi_2)  # -> EPMaterial; plug-in component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
epnomassmat_3 = Honeybee_EnergyPlusNoMassOpaqueMaterial(name=construction_name_4, R_Value=rip2rsi_3)  # -> EPMaterial; plug-in component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
epwindowmat = Honeybee_EnergyPlusWindowMaterial(name="Low_e_Argon_Vinyl", U_Value=uip2usi, SHGC=".22", VT=".5")  # -> EPMaterial; plug-in component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

honeybee = Honeybee_Honeybee()  # -> Vviiiiiiiiiizzz; plug-in component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
ladybug = Ladybug_Ladybug()  # -> Vviiiiiiiiiizzz; plug-in component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
panel_2 = Panel(".51")
sun_shelf_creation = BooleanToggle(False)
number_of_blinds = Slider(1, range=0..10)

number_of_blinds_2 = Slider(5, range=0..10)
window_creation = BooleanToggle(True)
blind_creation = BooleanToggle(True)

shading_depth = Slider(2, range=0..2)
shading_depth_2 = Slider(1.5, range=0..2)
panel_3 = Panel(".83")
panel_4 = Panel(".65")
panel_5 = Panel("1")
panel_6 = Panel(epwindowmat)
pt = ConstructPoint(XCoordinate="1.58", YCoordinate="-.5", ZCoordinate=".7")
pt_2 = ConstructPoint(XCoordinate="1.58", YCoordinate="-.5", ZCoordinate="1.23")
pt_3 = ConstructPoint(XCoordinate="1.58", YCoordinate="-.5", ZCoordinate="1.76")
pt_4 = ConstructPoint(XCoordinate="1.58", YCoordinate="-1.5", ZCoordinate="2.3")
pt_5 = ConstructPoint(XCoordinate="1.7", YCoordinate="-.5", ZCoordinate=".85")
pt_6 = ConstructPoint(XCoordinate="1.7", YCoordinate="-.5", ZCoordinate="1.25")
pt_7 = ConstructPoint(XCoordinate="1.7", YCoordinate="-.5", ZCoordinate="1.7")
pt_8 = ConstructPoint(XCoordinate="1.7", YCoordinate="-1.5", ZCoordinate="2.2")
planesrf = PlaneSurface(Plane=pt, XSize="2.2", YSize="1.5")
planesrf_2 = PlaneSurface(Plane=pt_2, XSize="2.2", YSize="1.5")
planesrf_3 = PlaneSurface(Plane=pt_4, XSize="2.2", YSize="4")
planesrf_4 = PlaneSurface(Plane=pt_5, XSize="1.95", YSize="1.5")
planesrf_5 = PlaneSurface(Plane=pt_6, XSize="1.95", YSize="1.5")
planesrf_6 = PlaneSurface(Plane=pt_7, XSize="1.95", YSize="1.5")
planesrf_7 = PlaneSurface(Plane=pt_8, XSize="1.95", YSize="4")
planesrf_8 = PlaneSurface(Plane=pt_3, XSize="2.2", YSize="1.5")
geo = Geometry([planesrf_3, planesrf_8, planesrf_2, planesrf])
geo_2 = Geometry([planesrf_7, planesrf_6, planesrf_5, planesrf_4])
wall_surface_with_opening = Brep(<brep referenced from the Rhino model>)
epconstruction = Honeybee_EnergyPlusConstruction(name="Single", layer_1=epwindowmat)  # -> EPConstruction; plug-in component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
walls = Brep([<brep referenced from the Rhino model> x3])

# ---- group: ceiling
ceiling = Brep(<brep referenced from the Rhino model>)

# ---- group: floor
floor = Brep(<brep referenced from the Rhino model>)

# ----
epconstruction_2 = Honeybee_EnergyPlusConstruction(name=construction_name_3, layer_1=epnomassmat)  # -> EPConstruction; plug-in component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
epconstruction_3 = Honeybee_EnergyPlusConstruction(name=construction_name_2, layer_1=epnomassmat_2)  # -> EPConstruction; plug-in component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
createhbsrfs = Honeybee_createHBSrfs(geometry=wall_surface_with_opening, EPConstruction=epconstruction_3)  # -> readMe, simplify(HBSurface); plug-in component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
epconstruction_4 = Honeybee_EnergyPlusConstruction(name=construction_name_4, layer_1=epnomassmat_3)  # -> EPConstruction; plug-in component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
glazingcreator = Honeybee_GlazingBasedOnRatio(
    HBObjects=createhbsrfs.HBSurface,
    glzRatio=Slider(0.4, range=0.2..0.8),
    breakUpWindow=Toggle(False),
    sillHeight=".762",
    EPConstructions=epconstruction,
    runIt=window_creation)  # -> readMe, HBObjWGLZ; plug-in component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
createhbsrfs_2 = Honeybee_createHBSrfs(geometry=walls, srfType="0", EPConstruction=epconstruction_3)  # -> readMe, simplify(HBSurface); plug-in component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
createhbsrfs_3 = Honeybee_createHBSrfs(geometry=flatten(floor), srfType="2", EPConstruction=epconstruction_4)  # -> readMe, simplify(HBSurface); plug-in component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
createhbsrfs_4 = Honeybee_createHBSrfs(geometry=ceiling, srfType="3", EPConstruction=epconstruction_2)  # -> readMe, simplify(HBSurface); plug-in component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
wires = BrepWireframe(Brep=glazingcreator.HBObjWGLZ, Density=-1)
makeadiabatic = Honeybee_MakeAdiabatic(HBSrfs=[createhbsrfs_2.HBSurface, createhbsrfs_4.HBSurface, createhbsrfs_3.HBSurface])  # -> HBSrfs; plug-in component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
panel_7 = Panel("test_room")
bldgprograms = Honeybee_bldgPrograms({"Office": 0, "Retail": 1, "MidriseApartment": 2, "PrimarySchool": 3, "SecondarySchool": 4, "SmallHotel": 5, "LargeHotel": 6, "Hospital": 7, "Outpatient": 8, "Warehouse": 9, "SuperMarket": 10, "FullServiceRestaurant": 11, "QuickServiceRestaurant": 12}, selected="MidriseApartment")
brep = Brep(flatten([makeadiabatic, glazingcreator.HBObjWGLZ]))
listzoneprograms = Honeybee_ListZonePrograms(bldgProgram=bldgprograms)  # -> MidriseApartmentZonePrograms; plug-in component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
item = ListItem(List=listzoneprograms, Index=0, Wrap=True)
createhbsrfs_5 = Honeybee_createHBSrfs(geometry=geo, srfName="Lightshelf", RADMaterial=radmetalmaterial)  # -> readMe, simplify(HBSurface); plug-in component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
conditioned = BooleanToggle(True)
createhbzones = Honeybee_createHBZones(name="test_room", zoneProgram=item, HBSurfaces=flatten(brep), isConditioned=conditioned)  # -> readMe, HBZone; plug-in component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
decomposebytype = Honeybee_DecomposeBasedOnType(HBZone=createhbzones.HBZone)  # -> walls, interiorWalls, airWalls, windows, interiorWindows, skylights, roofs, ceilings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; plug-in component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
decomposebytype_2 = Honeybee_DecomposeBasedOnType(HBZone=createhbzones.HBZone)  # -> walls, interiorWalls, airWalls, windows, interiorWindows, skylights, roofs, ceilings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; plug-in component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
shddesigner = Ladybug_ShadingDesigner(
    glzSrf=flatten(decomposebytype.windows),
    depthOrVector=flatten(shading_depth),
    numOfShds=number_of_blinds,
    runIt=sun_shelf_creation,
    port_4=False)  # -> readMe, shadingSrfs; plug-in component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
shddesigner_2 = Ladybug_ShadingDesigner(
    glzSrf=flatten(decomposebytype_2.windows),
    depthOrVector=flatten(shading_depth_2),
    numOfShds=number_of_blinds_2,
    runIt=blind_creation,
    port_4=False)  # -> readMe, shadingSrfs; plug-in component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
wires_2 = BrepWireframe(Brep=shddesigner.shadingSrfs, Density=-1)
preview = CustomPreview(Geometry=wires_2, Shader=ColourSwatch(SwatchColor=RGBA(0, 0, 0, 194)))
wires_3 = BrepWireframe(Brep=shddesigner_2.shadingSrfs, Density=-1)
preview_2 = CustomPreview(Geometry=wires_3, Shader=ColourSwatch(SwatchColor=RGBA(0, 0, 0, 194)))
createhbsrfs_6 = Honeybee_createHBSrfs(geometry=shddesigner_2.shadingSrfs, srfName="Shading", RADMaterial=radmetalmaterial)  # -> readMe, simplify(HBSurface); plug-in component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
panel_8 = Panel("https://www.energyplus.net/weather-download/north_and_central_america_wmo_region_4/USA/PA/USA_PA_Philadelphia.Intl.AP.724080_TMY3/all")
hb_epcontextsrf = HoneybeeEPContextSurfaces(shdSurfaces=flatten(createhbsrfs_5.HBSurface), RADMaterial=radmetalmaterial)  # -> HBContext; inputs shdSurfaces: list of Brep, justBoundingBox: Boolean
# ---------- hb_epcontextsrf: Python ----------
"""
prepare shading/context geometries

    Args:
        northVectorOrRotation: A vector that shows North or a number that shows
                               the rotation of the North from the Y axis
        bldgMasses: List of closed Breps as thermal zones.
    Returns:
        report: ...
        thermalZones: Thermal zone's geometries for visualiza
"""

ghenv.Component.Name = 'Honeybee EP context Surfaces'
ghenv.Component.NickName = 'HB_EPContextSrf'
ghenv.Component.Message = 'VER 0.0.62\nJUL_28_2017'
ghenv.Component.IconDisplayMode = ghenv.Component.IconDisplayMode.application
ghenv.Component.Category = "Honeybee"
ghenv.Component.SubCategory = "10 | Energy | Energy"
#compatibleHBVersion = VER 0.0.57\nNOV_04_2016
#compatibleLBVersion = VER 0.0.59\nFEB_01_2015
ghenv.Component.AdditionalHelpFromDocStrings = "2"

import rhinoscriptsyntax as rs
import Rhino as rc
import scriptcontext as sc
import os
import System
import Grasshopper.Kernel as gh
import uuid

tolerance = sc.doc.ModelAbsoluteTolerance
import math


def main(shdSurfaces, EPTransSchedule, meshingSettings, justBoundingBox):
    
    # import the classes
    if sc.sticky.has_key('honeybee_release'):

        try:
            if not sc.sticky['honeybee_release'].isCompatible(ghenv.Component): return -1
            if sc.sticky['honeybee_release'].isInputMissing(ghenv.Component): return -1
        except:
            warning = "You need a newer version of Honeybee to use this compoent." + \
            " Use updateHoneybee component to update userObjects.\n" + \
            "If you have already updated userObjects drag Honeybee_Honeybee component " + \
            "into canvas and try again."
            w = gh.GH_RuntimeMessageLevel.Warning
            ghenv.Component.AddRuntimeMessage(w, warning)
            return -1
        
        # don't customize this part
        hb_EPSrf = sc.sticky["honeybee_EPSurface"]
        hb_EPSHDSurface = sc.sticky["honeybee_EPShdSurface"]
        hb_RADMaterialAUX = sc.sticky["honeybee_RADMaterialAUX"]
        hb_EPObjectsAux = sc.sticky["honeybee_EPObjectsAUX"]()
        HBScheduleList = sc.sticky["honeybee_ScheduleLib"].keys()

        ########################################################################
        #----------------------------------------------------------------------#
        shdBreps = []
        # create bounding box of shading geometries
        if justBoundingBox:
            for brep in shdSurfaces:
                if brep.Faces.Count>1 or not brep.Faces[0].IsPlanar(sc.doc.ModelAbsoluteTolerance):
                    shdBreps.append(brep.GetBoundingBox(True).ToBrep())
                else:
                    shdBreps.append(brep)
        else:
            shdBreps = shdSurfaces
        
        shadingClasses = []
        shadingMeshPreview = []
        
        if meshingSettings == None:
            mp = rc.Geometry.MeshingParameters.Minimal
            mp.SimplePlanes = True
        else:
            mp = meshingSettings
        
        def getRadMaterialName(radMaterial):
            nameStr = radMaterial.split(" ")[2]
            name =  nameStr.split("\n")[0]
            return name
        
        for brepCount, brep in enumerate(shdBreps):
            if brep != None:
                isPlanar = True
                # check planarity
                for face in brep.Faces:
                    if not face.IsPlanar(tolerance):
                        isPlanar = False
                        break
                
                shadingBreps = []
                if not isPlanar:
                    meshArray = rc.Geometry.Mesh.CreateFromBrep(brep, mp)
                    for mesh in meshArray:
                        for meshFace in range(mesh.Faces.Count):
                            vertices = list(mesh.Faces.GetFaceVertices(meshFace))[1:]
                            vertices = vertices + [sc.doc.ModelAbsoluteTolerance]
                            # create the brep from mesh
                            shdBrep = rc.Geometry.Brep.CreateFromCornerPoints(*vertices)
                            shadingBreps.append(shdBrep)
                else:
                    for face in brep.Faces:
                        shadingBreps.append(face.DuplicateFace(False))
                
                for faceCount, shdBrep in enumerate(shadingBreps):
                        thisShading = hb_EPSHDSurface(shdBrep, 1000*brepCount + faceCount, 'shdSrf_' + `brepCount` + '_' + `faceCount` + "_" + str(uuid.uuid4()))
                        
                        # add transmittance schedule if any
                        if EPTransSchedule!=None:
                            schedule= EPTransSchedule.upper()
                            if schedule!=None and not schedule.lower().endswith(".csv") and schedule not in HBScheduleList:
                                msg = "Cannot find " + schedule + " in Honeybee schedule library."
                                print msg
                                ghenv.Component.AddRuntimeMessage(gh.GH_RuntimeMessageLevel.Warning, msg)
                                return -1
                            elif schedule!=None and schedule.lower().endswith(".csv"):
                                # check if csv file is existed
                                if not os.path.isfile(schedule):
                                    msg = "Cannot find the shchedule file: " + schedule
                                    print msg
                                    ghenv.Component.AddRuntimeMessage(gh.GH_RuntimeMessageLevel.Warning, msg)
                                    return -1
                            
                            thisShading.TransmittanceSCH = schedule
                        
                        # add the Rad Material if any
                        if RADMaterial!=None:
                            # if it is just the name of the material make sure it is already defined
                            if len(RADMaterial.split(" ")) == 1:
                                # if the material is not in the library add it to the library
                                if not hb_RADMaterialAUX.isMatrialExistInLibrary(RADMaterial):
                                    warningMsg = "Can't find " + RADMaterial + " in RAD Material Library.\n" + \
                                                "Add the material to the library and try again."
                                    ghenv.Component.AddRuntimeMessage(gh.GH_RuntimeMessageLevel.Warning, warningMsg)
                                    return
                                
                                try:
                                    thisShading.setRADMaterial(RADMaterial)
                                except Exception, e:
                                    print e
                                    warningMsg = "You are using an old version of Honeybee_Honeybee! Update your files and try again."
                                    print warningMsg
                                    ghenv.Component.AddRuntimeMessage(gh.GH_RuntimeMessageLevel.Warning, warningMsg)
                                    return
                                
                                addedToLib = True
                            else:
                                
                                # try to add the material to the library
                                addedToLib, thisShading.RadMaterial = hb_RADMaterialAUX.analyseRadMaterials(RADMaterial, True)
                                
                            if addedToLib==False:
                                warningMsg = "Failed to add " + RADMaterial + " to the Library."
                                ghenv.Component.AddRuntimeMessage(gh.GH_RuntimeMessageLevel.Warning, warningMsg)
                                return
                        
                        # add shading to the list
                        shadingClasses.append(thisShading)
                
        # add to the hive
        hb_hive = sc.sticky["honeybee_Hive"]()
        HBContext  = hb_hive.addToHoneybeeHive(shadingClasses, ghenv.Component)
        return HBContext
        ################################################################################################
    else:
        print "You should first let Honeybee to fly..."
        w = gh.GH_RuntimeMessageLevel.Warning
        ghenv.Component.AddRuntimeMessage(w, "You should first let Honeybee to fly...")
        return -1
        

if _shdSurfaces and _shdSurfaces[0]!=None:
    # add cleaning function
    result= main(_shdSurfaces, EPTransSchedule_, meshingSettings_, justBoundingBox_)
    
    if result != -1: HBContext = result
# ---------- end hb_epcontextsrf ----------
hb_epcontextsrf_2 = HoneybeeEPContextSurfaces(shdSurfaces=flatten(createhbsrfs_6.HBSurface), RADMaterial=radmetalmaterial)  # -> HBContext; inputs shdSurfaces: list of Brep, justBoundingBox: Boolean; same code as hb_epcontextsrf
hb_epcontextsrf_3 = HoneybeeEPContextSurfaces(shdSurfaces=flatten(createhbsrfs_5.HBSurface), RADMaterial=radmetalmaterial)  # -> HBContext; inputs shdSurfaces: list of Brep, justBoundingBox: Boolean; same code as hb_epcontextsrf
epw_stat = Ladybug_OpenEPWAndSTATWeatherFiles(weatherFileURL=panel_8)  # -> epwFile, statFile; plug-in component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
setepnatvent = Honeybee_SetEPAirFlow(
    HBZones=flatten(createhbzones.HBZone),
    naturalVentilationType="1",
    minIndoorTempForNatVent="24",
    maxIndoorTempForNatVent="27",
    minOutdoorTempForNatVent="22",
    maxOutdoorTempForNatVent="30")  # -> readMe, simplify(HBZones); plug-in component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
importepw = Ladybug_ImportEpw(epwFile=epw_stat.epwFile)  # -> readMe, latitude, location, dryBulbTemperature, dewPointTemperature, relativeHumidity, windSpeed, windDirection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; plug-in component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
wind_rose = BooleanToggle(False)
wires_4 = BrepWireframe(Brep=[brep, createhbsrfs_6.HBSurface], Density=-1)
decompose_honeybee_zone = Honeybee_DecomposeHBZone(HBZone=setepnatvent.HBZones)  # -> HBSurfaces; plug-in component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
pt_9 = ConstructPoint(XCoordinate="750", YCoordinate="800", ZCoordinate=0)
pt_10 = ConstructPoint(XCoordinate="500", YCoordinate=0, ZCoordinate=0)
windrose = Ladybug_WindRose(
    north=0,
    hourlyWindDirection=importepw.windDirection,
    hourlyWindSpeed=importepw.windSpeed,
    centerPoint=pt_9,
    runIt=wind_rose)  # -> readMe, calmRoseMesh, windRoseMesh, windRoseCrvs, windRoseCenPts, legend, legendBasePts, title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; plug-in component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
mrt = BooleanToggle(False)

exposure = BooleanToggle(False)
glare_analysis = BooleanToggle(False)
daylight_analysis = BooleanToggle(False)

solaradjusttemperature = Ladybug_OutdoorSolarTemperatureAdjustor(
    location=importepw.location,
    cumSkyMtxOrDirNormRad=importepw.directNormalRadiation,
    diffuseHorizRad=importepw.diffuseHorizontalRadiation,
    baseTemperature=importepw.dryBulbTemperature,
    horizInfraredRad=importepw.horizontalInfraredRadiation,
    runIt=mrt)  # -> readMe, port, effectiveRadiantField, MRTDelta, solarAdjustedMRT, port_2, mannequinMesh, port_3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; plug-in component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
panel_9 = Panel()
_3dchart = Ladybug_3DChart(inputData=flatten([importepw.dryBulbTemperature, importepw.relativeHumidity]), basePoint=pt_10, xScale=".5")  # -> readMe, graphMesh, graphCurves, legend, legendBasePts, title, titleBasePts, dataPts, conditionalHOY; plug-in component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
outdoorcomfortcalculator = Ladybug_OutdoorComfortCalculator(
    dryBulbTemperature=importepw.dryBulbTemperature,
    meanRadiantTemperature=solaradjusttemperature.solarAdjustedMRT,
    windSpeed_tenMeters=importepw.windSpeed,
    relativeHumidity=importepw.relativeHumidity,
    runIt=Toggle(False))  # -> readMe, port, universalThermalClimateIndex, comfortableOrNot, thermalStress, conditionOfPerson, port_2, percentOfTimeComfortable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; plug-in component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
panel_10 = Panel(outdoorcomfortcalculator.percentOfTimeComfortable)
pt_11 = Point(<point referenced from the Rhino model>)
pt_12 = ConstructPoint(XCoordinate="500", YCoordinate="1500", ZCoordinate=0)
concat = Concatenate(FragmentC="Percent Comfortable", FragmentA=panel_10)
legendpar = Ladybug_LegendParameters(numSegments="7")  # -> legendPar; plug-in component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
genclimatebasedsky = Honeybee_GenerateClimateBasedSky(weatherFile=epw_stat.epwFile, month="12", day="21", hour="15")  # -> radiationValues, skyFilePath; plug-in component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

daylight_analysis_2 = BooleanToggle(False)
flip = Flip(Surface=floor)  # -> Surface, Result
gentestpts = Honeybee_GenerateTestPoints(testGeometry=flip.Surface, gridSize=".25", distBaseSrf=".762", moveTestMesh=True)  # -> readMe, simplify(testPoints), simplify(ptsVectors), simplify(facesArea), simplify(mesh); plug-in component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
radparameters = Honeybee_RADParameters(quality=0, ab="5", ad="600", ar="22")  # -> readMe, radParameters; plug-in component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
gridbasedsimulation = Honeybee_GridBasedSimulation(
    skyFile=genclimatebasedsky.skyFilePath,
    testPoints=gentestpts.testPoints,
    ptsVectors=gentestpts.ptsVectors,
    simulationType=0,
    radParameters=radparameters.radParameters)  # -> analysisRecipe; plug-in component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
panel_11 = Panel("Daylight Analysis")
legendpar_2 = Ladybug_LegendParameters(lowBound="100", highBound="3000")  # -> legendPar; plug-in component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
rundaylightanalysis = Honeybee_RunDaylightSimulation(
    HBObjects=flatten([decompose_honeybee_zone, hb_epcontextsrf_3]),
    analysisRecipe=gridbasedsimulation,
    writeRad=daylight_analysis_2,
    runRad=daylight_analysis_2,
    overwriteResults=True)  # -> readMe, analysisType, resultsUnit, results, testPts, resultFiles, radGeoFile, studyFolder, done; plug-in component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
recolormesh = Ladybug_RecolorMesh(
    analysisResult=rundaylightanalysis.results,
    inputMesh=gentestpts.mesh,
    legendPar=legendpar_2,
    analysisTitle="December 21, 3PM",
    legendTitle="Lux")  # -> readMe, newMesh, newLegend, legendBasePt, meshColors, legendColors; plug-in component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

occupancy_sched = BooleanToggle(True)
daylight_analysis_3 = BooleanToggle(False)
read_result = BooleanToggle(False)
genhbzonetestpts = Honeybee_GenerateZoneTestPoints(HBZone=createhbzones.HBZone, gridSize=".25", distBaseSrf=".762", moveTestMesh=True)  # -> readMe, simplify(testPoints), simplify(ptsVectors), simplify(facesArea), simplify(mesh); plug-in component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
annualdaylightsimulation = Honeybee_AnnualDaylightSimulation(epwWeatherFile=epw_stat.epwFile, testPoints=genhbzonetestpts.testPoints, ptsVectors=genhbzonetestpts.ptsVectors)  # -> analysisRecipe; plug-in component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
rundaylightanalysis_2 = Honeybee_RunDaylightSimulation(
    HBObjects=flatten([setepnatvent.HBZones, hb_epcontextsrf_3]),
    analysisRecipe=annualdaylightsimulation,
    writeRad=daylight_analysis_3,
    runRad=daylight_analysis_3,
    overwriteResults=True)  # -> readMe, analysisType, resultsUnit, results, testPts, resultFiles, radGeoFile, studyFolder, done; plug-in component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
occupancygenerator = Honeybee_DaysimOccupancyGenerator(weekendDays=[1, 2], writeTheOcc=occupancy_sched)  # -> occupancyFile; plug-in component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
readannualresultsi = Honeybee_ReadAnnualResultI(
    illFilesAddress=rundaylightanalysis_2.resultFiles,
    testPoints=simplify(rundaylightanalysis_2.testPts),
    ptsVectors=gentestpts.ptsVectors,
    occupancyFiles=occupancygenerator,
    DLAIllumThresholds=300,
    runIt=read_result)  # -> DLA, UDLI_Less_100, UDLI_100_2000, UDLI_More_2000, CDA, sDA, annualProfiles, htmReport; plug-in component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
concat_2 = Concatenate(FragmentA="Annual Daylight Analysis", FragmentB="WWR_", FragmentC=panel_9)
legendpar_3 = Ladybug_LegendParameters(lowBound="0", highBound="100")  # -> legendPar; plug-in component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
recolormesh_2 = Ladybug_RecolorMesh(
    analysisResult=readannualresultsi.UDLI_100_2000,
    inputMesh=genhbzonetestpts.mesh,
    legendPar=legendpar_3,
    analysisTitle=concat_2,
    legendTitle="%")  # -> readMe, newMesh, newLegend, legendBasePt, meshColors, legendColors; plug-in component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
panel_12 = Panel("C:\Users\Kirin\Desktop\Fall 2017\Simulations\Final\Test\2_Useful_Daylight")
concat_3 = Concatenate(FragmentA="Annual_Daylight_Analysis_", FragmentB="WWR_", FragmentC=panel_9)
captureview = Ladybug_CaptureView(fileName=concat_3, folder=panel_12, capture=rundaylightanalysis_2.done)  # -> imagePath; plug-in component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

tag = TextTag(Location=pt_11, Text=concat)
_3dchart_2 = Ladybug_3DChart(inputData=flatten(outdoorcomfortcalculator.conditionOfPerson), basePoint=pt_12, xScale=".5", legendPar=legendpar)  # -> readMe, graphMesh, graphCurves, legend, legendBasePts, title, titleBasePts, dataPts, conditionalHOY; plug-in component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
panel_13 = Panel("Useful Dayling Analysis")
panel_14 = Panel("C:\Users\Kirin\Desktop\Fall 2017\Simulations\Final\Test\1_Daylight_Analysis")
concat_4 = Concatenate(
    FragmentA="Daylight_Analysis",
    FragmentB="WWR_",
    FragmentI=".4",
    FragmentF="_",
    FragmentC="12",
    FragmentG="_",
    FragmentD="21",
    FragmentH="_",
    FragmentE="15")
captureview_2 = Ladybug_CaptureView(fileName=concat_4, folder=panel_14, capture=rundaylightanalysis.done)  # -> imagePath; plug-in component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
pt_13 = Point(<point referenced from the Rhino model>)
pt_14 = Point(<point referenced from the Rhino model>)
pt_15 = Point(<point referenced from the Rhino model>)
pt_16 = Point(<point referenced from the Rhino model>)

ep_output = BooleanToggle(True)
energy_sim = BooleanToggle(True)
setepzoneschedules = Honeybee_SetEnergyPlusZoneSchedules(HBZones=setepnatvent.HBZones)  # -> schedules, simplify(HBZones); plug-in component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
epoutput = Honeybee_GenerateEPOutput(zoneEnergyUse=ep_output, zoneGainsAndLosses=ep_output, zoneComfortMetrics=ep_output, surfaceTempAnalysis=ep_output)  # -> report, flatten(simulationOutputs); plug-in component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
runenergysimulation = Honeybee_RunEnergySimulation(
    epwFile=epw_stat.epwFile,
    HBZones=flatten(setepnatvent.HBZones),
    HBContext=flatten(hb_epcontextsrf_3),
    simulationOutputs=flatten(epoutput.simulationOutputs),
    writeIdf=energy_sim,
    runEnergyPlus=energy_sim)  # -> report, idfFileAddress, htmlReport, resultFileAddress; plug-in component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
readepresult = Honeybee_ReadEPResult(resultFileAddress=runenergysimulation.resultFileAddress)  # -> totalThermalLoad, thermalLoadBalance, cooling, heating, electricLight, electricEquip, fanElectric, port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; plug-in component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
legendpar_4 = Ladybug_LegendParameters(lowBound=Slider(21, range=0..100))  # -> legendPar; plug-in component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
strnum = Ladybug_SeparateData(inputList=flatten(readepresult.cooling))  # -> numbers, strings; plug-in component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
strnum_2 = Ladybug_SeparateData(inputList=flatten(readepresult.heating))  # -> numbers, strings; plug-in component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
strnum_3 = Ladybug_SeparateData(inputList=flatten(readepresult.electricLight))  # -> numbers, strings; plug-in component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
legendpar_5 = Ladybug_LegendParameters(lowBound=Slider(0, range=0..100), highBound="2.9")  # -> legendPar; plug-in component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
graph = QuickGraph(readepresult.airTemperature)
ma = MassAddition(Input=strnum.numbers)  # -> Result, PartialResults
ma_2 = MassAddition(Input=strnum_2.numbers)  # -> Result, PartialResults
ma_3 = MassAddition(Input=strnum_3.numbers)  # -> Result, PartialResults
barchart = Ladybug_MonthlyBarChart(
    inputData=flatten(readepresult.airTemperature),
    basePoint=pt_13,
    xScale=Slider(0.5, range=0..1),
    yScale=Slider(0.7, range=0..1),
    legendPar=legendpar_4)  # -> readMe, dataMesh, dataCurves, dataCrvColors, graphAxes, graphLabels, title, titleBasePt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; plug-in component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
total_cooling = Panel(ma.Result)
total_heating = Panel(ma_2.Result)
total_electric_lighting = Panel(ma_3.Result)
round = Round(Number=total_cooling)  # -> Nearest, Floor, Ceiling
concat_5 = Concatenate(FragmentA="Cooling Loads", FragmentB=round.Nearest, FragmentD=" kwh")
barchart_2 = Ladybug_MonthlyBarChart(
    inputData=flatten(readepresult.cooling),
    altTitle=concat_5,
    altYAxisTitle="Cooling Loads",
    basePoint=pt_14,
    xScale=Slider(0.5, range=0..1),
    yScale=Slider(0.7, range=0..1),
    legendPar=legendpar_5)  # -> readMe, dataMesh, dataCurves, dataCrvColors, graphAxes, graphLabels, title, titleBasePt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; plug-in component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
round_2 = Round(Number=total_heating)  # -> Nearest, Floor, Ceiling
concat_6 = Concatenate(FragmentA="Heating Loads", FragmentB=round_2.Nearest, FragmentD=" kwh")
barchart_3 = Ladybug_MonthlyBarChart(
    inputData=flatten(readepresult.heating),
    altTitle=concat_6,
    altYAxisTitle="Heating Loads",
    basePoint=pt_15,
    xScale=Slider(0.5, range=0..1),
    yScale=Slider(0.7, range=0..1),
    legendPar=legendpar_5)  # -> readMe, dataMesh, dataCurves, dataCrvColors, graphAxes, graphLabels, title, titleBasePt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; plug-in component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
round_3 = Round(Number=total_electric_lighting)  # -> Nearest, Floor, Ceiling
panel_15 = Panel("260, 0, 0")
concat_7 = Concatenate(FragmentA="Lighting Loads", FragmentB=round_3.Nearest, FragmentD=" kwh")
tag_2 = TextTag(Location="30,-10,0", Text=concat_5)
barchart_4 = Ladybug_MonthlyBarChart(
    inputData=flatten(readepresult.electricLight),
    altTitle=concat_7,
    altYAxisTitle="Lighting Loads",
    basePoint=pt_16,
    xScale=Slider(0.5, range=0..1),
    yScale=Slider(0.7, range=0..1),
    legendPar=legendpar_5)  # -> readMe, dataMesh, dataCurves, dataCrvColors, graphAxes, graphLabels, title, titleBasePt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; plug-in component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
tag_3 = TextTag(Location="150,-10,0", Text=concat_6)
tag_4 = TextTag(Location="270,-10,0", Text=concat_7)

adaptive_comfort = BooleanToggle(True)
adaptivecomfortcalculator = Ladybug_AdaptiveComfortCalculator(
    dryBulbTemperature=readepresult.operativeTemperature,
    meanRadiantTemperature=readepresult.airTemperature,
    prevailingOutdoorTemp=importepw.dryBulbTemperature,
    runIt=adaptive_comfort)  # -> readMe, port, comfortableOrNot, conditionOfPerson, degreesFromTarget, port_2, targetTemperature, upperTemperatureBound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; plug-in component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
panel_16 = Panel("Adaptive Comfort")
legendpar_6 = Ladybug_LegendParameters(lowBound="-1", highBound="1", numSegments="3")  # -> legendPar; plug-in component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
_3dchart_3 = Ladybug_3DChart(
    inputData=flatten(adaptivecomfortcalculator.conditionOfPerson),
    basePoint="0,-1200,0",
    xScale="0.25",
    zScale="0",
    legendPar=legendpar_6)  # -> readMe, graphMesh, graphCurves, legend, legendBasePts, title, titleBasePts, dataPts, conditionalHOY; plug-in component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

pt_17 = Point(<point referenced from the Rhino model>)

# ----
# Energy Balance Bar Chart
surface_energy_flow = BooleanToggle(True)
stack_values_chart = BooleanToggle(True)
total_values = BooleanToggle(True)
exporttoopenstudio = Honeybee_ExportToOpenStudio(
    epwWeatherFile=epw_stat.epwFile,
    HBZones=flatten(createhbzones.HBZone),
    HBContext=flatten(hb_epcontextsrf_3),
    simulationOutputs=flatten(epoutput.simulationOutputs),
    writeOSM=surface_energy_flow,
    runSimulation=surface_energy_flow)  # -> readMe, osmFileAddress, idfFileAddress, resultFileAddress, eioFileAddress, rddFileAddress, htmlReport, studyFolder, model; plug-in component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
readepsrfresult = Honeybee_ReadEPSurfaceResult(resultFileAddress=exporttoopenstudio.resultFileAddress)  # -> surfaceIndoorTemp, surfaceOutdoorTemp, port, port_2, port_3, port_4, port_5, port_6, port_7, port_8; plug-in component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
energybalance = Honeybee_ConstructEnergyBalance(
    HBZones=flatten(createhbzones.HBZone),
    cooling=readepresult.cooling,
    heating=readepresult.heating,
    electricLight=readepresult.electricLight,
    electricEquip=readepresult.electricEquip,
    fanElectric=readepresult.fanElectric,
    peopleGains=readepresult.peopleGains,
    totalSolarGain=readepresult.totalSolarGain,
    infiltrationEnergy=readepresult.infiltrationEnergy,
    mechVentilationEnergy=readepresult.mechVentilationEnergy,
    natVentEnergy=readepresult.natVentEnergy,
    surfaceEnergyFlow=readepsrfresult.port)  # -> readMe, port, flrNormEnergyBal, flrNormBalWStorage, port_2, modelEnergyBalance, energyBalWithStorage; plug-in component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
gradientlibrary = Ladybug_GradientLibrary(gradIndex="19")  # -> customColors; plug-in component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
selectandaveragedata = Ladybug_AverageData(annualHourlyData=energybalance.flrNormBalWStorage, totalOrAverage=total_values)  # -> readMe, selHourlyData, totaledDaily, totaledMonthly, totMonthlyPerHour, totAnalysisPeriod; plug-in component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
legendpar_7 = Ladybug_LegendParameters(lowBound="20.6", highBound="20.6", customColors=flatten(gradientlibrary))  # -> legendPar; plug-in component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
barchart_5 = Ladybug_MonthlyBarChart(
    inputData=flatten(selectandaveragedata.totaledMonthly),
    stackValues=stack_values_chart,
    altTitle="Test_Room",
    altYAxisTitle="Energy (kWh)",
    basePoint=pt_17,
    legendPar=legendpar_7)  # -> readMe, dataMesh, dataCurves, dataCrvColors, graphAxes, graphLabels, title, titleBasePt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; plug-in component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
panel_17 = Panel(barchart_5.legend)
preview_3 = CustomPreview(Geometry=barchart_5.graphAxes, Shader=ColourSwatch(SwatchColor=RGB(0, 0, 0)))

sunpath = Ladybug_SunPath(location=importepw.location, hour=12, day=21, month=12, timeStep=1, sunPathScale=".2", dailyOrAnnualSunPath=True)  # -> readMe, sunVectors, sunAltitudes, sunAzimuths, port, sunSpheresMesh, sunPathCrvs, compassCrvs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; plug-in component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
genclimatebasedsky_2 = Honeybee_GenerateClimateBasedSky(weatherFile=epw_stat.epwFile, month="3", day="21", hour="9")  # -> radiationValues, skyFilePath; plug-in component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
genavgsky = Honeybee_GenerateAverageSky(weatherFile=epw_stat.epwFile, month="3", hour="9")  # -> radiationValues, skyFilePath; plug-in component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
panel_18 = Panel([genavgsky.radiationValues, genclimatebasedsky_2.radiationValues])
radparameters_2 = Honeybee_RADParameters(quality=0, ab="4")  # -> readMe, radParameters; plug-in component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
imagebasedsimulation = Honeybee_ImageBasedSimulation(
    skyFile=genavgsky.skyFilePath,
    cameraType="1",
    simulationType=2,
    radParameters=radparameters_2.radParameters,
    backupImages=0)  # -> analysisRecipe; plug-in component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
panel_19 = Panel("Glare Analysis")

rundaylightanalysis_3 = Honeybee_RunDaylightSimulation(
    HBObjects=flatten([brep, hb_epcontextsrf_3]),
    analysisRecipe=imagebasedsimulation,
    writeRad=daylight_analysis,
    runRad=daylight_analysis,
    overwriteResults=True)  # -> readMe, analysisType, resultsUnit, results, testPts, resultFiles, radGeoFile, studyFolder, done; plug-in component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

falsecolor = Honeybee_FalseColor(
    HDRFilePath=rundaylightanalysis_3.resultFiles,
    contourBands=False,
    maskThreshold=0.1,
    useAlterColors=False,
    render=Toggle(False))  # -> outputFilePath; plug-in component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
glareanalysis = Honeybee_GlareAnalysis(HDRImagePath=rundaylightanalysis_3.resultFiles, runIt=glare_analysis)  # -> readMe, glareCheckImage, DGP, DGI, glareComfortRange, imageWithTaskArea; plug-in component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
panel_20 = Panel(glareanalysis.DGP)
hdr_tif = Honeybee_ConvertHDRToTIF(HDRFilePath=glareanalysis.glareCheckImage, adjustExposure=exposure)  # -> TIFFFilePath; plug-in component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
hdr_tif_2 = Honeybee_ConvertHDRToTIF(HDRFilePath=falsecolor, adjustExposure=False)  # -> TIFFFilePath; plug-in component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
viewer = Ladybug_ImageViewer(ImagePath=hdr_tif, ViewportScale=1, DisableClickable=False, SaveImgWithCoords=False, scale=1)  # -> ImagePath, ColorValues, AnimatedGIFImage
viewer_2 = Ladybug_ImageViewer(ViewportScale=hdr_tif_2, DisableClickable=False, SaveImgWithCoords=False, scale=1)  # -> ImagePath, ColorValues, AnimatedGIFImage
panel_21 = Panel(viewer.ImagePath)
