# Grasshopper definition li_yunqian_final.gh (Grasshopper 0.9.76)
# plug-ins: Python Interpreter

ladybug = Ladybug_Ladybug()  # -> Vviiiiiiiiiizzz; plug-in component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

# ----
# 9 grid-based daylight analysis
brep = Brep([<brep referenced from the Rhino model> x8])  # disabled
createhbsrfs = Honeybee_createHBSrfs(geometry=brep)  # -> out, simplify(HBSurface); disabled; plug-in component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
number_slider = Slider(0.5, range=0.2..0.9)  # disabled
panel = Panel("30")  # disabled
panel_2 = Panel("20")  # disabled
panel_3 = Panel("12")  # disabled
box = DomainBox(Base=PlaneXY(0, 0, 0), X=panel, Y=panel_2, Z=panel_3)  # disabled
toggle = BooleanToggle(True)  # disabled
glzparamlist = Honeybee_GlazingParametersList(northGlzParam=0, westGlzParam=0, southGlzParam=number_slider, eastGlzParam=0)  # -> glzParamList; disabled; plug-in component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
panel_4 = Panel(glzparamlist)  # disabled
mass2zone = Honeybee_Masses2Zones(zoneMasses=flatten(box), isConditioned=True, maxRoofAngle=30, createHBZones=toggle)  # -> readMe, HBZones; disabled; plug-in component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
number_slider_2 = Slider(0, range=0..2)  # disabled
month = Panel("""3
6
12""")  # disabled
hour = Panel("""9
12
15""")  # disabled
number_slider_3 = Slider(0, range=0..2)  # disabled
toggle_2 = BooleanToggle(True)  # disabled
panel_5 = Panel("21")  # disabled
glazingcreator = Honeybee_GlazingBasedOnRatio(HBObjects=mass2zone.HBZones, glzRatio=glzparamlist, runIt=toggle_2)  # -> readMe, HBObjWGLZ; disabled; plug-in component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
item = ListItem(List=month, Index=number_slider_3, Wrap=True)  # disabled
item_2 = ListItem(List=hour, Index=number_slider_2, Wrap=True)  # disabled
path = FilePath("C:\Users\Yunqian\Desktop\Course Fall2017\Building Performance Sim\Philadelphia_weather_files\USA_PA_Philadelphia.Intl.AP.724080_TMY3.epw")  # disabled
wires = BrepWireframe(Brep=glazingcreator.HBObjWGLZ, Density=-1)  # disabled
panel_6 = Panel("0.762")  # disabled
panel_7 = Panel("0.5")  # disabled
genclimatebasedsky = Honeybee_GenerateClimateBasedSky(weatherFile=path, month=item, day=panel_5, hour=item_2)  # -> radiationValues, skyFilePath; disabled; plug-in component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
genhbzonetestpts = Honeybee_GenerateZoneTestPoints(HBZone=glazingcreator.HBObjWGLZ, gridSize=panel_7, distBaseSrf=panel_6, moveTestMesh=True)  # -> readMe, simplify(testPoints), simplify(ptsVectors), simplify(facesArea), simplify(mesh); disabled; plug-in component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
panel_8 = Panel(genclimatebasedsky.skyFilePath)  # disabled
gridbasedsimulation = Honeybee_GridBasedSimulation(
    skyFile=genclimatebasedsky.skyFilePath,
    testPoints=genhbzonetestpts.testPoints,
    ptsVectors=genhbzonetestpts.ptsVectors,
    simulationType=0)  # -> analysisRecipe; disabled; plug-in component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
toggle_3 = BooleanToggle(True)  # disabled
toggle_4 = BooleanToggle(False)  # disabled
panel_9 = Panel("0")  # disabled
panel_10 = Panel("2000")  # disabled
rundaylightanalysis = Honeybee_RunDaylightSimulation(
    HBObjects=flatten([glazingcreator.HBObjWGLZ, createhbsrfs.HBSurface]),
    analysisRecipe=gridbasedsimulation,
    writeRad=toggle_3,
    runRad=toggle_3,
    overwriteResults=True)  # -> readMe, analysisType, resultsUnit, illuminance_values, testPts, illuminance_files, radGeoFile, studyFolder, done; disabled; plug-in component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
fly = Ladybug_fly(inputSliders=[number_slider_3, number_slider_2], fly=toggle_4)  # -> Vviiiiiiiiiizzz; disabled; plug-in component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
legendpar = Ladybug_LegendParameters(lowBound=panel_9, highBound=panel_10)  # -> legendPar; disabled; plug-in component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
doy_hoy = Ladybug_DOY_HOY(days=panel_5, months=item, hours=item_2)  # -> HOY, DOY, date; disabled; plug-in component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
panel_11 = Panel(doy_hoy.date)  # disabled
panel_12 = Panel("WWR:")  # disabled
panel_13 = Panel("Illuminance study")  # disabled
panel_14 = Panel(" Date: ")  # disabled
panel_15 = Panel("")  # disabled
concat = Concatenate(
    FragmentA=panel_13,
    FragmentC=panel_15,
    FragmentB=panel_12,
    FragmentD=number_slider,
    FragmentE=panel_14,
    FragmentF=panel_11)  # disabled
panel_16 = Panel("lux")  # disabled
recolormesh = Ladybug_RecolorMesh(
    analysisResult=rundaylightanalysis.illuminance_values,
    inputMesh=genhbzonetestpts.mesh,
    legendPar=legendpar,
    analysisTitle=concat,
    legendTitle=panel_16)  # -> readMe, newMesh, newLegend, legendBasePt, meshColors, legendColors; disabled; plug-in component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
panel_17 = Panel(rundaylightanalysis.illuminance_values)  # disabled
panel_18 = Panel("100")  # disabled
panel_19 = Panel("2000")  # disabled
smaller = SmallerThan(FirstNumber=panel_17, SecondNumber=panel_18)  # -> SmallerThan, OrEqualTo; disabled
mesh = Mesh(recolormesh.newMesh)  # disabled
larger = LargerThan(FirstNumber=rundaylightanalysis.illuminance_values, SecondNumber=panel_19)  # -> LargerThan, OrEqualTo; disabled
or = GateOr(A=smaller.SmallerThan, B=larger.LargerThan)  # disabled
cullf = CullFaces(Mesh=mesh, Pattern=or)  # disabled
area = Area(Geometry=cullf)  # -> Area, Centroid; disabled
area_2 = Area(Geometry=mesh)  # -> Area, Centroid; disabled
panel_20 = Panel("100")  # disabled
division = Division(A=area.Area, B=area_2.Area)  # disabled
panel_21 = Panel("_hoy_")  # disabled
panel_22 = Panel("ill_wwr_")  # disabled
multiplication = Multiplication(A=division, B=panel_20)  # disabled
panel_23 = Panel("c:\ladybug\illuminance_study02")  # disabled
concat_2 = Concatenate(FragmentA=panel_22, FragmentB=number_slider, FragmentC=panel_21, FragmentD=doy_hoy.HOY)  # disabled
panel_24 = Panel("% met the criteria")  # disabled
round = Round(Number=multiplication)  # -> Nearest, Floor, Ceiling; disabled
number_slider_4 = Slider(0.8, range=0..1)  # disabled
captureview = Ladybug_CaptureView(fileName=concat_2, folder=panel_23, capture=rundaylightanalysis.done)  # -> imagePath; disabled; plug-in component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
panel_25 = Panel(concat_2)  # disabled
pt = Point(Point(0, -6, 0))  # disabled
concat_3 = Concatenate(FragmentA=round.Nearest, FragmentB=panel_24)  # disabled
tag = TextTag3D(Location=pt, Text=concat_3, Size=number_slider_4, Justification=7)  # disabled

path_2 = FilePath("C:\Users\Yunqian\Desktop\Course Fall2017\Building Performance Sim\Philadelphia_weather_files\USA_PA_Philadelphia.Intl.AP.724080_TMY3.epw")  # disabled
# Windrose
panel_26 = Panel("10")  # disabled
importepw = Ladybug_ImportEpw(epwFile=path_2)  # -> readMe, latitude, location, dryBulbTemperature, dewPointTemperature, relativeHumidity, windSpeed, windDirection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; disabled; plug-in component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
panel_27 = Panel("3")  # disabled
analysisperiod = Ladybug_AnalysisPeriod(fromMonth=panel_26, toMonth=panel_27)  # -> readMe, analysisPeriod; disabled; plug-in component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
panel_28 = Panel("18 < b < 26 and c < 80 and a > 2")  # disabled
toggle_5 = BooleanToggle(True)  # disabled
windrose = Ladybug_WindRose(
    north=0,
    hourlyWindDirection=importepw.windDirection,
    hourlyWindSpeed=importepw.windSpeed,
    analysisPeriod=analysisperiod.analysisPeriod,
    runIt=toggle_5)  # -> readMe, calmRoseMesh, windRoseMesh, windRoseCrvs, windRoseCenPts, legend, legendBasePts, title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; disabled; plug-in component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
colour_swatch = ColourSwatch(SwatchColor=RGBA(0, 0, 0, 225))  # disabled
custom_preview = CustomPreview(Geometry=[windrose.windRoseCrvs, windrose.windRoseMesh, windrose.legend, windrose.windRoseCenPts], Shader=colour_swatch)  # disabled

path_3 = FilePath("C:\Users\Yunqian\Desktop\Course Fall2017\Building Performance Sim\Philadelphia_weather_files\USA_PA_Philadelphia.Intl.AP.724080_TMY3.epw")  # disabled
# Psychrometric
importepw_2 = Ladybug_ImportEpw(epwFile=path_3)  # -> Output, latitude, location, dryBulbTemperature, dewPointTemperature, relativeHumidity, windSpeed, windDirection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; disabled; plug-in component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
panel_29 = Panel("0.015")  # disabled
boolean_toggle = BooleanToggle(True)  # disabled
pmvcomfortpar = Ladybug_PMVComfortParameters(humidRatioUpBound=panel_29)  # -> comfortPar; disabled; plug-in component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
panel_30 = Panel("18 < a < 26 and b < 80")  # disabled
panel_31 = Panel("""0.6
1""")  # disabled
boolean_toggle_2 = BooleanToggle(True)  # disabled
psychchart = Ladybug_PsychrometricChart(
    dryBulbTemperature=importepw_2.dryBulbTemperature,
    relativeHumidity=importepw_2.relativeHumidity,
    barometricPressure=importepw_2.barometricPressure,
    clothingLevel=panel_31,
    mergeComfPolygons=boolean_toggle_2,
    comfortPar=pmvcomfortpar,
    runIt=boolean_toggle)  # -> out, port, totalComfortPercent, totalComfortOrNot, strategyNames, strategyPercentOfTime, strategyOrNot, port_2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; disabled; plug-in component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
colour_swatch_2 = ColourSwatch(SwatchColor=RGBA(0, 0, 0, 225))  # disabled
custom_preview_2 = CustomPreview(Geometry=[psychchart.legend, psychchart.chartCurvesAndTxt], Shader=colour_swatch_2)  # disabled

path_4 = FilePath("C:\Users\Yunqian\Desktop\Course Fall2017\Building Performance Sim\Philadelphia_weather_files\USA_PA_Philadelphia.Intl.AP.724080_TMY3.epw")  # disabled
importepw_3 = Ladybug_ImportEpw(epwFile=path_4)  # -> readMe, latitude, location, dryBulbTemperature, dewPointTemperature, relativeHumidity, windSpeed, windDirection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; disabled; plug-in component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
# Sunpath
analysisperiod_2 = Ladybug_AnalysisPeriod()  # -> out, analysisPeriod; disabled; plug-in component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
sunpath = Ladybug_SunPath(
    location=importepw_3.location,
    hour=12,
    day=21,
    month=12,
    timeStep=1,
    analysisPeriod=analysisperiod_2.analysisPeriod,
    annualHourlyData=flatten([importepw_3.globalHorizontalRadiation, importepw_3.dryBulbTemperature]),
    dailyOrAnnualSunPath=True)  # -> out, sunVectors, sunAltitudes, sunAzimuths, port, sunSpheresMesh, sunPathCrvs, compassCrvs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; disabled; plug-in component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
colour_swatch_3 = ColourSwatch(SwatchColor=RGBA(0, 0, 0, 225))  # disabled
custom_preview_3 = CustomPreview(Geometry=[sunpath.legend, sunpath.sunPathCrvs, sunpath.sunSpheresMesh, sunpath.compassCrvs], Shader=colour_swatch_3)  # disabled

panel_32 = Panel(ladybug)

# ---- group: floor
brep_2 = Brep(<brep referenced from the Rhino model>)  # disabled

# ---- group: ceiling
brep_3 = Brep(<brep referenced from the Rhino model>)  # disabled

# ---- group: glass
brep_4 = Brep(<brep referenced from the Rhino model>)  # disabled

# ---- group: wall
brep_5 = Brep([<brep referenced from the Rhino model> x3])  # disabled

# ----
# UDLI
panel_33 = Panel("glass_60")  # disabled
panel_34 = Panel("0.6")  # disabled
radglassmaterial = Honeybee_RadianceGlassMaterial(materialName=panel_33, RTransmittance=panel_34, GTransmittance=panel_34, BTransmittance=panel_34, refractiveIndex=1.52)  # -> avrgTrans, RADMaterial; disabled; plug-in component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
createhbsrfs_2 = Honeybee_createHBSrfs(geometry=[brep_5, brep_3, brep_2])  # -> readMe, simplify(HBSurface); disabled; plug-in component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
createhbsrfs_3 = Honeybee_createHBSrfs(geometry=brep_4, RADMaterial=radglassmaterial.RADMaterial)  # -> readMe, simplify(HBSurface); disabled; plug-in component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
flip = Flip(Surface=brep_2)  # -> Surface, Result; disabled
panel_35 = Panel("0.762")  # disabled
panel_36 = Panel("0.5")  # disabled
wires_2 = BrepWireframe(Brep=[createhbsrfs_3.HBSurface, createhbsrfs_2.HBSurface], Density=-1)  # disabled
gentestpts = Honeybee_GenerateTestPoints(testGeometry=flip.Surface, gridSize=panel_36, distBaseSrf=panel_35, moveTestMesh=True)  # -> out, simplify(testPoints), simplify(ptsVectors), simplify(facesArea), simplify(mesh); disabled; plug-in component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
path_5 = FilePath("C:\Users\Yunqian\Desktop\Course Fall2017\Building Performance Sim\Philadelphia_weather_files\USA_PA_Philadelphia.Intl.AP.724080_TMY3.epw")  # disabled
annualdaylightsimulation = Honeybee_AnnualDaylightSimulation(epwWeatherFile=path_5, testPoints=gentestpts.testPoints, ptsVectors=gentestpts.ptsVectors, testMesh=gentestpts.mesh)  # -> analysisRecipe; disabled; plug-in component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
toggle_6 = BooleanToggle(True)  # disabled
rundaylightanalysis_2 = Honeybee_RunDaylightSimulation(
    HBObjects=flatten([createhbsrfs_3.HBSurface, createhbsrfs_2.HBSurface]),
    analysisRecipe=annualdaylightsimulation,
    writeRad=toggle_6,
    runRad=toggle_6,
    overwriteResults=True)  # -> readMe, analysisType, resultsUnit, results, testPts, annual_analysis_files, radGeoFile, studyFolder, done; disabled; plug-in component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
toggle_7 = BooleanToggle(True)  # disabled
panel_37 = Panel(rundaylightanalysis_2.annual_analysis_files)  # disabled
toggle_8 = BooleanToggle(True)  # disabled
occupancygenerator = Honeybee_DaysimOccupancyGenerator(weekendDays=[1, 2], writeTheOcc=toggle_7)  # -> occupancyFile; disabled; plug-in component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
readannualresultsi = Honeybee_ReadAnnualResultI(
    illFilesAddress=rundaylightanalysis_2.annual_analysis_files,
    testPoints=simplify(rundaylightanalysis_2.testPts),
    occupancyFiles=occupancygenerator,
    DLAIllumThresholds=300,
    runIt=toggle_8)  # -> DLA, UDLI_Less_100, UDLI_100_2000, UDLI_More_2000, CDA, sDA, annualProfiles, htmReport; disabled; plug-in component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
panel_38 = Panel("Daylight Autonomy")  # disabled
panel_39 = Panel("%")  # disabled
panel_40 = Panel(readannualresultsi.sDA)  # disabled
recolormesh_2 = Ladybug_RecolorMesh(analysisResult=readannualresultsi.UDLI_100_2000, inputMesh=gentestpts.mesh, analysisTitle=panel_38, legendTitle=panel_39)  # -> readMe, newMesh, newLegend, legendBasePt, meshColors, legendColors; disabled; plug-in component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

honeybee = Honeybee_Honeybee()  # -> out; plug-in component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

lb_schedule = GenePool(
    Decimals=1,
    Maximum=1,
    Minimum=0,
    Value=[0, 0, 0, 0, 0, 0, 0, 0, 0, 0, 0, 0.5, 0.5, 0.5, 0.5, 0.5, 0.5, 0.5, 0.5, 1, 1, 1, 1, 1])  # disabled
file_path = FilePath("C:\Users\Yunqian\Desktop\Course Fall2017\Building Performance Sim\Philadelphia_weather_files\USA_PA_Philadelphia.Intl.AP.724080_TMY3.epw")  # disabled
lb_schedule_2 = GenePool(
    Decimals=1,
    Maximum=1,
    Minimum=0,
    Value=[0, 0, 0, 0, 0, 0, 0, 0.5, 0.8, 0.2, 0.2, 0.2, 0.2, 0.2, 0.4, 0.4, 0.4, 0.4, 0.4, 0.8, 0.8, 1, 1, 1])  # disabled
panel_41 = Panel("Apartment Occupancy")  # disabled
toggle_9 = BooleanToggle(True)  # disabled
annualschedule = Honeybee_AnnualSchedule(
    sun=lb_schedule,
    mon=lb_schedule_2,
    tue=lb_schedule_2,
    wed=lb_schedule_2,
    thu=lb_schedule_2,
    fri=lb_schedule_2,
    sat=lb_schedule,
    scheduleName=panel_41,
    runIt=toggle_9)  # -> readMe, port, schedule, port_2, weekSched, schedIDFText; disabled; plug-in component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
convertepschvalues = Honeybee_ConvertEnergyPlusScheduleToValues(schName=annualschedule.schedule, epwFileForHol=file_path)  # -> values, holidays; disabled; plug-in component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
panel_42 = Panel("0")  # disabled
panel_43 = Panel("0.25")  # disabled
_3dchart = Ladybug_3DChart(inputData=flatten(convertepschvalues.values), xScale=panel_43, zScale=panel_42)  # -> readMe, graphMesh, graphCurves, legend, legendBasePts, title, titleBasePts, dataPts, conditionalHOY; disabled; plug-in component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
national_holidays = Panel(convertepschvalues.holidays)  # disabled
energysimpar = Honeybee_EnergySimulationPar(timestep=6, solarDistribution="4", holidays=national_holidays)  # -> energySimPar; disabled; plug-in component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
swatch = ColourSwatch(SwatchColor=RGB(0, 0, 0))  # disabled
preview = CustomPreview(Geometry=_3dchart.graphCurves, Shader=swatch)  # disabled

# ----
# Wall
callfromepconstrlibrary = Honeybee_CallFromEPConstructionLibrary()  # -> ThermMaterials, EPMaterials, EPWindowMaterials, EPConstructions; disabled; plug-in component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
panel_44 = Panel("0")  # disabled
panel_45 = Panel("1")  # disabled

# ----
# energy simulation
# Floor
callfromepconstrlibrary_2 = Honeybee_CallFromEPConstructionLibrary()  # -> ThermMaterials, EPMaterials, EPWindowMaterials, EPConstructions; disabled; plug-in component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
panel_46 = Panel("2")  # disabled
panel_47 = Panel("1")  # disabled

# ----
# Wall
callfromepconstrlibrary_3 = Honeybee_CallFromEPConstructionLibrary()  # -> ThermMaterials, EPMaterials, EPWindowMaterials, EPConstructions; disabled; plug-in component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
panel_48 = Panel("0")  # disabled
panel_49 = Panel("1")  # disabled

# ----
# energy simulation adjusted
# Floor
callfromepconstrlibrary_4 = Honeybee_CallFromEPConstructionLibrary()  # -> ThermMaterials, EPMaterials, EPWindowMaterials, EPConstructions; disabled; plug-in component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
panel_50 = Panel("2")  # disabled
panel_51 = Panel("1")  # disabled

panel_52 = Panel("4")  # disabled
panel_53 = Panel("4")  # disabled
panel_54 = Panel("3")  # disabled
panel_55 = Panel("1")  # disabled
panel_56 = Panel("low e Glass")  # disabled
panel_57 = Panel("1.9")  # disabled
panel_58 = Panel("0.41")  # disabled
panel_59 = Panel("0.7")  # disabled
ladybug_2 = Ladybug_Ladybug()  # -> out; disabled; plug-in component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
epwindowmat = Honeybee_EnergyPlusWindowMaterial(name=panel_56, U_Value=panel_57, SHGC=panel_58, VT=panel_59)  # -> EPMaterial; disabled; plug-in component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
ceiling = Brep(<brep referenced from the Rhino model>)  # disabled
wall_with_glass = Brep(<brep referenced from the Rhino model>)  # disabled
wall = Brep([<brep referenced from the Rhino model> x3])  # disabled
floor = Brep(<brep referenced from the Rhino model>)  # disabled
panel_60 = Panel("0")  # disabled
panel_61 = Panel("0")  # disabled
panel_62 = Panel("2")  # disabled
panel_63 = Panel("3")  # disabled
honeybee_2 = Honeybee_Honeybee()  # -> out; disabled; plug-in component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
panel_64 = Panel("low e glass")  # disabled
createhbsrfs_4 = Honeybee_createHBSrfs(geometry=ceiling, srfType=panel_63)  # -> out, simplify(HBSurface); disabled; plug-in component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
epconstruction = Honeybee_EnergyPlusConstruction(name=panel_64, layer_1=epwindowmat)  # -> EPConstruction; disabled; plug-in component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
boolean_toggle_3 = BooleanToggle(False)  # disabled
panel_65 = Panel("0.8")  # disabled
panel_66 = Panel("10")  # disabled
boolean_toggle_4 = BooleanToggle(True)  # disabled
boolean_toggle_5 = BooleanToggle(False)  # disabled
panel_67 = Panel("Dream Room")  # disabled
panel_68 = Panel("0.5")  # disabled
panel_69 = Panel("18")  # disabled
panel_70 = Panel("40")  # disabled
panel_71 = Panel("38")  # disabled
panel_72 = Panel("1")  # disabled
panel_73 = Panel("20")  # disabled
number_slider_5 = Slider(0.5, range=0..1)  # disabled
panel_74 = Panel("0.5")  # disabled
radparameters = Honeybee_RADParameters(quality=0)  # -> out, radParameters; disabled; plug-in component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
panel_75 = Panel("100")  # disabled
brep_6 = Brep([<brep referenced from the Rhino model> x8])  # disabled
hb_epcontextsrf = HoneybeeEPContextSurfaces(shdSurfaces=flatten(brep_6))  # -> HBContext; inputs shdSurfaces: list of Brep, justBoundingBox: Boolean; disabled
# ---------- hb_epcontextsrf: Python ----------
"""
prepare shading/context geometries

    Args:
        northVectorOrRotation: A vector that shows North or a number that shows
                               the rotation of the North from the Y axis
        bldgMasses: List of closed Breps as thermal zones.
    Returns:
        report: ...
        thermalZones: Thermal zone's geometries for visualiza
"""

ghenv.Component.Name = 'Honeybee EP context Surfaces'
ghenv.Component.NickName = 'HB_EPContextSrf'
ghenv.Component.Message = 'VER 0.0.62\nJUL_28_2017'
ghenv.Component.IconDisplayMode = ghenv.Component.IconDisplayMode.application
ghenv.Component.Category = "Honeybee"
ghenv.Component.SubCategory = "10 | Energy | Energy"
#compatibleHBVersion = VER 0.0.57\nNOV_04_2016
#compatibleLBVersion = VER 0.0.59\nFEB_01_2015
ghenv.Component.AdditionalHelpFromDocStrings = "2"

import rhinoscriptsyntax as rs
import Rhino as rc
import scriptcontext as sc
import os
import System
import Grasshopper.Kernel as gh
import uuid

tolerance = sc.doc.ModelAbsoluteTolerance
import math


def main(shdSurfaces, EPTransSchedule, meshingSettings, justBoundingBox):
    
    # import the classes
    if sc.sticky.has_key('honeybee_release'):

        try:
            if not sc.sticky['honeybee_release'].isCompatible(ghenv.Component): return -1
            if sc.sticky['honeybee_release'].isInputMissing(ghenv.Component): return -1
        except:
            warning = "You need a newer version of Honeybee to use this compoent." + \
            " Use updateHoneybee component to update userObjects.\n" + \
            "If you have already updated userObjects drag Honeybee_Honeybee component " + \
            "into canvas and try again."
            w = gh.GH_RuntimeMessageLevel.Warning
            ghenv.Component.AddRuntimeMessage(w, warning)
            return -1
        
        # don't customize this part
        hb_EPSrf = sc.sticky["honeybee_EPSurface"]
        hb_EPSHDSurface = sc.sticky["honeybee_EPShdSurface"]
        hb_RADMaterialAUX = sc.sticky["honeybee_RADMaterialAUX"]
        hb_EPObjectsAux = sc.sticky["honeybee_EPObjectsAUX"]()
        HBScheduleList = sc.sticky["honeybee_ScheduleLib"].keys()

        ########################################################################
        #----------------------------------------------------------------------#
        shdBreps = []
        # create bounding box of shading geometries
        if justBoundingBox:
            for brep in shdSurfaces:
                if brep.Faces.Count>1 or not brep.Faces[0].IsPlanar(sc.doc.ModelAbsoluteTolerance):
                    shdBreps.append(brep.GetBoundingBox(True).ToBrep())
                else:
                    shdBreps.append(brep)
        else:
            shdBreps = shdSurfaces
        
        shadingClasses = []
        shadingMeshPreview = []
        
        if meshingSettings == None:
            mp = rc.Geometry.MeshingParameters.Minimal
            mp.SimplePlanes = True
        else:
            mp = meshingSettings
        
        def getRadMaterialName(radMaterial):
            nameStr = radMaterial.split(" ")[2]
            name =  nameStr.split("\n")[0]
            return name
        
        for brepCount, brep in enumerate(shdBreps):
            if brep != None:
                isPlanar = True
                # check planarity
                for face in brep.Faces:
                    if not face.IsPlanar(tolerance):
                        isPlanar = False
                        break
                
                shadingBreps = []
                if not isPlanar:
                    meshArray = rc.Geometry.Mesh.CreateFromBrep(brep, mp)
                    for mesh in meshArray:
                        for meshFace in range(mesh.Faces.Count):
                            vertices = list(mesh.Faces.GetFaceVertices(meshFace))[1:]
                            vertices = vertices + [sc.doc.ModelAbsoluteTolerance]
                            # create the brep from mesh
                            shdBrep = rc.Geometry.Brep.CreateFromCornerPoints(*vertices)
                            shadingBreps.append(shdBrep)
                else:
                    for face in brep.Faces:
                        shadingBreps.append(face.DuplicateFace(False))
                
                for faceCount, shdBrep in enumerate(shadingBreps):
                        thisShading = hb_EPSHDSurface(shdBrep, 1000*brepCount + faceCount, 'shdSrf_' + `brepCount` + '_' + `faceCount` + "_" + str(uuid.uuid4()))
                        
                        # add transmittance schedule if any
                        if EPTransSchedule!=None:
                            schedule= EPTransSchedule.upper()
                            if schedule!=None and not schedule.lower().endswith(".csv") and schedule not in HBScheduleList:
                                msg = "Cannot find " + schedule + " in Honeybee schedule library."
                                print msg
                                ghenv.Component.AddRuntimeMessage(gh.GH_RuntimeMessageLevel.Warning, msg)
                                return -1
                            elif schedule!=None and schedule.lower().endswith(".csv"):
                                # check if csv file is existed
                                if not os.path.isfile(schedule):
                                    msg = "Cannot find the shchedule file: " + schedule
                                    print msg
                                    ghenv.Component.AddRuntimeMessage(gh.GH_RuntimeMessageLevel.Warning, msg)
                                    return -1
                            
                            thisShading.TransmittanceSCH = schedule
                        
                        # add the Rad Material if any
                        if RADMaterial!=None:
                            # if it is just the name of the material make sure it is already defined
                            if len(RADMaterial.split(" ")) == 1:
                                # if the material is not in the library add it to the library
                                if not hb_RADMaterialAUX.isMatrialExistInLibrary(RADMaterial):
                                    warningMsg = "Can't find " + RADMaterial + " in RAD Material Library.\n" + \
                                                "Add the material to the library and try again."
                                    ghenv.Component.AddRuntimeMessage(gh.GH_RuntimeMessageLevel.Warning, warningMsg)
                                    return
                                
                                try:
                                    thisShading.setRADMaterial(RADMaterial)
                                except Exception, e:
                                    print e
                                    warningMsg = "You are using an old version of Honeybee_Honeybee! Update your files and try again."
                                    print warningMsg
                                    ghenv.Component.AddRuntimeMessage(gh.GH_RuntimeMessageLevel.Warning, warningMsg)
                                    return
                                
                                addedToLib = True
                            else:
                                
                                # try to add the material to the library
                                addedToLib, thisShading.RadMaterial = hb_RADMaterialAUX.analyseRadMaterials(RADMaterial, True)
                                
                            if addedToLib==False:
                                warningMsg = "Failed to add " + RADMaterial + " to the Library."
                                ghenv.Component.AddRuntimeMessage(gh.GH_RuntimeMessageLevel.Warning, warningMsg)
                                return
                        
                        # add shading to the list
                        shadingClasses.append(thisShading)
                
        # add to the hive
        hb_hive = sc.sticky["honeybee_Hive"]()
        HBContext  = hb_hive.addToHoneybeeHive(shadingClasses, ghenv.Component)
        return HBContext
        ################################################################################################
    else:
        print "You should first let Honeybee to fly..."
        w = gh.GH_RuntimeMessageLevel.Warning
        ghenv.Component.AddRuntimeMessage(w, "You should first let Honeybee to fly...")
        return -1
        

if _shdSurfaces and _shdSurfaces[0]!=None:
    # add cleaning function
    result= main(_shdSurfaces, EPTransSchedule_, meshingSettings_, justBoundingBox_)
    
    if result != -1: HBContext = result
# ---------- end hb_epcontextsrf ----------
boolean_toggle_6 = BooleanToggle(True)  # disabled
panel_76 = Panel("4")  # disabled
boolean_toggle_7 = BooleanToggle(True)  # disabled
toggle_10 = BooleanToggle(True)  # disabled
brep_7 = Brep([<brep referenced from the Rhino model> x8])  # disabled
epoutput = Honeybee_GenerateEPOutput(
    zoneEnergyUse=toggle_10,
    zoneGainsAndLosses=toggle_10,
    zoneComfortMetrics=toggle_10,
    comfortMapVariables=toggle_10,
    zoneHVACParams=toggle_10,
    surfaceTempAnalysis=toggle_10,
    surfaceEnergyAnalysis=toggle_10,
    glazingSolarAnalysis=toggle_10)  # -> report, flatten(simulationOutputs); disabled; plug-in component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
hb_epcontextsrf_2 = HoneybeeEPContextSurfaces(shdSurfaces=flatten(brep_7))  # -> HBContext; inputs shdSurfaces: list of Brep, justBoundingBox: Boolean; disabled; same code as hb_epcontextsrf
panel_77 = Panel("%")  # disabled
toggle_11 = BooleanToggle(True)  # disabled
path_6 = FilePath("C:\ladybug\USA_PA_Philadelphia.Intl.AP.724080_TMY3.epw")  # disabled
point = Point(<point referenced from the Rhino model>)  # disabled
panel_78 = Panel("0.3")  # disabled
importepw_4 = Ladybug_ImportEpw(epwFile=path_6)  # -> readMe, latitude, location, dryBulbTemperature, dewPointTemperature, relativeHumidity, windSpeed, windDirection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; disabled; plug-in component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
toggle_12 = BooleanToggle(True)  # disabled
boolean_toggle_8 = BooleanToggle(True)  # disabled
panel_79 = Panel("0")  # disabled
point_2 = Point(<point referenced from the Rhino model>)  # disabled
boolean_toggle_9 = BooleanToggle(True)  # disabled
point_3 = Point(<point referenced from the Rhino model>)  # disabled

searchepconstruction = Honeybee_SearchEPConstruction(EPConstrList=callfromepconstrlibrary.EPConstructions, standard=panel_45, climateZone=panel_52, surfaceType=panel_44)  # -> EPSelectedConstr; disabled; plug-in component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

searchepconstruction_2 = Honeybee_SearchEPConstruction(EPConstrList=callfromepconstrlibrary_2.EPConstructions, standard=panel_47, climateZone=panel_53, surfaceType=panel_46)  # -> EPSelectedConstr; disabled; plug-in component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

list_item = ListItem(List=searchepconstruction, Index=panel_54, Wrap=True)  # disabled
list_item_2 = ListItem(List=searchepconstruction_2, Index=panel_55, Wrap=True)  # disabled
createhbsrfs_5 = Honeybee_createHBSrfs(geometry=wall, srfType=panel_61, EPConstruction=list_item)  # -> out, simplify(HBSurface); disabled; plug-in component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
createhbsrfs_6 = Honeybee_createHBSrfs(geometry=floor, srfType=panel_62, EPConstruction=list_item_2)  # -> out, simplify(HBSurface); disabled; plug-in component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
createhbsrfs_7 = Honeybee_createHBSrfs(geometry=wall_with_glass, srfType=panel_60, EPConstruction=list_item)  # -> out, simplify(HBSurface); disabled; plug-in component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
glazingcreator_2 = Honeybee_GlazingBasedOnRatio(
    HBObjects=createhbsrfs_7.HBSurface,
    glzRatio=panel_65,
    breakUpWindow=boolean_toggle_3,
    windowHeight=panel_66,
    EPConstructions=epconstruction,
    runIt=boolean_toggle_4)  # -> out, HBObjWGLZ; disabled; plug-in component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
makeadiabatic = Honeybee_MakeAdiabatic(HBSrfs=[createhbsrfs_5.HBSurface, createhbsrfs_6.HBSurface, createhbsrfs_4.HBSurface])  # -> HBSrfs; disabled; plug-in component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
createhbzones = Honeybee_createHBZones(name=panel_67, HBSurfaces=flatten([makeadiabatic, glazingcreator_2.HBObjWGLZ]), isConditioned=boolean_toggle_5)  # -> out, HBZone; disabled; plug-in component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
setepnatvent = Honeybee_SetEPAirFlow(
    HBZones=flatten(createhbzones.HBZone),
    naturalVentilationType=panel_72,
    minIndoorTempForNatVent=panel_73,
    maxIndoorTempForNatVent=panel_70,
    minOutdoorTempForNatVent=panel_69,
    maxOutdoorTempForNatVent=panel_71,
    fractionOfGlzAreaOperable=panel_68)  # -> readMe, simplify(HBZones); disabled; plug-in component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
genhbzonetestpts_2 = Honeybee_GenerateZoneTestPoints(HBZone=setepnatvent.HBZones, gridSize=panel_74, distBaseSrf=number_slider_5, moveTestMesh=True)  # -> out, simplify(testPoints), simplify(ptsVectors), simplify(facesArea), simplify(mesh); disabled; plug-in component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
annualdaylightsimulation_2 = Honeybee_AnnualDaylightSimulation(
    epwWeatherFile=path_6,
    testPoints=genhbzonetestpts_2.testPoints,
    ptsVectors=genhbzonetestpts_2.ptsVectors,
    radParameters=radparameters.radParameters)  # -> analysisRecipe; disabled; plug-in component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
list_item_3 = ListItem(List=genhbzonetestpts_2.testPoints, Index=panel_75, Wrap=True)  # disabled
lightingcontrol = Honeybee_LightingControlRecipe(
    controlType=panel_76,
    sensorPoints=list_item_3,
    lightingPower=250,
    lightingSetpoint=300,
    ballastLossFactor=20,
    standbyPower=3,
    delayTime=5)  # -> lightingControlGroup; disabled; plug-in component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
rundaylightanalysis_3 = Honeybee_RunDaylightSimulation(
    HBObjects=flatten([hb_epcontextsrf, setepnatvent.HBZones]),
    analysisRecipe=annualdaylightsimulation_2,
    writeRad=boolean_toggle_6,
    runRad=boolean_toggle_6,
    overwriteResults=True)  # -> out, analysisType, resultsUnit, results, testPts, annual_analysis_files, radGeoFile, studyFolder, done; disabled; plug-in component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
gethbzoneepschedules = Honeybee_GetZoneEnergyPlusSchedules(HBZone=setepnatvent.HBZones)  # -> occupancySchedule, occupancyActivitySch, heatingSetPtSchedule, coolingSetPtSchedule, lightingSchedule, equipmentSchedule, infiltrationSchedule; disabled; plug-in component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
readannualresultsi_2 = Honeybee_ReadAnnualResultI(
    illFilesAddress=rundaylightanalysis_3.annual_analysis_files,
    testPoints=simplify(rundaylightanalysis_3.testPts),
    occupancyFiles=gethbzoneepschedules.lightingSchedule,
    DLAIllumThresholds=300,
    lightingControlGroups=lightingcontrol,
    runIt=boolean_toggle_7)  # -> DLA, UDLI_Less_100, UDLI_100_2000, UDLI_More_2000, CDA, sDA, annualProfiles, htmReport; disabled; plug-in component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
setepzoneschedules = Honeybee_SetEnergyPlusZoneSchedules(HBZones=setepnatvent.HBZones, lightingSchedules=readannualresultsi_2.annualProfiles)  # -> schedules, simplify(HBZones); disabled; plug-in component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
dsannualprofiles = Honeybee_DaysimAnnualProfiles(annualProfiles=readannualresultsi_2.annualProfiles)  # -> simplify(occupancyProfile), simplify(shadingProfiles), simplify(lightingControlProfiles), simplify(dgpProfile); disabled; plug-in component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
convertepschvalues_2 = Honeybee_ConvertEnergyPlusScheduleToValues(schName=gethbzoneepschedules.lightingSchedule)  # -> values, holidays; disabled; plug-in component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
recolormesh_3 = Ladybug_RecolorMesh(analysisResult=readannualresultsi_2.UDLI_100_2000, inputMesh=genhbzonetestpts_2.mesh, legendTitle=panel_77)  # -> out, newMesh, newLegend, legendBasePt, meshColors, legendColors; disabled; plug-in component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
runenergysimulation = Honeybee_RunEnergySimulation(
    epwFile=path_6,
    HBZones=flatten(setepzoneschedules.HBZones),
    HBContext=flatten(hb_epcontextsrf_2),
    simulationOutputs=flatten(epoutput.simulationOutputs),
    writeIdf=toggle_11,
    runEnergyPlus=toggle_11)  # -> report, idfFileAddress, htmlReport, resultFileAddress; disabled; plug-in component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
_3dchart_2 = Ladybug_3DChart(
    inputData=flatten([dsannualprofiles.lightingControlProfiles, convertepschvalues_2.values]),
    basePoint=point,
    xScale=panel_78)  # -> out, graphMesh, graphCurves, legend, legendBasePts, title, titleBasePts, dataPts, conditionalHOY; disabled; plug-in component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
readepresult = Honeybee_ReadEPResult(resultFileAddress=runenergysimulation.resultFileAddress)  # -> port, port_2, port_3, port_4, electricLight, electricEquip, fanElectric, port_5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; disabled; plug-in component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
adaptivecomfortcalculator = Ladybug_AdaptiveComfortCalculator(
    dryBulbTemperature=readepresult.airTemperature,
    meanRadiantTemperature=readepresult.meanRadTemperature,
    prevailingOutdoorTemp=importepw_4.dryBulbTemperature,
    runIt=toggle_12)  # -> readMe, port, comfortableOrNot, conditionOfPerson, degreesFromTarget, port_2, targetTemperature, upperTemperatureBound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; disabled; plug-in component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
energybalance = Honeybee_ConstructEnergyBalance(
    HBZones=flatten(setepnatvent.HBZones),
    cooling=readepresult.port_3,
    heating=readepresult.port_4,
    electricLight=readepresult.electricLight,
    electricEquip=readepresult.electricEquip,
    fanElectric=readepresult.fanElectric,
    peopleGains=readepresult.peopleGains,
    totalSolarGain=readepresult.totalSolarGain,
    infiltrationEnergy=readepresult.infiltrationEnergy,
    mechVentilationEnergy=readepresult.port_6,
    natVentEnergy=readepresult.natVentEnergy)  # -> out, port, flrNormEnergyBal, flrNormBalWStorage, port_2, modelEnergyBalance, energyBalWithStorage; disabled; plug-in component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
panel_80 = Panel([adaptivecomfortcalculator.percentOfTimeComfortable, adaptivecomfortcalculator.percentHotCold])  # disabled
selectandaveragedata = Ladybug_AverageData(annualHourlyData=energybalance.flrNormBalWStorage, totalOrAverage=boolean_toggle_8)  # -> readMe, selHourlyData, totaledDaily, totaledMonthly, totMonthlyPerHour, totAnalysisPeriod; disabled; plug-in component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
_3dchart_3 = Ladybug_3DChart(inputData=flatten(adaptivecomfortcalculator.conditionOfPerson), basePoint=point_2, xScale="0.25", zScale=panel_79)  # -> readMe, graphMesh, graphCurves, legend, legendBasePts, title, titleBasePts, dataPts, conditionalHOY; disabled; plug-in component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
# Sunpath
barchart = Ladybug_MonthlyBarChart(inputData=flatten(selectandaveragedata.totaledMonthly), stackValues=boolean_toggle_9, basePoint=point_3)  # -> out, dataMesh, dataCurves, dataCrvColors, graphAxes, graphLabels, title, titleBasePt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; disabled; plug-in component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

panel_81 = Panel("4")  # disabled
panel_82 = Panel("4")  # disabled
panel_83 = Panel("3")  # disabled
panel_84 = Panel("1")  # disabled
panel_85 = Panel("low e Glass")  # disabled
panel_86 = Panel("0.8")  # disabled
panel_87 = Panel("0.55")  # disabled
panel_88 = Panel("0.83")  # disabled
ladybug_3 = Ladybug_Ladybug()  # -> out; disabled; plug-in component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
epwindowmat_2 = Honeybee_EnergyPlusWindowMaterial(name=panel_85, U_Value=panel_86, SHGC=panel_87, VT=panel_88)  # -> EPMaterial; disabled; plug-in component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
ceiling_2 = Brep(<brep referenced from the Rhino model>)  # disabled
wall_with_glass_2 = Brep(<brep referenced from the Rhino model>)  # disabled
wall_2 = Brep([<brep referenced from the Rhino model> x3])  # disabled
floor_2 = Brep(<brep referenced from the Rhino model>)  # disabled
panel_89 = Panel("0")  # disabled
panel_90 = Panel("0")  # disabled
panel_91 = Panel("2")  # disabled
panel_92 = Panel("3")  # disabled
honeybee_3 = Honeybee_Honeybee()  # -> out; disabled; plug-in component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
panel_93 = Panel("low e glass")  # disabled
createhbsrfs_8 = Honeybee_createHBSrfs(geometry=ceiling_2, srfType=panel_92)  # -> out, simplify(HBSurface); disabled; plug-in component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
epconstruction_2 = Honeybee_EnergyPlusConstruction(name=panel_93, layer_1=epwindowmat_2)  # -> EPConstruction; disabled; plug-in component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
boolean_toggle_10 = BooleanToggle(False)  # disabled
panel_94 = Panel("0.8")  # disabled
panel_95 = Panel("10")  # disabled
boolean_toggle_11 = BooleanToggle(True)  # disabled
boolean_toggle_12 = BooleanToggle(False)  # disabled
panel_96 = Panel("Dream Room")  # disabled
panel_97 = Panel("1")  # disabled
panel_98 = Panel("-20")  # disabled
panel_99 = Panel("38")  # disabled
panel_100 = Panel("50")  # disabled
panel_101 = Panel("1")  # disabled
panel_102 = Panel("23")  # disabled
number_slider_6 = Slider(0.5, range=0..1)  # disabled
panel_103 = Panel("0.5")  # disabled
radparameters_2 = Honeybee_RADParameters(quality=0)  # -> out, radParameters; disabled; plug-in component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
panel_104 = Panel("100")  # disabled
brep_8 = Brep([<brep referenced from the Rhino model> x8])  # disabled
hb_epcontextsrf_3 = HoneybeeEPContextSurfaces(shdSurfaces=flatten(brep_8))  # -> HBContext; inputs shdSurfaces: list of Brep, justBoundingBox: Boolean; disabled; same code as hb_epcontextsrf
boolean_toggle_13 = BooleanToggle(True)  # disabled
panel_105 = Panel("4")  # disabled
boolean_toggle_14 = BooleanToggle(True)  # disabled
toggle_13 = BooleanToggle(True)  # disabled
brep_9 = Brep([<brep referenced from the Rhino model> x8])  # disabled
epoutput_2 = Honeybee_GenerateEPOutput(
    zoneEnergyUse=toggle_13,
    zoneGainsAndLosses=toggle_13,
    zoneComfortMetrics=toggle_13,
    comfortMapVariables=toggle_13,
    zoneHVACParams=toggle_13,
    surfaceTempAnalysis=toggle_13,
    surfaceEnergyAnalysis=toggle_13,
    glazingSolarAnalysis=toggle_13)  # -> report, flatten(simulationOutputs); disabled; plug-in component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
hb_epcontextsrf_4 = HoneybeeEPContextSurfaces(shdSurfaces=flatten(brep_9))  # -> HBContext; inputs shdSurfaces: list of Brep, justBoundingBox: Boolean; disabled; same code as hb_epcontextsrf
panel_106 = Panel("%")  # disabled
toggle_14 = BooleanToggle(True)  # disabled
path_7 = FilePath("C:\ladybug\USA_PA_Philadelphia.Intl.AP.724080_TMY3.epw")  # disabled
point_4 = Point(<point referenced from the Rhino model>)  # disabled
panel_107 = Panel("0.3")  # disabled
importepw_5 = Ladybug_ImportEpw(epwFile=path_7)  # -> readMe, latitude, location, dryBulbTemperature, dewPointTemperature, relativeHumidity, windSpeed, windDirection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; disabled; plug-in component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
toggle_15 = BooleanToggle(True)  # disabled
boolean_toggle_15 = BooleanToggle(True)  # disabled
panel_108 = Panel("0")  # disabled
point_5 = Point(<point referenced from the Rhino model>)  # disabled
panel_109 = Panel("19")  # disabled
gradientlibrary = Ladybug_GradientLibrary(gradIndex=panel_109)  # -> customColors; disabled; plug-in component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
legendpar_2 = Ladybug_LegendParameters(customColors=flatten(gradientlibrary))  # -> legendPar; disabled; plug-in component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
boolean_toggle_16 = BooleanToggle(True)  # disabled
panel_110 = Panel("Energy (kWh)")  # disabled
point_6 = Point(<point referenced from the Rhino model>)  # disabled
swatch_2 = ColourSwatch(SwatchColor=RGB(0, 0, 0))  # disabled

searchepconstruction_3 = Honeybee_SearchEPConstruction(EPConstrList=callfromepconstrlibrary_3.EPConstructions, standard=panel_49, climateZone=panel_81, surfaceType=panel_48)  # -> EPSelectedConstr; disabled; plug-in component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

searchepconstruction_4 = Honeybee_SearchEPConstruction(EPConstrList=callfromepconstrlibrary_4.EPConstructions, standard=panel_51, climateZone=panel_82, surfaceType=panel_50)  # -> EPSelectedConstr; disabled; plug-in component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

list_item_4 = ListItem(List=searchepconstruction_3, Index=panel_83, Wrap=True)  # disabled
list_item_5 = ListItem(List=searchepconstruction_4, Index=panel_84, Wrap=True)  # disabled
createhbsrfs_9 = Honeybee_createHBSrfs(geometry=wall_2, srfType=panel_90, EPConstruction=list_item_4)  # -> out, simplify(HBSurface); disabled; plug-in component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
createhbsrfs_10 = Honeybee_createHBSrfs(geometry=floor_2, srfType=panel_91, EPConstruction=list_item_5)  # -> out, simplify(HBSurface); disabled; plug-in component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
createhbsrfs_11 = Honeybee_createHBSrfs(geometry=wall_with_glass_2, srfType=panel_89, EPConstruction=list_item_4)  # -> out, simplify(HBSurface); disabled; plug-in component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
glazingcreator_3 = Honeybee_GlazingBasedOnRatio(
    HBObjects=createhbsrfs_11.HBSurface,
    glzRatio=panel_94,
    breakUpWindow=boolean_toggle_10,
    windowHeight=panel_95,
    EPConstructions=epconstruction_2,
    runIt=boolean_toggle_11)  # -> out, HBObjWGLZ; disabled; plug-in component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
makeadiabatic_2 = Honeybee_MakeAdiabatic(HBSrfs=[createhbsrfs_9.HBSurface, createhbsrfs_10.HBSurface, createhbsrfs_8.HBSurface])  # -> HBSrfs; disabled; plug-in component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
createhbzones_2 = Honeybee_createHBZones(name=panel_96, HBSurfaces=flatten([makeadiabatic_2, glazingcreator_3.HBObjWGLZ]), isConditioned=boolean_toggle_12)  # -> out, HBZone; disabled; plug-in component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
setepnatvent_2 = Honeybee_SetEPAirFlow(
    HBZones=flatten(createhbzones_2.HBZone),
    naturalVentilationType=panel_101,
    minIndoorTempForNatVent=panel_102,
    maxIndoorTempForNatVent=panel_100,
    minOutdoorTempForNatVent=panel_98,
    maxOutdoorTempForNatVent=panel_99,
    fractionOfGlzAreaOperable=panel_97)  # -> readMe, simplify(HBZones); disabled; plug-in component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
genhbzonetestpts_3 = Honeybee_GenerateZoneTestPoints(HBZone=setepnatvent_2.HBZones, gridSize=panel_103, distBaseSrf=number_slider_6, moveTestMesh=True)  # -> out, simplify(testPoints), simplify(ptsVectors), simplify(facesArea), simplify(mesh); disabled; plug-in component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
annualdaylightsimulation_3 = Honeybee_AnnualDaylightSimulation(
    epwWeatherFile=path_7,
    testPoints=genhbzonetestpts_3.testPoints,
    ptsVectors=genhbzonetestpts_3.ptsVectors,
    radParameters=radparameters_2.radParameters)  # -> analysisRecipe; disabled; plug-in component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
list_item_6 = ListItem(List=genhbzonetestpts_3.testPoints, Index=panel_104, Wrap=True)  # disabled
lightingcontrol_2 = Honeybee_LightingControlRecipe(
    controlType=panel_105,
    sensorPoints=list_item_6,
    lightingPower=250,
    lightingSetpoint=300,
    ballastLossFactor=20,
    standbyPower=3,
    delayTime=5)  # -> lightingControlGroup; disabled; plug-in component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
rundaylightanalysis_4 = Honeybee_RunDaylightSimulation(
    HBObjects=flatten([hb_epcontextsrf_3, setepnatvent_2.HBZones]),
    analysisRecipe=annualdaylightsimulation_3,
    writeRad=boolean_toggle_13,
    runRad=boolean_toggle_13,
    overwriteResults=True)  # -> out, analysisType, resultsUnit, results, testPts, annual_analysis_files, radGeoFile, studyFolder, done; disabled; plug-in component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
readannualresultsi_3 = Honeybee_ReadAnnualResultI(
    illFilesAddress=rundaylightanalysis_4.annual_analysis_files,
    testPoints=simplify(rundaylightanalysis_4.testPts),
    occupancyFiles=annualschedule.schedule,
    DLAIllumThresholds=300,
    lightingControlGroups=lightingcontrol_2,
    runIt=boolean_toggle_14)  # -> DLA, UDLI_Less_100, UDLI_100_2000, UDLI_More_2000, CDA, sDA, annualProfiles, htmReport; disabled; plug-in component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
setepzoneschedules_2 = Honeybee_SetEnergyPlusZoneSchedules(HBZones=setepnatvent_2.HBZones, lightingSchedules=readannualresultsi_3.annualProfiles)  # -> schedules, simplify(HBZones); disabled; plug-in component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
dsannualprofiles_2 = Honeybee_DaysimAnnualProfiles(annualProfiles=readannualresultsi_3.annualProfiles)  # -> simplify(occupancyProfile), simplify(shadingProfiles), simplify(lightingControlProfiles), simplify(dgpProfile); disabled; plug-in component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
recolormesh_4 = Ladybug_RecolorMesh(analysisResult=readannualresultsi_3.UDLI_100_2000, inputMesh=genhbzonetestpts_3.mesh, legendTitle=panel_106)  # -> out, newMesh, newLegend, legendBasePt, meshColors, legendColors; disabled; plug-in component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
runenergysimulation_2 = Honeybee_RunEnergySimulation(
    epwFile=path_7,
    energySimPar=energysimpar,
    HBZones=flatten(setepzoneschedules_2.HBZones),
    HBContext=flatten(hb_epcontextsrf_4),
    simulationOutputs=flatten(epoutput_2.simulationOutputs),
    writeIdf=toggle_14,
    runEnergyPlus=toggle_14)  # -> report, idfFileAddress, htmlReport, resultFileAddress; disabled; plug-in component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
_3dchart_4 = Ladybug_3DChart(inputData=flatten(dsannualprofiles_2.lightingControlProfiles), basePoint=point_4, xScale=panel_107)  # -> out, graphMesh, graphCurves, legend, legendBasePts, title, titleBasePts, dataPts, conditionalHOY; disabled; plug-in component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
readepsrfresult = Honeybee_ReadEPSurfaceResult(resultFileAddress=runenergysimulation_2.resultFileAddress)  # -> surfaceIndoorTemp, surfaceOutdoorTemp, surfaceEnergyFlow, opaqueEnergyFlow, glazEnergyFlow, windowTotalSolarEnergy, windowBeamEnergy, windowDiffEnergy, windowTransmissivity, port; disabled; plug-in component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
readepresult_2 = Honeybee_ReadEPResult(resultFileAddress=runenergysimulation_2.resultFileAddress)  # -> port, port_2, port_3, port_4, electricLight, electricEquip, fanElectric, port_5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; disabled; plug-in component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
adaptivecomfortcalculator_2 = Ladybug_AdaptiveComfortCalculator(
    dryBulbTemperature=readepresult_2.airTemperature,
    meanRadiantTemperature=readepresult_2.meanRadTemperature,
    prevailingOutdoorTemp=importepw_5.dryBulbTemperature,
    runIt=toggle_15)  # -> readMe, port, comfortableOrNot, conditionOfPerson, degreesFromTarget, port_2, targetTemperature, upperTemperatureBound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; disabled; plug-in component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
energybalance_2 = Honeybee_ConstructEnergyBalance(
    HBZones=flatten(setepnatvent_2.HBZones),
    cooling=readepresult_2.port_3,
    heating=readepresult_2.port_4,
    electricLight=readepresult_2.electricLight,
    electricEquip=readepresult_2.electricEquip,
    fanElectric=readepresult_2.fanElectric,
    peopleGains=readepresult_2.peopleGains,
    totalSolarGain=readepresult_2.totalSolarGain,
    infiltrationEnergy=readepresult_2.infiltrationEnergy,
    mechVentilationEnergy=readepresult_2.port_6,
    natVentEnergy=readepresult_2.natVentEnergy,
    surfaceEnergyFlow=readepsrfresult.surfaceEnergyFlow)  # -> out, port, flrNormEnergyBal, flrNormBalWStorage, port_2, modelEnergyBalance, energyBalWithStorage; disabled; plug-in component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
panel_111 = Panel([adaptivecomfortcalculator_2.percentOfTimeComfortable, adaptivecomfortcalculator_2.percentHotCold])  # disabled
selectandaveragedata_2 = Ladybug_AverageData(annualHourlyData=energybalance_2.flrNormBalWStorage, totalOrAverage=boolean_toggle_15)  # -> readMe, selHourlyData, totaledDaily, totaledMonthly, totMonthlyPerHour, totAnalysisPeriod; disabled; plug-in component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
_3dchart_5 = Ladybug_3DChart(inputData=flatten(adaptivecomfortcalculator_2.conditionOfPerson), basePoint=point_5, xScale="0.25", zScale=panel_108)  # -> readMe, graphMesh, graphCurves, legend, legendBasePts, title, titleBasePts, dataPts, conditionalHOY; disabled; plug-in component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
barchart_2 = Ladybug_MonthlyBarChart(
    inputData=flatten(selectandaveragedata_2.totaledMonthly),
    stackValues=boolean_toggle_16,
    altYAxisTitle=panel_110,
    basePoint=point_6,
    legendPar=legendpar_2)  # -> out, dataMesh, dataCurves, dataCrvColors, graphAxes, graphLabels, title, titleBasePt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; disabled; plug-in component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
preview_2 = CustomPreview(Geometry=barchart_2.graphAxes, Shader=swatch_2)  # disabled
