# Grasshopper definition ma_xiaoyu.gh (Grasshopper 0.9.76)
# plug-ins: Python Interpreter, Ironbug

path = FilePath("\\juno.design.upenn.edu\home\grad\arch\maxiaoyu\Desktop\Philadelphia\USA_PA_Philadelphia.Intl.AP.724080_TMY3.epw")
importepw = Ladybug_ImportEpw(epwFile=path)  # -> readMe, latitude, location, dryBulbTemperature, dewPointTemperature, relativeHumidity, windSpeed, windDirection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; plug-in component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
solaradjusttemperature = Ladybug_OutdoorSolarTemperatureAdjustor(
    location=importepw.location,
    cumSkyMtxOrDirNormRad=importepw.directNormalRadiation,
    diffuseHorizRad=importepw.diffuseHorizontalRadiation,
    baseTemperature=importepw.dryBulbTemperature,
    horizInfraredRad=importepw.horizontalInfraredRadiation,
    runIt=Toggle(True))  # -> readMe, port, effectiveRadiantField, MRTDelta, solarAdjustedMRT, port_2, mannequinMesh, port_3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; plug-in component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
gradientlibrary = Ladybug_GradientLibrary(gradIndex="8")  # -> customColors; plug-in component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
outdoorcomfortcalculator = Ladybug_OutdoorComfortCalculator(
    dryBulbTemperature=importepw.dryBulbTemperature,
    meanRadiantTemperature=solaradjusttemperature.solarAdjustedMRT,
    windSpeed_tenMeters=importepw.windSpeed,
    relativeHumidity=importepw.relativeHumidity,
    runIt=Toggle(True))  # -> readMe, port, universalThermalClimateIndex, comfortableOrNot, thermalStress, conditionOfPerson, port_2, percentOfTimeComfortable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; plug-in component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
legendpar = Ladybug_LegendParameters(lowBound="-3", highBound="3", numSegments="7")  # -> legendPar; plug-in component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
_3dchart = Ladybug_3DChart(inputData=flatten(outdoorcomfortcalculator.conditionOfPerson), xScale="0.25", zScale="0", legendPar=legendpar)  # -> readMe, graphMesh, graphCurves, legend, legendBasePts, title, titleBasePts, dataPts, conditionalHOY; disabled; plug-in component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

# ----
# Start
ladybug = Ladybug_Ladybug()  # -> Vviiiiiiiiiizzz; plug-in component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
# Temperature with MRT
honeybee = Honeybee_Honeybee()  # -> Vviiiiiiiiiizzz; plug-in component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

path_2 = FilePath("\\juno.design.upenn.edu\home\grad\arch\maxiaoyu\Desktop\Philadelphia\USA_PA_Philadelphia.Intl.AP.724080_TMY3.epw")
importepw_2 = Ladybug_ImportEpw(epwFile=path_2)  # -> readMe, latitude, location, dryBulbTemperature, dewPointTemperature, relativeHumidity, windSpeed, windDirection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; disabled; plug-in component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
analysisperiod = Ladybug_AnalysisPeriod(fromMonth="12", toMonth="2")  # -> readMe, analysisPeriod; plug-in component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
windrose = Ladybug_WindRose(
    north=0,
    hourlyWindDirection=importepw_2.windDirection,
    hourlyWindSpeed=importepw_2.windSpeed,
    annualHourlyData=flatten([importepw_2.dryBulbTemperature, importepw_2.relativeHumidity]),
    analysisPeriod=analysisperiod.analysisPeriod,
    runIt=Toggle(False))  # -> readMe, calmRoseMesh, windRoseMesh, windRoseCrvs, windRoseCenPts, legend, legendBasePts, title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; plug-in component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

path_3 = FilePath("\\juno.design.upenn.edu\home\grad\arch\maxiaoyu\Desktop\Philadelphia\USA_PA_Philadelphia.Intl.AP.724080_TMY3.epw")
# Sun Path
importepw_3 = Ladybug_ImportEpw(epwFile=path_3)  # -> readMe, latitude, location, dryBulbTemperature, dewPointTemperature, relativeHumidity, windSpeed, windDirection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; disabled; plug-in component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
analysisperiod_2 = Ladybug_AnalysisPeriod(fromMonth="1", toMonth="12")  # -> readMe, analysisPeriod; plug-in component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
sunpath = Ladybug_SunPath(
    location=importepw_3.location,
    hour=12,
    day=21,
    month=12,
    timeStep=1,
    analysisPeriod=analysisperiod_2.analysisPeriod,
    dailyOrAnnualSunPath=True)  # -> readMe, sunVectors, sunAltitudes, sunAzimuths, port, sunSpheresMesh, sunPathCrvs, compassCrvs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; plug-in component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

# ----
# 9 Points Day Light
panel = Panel("Glass_60")
# Annual Day Light
panel_2 = Panel("Glass_60")
# Energy Model
brep = Brep(<brep referenced from the Rhino model>)
# Glare Analysis
panel_3 = Panel("6")
glzparamlist = Honeybee_GlazingParametersList(northGlzParam=0, westGlzParam=0, southGlzParam="0.1", eastGlzParam=0)  # -> glzParamList; plug-in component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
mass2zone = Honeybee_Masses2Zones(zoneMasses=flatten(brep), isConditioned=Toggle(False), maxRoofAngle=30, createHBZones=Toggle(True))  # -> readMe, HBZones; plug-in component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
radglassmaterial = Honeybee_RadianceGlassMaterial(materialName=panel, RTransmittance="0.6", GTransmittance="0.6", BTransmittance="0.6", refractiveIndex=1.52)  # -> avrgTrans, RADMaterial; plug-in component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
radglassmaterial_2 = Honeybee_RadianceGlassMaterial(materialName="Glass_60", RTransmittance="0.6", GTransmittance="0.6", BTransmittance="0.6", refractiveIndex=1.52)  # -> avrgTrans, RADMaterial; plug-in component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
brep_2 = Brep(<brep referenced from the Rhino model>)
radglassmaterial_3 = Honeybee_RadianceGlassMaterial(materialName=panel_2, RTransmittance="0.6", GTransmittance="0.6", BTransmittance="0.6", refractiveIndex=1.52)  # -> avrgTrans, RADMaterial; plug-in component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

# ---- group: Wall
brep_3 = Brep([<brep referenced from the Rhino model> x4])

# ---- group: Ceiling
brep_4 = Brep(<brep referenced from the Rhino model>)

# ---- group: Floor
brep_5 = Brep(<brep referenced from the Rhino model>)

# ---- group: Shade
brep_6 = Brep()

# ---- group: Wall
brep_7 = Brep([<brep referenced from the Rhino model> x4])

# ---- group: Ceiling
brep_8 = Brep(<brep referenced from the Rhino model>)

# ---- group: Floor
brep_9 = Brep(<brep referenced from the Rhino model>)

# ----
# Glazing Ratio Annual Daylight Test
brep_10 = Brep(<brep referenced from the Rhino model>)

# ---- group: Wall
brep_11 = Brep([<brep referenced from the Rhino model> x4])

# ---- group: Ceiling
brep_12 = Brep(<brep referenced from the Rhino model>)

# ---- group: Floor
brep_13 = Brep(<brep referenced from the Rhino model>)

# ----
# Glazing Ratio 9 Points Daylight Test
panel_4 = Panel("6")
brep_14 = Brep([<brep referenced from the Rhino model> x2])
flip = Flip(Surface=brep_5)  # -> Surface, Result
flip_2 = Flip(Surface=brep_9)  # -> Surface, Result

# ---- group: Window
brep_15 = Brep([<brep referenced from the Rhino model> x2])

# ----
flip_3 = Flip(Surface=brep_13)  # -> Surface, Result
# Glare Analysis for Modified Room (Shading)
panel_5 = Panel("Glass_60")
glzparamlist_2 = Honeybee_GlazingParametersList(northGlzParam=0, westGlzParam=0, southGlzParam="0.3", eastGlzParam=0)  # -> glzParamList; plug-in component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

# ---- group: Window
brep_16 = Brep([<brep referenced from the Rhino model> x2])

# ----
mass2zone_2 = Honeybee_Masses2Zones(zoneMasses=flatten(brep_2), isConditioned=Toggle(False), maxRoofAngle=30, createHBZones=Toggle(True))  # -> readMe, HBZones; plug-in component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

# ---- group: Window
brep_17 = Brep([<brep referenced from the Rhino model> x2])

# ----
glzparamlist_3 = Honeybee_GlazingParametersList(northGlzParam=0, westGlzParam=0, southGlzParam="0.3", eastGlzParam=0)  # -> glzParamList; plug-in component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
mass2zone_3 = Honeybee_Masses2Zones(zoneMasses=flatten(brep_10), isConditioned=Toggle(False), maxRoofAngle=30, createHBZones=Toggle(True))  # -> readMe, HBZones; plug-in component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
glazingcreator = Honeybee_GlazingBasedOnRatio(HBObjects=mass2zone.HBZones, glzRatio=glzparamlist, runIt=Toggle(True))  # -> readMe, HBObjWGLZ; plug-in component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
createhbsrfs = Honeybee_createHBSrfs(geometry=[brep_5, brep_3, brep_4])  # -> readMe, simplify(HBSurface); plug-in component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
createhbsrfs_2 = Honeybee_createHBSrfs(geometry=brep_15, RADMaterial=radglassmaterial.RADMaterial)  # -> readMe, simplify(HBSurface); plug-in component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
createhbsrfs_3 = Honeybee_createHBSrfs(geometry=brep_6, srfType=panel_3)  # -> readMe, simplify(HBSurface); disabled; plug-in component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
createhbsrfs_4 = Honeybee_createHBSrfs(geometry=brep_16, RADMaterial=radglassmaterial_2.RADMaterial)  # -> readMe, simplify(HBSurface); plug-in component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
createhbsrfs_5 = Honeybee_createHBSrfs(geometry=[brep_9, brep_7, brep_8])  # -> readMe, simplify(HBSurface); plug-in component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
createhbsrfs_6 = Honeybee_createHBSrfs(geometry=brep_17, RADMaterial=radglassmaterial_3.RADMaterial)  # -> readMe, simplify(HBSurface); plug-in component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
createhbsrfs_7 = Honeybee_createHBSrfs(geometry=[brep_13, brep_11, brep_12])  # -> readMe, simplify(HBSurface); plug-in component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
createhbsrfs_8 = Honeybee_createHBSrfs(geometry=brep_14, srfType=panel_4)  # -> readMe, simplify(HBSurface); plug-in component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
toggle = BooleanToggle(True)
# Energy Model 2
callfromepconstrlibrary = Honeybee_CallFromEPConstructionLibrary()  # -> ThermMaterials, EPMaterials, EPWindowMaterials, EPConstructions; plug-in component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
radglassmaterial_4 = Honeybee_RadianceGlassMaterial(materialName=panel_5, RTransmittance="0.6", GTransmittance="0.6", BTransmittance="0.6", refractiveIndex=1.52)  # -> avrgTrans, RADMaterial; plug-in component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
panel_6 = Panel("""0
4
1
2""")

# ---- group: Wall
brep_18 = Brep([<brep referenced from the Rhino model> x4])

# ---- group: Ceiling
brep_19 = Brep(<brep referenced from the Rhino model>)

# ---- group: Floor
brep_20 = Brep(<brep referenced from the Rhino model>)

# ----
brep_21 = Brep([<brep referenced from the Rhino model> x2])
glazingcreator_2 = Honeybee_GlazingBasedOnRatio(HBObjects=mass2zone_2.HBZones, glzRatio=glzparamlist_2, runIt=Toggle(True))  # -> readMe, HBObjWGLZ; plug-in component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
epoutput = Honeybee_GenerateEPOutput(zoneGainsAndLosses="False", zoneComfortMetrics=Toggle(True), surfaceTempAnalysis="False")  # -> report, flatten(simulationOutputs); plug-in component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
glazingcreator_3 = Honeybee_GlazingBasedOnRatio(HBObjects=mass2zone_3.HBZones, glzRatio=glzparamlist_3, runIt=Toggle(True))  # -> readMe, HBObjWGLZ; plug-in component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
flip_4 = Flip(Surface=brep_20)  # -> Surface, Result
makeadiabaticbytype = Honeybee_MakeAdiabaticByType(
    HBZones=glazingcreator.HBObjWGLZ,
    roofs=toggle,
    ceilings=toggle,
    floors=toggle,
    exposedFloors=toggle,
    groundFloors=toggle)  # -> HBZones; plug-in component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

# ---- group: Window
brep_22 = Brep([<brep referenced from the Rhino model> x3])

# ----
_3dchart_2 = Ladybug_3DChart(inputData=flatten(importepw.dryBulbTemperature), xScale="0.25", zScale="0")  # -> readMe, graphMesh, graphCurves, legend, legendBasePts, title, titleBasePts, dataPts, conditionalHOY; disabled; plug-in component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
wires = BrepWireframe(Brep=[createhbsrfs_4.HBSurface, createhbsrfs_5.HBSurface], Density=-1)
wires_2 = BrepWireframe(Brep=[createhbsrfs_6.HBSurface, createhbsrfs_7.HBSurface], Density=-1)
searchepconstruction = Honeybee_SearchEPConstruction(EPConstrList=callfromepconstrlibrary.EPConstructions, standard="2", climateZone="4", surfaceType=panel_6)  # -> EPSelectedConstr; plug-in component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
brep_23 = Brep(<brep referenced from the Rhino model>)
createhbsrfs_9 = Honeybee_createHBSrfs(geometry=brep_21, srfType="6")  # -> readMe, simplify(HBSurface); plug-in component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
createhbsrfs_10 = Honeybee_createHBSrfs(geometry=brep_22, RADMaterial=radglassmaterial_4.RADMaterial)  # -> readMe, simplify(HBSurface); plug-in component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
createhbsrfs_11 = Honeybee_createHBSrfs(geometry=[brep_20, brep_18, brep_19])  # -> readMe, simplify(HBSurface); plug-in component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
gentestpts = Honeybee_GenerateTestPoints(testGeometry=flip_3.Surface, gridSize="0.1", distBaseSrf="0.765", moveTestMesh=True)  # -> readMe, simplify(testPoints), simplify(ptsVectors), simplify(facesArea), simplify(mesh); plug-in component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
gentestpts_2 = Honeybee_GenerateTestPoints(testGeometry=flip_2.Surface, gridSize="0.1", distBaseSrf="0.765", moveTestMesh=True)  # -> readMe, simplify(testPoints), simplify(ptsVectors), simplify(facesArea), simplify(mesh); plug-in component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
wires_3 = BrepWireframe(Brep=glazingcreator_2.HBObjWGLZ, Density=-1)
toggle_2 = BooleanToggle(False)
glzparamlist_4 = Honeybee_GlazingParametersList(northGlzParam=0, westGlzParam=0, southGlzParam="0.3", eastGlzParam=0)  # -> glzParamList; plug-in component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
pt = ConstructPoint(XCoordinate="0", YCoordinate="350", ZCoordinate="0")

path_4 = FilePath("\\juno.design.upenn.edu\home\grad\arch\maxiaoyu\Desktop\Philadelphia\USA_PA_Philadelphia.Intl.AP.724080_TMY3.epw")
# Temperature
importepw_4 = Ladybug_ImportEpw(epwFile=path_4)  # -> readMe, latitude, location, dryBulbTemperature, dewPointTemperature, relativeHumidity, windSpeed, windDirection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; disabled; plug-in component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
outdoorcomfortcalculator_2 = Ladybug_OutdoorComfortCalculator(
    dryBulbTemperature=importepw_4.dryBulbTemperature,
    windSpeed_tenMeters=importepw_4.windSpeed,
    relativeHumidity=importepw_4.relativeHumidity,
    runIt=Toggle(True))  # -> readMe, port, universalThermalClimateIndex, comfortableOrNot, thermalStress, conditionOfPerson, port_2, percentOfTimeComfortable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; plug-in component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
gradientlibrary_2 = Ladybug_GradientLibrary(gradIndex="8")  # -> customColors; plug-in component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
legendpar_2 = Ladybug_LegendParameters(lowBound="-3", highBound="3", numSegments="7")  # -> legendPar; plug-in component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
_3dchart_3 = Ladybug_3DChart(
    inputData=flatten(outdoorcomfortcalculator_2.conditionOfPerson),
    basePoint=pt,
    xScale="0.25",
    zScale="0",
    legendPar=legendpar_2)  # -> readMe, graphMesh, graphCurves, legend, legendBasePts, title, titleBasePts, dataPts, conditionalHOY; plug-in component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

# ----
# Reletive Humidity
importepw_5 = Ladybug_ImportEpw(epwFile=path_4)  # -> readMe, latitude, location, dryBulbTemperature, dewPointTemperature, relativeHumidity, windSpeed, windDirection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; disabled; plug-in component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
gradientlibrary_3 = Ladybug_GradientLibrary(gradIndex="0")  # -> customColors; plug-in component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
rev = ReverseList(List=gradientlibrary_3)
legendpar_3 = Ladybug_LegendParameters(lowBound="0", customColors=flatten(rev))  # -> legendPar; plug-in component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
pt_2 = ConstructPoint(XCoordinate="0", YCoordinate="-350", ZCoordinate="0")
_3dchart_4 = Ladybug_3DChart(inputData=flatten(importepw_5.relativeHumidity), basePoint=pt_2, xScale="0.25", zScale="0", legendPar=legendpar_3)  # -> readMe, graphMesh, graphCurves, legend, legendBasePts, title, titleBasePts, dataPts, conditionalHOY; plug-in component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

# ----
# Reletive Humidity (25% - 60%)
importepw_6 = Ladybug_ImportEpw(epwFile=path_4)  # -> readMe, latitude, location, dryBulbTemperature, dewPointTemperature, relativeHumidity, windSpeed, windDirection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; disabled; plug-in component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
# Wind Rose
panel_7 = Panel("0")
gradientlibrary_4 = Ladybug_GradientLibrary(gradIndex=panel_7)  # -> customColors; plug-in component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
rev_2 = ReverseList(List=gradientlibrary_4)
legendpar_4 = Ladybug_LegendParameters(lowBound="0", customColors=flatten(rev_2))  # -> legendPar; plug-in component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
pt_3 = ConstructPoint(XCoordinate="0", YCoordinate="-700", ZCoordinate="0")
_3dchart_5 = Ladybug_3DChart(
    inputData=flatten(importepw_6.relativeHumidity),
    basePoint=pt_3,
    xScale="0.25",
    zScale="0",
    legendPar=legendpar_4,
    condStatement="25<a<60")  # -> readMe, graphMesh, graphCurves, legend, legendBasePts, title, titleBasePts, dataPts, conditionalHOY; plug-in component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

mass2zone_4 = Honeybee_Masses2Zones(zoneMasses=flatten(brep_23), isConditioned=Toggle(False), maxRoofAngle=30, createHBZones=Toggle(True))  # -> readMe, HBZones; plug-in component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
wires_4 = BrepWireframe(Brep=[glazingcreator_3.HBObjWGLZ, createhbsrfs_8.HBSurface], Density=-1)
path_5 = FilePath("\\juno.design.upenn.edu\home\grad\arch\maxiaoyu\Desktop\Philadelphia\USA_PA_Philadelphia.Intl.AP.724080_TMY3.epw")
path_6 = FilePath("\\juno.design.upenn.edu\home\grad\arch\maxiaoyu\Desktop\Philadelphia\USA_PA_Philadelphia.Intl.AP.724080_TMY3.epw")
wires_5 = BrepWireframe(Brep=makeadiabaticbytype, Density=-1)
item = ListItem(List=searchepconstruction, Index="1", Wrap=True)
genclimatebasedsky = Honeybee_GenerateClimateBasedSky(weatherFile=path_5, month="3", day="21", hour="9")  # -> radiationValues, skyFilePath; plug-in component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
genhbzonetestpts = Honeybee_GenerateZoneTestPoints(HBZone=glazingcreator_2.HBObjWGLZ, gridSize="0.1", distBaseSrf="0.765", moveTestMesh=True)  # -> out, simplify(testPoints), simplify(ptsVectors), simplify(facesArea), simplify(mesh); plug-in component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
runenergysimulation = Honeybee_RunEnergySimulation(
    epwFile=path_6,
    HBZones=flatten(makeadiabaticbytype),
    simulationOutputs=flatten(epoutput.simulationOutputs),
    writeIdf=toggle_2,
    runEnergyPlus=toggle_2)  # -> report, idfFileAddress, htmlReport, resultFileAddress; plug-in component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
genhbzonetestpts_2 = Honeybee_GenerateZoneTestPoints(HBZone=glazingcreator_3.HBObjWGLZ, gridSize="0.1", distBaseSrf="0.765", moveTestMesh=True)  # -> out, simplify(testPoints), simplify(ptsVectors), simplify(facesArea), simplify(mesh); plug-in component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
radparameters = Honeybee_RADParameters(quality=0)  # -> readMe, radParameters; plug-in component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
path_7 = FilePath("\\juno.design.upenn.edu\home\grad\arch\maxiaoyu\Desktop\Philadelphia\USA_PA_Philadelphia.Intl.AP.724080_TMY3.epw")
path_8 = FilePath("\\juno.design.upenn.edu\home\grad\arch\maxiaoyu\Desktop\Philadelphia\USA_PA_Philadelphia.Intl.AP.724080_TMY3.epw")
wires_6 = BrepWireframe(Brep=[createhbsrfs_10.HBSurface, createhbsrfs_11.HBSurface], Density=-1)
flatten = FlattenTree(Tree=item, Path="{0}")
brep_24 = Brep([<brep referenced from the Rhino model> x2])
annualdaylightsimulation = Honeybee_AnnualDaylightSimulation(epwWeatherFile=path_8, testPoints=gentestpts.testPoints, ptsVectors=gentestpts.ptsVectors)  # -> analysisRecipe; plug-in component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
glazingcreator_4 = Honeybee_GlazingBasedOnRatio(HBObjects=mass2zone_4.HBZones, glzRatio=glzparamlist_4, runIt=Toggle(True))  # -> readMe, HBObjWGLZ; plug-in component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
item_2 = ListItem(List=flatten, Index=0, Wrap=True)  # -> Item, Item1, Item2, Item3
gentestpts_3 = Honeybee_GenerateTestPoints(testGeometry=flip.Surface, gridSize="0.1", distBaseSrf="0.765", moveTestMesh=True)  # -> readMe, simplify(testPoints), simplify(ptsVectors), simplify(facesArea), simplify(mesh); plug-in component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
gentestpts_4 = Honeybee_GenerateTestPoints(testGeometry=flip_4.Surface, gridSize="0.1", distBaseSrf="0.765", moveTestMesh=True)  # -> readMe, simplify(testPoints), simplify(ptsVectors), simplify(facesArea), simplify(mesh); plug-in component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
radparameters_2 = Honeybee_RADParameters(quality=0)  # -> readMe, radParameters; plug-in component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
genclimatebasedsky_2 = Honeybee_GenerateClimateBasedSky(weatherFile=path_7, month="12", day="21", hour="15")  # -> radiationValues, skyFilePath; plug-in component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
doy_hoy = Ladybug_DOY_HOY(days="21", months="12", hours="15")  # -> HOY, DOY, date; plug-in component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
toggle_3 = BooleanToggle(False)
imagebasedsimulation = Honeybee_ImageBasedSimulation(
    skyFile=genclimatebasedsky.skyFilePath,
    cameraType="1",
    simulationType=2,
    radParameters=radparameters.radParameters,
    backupImages=0)  # -> analysisRecipe; plug-in component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
path_9 = FilePath("\\juno.design.upenn.edu\home\grad\arch\maxiaoyu\Desktop\Philadelphia\USA_PA_Philadelphia.Intl.AP.724080_TMY3.epw")
path_10 = FilePath("\\juno.design.upenn.edu\home\grad\arch\maxiaoyu\Desktop\Philadelphia\USA_PA_Philadelphia.Intl.AP.724080_TMY3.epw")
importepw_7 = Ladybug_ImportEpw(epwFile=path_6)  # -> readMe, latitude, location, dryBulbTemperature, dewPointTemperature, relativeHumidity, windSpeed, windDirection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; plug-in component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
readepresult = Honeybee_ReadEPResult(resultFileAddress=runenergysimulation.resultFileAddress)  # -> totalThermalLoad, thermalLoadBalance, cooling, heating, electricLight, electricEquip, fanElectric, pumpElectric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; plug-in component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
genclimatebasedsky_3 = Honeybee_GenerateClimateBasedSky(weatherFile=path_9, month="12", day="21", hour="15")  # -> radiationValues, skyFilePath; plug-in component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
annualdaylightsimulation_2 = Honeybee_AnnualDaylightSimulation(epwWeatherFile=path_10, testPoints=genhbzonetestpts_2.testPoints, ptsVectors=genhbzonetestpts_2.ptsVectors)  # -> analysisRecipe; plug-in component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
toggle_4 = BooleanToggle(False)
path_11 = FilePath("\\juno.design.upenn.edu\home\grad\arch\maxiaoyu\Desktop\Philadelphia\USA_PA_Philadelphia.Intl.AP.724080_TMY3.epw")
hb_epcontextsrf = HoneybeeEPContextSurfaces(shdSurfaces=flatten(brep_24))  # -> HBContext; inputs shdSurfaces: list of Brep, justBoundingBox: Boolean
# ---------- hb_epcontextsrf: Python ----------
"""
prepare shading/context geometries

    Args:
        northVectorOrRotation: A vector that shows North or a number that shows
                               the rotation of the North from the Y axis
        bldgMasses: List of closed Breps as thermal zones.
    Returns:
        report: ...
        thermalZones: Thermal zone's geometries for visualiza
"""

ghenv.Component.Name = 'Honeybee EP context Surfaces'
ghenv.Component.NickName = 'HB_EPContextSrf'
ghenv.Component.Message = 'VER 0.0.62\nJUL_28_2017'
ghenv.Component.IconDisplayMode = ghenv.Component.IconDisplayMode.application
ghenv.Component.Category = "Honeybee"
ghenv.Component.SubCategory = "10 | Energy | Energy"
#compatibleHBVersion = VER 0.0.57\nNOV_04_2016
#compatibleLBVersion = VER 0.0.59\nFEB_01_2015
ghenv.Component.AdditionalHelpFromDocStrings = "2"

import rhinoscriptsyntax as rs
import Rhino as rc
import scriptcontext as sc
import os
import System
import Grasshopper.Kernel as gh
import uuid

tolerance = sc.doc.ModelAbsoluteTolerance
import math


def main(shdSurfaces, EPTransSchedule, meshingSettings, justBoundingBox):
    
    # import the classes
    if sc.sticky.has_key('honeybee_release'):

        try:
            if not sc.sticky['honeybee_release'].isCompatible(ghenv.Component): return -1
            if sc.sticky['honeybee_release'].isInputMissing(ghenv.Component): return -1
        except:
            warning = "You need a newer version of Honeybee to use this compoent." + \
            " Use updateHoneybee component to update userObjects.\n" + \
            "If you have already updated userObjects drag Honeybee_Honeybee component " + \
            "into canvas and try again."
            w = gh.GH_RuntimeMessageLevel.Warning
            ghenv.Component.AddRuntimeMessage(w, warning)
            return -1
        
        # don't customize this part
        hb_EPSrf = sc.sticky["honeybee_EPSurface"]
        hb_EPSHDSurface = sc.sticky["honeybee_EPShdSurface"]
        hb_RADMaterialAUX = sc.sticky["honeybee_RADMaterialAUX"]
        hb_EPObjectsAux = sc.sticky["honeybee_EPObjectsAUX"]()
        HBScheduleList = sc.sticky["honeybee_ScheduleLib"].keys()

        ########################################################################
        #----------------------------------------------------------------------#
        shdBreps = []
        # create bounding box of shading geometries
        if justBoundingBox:
            for brep in shdSurfaces:
                if brep.Faces.Count>1 or not brep.Faces[0].IsPlanar(sc.doc.ModelAbsoluteTolerance):
                    shdBreps.append(brep.GetBoundingBox(True).ToBrep())
                else:
                    shdBreps.append(brep)
        else:
            shdBreps = shdSurfaces
        
        shadingClasses = []
        shadingMeshPreview = []
        
        if meshingSettings == None:
            mp = rc.Geometry.MeshingParameters.Minimal
            mp.SimplePlanes = True
        else:
            mp = meshingSettings
        
        def getRadMaterialName(radMaterial):
            nameStr = radMaterial.split(" ")[2]
            name =  nameStr.split("\n")[0]
            return name
        
        for brepCount, brep in enumerate(shdBreps):
            if brep != None:
                isPlanar = True
                # check planarity
                for face in brep.Faces:
                    if not face.IsPlanar(tolerance):
                        isPlanar = False
                        break
                
                shadingBreps = []
                if not isPlanar:
                    meshArray = rc.Geometry.Mesh.CreateFromBrep(brep, mp)
                    for mesh in meshArray:
                        for meshFace in range(mesh.Faces.Count):
                            vertices = list(mesh.Faces.GetFaceVertices(meshFace))[1:]
                            vertices = vertices + [sc.doc.ModelAbsoluteTolerance]
                            # create the brep from mesh
                            shdBrep = rc.Geometry.Brep.CreateFromCornerPoints(*vertices)
                            shadingBreps.append(shdBrep)
                else:
                    for face in brep.Faces:
                        shadingBreps.append(face.DuplicateFace(False))
                
                for faceCount, shdBrep in enumerate(shadingBreps):
                        thisShading = hb_EPSHDSurface(shdBrep, 1000*brepCount + faceCount, 'shdSrf_' + `brepCount` + '_' + `faceCount` + "_" + str(uuid.uuid4()))
                        
                        # add transmittance schedule if any
                        if EPTransSchedule!=None:
                            schedule= EPTransSchedule.upper()
                            if schedule!=None and not schedule.lower().endswith(".csv") and schedule not in HBScheduleList:
                                msg = "Cannot find " + schedule + " in Honeybee schedule library."
                                print msg
                                ghenv.Component.AddRuntimeMessage(gh.GH_RuntimeMessageLevel.Warning, msg)
                                return -1
                            elif schedule!=None and schedule.lower().endswith(".csv"):
                                # check if csv file is existed
                                if not os.path.isfile(schedule):
                                    msg = "Cannot find the shchedule file: " + schedule
                                    print msg
                                    ghenv.Component.AddRuntimeMessage(gh.GH_RuntimeMessageLevel.Warning, msg)
                                    return -1
                            
                            thisShading.TransmittanceSCH = schedule
                        
                        # add the Rad Material if any
                        if RADMaterial!=None:
                            # if it is just the name of the material make sure it is already defined
                            if len(RADMaterial.split(" ")) == 1:
                                # if the material is not in the library add it to the library
                                if not hb_RADMaterialAUX.isMatrialExistInLibrary(RADMaterial):
                                    warningMsg = "Can't find " + RADMaterial + " in RAD Material Library.\n" + \
                                                "Add the material to the library and try again."
                                    ghenv.Component.AddRuntimeMessage(gh.GH_RuntimeMessageLevel.Warning, warningMsg)
                                    return
                                
                                try:
                                    thisShading.setRADMaterial(RADMaterial)
                                except Exception, e:
                                    print e
                                    warningMsg = "You are using an old version of Honeybee_Honeybee! Update your files and try again."
                                    print warningMsg
                                    ghenv.Component.AddRuntimeMessage(gh.GH_RuntimeMessageLevel.Warning, warningMsg)
                                    return
                                
                                addedToLib = True
                            else:
                                
                                # try to add the material to the library
                                addedToLib, thisShading.RadMaterial = hb_RADMaterialAUX.analyseRadMaterials(RADMaterial, True)
                                
                            if addedToLib==False:
                                warningMsg = "Failed to add " + RADMaterial + " to the Library."
                                ghenv.Component.AddRuntimeMessage(gh.GH_RuntimeMessageLevel.Warning, warningMsg)
                                return
                        
                        # add shading to the list
                        shadingClasses.append(thisShading)
                
        # add to the hive
        hb_hive = sc.sticky["honeybee_Hive"]()
        HBContext  = hb_hive.addToHoneybeeHive(shadingClasses, ghenv.Component)
        return HBContext
        ################################################################################################
    else:
        print "You should first let Honeybee to fly..."
        w = gh.GH_RuntimeMessageLevel.Warning
        ghenv.Component.AddRuntimeMessage(w, "You should first let Honeybee to fly...")
        return -1
        

if _shdSurfaces and _shdSurfaces[0]!=None:
    # add cleaning function
    result= main(_shdSurfaces, EPTransSchedule_, meshingSettings_, justBoundingBox_)
    
    if result != -1: HBContext = result
# ---------- end hb_epcontextsrf ----------
occupancygenerator = Honeybee_DaysimOccupancyGenerator(dailyOffHours="-1", weekendDays="0", writeTheOcc=Toggle(True))  # -> occupancyFile; plug-in component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
rundaylightanalysis = Honeybee_RunDaylightSimulation(
    HBObjects=flatten([createhbsrfs_6.HBSurface, createhbsrfs_7.HBSurface]),
    analysisRecipe=annualdaylightsimulation,
    writeRad=toggle_3,
    runRad=toggle_3,
    overwriteResults=True)  # -> readMe, analysisType, resultsUnit, results, testPts, resultFiles, radGeoFile, studyFolder, done; plug-in component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
radparameters_3 = Honeybee_RADParameters(quality=0)  # -> readMe, radParameters; plug-in component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
setepzonecnstr = Honeybee_SetEPZoneConstruction(
    HBZones=flatten(glazingcreator_4.HBObjWGLZ),
    wallEPConstruction=item_2.Item,
    windowEPConstruction=item_2.Item1,
    roofEPConstruction=item_2.Item2,
    floorEPConstruction=item_2.Item3)  # -> simplify(modifiedHBZones); plug-in component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
wires_7 = BrepWireframe(Brep=[glazingcreator_4.HBObjWGLZ, hb_epcontextsrf], Density=-1)
toggle_5 = BooleanToggle(False)
gridbasedsimulation = Honeybee_GridBasedSimulation(
    skyFile=genclimatebasedsky_2.skyFilePath,
    testPoints=gentestpts_3.testPoints,
    ptsVectors=gentestpts_3.ptsVectors,
    simulationType=0,
    radParameters=radparameters_2.radParameters)  # -> analysisRecipe; plug-in component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
genclimatebasedsky_4 = Honeybee_GenerateClimateBasedSky(weatherFile=path_11, month="3", day="21", hour="9")  # -> radiationValues, skyFilePath; plug-in component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
radparameters_4 = Honeybee_RADParameters(quality=0)  # -> readMe, radParameters; plug-in component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
doy_hoy_2 = Ladybug_DOY_HOY(days="21", months="3", hours="9")  # -> HOY, DOY, date; plug-in component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
rundaylightanalysis_2 = Honeybee_RunDaylightSimulation(
    HBObjects=flatten([createhbsrfs_4.HBSurface, createhbsrfs_5.HBSurface]),
    analysisRecipe=imagebasedsimulation,
    writeRad=toggle_4,
    runRad=toggle_4,
    overwriteResults=True)  # -> readMe, analysisType, resultsUnit, results, testPts, resultFiles, radGeoFile, studyFolder, done; plug-in component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
occupancygenerator_2 = Honeybee_DaysimOccupancyGenerator(dailyOffHours="-1", weekendDays="0", writeTheOcc=Toggle(True))  # -> occupancyFile; plug-in component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
rundaylightanalysis_3 = Honeybee_RunDaylightSimulation(
    HBObjects=flatten([glazingcreator_3.HBObjWGLZ, createhbsrfs_8.HBSurface]),
    analysisRecipe=annualdaylightsimulation_2,
    writeRad=toggle_5,
    runRad=toggle_5,
    overwriteResults=True)  # -> readMe, analysisType, resultsUnit, results, testPts, resultFiles, radGeoFile, studyFolder, done; plug-in component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
imagebasedsimulation_2 = Honeybee_ImageBasedSimulation(
    skyFile=genclimatebasedsky_3.skyFilePath,
    cameraType="1",
    simulationType=2,
    radParameters=radparameters_3.radParameters,
    backupImages=0)  # -> analysisRecipe; plug-in component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
toggle_6 = BooleanToggle(False)
toggle_7 = BooleanToggle(False)
gridbasedsimulation_2 = Honeybee_GridBasedSimulation(
    skyFile=genclimatebasedsky_4.skyFilePath,
    testPoints=genhbzonetestpts.testPoints,
    ptsVectors=genhbzonetestpts.ptsVectors,
    simulationType=0,
    radParameters=radparameters_4.radParameters)  # -> analysisRecipe; plug-in component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
readannualresultsi = Honeybee_ReadAnnualResultI(
    illFilesAddress=rundaylightanalysis.resultFiles,
    testPoints=simplify(rundaylightanalysis.testPts),
    occupancyFiles=occupancygenerator,
    DLAIllumThresholds=300,
    runIt=Toggle(False))  # -> DLA, UDLI_Less_100, UDLI_100_2000, UDLI_More_2000, CDA, sDA, annualProfiles, htmReport; plug-in component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
adaptivecomfortcalculator = Ladybug_AdaptiveComfortCalculator(
    dryBulbTemperature=readepresult.airTemperature,
    meanRadiantTemperature=readepresult.meanRadTemperature,
    prevailingOutdoorTemp=importepw_7.dryBulbTemperature,
    runIt=Toggle(False))  # -> readMe, port, comfortableOrNot, conditionOfPerson, degreesFromTarget, port_2, targetTemperature, upperTemperatureBound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; plug-in component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
rundaylightanalysis_4 = Honeybee_RunDaylightSimulation(
    HBObjects=flatten([createhbsrfs_2.HBSurface, createhbsrfs.HBSurface, createhbsrfs_3.HBSurface]),
    analysisRecipe=gridbasedsimulation,
    writeRad=toggle_6,
    runRad=toggle_6,
    overwriteResults=True)  # -> readMe, analysisType, resultsUnit, results, testPts, resultFiles, radGeoFile, studyFolder, done; plug-in component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
wires_8 = BrepWireframe(Brep=[createhbsrfs_2.HBSurface, createhbsrfs.HBSurface, createhbsrfs_3.HBSurface], Density=-1)
legendpar_5 = Ladybug_LegendParameters(lowBound="100", highBound="2000")  # -> legendPar; plug-in component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
epoutput_2 = Honeybee_GenerateEPOutput(zoneGainsAndLosses="False", zoneComfortMetrics=Toggle(True), surfaceTempAnalysis="False")  # -> report, flatten(simulationOutputs); plug-in component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
rundaylightanalysis_5 = Honeybee_RunDaylightSimulation(
    HBObjects=flatten([createhbsrfs_10.HBSurface, createhbsrfs_11.HBSurface, createhbsrfs_9.HBSurface]),
    analysisRecipe=imagebasedsimulation_2,
    writeRad=toggle_7,
    runRad=toggle_7,
    overwriteResults=True)  # -> readMe, analysisType, resultsUnit, results, testPts, resultFiles, radGeoFile, studyFolder, done; plug-in component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
setepnatvent = Honeybee_SetEPAirFlow(
    HBZones=flatten(setepzonecnstr),
    naturalVentilationType="1",
    minIndoorTempForNatVent="24",
    maxIndoorTempForNatVent="27",
    minOutdoorTempForNatVent="22",
    maxOutdoorTempForNatVent="30")  # -> readMe, simplify(HBZones); plug-in component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
toggle_8 = BooleanToggle(False)
glareanalysis = Honeybee_GlareAnalysis(HDRImagePath=rundaylightanalysis_2.resultFiles, runIt=Toggle(False))  # -> readMe, glareCheckImage, DGP, DGI, glareComfortRange, imageWithTaskArea; plug-in component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
readannualresultsi_2 = Honeybee_ReadAnnualResultI(
    illFilesAddress=rundaylightanalysis_3.resultFiles,
    testPoints=simplify(rundaylightanalysis_3.testPts),
    occupancyFiles=occupancygenerator_2,
    DLAIllumThresholds=300,
    runIt=Toggle(True))  # -> DLA, UDLI_Less_100, UDLI_100_2000, UDLI_More_2000, CDA, sDA, annualProfiles, htmReport; plug-in component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
legendpar_6 = Ladybug_LegendParameters(lowBound="-1", highBound="1", numSegments="3")  # -> legendPar; plug-in component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
rundaylightanalysis_6 = Honeybee_RunDaylightSimulation(
    HBObjects=flatten(glazingcreator_2.HBObjWGLZ),
    analysisRecipe=gridbasedsimulation_2,
    writeRad=toggle_8,
    runRad=toggle_8,
    overwriteResults=True)  # -> readMe, analysisType, resultsUnit, results, testPts, resultFiles, radGeoFile, studyFolder, done; plug-in component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
legendpar_7 = Ladybug_LegendParameters(lowBound="100", highBound="2000")  # -> legendPar; plug-in component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
panel_8 = Panel([adaptivecomfortcalculator.percentOfTimeComfortable, adaptivecomfortcalculator.percentHotCold])
recolormesh = Ladybug_RecolorMesh(
    analysisResult=readannualresultsi.UDLI_100_2000,
    inputMesh=gentestpts.mesh,
    analysisTitle="Continues Daylight Autonomy (CDA)",
    legendTitle="%")  # -> readMe, newMesh, newLegend, legendBasePt, meshColors, legendColors; plug-in component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
toggle_9 = BooleanToggle(False)
path_12 = FilePath("\\juno.design.upenn.edu\home\grad\arch\maxiaoyu\Desktop\Philadelphia\USA_PA_Philadelphia.Intl.AP.724080_TMY3.epw")
_3dchart_6 = Ladybug_3DChart(inputData=flatten(adaptivecomfortcalculator.conditionOfPerson), xScale="0.25", zScale="0", legendPar=legendpar_6)  # -> readMe, graphMesh, graphCurves, legend, legendBasePts, title, titleBasePts, dataPts, conditionalHOY; plug-in component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
ach2m3_s_m2_calculator = Honeybee_infORventPerAreaCalculator(HBZones=flatten(setepnatvent.HBZones), airFlowRate="1")  # -> readMe, infORventPerArea, allFloors; plug-in component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
glareanalysis_2 = Honeybee_GlareAnalysis(HDRImagePath=rundaylightanalysis_5.resultFiles, runIt=Toggle(True))  # -> readMe, glareCheckImage, DGP, DGI, glareComfortRange, imageWithTaskArea; plug-in component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
recolormesh_2 = Ladybug_RecolorMesh(
    analysisResult=readannualresultsi_2.UDLI_100_2000,
    inputMesh=genhbzonetestpts_2.mesh,
    analysisTitle="UDLI (100-2000)",
    legendTitle="%")  # -> readMe, newMesh, newLegend, legendBasePt, meshColors, legendColors; plug-in component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
runenergysimulation_2 = Honeybee_RunEnergySimulation(
    epwFile=path_12,
    HBZones=flatten(setepnatvent.HBZones),
    HBContext=flatten(hb_epcontextsrf),
    simulationOutputs=flatten(epoutput_2.simulationOutputs),
    writeIdf=toggle_9,
    runEnergyPlus=toggle_9)  # -> report, idfFileAddress, htmlReport, resultFileAddress; plug-in component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
hdr_tif = Honeybee_ConvertHDRToTIF(HDRFilePath=glareanalysis.glareCheckImage, adjustExposure=Toggle(True))  # -> TIFFFilePath; plug-in component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
smaller = SmallerThan(FirstNumber=rundaylightanalysis_4.results, SecondNumber="2000")  # -> SmallerThan, OrEqualTo
larger = LargerThan(FirstNumber=rundaylightanalysis_4.results, SecondNumber="100")  # -> LargerThan, OrEqualTo
toggle_10 = BooleanToggle(True)
and = GateAnd(A=smaller.SmallerThan, B=larger.LargerThan)
viewer = Ladybug_ImageViewer(ImagePath_=hdr_tif, _scale_=1, DisableClickable=False, SaveImgWithCoords=False, scale=1)  # -> ImagePath, Colors, GIF
panel_9 = Panel(hdr_tif)
importepw_8 = Ladybug_ImportEpw(epwFile=path_12)  # -> readMe, latitude, location, dryBulbTemperature, dewPointTemperature, relativeHumidity, windSpeed, windDirection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; plug-in component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
readepresult_2 = Honeybee_ReadEPResult(resultFileAddress=runenergysimulation_2.resultFileAddress)  # -> totalThermalLoad, thermalLoadBalance, cooling, heating, electricLight, electricEquip, fanElectric, pumpElectric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; plug-in component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
hdr_tif_2 = Honeybee_ConvertHDRToTIF(HDRFilePath=glareanalysis_2.glareCheckImage, adjustExposure=Toggle(True))  # -> TIFFFilePath; plug-in component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
num = Number(and)
epoutput_3 = Honeybee_GenerateEPOutput(
    zoneEnergyUse=toggle_10,
    zoneGainsAndLosses=toggle_10,
    zoneComfortMetrics="False",
    surfaceTempAnalysis="False",
    surfaceEnergyAnalysis=toggle_10)  # -> report, flatten(simulationOutputs); plug-in component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
setepzoneloads = Honeybee_SetEnergyPlusZoneLoads(HBZones=setepnatvent.HBZones, numOfPeoplePerArea="0.12", ventilationPerArea=ach2m3_s_m2_calculator.infORventPerArea)  # -> loads, HBZones; plug-in component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
smaller_2 = SmallerThan(FirstNumber=rundaylightanalysis_6.results, SecondNumber="2000")  # -> SmallerThan, OrEqualTo
larger_2 = LargerThan(FirstNumber=rundaylightanalysis_6.results, SecondNumber="100")  # -> LargerThan, OrEqualTo
ma = MassAddition(Input=num)  # -> Result, PartialResults
lng = ListLength(List=rundaylightanalysis_4.results)
and_2 = GateAnd(A=smaller_2.SmallerThan, B=larger_2.LargerThan)
division = Division(A=ma.Result, B=lng)
toggle_11 = BooleanToggle(False)
multiplication = Multiplication(A=division, B="100")
viewer_2 = Ladybug_ImageViewer(ImagePath_=hdr_tif_2, _scale_=1, DisableClickable=False, SaveImgWithCoords=False, scale=1)  # -> ImagePath, Colors, GIF
panel_10 = Panel(hdr_tif_2)
path_13 = FilePath("\\juno.design.upenn.edu\home\grad\arch\maxiaoyu\Desktop\Philadelphia\USA_PA_Philadelphia.Intl.AP.724080_TMY3.epw")
num_2 = Number(and_2)
round = Round(Number=multiplication)  # -> Nearest, Floor, Ceiling
adaptivecomfortcalculator_2 = Ladybug_AdaptiveComfortCalculator(
    dryBulbTemperature=readepresult_2.airTemperature,
    meanRadiantTemperature=readepresult_2.meanRadTemperature,
    prevailingOutdoorTemp=importepw_8.dryBulbTemperature,
    runIt=Toggle(False))  # -> readMe, port, comfortableOrNot, conditionOfPerson, degreesFromTarget, port_2, targetTemperature, upperTemperatureBound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; plug-in component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
ma_2 = MassAddition(Input=num_2)  # -> Result, PartialResults
lng_2 = ListLength(List=rundaylightanalysis_6.results)
exporttoopenstudio = Honeybee_ExportToOpenStudio(
    epwWeatherFile=path_13,
    HBZones=flatten(setepzoneloads.HBZones),
    simulationOutputs=flatten(epoutput_3.simulationOutputs),
    writeOSM=toggle_11,
    runSimulation=toggle_11)  # -> readMe, osmFileAddress, idfFileAddress, resultFileAddress, eioFileAddress, rddFileAddress, htmlReport, studyFolder, model; plug-in component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
concat = Concatenate(FragmentA=round.Nearest, FragmentB="% between 100 Lux and 2000 Lux")
concat_2 = Concatenate(FragmentA="Illuminance", FragmentB=concat, FragmentE="Date: ", FragmentF=doy_hoy.date)
recolormesh_3 = Ladybug_RecolorMesh(
    analysisResult=rundaylightanalysis_4.results,
    inputMesh=gentestpts_3.mesh,
    legendPar=legendpar_5,
    analysisTitle=concat_2,
    legendTitle="LUX")  # -> readMe, newMesh, newLegend, legendBasePt, meshColors, legendColors; plug-in component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
pt_4 = ConstructPoint(XCoordinate=0, YCoordinate="-1.2", ZCoordinate=0)
division_2 = Division(A=ma_2.Result, B=lng_2)
multiplication_2 = Multiplication(A=division_2, B="100")
panel_11 = Panel(concat)
tag = TextTag3D(Location=pt_4, Text=concat, Size="0.35", Colour=ColourSwatch(SwatchColor=RGB(0, 0, 0)), Justification=7)
round_2 = Round(Number=multiplication_2)  # -> Nearest, Floor, Ceiling
legendpar_8 = Ladybug_LegendParameters(lowBound="-1", highBound="1", numSegments="3")  # -> legendPar; plug-in component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
panel_12 = Panel([adaptivecomfortcalculator_2.percentOfTimeComfortable, adaptivecomfortcalculator_2.percentHotCold])
_3dchart_7 = Ladybug_3DChart(inputData=flatten(readepresult_2.relativeHumidity), xScale="0.25", zScale="0")  # -> out, graphMesh, graphCurves, legend, legendBasePts, title, titleBasePts, dataPts, conditionalHOY; plug-in component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
concat_3 = Concatenate(FragmentA=round_2.Nearest, FragmentB="% between 100 Lux and 2000 Lux")
concat_4 = Concatenate(FragmentA="Illuminance", FragmentB=concat_3, FragmentE="Date: ", FragmentF=doy_hoy_2.date)
recolormesh_4 = Ladybug_RecolorMesh(
    analysisResult=rundaylightanalysis_6.results,
    inputMesh=genhbzonetestpts.mesh,
    legendPar=legendpar_7,
    analysisTitle=concat_4,
    legendTitle="LUX")  # -> readMe, newMesh, newLegend, legendBasePt, meshColors, legendColors; plug-in component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
pt_5 = ConstructPoint(XCoordinate=0, YCoordinate="-1.2", ZCoordinate=0)

gradientlibrary_5 = Ladybug_GradientLibrary(gradIndex="0")  # -> customColors; plug-in component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
rev_3 = ReverseList(List=gradientlibrary_5)
legendpar_9 = Ladybug_LegendParameters(lowBound="0", customColors=flatten(rev_3))  # -> legendPar; plug-in component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
_3dchart_8 = Ladybug_3DChart(
    inputData=flatten(readepresult_2.relativeHumidity),
    xScale="0.25",
    zScale="0",
    legendPar=legendpar_9,
    condStatement="25<a<60")  # -> readMe, graphMesh, graphCurves, legend, legendBasePts, title, titleBasePts, dataPts, conditionalHOY; disabled; plug-in component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

panel_13 = Panel(concat_3)
readepresult_3 = Honeybee_ReadEPResult(resultFileAddress=exporttoopenstudio.resultFileAddress)  # -> totalThermalLoad, thermalLoadBalance, cooling, heating, electricLight, electricEquip, fanElectric, pumpElectric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; plug-in component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
readepsrfresult = Honeybee_ReadEPSurfaceResult(resultFileAddress=exporttoopenstudio.resultFileAddress)  # -> surfaceIndoorTemp, surfaceOutdoorTemp, surfaceEnergyFlow, opaqueEnergyFlow, glazEnergyFlow, windowTotalSolarEnergy, windowBeamEnergy, windowDiffEnergy, windowTransmissivity, otherSurfaceData; plug-in component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
tag_2 = TextTag3D(Location=pt_5, Text=concat_3, Size="0.35", Colour=ColourSwatch(SwatchColor=RGB(0, 0, 0)), Justification=7)
_3dchart_9 = Ladybug_3DChart(inputData=flatten(adaptivecomfortcalculator_2.conditionOfPerson), xScale="0.25", zScale="0", legendPar=legendpar_8)  # -> readMe, graphMesh, graphCurves, legend, legendBasePts, title, titleBasePts, dataPts, conditionalHOY; plug-in component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
energybalance = Honeybee_ConstructEnergyBalance(
    HBZones=flatten(setepzoneloads.HBZones),
    cooling=readepresult_3.cooling,
    heating=readepresult_3.heating,
    electricLight=readepresult_3.electricLight,
    electricEquip=readepresult_3.electricEquip,
    fanElectric=readepresult_3.fanElectric,
    peopleGains=readepresult_3.peopleGains,
    totalSolarGain=readepresult_3.totalSolarGain,
    infiltrationEnergy=readepresult_3.infiltrationEnergy,
    mechVentilationEnergy=readepresult_3.mechVentilationEnergy,
    natVentEnergy=readepresult_3.natVentEnergy,
    surfaceEnergyFlow=readepsrfresult.surfaceEnergyFlow)  # -> readMe, port, flrNormEnergyBal, flrNormBalWStorage, port_2, modelEnergyBalance, energyBalWithStorage; plug-in component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
gradientlibrary_6 = Ladybug_GradientLibrary(gradIndex="19")  # -> customColors; plug-in component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
legendpar_10 = Ladybug_LegendParameters(lowBound="-50", highBound="50", customColors=flatten(gradientlibrary_6))  # -> legendPar; plug-in component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
selectandaveragedata = Ladybug_AverageData(annualHourlyData=energybalance.flrNormBalWStorage, totalOrAverage=Toggle(True))  # -> readMe, selHourlyData, totaledDaily, totaledMonthly, totMonthlyPerHour, totAnalysisPeriod; plug-in component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
point = Point(<point referenced from the Rhino model>)
barchart = Ladybug_MonthlyBarChart(
    inputData=flatten(selectandaveragedata.totaledMonthly),
    stackValues=Toggle(True),
    altTitle="Bedroom Energy Balance",
    basePoint=point,
    legendPar=legendpar_10)  # -> readMe, dataMesh, dataCurves, dataCrvColors, graphAxes, graphLabels, title, titleBasePt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; plug-in component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
