# Grasshopper definition peng_yunzhongda_final_proposal_novent_shading1.gh (Grasshopper 0.9.76)
# plug-ins: Python Interpreter

# ---- group: construction setting
number_slider = Slider(4, range=0..10)
callfromepconstrlibrary = Honeybee_CallFromEPConstructionLibrary()  # -> ThermMaterials, EPMaterials, EPWindowMaterials, EPConstructions; plug-in component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
panel = Panel("2")
# Construction Setting
# Wall
searchepconstruction = Honeybee_SearchEPConstruction(EPConstrList=callfromepconstrlibrary.EPConstructions, standard=panel, climateZone=number_slider, surfaceType="0")  # -> EPSelectedConstr; plug-in component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
# Floor
searchepconstruction_2 = Honeybee_SearchEPConstruction(EPConstrList=callfromepconstrlibrary.EPConstructions, standard=panel, climateZone=number_slider, surfaceType="2")  # -> EPSelectedConstr; plug-in component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
decomposeepconstruction = Honeybee_DecomposeEPConstruction(cnstrName=searchepconstruction)  # -> materials, comments, UValue_SI, UValue_IP, RValue_SI, RValue_IP; plug-in component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
lng = ListLength(List=decomposeepconstruction.RValue_SI)
sort = SortList(Keys=decomposeepconstruction.RValue_SI, ValuesA=searchepconstruction)  # -> Keys, ValuesA
subtraction = Subtraction(A=lng, B=1)
item = ListItem(List=sort.ValuesA, Index=subtraction, Wrap=True)

# ----
panel_2 = Panel("https://www.energyplus.net/weather-download/north_and_central_america_wmo_region_4/USA/PA/USA_PA_Philadelphia.Intl.AP.724080_TMY3/all")
epw_stat = Ladybug_OpenEPWAndSTATWeatherFiles(weatherFileURL=panel_2)  # -> epwFile, statFile; plug-in component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
# Ceiling(Void)
searchepconstruction_3 = Honeybee_SearchEPConstruction(EPConstrList=callfromepconstrlibrary.EPConstructions, standard=panel, climateZone=number_slider, surfaceType="3")  # -> EPSelectedConstr; plug-in component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
# Window
searchepconstruction_4 = Honeybee_SearchEPConstruction(EPConstrList=callfromepconstrlibrary.EPConstructions, standard=panel, climateZone=number_slider, surfaceType="4")  # -> EPSelectedConstr; plug-in component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
panel_3 = Panel(searchepconstruction_4)
item_2 = ListItem(List=searchepconstruction_3, Index=0, Wrap=True)  # -> Item, Item1
panel_4 = Panel(searchepconstruction_3)
panel_5 = Panel(searchepconstruction_2)
panel_6 = Panel(searchepconstruction)
decomposeepconstruction_2 = Honeybee_DecomposeEPConstruction(cnstrName=panel_3)  # -> materials, comments, UValue_SI, UValue_IP, RValue_SI, RValue_IP; plug-in component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
ladybug = Ladybug_Ladybug()  # -> Vviiiiiiiiiizzz; plug-in component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
honeybee = Honeybee_Honeybee()  # -> Vviiiiiiiiiizzz; plug-in component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
lng_2 = ListLength(List=decomposeepconstruction_2.RValue_SI)
sort_2 = SortList(Keys=decomposeepconstruction_2.RValue_SI, ValuesA=panel_3)  # -> Keys, ValuesA
subtraction_2 = Subtraction(A=lng_2, B=1)

# ---- group: floor
floor = Brep(<brep referenced from the Rhino model>)

# ---- group: ceiling
ceiling = Brep(<brep referenced from the Rhino model>)

# ----
item_3 = ListItem(List=sort_2.ValuesA, Index=subtraction_2, Wrap=True)
walls = Brep(<brep referenced from the Rhino model>)
wall_surface_with_opening = Brep(<brep referenced from the Rhino model>)
# Geometry Preparation
panel_7 = Panel("0")
createhbsrfs = Honeybee_createHBSrfs(geometry=flatten(floor), srfType="2", EPConstruction=panel_5)  # -> readMe, simplify(HBSurface); plug-in component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
createhbsrfs_2 = Honeybee_createHBSrfs(geometry=walls, srfType=panel_7, EPConstruction=item)  # -> readMe, simplify(HBSurface); plug-in component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
createhbsrfs_3 = Honeybee_createHBSrfs(geometry=wall_surface_with_opening, srfType="0", EPBC=Slider(2, range=0..10), EPConstruction=item)  # -> readMe, simplify(HBSurface); plug-in component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
createhbsrfs_4 = Honeybee_createHBSrfs(geometry=ceiling, srfType="3")  # -> readMe, simplify(HBSurface); plug-in component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
bldgprograms = Honeybee_bldgPrograms({"Office": 0, "Retail": 1, "MidriseApartment": 2, "PrimarySchool": 3, "SecondarySchool": 4, "SmallHotel": 5, "LargeHotel": 6, "Hospital": 7, "Outpatient": 8, "Warehouse": 9, "SuperMarket": 10, "FullServiceRestaurant": 11, "QuickServiceRestaurant": 12}, selected="MidriseApartment")
glass = Brep(<brep referenced from the Rhino model>)

# ---- group: shading
brep = Brep(<brep referenced from the Rhino model>)

# ----
preview = CustomPreview(Geometry=glass, Shader=ColourSwatch(SwatchColor=RGBA(80, 222, 255, 160)))
preview_2 = CustomPreview(Geometry=brep, Shader=ColourSwatch(SwatchColor=RGBA(199, 185, 98, 160)))
makeadiabatic = Honeybee_MakeAdiabatic(HBSrfs=[createhbsrfs_2.HBSurface, createhbsrfs_4.HBSurface, createhbsrfs.HBSurface])  # -> HBSrfs; plug-in component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
wires = BrepWireframe(Brep=brep, Density=-1)
addhbglz = Honeybee_addHBGlz(
    HBObj=createhbsrfs_3.HBSurface,
    childSurfaces=flatten(glass),
    childSurfacesName=flatten("window"),
    EPConstructions=item_3)  # -> simplify(HBObjWGLZ); plug-in component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
listzoneprograms = Honeybee_ListZonePrograms(bldgProgram=bldgprograms)  # -> MidriseApartmentZonePrograms; plug-in component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
hb_epcontextsrf = HoneybeeEPContextSurfaces(shdSurfaces=flatten(brep))  # -> HBContext; inputs shdSurfaces: list of GeometryBase, justBoundingBox: Boolean
# ---------- hb_epcontextsrf: Python ----------
"""
prepare shading/context geometries

    Args:
        northVectorOrRotation: A vector that shows North or a number that shows
                               the rotation of the North from the Y axis
        bldgMasses: List of closed Breps as thermal zones.
    Returns:
        report: ...
        thermalZones: Thermal zone's geometries for visualiza
"""

ghenv.Component.Name = 'Honeybee EP context Surfaces'
ghenv.Component.NickName = 'HB_EPContextSrf'
ghenv.Component.Message = 'VER 0.0.60\nNOV_04_2016'
ghenv.Component.IconDisplayMode = ghenv.Component.IconDisplayMode.application
ghenv.Component.Category = "Honeybee"
ghenv.Component.SubCategory = "10 | Energy | Energy"
#compatibleHBVersion = VER 0.0.57\nNOV_04_2016
#compatibleLBVersion = VER 0.0.59\nFEB_01_2015
ghenv.Component.AdditionalHelpFromDocStrings = "2"

import rhinoscriptsyntax as rs
import Rhino as rc
import scriptcontext as sc
import os
import System
import Grasshopper.Kernel as gh
import uuid

tolerance = sc.doc.ModelAbsoluteTolerance
import math


def main(shdSurfaces, EPTransSchedule, meshingSettings, justBoundingBox):
    
    # import the classes
    if sc.sticky.has_key('honeybee_release'):

        try:
            if not sc.sticky['honeybee_release'].isCompatible(ghenv.Component): return -1
            if sc.sticky['honeybee_release'].isInputMissing(ghenv.Component): return -1
        except:
            warning = "You need a newer version of Honeybee to use this compoent." + \
            " Use updateHoneybee component to update userObjects.\n" + \
            "If you have already updated userObjects drag Honeybee_Honeybee component " + \
            "into canvas and try again."
            w = gh.GH_RuntimeMessageLevel.Warning
            ghenv.Component.AddRuntimeMessage(w, warning)
            return -1
        
        # don't customize this part
        hb_EPSrf = sc.sticky["honeybee_EPSurface"]
        hb_EPSHDSurface = sc.sticky["honeybee_EPShdSurface"]
        hb_RADMaterialAUX = sc.sticky["honeybee_RADMaterialAUX"]
        hb_EPObjectsAux = sc.sticky["honeybee_EPObjectsAUX"]()
        HBScheduleList = sc.sticky["honeybee_ScheduleLib"].keys()

        ########################################################################
        #----------------------------------------------------------------------#
        shdBreps = []
        # create bounding box of shading geometries
        if justBoundingBox:
            for brep in shdSurfaces:
                if brep.Faces.Count>1 or not brep.Faces[0].IsPlanar(sc.doc.ModelAbsoluteTolerance):
                    shdBreps.append(brep.GetBoundingBox(True).ToBrep())
                else:
                    shdBreps.append(brep)
        else:
            shdBreps = shdSurfaces
        
        shadingClasses = []
        shadingMeshPreview = []
        
        if meshingSettings == None:
            mp = rc.Geometry.MeshingParameters.Minimal
            mp.SimplePlanes = True
        else:
            mp = meshingSettings
        
        def getRadMaterialName(radMaterial):
            nameStr = radMaterial.split(" ")[2]
            name =  nameStr.split("\n")[0]
            return name
        
        for brepCount, brep in enumerate(shdBreps):
            if brep != None:
                isPlanar = True
                # check planarity
                for face in brep.Faces:
                    if not face.IsPlanar(tolerance):
                        isPlanar = False
                        break
                
                shadingBreps = []
                if not isPlanar:
                    meshArray = rc.Geometry.Mesh.CreateFromBrep(brep, mp)
                    for mesh in meshArray:
                        for meshFace in range(mesh.Faces.Count):
                            vertices = list(mesh.Faces.GetFaceVertices(meshFace))[1:]
                            vertices = vertices + [sc.doc.ModelAbsoluteTolerance]
                            # create the brep from mesh
                            shdBrep = rc.Geometry.Brep.CreateFromCornerPoints(*vertices)
                            shadingBreps.append(shdBrep)
                else:
                    for face in brep.Faces:
                        shadingBreps.append(face.DuplicateFace(False))
                
                for faceCount, shdBrep in enumerate(shadingBreps):
                        thisShading = hb_EPSHDSurface(shdBrep, 1000*brepCount + faceCount, 'shdSrf_' + `brepCount` + '_' + `faceCount` + "_" + str(uuid.uuid4()))
                        
                        # add transmittance schedule if any
                        if EPTransSchedule!=None:
                            schedule= EPTransSchedule.upper()
                            if schedule!=None and not schedule.lower().endswith(".csv") and schedule not in HBScheduleList:
                                msg = "Cannot find " + schedule + " in Honeybee schedule library."
                                print msg
                                ghenv.Component.AddRuntimeMessage(gh.GH_RuntimeMessageLevel.Warning, msg)
                                return -1
                            elif schedule!=None and schedule.lower().endswith(".csv"):
                                # check if csv file is existed
                                if not os.path.isfile(schedule):
                                    msg = "Cannot find the shchedule file: " + schedule
                                    print msg
                                    ghenv.Component.AddRuntimeMessage(gh.GH_RuntimeMessageLevel.Warning, msg)
                                    return -1
                            
                            thisShading.TransmittanceSCH = schedule
                        
                        # add the Rad Material if any
                        if RADMaterial!=None:
                            # if it is just the name of the material make sure it is already defined
                            if len(RADMaterial.split(" ")) == 1:
                                # if the material is not in the library add it to the library
                                if not hb_RADMaterialAUX.isMatrialExistInLibrary(RADMaterial):
                                    warningMsg = "Can't find " + RADMaterial + " in RAD Material Library.\n" + \
                                                "Add the material to the library and try again."
                                    ghenv.Component.AddRuntimeMessage(gh.GH_RuntimeMessageLevel.Warning, warningMsg)
                                    return
                                
                                try:
                                    thisShading.setRADMaterial(RADMaterial)
                                except Exception, e:
                                    print e
                                    warningMsg = "You are using an old version of Honeybee_Honeybee! Update your files and try again."
                                    print warningMsg
                                    ghenv.Component.AddRuntimeMessage(gh.GH_RuntimeMessageLevel.Warning, warningMsg)
                                    return
                                
                                addedToLib = True
                            else:
                                
                                # try to add the material to the library
                                addedToLib, thisShading.RadMaterial = hb_RADMaterialAUX.analyseRadMaterials(RADMaterial, True)
                                
                            if addedToLib==False:
                                warningMsg = "Failed to add " + RADMaterial + " to the Library."
                                ghenv.Component.AddRuntimeMessage(gh.GH_RuntimeMessageLevel.Warning, warningMsg)
                                return
                        
                        # add shading to the list
                        shadingClasses.append(thisShading)
                
        # add to the hive
        hb_hive = sc.sticky["honeybee_Hive"]()
        HBContext  = hb_hive.addToHoneybeeHive(shadingClasses, ghenv.Component)
        return HBContext
        ################################################################################################
    else:
        print "You should first let Honeybee to fly..."
        w = gh.GH_RuntimeMessageLevel.Warning
        ghenv.Component.AddRuntimeMessage(w, "You should first let Honeybee to fly...")
        return -1
        

if _shdSurfaces and _shdSurfaces[0]!=None:
    # add cleaning function
    result= main(_shdSurfaces, EPTransSchedule_, meshingSettings_, justBoundingBox_)
    
    if result != -1: HBContext = result
# ---------- end hb_epcontextsrf ----------
item_4 = ListItem(List=listzoneprograms, Index=0, Wrap=True)

# ---- group: collect all honeybee surfaces
brep_2 = Brep(flatten([makeadiabatic, addhbglz]))

# ----
panel_8 = Panel(item_4)
createhbzones = Honeybee_createHBZones(name="test_room", zoneProgram=item_4, HBSurfaces=flatten(brep_2), isConditioned=True)  # -> readMe, HBZone; plug-in component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
wires_2 = BrepWireframe(Brep=createhbzones.HBZone, Density=-1)

setepzonethresholds = Honeybee_SetEnergyPlusZoneThresholds(HBZones=createhbzones.HBZone, coolingSetPt="28")  # -> readMe, HBZones; plug-in component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
setepnatvent = Honeybee_SetEPAirFlow(
    HBZones=flatten(setepzonethresholds.HBZones),
    naturalVentilationType="1",
    minIndoorTempForNatVent="22",
    maxIndoorTempForNatVent="28")  # -> readMe, simplify(HBZones); plug-in component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

analysisperiod = Ladybug_AnalysisPeriod()  # -> readMe, analysisPeriod; plug-in component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
panel_9 = Panel("ThermalAutonomyTest")

importepw = Ladybug_ImportEpw(epwFile=epw_stat.epwFile)  # -> readMe, latitude, location, dryBulbTemperature, dewPointTemperature, relativeHumidity, windSpeed, windDirection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; plug-in component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
clofunction = Ladybug_ClothingFunction(outdoorAirTemperature=importepw.dryBulbTemperature, maxClo="1.1", maxCloTemp="10")  # -> readMe, cloValues; plug-in component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

# ----
# Run the analysis
# Put the recipie together!
# Generate annual results
# Run Energy Model
# RUN THE SIMULATION
# Calculate Clothing Function
# Visualize Underheated / Overheated Hours
# Calculate High Resolution Thermal Map
number_slider_2 = Slider(0.0001, range=0..0.0001)
ach2m3_s_m2_calculator = Honeybee_infORventPerAreaCalculator(HBZones=flatten(setepnatvent.HBZones), airFlowRate=number_slider_2, ACHorM3sM2=Toggle(True))  # -> readMe, infORventPerArea, allFloors; plug-in component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
toggle = BooleanToggle(True)
epoutput = Honeybee_GenerateEPOutput(
    zoneEnergyUse=toggle,
    zoneGainsAndLosses=toggle,
    zoneComfortMetrics=toggle,
    comfortMapVariables=toggle,
    surfaceTempAnalysis=toggle,
    surfaceEnergyAnalysis=Toggle(True))  # -> report, flatten(simulationOutputs); plug-in component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
toggle_2 = BooleanToggle(True)
searchepconstruction_5 = Honeybee_SearchEPConstruction(standard=Slider(2, range=0..10), climateZone=Slider(4, range=0..10), surfaceType=Slider(0, range=0..10))  # -> EPSelectedConstr; plug-in component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
genhbzonetestpts = Honeybee_GenerateZoneTestPoints(
    HBZone=createhbzones.HBZone,
    gridSize=Slider(0.5, range=0..1),
    distBaseSrf=Slider(0.762, range=0..1),
    moveTestMesh=Toggle(True))  # -> readMe, simplify(testPoints), simplify(ptsVectors), simplify(facesArea), simplify(mesh); plug-in component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
# Honeybee default materials will be assigned
# based on surface type
searchepconstruction_6 = Honeybee_SearchEPConstruction()  # -> EPSelectedConstr; plug-in component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
number_slider_3 = Slider(0, range=0..10)
setepzoneintcnstr = Honeybee_SetEPZoneInteriorConstruction()  # -> simplify(modifiedHBZones); plug-in component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
radparameters = Honeybee_RADParameters(quality=number_slider_3)  # -> readMe, radParameters; plug-in component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
annualdaylightsimulation = Honeybee_AnnualDaylightSimulation(
    epwWeatherFile=epw_stat.epwFile,
    testPoints=genhbzonetestpts.testPoints,
    ptsVectors=genhbzonetestpts.ptsVectors,
    testMesh=genhbzonetestpts.mesh,
    radParameters=radparameters.radParameters)  # -> analysisRecipe; plug-in component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
toggle_3 = BooleanToggle(True)
rundaylightanalysis = Honeybee_RunDaylightSimulation(
    HBObjects=flatten(createhbzones.HBZone),
    analysisRecipe=annualdaylightsimulation,
    writeRad=toggle_3,
    runRad=toggle_3,
    numOfCPUs=Slider(10, range=0..10),
    overwriteResults=True)  # -> readMe, analysisType, resultsUnit, results, testPts, annual_analysis_files, radGeoFile, studyFolder, done; plug-in component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
occupancygenerator = Honeybee_DaysimOccupancyGenerator(weekendDays=[1, 2], writeTheOcc=Toggle(True))  # -> occupancyFile; plug-in component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
readannualresultsi = Honeybee_ReadAnnualResultI(
    illFilesAddress=rundaylightanalysis.annual_analysis_files,
    testPoints=simplify(rundaylightanalysis.testPts),
    occupancyFiles=occupancygenerator,
    DLAIllumThresholds=300,
    runIt=Toggle(True))  # -> DLA, UDLI_Less_100, UDLI_100_2000, UDLI_More_2000, CDA, sDA, annualProfiles, htmReport; plug-in component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
gradientlibrary = Ladybug_GradientLibrary(gradIndex=Slider(1, range=0..10))  # -> customColors; plug-in component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
avr = Average(Input=readannualresultsi.UDLI_100_2000)
galapagos = Galapagos()
number_slider_4 = Slider(1, range=0..1)
legendpar = Ladybug_LegendParameters(
    lowBound=Slider(0, range=0..100),
    highBound=Slider(100, range=0..100),
    numSegments=Slider(6, range=0..10),
    customColors=flatten(gradientlibrary))  # -> legendPar; plug-in component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
concat = Concatenate(FragmentA=avr, FragmentB="%")
concat_2 = Concatenate(FragmentA="annual_UDI mat @self window1", FragmentB=number_slider_3)
captureview = Ladybug_CaptureView(fileName=concat_2, folder="c:\ladybug\illuminance_study", capture=rundaylightanalysis.done)  # -> imagePath; plug-in component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
# MAKE AN ENERGY BALANCE AND PLOT IT ON A CHART
# Visualize the results
recolormesh = Ladybug_RecolorMesh(
    analysisResult=readannualresultsi.UDLI_100_2000,
    inputMesh=genhbzonetestpts.mesh,
    legendPar=legendpar,
    analysisTitle=rundaylightanalysis.analysisType,
    legendTitle=concat)  # -> readMe, newMesh, newLegend, legendBasePt, meshColors, legendColors; plug-in component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
move = Move(Geometry=[recolormesh.newMesh, recolormesh.newLegend], Motion="20,0,0")  # -> Geometry, Transform

ach2m3_s_m2_calculator_2 = HoneybeeInfORventPerAreaCalculator(airChangeHour="0.04")  # -> out, infORventPerArea, allFloors; plug-in component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
setepzoneloads = Honeybee_SetEnergyPlusZoneLoads(
    HBZones=setepnatvent.HBZones,
    infiltrationRatePerArea=ach2m3_s_m2_calculator.infORventPerArea,
    numOfPeoplePerArea="0.045",
    ventilationPerArea=ach2m3_s_m2_calculator_2.infORventPerArea)  # -> loads, HBZones; plug-in component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

exporttoopenstudio = Honeybee_ExportToOpenStudio(
    epwWeatherFile=epw_stat.epwFile,
    analysisPeriod=analysisperiod.analysisPeriod,
    HBZones=flatten(createhbzones.HBZone),
    simulationOutputs=flatten(epoutput.simulationOutputs),
    writeOSM=toggle_2,
    runSimulation=toggle_2,
    fileName="windowsrf")  # -> readMe, osmFileAddress, idfFileAddress, resultFileAddress, eioFileAddress, rddFileAddress, htmlReport, studyFolder, model; plug-in component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
readepsrfresult = Honeybee_ReadEPSurfaceResult(resultFileAddress=exporttoopenstudio.resultFileAddress)  # -> surfaceIndoorTemp, surfaceOutdoorTemp, surfaceEnergyFlow, opaqueEnergyFlow, glazEnergyFlow, port, port_2, port_3, windowTransmissivity, port_4; plug-in component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
readepresult = Honeybee_ReadEPResult(resultFileAddress=exporttoopenstudio.resultFileAddress)  # -> totalThermalLoad, thermalLoadBalance, cooling, heating, electricLight, electricEquip, port, port_2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; plug-in component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

toggle_4 = BooleanToggle(True)
readepresult_2 = Honeybee_ReadEPResult(resultFileAddress=exporttoopenstudio.resultFileAddress)  # -> totalThermalLoad, thermalLoadBalance, cooling, heating, electricLight, electricEquip, port, port_2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; plug-in component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
readepsrfresult_2 = Honeybee_ReadEPSurfaceResult(resultFileAddress=exporttoopenstudio.resultFileAddress)  # -> surfaceIndoorTemp, surfaceOutdoorTemp, surfaceEnergyFlow, opaqueEnergyFlow, glazEnergyFlow, port, port_2, port_3, windowTransmissivity, port_4; plug-in component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
indoorviewfactor = Honeybee_IndoorViewFactorCalculator(HBZones=flatten(createhbzones.HBZone), gridSize="1", parallel=Toggle(True), buildMesh=toggle_4, runIt=toggle_4)  # -> readMe, port, viewFactorMesh, viewFactorInfo, port_2, testPts, viewMeshFaces, zoneWireFrame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; plug-in component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
pmvcomfrecipe = Honeybee_PMVComfortAnalysisRecipe(
    viewFactorMesh=indoorviewfactor.viewFactorMesh,
    viewFactorInfo=indoorviewfactor.viewFactorInfo,
    epwFile=epw_stat.epwFile,
    srfIndoorTemp=readepsrfresult_2.surfaceIndoorTemp,
    zoneAirTemp=readepresult_2.airTemperature,
    zoneRelHumid=readepresult_2.relativeHumidity,
    zoneAirFlowVol=readepresult_2.airFlowVolume,
    zoneAirHeatGain=readepresult_2.airHeatGainRate,
    metabolicRate="1.2",
    clothingLevel=clofunction.cloValues)  # -> comfRecipe; plug-in component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
microclimatemap = Honeybee_MicroclimateMapAnalysis(
    comfAnalysisRecipe=pmvcomfrecipe,
    fileName="test",
    analysisPeriodOrHOY=analysisperiod.analysisPeriod,
    writeResultFile=Toggle(True),
    parallel=Toggle(True),
    runIt=Toggle(True))  # -> readMe, port, radTempMtx, airTempMtx, SET_Mtx, PMVComfMtx, PMV_Mtx, port_2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; plug-in component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

thermalautonomy = Honeybee_ThermalAutonomyAnalysis(
    comfResultsMtx=microclimatemap.PMVComfMtx,
    degOrPMVMtx=microclimatemap.PMV_Mtx,
    viewFactorMesh=flatten(indoorviewfactor.viewFactorMesh),
    HBZones=flatten(createhbzones.HBZone),
    totalThermalEnergy=readepresult_2.totalThermalLoad,
    runIt=Toggle(True))  # -> readMe, port, occTCP_Mtx, TA_Mtx, OverHeatedMtx, UnderHeatedMtx, port_2, occTCP_Result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; plug-in component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
visualizemicroclimate = Honeybee_VisualizeMicroclimateMap(comfResultsMtx=thermalautonomy.OverHeatedMtx, viewFactorMesh=flatten(indoorviewfactor.viewFactorMesh))  # -> readMe, port, resultMesh, legend, legendBasePt, port_2, resultValues, resultColors; plug-in component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
move_2 = Move(Geometry=indoorviewfactor.zoneWireFrame, Motion="30,0,0")  # -> Geometry, Transform
move_3 = Move(Geometry=[visualizemicroclimate.resultMesh, visualizemicroclimate.legend], Motion="30,0,0")  # -> Geometry, Transform
preview_3 = CustomPreview(Geometry=[indoorviewfactor.zoneWireFrame, move_2.Geometry], Shader=ColourSwatch(SwatchColor=RGB(0, 0, 0)))

energybalance = Honeybee_ConstructEnergyBalance(
    HBZones=flatten(createhbzones.HBZone),
    cooling=readepresult.cooling,
    heating=readepresult.heating,
    electricLight=readepresult.electricLight,
    electricEquip=readepresult.electricEquip,
    fanElectric=readepresult.port,
    peopleGains=readepresult.peopleGains,
    totalSolarGain=readepresult.totalSolarGain,
    infiltrationEnergy=readepresult.infiltrationEnergy,
    mechVentilationEnergy=readepresult.mechVentilationEnergy,
    natVentEnergy=readepresult.port_3,
    surfaceEnergyFlow=readepsrfresult.surfaceEnergyFlow)  # -> readMe, port, flrNormEnergyBal, flrNormBalWStorage, port_2, modelEnergyBalance, energyBalWithStorage; plug-in component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
gradientlibrary_2 = Ladybug_GradientLibrary(gradIndex="19")  # -> customColors; plug-in component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
legendpar_2 = Ladybug_LegendParameters(customColors=flatten(gradientlibrary_2))  # -> legendPar; plug-in component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

selectandaveragedata = Ladybug_AverageData(annualHourlyData=energybalance.flrNormBalWStorage, totalOrAverage=Toggle(True))  # -> readMe, selHourlyData, totaledDaily, totaledMonthly, totMonthlyPerHour, totAnalysisPeriod; plug-in component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
barchart = Ladybug_MonthlyBarChart(
    inputData=flatten(selectandaveragedata.totaledMonthly),
    stackValues=Toggle(True),
    altTitle="Dorm Room Energy Balance",
    altYAxisTitle="Energy (kWh)",
    legendPar=legendpar_2)  # -> readMe, dataMesh, dataCurves, dataCrvColors, graphAxes, graphLabels, title, titleBasePt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; plug-in component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
visualizemicroclimate_2 = Honeybee_VisualizeMicroclimateMap(comfResultsMtx=thermalautonomy.UnderHeatedMtx, viewFactorMesh=flatten(indoorviewfactor.viewFactorMesh))  # -> readMe, port, resultMesh, legend, legendBasePt, port_2, resultValues, resultColors; plug-in component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
move_4 = Move(Geometry=indoorviewfactor.zoneWireFrame, Motion="40,0,0")  # -> Geometry, Transform
move_5 = Move(Geometry=[visualizemicroclimate_2.resultMesh, visualizemicroclimate_2.legend], Motion="40,0,0")  # -> Geometry, Transform
preview_4 = CustomPreview(Geometry=[indoorviewfactor.zoneWireFrame, move_4.Geometry], Shader=ColourSwatch(SwatchColor=RGB(0, 0, 0)))

preview_5 = CustomPreview(Geometry=barchart.graphAxes, Shader=ColourSwatch(SwatchColor=RGB(0, 0, 0)))
