# Grasshopper definition wang_yuchi.gh (Grasshopper 0.9.76)
# plug-ins: Python Interpreter

ladybug = Ladybug_Ladybug()  # -> Vviiiiiiiiiizzz; plug-in component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
honeybee = Honeybee_Honeybee()  # -> Vviiiiiiiiiizzz; plug-in component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

pt = Point(<point referenced from the Rhino model>)
# Northpoint Setup
northarrow = Ladybug_North(centerPt=pt, scale="0.075")  # -> northSign; plug-in component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
# Daylighting
preview = CustomPreview(Geometry=northarrow, Shader=ColourSwatch(SwatchColor=RGB(0, 0, 0)))

# ---- group: INNER_WALL
brep = Brep([<brep referenced from the Rhino model> x5])

# ---- group: EXTERIOR_WALL
brep_2 = Brep(<brep referenced from the Rhino model>)

# ---- group: ROOF
brep_3 = Brep(<brep referenced from the Rhino model>)

# ---- group: FLOOR
brep_4 = Brep(<brep referenced from the Rhino model>)

# ----
# Energy Simulation
# Prepare Geometry
createhbsrfs = Honeybee_createHBSrfs(geometry=brep, srfType="0")  # -> readMe, simplify(HBSurface); plug-in component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
createhbsrfs_2 = Honeybee_createHBSrfs(geometry=brep_2, srfType="0")  # -> readMe, simplify(HBSurface); plug-in component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
createhbsrfs_3 = Honeybee_createHBSrfs(geometry=brep_3, srfType="1")  # -> readMe, simplify(HBSurface); plug-in component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
createhbsrfs_4 = Honeybee_createHBSrfs(geometry=brep_4, srfType="2")  # -> readMe, simplify(HBSurface); plug-in component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
# ROOM SETUP
makeadiabatic = Honeybee_MakeAdiabatic(HBSrfs=createhbsrfs.HBSurface)  # -> HBSrfs; plug-in component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
makeadiabatic_2 = Honeybee_MakeAdiabatic(HBSrfs=createhbsrfs_4.HBSurface)  # -> HBSrfs; plug-in component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
merge = Merge(Data1=makeadiabatic, Data2=createhbsrfs_2.HBSurface, Data3=createhbsrfs_3.HBSurface, Data4=makeadiabatic_2)
bldgprograms = Honeybee_bldgPrograms({"Office": 0, "Retail": 1, "MidriseApartment": 2, "PrimarySchool": 3, "SecondarySchool": 4, "SmallHotel": 5, "LargeHotel": 6, "Hospital": 7, "Outpatient": 8, "Warehouse": 9, "SuperMarket": 10, "FullServiceRestaurant": 11, "QuickServiceRestaurant": 12}, selected="MidriseApartment")
listzoneprograms = Honeybee_ListZonePrograms(bldgProgram=bldgprograms)  # -> MidriseApartmentZonePrograms; plug-in component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
item = ListItem(List=listzoneprograms, Index=0, Wrap=True)
createhbzones = Honeybee_createHBZones(name="APARTMENT_PHILLY", zoneProgram=item, HBSurfaces=flatten(merge), isConditioned=Toggle(False))  # -> readMe, HBZone; plug-in component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

# ---- group: Airwall
brep_5 = Brep(<brep referenced from the Rhino model>)

# ---- group: shading
brep_6 = Brep([<brep referenced from the Rhino model> x8])

# ----
panel_3 = Panel("""EnergyChart
AdaptiveComf""")
createhbsrfs_5 = Honeybee_createHBSrfs(geometry=brep_5, srfType="4")  # -> readMe, simplify(HBSurface); plug-in component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
createhbsrfs_6 = Honeybee_createHBSrfs(geometry=brep_6, srfType="6")  # -> readMe, simplify(HBSurface); plug-in component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

# ----
# Download EPW File
panel_4 = Panel("https://www.energyplus.net/weather-download/north_and_central_america_wmo_region_4/USA/PA/USA_PA_Philadelphia.Intl.AP.724080_TMY3/all")
epw_stat = Ladybug_OpenEPWAndSTATWeatherFiles(weatherFileURL=panel_4)  # -> epwFile, statFile; plug-in component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

path = FilePath("\\juno.design.upenn.edu\home\grad\arch\yuchwang\Desktop\Philadelphia_weather_files\USA_PA_Philadelphia.Intl.AP.724080_TMY3.epw")
# Climate Analysis
importepw = Ladybug_ImportEpw(epwFile=path)  # -> readMe, latitude, location, dryBulbTemperature, dewPointTemperature, relativeHumidity, windSpeed, windDirection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; plug-in component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
analysisperiod = Ladybug_AnalysisPeriod(fromMonth="3", fromDay="20", toMonth="6", toDay="21")  # -> readMe, analysisPeriod; plug-in component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

# ----
# Wind Rose
windrose = Ladybug_WindRose(
    north=0,
    hourlyWindDirection=importepw.windDirection,
    hourlyWindSpeed=importepw.windSpeed,
    annualHourlyData=flatten(importepw.dryBulbTemperature),
    analysisPeriod=analysisperiod.analysisPeriod,
    conditionalStatement="b>22 and b<30",
    runIt=Toggle(True))  # -> readMe, calmRoseMesh, windRoseMesh, windRoseCrvs, windRoseCenPts, legend, legendBasePts, title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; plug-in component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
preview_2 = CustomPreview(Geometry=windrose.windRoseCrvs, Shader=ColourSwatch(SwatchColor=RGBA(0, 0, 0, 135)))

# ---- group: ANNUAL DAYLIGHTING SIMULATION
toggle = BooleanToggle(False)

# ----
radparameters = Honeybee_RADParameters(quality=0, ab="3")  # -> readMe, radParameters; plug-in component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

# ---- group: ENERGY SIMULATION
toggle_2 = BooleanToggle(False)

# ---- group: Fly
toggle_3 = BooleanToggle(False)

# ---- group: Create Zone and Glazing
toggle_4 = BooleanToggle(True)

# ----
radglassmaterial = Honeybee_RadianceGlassMaterial(materialName=" Glass_60", RTransmittance="0.6", GTransmittance="0.6", BTransmittance="0.6", refractiveIndex=1.52)  # -> avrgTrans, RADMaterial; plug-in component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
# Glazing Setup
glzparamlist = Honeybee_GlazingParametersList(northGlzParam=0, westGlzParam=0, southGlzParam="0.4", eastGlzParam=0)  # -> glzParamList; plug-in component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
glazingcreator = Honeybee_GlazingBasedOnRatio(
    HBObjects=createhbzones.HBZone,
    glzRatio=glzparamlist,
    breakUpDist="3",
    RADMaterials=radglassmaterial.RADMaterial,
    runIt=toggle_4)  # -> readMe, HBObjWGLZ; plug-in component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

genhbzonetestpts = Honeybee_GenerateZoneTestPoints(HBZone=glazingcreator.HBObjWGLZ, gridSize="0.5", distBaseSrf="0.762", moveTestMesh=True)  # -> readMe, simplify(testPoints), simplify(ptsVectors), simplify(facesArea), simplify(mesh); plug-in component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

srfattributelist = Honeybee_SurfaceAttributeList({"Name": "name", "Radiance Material": "RadMaterial", "EnergyPlus Construction": "EPConstruction", "Surface Type": "type", "Boundary Condition": "BC", "Sun Exposure": "sunExposure", "Wind Exposure": "windExposure", "Has Child Surface": "hasChild", "Is Child Surface": "isChild", "Is Planar": "isPlanar", "Srf Type Set By User": "srfTypeByUser", "Boundary Condition Set By User": "srfBCByUser", "Shade Material Name": "shadeMaterialName", "Shading Control Name": "shadingControlName", "Shcading Schedule Name": "shadingSchName"}, selected="Surface Type")
# Show Surface Info
toggle_5 = BooleanToggle(False)
labelsurfaces = Honeybee_LabelZoneSurfaces(HBObjects=flatten(glazingcreator.HBObjWGLZ), attribute=srfattributelist, windows=toggle_5)  # -> surfaceTxtLabels, labelBasePts, brepTxtLabels, surfaceWireFrames; plug-in component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

annualdaylightsimulation = Honeybee_AnnualDaylightSimulation(
    epwWeatherFile=path,
    testPoints=genhbzonetestpts.testPoints,
    ptsVectors=genhbzonetestpts.ptsVectors,
    testMesh=genhbzonetestpts.mesh,
    radParameters=radparameters.radParameters)  # -> analysisRecipe; plug-in component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
fly = Ladybug_fly(fly=toggle_3)  # -> Vviiiiiiiiiizzz; plug-in component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

toggle_6 = BooleanToggle(True)
solaradjusttemperature = Ladybug_OutdoorSolarTemperatureAdjustor(
    location=importepw.location,
    cumSkyMtxOrDirNormRad=importepw.directNormalRadiation,
    diffuseHorizRad=importepw.diffuseHorizontalRadiation,
    baseTemperature=importepw.dryBulbTemperature,
    horizInfraredRad=importepw.horizontalInfraredRadiation,
    runIt=toggle_6)  # -> readMe, port, effectiveRadiantField, MRTDelta, solarAdjustedMRT, port_2, mannequinMesh, port_3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; plug-in component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
outdoorcomfortcalculator = Ladybug_OutdoorComfortCalculator(
    dryBulbTemperature=importepw.dryBulbTemperature,
    meanRadiantTemperature=solaradjusttemperature.solarAdjustedMRT,
    windSpeed_tenMeters=importepw.windSpeed,
    relativeHumidity=importepw.relativeHumidity,
    runIt=toggle_6)  # -> readMe, port, universalThermalClimateIndex, comfortableOrNot, thermalStress, conditionOfPerson, port_2, percentOfTimeComfortable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; plug-in component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
# UTCI
panel_5 = Panel("-10")
legendpar = Ladybug_LegendParameters(lowBound=panel_5, highBound="30", numSegments="11")  # -> legendPar; plug-in component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
_3dchart = Ladybug_3DChart(inputData=flatten(outdoorcomfortcalculator.universalThermalClimateIndex), xScale="0.25", zScale="0", legendPar=legendpar)  # -> readMe, graphMesh, graphCurves, legend, legendBasePts, title, titleBasePts, dataPts, conditionalHOY; plug-in component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

# ----
# Wireframe Preview
swatch = ColourSwatch(SwatchColor=RGB(0, 0, 0))
wires = BrepWireframe(Brep=[glazingcreator.HBObjWGLZ, brep_6], Density=-1)

preview_3 = CustomPreview(Geometry=wires, Shader=swatch)
panel_7 = Panel("""wall
window
roof
floor""")
# Change Construction
callfromepconstrlibrary = Honeybee_CallFromEPConstructionLibrary()  # -> ThermMaterials, EPMaterials, EPWindowMaterials, EPConstructions; plug-in component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
panel_9 = Panel("""0
4
1
2""")
# Sort Construction
searchepconstruction = Honeybee_SearchEPConstruction(EPConstrList=callfromepconstrlibrary.EPConstructions, standard="2", climateZone="4", surfaceType=panel_9)  # -> EPSelectedConstr; plug-in component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
decomposeepconstruction = Honeybee_DecomposeEPConstruction(cnstrName=searchepconstruction)  # -> materials, comments, UValue_SI, UValue_IP, RValue_SI, RValue_IP; plug-in component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
sort = SortList(Keys=decomposeepconstruction.RValue_SI, ValuesA=searchepconstruction)  # -> Keys, ValuesA
bang = ExplodeTree(Data=sort.ValuesA)  # -> Branch0, Branch1, Branch2, Branch3

# ----
# Check R Value
decomposeepconstruction_2 = Honeybee_DecomposeEPConstruction(cnstrName=bang.Branch0)  # -> materials, comments, UValue_SI, UValue_IP, RValue_SI, RValue_IP; plug-in component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
decomposeepconstruction_3 = Honeybee_DecomposeEPConstruction(cnstrName=bang.Branch3)  # -> materials, comments, UValue_SI, UValue_IP, RValue_SI, RValue_IP; plug-in component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
decomposeepconstruction_4 = Honeybee_DecomposeEPConstruction(cnstrName=bang.Branch1)  # -> materials, comments, UValue_SI, UValue_IP, RValue_SI, RValue_IP; plug-in component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
decomposeepconstruction_5 = Honeybee_DecomposeEPConstruction(cnstrName=bang.Branch2)  # -> materials, comments, UValue_SI, UValue_IP, RValue_SI, RValue_IP; plug-in component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
panel_10 = Panel(decomposeepconstruction_2.RValue_IP)
panel_11 = Panel(decomposeepconstruction_3.RValue_SI)
panel_12 = Panel(decomposeepconstruction_4.UValue_IP)
panel_13 = Panel(decomposeepconstruction_5.RValue_SI)

item_2 = ListItem(List=bang.Branch0, Index="5", Wrap=True)
item_3 = ListItem(List=bang.Branch1, Index="1", Wrap=True)
item_4 = ListItem(List=bang.Branch2, Index="1", Wrap=True)
item_5 = ListItem(List=bang.Branch3, Index="0", Wrap=True)

rundaylightanalysis = Honeybee_RunDaylightSimulation(
    HBObjects=flatten(glazingcreator.HBObjWGLZ),
    analysisRecipe=annualdaylightsimulation,
    writeRad=toggle,
    runRad=toggle,
    overwriteResults=True)  # -> readMe, analysisType, resultsUnit, results, testPts, resultFiles, radGeoFile, studyFolder, done; plug-in component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
readannualresultsi = Honeybee_ReadAnnualResultI(
    illFilesAddress=rundaylightanalysis.resultFiles,
    testPoints=simplify(genhbzonetestpts.testPoints),
    ptsVectors=genhbzonetestpts.ptsVectors,
    DLAIllumThresholds=300,
    runIt=Toggle(True))  # -> DLA, UDLI_Less_100, UDLI_100_2000, UDLI_More_2000, CDA, sDA, annualProfiles, htmReport; plug-in component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
panel_14 = Panel(readannualresultsi.sDA)
legendpar_2 = Ladybug_LegendParameters(lowBound="0", highBound="100", numSegments="11")  # -> legendPar; plug-in component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
concat = Concatenate(
    FragmentA="Daylight Autonomy (DLA)",
    FragmentC="300 Lux Thresholds",
    FragmentD="sDA : ",
    FragmentE=readannualresultsi.sDA)
recolormesh = Ladybug_RecolorMesh(
    analysisResult=readannualresultsi.DLA,
    inputMesh=genhbzonetestpts.mesh,
    legendPar=legendpar_2,
    analysisTitle=concat,
    legendTitle="%")  # -> readMe, newMesh, newLegend, legendBasePt, meshColors, legendColors; plug-in component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

uip2usi = Ladybug_uIP2uSI(U_IP="0.9")  # -> U_SI; plug-in component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
epwindowmat = Honeybee_EnergyPlusWindowMaterial(name="New_Glass", U_Value=uip2usi, SHGC="0.76", VT="0.81")  # -> EPMaterial; plug-in component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
gradientlibrary = Ladybug_GradientLibrary(gradIndex="1")  # -> customColors; plug-in component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
epconstruction = Honeybee_EnergyPlusConstruction(name="New_Glass_Construction", layer_1=epwindowmat)  # -> EPConstruction; plug-in component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
setepzonecnstr = Honeybee_SetEPZoneConstruction(
    HBZones=flatten(glazingcreator.HBObjWGLZ),
    wallEPConstruction=item_2,
    windowEPConstruction=epconstruction,
    roofEPConstruction=item_4,
    floorEPConstruction=item_5)  # -> simplify(modifiedHBZones); plug-in component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

legendpar_3 = Ladybug_LegendParameters(lowBound="-10", highBound="30", numSegments="11")  # -> legendPar; plug-in component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
# Dry Bulb Temperature
panel_16 = Panel("0.25")
_3dchart_2 = Ladybug_3DChart(inputData=flatten(importepw.dryBulbTemperature), xScale=panel_16, zScale="0", legendPar=legendpar_3)  # -> readMe, graphMesh, graphCurves, legend, legendBasePts, title, titleBasePts, dataPts, conditionalHOY; plug-in component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

# ----
# Relative Humidity
legendpar_4 = Ladybug_LegendParameters(lowBound="20", highBound="80", numSegments="11", customColors=flatten(gradientlibrary))  # -> legendPar; plug-in component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
_3dchart_3 = Ladybug_3DChart(inputData=flatten(importepw.relativeHumidity), xScale="0.25", zScale="0", legendPar=legendpar_4)  # -> readMe, graphMesh, graphCurves, legend, legendBasePts, title, titleBasePts, dataPts, conditionalHOY; plug-in component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

panel_17 = Panel("28")
# Add Airflow
setepnatvent = Honeybee_SetEPAirFlow(
    HBZones=flatten(setepzonecnstr),
    naturalVentilationType="1",
    minIndoorTempForNatVent="24",
    minOutdoorTempForNatVent="22",
    maxOutdoorTempForNatVent="30")  # -> readMe, simplify(HBZones); plug-in component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
legendpar_5 = Ladybug_LegendParameters(lowBound="0", highBound="100", numSegments="11")  # -> legendPar; plug-in component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
panel_18 = Panel(epconstruction)
# Lighting Schedule From
# Daylighing Simulation
path_2 = FilePath("\\juno.design.upenn.edu\home\grad\arch\yuchwang\Desktop\BuildingSimulation\05_Final_Project\06_Change_Construction\unnamed_0_space_0_intgain.csv")
recolormesh_2 = Ladybug_RecolorMesh(
    analysisResult=readannualresultsi.UDLI_100_2000,
    inputMesh=genhbzonetestpts.mesh,
    legendPar=legendpar_5,
    analysisTitle="UDLI 100-2000 Lux",
    legendTitle="%")  # -> readMe, newMesh, newLegend, legendBasePt, meshColors, legendColors; plug-in component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
# Setup Simulation
# Add Daylight Schedule
setepzoneschedules = Honeybee_SetEnergyPlusZoneSchedules(HBZones=setepnatvent.HBZones, lightingSchedules=flatten(path_2))  # -> schedules, simplify(HBZones); plug-in component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
# Add Context Shading
hb_epcontextsrf = HoneybeeEPContextSurfaces(shdSurfaces=flatten(brep_6))  # -> HBContext; inputs shdSurfaces: list of Brep, justBoundingBox: Boolean
# ---------- hb_epcontextsrf: Python ----------
"""
prepare shading/context geometries

    Args:
        northVectorOrRotation: A vector that shows North or a number that shows
                               the rotation of the North from the Y axis
        bldgMasses: List of closed Breps as thermal zones.
    Returns:
        report: ...
        thermalZones: Thermal zone's geometries for visualiza
"""

ghenv.Component.Name = 'Honeybee EP context Surfaces'
ghenv.Component.NickName = 'HB_EPContextSrf'
ghenv.Component.Message = 'VER 0.0.62\nJUL_28_2017'
ghenv.Component.IconDisplayMode = ghenv.Component.IconDisplayMode.application
ghenv.Component.Category = "Honeybee"
ghenv.Component.SubCategory = "10 | Energy | Energy"
#compatibleHBVersion = VER 0.0.57\nNOV_04_2016
#compatibleLBVersion = VER 0.0.59\nFEB_01_2015
ghenv.Component.AdditionalHelpFromDocStrings = "2"

import rhinoscriptsyntax as rs
import Rhino as rc
import scriptcontext as sc
import os
import System
import Grasshopper.Kernel as gh
import uuid

tolerance = sc.doc.ModelAbsoluteTolerance
import math


def main(shdSurfaces, EPTransSchedule, meshingSettings, justBoundingBox):
    
    # import the classes
    if sc.sticky.has_key('honeybee_release'):

        try:
            if not sc.sticky['honeybee_release'].isCompatible(ghenv.Component): return -1
            if sc.sticky['honeybee_release'].isInputMissing(ghenv.Component): return -1
        except:
            warning = "You need a newer version of Honeybee to use this compoent." + \
            " Use updateHoneybee component to update userObjects.\n" + \
            "If you have already updated userObjects drag Honeybee_Honeybee component " + \
            "into canvas and try again."
            w = gh.GH_RuntimeMessageLevel.Warning
            ghenv.Component.AddRuntimeMessage(w, warning)
            return -1
        
        # don't customize this part
        hb_EPSrf = sc.sticky["honeybee_EPSurface"]
        hb_EPSHDSurface = sc.sticky["honeybee_EPShdSurface"]
        hb_RADMaterialAUX = sc.sticky["honeybee_RADMaterialAUX"]
        hb_EPObjectsAux = sc.sticky["honeybee_EPObjectsAUX"]()
        HBScheduleList = sc.sticky["honeybee_ScheduleLib"].keys()

        ########################################################################
        #----------------------------------------------------------------------#
        shdBreps = []
        # create bounding box of shading geometries
        if justBoundingBox:
            for brep in shdSurfaces:
                if brep.Faces.Count>1 or not brep.Faces[0].IsPlanar(sc.doc.ModelAbsoluteTolerance):
                    shdBreps.append(brep.GetBoundingBox(True).ToBrep())
                else:
                    shdBreps.append(brep)
        else:
            shdBreps = shdSurfaces
        
        shadingClasses = []
        shadingMeshPreview = []
        
        if meshingSettings == None:
            mp = rc.Geometry.MeshingParameters.Minimal
            mp.SimplePlanes = True
        else:
            mp = meshingSettings
        
        def getRadMaterialName(radMaterial):
            nameStr = radMaterial.split(" ")[2]
            name =  nameStr.split("\n")[0]
            return name
        
        for brepCount, brep in enumerate(shdBreps):
            if brep != None:
                isPlanar = True
                # check planarity
                for face in brep.Faces:
                    if not face.IsPlanar(tolerance):
                        isPlanar = False
                        break
                
                shadingBreps = []
                if not isPlanar:
                    meshArray = rc.Geometry.Mesh.CreateFromBrep(brep, mp)
                    for mesh in meshArray:
                        for meshFace in range(mesh.Faces.Count):
                            vertices = list(mesh.Faces.GetFaceVertices(meshFace))[1:]
                            vertices = vertices + [sc.doc.ModelAbsoluteTolerance]
                            # create the brep from mesh
                            shdBrep = rc.Geometry.Brep.CreateFromCornerPoints(*vertices)
                            shadingBreps.append(shdBrep)
                else:
                    for face in brep.Faces:
                        shadingBreps.append(face.DuplicateFace(False))
                
                for faceCount, shdBrep in enumerate(shadingBreps):
                        thisShading = hb_EPSHDSurface(shdBrep, 1000*brepCount + faceCount, 'shdSrf_' + `brepCount` + '_' + `faceCount` + "_" + str(uuid.uuid4()))
                        
                        # add transmittance schedule if any
                        if EPTransSchedule!=None:
                            schedule= EPTransSchedule.upper()
                            if schedule!=None and not schedule.lower().endswith(".csv") and schedule not in HBScheduleList:
                                msg = "Cannot find " + schedule + " in Honeybee schedule library."
                                print msg
                                ghenv.Component.AddRuntimeMessage(gh.GH_RuntimeMessageLevel.Warning, msg)
                                return -1
                            elif schedule!=None and schedule.lower().endswith(".csv"):
                                # check if csv file is existed
                                if not os.path.isfile(schedule):
                                    msg = "Cannot find the shchedule file: " + schedule
                                    print msg
                                    ghenv.Component.AddRuntimeMessage(gh.GH_RuntimeMessageLevel.Warning, msg)
                                    return -1
                            
                            thisShading.TransmittanceSCH = schedule
                        
                        # add the Rad Material if any
                        if RADMaterial!=None:
                            # if it is just the name of the material make sure it is already defined
                            if len(RADMaterial.split(" ")) == 1:
                                # if the material is not in the library add it to the library
                                if not hb_RADMaterialAUX.isMatrialExistInLibrary(RADMaterial):
                                    warningMsg = "Can't find " + RADMaterial + " in RAD Material Library.\n" + \
                                                "Add the material to the library and try again."
                                    ghenv.Component.AddRuntimeMessage(gh.GH_RuntimeMessageLevel.Warning, warningMsg)
                                    return
                                
                                try:
                                    thisShading.setRADMaterial(RADMaterial)
                                except Exception, e:
                                    print e
                                    warningMsg = "You are using an old version of Honeybee_Honeybee! Update your files and try again."
                                    print warningMsg
                                    ghenv.Component.AddRuntimeMessage(gh.GH_RuntimeMessageLevel.Warning, warningMsg)
                                    return
                                
                                addedToLib = True
                            else:
                                
                                # try to add the material to the library
                                addedToLib, thisShading.RadMaterial = hb_RADMaterialAUX.analyseRadMaterials(RADMaterial, True)
                                
                            if addedToLib==False:
                                warningMsg = "Failed to add " + RADMaterial + " to the Library."
                                ghenv.Component.AddRuntimeMessage(gh.GH_RuntimeMessageLevel.Warning, warningMsg)
                                return
                        
                        # add shading to the list
                        shadingClasses.append(thisShading)
                
        # add to the hive
        hb_hive = sc.sticky["honeybee_Hive"]()
        HBContext  = hb_hive.addToHoneybeeHive(shadingClasses, ghenv.Component)
        return HBContext
        ################################################################################################
    else:
        print "You should first let Honeybee to fly..."
        w = gh.GH_RuntimeMessageLevel.Warning
        ghenv.Component.AddRuntimeMessage(w, "You should first let Honeybee to fly...")
        return -1
        

if _shdSurfaces and _shdSurfaces[0]!=None:
    # add cleaning function
    result= main(_shdSurfaces, EPTransSchedule_, meshingSettings_, justBoundingBox_)
    
    if result != -1: HBContext = result
# ---------- end hb_epcontextsrf ----------
legendpar_6 = Ladybug_LegendParameters(lowBound="0", highBound="100", numSegments="11")  # -> legendPar; plug-in component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
toggle_7 = BooleanToggle(True)
recolormesh_3 = Ladybug_RecolorMesh(
    analysisResult=readannualresultsi.UDLI_More_2000,
    inputMesh=genhbzonetestpts.mesh,
    legendPar=legendpar_6,
    analysisTitle="UDLI >2000 Lux",
    legendTitle="%")  # -> readMe, newMesh, newLegend, legendBasePt, meshColors, legendColors; plug-in component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
epoutput = Honeybee_GenerateEPOutput(
    zoneEnergyUse=toggle_7,
    zoneGainsAndLosses=toggle_7,
    zoneComfortMetrics=toggle_7,
    surfaceTempAnalysis="False",
    surfaceEnergyAnalysis=toggle_7)  # -> report, flatten(simulationOutputs); plug-in component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
runenergysimulation = Honeybee_RunEnergySimulation(
    epwFile=path,
    HBZones=flatten(setepzoneschedules.HBZones),
    HBContext=flatten(hb_epcontextsrf),
    simulationOutputs=flatten(epoutput.simulationOutputs),
    writeIdf=toggle_2,
    runEnergyPlus=toggle_2)  # -> report, idfFileAddress, htmlReport, resultFileAddress; plug-in component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
# Run Simulation
readepresult = Honeybee_ReadEPResult(resultFileAddress=runenergysimulation.resultFileAddress)  # -> totalThermalLoad, thermalLoadBalance, cooling, heating, electricLight, electricEquip, fanElectric, pumpElectric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; plug-in component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
readepsrfresult = Honeybee_ReadEPSurfaceResult(resultFileAddress=runenergysimulation.resultFileAddress)  # -> surfaceIndoorTemp, surfaceOutdoorTemp, surfaceEnergyFlow, opaqueEnergyFlow, glazEnergyFlow, windowTotalSolarEnergy, windowBeamEnergy, windowDiffEnergy, windowTransmissivity, otherSurfaceData; plug-in component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

# ----
# Post-production
# Comfort
# PMV
pmvcomfortcalculator = Ladybug_PMVComfortCalculator(
    dryBulbTemperature=readepresult.airTemperature,
    meanRadiantTemperature=readepresult.meanRadTemperature,
    relativeHumidity=readepresult.relativeHumidity,
    calcBalanceTemperature=False,
    runIt=Toggle(True))  # -> readMe, port, predictedMeanVote, percentPeopleDissatisfied, standardEffectiveTemperature, port_2, comfortableOrNot, percentOfTimeComfortable, port_3, balanceTemperature; plug-in component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

# ----
# Adaptive Comfort
adaptivecomfortcalculator = Ladybug_AdaptiveComfortCalculator(
    dryBulbTemperature=readepresult.airTemperature,
    meanRadiantTemperature=readepresult.meanRadTemperature,
    prevailingOutdoorTemp=importepw.dryBulbTemperature,
    runIt=Toggle(True))  # -> readMe, port, comfortableOrNot, conditionOfPerson, degreesFromTarget, port_2, targetTemperature, upperTemperatureBound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; plug-in component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

concat_2 = Concatenate(FragmentA="Glz_", FragmentC="_adaComf_", FragmentD=adaptivecomfortcalculator.percentOfTimeComfortable)
panel_21 = Panel(concat_2)

# ----
# Energy Balance
energybalance = Honeybee_ConstructEnergyBalance(
    HBZones=flatten(setepzonecnstr),
    cooling=readepresult.cooling,
    heating=readepresult.heating,
    electricLight=readepresult.electricLight,
    electricEquip=readepresult.electricEquip,
    fanElectric=readepresult.fanElectric,
    peopleGains=readepresult.peopleGains,
    totalSolarGain=readepresult.totalSolarGain,
    infiltrationEnergy=readepresult.infiltrationEnergy,
    mechVentilationEnergy=readepresult.mechVentilationEnergy,
    natVentEnergy=readepresult.natVentEnergy,
    surfaceEnergyFlow=readepsrfresult.surfaceEnergyFlow)  # -> readMe, port, flrNormEnergyBal, flrNormBalWStorage, port_2, modelEnergyBalance, energyBalWithStorage; plug-in component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

panel_22 = Panel(pmvcomfortcalculator.percentOfTimeComfortable)
panel_23 = Panel(adaptivecomfortcalculator.percentOfTimeComfortable)
captureview = Ladybug_CaptureView(
    fileName=panel_23,
    viewNames=graft(panel_3),
    imageWidth="3000",
    displayMode="Wireframe",
    keepAspectR=Toggle(True),
    capture=Toggle(False))  # -> imagePath; plug-in component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
gradientlibrary_2 = Ladybug_GradientLibrary(gradIndex="19")  # -> customColors; plug-in component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
selectandaveragedata = Ladybug_AverageData(annualHourlyData=energybalance.energyBalWithStorage, totalOrAverage=Toggle(True))  # -> readMe, selHourlyData, totaledDaily, totaledMonthly, totMonthlyPerHour, totAnalysisPeriod; plug-in component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
gradientlibrary_3 = Ladybug_GradientLibrary(gradIndex="13")  # -> customColors; plug-in component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
strnum = Ladybug_SeparateData(inputList=flatten(adaptivecomfortcalculator.comfortableOrNot))  # -> numbers, strings; plug-in component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
legendpar_7 = Ladybug_LegendParameters(lowBound="-1", highBound="1", numSegments="3", customColors=flatten(gradientlibrary_3))  # -> legendPar; plug-in component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
legendpar_8 = Ladybug_LegendParameters(customColors=flatten(gradientlibrary_2))  # -> legendPar; plug-in component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
# Visualization
ma = MassAddition(Input=strnum.numbers)  # -> Result, PartialResults
division = Division(A=ma.Result, B=8760)
pt_2 = Point(Point(-3.640537141, -621.7568791, 0))
panel_24 = Panel(division)
barchart = Ladybug_MonthlyBarChart(
    inputData=flatten(selectandaveragedata.totaledMonthly),
    stackValues=Toggle(True),
    altTitle="Energy Balance",
    altYAxisTitle="Energy (KWh)",
    basePoint=pt_2,
    legendPar=legendpar_8)  # -> readMe, dataMesh, dataCurves, dataCrvColors, graphAxes, graphLabels, title, titleBasePt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; plug-in component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
_3dchart_4 = Ladybug_3DChart(inputData=flatten(adaptivecomfortcalculator.conditionOfPerson), xScale="0.25", zScale="0", legendPar=legendpar_7)  # -> readMe, graphMesh, graphCurves, legend, legendBasePts, title, titleBasePts, dataPts, conditionalHOY; plug-in component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
geo = Geometry(_3dchart_4.graphMesh)
