# Grasshopper definition zhang_yunlong.gh (Grasshopper 0.9.76)
# plug-ins: Python Interpreter

floor_roof = Brep([<brep referenced from the Rhino model> x2])
walls = Brep([<brep referenced from the Rhino model> x7])
outdoors = Brep(<brep referenced from the Rhino model>)

floor_roof_2 = Brep([<brep referenced from the Rhino model> x2])
walls_2 = Brep([<brep referenced from the Rhino model> x6])
outdoors_2 = Brep(<brep referenced from the Rhino model>)

# ----
# GEOMETRY
floor_roof_3 = Brep([<brep referenced from the Rhino model> x2])
walls_3 = Brep([<brep referenced from the Rhino model> x3])
outdoors_3 = Brep(<brep referenced from the Rhino model>)

floor_roof_4 = Brep([<brep referenced from the Rhino model> x2])
walls_4 = Brep([<brep referenced from the Rhino model> x6])
outdoors_4 = Brep(<brep referenced from the Rhino model>)

createhbsrfs = Honeybee_createHBSrfs(geometry=outdoors_2)  # -> readMe, simplify(HBSurface); plug-in component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
createhbsrfs_2 = Honeybee_createHBSrfs(geometry=walls_2, EPBC="Adiabatic")  # -> readMe, simplify(HBSurface); plug-in component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
createhbsrfs_3 = Honeybee_createHBSrfs(geometry=floor_roof_2, EPBC="Adiabatic")  # -> readMe, simplify(HBSurface); plug-in component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
glazingcreator = Honeybee_GlazingBasedOnRatio(HBObjects=createhbsrfs.HBSurface, glzRatio="0.35", breakUpDist="4", windowHeight="3", runIt=Toggle(True))  # -> readMe, HBObjWGLZ; plug-in component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

createhbsrfs_4 = Honeybee_createHBSrfs(geometry=outdoors)  # -> readMe, simplify(HBSurface); plug-in component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
createhbsrfs_5 = Honeybee_createHBSrfs(geometry=walls, EPBC="Adiabatic")  # -> readMe, simplify(HBSurface); plug-in component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
createhbsrfs_6 = Honeybee_createHBSrfs(geometry=floor_roof, EPBC="Adiabatic")  # -> readMe, simplify(HBSurface); plug-in component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
glazingcreator_2 = Honeybee_GlazingBasedOnRatio(HBObjects=createhbsrfs_4.HBSurface, glzRatio="0.6", breakUpDist="4", windowHeight="2.25", runIt=Toggle(True))  # -> readMe, HBObjWGLZ; plug-in component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

createhbsrfs_7 = Honeybee_createHBSrfs(geometry=outdoors_3)  # -> readMe, simplify(HBSurface); plug-in component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
createhbsrfs_8 = Honeybee_createHBSrfs(geometry=walls_3, EPBC="Adiabatic")  # -> readMe, simplify(HBSurface); plug-in component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
createhbsrfs_9 = Honeybee_createHBSrfs(geometry=floor_roof_3, EPBC="Adiabatic")  # -> readMe, simplify(HBSurface); plug-in component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
glazingcreator_3 = Honeybee_GlazingBasedOnRatio(HBObjects=createhbsrfs_7.HBSurface, glzRatio="0.35", breakUpDist="4", windowHeight="2.25", runIt=Toggle(True))  # -> readMe, HBObjWGLZ; plug-in component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

createhbsrfs_10 = Honeybee_createHBSrfs(geometry=outdoors_4)  # -> readMe, simplify(HBSurface); plug-in component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
createhbsrfs_11 = Honeybee_createHBSrfs(geometry=walls_4, EPBC="Adiabatic")  # -> readMe, simplify(HBSurface); plug-in component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
createhbsrfs_12 = Honeybee_createHBSrfs(geometry=floor_roof_4, EPBC="Adiabatic")  # -> readMe, simplify(HBSurface); plug-in component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
glazingcreator_4 = Honeybee_GlazingBasedOnRatio(
    HBObjects=createhbsrfs_10.HBSurface,
    glzRatio="0.2",
    breakUpDist="4",
    windowHeight="1",
    sillHeight="3",
    runIt=Toggle(True))  # -> readMe, HBObjWGLZ; plug-in component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

createhbzones = Honeybee_createHBZones(
    name="Living room",
    HBSurfaces=flatten([createhbsrfs_6.HBSurface, glazingcreator_2.HBObjWGLZ, createhbsrfs_5.HBSurface]),
    isConditioned=Toggle(True))  # -> readMe, HBZone; plug-in component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

createhbzones_2 = Honeybee_createHBZones(
    name="Bedroom1",
    HBSurfaces=flatten([createhbsrfs_3.HBSurface, glazingcreator.HBObjWGLZ, createhbsrfs_2.HBSurface]),
    isConditioned=Toggle(True))  # -> readMe, HBZone; plug-in component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

createhbzones_3 = Honeybee_createHBZones(
    name="Bedroom2",
    HBSurfaces=flatten([createhbsrfs_9.HBSurface, glazingcreator_3.HBObjWGLZ, createhbsrfs_8.HBSurface]),
    isConditioned=Toggle(True))  # -> readMe, HBZone; plug-in component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

createhbzones_4 = Honeybee_createHBZones(
    name="Entrence",
    HBSurfaces=flatten([createhbsrfs_12.HBSurface, glazingcreator_4.HBObjWGLZ, createhbsrfs_11.HBSurface]),
    isConditioned=Toggle(True))  # -> readMe, HBZone; plug-in component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

ladybug = Ladybug_Ladybug()  # -> Vviiiiiiiiiizzz; plug-in component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
honeybee = Honeybee_Honeybee()  # -> Vviiiiiiiiiizzz; plug-in component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

floor_roof_5 = Brep([<brep referenced from the Rhino model> x2])
walls_5 = Brep([<brep referenced from the Rhino model> x7])
outdoors_5 = Brep(<brep referenced from the Rhino model>)

floor_roof_6 = Brep([<brep referenced from the Rhino model> x2])
walls_6 = Brep([<brep referenced from the Rhino model> x5])
outdoors_6 = Brep(<brep referenced from the Rhino model>)

floor_roof_7 = Brep([<brep referenced from the Rhino model> x2])
walls_7 = Brep([<brep referenced from the Rhino model> x2])
outdoors_7 = Brep(<brep referenced from the Rhino model>)

floor_roof_8 = Brep([<brep referenced from the Rhino model> x2])
walls_8 = Brep([<brep referenced from the Rhino model> x6])
outdoors_8 = Brep(<brep referenced from the Rhino model>)

panel = Panel(ladybug)
outdoors1 = Brep(<brep referenced from the Rhino model>)
# GEOMETRY
outdoors1_2 = Brep(<brep referenced from the Rhino model>)

createhbsrfs_13 = Honeybee_createHBSrfs(geometry=outdoors1_2)  # -> readMe, simplify(HBSurface); plug-in component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
createhbsrfs_14 = Honeybee_createHBSrfs(geometry=outdoors_6)  # -> readMe, simplify(HBSurface); plug-in component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
createhbsrfs_15 = Honeybee_createHBSrfs(geometry=walls_6, EPBC="Adiabatic")  # -> readMe, simplify(HBSurface); plug-in component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
createhbsrfs_16 = Honeybee_createHBSrfs(geometry=floor_roof_6, EPBC="Adiabatic")  # -> readMe, simplify(HBSurface); plug-in component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
glazingcreator_5 = Honeybee_GlazingBasedOnRatio(HBObjects=createhbsrfs_14.HBSurface, glzRatio="0.6", breakUpDist="2", windowHeight="5", runIt=Toggle(True))  # -> readMe, HBObjWGLZ; plug-in component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
glazingcreator_6 = Honeybee_GlazingBasedOnRatio(HBObjects=createhbsrfs_13.HBSurface, glzRatio="0.4", breakUpDist="2", windowHeight="4", runIt=Toggle(True))  # -> readMe, HBObjWGLZ; plug-in component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

createhbsrfs_17 = Honeybee_createHBSrfs(geometry=outdoors_5)  # -> readMe, simplify(HBSurface); plug-in component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
createhbsrfs_18 = Honeybee_createHBSrfs(geometry=walls_5, EPBC="Adiabatic")  # -> readMe, simplify(HBSurface); plug-in component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
createhbsrfs_19 = Honeybee_createHBSrfs(geometry=floor_roof_5, EPBC="Adiabatic")  # -> readMe, simplify(HBSurface); plug-in component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
glazingcreator_7 = Honeybee_GlazingBasedOnRatio(HBObjects=createhbsrfs_17.HBSurface, glzRatio="0.6", breakUpDist="1", windowHeight="5", runIt=Toggle(True))  # -> readMe, HBObjWGLZ; plug-in component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

createhbsrfs_20 = Honeybee_createHBSrfs(geometry=outdoors1)  # -> readMe, simplify(HBSurface); plug-in component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
createhbsrfs_21 = Honeybee_createHBSrfs(geometry=outdoors_7)  # -> readMe, simplify(HBSurface); plug-in component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
createhbsrfs_22 = Honeybee_createHBSrfs(geometry=walls_7, EPBC="Adiabatic")  # -> readMe, simplify(HBSurface); plug-in component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
createhbsrfs_23 = Honeybee_createHBSrfs(geometry=floor_roof_7, EPBC="Adiabatic")  # -> readMe, simplify(HBSurface); plug-in component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
glazingcreator_8 = Honeybee_GlazingBasedOnRatio(HBObjects=createhbsrfs_20.HBSurface, glzRatio="0.6", breakUpDist="2", windowHeight="5", runIt=Toggle(True))  # -> readMe, HBObjWGLZ; plug-in component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
glazingcreator_9 = Honeybee_GlazingBasedOnRatio(HBObjects=createhbsrfs_21.HBSurface, glzRatio="0.6", breakUpDist="2", windowHeight="5", runIt=Toggle(True))  # -> readMe, HBObjWGLZ; plug-in component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

createhbsrfs_24 = Honeybee_createHBSrfs(geometry=outdoors_8)  # -> readMe, simplify(HBSurface); plug-in component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
createhbsrfs_25 = Honeybee_createHBSrfs(geometry=walls_8, EPBC="Adiabatic")  # -> readMe, simplify(HBSurface); plug-in component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
createhbsrfs_26 = Honeybee_createHBSrfs(geometry=floor_roof_8, EPBC="Adiabatic")  # -> readMe, simplify(HBSurface); plug-in component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
glazingcreator_10 = Honeybee_GlazingBasedOnRatio(
    HBObjects=createhbsrfs_24.HBSurface,
    glzRatio="0.2",
    breakUpDist="4",
    windowHeight="1",
    sillHeight="3",
    runIt=Toggle(True))  # -> readMe, HBObjWGLZ; plug-in component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

createhbzones_5 = Honeybee_createHBZones(
    name="Living room",
    HBSurfaces=flatten([createhbsrfs_19.HBSurface, glazingcreator_7.HBObjWGLZ, createhbsrfs_18.HBSurface]),
    isConditioned=Toggle(True))  # -> readMe, HBZone; plug-in component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

createhbzones_6 = Honeybee_createHBZones(
    name="Bedroom2",
    HBSurfaces=flatten([createhbsrfs_23.HBSurface, glazingcreator_9.HBObjWGLZ, createhbsrfs_22.HBSurface, glazingcreator_8.HBObjWGLZ]),
    isConditioned=Toggle(True))  # -> readMe, HBZone; plug-in component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

createhbzones_7 = Honeybee_createHBZones(
    name="Entrence",
    HBSurfaces=flatten([createhbsrfs_26.HBSurface, glazingcreator_10.HBObjWGLZ, createhbsrfs_25.HBSurface]),
    isConditioned=Toggle(True))  # -> readMe, HBZone; plug-in component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

createhbzones_8 = Honeybee_createHBZones(
    name="Bedroom1",
    HBSurfaces=flatten([createhbsrfs_16.HBSurface, glazingcreator_5.HBObjWGLZ, createhbsrfs_15.HBSurface, glazingcreator_6.HBObjWGLZ]),
    isConditioned=Toggle(True))  # -> readMe, HBZone; plug-in component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

all_zones = Geometry(flatten([createhbzones_2.HBZone, createhbzones.HBZone, createhbzones_3.HBZone, createhbzones_4.HBZone]))
all_zones_2 = Geometry(flatten([createhbzones_6.HBZone, createhbzones_7.HBZone, createhbzones_8.HBZone, createhbzones_5.HBZone]))
solveadjc = Honeybee_SolveAdjacencies(HBZones=flatten(all_zones), removeCurrentAdjc=False, findAdjc=Toggle(True))  # -> readMe, HBZonesWADJ; plug-in component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
wires = BrepWireframe(Brep=solveadjc.HBZonesWADJ, Density=-1)

u_value_btu_h_ft2_f = Panel("0.2")
construction_name = Panel("Triple Pane")
shgc = Panel("0.2")
uip2usi = Ladybug_uIP2uSI(U_IP=u_value_btu_h_ft2_f)  # -> U_SI; plug-in component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
vt = Panel("0.2")
epwindowmat = Honeybee_EnergyPlusWindowMaterial(name=construction_name, U_Value=uip2usi, SHGC=shgc, VT=vt)  # -> EPMaterial; plug-in component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
epconstruction = Honeybee_EnergyPlusConstruction(name=construction_name, layer_1=epwindowmat)  # -> EPConstruction; plug-in component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

r_value_h_ft2_f_btu = Panel("32.2")
construction_name_2 = Panel("Floor")
rip2rsi = Ladybug_rIP2rSI(R_IP=r_value_h_ft2_f_btu)  # -> R_SI; plug-in component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
epnomassmat = Honeybee_EnergyPlusNoMassOpaqueMaterial(name=construction_name_2, R_Value=rip2rsi)  # -> EPMaterial; plug-in component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
epconstruction_2 = Honeybee_EnergyPlusConstruction(name=construction_name_2, layer_1=epnomassmat)  # -> EPConstruction; plug-in component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

r_value_h_ft2_f_btu_2 = Panel("48.1")
construction_name_3 = Panel("Walls")
rip2rsi_2 = Ladybug_rIP2rSI(R_IP=r_value_h_ft2_f_btu_2)  # -> R_SI; plug-in component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
epnomassmat_2 = Honeybee_EnergyPlusNoMassOpaqueMaterial(name=construction_name_3, R_Value=rip2rsi_2)  # -> EPMaterial; plug-in component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
epconstruction_3 = Honeybee_EnergyPlusConstruction(name=construction_name_3, layer_1=epnomassmat_2)  # -> EPConstruction; plug-in component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

r_value_h_ft2_f_btu_3 = Panel("34.4")
construction_name_4 = Panel("Roof")
rip2rsi_3 = Ladybug_rIP2rSI(R_IP=r_value_h_ft2_f_btu_3)  # -> R_SI; plug-in component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
epnomassmat_3 = Honeybee_EnergyPlusNoMassOpaqueMaterial(name=construction_name_4, R_Value=rip2rsi_3)  # -> EPMaterial; plug-in component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
epconstruction_4 = Honeybee_EnergyPlusConstruction(name=construction_name_4, layer_1=epnomassmat_3)  # -> EPConstruction; plug-in component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

# ----
# Shading_rotate_change1
brep = Brep([<brep referenced from the Rhino model> x15])

# ----
# Shading_rotate_change2
brep_2 = Brep([<brep referenced from the Rhino model> x15])

setepzonecnstr = Honeybee_SetEPZoneConstruction(
    HBZones=flatten(solveadjc.HBZonesWADJ),
    wallEPConstruction=epconstruction_3,
    windowEPConstruction=epconstruction,
    roofEPConstruction=epconstruction_4,
    expFloorEPConstruction=epconstruction_2)  # -> simplify(modifiedHBZones); plug-in component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
panel_2 = Panel(setepzonecnstr)
wires_2 = BrepWireframe(Brep=setepzonecnstr, Density=-1)

# ----
# Shading_strit1
brep_3 = Brep([<brep referenced from the Rhino model> x15])

# ----
# Shading_arry
brep_4 = Brep([<brep referenced from the Rhino model> x100])

hb_epcontextsrf = HoneybeeEPContextSurfaces(shdSurfaces=flatten(brep))  # -> HBContext; inputs shdSurfaces: list of Brep, justBoundingBox: Boolean
# ---------- hb_epcontextsrf: Python ----------
"""
prepare shading/context geometries

    Args:
        northVectorOrRotation: A vector that shows North or a number that shows
                               the rotation of the North from the Y axis
        bldgMasses: List of closed Breps as thermal zones.
    Returns:
        report: ...
        thermalZones: Thermal zone's geometries for visualiza
"""

ghenv.Component.Name = 'Honeybee EP context Surfaces'
ghenv.Component.NickName = 'HB_EPContextSrf'
ghenv.Component.Message = 'VER 0.0.62\nJUL_28_2017'
ghenv.Component.IconDisplayMode = ghenv.Component.IconDisplayMode.application
ghenv.Component.Category = "Honeybee"
ghenv.Component.SubCategory = "10 | Energy | Energy"
#compatibleHBVersion = VER 0.0.57\nNOV_04_2016
#compatibleLBVersion = VER 0.0.59\nFEB_01_2015
ghenv.Component.AdditionalHelpFromDocStrings = "2"

import rhinoscriptsyntax as rs
import Rhino as rc
import scriptcontext as sc
import os
import System
import Grasshopper.Kernel as gh
import uuid

tolerance = sc.doc.ModelAbsoluteTolerance
import math


def main(shdSurfaces, EPTransSchedule, meshingSettings, justBoundingBox):
    
    # import the classes
    if sc.sticky.has_key('honeybee_release'):

        try:
            if not sc.sticky['honeybee_release'].isCompatible(ghenv.Component): return -1
            if sc.sticky['honeybee_release'].isInputMissing(ghenv.Component): return -1
        except:
            warning = "You need a newer version of Honeybee to use this compoent." + \
            " Use updateHoneybee component to update userObjects.\n" + \
            "If you have already updated userObjects drag Honeybee_Honeybee component " + \
            "into canvas and try again."
            w = gh.GH_RuntimeMessageLevel.Warning
            ghenv.Component.AddRuntimeMessage(w, warning)
            return -1
        
        # don't customize this part
        hb_EPSrf = sc.sticky["honeybee_EPSurface"]
        hb_EPSHDSurface = sc.sticky["honeybee_EPShdSurface"]
        hb_RADMaterialAUX = sc.sticky["honeybee_RADMaterialAUX"]
        hb_EPObjectsAux = sc.sticky["honeybee_EPObjectsAUX"]()
        HBScheduleList = sc.sticky["honeybee_ScheduleLib"].keys()

        ########################################################################
        #----------------------------------------------------------------------#
        shdBreps = []
        # create bounding box of shading geometries
        if justBoundingBox:
            for brep in shdSurfaces:
                if brep.Faces.Count>1 or not brep.Faces[0].IsPlanar(sc.doc.ModelAbsoluteTolerance):
                    shdBreps.append(brep.GetBoundingBox(True).ToBrep())
                else:
                    shdBreps.append(brep)
        else:
            shdBreps = shdSurfaces
        
        shadingClasses = []
        shadingMeshPreview = []
        
        if meshingSettings == None:
            mp = rc.Geometry.MeshingParameters.Minimal
            mp.SimplePlanes = True
        else:
            mp = meshingSettings
        
        def getRadMaterialName(radMaterial):
            nameStr = radMaterial.split(" ")[2]
            name =  nameStr.split("\n")[0]
            return name
        
        for brepCount, brep in enumerate(shdBreps):
            if brep != None:
                isPlanar = True
                # check planarity
                for face in brep.Faces:
                    if not face.IsPlanar(tolerance):
                        isPlanar = False
                        break
                
                shadingBreps = []
                if not isPlanar:
                    meshArray = rc.Geometry.Mesh.CreateFromBrep(brep, mp)
                    for mesh in meshArray:
                        for meshFace in range(mesh.Faces.Count):
                            vertices = list(mesh.Faces.GetFaceVertices(meshFace))[1:]
                            vertices = vertices + [sc.doc.ModelAbsoluteTolerance]
                            # create the brep from mesh
                            shdBrep = rc.Geometry.Brep.CreateFromCornerPoints(*vertices)
                            shadingBreps.append(shdBrep)
                else:
                    for face in brep.Faces:
                        shadingBreps.append(face.DuplicateFace(False))
                
                for faceCount, shdBrep in enumerate(shadingBreps):
                        thisShading = hb_EPSHDSurface(shdBrep, 1000*brepCount + faceCount, 'shdSrf_' + `brepCount` + '_' + `faceCount` + "_" + str(uuid.uuid4()))
                        
                        # add transmittance schedule if any
                        if EPTransSchedule!=None:
                            schedule= EPTransSchedule.upper()
                            if schedule!=None and not schedule.lower().endswith(".csv") and schedule not in HBScheduleList:
                                msg = "Cannot find " + schedule + " in Honeybee schedule library."
                                print msg
                                ghenv.Component.AddRuntimeMessage(gh.GH_RuntimeMessageLevel.Warning, msg)
                                return -1
                            elif schedule!=None and schedule.lower().endswith(".csv"):
                                # check if csv file is existed
                                if not os.path.isfile(schedule):
                                    msg = "Cannot find the shchedule file: " + schedule
                                    print msg
                                    ghenv.Component.AddRuntimeMessage(gh.GH_RuntimeMessageLevel.Warning, msg)
                                    return -1
                            
                            thisShading.TransmittanceSCH = schedule
                        
                        # add the Rad Material if any
                        if RADMaterial!=None:
                            # if it is just the name of the material make sure it is already defined
                            if len(RADMaterial.split(" ")) == 1:
                                # if the material is not in the library add it to the library
                                if not hb_RADMaterialAUX.isMatrialExistInLibrary(RADMaterial):
                                    warningMsg = "Can't find " + RADMaterial + " in RAD Material Library.\n" + \
                                                "Add the material to the library and try again."
                                    ghenv.Component.AddRuntimeMessage(gh.GH_RuntimeMessageLevel.Warning, warningMsg)
                                    return
                                
                                try:
                                    thisShading.setRADMaterial(RADMaterial)
                                except Exception, e:
                                    print e
                                    warningMsg = "You are using an old version of Honeybee_Honeybee! Update your files and try again."
                                    print warningMsg
                                    ghenv.Component.AddRuntimeMessage(gh.GH_RuntimeMessageLevel.Warning, warningMsg)
                                    return
                                
                                addedToLib = True
                            else:
                                
                                # try to add the material to the library
                                addedToLib, thisShading.RadMaterial = hb_RADMaterialAUX.analyseRadMaterials(RADMaterial, True)
                                
                            if addedToLib==False:
                                warningMsg = "Failed to add " + RADMaterial + " to the Library."
                                ghenv.Component.AddRuntimeMessage(gh.GH_RuntimeMessageLevel.Warning, warningMsg)
                                return
                        
                        # add shading to the list
                        shadingClasses.append(thisShading)
                
        # add to the hive
        hb_hive = sc.sticky["honeybee_Hive"]()
        HBContext  = hb_hive.addToHoneybeeHive(shadingClasses, ghenv.Component)
        return HBContext
        ################################################################################################
    else:
        print "You should first let Honeybee to fly..."
        w = gh.GH_RuntimeMessageLevel.Warning
        ghenv.Component.AddRuntimeMessage(w, "You should first let Honeybee to fly...")
        return -1
        

if _shdSurfaces and _shdSurfaces[0]!=None:
    # add cleaning function
    result= main(_shdSurfaces, EPTransSchedule_, meshingSettings_, justBoundingBox_)
    
    if result != -1: HBContext = result
# ---------- end hb_epcontextsrf ----------
epoutput = Honeybee_GenerateEPOutput(zoneGainsAndLosses="False", zoneComfortMetrics=Toggle(True), surfaceTempAnalysis="False")  # -> report, flatten(simulationOutputs); plug-in component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

panel_3 = Panel("21")
panel_4 = Panel("9")
panel_5 = Panel("3")

panel_6 = Panel("12")

panel_8 = Panel("6")

toggle = BooleanToggle(True)

panel_21 = Panel("15")

ach2m3_s_m2_calculator = HoneybeeInfORventPerAreaCalculator(HBZones=flatten(setepzonecnstr), airChangeHour="0.5")  # -> out, infORventPerArea, allFloors; plug-in component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
setepzoneloads = Honeybee_SetEnergyPlusZoneLoads(HBZones=setepzonecnstr, numOfPeoplePerArea="0.12", ventilationPerArea=ach2m3_s_m2_calculator.infORventPerArea)  # -> loads, HBZones; plug-in component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

panel_27 = Panel("https://www.energyplus.net/weather-download/north_and_central_america_wmo_region_4/USA/NH/USA_NH_Berlin.Muni.AP.726160_TMY3/all")
epw_stat = Ladybug_OpenEPWAndSTATWeatherFiles(weatherFileURL=panel_27)  # -> epwFile, statFile; plug-in component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
runenergysimulation = Honeybee_RunEnergySimulation(
    epwFile=epw_stat.epwFile,
    HBZones=flatten(setepzonecnstr),
    HBContext=flatten(hb_epcontextsrf),
    simulationOutputs=flatten(epoutput.simulationOutputs),
    writeIdf=toggle,
    runEnergyPlus=toggle)  # -> report, idfFileAddress, htmlReport, resultFileAddress; plug-in component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

toggle_2 = BooleanToggle(True)
epoutput_2 = Honeybee_GenerateEPOutput(
    zoneEnergyUse=toggle_2,
    zoneGainsAndLosses=toggle_2,
    zoneComfortMetrics="False",
    surfaceTempAnalysis="False",
    surfaceEnergyAnalysis=toggle_2)  # -> report, flatten(simulationOutputs); plug-in component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

setepnatvent = Honeybee_SetEPAirFlow(
    HBZones=flatten(setepzonecnstr),
    naturalVentilationType="1",
    minIndoorTempForNatVent="24",
    maxIndoorTempForNatVent="27",
    minOutdoorTempForNatVent="25",
    maxOutdoorTempForNatVent="30")  # -> readMe, simplify(HBZones); plug-in component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
brep_5 = Brep([<brep referenced from the Rhino model> x15])
hb_epcontextsrf_2 = HoneybeeEPContextSurfaces(shdSurfaces=flatten(brep_5))  # -> HBContext; inputs shdSurfaces: list of Brep, justBoundingBox: Boolean; same code as hb_epcontextsrf
epoutput_3 = Honeybee_GenerateEPOutput(zoneGainsAndLosses="False", zoneComfortMetrics=Toggle(True), surfaceTempAnalysis="False")  # -> report, flatten(simulationOutputs); plug-in component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
toggle_3 = BooleanToggle(True)

panel_28 = Panel("March.21st.12pm")

panel_29 = Panel("Dec.21st.9am")

gentestpts = Honeybee_GenerateTestPoints(gridSize="0.5", distBaseSrf="0.75", moveTestMesh=True)  # -> out, simplify(testPoints), simplify(ptsVectors), simplify(facesArea), simplify(mesh); plug-in component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
radparameters = Honeybee_RADParameters(quality="0")  # -> out, radParameters; plug-in component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
file_path = FilePath("D:\Upenn\2017-2\ARCH-753-001-Building Performance\20170918CLASS-02\berlin\USA_NH_Berlin.Muni.AP.726160_TMY3.epw")
genclimatebasedsky = Honeybee_GenerateClimateBasedSky(weatherFile=file_path, month="12", day="21", hour="9")  # -> out, skyFilePath; plug-in component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
gridbasedsimulation = Honeybee_GridBasedSimulation(
    skyFile=genclimatebasedsky.skyFilePath,
    testPoints=gentestpts.testPoints,
    ptsVectors=gentestpts.ptsVectors,
    simulationType=0,
    radParameters=radparameters.radParameters)  # -> analysisRecipe; plug-in component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
legendpar = Ladybug_LegendParameters(lowBound="100", highBound="2000")  # -> legendPar; plug-in component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
rundaylightanalysis = Honeybee_RunDaylightSimulation(analysisRecipe=gridbasedsimulation, writeRad=Toggle(True), runRad=Toggle(True), overwriteResults=True)  # -> out, analysisType, resultsUnit, results, testPts, resultFiles, radGeoFile, studyFolder, done; plug-in component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
recolormesh = Ladybug_RecolorMesh(
    analysisResult=rundaylightanalysis.results,
    inputMesh=gentestpts.mesh,
    legendPar=legendpar,
    analysisTitle="June.21st.12pm",
    legendTitle="LUX")  # -> out, newMesh, newLegend, legendBasePt, meshColors, legendColors; plug-in component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

exporttoopenstudio = Honeybee_ExportToOpenStudio(
    epwWeatherFile=epw_stat.epwFile,
    HBZones=flatten(setepzoneloads.HBZones),
    HBContext=flatten(hb_epcontextsrf_2),
    simulationOutputs=flatten(epoutput_2.simulationOutputs),
    writeOSM=toggle_3,
    runSimulation=toggle_3)  # -> readMe, osmFileAddress, idfFileAddress, resultFileAddress, eioFileAddress, rddFileAddress, htmlReport, studyFolder, model; plug-in component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
readepsrfresult = Honeybee_ReadEPSurfaceResult(resultFileAddress=exporttoopenstudio.resultFileAddress)  # -> port, port_2, surfaceEnergyFlow, opaqueEnergyFlow, glazEnergyFlow, port_3, port_4, port_5, port_6, port_7; plug-in component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
readepresult = Honeybee_ReadEPResult(resultFileAddress=exporttoopenstudio.resultFileAddress)  # -> totalThermalLoad, thermalLoadBalance, cooling, heating, electricLight, electricEquip, port, port_2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; plug-in component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

brep_6 = Brep([<brep referenced from the Rhino model> x15])
hb_epcontextsrf_3 = HoneybeeEPContextSurfaces(shdSurfaces=flatten(brep_6))  # -> HBContext; inputs shdSurfaces: list of Brep, justBoundingBox: Boolean; same code as hb_epcontextsrf
toggle_4 = BooleanToggle(True)
runenergysimulation_2 = Honeybee_RunEnergySimulation(
    epwFile=epw_stat.epwFile,
    HBZones=flatten([setepnatvent.HBZones, setepzonecnstr]),
    HBContext=flatten(hb_epcontextsrf_3),
    simulationOutputs=flatten(epoutput_3.simulationOutputs),
    writeIdf=toggle_4,
    runEnergyPlus=toggle_4)  # -> report, idfFileAddress, htmlReport, resultFileAddress; plug-in component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
readepresult_2 = Honeybee_ReadEPResult(resultFileAddress=runenergysimulation_2.resultFileAddress)  # -> port, port_2, port_3, port_4, port_5, port_6, port_7, port_8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; plug-in component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
importepw = Ladybug_ImportEpw(epwFile=epw_stat.epwFile)  # -> readMe, latitude, location, dryBulbTemperature, dewPointTemperature, relativeHumidity, windSpeed, windDirection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; plug-in component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
adaptivecomfortcalculator = Ladybug_AdaptiveComfortCalculator(
    dryBulbTemperature=readepresult_2.airTemperature,
    meanRadiantTemperature=readepresult_2.meanRadTemperature,
    prevailingOutdoorTemp=importepw.dryBulbTemperature,
    runIt=Toggle(True))  # -> readMe, port, comfortableOrNot, conditionOfPerson, degreesFromTarget, port_2, targetTemperature, upperTemperatureBound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; plug-in component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
point = Point(<point referenced from the Rhino model>)
_3dchart = Ladybug_3DChart(inputData=flatten(adaptivecomfortcalculator.conditionOfPerson), xScale="0.2", zScale="0")  # -> readMe, graphMesh, graphCurves, legend, legendBasePts, title, titleBasePts, dataPts, conditionalHOY; plug-in component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

energybalance = Honeybee_ConstructEnergyBalance(
    HBZones=flatten(setepzoneloads.HBZones),
    cooling=readepresult.cooling,
    heating=readepresult.heating,
    electricLight=readepresult.electricLight,
    electricEquip=readepresult.electricEquip,
    fanElectric=readepresult.port,
    peopleGains=readepresult.peopleGains,
    totalSolarGain=readepresult.totalSolarGain,
    infiltrationEnergy=readepresult.infiltrationEnergy,
    mechVentilationEnergy=readepresult.mechVentilationEnergy,
    natVentEnergy=readepresult.port_3,
    surfaceEnergyFlow=readepsrfresult.surfaceEnergyFlow)  # -> readMe, port, flrNormEnergyBal, flrNormBalWStorage, port_2, modelEnergyBalance, energyBalWithStorage; plug-in component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
gradientlibrary = Ladybug_GradientLibrary(gradIndex="19")  # -> customColors; plug-in component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
legendpar_2 = Ladybug_LegendParameters(highBound="100", customColors=flatten(gradientlibrary))  # -> legendPar; plug-in component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
selectandaveragedata = Ladybug_AverageData(annualHourlyData=energybalance.flrNormBalWStorage, totalOrAverage=Toggle(True))  # -> readMe, selHourlyData, totaledDaily, totaledMonthly, totMonthlyPerHour, totAnalysisPeriod; plug-in component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

barchart = Ladybug_MonthlyBarChart(
    inputData=flatten(selectandaveragedata.totaledMonthly),
    stackValues=Toggle(True),
    altTitle="Patient Room Energy Balance",
    altYAxisTitle="Energy (kWh)",
    basePoint=point,
    legendPar=legendpar_2)  # -> readMe, dataMesh, dataCurves, dataCrvColors, graphAxes, graphLabels, title, titleBasePt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; plug-in component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

preview = CustomPreview(Geometry=barchart.graphAxes, Shader=ColourSwatch(SwatchColor=RGB(0, 0, 0)))
