# Grasshopper definition zhao_xiaoyu.gh (Grasshopper 0.9.76)
# plug-ins: Python Interpreter

honeybee = Honeybee_Honeybee()  # -> Vviiiiiiiiiizzz; plug-in component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
bldgprograms = Honeybee_bldgPrograms({"Office": 0, "Retail": 1, "MidriseApartment": 2, "PrimarySchool": 3, "SecondarySchool": 4, "SmallHotel": 5, "LargeHotel": 6, "Hospital": 7, "Outpatient": 8, "Warehouse": 9, "SuperMarket": 10, "FullServiceRestaurant": 11, "QuickServiceRestaurant": 12}, selected="MidriseApartment")
ladybug = Ladybug_Ladybug()  # -> Vviiiiiiiiiizzz; plug-in component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
box = DomainBox(Base=PlaneXY(0, 0, 0), X="4", Y="4.9", Z="3")
listzoneprograms = Honeybee_ListZonePrograms(bldgProgram=bldgprograms)  # -> MidriseApartmentZonePrograms; plug-in component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
panel = Panel([ladybug, honeybee])
item = ListItem(List=listzoneprograms, Index=0, Wrap=True)
mass2zone = Honeybee_Masses2Zones(
    zoneMasses=flatten(box),
    zoneNames="my room",
    zonePrograms=item,
    isConditioned=Toggle(False),
    maxRoofAngle=30,
    createHBZones=Toggle(True))  # -> readMe, HBZones; plug-in component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
glzparamlist = Honeybee_GlazingParametersList(northGlzParam=0, westGlzParam=0, southGlzParam=Slider(0.2, range=0..1), eastGlzParam=Slider(0.1, range=0..1))  # -> glzParamList; plug-in component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
callfromepconstrlibrary = Honeybee_CallFromEPConstructionLibrary()  # -> ThermMaterials, EPMaterials, EPWindowMaterials, EPConstructions; plug-in component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
callfromepconstrlibrary_2 = Honeybee_CallFromEPConstructionLibrary()  # -> ThermMaterials, EPMaterials, EPWindowMaterials, EPConstructions; plug-in component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
panel_2 = Panel("""1
1
1
1
1
1
1
1
0
0
0
0
0
0
0
0
0
0
0
0
1
1
1
1""")
brep = Brep([<brep referenced from the Rhino model> x8])
genhbzonetestpts = Honeybee_GenerateZoneTestPoints(HBZone=mass2zone.HBZones, gridSize="0.5", distBaseSrf="1", moveTestMesh=True)  # -> readMe, simplify(testPoints), simplify(ptsVectors), simplify(facesArea), simplify(mesh); plug-in component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
createhbsrfs = Honeybee_createHBSrfs(geometry=brep, srfType="6")  # -> readMe, simplify(HBSurface); plug-in component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
searchepconstruction = Honeybee_SearchEPConstruction(EPConstrList=callfromepconstrlibrary.EPConstructions, standard="2", climateZone="4", surfaceType="4")  # -> EPSelectedConstr; plug-in component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
searchepconstruction_2 = Honeybee_SearchEPConstruction(EPConstrList=callfromepconstrlibrary_2.EPConstructions, standard="2", climateZone="4", surfaceType="2")  # -> EPSelectedConstr; plug-in component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
glazingcreator = Honeybee_GlazingBasedOnRatio(HBObjects=mass2zone.HBZones, glzRatio=glzparamlist, breakUpWindow=Toggle(True), sillHeight="0.4", runIt=Toggle(True))  # -> readMe, HBObjWGLZ; plug-in component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
dup = DuplicateData(Data=panel_2, Number="365", Order=True)
setepnatvent = Honeybee_SetEPAirFlow(
    HBZones=flatten(glazingcreator.HBObjWGLZ),
    naturalVentilationType="1",
    minOutdoorTempForNatVent="20",
    maxOutdoorTempForNatVent="24")  # -> readMe, simplify(HBZones); plug-in component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
csvschedule = Honeybee_CreateCSVSchedule(values=dup, scheduleName="dormitory", writeFile=Toggle(True))  # -> readMe, csvSchedule; plug-in component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
ach2m3_s_m2_calculator = Honeybee_infORventPerAreaCalculator()  # -> readMe, infORventPerArea, allFloors; plug-in component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
decomposeepconstruction = Honeybee_DecomposeEPConstruction(cnstrName=searchepconstruction)  # -> materials, comments, UValue_SI, UValue_IP, RValue_SI, RValue_IP; plug-in component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
wires = BrepWireframe(Brep=glazingcreator.HBObjWGLZ, Density=-1)
decomposeepconstruction_2 = Honeybee_DecomposeEPConstruction(cnstrName=searchepconstruction_2)  # -> materials, comments, UValue_SI, UValue_IP, RValue_SI, RValue_IP; plug-in component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
path = FilePath("K:\Dropbox\Philadelphia_weather_files\USA_PA_Philadelphia.Intl.AP.724080_TMY3.epw")
annualdaylightsimulation = Honeybee_AnnualDaylightSimulation(
    epwWeatherFile=path,
    testPoints=genhbzonetestpts.testPoints,
    ptsVectors=genhbzonetestpts.ptsVectors,
    testMesh=genhbzonetestpts.mesh)  # -> analysisRecipe; plug-in component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
sort = SortList(Keys=decomposeepconstruction.RValue_SI, ValuesA=searchepconstruction)  # -> Keys, ValuesA
panel_3 = Panel(decomposeepconstruction.RValue_IP)
sort_2 = SortList(Keys=decomposeepconstruction_2.RValue_SI, ValuesA=searchepconstruction_2)  # -> Keys, ValuesA
panel_4 = Panel(decomposeepconstruction_2.RValue_IP)
setepzoneschedules = Honeybee_SetEnergyPlusZoneSchedules(HBZones=setepnatvent.HBZones, occupancySchedules=csvschedule.csvSchedule)  # -> schedules, simplify(HBZones); plug-in component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

setepzoneloads = Honeybee_SetEnergyPlusZoneLoads(
    HBZones=setepzoneschedules.HBZones,
    equipmentLoadPerArea="8",
    infiltrationRatePerArea="0.0001",
    lightingDensityPerArea="8",
    numOfPeoplePerArea="0.1",
    ventilationPerArea=ach2m3_s_m2_calculator.infORventPerArea)  # -> loads, HBZones; plug-in component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

item_2 = ListItem(List=sort.ValuesA, Index=Slider(1, range=0..8), Wrap=False)
item_3 = ListItem(List=sort_2.ValuesA, Index=Slider(0, range=0..8), Wrap=False)
toggle = BooleanToggle(True)
panel_5 = Panel(item_2)
panel_6 = Panel(item_3)
rundaylightanalysis = Honeybee_RunDaylightSimulation(
    HBObjects=flatten(glazingcreator.HBObjWGLZ),
    analysisRecipe=annualdaylightsimulation,
    writeRad=toggle,
    runRad=toggle,
    overwriteResults=True)  # -> readMe, analysisType, resultsUnit, results, testPts, annual_analysis_files, radGeoFile, studyFolder, done; plug-in component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
importepw = Ladybug_ImportEpw(epwFile=path)  # -> readMe, latitude, location, dryBulbTemperature, dewPointTemperature, relativeHumidity, windSpeed, windDirection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; plug-in component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
brep_2 = Brep([<brep referenced from the Rhino model> x8])
epoutput = Honeybee_GenerateEPOutput(zoneGainsAndLosses="False", zoneComfortMetrics=Toggle(True), surfaceTempAnalysis="False")  # -> report, flatten(simulationOutputs); plug-in component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
hb_epcontextsrf = HoneybeeEPContextSurfaces(shdSurfaces=flatten(brep_2))  # -> HBContext; inputs shdSurfaces: list of Brep, justBoundingBox: Boolean
# ---------- hb_epcontextsrf: Python ----------
"""
prepare shading/context geometries

    Args:
        northVectorOrRotation: A vector that shows North or a number that shows
                               the rotation of the North from the Y axis
        bldgMasses: List of closed Breps as thermal zones.
    Returns:
        report: ...
        thermalZones: Thermal zone's geometries for visualiza
"""

ghenv.Component.Name = 'Honeybee EP context Surfaces'
ghenv.Component.NickName = 'HB_EPContextSrf'
ghenv.Component.Message = 'VER 0.0.62\nJUL_28_2017'
ghenv.Component.IconDisplayMode = ghenv.Component.IconDisplayMode.application
ghenv.Component.Category = "Honeybee"
ghenv.Component.SubCategory = "10 | Energy | Energy"
#compatibleHBVersion = VER 0.0.57\nNOV_04_2016
#compatibleLBVersion = VER 0.0.59\nFEB_01_2015
ghenv.Component.AdditionalHelpFromDocStrings = "2"

import rhinoscriptsyntax as rs
import Rhino as rc
import scriptcontext as sc
import os
import System
import Grasshopper.Kernel as gh
import uuid

tolerance = sc.doc.ModelAbsoluteTolerance
import math


def main(shdSurfaces, EPTransSchedule, meshingSettings, justBoundingBox):
    
    # import the classes
    if sc.sticky.has_key('honeybee_release'):

        try:
            if not sc.sticky['honeybee_release'].isCompatible(ghenv.Component): return -1
            if sc.sticky['honeybee_release'].isInputMissing(ghenv.Component): return -1
        except:
            warning = "You need a newer version of Honeybee to use this compoent." + \
            " Use updateHoneybee component to update userObjects.\n" + \
            "If you have already updated userObjects drag Honeybee_Honeybee component " + \
            "into canvas and try again."
            w = gh.GH_RuntimeMessageLevel.Warning
            ghenv.Component.AddRuntimeMessage(w, warning)
            return -1
        
        # don't customize this part
        hb_EPSrf = sc.sticky["honeybee_EPSurface"]
        hb_EPSHDSurface = sc.sticky["honeybee_EPShdSurface"]
        hb_RADMaterialAUX = sc.sticky["honeybee_RADMaterialAUX"]
        hb_EPObjectsAux = sc.sticky["honeybee_EPObjectsAUX"]()
        HBScheduleList = sc.sticky["honeybee_ScheduleLib"].keys()

        ########################################################################
        #----------------------------------------------------------------------#
        shdBreps = []
        # create bounding box of shading geometries
        if justBoundingBox:
            for brep in shdSurfaces:
                if brep.Faces.Count>1 or not brep.Faces[0].IsPlanar(sc.doc.ModelAbsoluteTolerance):
                    shdBreps.append(brep.GetBoundingBox(True).ToBrep())
                else:
                    shdBreps.append(brep)
        else:
            shdBreps = shdSurfaces
        
        shadingClasses = []
        shadingMeshPreview = []
        
        if meshingSettings == None:
            mp = rc.Geometry.MeshingParameters.Minimal
            mp.SimplePlanes = True
        else:
            mp = meshingSettings
        
        def getRadMaterialName(radMaterial):
            nameStr = radMaterial.split(" ")[2]
            name =  nameStr.split("\n")[0]
            return name
        
        for brepCount, brep in enumerate(shdBreps):
            if brep != None:
                isPlanar = True
                # check planarity
                for face in brep.Faces:
                    if not face.IsPlanar(tolerance):
                        isPlanar = False
                        break
                
                shadingBreps = []
                if not isPlanar:
                    meshArray = rc.Geometry.Mesh.CreateFromBrep(brep, mp)
                    for mesh in meshArray:
                        for meshFace in range(mesh.Faces.Count):
                            vertices = list(mesh.Faces.GetFaceVertices(meshFace))[1:]
                            vertices = vertices + [sc.doc.ModelAbsoluteTolerance]
                            # create the brep from mesh
                            shdBrep = rc.Geometry.Brep.CreateFromCornerPoints(*vertices)
                            shadingBreps.append(shdBrep)
                else:
                    for face in brep.Faces:
                        shadingBreps.append(face.DuplicateFace(False))
                
                for faceCount, shdBrep in enumerate(shadingBreps):
                        thisShading = hb_EPSHDSurface(shdBrep, 1000*brepCount + faceCount, 'shdSrf_' + `brepCount` + '_' + `faceCount` + "_" + str(uuid.uuid4()))
                        
                        # add transmittance schedule if any
                        if EPTransSchedule!=None:
                            schedule= EPTransSchedule.upper()
                            if schedule!=None and not schedule.lower().endswith(".csv") and schedule not in HBScheduleList:
                                msg = "Cannot find " + schedule + " in Honeybee schedule library."
                                print msg
                                ghenv.Component.AddRuntimeMessage(gh.GH_RuntimeMessageLevel.Warning, msg)
                                return -1
                            elif schedule!=None and schedule.lower().endswith(".csv"):
                                # check if csv file is existed
                                if not os.path.isfile(schedule):
                                    msg = "Cannot find the shchedule file: " + schedule
                                    print msg
                                    ghenv.Component.AddRuntimeMessage(gh.GH_RuntimeMessageLevel.Warning, msg)
                                    return -1
                            
                            thisShading.TransmittanceSCH = schedule
                        
                        # add the Rad Material if any
                        if RADMaterial!=None:
                            # if it is just the name of the material make sure it is already defined
                            if len(RADMaterial.split(" ")) == 1:
                                # if the material is not in the library add it to the library
                                if not hb_RADMaterialAUX.isMatrialExistInLibrary(RADMaterial):
                                    warningMsg = "Can't find " + RADMaterial + " in RAD Material Library.\n" + \
                                                "Add the material to the library and try again."
                                    ghenv.Component.AddRuntimeMessage(gh.GH_RuntimeMessageLevel.Warning, warningMsg)
                                    return
                                
                                try:
                                    thisShading.setRADMaterial(RADMaterial)
                                except Exception, e:
                                    print e
                                    warningMsg = "You are using an old version of Honeybee_Honeybee! Update your files and try again."
                                    print warningMsg
                                    ghenv.Component.AddRuntimeMessage(gh.GH_RuntimeMessageLevel.Warning, warningMsg)
                                    return
                                
                                addedToLib = True
                            else:
                                
                                # try to add the material to the library
                                addedToLib, thisShading.RadMaterial = hb_RADMaterialAUX.analyseRadMaterials(RADMaterial, True)
                                
                            if addedToLib==False:
                                warningMsg = "Failed to add " + RADMaterial + " to the Library."
                                ghenv.Component.AddRuntimeMessage(gh.GH_RuntimeMessageLevel.Warning, warningMsg)
                                return
                        
                        # add shading to the list
                        shadingClasses.append(thisShading)
                
        # add to the hive
        hb_hive = sc.sticky["honeybee_Hive"]()
        HBContext  = hb_hive.addToHoneybeeHive(shadingClasses, ghenv.Component)
        return HBContext
        ################################################################################################
    else:
        print "You should first let Honeybee to fly..."
        w = gh.GH_RuntimeMessageLevel.Warning
        ghenv.Component.AddRuntimeMessage(w, "You should first let Honeybee to fly...")
        return -1
        

if _shdSurfaces and _shdSurfaces[0]!=None:
    # add cleaning function
    result= main(_shdSurfaces, EPTransSchedule_, meshingSettings_, justBoundingBox_)
    
    if result != -1: HBContext = result
# ---------- end hb_epcontextsrf ----------
readannualresultsi = Honeybee_ReadAnnualResultI(
    illFilesAddress=rundaylightanalysis.annual_analysis_files,
    testPoints=simplify(genhbzonetestpts.testPoints),
    ptsVectors=genhbzonetestpts.ptsVectors,
    DLAIllumThresholds=300,
    runIt=Toggle(True))  # -> DLA, UDLI_Less_100, UDLI_100_2000, UDLI_More_2000, CDA, sDA, annualProfiles, htmReport; plug-in component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
toggle_2 = BooleanToggle(True)
legendpar = Ladybug_LegendParameters(lowBound="0", highBound="100")  # -> legendPar; plug-in component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
panel_7 = Panel(readannualresultsi.UDLI_100_2000)
recolormesh = Ladybug_RecolorMesh(
    analysisResult=readannualresultsi.UDLI_100_2000,
    inputMesh=genhbzonetestpts.mesh,
    legendPar=legendpar,
    analysisTitle="UDI:100-2000lux",
    legendTitle="%")  # -> readMe, newMesh, newLegend, legendBasePt, meshColors, legendColors; plug-in component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
larger = LargerThan(FirstNumber=panel_7, SecondNumber="80")  # -> LargerThan, OrEqualTo
panel_8 = Panel(larger.OrEqualTo)
sort_3 = SortList(Keys=panel_8)  # -> Keys, ValuesA
panel_9 = Panel(sort_3.Keys)
panel_10 = Panel("20%,")
division = Division(A="57", B="72")
legendpar_2 = Ladybug_LegendParameters(lowBound="-3", highBound="3", numSegments="7")  # -> legendPar; plug-in component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
panel_11 = Panel(division)
pt = Point(<point referenced from the Rhino model>)

callfromepconstrlibrary_3 = Honeybee_CallFromEPConstructionLibrary()  # -> ThermMaterials, EPMaterials, EPWindowMaterials, EPConstructions; plug-in component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

searchepconstruction_3 = Honeybee_SearchEPConstruction(EPConstrList=callfromepconstrlibrary_3.EPConstructions, standard="2", climateZone="4", surfaceType="0")  # -> EPSelectedConstr; plug-in component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
decomposeepconstruction_3 = Honeybee_DecomposeEPConstruction(cnstrName=searchepconstruction_3)  # -> materials, comments, UValue_SI, UValue_IP, RValue_SI, RValue_IP; plug-in component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
sort_4 = SortList(Keys=decomposeepconstruction_3.RValue_SI, ValuesA=searchepconstruction_3)  # -> Keys, ValuesA
panel_12 = Panel(decomposeepconstruction_3.RValue_SI)
item_4 = ListItem(List=sort_4.ValuesA, Index=Slider(4, range=0..8), Wrap=False)
panel_13 = Panel(item_4)

setepzonecnstr = Honeybee_SetEPZoneConstruction(
    HBZones=flatten(setepzoneloads.HBZones),
    wallEPConstruction=item_4,
    windowEPConstruction=panel_5,
    floorEPConstruction=panel_6)  # -> simplify(modifiedHBZones); plug-in component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

runenergysimulation = Honeybee_RunEnergySimulation(
    epwFile=path,
    HBZones=flatten(setepzonecnstr),
    HBContext=flatten(hb_epcontextsrf),
    simulationOutputs=flatten(epoutput.simulationOutputs),
    writeIdf=toggle_2,
    runEnergyPlus=toggle_2)  # -> report, idfFileAddress, htmlReport, resultFileAddress; plug-in component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
readepresult = Honeybee_ReadEPResult(resultFileAddress=runenergysimulation.resultFileAddress)  # -> port, port_2, port_3, port_4, port_5, port_6, port_7, port_8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; plug-in component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
adaptivecomfortcalculator = Ladybug_AdaptiveComfortCalculator(
    dryBulbTemperature=readepresult.airTemperature,
    meanRadiantTemperature=readepresult.meanRadTemperature,
    prevailingOutdoorTemp=importepw.dryBulbTemperature,
    runIt=Toggle(True))  # -> readMe, port, comfortableOrNot, conditionOfPerson, degreesFromTarget, port_2, targetTemperature, upperTemperatureBound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; plug-in component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
panel_14 = Panel([adaptivecomfortcalculator.percentOfTimeComfortable, adaptivecomfortcalculator.percentHotCold])
_3dchart = Ladybug_3DChart(inputData=flatten(adaptivecomfortcalculator.conditionOfPerson), basePoint=pt, xScale="0.3")  # -> readMe, graphMesh, graphCurves, legend, legendBasePts, title, titleBasePts, dataPts, conditionalHOY; plug-in component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
